# Grasshopper definition python fot grasshopper斗拱20250407.gh (Grasshopper 1.0.8)
# plug-ins: Human, Bifocals

number_slider = Slider(21, range=0..100)
number_slider_2 = Slider(21, range=0..100)

number_slider_3 = Slider(9, range=0..17)

number_slider_4 = Slider(9, range=0..10)
number_slider_5 = Slider(9, range=0..10)
number_slider_6 = Slider(7, range=0..10)
number_slider_7 = Slider(9, range=0..10)
python_3_script = Python3Script(CaiFen=number_slider)  # -> out, LuDou_SZ_center_point, LuDou_SZ, LuDou_SZ_base_pto, LuDou_SZ_base_pt1, LuDou_SZ_base_pt2, LuDou_SZ_base_pt5, LuDou_SZ_base_pt6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
# ---------- python_3_script: Python ----------
#馒头榫,广为2.5分,厚为2.5分,深为2.5分
import rhinoscriptsyntax as rs
import Rhino.Geometry as rg
import itertools as it
x = CaiFen

#佛光寺大殿蜀柱栌斗

#栌斗.深15分,广15分
szld_pt_o = rs.AddPoint(0,0,0)
szld_pt2 = rs.AddPoint(23 * x,0,0)
#栌斗,欹,厚6分
szld_pt_z1 = rs.AddPoint(-3 * x,0, 6 * x)
szld_cr_1 = rs.AddLine(szld_pt_o,szld_pt_z1)

szld_cr_6 = rs.AddLine(szld_pt_o,szld_pt_z1)

szld_pt_z2 = rs.CurveMidPoint(szld_cr_1)
direction_left = (x, 0, 2 * x)  # 任意方向向量 
distance = 1 * x # 移动距离 
# 单位化方向向量并计算实际位移 
unit_vector_left = rs.VectorUnitize(direction_left)
displacement_left = rs.VectorScale(unit_vector_left, distance)
rs.MoveObject(szld_pt_z2, displacement_left)
szld_cr_1 = rs.AddCurve([szld_pt_o,szld_pt_z2,szld_pt_z1])
szld_pt_3 = rs.MoveObject(rs.CopyObject(szld_pt_o),(0,2 * x,0))
szld_sr1 = rs.AddLine(szld_pt_3,rs.MoveObject(rs.CopyObject(szld_pt_3),(-6.5 * x,-6.5 * x,0)))
szld_sr1 = rs.AddLoftSrf([szld_sr1,rs.MoveObject(rs.CopyObject(szld_sr1),(0,0,8.5 * x))])
szld_cr_1 =rs.ProjectCurveToSurface(szld_cr_1,szld_sr1,[0,1,0])
szld_cr_2 = rs.MoveObject(rs.CopyObject(szld_cr_1),(0,15 * x,0 ))
szld_cr_2 = rs.RotateObject(szld_cr_2, rs.CurveStartPoint(szld_cr_2),-90,[0,0,1],copy=True)
szld_cr_3 = rs.MoveObject(rs.CopyObject(szld_cr_2),(15 * x,0,0 ))
szld_cr_3 = rs.RotateObject(szld_cr_3, rs.CurveStartPoint(szld_cr_3),-90,[0,0,1],copy=True)
szld_cr_4 = rs.MoveObject(rs.CopyObject(szld_cr_1),(15 * x,0,0 ))
szld_cr_4 = rs.RotateObject(szld_cr_4, rs.CurveStartPoint(szld_cr_4),90,[0,0,1],copy=True)
szld_down_Brep = rs.AddLoftSrf([szld_cr_1,szld_cr_2,szld_cr_3,szld_cr_4],loft_type=2,closed=True)
rs.CapPlanarHoles(szld_down_Brep)
#栌斗,平,厚3分
szld_sr2 = rs.ExplodePolysurfaces(szld_down_Brep)
szld_sr2 = szld_sr2[2]
LuDou_SZ_center_point = rs.SurfaceAreaCentroid(rs.ExplodePolysurfaces(szld_down_Brep)[1])
LuDou_SZ_center_point = rs.AddPoint(LuDou_SZ_center_point[0])
szld_mid_Brep = rs.ExtrudeSurface(szld_sr2,rs.AddLine(rs.CurveEndPoint(szld_cr_2),rs.MoveObject(rs.CurveEndPoint(szld_cr_2),(0,0, 3 * x))))
#栌斗,耳,厚6分
szld_up_brep1 = rs.CopyObject(rs.CurveEndPoint(szld_cr_1))
rs.MoveObject(szld_up_brep1,(0,0,3 * x))
szld_up_brep1 = rs.AddLine(szld_up_brep1,rs.MoveObject(rs.CopyObject(szld_up_brep1),(5.5 * x,0,0)))
szld_up_brep1 = rs.ExtrudeCurve(szld_up_brep1,rs.AddLine(szld_pt_o,rs.MoveObject(rs.CopyObject(szld_pt_o),(0,5.5 * x,0))))
szld_up_brep1 = rs.ExtrudeSurface(szld_up_brep1,rs.AddLine(szld_pt_o,rs.MoveObject(rs.CopyObject(szld_pt_o),(0,0,6 * x))))
szld_up_brep2 = rs.MirrorObject(szld_up_brep1,LuDou_SZ_center_point,rs.MoveObject(rs.CopyObject(LuDou_SZ_center_point),(x,0,0)),copy=True)
szld_up_brep3 = rs.MirrorObject(szld_up_brep2,LuDou_SZ_center_point,rs.MoveObject(rs.CopyObject(LuDou_SZ_center_point),(0,x,0)),copy=True)
szld_up_brep4 = rs.MirrorObject(szld_up_brep3,LuDou_SZ_center_point,rs.MoveObject(rs.CopyObject(LuDou_SZ_center_point),(x,0,0)),copy=True)

szld_up_brep5 = rs.CopyObject(rs.CurveEndPoint(szld_cr_1))
rs.MoveObject(szld_up_brep5,(2.5 * x,5.5 * x,3 * x))
szld_up_brep5 = rs.AddLine(szld_up_brep5,rs.MoveObject(rs.CopyObject(szld_up_brep5),(0,10 * x,0)))
szld_up_brep5 = rs.ExtrudeCurve(szld_up_brep5,rs.AddLine(szld_pt_o,rs.MoveObject(rs.CopyObject(szld_pt_o),(3 * x,0,0))))
szld_up_brep5 = rs.ExtrudeSurface(szld_up_brep5,rs.AddLine(szld_pt_o,rs.MoveObject(rs.CopyObject(szld_pt_o),(0,0,3 * x))))
szld_up_brep6 = rs.MirrorObject(szld_up_brep5,LuDou_SZ_center_point,rs.MoveObject(rs.CopyObject(LuDou_SZ_center_point),(0,x,0)),copy=True)






LuDou_SZ = rs.BooleanDifference(szld_mid_Brep,szld_down_Brep,delete_input=False)
LuDou_SZ = rs.BooleanIntersection(LuDou_SZ,szld_up_brep1,delete_input=False)
LuDou_SZ = rs.BooleanIntersection(LuDou_SZ,szld_up_brep2,delete_input=False)
LuDou_SZ = rs.BooleanIntersection(LuDou_SZ,szld_up_brep3,delete_input=False)
LuDou_SZ = rs.BooleanIntersection(LuDou_SZ,szld_up_brep4,delete_input=False)
LuDou_SZ = rs.BooleanDifference(LuDou_SZ,szld_up_brep5,delete_input=False)
LuDou_SZ = rs.BooleanDifference(LuDou_SZ,szld_up_brep6,delete_input=False)

#蜀柱栌斗底座
LuDou_SZ_base_pto = rs.CopyObject(LuDou_SZ_center_point)
rs.MoveObject(LuDou_SZ_base_pto,(10.5 * x,0,6*x))
LuDou_SZ_base_pt1 = rs.CopyObject(LuDou_SZ_base_pto)
rs.MoveObject(LuDou_SZ_base_pt1,(1.3 * x,0,1.5*x))
LuDou_SZ_base_pt2 = rs.CopyObject(LuDou_SZ_base_pt1)
rs.MoveObject(LuDou_SZ_base_pt2,(1.7 * x,0,0))
LuDou_SZ_base_pt3 = rs.CopyObject(LuDou_SZ_base_pt2)
rs.MoveObject(LuDou_SZ_base_pt3,(4 * x,0,3 * x))
LuDou_SZ_base_pt4 = rs.CopyObject(LuDou_SZ_base_pt2)
rs.MoveObject(LuDou_SZ_base_pt4,(8 * x,0,0))
LuDou_SZ_base_pt5 =rs.CopyObject(LuDou_SZ_center_point)
rs.MoveObject(LuDou_SZ_base_pt5,(0,0,-6 * x))
LuDou_SZ_base_pt6 =rs.CopyObject(LuDou_SZ_base_pt5 )
rs.MoveObject(LuDou_SZ_base_pt6,(8.5 * x,0,3 * x))
LuDou_SZ_base_pt7 =rs.CopyObject(LuDou_SZ_center_point)
rs.MoveObject(LuDou_SZ_base_pt7,(7.5 * x,0,0))
LuDou_SZ_base_pt8 =rs.CopyObject(LuDou_SZ_base_pt5 )
rs.MoveObject(LuDou_SZ_base_pt8,(10.5 * x,0,x))
LuDou_SZ_base_pt9 =rs.CopyObject(LuDou_SZ_base_pt5 )
rs.MoveObject(LuDou_SZ_base_pt9,(15 * x,0,0))
LuDou_SZ_base_pt10 =rs.CopyObject(LuDou_SZ_base_pt5 )
rs.MoveObject(LuDou_SZ_base_pt10,(24 * x,0,-x))


LuDou_SZ_base_cr_1 =rs.AddCurve([LuDou_SZ_base_pto,LuDou_SZ_base_pt1,LuDou_SZ_base_pt2])
LuDou_SZ_base_cr_2 =rs.AddCurve([LuDou_SZ_base_pt2,LuDou_SZ_base_pt3,LuDou_SZ_base_pt4])
LuDou_SZ_base_cr_3 = rs.CopyObject(LuDou_SZ_base_cr_2)
rs.MoveObject(LuDou_SZ_base_cr_3,(8 * x,0,0))
rs.RotateObject(LuDou_SZ_base_cr_3,LuDou_SZ_base_pt4,45,[0,x,0])
LuDou_SZ_base_cr_4 = rs.RotateObject(LuDou_SZ_base_cr_3,rs.CurveEndPoint(LuDou_SZ_base_cr_3),150,[0,x,0],copy = True)
rs.ScaleObject(LuDou_SZ_base_cr_4,rs.CurveEndPoint(LuDou_SZ_base_cr_4),[1.1,1,1])
LuDou_SZ_base_cr_5 = rs.CopyObject(LuDou_SZ_base_cr_4)
rs.RotateObject(LuDou_SZ_base_cr_5,rs.CurveStartPoint(LuDou_SZ_base_cr_5),-40,[0,x,0])
LuDou_SZ_base_cr_6 =rs.AddCurve([LuDou_SZ_base_pt7,LuDou_SZ_base_pt6,LuDou_SZ_base_pt8,LuDou_SZ_base_pt9])
LuDou_SZ_base_cr_7 =rs.AddCurve([LuDou_SZ_base_pt9,LuDou_SZ_base_pt10,rs.CurveEndPoint(LuDou_SZ_base_cr_5 )])

LuDou_SZ_base_cr = rs.JoinCurves([LuDou_SZ_base_cr_1,LuDou_SZ_base_cr_2,LuDou_SZ_base_cr_3,LuDou_SZ_base_cr_4,LuDou_SZ_base_cr_5,LuDou_SZ_base_cr_6,LuDou_SZ_base_cr_7])
LuDou_SZ_base_cr = rs.JoinCurves([LuDou_SZ_base_cr,rs.AddLine(rs.CurveStartPoint(LuDou_SZ_base_cr),rs.CurveEndPoint(LuDou_SZ_base_cr))])
LuDou_SZ_base_brep1 = rs.AddPlanarSrf(LuDou_SZ_base_cr)
LuDou_SZ_base_brep1 = rs.ExtrudeSurface(LuDou_SZ_base_brep1,rs.AddLine(rs.AddPoint(0,0,0),rs.AddPoint(0,10 * x,0)))
rs.MoveObject(LuDou_SZ_base_brep1,(0,-5 *x,0))
LuDou_SZ_base_brep2 = rs.AddPolyline([LuDou_SZ_center_point,LuDou_SZ_base_pto,LuDou_SZ_base_pt9,LuDou_SZ_base_pt5])
LuDou_SZ_base_brep2 = rs.JoinCurves([LuDou_SZ_base_brep2,rs.AddLine(rs.CurveStartPoint(LuDou_SZ_base_brep2),rs.CurveEndPoint(LuDou_SZ_base_brep2))])
LuDou_SZ_base_brep2 = rs.AddPlanarSrf(LuDou_SZ_base_brep2 )
LuDou_SZ_base_brep2 = rs.ExtrudeSurface(LuDou_SZ_base_brep2 ,rs.AddLine(rs.AddPoint(0,0,0),rs.AddPoint(0,10 * x,0)))
rs.MoveObject(LuDou_SZ_base_brep2 ,(0,-5 *x,0))

LuDou_SZ_base_brep = rs.BooleanDifference(LuDou_SZ_base_brep1,LuDou_SZ_base_brep2,delete_input=False)
LuDou_SZ_base_brep = rs.BooleanDifference(LuDou_SZ,LuDou_SZ_base_brep,delete_input=False)
LuDou_SZ_base_brep_2 = rs.MirrorObject(LuDou_SZ_base_brep,LuDou_SZ_center_point,rs.MoveObject(rs.CopyObject(LuDou_SZ_center_point),(0,x,0)),copy=True)
LuDou_SZ_base_brep = rs.BooleanUnion([LuDou_SZ_base_brep,LuDou_SZ_base_brep_2],delete_input=False)
# ---------- end python_3_script ----------
python_3_script_2 = Python3Script(CaiFen=number_slider)  # -> out, ShanDou_target_point, SanDou, sd_cr_2
# ---------- python_3_script_2: Python ----------
#馒头榫,广为2.5分,厚为2.5分,深为2.5分
import rhinoscriptsyntax as rs
import Rhino.Geometry as rg
import itertools as it
x = CaiFen

#佛光寺大殿散斗 第二抄昂上

x = CaiFen
#散斗.深12分,广10分,泥道栱
sd_ndg_pt_o = rs.AddPoint(0,0,0)
sd_ndg_pt2 = rs.AddPoint(10 * x,0,0)
sd_ndg_pt_z1 = rs.AddPoint(- 2 * x,0, 4 * x)
sd_ndg_cr_1 = rs.AddLine(sd_ndg_pt_o,sd_ndg_pt_z1)
#散斗,欹
sd_ndg_pt_z2 = rs.CurveMidPoint(sd_ndg_cr_1)
direction_left = (x, 0, 2 * x)  # 任意方向向量 
distance = 0.5 * x # 移动距离 
# 单位化方向向量并计算实际位移 
unit_vector_left = rs.VectorUnitize(direction_left)
displacement_left = rs.VectorScale(unit_vector_left, distance)
rs.MoveObject(sd_ndg_pt_z2, displacement_left)
sd_ndg_cr_1 = rs.AddCurve([sd_ndg_pt_o,sd_ndg_pt_z2,sd_ndg_pt_z1])
sd_ndg_pt_3 = rs.MoveObject(rs.CopyObject(sd_ndg_pt_o),(0,2 * x,0))
sd_ndg_sr1 = rs.AddLine(sd_ndg_pt_3,rs.MoveObject(rs.CopyObject(sd_ndg_pt_3),(-2 * x,-2 * x,0)))
sd_ndg_sr1 = rs.AddLoftSrf([sd_ndg_sr1,rs.MoveObject(rs.CopyObject(sd_ndg_sr1),(0,0,4 * x))])
sd_ndg_cr_1 =rs.ProjectCurveToSurface(sd_ndg_cr_1,sd_ndg_sr1,[0,1,0])
sd_ndg_cr_2 = rs.MoveObject(rs.CopyObject(sd_ndg_cr_1),(0,12 * x,0 ))
sd_ndg_cr_2 = rs.RotateObject(sd_ndg_cr_2, rs.CurveStartPoint(sd_ndg_cr_2),-90,[0,0,1],copy=True)
sd_ndg_cr_3 = rs.MoveObject(rs.CopyObject(sd_ndg_cr_2),(10 * x,0,0 ))
sd_ndg_cr_3 = rs.RotateObject(sd_ndg_cr_3, rs.CurveStartPoint(sd_ndg_cr_3),-90,[0,0,1],copy=True)
sd_ndg_cr_4 = rs.MoveObject(rs.CopyObject(sd_ndg_cr_1),(10 * x,0,0 ))
sd_ndg_cr_4 = rs.RotateObject(sd_ndg_cr_4, rs.CurveStartPoint(sd_ndg_cr_4),90,[0,0,1],copy=True)
sd_ndg_down_Brep = rs.AddLoftSrf([sd_ndg_cr_1,sd_ndg_cr_2,sd_ndg_cr_3,sd_ndg_cr_4],loft_type=2,closed=True)
rs.CapPlanarHoles(sd_ndg_down_Brep)
#散斗,平
sd_ndg_sr2 = rs.ExplodePolysurfaces(sd_ndg_down_Brep)
sd_ndg_sr2 = sd_ndg_sr2[2]
sd_ndg_mid_Brep = rs.ExtrudeSurface(sd_ndg_sr2,rs.AddLine(rs.CurveEndPoint(sd_ndg_cr_2),rs.MoveObject(rs.CurveEndPoint(sd_ndg_cr_2),(0,0,2 * x))))
sd_ndg_sr3_curve= rs.DuplicateEdgeCurves(sd_ndg_mid_Brep)[9]
sd_ndg_sr3 = rs.AddLoftSrf([sd_ndg_sr3_curve,rs.MoveObject(rs.CopyObject(sd_ndg_sr3_curve),(0,-2 * x,0))])
sd_ndg_source_point = rs.SurfaceAreaCentroid(rs.ExplodePolysurfaces(sd_ndg_down_Brep)[1])[0]
sd_ndg_up_brep1 = rs.ExtrudeSurface(sd_ndg_sr3,rs.AddLine(sd_ndg_pt_o,rs.MoveObject(rs.CopyObject(sd_ndg_pt_o),(0,0,4 * x))))
sd_ndg_up_brep2 =rs.MirrorObject(sd_ndg_up_brep1,sd_ndg_source_point,rs.MoveObject(rs.CopyObject(sd_ndg_source_point),(x,0,0)),copy=True)



SanDou = rs.BooleanDifference(sd_ndg_mid_Brep,sd_ndg_down_Brep,delete_input=False)
SanDou = rs.BooleanDifference(SanDou,sd_ndg_up_brep1,delete_input=False)
SanDou = rs.BooleanDifference(SanDou,sd_ndg_up_brep2,delete_input=False)
# ---------- end python_3_script_2 ----------
python_3_script_3 = Python3Script(CaiFen=number_slider)  # -> out, ShanDou_target_point, sd_ang_down, sd_ang_mid, sd_ang_up1, sd_ang_up2, sd_ang, sd_ang_mid_2, sd_ang_up1_2
# ---------- python_3_script_3: Python ----------
#馒头榫,广为2.5分,厚为2.5分,深为2.5分
import rhinoscriptsyntax as rs
import Rhino.Geometry as rg
import itertools as it


x = CaiFen


#佛光寺东大殿散斗,昂上

x = CaiFen
#散斗,深12分,广10分,华拱/散斗.深10分,广12分,泥道栱
sd_ang_pt_o = rs.AddPoint(0,0,0)
sd_ang_pt2 = rs.AddPoint(12 * x,0,0)
sd_ang_pt_z1 = rs.AddPoint(- 2 * x,0, 4 * x)
sd_ang_cr_1 = rs.AddLine(sd_ang_pt_o,sd_ang_pt_z1)
#散斗,欹
sd_ang_pt_z2 = rs.CurveMidPoint(sd_ang_cr_1)
direction_left = (x, 0, 2 * x)  # 任意方向向量 
distance = 0.5 * x # 移动距离 
# 单位化方向向量并计算实际位移 
unit_vector_left = rs.VectorUnitize(direction_left)
displacement_left = rs.VectorScale(unit_vector_left, distance)
rs.MoveObject(sd_ang_pt_z2, displacement_left)
sd_ang_cr_1 = rs.AddCurve([sd_ang_pt_o,sd_ang_pt_z2,sd_ang_pt_z1])
sd_ang_pt_3 = rs.MoveObject(rs.CopyObject(sd_ang_pt_o),(0,2 * x,0))
sd_ang_sr1 = rs.AddLine(sd_ang_pt_3,rs.MoveObject(rs.CopyObject(sd_ang_pt_3),(-2 * x,-2 * x,0)))
sd_ang_sr1 = rs.AddLoftSrf([sd_ang_sr1,rs.MoveObject(rs.CopyObject(sd_ang_sr1),(0,0,4* x))])
sd_ang_cr_1 =rs.ProjectCurveToSurface(sd_ang_cr_1,sd_ang_sr1,[0,1,0])

sd_ang_cr_2 = rs.CopyObject(sd_ang_cr_1)
rs.MoveObject(sd_ang_cr_2,(12 * x,0,0))
rs.RotateObject(sd_ang_cr_2,rs.CurveStartPoint(sd_ang_cr_2),90,[0,0,x])
sd_ang_cr_3 = rs.AddLine(rs.CurveStartPoint(sd_ang_cr_1),rs.CurveStartPoint(sd_ang_cr_2))
sd_ang_cr_2_1 = rs.JoinCurves([sd_ang_cr_3,sd_ang_cr_2])
rs.RotateObject(sd_ang_cr_2_1,rs.CurveStartPoint(sd_ang_cr_1),24.5,[0,x,0])
sd_ang_cr_2 = rs.ExplodeCurves(sd_ang_cr_2_1)[1]

rs.RotateObject(sd_ang_cr_2,rs.CurveStartPoint(sd_ang_cr_2),24.5                 ,[0,x,0])

sd_ang_cr_3 = rs.CopyObject(sd_ang_cr_1)
rs.MoveObject(sd_ang_cr_3,(0,10 * x,0))
rs.RotateObject(sd_ang_cr_3,rs.CurveStartPoint(sd_ang_cr_3),-90,[0,0,x])
sd_ang_cr_4 = rs.CopyObject(sd_ang_cr_3)
rs.MoveObject(sd_ang_cr_4,(12 * x,0,0))
rs.RotateObject(sd_ang_cr_4,rs.CurveStartPoint(sd_ang_cr_4),-90,[0,0,x])



sd_ang_cr_5 = rs.AddLine(rs.CurveStartPoint(sd_ang_cr_3),rs.CurveStartPoint(sd_ang_cr_4))
sd_ang_cr_4_1 = rs.JoinCurves([sd_ang_cr_5,sd_ang_cr_4])
rs.RotateObject(sd_ang_cr_4_1,rs.CurveStartPoint(sd_ang_cr_3),24.5,[0,x,0])
sd_ang_cr_4 = rs.ExplodeCurves(sd_ang_cr_4_1)[1]

rs.RotateObject(sd_ang_cr_4,rs.CurveStartPoint(sd_ang_cr_2),24.5                 ,[0,x,0])

sd_ang_cr_5 = rs.AddLine(rs.CurveEndPoint(sd_ang_cr_2),rs.CurveEndPoint(sd_ang_cr_4))
sd_ang_cr_6 =rs.AddLine(rs.CurveEndPoint(sd_ang_cr_1),rs.CurveEndPoint(sd_ang_cr_3))
sd_ang_cr_7 = rs.AddLine(rs.CurveStartPoint(sd_ang_cr_2),rs.CurveStartPoint(sd_ang_cr_4))
sd_ang_cr_8 =rs.AddLine(rs.CurveStartPoint(sd_ang_cr_1),rs.CurveStartPoint(sd_ang_cr_3))
sd_ang_down = rs.AddLoftSrf([sd_ang_cr_1,sd_ang_cr_2,sd_ang_cr_4,sd_ang_cr_3],loft_type=2,closed=True)

sd_ang_down_sr1 =rs.AddLoftSrf([sd_ang_cr_5,sd_ang_cr_6])
sd_ang_down_sr2 =rs.AddLoftSrf([sd_ang_cr_7,sd_ang_cr_8])

sd_ang_down =rs.JoinSurfaces([sd_ang_down,sd_ang_down_sr1,sd_ang_down_sr2])

#散斗,平
sd_ang_mid = rs.ExtrudeSurface(sd_ang_down_sr1,rs.AddLine(rs.AddPoint(0,0,0),rs.AddPoint(0,0,2 * x)))

#散斗,耳
sd_ang_up1 = rs.AddLine(rs.CurveEndPoint(sd_ang_cr_1),rs.CurveEndPoint(sd_ang_cr_2))
rs.MoveObject(sd_ang_up1,(0,0,2 * x))
sd_ang_up1 = rs.AddLoftSrf([sd_ang_up1,rs.MoveObject(rs.CopyObject(sd_ang_up1),(0,3 * x,0))])
sd_ang_up1 = rs.ExtrudeSurface(sd_ang_up1,rs.AddLine(rs.AddPoint(0,0,0),rs.AddPoint(0,0,4 * x)))

sd_ang_up2 = rs.CopyObject(sd_ang_up1)
rs.MoveObject(sd_ang_up2,(0,11 * x,0))

sd_ang = rs.BooleanUnion([sd_ang_mid,sd_ang_down,sd_ang_up1,sd_ang_up2], delete_input=False)
# ---------- end python_3_script_3 ----------
number_slider_8 = Slider(35, range=0..100)
python_3_script_4 = Python3Script(CaiFen=number_slider)  # -> out, ShanDou_target_point, SanDou, a
# ---------- python_3_script_4: Python ----------
#佛光寺大殿散斗
import rhinoscriptsyntax as rs
import Rhino.Geometry as rg
import itertools as it
import math
x = CaiFen
#散斗,深12分,广10分,华拱/散斗.深10分,广12分,泥道栱
sd_pt_o = rs.AddPoint(0,0,0)
sd_pt2 = rs.AddPoint(12 * x,0,0)
sd_pt_z1 = rs.AddPoint(- 2 * x,0, 4 * x)
sd_cr_1 = rs.AddLine(sd_pt_o,sd_pt_z1)
#散斗,欹
sd_pt_z2 = rs.CurveMidPoint(sd_cr_1)
direction_left = (x, 0, 2 * x)  # 任意方向向量 
distance = 0.5 * x # 移动距离 
# 单位化方向向量并计算实际位移 
unit_vector_left = rs.VectorUnitize(direction_left)
displacement_left = rs.VectorScale(unit_vector_left, distance)
rs.MoveObject(sd_pt_z2, displacement_left)
sd_cr_1 = rs.AddCurve([sd_pt_o,sd_pt_z2,sd_pt_z1])
sd_pt_3 = rs.MoveObject(rs.CopyObject(sd_pt_o),(0,2 * x,0))
sd_sr1 = rs.AddLine(sd_pt_3,rs.MoveObject(rs.CopyObject(sd_pt_3),(-2 * x,-2 * x,0)))
sd_sr1 = rs.AddLoftSrf([sd_sr1,rs.MoveObject(rs.CopyObject(sd_sr1),(0,0,4 * x))])
sd_cr_1 =rs.ProjectCurveToSurface(sd_cr_1,sd_sr1,[0,1,0])
sd_cr_2 = rs.MoveObject(rs.CopyObject(sd_cr_1),(0,10 * x,0 ))
sd_cr_2 = rs.RotateObject(sd_cr_2, rs.CurveStartPoint(sd_cr_2),-90,[0,0,1],copy=False)
sd_cr_3 = rs.MirrorObject(sd_cr_2,(6 * x ,0,0),(6 * x,x,0),copy=True)
sd_cr_4 = rs.MirrorObject(sd_cr_1,(6 * x ,0,0),(6 * x,x,0),copy=True)
sd_down_Brep = rs.AddLoftSrf([sd_cr_1,sd_cr_2,sd_cr_3,sd_cr_4],loft_type=2,closed=True)
rs.CapPlanarHoles(sd_down_Brep)
#散斗,平
sd_sr2 = rs.ExplodePolysurfaces(sd_down_Brep)
sd_sr2 = sd_sr2[-1]
sd_mid_Brep = rs.ExtrudeSurface(sd_sr2,rs.AddLine(rs.CurveEndPoint(sd_cr_2),rs.MoveObject(rs.CurveEndPoint(sd_cr_2),(0,0,2 * x))))
sd_sr3_curve= rs.DuplicateEdgeCurves(sd_mid_Brep)[9]
sd_sr3 = rs.AddLoftSrf([sd_sr3_curve,rs.MoveObject(rs.CopyObject(sd_sr3_curve),(0,-3 * x,0))])
sd_source_point = rs.SurfaceAreaCentroid(rs.ExplodePolysurfaces(sd_down_Brep)[1])[0]
sd_up_brep1 = rs.ExtrudeSurface(sd_sr3,rs.AddLine(sd_pt_o,rs.MoveObject(rs.CopyObject(sd_pt_o),(0,0,4 * x))))
sd_up_brep2 =rs.MirrorObject(sd_up_brep1,sd_source_point,rs.MoveObject(rs.CopyObject(sd_source_point),(x,0,0)),copy=True)

#馒头榫,广为2.5分,厚为2.5分,深为2.5分
mts_base_point = rs.AddPoint(0,0,0)
mts_pt_1 = rs.AddPoint(2.5 * x,0,0)
mts_cr_1 = rs.AddLine(mts_base_point,mts_pt_1)
mts_cr_2 = rs.CopyObject(mts_cr_1)
rs.MoveObject(mts_cr_2,(0,2.5 * x,0))
mts_sr = rs.AddLoftSrf([mts_cr_1,mts_cr_2])
mts = rs.ExtrudeSurface(mts_sr,rs.AddLine(mts_base_point,rs.MoveObject(rs.CopyObject(mts_base_point),(0,0,2.5 * x))))
mts_source = [2.5/2 *x,2.5/2 * x,0]
source_x = [2.5/2 * x + 1,2.5/2 * x,0]            # X 轴方向点
source_y = [2.5/2 * x,2.5/2 * x + 1,0] 
source = [mts_source, source_x, source_y]           # Y 轴方向点

#馒头榫投射点 
mts_project_sd = [6 * x,7 * x,0]
target_x_sd= [6 * x + 1,7 * x,0]            # 新 X 轴方向点（向右）
target_y_sd = [6 * x,7 * x + 1,0]            # 新 Y 轴方向点（向上）
target_sd = [mts_project_sd, target_x_sd, target_y_sd]
#馒头榫投射 
mts_sd = rs.OrientObject(rs.CopyObject(mts), source, target_sd)

SanDou = rs.BooleanDifference(sd_mid_Brep,sd_down_Brep,delete_input=True)
SanDou = rs.BooleanDifference(SanDou,sd_up_brep1,delete_input=True)
SanDou = rs.BooleanDifference(SanDou,sd_up_brep2,delete_input=True)
SanDou = rs.BooleanUnion([SanDou,mts_sd],delete_input=False)
# ---------- end python_3_script_4 ----------
number_slider_9 = Slider(9, range=0..10)
number_slider_10 = Slider(10, range=0..10)
number_slider_11 = Slider(32, range=0..100)
curve = Curve()
brep = Brep(python_3_script_3.sd_ang)
surface = Surface()
panel = Panel(python_3_script_4.ShanDou_target_point)
list_item = ListItem(List=python_3_script_3.sd_ang_up1_2, Index=Slider(3, range=0..10), Wrap=True)
number_slider_12 = Slider(240, range=0..1000)
number_slider_13 = Slider(32, range=0..100)
number_slider_14 = Slider(31.5, range=0..100)
list_item_2 = ListItem(Index=Slider(9, range=0..100), Wrap=True)
number_slider_15 = Slider(0, range=0..10)
number_slider_16 = Slider(32, range=0..100)
number_slider_17 = Slider(32, range=0..100)
number_slider_18 = Slider(2, range=0..10)
number_slider_19 = Slider(32, range=0..100)
number_slider_20 = Slider(31.5, range=0..100)

# ----
# 瓦片先不做了
# 瓦片
斗拱编辑器 = Python3Script(
    CaiFen=number_slider_2,
    HuaGong_CaiFen_left=number_slider_13,
    HuaGong_CaiFen_right=number_slider_11,
    NiDaoGong_CaiFen_left=number_slider_14,
    NiDaoGong_CaiFen_right=number_slider_14,
    MianKuo=Slider(7, range=0..100))  # -> sq_curve4, wp_point1, wp_miankuo2_rotate_point, wp_down1, wp_down2, wp_up1, wp_up2, wp_up3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; inputs CaiFen: Int32; disabled
# ---------- 斗拱编辑器: Python ----------
#佛光寺东大殿柱基
#每一跳为21分
import rhinoscriptsyntax as rs
import Rhino.Geometry as rg
import itertools as it
import math
#材分可调变量x
x = CaiFen
#柱头点
ZhuTou_point = rs.AddPoint(HuaGong_CaiFen_left * x,5 *x,0)
#原点
BasePoint = 0
pt_o = rs.AddPoint(BasePoint * 500,0,0)
#进深为14倍材广,一材广为15材分(j的单位为分)
j = 14 * 15
MianKuo_length = 16 * 15

#   面扩七开间，五进深,明间为16倍材广为240分，除了尽间，面阔皆为240分，尽间面扩为210分。进深开间 = 尽间开间也为210分
if (MianKuo % 2 == 0) | (MianKuo < 5):
    raise ValueError(f"开间最小数不能低于5,且为单数")

zhu_pt1 = rs.CopyObject(ZhuTou_point)
rs.MoveObject(zhu_pt1,(0,j * x,0))
zhu_pt2 = rs.CopyObject(zhu_pt1,(0,MianKuo_length * (MianKuo - 2) * x,0))
zhu_cr = rs.AddLine(zhu_pt1,zhu_pt2)
zhutou_pt = rs.DivideCurve(zhu_cr,MianKuo-2)
zhu_pt3 = rs.CopyObject(ZhuTou_point)
zhu_pt4 =rs.MoveObject(rs.CopyObject(zhutou_pt[-1]),(0, j * x,0))
zhutou_pt.insert(0,zhu_pt3)
zhutou_pt.append(zhu_pt4)
zhutou_pt2 = rs.MoveObjects(rs.CopyObjects(zhutou_pt),(j * x,0,0))

zhutou_pt3 = rs.MoveObjects(rs.CopyObjects(zhutou_pt2[0:2] ),(j * x,0,0))

zhutou_pt3_1 = rs.MoveObjects(rs.CopyObjects(zhutou_pt2[len(zhutou_pt2)-2:len(zhutou_pt2)] ),(j * x,0,0))

zhutou_pt3 = zhutou_pt3 + zhutou_pt3_1

zhutou_pt4 = rs.MoveObjects(rs.CopyObjects(zhutou_pt2),(2 * j * x,0,0))

zhutou_pt5 = rs.MoveObjects(rs.CopyObjects(zhutou_pt2),(3 * j * x,0,0))


#柱高
#当心间的柱高为237.5分

#生起的规律

zhutou_pt_up =rs.CopyObjects(zhutou_pt)
rs.MoveObjects(zhutou_pt_up,(0,0,237.5 * x))

zhutou_pt_up2 =rs.CopyObjects(zhutou_pt2)
rs.MoveObjects(zhutou_pt_up2,(0,0,237.5 * x))

zhutou_pt_up3 =rs.CopyObjects(zhutou_pt3)
rs.MoveObjects(zhutou_pt_up3,(0,0,237.5 * x))

if MianKuo > 5:
    #前檐
    rs.MoveObjects([zhutou_pt_up[0],zhutou_pt_up[-1]],(0,0,10.5 * x))
    rs.MoveObjects([zhutou_pt_up[1],zhutou_pt_up[-2]],(0,0,6 * x))
    rs.MoveObjects([zhutou_pt_up[2],zhutou_pt_up[-3]],(0,0,2.5 * x))
    #内檐
    rs.MoveObjects([zhutou_pt_up2[0],zhutou_pt_up2[-1]],(0,0,7.5 * x))
    rs.MoveObjects([zhutou_pt_up2[1],zhutou_pt_up2[-2]],(0,0,5 * x))
    rs.MoveObjects([zhutou_pt_up2[2],zhutou_pt_up2[-3]],(0,0,2.5 * x))
    #中柱
    rs.MoveObjects([zhutou_pt_up3[1],zhutou_pt_up3[-2]],(0,0, 2.5* x))
 
else: 
    #前檐
    rs.MoveObjects([zhutou_pt_up[0],zhutou_pt_up[-1]],(0,0,6 * x))
    rs.MoveObjects([zhutou_pt_up[1],zhutou_pt_up[-2]],(0,0,2.5 * x))
    #内檐
    rs.MoveObjects([zhutou_pt_up2[0],zhutou_pt_up2[-1]],(0,0,5 * x))
    rs.MoveObjects([zhutou_pt_up2[1],zhutou_pt_up2[-2]],(0,0,2.5 * x))



zhutou_pt_up4 = rs.CopyObjects(zhutou_pt_up2,(2 * j * x,0,0))
zhutou_pt_up5 = rs.CopyObjects(zhutou_pt_up,(4 * j * x,0,0))







#檩条生成

# 生起曲线

lt_breps = []
lt_trimed2 = rs.CopyObjects(zhutou_pt_up[0:len(zhutou_pt_up)-1])
rs.MoveObjects(lt_trimed2,(0,0,0))
lt_trimed1 = rs.CopyObjects(zhutou_pt_up[1:len(zhutou_pt_up)])
rs.MoveObjects(lt_trimed1,(0,0,0))
sq_cr = rs.AddInterpCurve(zhutou_pt_up)
sq_sr = rs.ExtrudeCurve(sq_cr,rs.AddLine(rs.AddPoint(0,0,0),rs.AddPoint(5 * x,0,0)))

sq_curves = []
lt_breps = []
for i in range(len(lt_trimed1)):
    cr1 = rs.AddLine(lt_trimed1[i],lt_trimed2[i])
    rs.MoveObject(cr1,(5 * x,0,21 * x))
    cr1 = rs.ProjectCurveToSurface(cr1,sq_sr,[0,0,x])
    sq_curves.append(cr1[0])
sq_curves = sq_curves[::-1]

sq_curve_1 = rs.CurveEndPoint(sq_curves[0])
sq_curve_1 = rs.AddLine(sq_curve_1,rs.MoveObject(rs.CopyObject(sq_curve_1),(0,195 * x,0)))

sq_curves[0] = rs.JoinCurves([sq_curves[0],sq_curve_1])[0]
sq_curves[-1] = rs.MirrorObjects(sq_curves[0],rs.MoveObject(rs.CopyObject(ZhuTou_point),(0,(MianKuo_length * (MianKuo - 2) * x + 2 * j * x)/2 ,0)),rs.MoveObject(rs.CopyObject(ZhuTou_point),(x,(MianKuo_length * (MianKuo - 2) * x + 2 * j * x)/2 ,0)),copy=True)[0]

sq_curve_or = sq_curves
rs.MoveObjects(sq_curve_or,(-5 * x,0,-237.5 * x))
rs.MoveObjects(sq_curve_or,(0,0,-7.5 * x))
sq_curve1 = rs.MoveObjects(rs.CopyObjects(sq_curve_or),(-89 * x,0,375 * x))

sq_curve2 = rs.MoveObjects(rs.CopyObjects(sq_curve_or),(j/2 * x,0,426.5 * x))

sq_curve3 = rs.CopyObjects(sq_curve2)
sq_curve4 = rs.MoveObjects(rs.CopyObjects(sq_curve_or),(j/2 * x + 105 * x,0,466.5 * x))

sq_curve5 = rs.CopyObjects(sq_curve4)
sq_curve6 = rs.MoveObjects(rs.CopyObjects(sq_curve_or),(j/2 * x + 210 * x,0,521.5 * x))

sq_curve7 = rs.CopyObjects(sq_curve6)
sq_curve8 = rs.MoveObjects(rs.CopyObjects(sq_curve_or),(j/2 * x + 315 * x,0,583.5 * x))

chuan5_trimed = rs.JoinCurves(sq_curve8)
chuan5_trimed = rs.ExtrudeCurve(chuan5_trimed,rs.AddLine(rs.AddPoint(0,0,0),rs.AddPoint(0,0,42 * x)))
chuan5_trimed = rs.ExtrudeSurface(chuan5_trimed,rs.AddLine(rs.AddPoint(0,0,0),rs.AddPoint(42 * x,0,0)))

rs.MoveObjects(sq_curve1,(-((7.5)/3.46)* x,0,((7.5)/1.00)*x))
rs.MoveObjects(sq_curve2,(-((7.5)/3.46)* x,0,((7.5)/1.00)*x))
sq_curve1 = sq_curve1[::-1]
sq_curve2 = sq_curve2[::-1]
sq_curve3 = sq_curve3[::-1]
sq_curve4 = sq_curve4[::-1]
sq_curve5 = sq_curve5[::-1]
sq_curve6 = sq_curve6[::-1]
sq_curve7 = sq_curve7[::-1]
sq_curve8 = sq_curve8[::-1]

#瓦片生成

rs.MoveObject(sq_curve1,((-58.8 + 1.94*3) * x,0,(-17.55 + 0.58*3) * x))

wp_curve1 = rs.JoinCurves(sq_curve1)

wp_curve1_1 = rs.CopyObject(wp_curve1 )








wp_point1 = rs.DivideCurve(wp_curve1 ,MianKuo * 29)
wp_point1_1 =rs.DivideCurve(wp_curve1_1 ,MianKuo * 29)
for i in range(40):
    rs.MoveObject(wp_point1[39-i],(-math.sin(i/32) * 25* x,0,math.sin(i/32) * -6* x) )
    wp_point1[len(wp_point1)-(40-i)] = rs.MirrorObject(wp_point1[39-i],rs.MoveObject(rs.CopyObject(ZhuTou_point),(0,(MianKuo_length * (MianKuo - 2) * x + 2 * j * x)/2 ,0)),rs.MoveObject(rs.CopyObject(ZhuTou_point),(x,(MianKuo_length * (MianKuo - 2) * x + 2 * j * x)/2 ,0)),copy=True)


for i in range(34):
    rs.MoveObject(wp_point1[33-i],(-math.sin(i/32) * 15* x,0,math.sin(i/32) * 3.5* x) )
    wp_point1[len(wp_point1)-(34-i)] = rs.MirrorObject(wp_point1[33-i],rs.MoveObject(rs.CopyObject(ZhuTou_point),(0,(MianKuo_length * (MianKuo - 2) * x + 2 * j * x)/2 ,0)),rs.MoveObject(rs.CopyObject(ZhuTou_point),(x,(MianKuo_length * (MianKuo - 2) * x + 2 * j * x)/2 ,0)),copy=True)

for i in range(24):
    rs.MoveObject(wp_point1[23-i],(-math.sin(i/32) * 0* x,0,math.sin(i/32) * 16* x) )
    wp_point1[len(wp_point1)-(24-i)] = rs.MirrorObject(wp_point1[23-i],rs.MoveObject(rs.CopyObject(ZhuTou_point),(0,(MianKuo_length * (MianKuo - 2) * x + 2 * j * x)/2 ,0)),rs.MoveObject(rs.CopyObject(ZhuTou_point),(x,(MianKuo_length * (MianKuo - 2) * x + 2 * j * x)/2 ,0)),copy=True)
for i in range(19):
    rs.MoveObject(wp_point1[18-i],(-math.sin(i/32) *0* x,0,math.sin(i/32) * 14* x) )
    wp_point1[len(wp_point1)-(19-i)] = rs.MirrorObject(wp_point1[18-i],rs.MoveObject(rs.CopyObject(ZhuTou_point),(0,(MianKuo_length * (MianKuo - 2) * x + 2 * j * x)/2 ,0)),rs.MoveObject(rs.CopyObject(ZhuTou_point),(x,(MianKuo_length * (MianKuo - 2) * x + 2 * j * x)/2 ,0)),copy=True)
for i in range(18):
    rs.MoveObject(wp_point1[17-i],(-math.sin(i/32) *0* x,0,math.sin(i/32) * -3* x) )
    wp_point1[len(wp_point1)-(18-i)] = rs.MirrorObject(wp_point1[17-i],rs.MoveObject(rs.CopyObject(ZhuTou_point),(0,(MianKuo_length * (MianKuo - 2) * x + 2 * j * x)/2 ,0)),rs.MoveObject(rs.CopyObject(ZhuTou_point),(x,(MianKuo_length * (MianKuo - 2) * x + 2 * j * x)/2 ,0)),copy=True)

for i in range(11):
    rs.MoveObject(wp_point1[10-i],(-math.sin(i/32) *0* x,0,math.sin(i/32) * 20* x) )
    wp_point1[len(wp_point1)-(11-i)] = rs.MirrorObject(wp_point1[10-i],rs.MoveObject(rs.CopyObject(ZhuTou_point),(0,(MianKuo_length * (MianKuo - 2) * x + 2 * j * x)/2 ,0)),rs.MoveObject(rs.CopyObject(ZhuTou_point),(x,(MianKuo_length * (MianKuo - 2) * x + 2 * j * x)/2 ,0)),copy=True)

for i in range(6):
    rs.MoveObject(wp_point1[5-i],(-math.sin(i/32) * 20* x,0,math.sin(i/32) * 75* x) )
    wp_point1[len(wp_point1)-(6-i)] = rs.MirrorObject(wp_point1[5-i],rs.MoveObject(rs.CopyObject(ZhuTou_point),(0,(MianKuo_length * (MianKuo - 2) * x + 2 * j * x)/2 ,0)),rs.MoveObject(rs.CopyObject(ZhuTou_point),(x,(MianKuo_length * (MianKuo - 2) * x + 2 * j * x)/2 ,0)),copy=True)

rs.MoveObject(wp_point1[2],(0,0,-2 * x))
wp_point1[len(wp_point1)-(3)] = rs.MirrorObject(wp_point1[2],rs.MoveObject(rs.CopyObject(ZhuTou_point),(0,(MianKuo_length * (MianKuo - 2) * x + 2 * j * x)/2 ,0)),rs.MoveObject(rs.CopyObject(ZhuTou_point),(x,(MianKuo_length * (MianKuo - 2) * x + 2 * j * x)/2 ,0)),copy=True)




wp_down1 = []
for i in range(int(len(wp_point1)/2)):
    wp_down1_1 = rs.AddLine(wp_point1[i*2+1],wp_point1[i*2])
    wp_down1.append(wp_down1_1 )


wp_point1_1 = rs.CopyObjects(wp_point1)


del(wp_point1_1[0])
del(wp_point1_1[-1])

wp_down2 = []
for i in range(int(len(wp_point1_1)/2)):
    wp_down2_1 = rs.AddLine(wp_point1_1[i*2],wp_point1_1[i*2+1])
    wp_down2.append(wp_down2_1 )







wp_up1 = []
for i in range(int(len(wp_down1))):
    wp_up1_1 = rs.CurveMidPoint(wp_down1[i])
    rs.MoveObject(wp_up1_1 ,(0,0,1.5 *x))
    wp_cr1 = rs.AddInterpCurve([rs.CurveStartPoint(wp_down1[i]),wp_up1_1,rs.CurveEndPoint(wp_down1[i])])
    wp_cr1 = rs.ExtendCurveLength(rs.CopyObject(wp_cr1),2,2,1.5 * x)
    wp_up1.append(wp_cr1 )
#############################################
wp_up2 = []
for i in range(int(len(wp_down2))):
    wp_up2_1 = rs.CurveMidPoint(wp_down2[i])
    rs.MoveObject(wp_up2_1 ,(0,0,-1.5 *x))
    wp_cr2 = rs.AddInterpCurve([rs.CurveStartPoint(wp_down2[i]),wp_up2_1,rs.CurveEndPoint(wp_down2[i])])
    wp_cr2 = rs.ExtendCurveLength(rs.CopyObject(wp_cr2),2,2,1.5* x)
    wp_up2.append(wp_cr2 )

wp_up3 = []
for i in range(len(wp_up1)):
    wp_up3_1 = rs.ExtendCurveLength(rs.CopyObject(wp_up1[i]),2,2,1.9 * x)
    rs.MoveObject(wp_up3_1 ,(0,0,2 *x))
    wp_up3.append(wp_up3_1)

wp_up4 = []
for i in range(len(wp_up2)):
    wp_up4_1 = rs.ExtendCurveLength(rs.CopyObject(wp_up2[i]),2,2,1.9 * x)
    rs.MoveObject(wp_up4_1 ,(0,0,-2 *x))
    wp_up4.append(wp_up4_1)

rs.MoveObjects(wp_up1,(0,0,2.2 * x))
rs.MoveObjects(wp_up2,(0,0,2 * x))
rs.MoveObjects(wp_up3,(0,0,2.2 * x))
rs.MoveObjects(wp_up4,(0,0,2 * x))

wp_sr1 = []
for i in range(len(wp_up1)):
    wp_sr1_1 = rs.AddLoftSrf([wp_up1[i],wp_up3[i]])
    wp_sr1.append(wp_sr1_1[0])

wp_sr2 = []
for i in range(len(wp_up4)):
    wp_sr2_1 = rs.AddLoftSrf([wp_up2[i],wp_up4[i]])
    wp_sr2.append(wp_sr2_1[0])


wp_sr1_1 = []
for i in range(len(wp_sr1)):
    wp_sr1_1_1 = rs.ScaleObject(wp_sr1[i],rs.MoveObject(rs.CurveMidPoint(wp_up1[i]),(0,0,-4 * x)),[1,0.8,0.9],copy=True)
    rs.MoveObject(wp_sr1_1_1,(1.94 * x * 5 ,0,0.585 * x * 5))
    rs.MoveObject(wp_sr1_1_1,(0 ,0, x * 1.1))
    wp_sr1_1.append(wp_sr1_1_1)

wp_sr2_1 = []
for i in range(len(wp_sr2)):
    wp_sr2_1_1 = rs.ScaleObject(wp_sr2[i],rs.MoveObject(rs.CurveMidPoint(wp_up2[i]),(0,0,-4 * x)),[1,0.8,0.9],copy=True)
    rs.MoveObject(wp_sr2_1_1,(1.94 * x * 5 ,0,0.585 * x * 5))
    wp_sr2_1.append(wp_sr2_1_1)
wp1 = []
for i in range(len(wp_sr1)):
    wp1_1 = rs.AddLoftSrf([rs.JoinCurves(rs.DuplicateEdgeCurves(wp_sr1[i])),rs.JoinCurves(rs.DuplicateEdgeCurves(wp_sr1_1[i]))])
    rs.CapPlanarHoles(wp1_1)
    wp1.append(wp1_1[0])
wp2 = []
for i in range(len(wp_sr2)):
    wp2_1 = rs.AddLoftSrf([rs.JoinCurves(rs.DuplicateEdgeCurves(wp_sr2[i])),rs.JoinCurves(rs.DuplicateEdgeCurves(wp_sr2_1[i]))])
    rs.CapPlanarHoles(wp2_1)
    wp2.append(wp2_1[0])
rs.MoveObjects(wp1,(0,0,x))
rs.MoveObjects(wp2,(0,0,x))
del(wp1[0])
del(wp1[-1])
del(wp2[0])
del(wp2[-1])
wp_miankuo_1 = wp1[20:len(wp1)-20]
wp_miankuo_2 = wp2[20:len(wp2)-20]

wp_miankuo_3 = wp1[0:20]
wp_miankuo_4 = wp1[0:20]


wp_miankuo_1 = wp_miankuo_1[0:int(len(wp_miankuo_1)/2)+1]
wp_miankuo_2 = wp_miankuo_2[0:int(len(wp_miankuo_2)/2)+2]
wp_miankuo = []
for i in range(len(wp_miankuo_1)):
    wp_miankuo.append(wp_miankuo_1[i])
    wp_miankuo.append(wp_miankuo_2[i])

delete_group = [2,1,1,1,2,1,1,2,1,1,2,1,1,2,1,1,2,1,1,2,1,1,2,1,1,2,1,1,2,1,1,2,1,1,2,1,1,2,1,1,2,1,1,2,]


del(wp_miankuo[len(wp_miankuo)-delete_group[int(MianKuo-7)]:len(wp_miankuo)])

wp_miankuo_left = rs.MirrorObjects(wp_miankuo,rs.MoveObject(rs.CopyObject(ZhuTou_point),(0,(MianKuo_length * (MianKuo - 2) * x + 2 * j * x)/2 ,0)),rs.MoveObject(rs.CopyObject(ZhuTou_point),(x,(MianKuo_length * (MianKuo - 2) * x + 2 * j * x)/2 ,0)),copy=True)

del(wp_miankuo_left[-1])

wp_miankuo_left = wp_miankuo_left[::-1]

wp_miankuo = wp_miankuo + wp_miankuo_left 





wps_miankuo = []
for i in range(25):
    wps_wps_miankuo1 = rs.MoveObjects(rs.CopyObjects(wp_miankuo),(1.94 * x * 5 * i ,0,0.585 * x * 5 * i ))
    wps_miankuo = wps_miankuo + wps_wps_miankuo1

wp_miankuo2 = rs.CopyObjects(wp_miankuo)
wp_miankuo2_rotate_point = rs.MoveObject(rs.CurveMidPoint(rs.JoinCurves(sq_curve1)),(0,0,15 * x))


rs.MoveObjects(wp_miankuo2,(1.94 * x * 5 * 25 ,0,0.585 * x * 5 * 25 ))

rs.MoveObject(wp_miankuo2_rotate_point,(1.94 * x * 5 * 25 ,0,0.585 * x * 5 * 25 ))

wp_miankuo3_rotate_point = rs.CopyObject(wp_miankuo2_rotate_point)

wps_miankuo2 = []
for i in range(13):
    wps_wps_miankuo2 = rs.MoveObjects(rs.CopyObjects(wp_miankuo2),(1.05 * x * 8.98 * i ,0,0.4 * x * 8.98 * i ))
    wps_miankuo2 = wps_miankuo2 + wps_wps_miankuo2
rs.RotateObjects(wps_miankuo2,wp_miankuo2_rotate_point,-1,[0,x,0],copy=False)

rs.MoveObjects(wps_miankuo2,(-1.05 * x * 0.17 ,0,-0.4 * x *  0.17 ))

wp_miankuo3 = rs.CopyObjects(wp_miankuo2)

rs.MoveObjects(wp_miankuo3,(1.05 * x * 8.98 * 13 ,0,0.4 * x * 8.98 * 13 ))
rs.RotateObjects(wp_miankuo3,wp_miankuo2_rotate_point,-1,[0,x,0],copy=False)

rs.MoveObjects(wp_miankuo3,(-1.05 * x * 0.17 ,0,-0.4 * x *  0.17 ))

rs.MoveObject(wp_miankuo3_rotate_point,(1.05 * x * 8.98 * 13 ,0,0.4 * x * 8.98 * 13 ))
rs.RotateObject(wp_miankuo3_rotate_point,wp_miankuo2_rotate_point,-1,[0,x,0],copy=False)

rs.MoveObject(wp_miankuo3_rotate_point,(-1.05 * x * 0.17 ,0,-0.4 * x *  0.17 ))





wps_miankuo3 = []
for i in range(22):
    wps_wps_miankuo3 = rs.MoveObjects(rs.CopyObjects(wp_miankuo3),(1.05 * x * 8.98 * i ,0,0.4 * x * 8.98 * i ))
    del(wps_wps_miankuo3[0:i])
    del(wps_wps_miankuo3[len(wps_wps_miankuo3)-i:len(wps_wps_miankuo3)])


    wps_miankuo3 = wps_miankuo3 + wps_wps_miankuo3
rs.RotateObjects(wps_miankuo3,wp_miankuo3_rotate_point,-8,[0,x,0],copy=False)

rs.MoveObjects(wps_miankuo3,(-1.05 * x * 1.2 ,0,-0.55 * x *  1.2 ))
# ---------- end 斗拱编辑器 ----------

light = Light()
panel_2 = Panel(python_3_script.LuDou_SZ_center_point)
python_3_script_5 = Python3Script(CaiFen=number_slider)  # -> out, ShanDou_target_point, SanDou, sd_cr_2
# ---------- python_3_script_5: Python ----------
#馒头榫,广为2.5分,厚为2.5分,深为2.5分
import rhinoscriptsyntax as rs
import Rhino.Geometry as rg
import itertools as it
x = CaiFen

#佛光寺大殿散斗 泥道拱上

x = CaiFen
#散斗.深10分,广10分,泥道栱
sd_ndg_pt_o = rs.AddPoint(0,0,0)
sd_ndg_pt2 = rs.AddPoint(10 * x,0,0)
sd_ndg_pt_z1 = rs.AddPoint(- 2 * x,0, 4 * x)
sd_ndg_cr_1 = rs.AddLine(sd_ndg_pt_o,sd_ndg_pt_z1)
#散斗,欹
sd_ndg_pt_z2 = rs.CurveMidPoint(sd_ndg_cr_1)
direction_left = (x, 0, 2 * x)  # 任意方向向量 
distance = 0.5 * x # 移动距离 
# 单位化方向向量并计算实际位移 
unit_vector_left = rs.VectorUnitize(direction_left)
displacement_left = rs.VectorScale(unit_vector_left, distance)
rs.MoveObject(sd_ndg_pt_z2, displacement_left)
sd_ndg_cr_1 = rs.AddCurve([sd_ndg_pt_o,sd_ndg_pt_z2,sd_ndg_pt_z1])
sd_ndg_pt_3 = rs.MoveObject(rs.CopyObject(sd_ndg_pt_o),(0,2 * x,0))
sd_ndg_sr1 = rs.AddLine(sd_ndg_pt_3,rs.MoveObject(rs.CopyObject(sd_ndg_pt_3),(-2 * x,-2 * x,0)))
sd_ndg_sr1 = rs.AddLoftSrf([sd_ndg_sr1,rs.MoveObject(rs.CopyObject(sd_ndg_sr1),(0,0,4 * x))])
sd_ndg_cr_1 =rs.ProjectCurveToSurface(sd_ndg_cr_1,sd_ndg_sr1,[0,1,0])
sd_ndg_cr_2 = rs.MoveObject(rs.CopyObject(sd_ndg_cr_1),(0,10 * x,0 ))
sd_ndg_cr_2 = rs.RotateObject(sd_ndg_cr_2, rs.CurveStartPoint(sd_ndg_cr_2),-90,[0,0,1],copy=True)
sd_ndg_cr_3 = rs.MoveObject(rs.CopyObject(sd_ndg_cr_2),(10 * x,0,0 ))
sd_ndg_cr_3 = rs.RotateObject(sd_ndg_cr_3, rs.CurveStartPoint(sd_ndg_cr_3),-90,[0,0,1],copy=True)
sd_ndg_cr_4 = rs.MoveObject(rs.CopyObject(sd_ndg_cr_1),(10 * x,0,0 ))
sd_ndg_cr_4 = rs.RotateObject(sd_ndg_cr_4, rs.CurveStartPoint(sd_ndg_cr_4),90,[0,0,1],copy=True)
sd_ndg_down_Brep = rs.AddLoftSrf([sd_ndg_cr_1,sd_ndg_cr_2,sd_ndg_cr_3,sd_ndg_cr_4],loft_type=2,closed=True)
rs.CapPlanarHoles(sd_ndg_down_Brep)
#散斗,平
sd_ndg_sr2 = rs.ExplodePolysurfaces(sd_ndg_down_Brep)
sd_ndg_sr2 = sd_ndg_sr2[2]
sd_ndg_mid_Brep = rs.ExtrudeSurface(sd_ndg_sr2,rs.AddLine(rs.CurveEndPoint(sd_ndg_cr_2),rs.MoveObject(rs.CurveEndPoint(sd_ndg_cr_2),(0,0,2 * x))))
sd_ndg_sr3_curve= rs.DuplicateEdgeCurves(sd_ndg_mid_Brep)[9]
sd_ndg_sr3 = rs.AddLoftSrf([sd_ndg_sr3_curve,rs.MoveObject(rs.CopyObject(sd_ndg_sr3_curve),(0,-3 * x,0))])
sd_ndg_source_point = rs.SurfaceAreaCentroid(rs.ExplodePolysurfaces(sd_ndg_down_Brep)[1])[0]
sd_ndg_up_brep1 = rs.ExtrudeSurface(sd_ndg_sr3,rs.AddLine(sd_ndg_pt_o,rs.MoveObject(rs.CopyObject(sd_ndg_pt_o),(0,0,4 * x))))
sd_ndg_up_brep2 =rs.MirrorObject(sd_ndg_up_brep1,sd_ndg_source_point,rs.MoveObject(rs.CopyObject(sd_ndg_source_point),(x,0,0)),copy=True)



SanDou = rs.BooleanDifference(sd_ndg_mid_Brep,sd_ndg_down_Brep,delete_input=False)
SanDou = rs.BooleanDifference(SanDou,sd_ndg_up_brep1,delete_input=False)
SanDou = rs.BooleanDifference(SanDou,sd_ndg_up_brep2,delete_input=False)
# ---------- end python_3_script_5 ----------
python_3_script_6 = Python3Script()  # -> out, a
# ---------- python_3_script_6: Python ----------
yl_cross_crs2 = []

for i in range(len(yl_pt_y2)):
    yl_cross_cr = rs.AddLine(yl_pt_y2[i],yl_pt_x2[i])
    yl_cross_crs2.append(yl_cross_cr)

yl_cross_crs2 = yl_cross_crs2[1:len(yl_cross_crs2)-1]

yl_cross_pts2 = []
for i in range(len(yl_cross_crs2)):
    if i + 1 < len(yl_cross_crs2):
        yl_cross_pt = rs.CurveCurveIntersection(yl_cross_crs2[i],yl_cross_crs2[i+1])
        yl_cross_pts2.append(yl_cross_pt[0][1])

yl_cross_pts2.insert(0,yl_pt6)
yl_cross_pts2.append(yl_pt4)

yl_curve_up = rs.AddPolyline(yl_cross_pts2)
rs.RotateObject(yl_curve_up,hg_pt1,45,[0,0,x],copy=False)

yl_curve_up_1 = rs.RotateObject(yl_curve_up,hg_pt1,180,[0,0,x],copy=True)
rs.MoveObjects(yl_curve_up_1 ,(j*x,j*x,-5.5*x)) 

yl_curve_up = rs.JoinCurves([yl_curve_up,yl_curve_up_1,rs.AddLine(rs.CurveStartPoint(yl_curve_up),rs.CurveStartPoint(yl_curve_up_1))])
# ---------- end python_3_script_6 ----------
point = Point(python_3_script.LuDou_SZ_base_pt10)
brep_2 = Brep(斗拱编辑器.wp_miankuo_3)
point_2 = Point(斗拱编辑器.wp_miankuo3_rotate_point)
brep_3 = Brep(斗拱编辑器.wp_miankuo_3)
brep_4 = Brep(斗拱编辑器.wp_miankuo)
curve_2 = Curve(斗拱编辑器.sq_curve4)
brep_5 = Brep(斗拱编辑器.wps_miankuo3)
curve_3 = Curve(斗拱编辑器.wp_up4)
curve_4 = Curve()
curve_5 = Curve(斗拱编辑器.wp_up1)
curve_6 = Curve(斗拱编辑器.wp_up3)
curve_7 = Curve()
python_3_script_7 = Python3Script()  # -> out, a
# ---------- python_3_script_7: Python ----------
for i in range(int(len(wp_down2))):
    wp_up2_1 = rs.CurveMidPoint(wp_down2[i])
    rs.MoveObject(wp_up2_1 ,(0,0,2 *x))
    wp_cr1 = rs.AddInterpCurve([rs.CurveStartPoint(wp_down2[i]),wp_up2_1,rs.CurveEndPoint(wp_down2[i])])
    wp_up2.append(wp_cr1 )
# ---------- end python_3_script_7 ----------
curve_8 = Curve(斗拱编辑器.wp_down1)
python_3_script_8 = Python3Script(x=Slider(21, range=0..100))  # -> out, baoping_brep
# ---------- python_3_script_8: Python ----------
#转角铺作华拱生成

hg4_zj_neiyan_pt1 = rs.CopyObject(ZhuTou_point)
rs.MoveObject(hg4_zj_neiyan_pt1,(HuaGong_CaiFen_left * x-32*x,0,262.5 * x))

hg4_zj_neiyan_pt2 = rs.CopyObject(hg4_zj_neiyan_pt1)
rs.MoveObject(hg4_zj_neiyan_pt2,(-(HuaGong_CaiFen_left+21) * x,0,0))

hg4_zj_neiyan_pt3 = rs.CopyObject(hg4_zj_neiyan_pt1)
rs.MoveObject(hg4_zj_neiyan_pt3,((HuaGong_CaiFen_left+21) * x,0,0))

hg4_zj_neiyan_pt2z = rs.CopyObject(hg4_zj_neiyan_pt2)
rs.MoveObject(hg4_zj_neiyan_pt2z,(0,0,9 * x))

hg4_zj_neiyan_pt3z = rs.CopyObject(hg4_zj_neiyan_pt3)
rs.MoveObject(hg4_zj_neiyan_pt3z,(0,0,9 * x))


hg4_zj_neiyan_pt2x = rs.CopyObject(hg4_zj_neiyan_pt2)
rs.MoveObject(hg4_zj_neiyan_pt2x,(16 * x,0,0))

hg4_zj_neiyan_pt3x = rs.CopyObject(hg4_zj_neiyan_pt3)
rs.MoveObject(hg4_zj_neiyan_pt3x,(-16 * x,0,0))

hg4_zj_neiyan_cr1z = rs.AddLine(hg4_zj_neiyan_pt2,hg4_zj_neiyan_pt2z)

hg4_zj_neiyan_cr1x = rs.AddLine(hg4_zj_neiyan_pt2x,hg4_zj_neiyan_pt2)

#卷杀生成
juansha_zj_crs = []

juansha_zj_pt1 = rs.DivideCurve(hg4_zj_neiyan_cr1z,5)

juansha_zj_pt2 = rs.DivideCurve(hg4_zj_neiyan_cr1x,5)

for i in range(len(juansha_zj_pt1)):
    juansha_zj_cr = rs.AddLine(juansha_zj_pt1[i],juansha_zj_pt2[i])
    juansha_zj_crs.append(juansha_zj_cr)

juansha_zj_crs = juansha_zj_crs[1:len(juansha_zj_crs)-1]

juansha_zj_pts = []

for i in range(len(juansha_zj_crs)):
    if i + 1 < len(juansha_zj_crs):
        juansha_pt = rs.CurveCurveIntersection(juansha_zj_crs[i],juansha_zj_crs[i+1])
        juansha_zj_pts.append(juansha_pt[0][1])
juansha_zj_pts.append(rs.CurveEndPoint(hg4_zj_neiyan_cr1z))
juansha_zj_pts.append(rs.MoveObject(rs.CopyObject(hg4_zj_neiyan_pt2z),(0,0,6 * x)))
juansha_zj_pts.append(rs.MoveObject(rs.CopyObject(hg4_zj_neiyan_pt2z),(12 * x,0,6 * x)))
juansha_zj_pts.insert(0,rs.CurveStartPoint(hg4_zj_neiyan_cr1x))

juansha_zj_curve = rs.AddPolyline(juansha_zj_pts)

#欹幽
#左
qa_zj_left_2 = rs.CopyObject(rs.MoveObject(rs.CopyObject(hg4_zj_neiyan_pt2z),(12 * x,0,6 * x)))
rs.MoveObject(qa_zj_left_2,(2 * x,0,4 * x))
qa_zj_curve_left_1 = rs.AddLine(rs.MoveObject(rs.CopyObject(hg4_zj_neiyan_pt2z),(12 * x,0,6 * x)),qa_zj_left_2)

qa_zj_left_3 = rs.CurveMidPoint(qa_zj_curve_left_1)
direction_left = (-x, 0, 2 * x)  # 任意方向向量 
distance = 0.5 * x # 移动距离 
# 单位化方向向量并计算实际位移 
unit_vector_left = rs.VectorUnitize(direction_left)
displacement_left = rs.VectorScale(unit_vector_left, distance)
rs.MoveObject(qa_zj_left_3, displacement_left)
qa_zj_curve_left_1 = rs.AddCurve([rs.MoveObject(rs.CopyObject(hg4_zj_neiyan_pt2z),(12 * x,0,6 * x)),qa_zj_left_3,qa_zj_left_2])
qa_zj_curve_left_1 = rs.JoinCurves([qa_zj_curve_left_1,rs.AddLine(rs.CurveEndPoint(qa_zj_curve_left_1),rs.MoveObject(rs.CurveEndPoint(qa_zj_curve_left_1),(0,0,2*x)))])

juansha_zj_curve = rs.JoinCurves([juansha_zj_curve,qa_zj_curve_left_1])

juansha_zj_brep_untrimed = rs.MirrorObject(juansha_zj_curve,hg4_zj_neiyan_pt1,rs.MoveObject(rs.CopyObject(hg4_zj_neiyan_pt1),(0,x,0)),copy=True)
rs.MoveObject(juansha_zj_brep_untrimed,((HuaGong_CaiFen_left - HuaGong_CaiFen_left)*x,0,0))

juansha_zj_brep_untrimed = rs.JoinCurves([juansha_zj_curve,juansha_zj_brep_untrimed ,rs.AddLine(rs.CurveStartPoint(juansha_zj_curve),rs.CurveStartPoint(juansha_zj_brep_untrimed)),rs.AddLine(rs.CurveEndPoint(juansha_zj_curve),rs.CurveEndPoint(juansha_zj_brep_untrimed))])
juansha_zj_brep_untrimed = rs.AddPlanarSrf(juansha_zj_brep_untrimed)
rs.MoveObject(juansha_zj_brep_untrimed,(0,5 * x,0))
juansha_zj_brep_untrimed = rs.ExtrudeSurface(juansha_zj_brep_untrimed,rs.AddLine(rs.AddPoint(0,0,0),rs.AddPoint(0,-10 * x ,0)))
#拱眼隐去部深1分
#左
gyy_zj_cr =rs.AddLine(rs.CurveStartPoint(qa_zj_curve_left_1),rs.MoveObject(rs.CurveStartPoint(qa_zj_curve_left_1),(0,0,-x)))
gyy_zj_cr_1 = rs.RotateObject(gyy_zj_cr,rs.CurveEndPoint(gyy_zj_cr),90,[0,x,0],copy=True)
gyy_zj_cr = rs.AddFilletCurve(gyy_zj_cr,gyy_zj_cr_1,x)
qa_zj_curve_left1 = rs.JoinCurves([qa_zj_curve_left_1,gyy_zj_cr])

qa_zj_curve_left2 = rs.RotateObject(qa_zj_curve_left1,rs.CurveEndPoint(qa_zj_curve_left1),180,[0,0,x],copy=True)
rs.MoveObject(qa_zj_curve_left2,((HuaGong_CaiFen_left +10 -14 - 7.875) * x,0,0))
qa_zj_curve_left = rs.JoinCurves([qa_zj_curve_left1,qa_zj_curve_left2,rs.AddLine(rs.CurveStartPoint(qa_zj_curve_left1),rs.CurveStartPoint(qa_zj_curve_left2)),rs.AddLine(rs.CurveEndPoint(qa_zj_curve_left1),rs.CurveEndPoint(qa_zj_curve_left2))])

qa_zj_curve_left = rs.AddPlanarSrf(qa_zj_curve_left)
qa_zj_curve_left_1 = rs.ExtrudeSurface(qa_zj_curve_left,rs.AddLine(rs.AddPoint(0,0,0),rs.AddPoint(0,-2 * x,0)))
rs.MoveObject(qa_zj_curve_left_1,(0,-4 * x ,0))
qa_zj_curve_left_2 = rs.MirrorObject(qa_zj_curve_left_1,hg4_zj_neiyan_pt1,rs.MoveObject(rs.CopyObject(hg4_zj_neiyan_pt1),(x,0,0)),copy=True)

qa_zj_curve_right2 =  rs.MirrorObject(qa_zj_curve_left2,hg4_zj_neiyan_pt1,rs.MoveObject(rs.CopyObject(hg4_zj_neiyan_pt1),(0,x,0)),copy=True)
qa_zj_curve_right1 =  rs.MirrorObject(qa_zj_curve_left1,hg4_zj_neiyan_pt1,rs.MoveObject(rs.CopyObject(hg4_zj_neiyan_pt1),(0,x,0)),copy=True)
rs.MoveObject(qa_zj_curve_right1,((HuaGong_CaiFen_left - HuaGong_CaiFen_left)*x,0,0))

qa_zj_curve_right_1 = rs.JoinCurves([qa_zj_curve_right1,qa_zj_curve_right2,rs.AddLine(rs.CurveStartPoint(qa_zj_curve_right1),rs.CurveStartPoint(qa_zj_curve_right2)),rs.AddLine(rs.CurveEndPoint(qa_zj_curve_right1),rs.CurveEndPoint(qa_zj_curve_right2))])
qa_zj_curve_right_1 = rs.AddPlanarSrf(qa_zj_curve_right_1)
qa_zj_curve_right_1 = rs.ExtrudeSurface(qa_zj_curve_right_1,rs.AddLine(rs.AddPoint(0,0,0),rs.AddPoint(0,-2 * x,0)))
rs.MoveObject(qa_zj_curve_right_1,(0,-4 * x ,0))
qa_zj_curve_right_2 = rs.MirrorObject(qa_zj_curve_right_1,hg4_zj_neiyan_pt1,rs.MoveObject(rs.CopyObject(hg4_zj_neiyan_pt1),(x,0,0)),copy=True)

#馒头榫生成
mts_zj_pt1 = rs.CopyObject(hg4_zj_neiyan_pt2z)
rs.MoveObject(mts_zj_pt1,(4.75 * x,-1.25 * x,6 * x))
mts_zj1 = rs.AddLine(mts_zj_pt1,rs.MoveObject(rs.CopyObject(mts_zj_pt1),(2.5 * x,0,0)))
mts_zj1 = rs.ExtrudeCurve(mts_zj1,rs.AddLine(rs.AddPoint(0,0,0),rs.AddPoint(0,2.5 * x,0)))
mts_zj1 = rs.ExtrudeSurface(mts_zj1,rs.AddLine(rs.AddPoint(0,0,0),rs.AddPoint(0,0,2.5 * x)))
mts_zj2 = rs.MirrorObject(mts_zj1,hg4_zj_neiyan_pt1,rs.MoveObject(rs.CopyObject(hg4_zj_neiyan_pt1),(0,x,0)),copy=True)
rs.MoveObject(mts_zj2,((HuaGong_CaiFen_left - HuaGong_CaiFen_left)*x,0,0))

#拱眼插销生成
#拱眼上的插栓,广4分,厚4分,深2.5分
gy_cx_zj1 = rs.CopyObject(rs.CurveEndPoint(qa_zj_curve_left1))
rs.MoveObject(gy_cx_zj1,(rs.Distance(rs.CurveEndPoint(qa_zj_curve_left1),rs.CurveEndPoint(qa_zj_curve_left2))/2-2*x,-1.25 * x,0))
gy_cx_zj1 = rs.AddLine(gy_cx_zj1,rs.MoveObject(rs.CopyObject(gy_cx_zj1),(4 * x,0,0)))
gy_cx_zj1 = rs.ExtrudeCurve(gy_cx_zj1,rs.AddLine(rs.AddPoint(0,0,0),rs.AddPoint(0,2.5 * x,0)))
gy_cx_zj1 = rs.ExtrudeSurface(gy_cx_zj1,rs.AddLine(rs.AddPoint(0,0,0),rs.AddPoint(0,0,4 * x)))
gy_cx_zj2 = rs.MirrorObject(gy_cx_zj1,hg4_zj_neiyan_pt1,rs.MoveObject(rs.CopyObject(hg4_zj_neiyan_pt1),(0,x,0)),copy=True)
rs.MoveObject(gy_cx_zj2,((HuaGong_CaiFen_left - HuaGong_CaiFen_left)*x/2,0,0))


#用于剪切华拱下部的体块

huagong_trimed_brep = rs.ExplodePolysurfaces(JiaoLuDou)[31]
huagong_trimed_brep = rs.CurveStartPoint(rs.DuplicateEdgeCurves(huagong_trimed_brep)[1])
rs.RotateObject(huagong_trimed_brep,hg4_zj_neiyan_pt1,-45,[0,0,x])
huagong_trimed_brep = rs.AddLine(huagong_trimed_brep,rs.MoveObject(rs.CopyObject(huagong_trimed_brep),(0,-14 * x,0)))
huagong_trimed_brep_1 = rs.MirrorObject(huagong_trimed_brep,hg4_zj_neiyan_pt1,rs.MoveObject(rs.CopyObject(hg4_zj_neiyan_pt1),(0,x,0)),copy=True)
huagong_trimed_brep = rs.AddLoftSrf([huagong_trimed_brep,huagong_trimed_brep_1])
huagong_trimed_brep = rs.ExtrudeSurface(huagong_trimed_brep,rs.AddLine(rs.AddPoint(0,0,0),rs.AddPoint(0,0,6 * x)))
rs.MoveObject(huagong_trimed_brep,(0,0,-6 * x))

huagong_trimed_brep2 = rs.CopyObject(hg4_zj_neiyan_pt1)
rs.MoveObject(huagong_trimed_brep2,(-5 * x,-6 * x,6 * x))
huagong_trimed_brep2 = rs.AddLine(huagong_trimed_brep2,rs.MoveObject(rs.CopyObject(huagong_trimed_brep2),((10 * x),0,0)))
huagong_trimed_brep2 = rs.ExtrudeCurve(huagong_trimed_brep2,rs.AddLine(rs.AddPoint(0,0,0),rs.AddPoint(0,12 * x,0)))
huagong_trimed_brep2 = rs.ExtrudeSurface(huagong_trimed_brep2,rs.AddLine(rs.AddPoint(0,0,0),rs.AddPoint(0,0,9 * x)))


#华拱剪切
HuaGong1_zj = rs.BooleanDifference(juansha_zj_brep_untrimed,qa_zj_curve_left_1,delete_input=False)
HuaGong1_zj = rs.BooleanDifference(HuaGong1_zj,qa_zj_curve_left_2,delete_input=False)
HuaGong1_zj = rs.BooleanIntersection(HuaGong1_zj,qa_zj_curve_right_1,delete_input=False)
HuaGong1_zj = rs.BooleanIntersection(HuaGong1_zj,qa_zj_curve_right_2,delete_input=False)
HuaGong1_zj = rs.BooleanDifference(mts_zj1,HuaGong1_zj,delete_input=False)
HuaGong1_zj = rs.BooleanIntersection(HuaGong1_zj,mts_zj2,delete_input=False)
HuaGong1_zj = rs.BooleanIntersection(HuaGong1_zj,gy_cx_zj1,delete_input=False)
HuaGong1_zj = rs.BooleanIntersection(HuaGong1_zj,gy_cx_zj2,delete_input=False)
HuaGong1_zj = rs.BooleanUnion([HuaGong1_zj,huagong_trimed_brep],delete_input=False)
HuaGong1_zj = rs.BooleanDifference(huagong_trimed_brep2,HuaGong1_zj,delete_input=False)
# ---------- end python_3_script_8 ----------
brep_6 = Brep([斗拱编辑器.wps_miankuo2, 斗拱编辑器.wps_miankuo3, 斗拱编辑器.wps_miankuo])
list_item_3 = ListItem(List=brep_6, Index=Slider(73, range=0..1000), Wrap=True)
brep_7 = Brep()
panel_3 = Panel(斗拱编辑器.wp_miankuo_1)
point_3 = Point()
curve_9 = Curve(斗拱编辑器.wp_up2)
colour_swatch = ColourSwatch(SwatchColor=RGB(9, 52, 158))
colour_swatch_2 = ColourSwatch(SwatchColor=RGB(35, 46, 61))
panel_4 = Panel(point_3)
custom_preview = CustomPreview(Geometry=brep_4, Material=colour_swatch_2)
brep_8 = Brep(斗拱编辑器.wp_miankuo_left)
custom_preview_2 = CustomPreview(Geometry=斗拱编辑器.wps_miankuo3, Material=colour_swatch_2)
subtraction = Subtraction(B=1)
create_material = CreateMaterial(
    Diffuse=colour_swatch,
    Specular=colour_swatch,
    Emission=colour_swatch,
    Transparency=Slider(0, range=0..1),
    Shine=Slider(0, range=0..1))
brep_9 = Brep()

斗拱编辑器_2 = Python3Script(
    CaiFen=number_slider_2,
    HuaGong_CaiFen_left=number_slider_13,
    HuaGong_CaiFen_right=number_slider_11,
    NiDaoGong_CaiFen_left=number_slider_14,
    NiDaoGong_CaiFen_right=number_slider_14,
    MianKuo=number_slider_3)  # -> chuans, chuans_jinshen, yjc_breps, wb_miankuo, wb_jinshen, wb_jinjian; inputs CaiFen: Int32
# ---------- 斗拱编辑器_2: Python ----------
#佛光寺东大殿柱基
#每一跳为21分
import rhinoscriptsyntax as rs
import Rhino.Geometry as rg
import itertools as it
import math
#材分可调变量x
x = CaiFen
#柱头点
ZhuTou_point = rs.AddPoint(HuaGong_CaiFen_left * x,5 *x,0)
#原点
BasePoint = 0
pt_o = rs.AddPoint(BasePoint * 500,0,0)
#进深为14倍材广,一材广为15材分(j的单位为分)
j = 14 * 15
MianKuo_length = 16 * 15

#   面扩七开间，五进深,明间为16倍材广为240分，除了尽间，面阔皆为240分，尽间面扩为210分。进深开间 = 尽间开间也为210分
if (MianKuo % 2 == 0) | (MianKuo < 5):
    raise ValueError(f"开间最小数不能低于5,且为单数")

zhu_pt1 = rs.CopyObject(ZhuTou_point)
rs.MoveObject(zhu_pt1,(0,j * x,0))
zhu_pt2 = rs.CopyObject(zhu_pt1,(0,MianKuo_length * (MianKuo - 2) * x,0))
zhu_cr = rs.AddLine(zhu_pt1,zhu_pt2)
zhutou_pt = rs.DivideCurve(zhu_cr,MianKuo-2)
zhu_pt3 = rs.CopyObject(ZhuTou_point)
zhu_pt4 =rs.MoveObject(rs.CopyObject(zhutou_pt[-1]),(0, j * x,0))
zhutou_pt.insert(0,zhu_pt3)
zhutou_pt.append(zhu_pt4)
zhutou_pt2 = rs.MoveObjects(rs.CopyObjects(zhutou_pt),(j * x,0,0))

zhutou_pt3 = rs.MoveObjects(rs.CopyObjects(zhutou_pt2[0:2] ),(j * x,0,0))

zhutou_pt3_1 = rs.MoveObjects(rs.CopyObjects(zhutou_pt2[len(zhutou_pt2)-2:len(zhutou_pt2)] ),(j * x,0,0))

zhutou_pt3 = zhutou_pt3 + zhutou_pt3_1

zhutou_pt4 = rs.MoveObjects(rs.CopyObjects(zhutou_pt2),(2 * j * x,0,0))

zhutou_pt5 = rs.MoveObjects(rs.CopyObjects(zhutou_pt2),(3 * j * x,0,0))


#柱高
#当心间的柱高为237.5分

#生起的规律

zhutou_pt_up =rs.CopyObjects(zhutou_pt)
rs.MoveObjects(zhutou_pt_up,(0,0,237.5 * x))

zhutou_pt_up2 =rs.CopyObjects(zhutou_pt2)
rs.MoveObjects(zhutou_pt_up2,(0,0,237.5 * x))

zhutou_pt_up3 =rs.CopyObjects(zhutou_pt3)
rs.MoveObjects(zhutou_pt_up3,(0,0,237.5 * x))

if MianKuo > 5:
    #前檐
    rs.MoveObjects([zhutou_pt_up[0],zhutou_pt_up[-1]],(0,0,10.5 * x))
    rs.MoveObjects([zhutou_pt_up[1],zhutou_pt_up[-2]],(0,0,6 * x))
    rs.MoveObjects([zhutou_pt_up[2],zhutou_pt_up[-3]],(0,0,2.5 * x))
    #内檐
    rs.MoveObjects([zhutou_pt_up2[0],zhutou_pt_up2[-1]],(0,0,7.5 * x))
    rs.MoveObjects([zhutou_pt_up2[1],zhutou_pt_up2[-2]],(0,0,5 * x))
    rs.MoveObjects([zhutou_pt_up2[2],zhutou_pt_up2[-3]],(0,0,2.5 * x))
    #中柱
    rs.MoveObjects([zhutou_pt_up3[1],zhutou_pt_up3[-2]],(0,0, 2.5* x))
 
else: 
    #前檐
    rs.MoveObjects([zhutou_pt_up[0],zhutou_pt_up[-1]],(0,0,6 * x))
    rs.MoveObjects([zhutou_pt_up[1],zhutou_pt_up[-2]],(0,0,2.5 * x))
    #内檐
    rs.MoveObjects([zhutou_pt_up2[0],zhutou_pt_up2[-1]],(0,0,5 * x))
    rs.MoveObjects([zhutou_pt_up2[1],zhutou_pt_up2[-2]],(0,0,2.5 * x))



zhutou_pt_up4 = rs.CopyObjects(zhutou_pt_up2,(2 * j * x,0,0))
zhutou_pt_up5 = rs.CopyObjects(zhutou_pt_up,(4 * j * x,0,0))







#檩条生成

# 生起曲线

lt_breps = []
lt_trimed2 = rs.CopyObjects(zhutou_pt_up[0:len(zhutou_pt_up)-1])
rs.MoveObjects(lt_trimed2,(0,0,0))
lt_trimed1 = rs.CopyObjects(zhutou_pt_up[1:len(zhutou_pt_up)])
rs.MoveObjects(lt_trimed1,(0,0,0))
sq_cr = rs.AddInterpCurve(zhutou_pt_up)
sq_sr = rs.ExtrudeCurve(sq_cr,rs.AddLine(rs.AddPoint(0,0,0),rs.AddPoint(5 * x,0,0)))

sq_curves = []
lt_breps = []
for i in range(len(lt_trimed1)):
    cr1 = rs.AddLine(lt_trimed1[i],lt_trimed2[i])
    rs.MoveObject(cr1,(5 * x,0,21 * x))
    cr1 = rs.ProjectCurveToSurface(cr1,sq_sr,[0,0,x])
    sq_curves.append(cr1[0])
sq_curves = sq_curves[::-1]

sq_curve_1 = rs.CurveEndPoint(sq_curves[0])
sq_curve_1 = rs.AddLine(sq_curve_1,rs.MoveObject(rs.CopyObject(sq_curve_1),(0,195 * x,0)))

sq_curves[0] = rs.JoinCurves([sq_curves[0],sq_curve_1])[0]
sq_curves[-1] = rs.MirrorObjects(sq_curves[0],rs.MoveObject(rs.CopyObject(ZhuTou_point),(0,(MianKuo_length * (MianKuo - 2) * x + 2 * j * x)/2 ,0)),rs.MoveObject(rs.CopyObject(ZhuTou_point),(x,(MianKuo_length * (MianKuo - 2) * x + 2 * j * x)/2 ,0)),copy=True)[0]

sq_curve_or = sq_curves
rs.MoveObjects(sq_curve_or,(-5 * x,0,-237.5 * x))
rs.MoveObjects(sq_curve_or,(0,0,-7.5 * x))
sq_curve1 = rs.MoveObjects(rs.CopyObjects(sq_curve_or),(-89 * x,0,358 * x))[1:len(sq_curve_or)-1]

sq_curve2 = rs.MoveObjects(rs.CopyObjects(sq_curve_or),(j/2 * x,0,416.5 * x))[1:len(sq_curve_or)-1]

sq_curve3 = rs.CopyObjects(sq_curve2)
sq_curve4 = rs.MoveObjects(rs.CopyObjects(sq_curve_or),(j/2 * x + 105 * x,0,456.5 * x))[1:len(sq_curve_or)-1]

sq_curve5 = rs.CopyObjects(sq_curve4)
sq_curve6 = rs.MoveObjects(rs.CopyObjects(sq_curve_or),(j/2 * x + 210 * x,0,511.5 * x))[1:len(sq_curve_or)-1]

sq_curve7 = rs.CopyObjects(sq_curve6)
sq_curve8 = rs.MoveObjects(rs.CopyObjects(sq_curve_or),(j/2 * x + 315 * x,0,573.5 * x))[1:len(sq_curve_or)-1]

chuan5_trimed = rs.JoinCurves(sq_curve8)
chuan5_trimed = rs.ExtrudeCurve(chuan5_trimed,rs.AddLine(rs.AddPoint(0,0,0),rs.AddPoint(0,0,42 * x)))
chuan5_trimed = rs.ExtrudeSurface(chuan5_trimed,rs.AddLine(rs.AddPoint(0,0,0),rs.AddPoint(42 * x,0,0)))

rs.MoveObjects(sq_curve1,(-((7.5)/3.46)* x,0,((7.5)/1.00)*x))
rs.MoveObjects(sq_curve2,(-((7.5)/3.46)* x,0,((7.5)/1.00)*x))
sq_curve1 = sq_curve1[::-1]
sq_curve2 = sq_curve2[::-1]
sq_curve3 = sq_curve3[::-1]
sq_curve4 = sq_curve4[::-1]
sq_curve5 = sq_curve5[::-1]
sq_curve6 = sq_curve6[::-1]
sq_curve7 = sq_curve7[::-1]
sq_curve8 = sq_curve8[::-1]

chuan = []

for i in range(len(sq_curve1)):
    sq_point1 = rs.DivideCurve(sq_curve1[i],15)
    sq_point2 = rs.DivideCurve(sq_curve2[i],15)
    chuan1 = []
    for y in range(len(sq_point1)):
        chuan1_1 = rs.AddLine(sq_point1[y],sq_point2[y])
        rs.MoveObject(chuan1_1,(0,3.25 * x,0))
        chuan1_1 = rs.ExtrudeCurve(chuan1_1,rs.AddLine(rs.AddPoint(0,0,0),rs.AddPoint(0,-6.5 * x,0)))
        chuan1_1 = rs.ExtrudeSurface(chuan1_1,rs.AddLine(rs.AddPoint(0,0,0),rs.AddPoint(0,0,6.5 * x)))
        chuan1.append(chuan1_1)
    chuan = chuan + chuan1

rs.MoveObjects(chuan,(-(87.3)* x,0,(-26.325)*x))


chuan2 = rs.MoveObjects(rs.CopyObjects(chuan),(0,-8 * x,0))

del(chuan2[0])
rs.MoveObjects(chuan2,((155.2)* x,0,(46.8)*x))

#椽剪切

sq_curve2_trimed = rs.JoinCurves(sq_curve2)

sq_curve2_trimed = rs.ExtrudeCurve(sq_curve2_trimed,rs.AddLine(rs.AddPoint(0,0,0),rs.AddPoint(0,0,84 *x)))
sq_curve2_trimed = rs.ExtrudeSurface(sq_curve2_trimed,rs.AddLine(rs.AddPoint(0,0,0),rs.AddPoint(100 * x,0,0)))

rs.MoveObject(sq_curve2_trimed,(21 *x,0,0))

chuan2_1 = []

for i in range(len(chuan2)):
    chuan2_1_1 = rs.BooleanIntersection(sq_curve2_trimed,chuan2[i],delete_input=False)
    chuan2_1.append(chuan2_1_1[0])
chuan2 = chuan2_1

#第三层椽


rs.MoveObjects(sq_curve3,(-((7.5)/2.809)* x,0,((7.5)/1.07)*x))
rs.MoveObjects(sq_curve4,(-((7.5)/2.809)* x,0,((7.5)/1.07)*x))

rs.MoveObjects(sq_curve3,(-(21)* x,0,-(8)*x))
rs.MoveObjects(sq_curve4,((21)* x,0,(8)*x))

chuan3 = []
for i in range(len(sq_curve3)):
    sq_point3 = rs.DivideCurve(sq_curve3[i],15)
    sq_point4 = rs.DivideCurve(sq_curve4[i],15)
    chuan_3 = []
    for y in range(len(sq_point3)):
        chuan_3_1 = rs.AddLine(sq_point3[y],sq_point4[y])
        rs.MoveObject(chuan_3_1,(0,3.25 * x,0))
        chuan_3_1 = rs.ExtrudeCurve(chuan_3_1,rs.AddLine(rs.AddPoint(0,0,0),rs.AddPoint(0,-6.5 * x,0)))
        chuan_3_1 = rs.ExtrudeSurface(chuan_3_1,rs.AddLine(rs.AddPoint(0,0,0),rs.AddPoint(0,0,6.5 * x)))
        chuan_3.append(chuan_3_1)
    chuan3 = chuan3 + chuan_3

#第四层椽

rs.MoveObjects(sq_curve5,(-((7.5)/2.15513)* x,0,((7.5)/1.1288)*x))
rs.MoveObjects(sq_curve6,(-((7.5)/2.15513)* x,0,((7.5)/1.1288)*x))

rs.MoveObjects(sq_curve5,(-(21)* x,0,-(11)*x))
rs.MoveObjects(sq_curve6,((21)* x,0,(11)*x))


chuan4 = []
for i in range(len(sq_curve5)):
    sq_point4 = rs.DivideCurve(sq_curve5[i],15)
    sq_point5 = rs.DivideCurve(sq_curve6[i],15)
    chuan_4 = []
    for y in range(len(sq_point5)):
        chuan_4_1 = rs.AddLine(sq_point4[y],sq_point5[y])
        rs.MoveObject(chuan_4_1,(0,3.25 * x,0))
        chuan_4_1 = rs.ExtrudeCurve(chuan_4_1,rs.AddLine(rs.AddPoint(0,0,0),rs.AddPoint(0,-6.5 * x,0)))
        chuan_4_1 = rs.ExtrudeSurface(chuan_4_1,rs.AddLine(rs.AddPoint(0,0,0),rs.AddPoint(0,0,6.5 * x)))
        chuan_4.append(chuan_4_1)
    chuan4 = chuan4 + chuan_4

rs.MoveObjects(chuan4,(0,-8 * x,0))
del(chuan4[0])


#第五层椽



rs.MoveObjects(sq_curve7,(-((7.5)/1.96675)* x,0,((7.5)/1.1613)*x))
rs.MoveObjects(sq_curve8,(-((7.5)/1.96675)* x,0,((7.5)/1.1613)*x))

rs.MoveObjects(sq_curve7,(-(21)* x,0,-(12.4)*x))
rs.MoveObjects(sq_curve8,((21)* x,0,(12.4)*x))


chuan5 = []
for i in range(len(sq_curve7)):
    sq_point7 = rs.DivideCurve(sq_curve7[i],15)
    sq_point8 = rs.DivideCurve(sq_curve8[i],15)
    chuan_5 = []
    for y in range(len(sq_point7)):
        chuan_5_1 = rs.AddLine(sq_point7[y],sq_point8[y])
        rs.MoveObject(chuan_5_1,(0,3.25 * x,0))
        chuan_5_1 = rs.ExtrudeCurve(chuan_5_1,rs.AddLine(rs.AddPoint(0,0,0),rs.AddPoint(0,-6.5 * x,0)))
        chuan_5_1 = rs.ExtrudeSurface(chuan_5_1,rs.AddLine(rs.AddPoint(0,0,0),rs.AddPoint(0,0,6.5 * x)))
        chuan_5.append(chuan_5_1)
    chuan5 = chuan5 + chuan_5

#椽两侧剪切


chuan_trimed_lateral = rs.AddLine(ZhuTou_point,rs.MoveObject(rs.CopyObject(ZhuTou_point),(3 * j*x,3 * j*x,0)))
chuan_trimed_lateral = rs.ExtrudeCurve(chuan_trimed_lateral,rs.AddLine(rs.AddPoint(0,0,0),rs.AddPoint(0,0,700 * x)))
rs.RotateObject(chuan_trimed_lateral,ZhuTou_point,45,[0,0,x],copy=False)
rs.MoveObject(chuan_trimed_lateral,(-0 * x,0,0))
chuan_trimed_lateral3 = rs.ExtrudeSurface(chuan_trimed_lateral,rs.AddLine(rs.AddPoint(0,0,0),rs.AddPoint(-200 * x,0,0)))
chuan_trimed_lateral = rs.ExtrudeSurface(chuan_trimed_lateral,rs.AddLine(rs.AddPoint(0,0,0),rs.AddPoint(200 * x,0,0)))

rs.MoveObject(chuan_trimed_lateral3,(5 * x,0,0))
rs.RotateObject(chuan_trimed_lateral,ZhuTou_point,-45,[0,0,x],copy=False)
rs.RotateObject(chuan_trimed_lateral3,ZhuTou_point,-45,[0,0,x],copy=False)

for i in range((int(2))):
    chuan3[i] = rs.BooleanIntersection(chuan_trimed_lateral,chuan3[i],delete_input=False)[0]
    chuan3[-(i)-1] = rs.MirrorObjects(chuan3[i],rs.MoveObject(rs.CopyObject(ZhuTou_point),(0,(MianKuo_length * (MianKuo - 2) * x + 2 * j * x)/2 ,0)),rs.MoveObject(rs.CopyObject(ZhuTou_point),(x,(MianKuo_length * (MianKuo - 2) * x + 2 * j * x)/2 ,0)),copy=True)[0]

for i in range((int(8))):
    chuan4[i] = rs.BooleanIntersection(chuan_trimed_lateral,chuan4[i],delete_input=False)[0]
    chuan4[-(i)-1] = rs.MirrorObjects(chuan4[i],rs.MoveObject(rs.CopyObject(ZhuTou_point),(0,(MianKuo_length * (MianKuo - 2) * x + 2 * j * x)/2 ,0)),rs.MoveObject(rs.CopyObject(ZhuTou_point),(x,(MianKuo_length * (MianKuo - 2) * x + 2 * j * x)/2 ,0)),copy=True)[0]


######

chuan5_2 = []
for i in range(len(chuan5)):
    chuan5_2_1 = rs.BooleanIntersection(chuan5[i],chuan5_trimed,delete_input=False)[0]
    chuan5_2.append(chuan5_2_1)

chuan5 = chuan5_2
del(chuan5[0:6])
del(chuan5[int(len(chuan5))-6:int(len(chuan5))])

for i in range((int(8))):
    chuan5[i] = rs.BooleanIntersection(chuan_trimed_lateral,chuan5[i],delete_input=False)[0]
    chuan5[-(i)-1] = rs.MirrorObjects(chuan5[i],rs.MoveObject(rs.CopyObject(ZhuTou_point),(0,(MianKuo_length * (MianKuo - 2) * x + 2 * j * x)/2 ,0)),rs.MoveObject(rs.CopyObject(ZhuTou_point),(x,(MianKuo_length * (MianKuo - 2) * x + 2 * j * x)/2 ,0)),copy=True)[0]

#侧面的椽

#######################################################
# 生起曲线
sq_curves2 = []
shan_mian_pt_up = [zhutou_pt_up[0],zhutou_pt_up2[0],zhutou_pt_up3[0],zhutou_pt_up4[0],zhutou_pt_up5[0]]
le_trimed2_3 = rs.CopyObjects(shan_mian_pt_up[0:len(zhutou_pt_up)-1])
rs.MoveObjects(le_trimed2_3,((0) * x,0,0))
le_trimed1_3 = rs.CopyObjects(shan_mian_pt_up[1:len(zhutou_pt_up)])
rs.MoveObjects(le_trimed1_3,(-(0) * x,0,0))
sq_cr_3 = rs.AddInterpCurve(shan_mian_pt_up)
sq_sr_3 = rs.ExtrudeCurve(sq_cr_3,rs.AddLine(rs.AddPoint(0,0,0),rs.AddPoint(0,5 * x,0)))
for i in range(len(le_trimed1_3)):
    cr1_3 = rs.AddLine(le_trimed1_3[i],le_trimed2_3[i])
    rs.MoveObject(cr1_3,(0,4 * x,21 * x))
    cr1_3 = rs.ProjectCurveToSurface(cr1_3,sq_sr_3,[0,0,x])
    sq_curves2.append(cr1_3[0])

sq_curve_or2 = rs.MoveObjects(sq_curves2,(0,-5 * x,-237.5 * x))
rs.MoveObjects(sq_curve_or2,(0,0,-7.5 * x))

#延长两头

sq_curve_or2_1 = rs.CurveEndPoint(sq_curve_or2[0])
sq_curve_or2_1 = rs.AddLine(sq_curve_or2_1,rs.MoveObject(rs.CopyObject(sq_curve_or2_1),(-160 * x,0,0)))
sq_curve_or2[0] = rs.JoinCurves([sq_curve_or2[0],sq_curve_or2_1])[0]
sq_curve_or2[-1] = rs.MirrorObject(sq_curve_or2[0],rs.MoveObject(rs.CopyObject(ZhuTou_point),(4 * j/2 * x,0,0)),rs.MoveObject(rs.CopyObject(ZhuTou_point),(4 * j/2 * x,x,0)),copy=True)



sq_curve1_jinshen = rs.MoveObjects(rs.CopyObjects(sq_curve_or2),(0,-89 *x,358 * x))[1:len(sq_curve_or2)-1]
sq_curve2_jinshen = rs.MoveObjects(rs.CopyObjects(sq_curve_or2),(0,j/2 *x,416.5 * x))[1:len(sq_curve_or2)-1]

sq_curve3_jinshen = rs.CopyObjects(sq_curve2_jinshen)
sq_curve4_jinshen = rs.MoveObjects(rs.CopyObjects(sq_curve_or2),(0,j/2 * x + 105 * x,456.5 * x))[1:len(sq_curve_or2)-1]

sq_curve5_jinshen = rs.CopyObjects(sq_curve4_jinshen)
sq_curve6_jinshen = rs.MoveObjects(rs.CopyObjects(sq_curve_or2),(0,j/2 * x + 210 * x,511.5 * x))[1:len(sq_curve_or2)-1]

sq_curve7_jinshen = rs.CopyObjects(sq_curve6_jinshen)
sq_curve8_jinshen = rs.MoveObjects(rs.CopyObjects(sq_curve_or2),(0,j/2 * x + 315 * x,573.5 * x))[1:len(sq_curve_or2)-1]

sq_curve1_jinshen = sq_curve1_jinshen[::-1]
sq_curve2_jinshen = sq_curve2_jinshen[::-1]
sq_curve3_jinshen = sq_curve3_jinshen[::-1]
sq_curve4_jinshen = sq_curve4_jinshen[::-1]
sq_curve5_jinshen = sq_curve5_jinshen[::-1]
sq_curve6_jinshen = sq_curve6_jinshen[::-1]
sq_curve7_jinshen = sq_curve7_jinshen[::-1]
sq_curve8_jinshen = sq_curve8_jinshen[::-1]


#侧面第一层椽
rs.MoveObjects(sq_curve1_jinshen,(0,-((7.5)/3.46)* x,((7.5)/1.00)*x))
rs.MoveObjects(sq_curve2_jinshen,(0,-((7.5)/3.46)* x,((7.5)/1.00)*x))

rs.MoveObjects(sq_curve1_jinshen,(0,-(87.3)* x,(-26.325)*x))
rs.MoveObjects(sq_curve2_jinshen,(0,-(87.3)* x,(-26.325)*x))

chuan_jinshen = []

for i in range(len(sq_curve1_jinshen)):
    sq_point1 = rs.DivideCurve(sq_curve1_jinshen[i],15)
    sq_point2 = rs.DivideCurve(sq_curve2_jinshen[i],15)
    chuan1 = []
    for y in range(len(sq_point1)):
        chuan1_jinshen_1 = rs.AddLine(sq_point1[y],sq_point2[y])
        rs.MoveObject(chuan1_jinshen_1,(3.25 * x,0,0))
        chuan1_jinshen_1 = rs.ExtrudeCurve(chuan1_jinshen_1,rs.AddLine(rs.AddPoint(0,0,0),rs.AddPoint(-6.5 * x,0,0)))
        chuan1_jinshen_1 = rs.ExtrudeSurface(chuan1_jinshen_1,rs.AddLine(rs.AddPoint(0,0,0),rs.AddPoint(0,0,6.5 * x)))
        chuan_jinshen.append(chuan1_jinshen_1)
    

chuan2_jinshen = rs.MoveObjects(rs.CopyObjects(chuan_jinshen),(7 * x,0,0))


rs.MoveObjects(chuan2_jinshen,(0,(155.2)* x,(46.8)*x))

del(chuan2_jinshen[0])

sq_curve2_trimed_jinshen = rs.RotateObject(sq_curve2_trimed,ZhuTou_point,90,[0,0,x],copy=True)
rs.MoveObject(sq_curve2_trimed_jinshen,(6 *j * x,0,0))

chuan2_jinshen_1 = []

for i in range(len(chuan2_jinshen)):
    chuan2_jinshen_1_1 = rs.BooleanDifference(sq_curve2_trimed_jinshen,chuan2_jinshen[i],delete_input=False)
    chuan2_jinshen_1.append(chuan2_jinshen_1_1[0])
chuan2_jinshen = chuan2_jinshen_1


#第三层椽


rs.MoveObjects(sq_curve3_jinshen,(0,-((7.5)/2.809)* x,((7.5)/1.07)*x))
rs.MoveObjects(sq_curve4_jinshen,(0,-((7.5)/2.809)* x,((7.5)/1.07)*x))

rs.MoveObjects(sq_curve3_jinshen,(0,-(21)* x,-(8)*x))
rs.MoveObjects(sq_curve4_jinshen,(0,(21)* x,(8)*x))

chuan3_jinshen = []
for i in range(len(sq_curve3_jinshen)):
    sq_point3 = rs.DivideCurve(sq_curve3_jinshen[i],15)
    sq_point4 = rs.DivideCurve(sq_curve4_jinshen[i],15)
    chuan_3 = []
    for y in range(len(sq_point3)):
        chuan_3_1 = rs.AddLine(sq_point3[y],sq_point4[y])
        rs.MoveObject(chuan_3_1,(3.25 * x,0,0))
        chuan_3_1 = rs.ExtrudeCurve(chuan_3_1,rs.AddLine(rs.AddPoint(0,0,0),rs.AddPoint(-6.5 * x,0,0)))
        chuan_3_1 = rs.ExtrudeSurface(chuan_3_1,rs.AddLine(rs.AddPoint(0,0,0),rs.AddPoint(0,0,6.5 * x)))
        chuan_3.append(chuan_3_1)
    chuan3_jinshen = chuan3_jinshen + chuan_3

#第四层椽

rs.MoveObjects(sq_curve5_jinshen,(0,-((7.5)/2.15513)* x,((7.5)/1.1288)*x))
rs.MoveObjects(sq_curve6_jinshen,(0,-((7.5)/2.15513)* x,((7.5)/1.1288)*x))

rs.MoveObjects(sq_curve5_jinshen,(0,-(21)* x,-(11)*x))
rs.MoveObjects(sq_curve6_jinshen,(0,(21)* x,(11)*x))

chuan4_jinshen= []
for i in range(len(sq_curve5_jinshen)):
    sq_point4 = rs.DivideCurve(sq_curve5_jinshen[i],15)
    sq_point5 = rs.DivideCurve(sq_curve6_jinshen[i],15)
    chuan_4 = []
    for y in range(len(sq_point5)):
        chuan_4_1 = rs.AddLine(sq_point4[y],sq_point5[y])
        rs.MoveObject(chuan_4_1,(3.25 * x,0,0))
        chuan_4_1 = rs.ExtrudeCurve(chuan_4_1,rs.AddLine(rs.AddPoint(0,0,0),rs.AddPoint(-6.5 * x,0,0)))
        chuan_4_1 = rs.ExtrudeSurface(chuan_4_1,rs.AddLine(rs.AddPoint(0,0,0),rs.AddPoint(0,0,6.5 * x)))
        chuan_4.append(chuan_4_1)
    chuan4_jinshen= chuan4_jinshen+ chuan_4

rs.MoveObjects(chuan4_jinshen,(7 * x,0,0))
del(chuan4_jinshen[0])
#第五层椽



rs.MoveObjects(sq_curve7_jinshen,(0,-((7.5)/1.96675)* x,((7.5)/1.1613)*x))
rs.MoveObjects(sq_curve8_jinshen,(0,-((7.5)/1.96675)* x,((7.5)/1.1613)*x))

rs.MoveObjects(sq_curve7_jinshen,(0,-(21)* x,-(12.4)*x))
rs.MoveObjects(sq_curve8_jinshen,(0,(21)* x,(12.4)*x))


chuan5_jinshen= []
for i in range(len(sq_curve7_jinshen)):
    sq_point7 = rs.DivideCurve(sq_curve7_jinshen[i],15)
    sq_point8 = rs.DivideCurve(sq_curve8_jinshen[i],15)
    chuan_5 = []
    for y in range(len(sq_point7)):
        chuan_5_1 = rs.AddLine(sq_point7[y],sq_point8[y])
        rs.MoveObject(chuan_5_1,(3.25 * x,0,0))
        chuan_5_1 = rs.ExtrudeCurve(chuan_5_1,rs.AddLine(rs.AddPoint(0,0,0),rs.AddPoint(-6.5 * x,0,0)))
        chuan_5_1 = rs.ExtrudeSurface(chuan_5_1,rs.AddLine(rs.AddPoint(0,0,0),rs.AddPoint(0,0,6.5 * x)))
        chuan_5.append(chuan_5_1)
    chuan5_jinshen= chuan5_jinshen+ chuan_5

#进深侧面的椽剪切
rs.MoveObject(chuan_trimed_lateral3,(0,5 * x,0))
rs.MirrorObject(chuan_trimed_lateral3,rs.MoveObject(rs.CopyObject(ZhuTou_point),(2 *j* x,0,0)),rs.MoveObject(rs.CopyObject(ZhuTou_point),(2 *j* x,x,0)),copy=False)

for i in range((int(2))):
    chuan3_jinshen[i] = rs.BooleanUnion([chuan_trimed_lateral3,chuan3_jinshen[i]],delete_input=False)[0]
    chuan3_jinshen[-(i)-1] = rs.MirrorObjects(chuan3_jinshen[i],rs.MoveObject(rs.CopyObject(ZhuTou_point),(4 * j/2 * x,0,0)),rs.MoveObject(rs.CopyObject(ZhuTou_point),(4 * j/2 * x,x,0)),copy=True)[0]

for i in range((int(9))):
    chuan4_jinshen[i] = rs.BooleanUnion([chuan_trimed_lateral3,chuan4_jinshen[i]],delete_input=False)[0]
    chuan4_jinshen[-(i)-1] = rs.MirrorObjects(chuan4_jinshen[i],rs.MoveObject(rs.CopyObject(ZhuTou_point),(4 * j/2 * x,0,0)),rs.MoveObject(rs.CopyObject(ZhuTou_point),(4 * j/2 * x,x,0)),copy=True)[0]

del(chuan5_jinshen[0:7])
del(chuan5_jinshen[int(len(chuan5_jinshen))-7:int(len(chuan5_jinshen))])

for i in range((int(8))):
    chuan5_jinshen[i] = rs.BooleanUnion([chuan_trimed_lateral3,chuan5_jinshen[i]],delete_input=False)[0]
    chuan5_jinshen[-(i)-1] = rs.MirrorObjects(chuan5_jinshen[i],rs.MoveObject(rs.CopyObject(ZhuTou_point),(4 * j/2 * x,0,0)),rs.MoveObject(rs.CopyObject(ZhuTou_point),(4 * j/2 * x,x,0)),copy=True)[0]


#中间剪切
chuan5_jinshen_mid_trimed = rs.ExplodePolysurfaces(rs.CopyObject(chuan5_jinshen[8]))[0]
chuan5_jinshen_mid_trimed = rs.CurveEndPoint(rs.DuplicateEdgeCurves(chuan5_jinshen_mid_trimed)[0])
rs.MoveObject(chuan5_jinshen_mid_trimed,(x,x,20 * x))

chuan5_jinshen_mid_trimed = rs.AddLine(chuan5_jinshen_mid_trimed,rs.MoveObject(rs.CopyObject(chuan5_jinshen_mid_trimed),(-10 * x,0,0)))

chuan5_jinshen_mid_trimed = rs.ExtrudeCurve(chuan5_jinshen_mid_trimed,rs.AddLine(rs.AddPoint(0,0,0),rs.AddPoint(0,-55 * x,0)))

chuan5_jinshen_mid_trimed = rs.ExtrudeSurface(chuan5_jinshen_mid_trimed,rs.AddLine(rs.AddPoint(0,0,0),rs.AddPoint(0,0,-100 * x)))

del(chuan5_jinshen[8])

chuan5_jinshen_mid = rs.BooleanUnion([chuan5_jinshen[8],chuan5_jinshen_mid_trimed],delete_input=False)[0]

chuan5_jinshen[8] = chuan5_jinshen_mid

#转角处的椽




sq_curve1_zj= rs.MoveObject(rs.CopyObject(sq_curve_or[-1]),(-89 * x,0,358 * x))

sq_curve2_zj= rs.MoveObject(rs.CopyObject(sq_curve_or[-1]),(j/2 * x,0,416.5 * x))


sq_curve3_zj = rs.CopyObject(sq_curve2_zj)
sq_curve4_zj = rs.MoveObject(rs.CopyObject(sq_curve_or[-1]),(j/2 * x + 105 * x,0,456.5 * x))

#翼角椽的放射点
yjc_point2 = rs.CurveStartPoint(sq_curve4_zj)
yjc_point1 = rs.CurveStartPoint(sq_curve4_zj)
yjc_point3 = rs.CurveStartPoint(sq_curve1_zj)
yjc_point4 = rs.CurveStartPoint(sq_curve2_zj)

rs.MoveObject(sq_curve1_zj,(-((7.5)/3.46)* x,0,((7.5)/1.00)*x))

rs.MoveObject(sq_curve1_zj,(-(87.3)* x,3.5 * x,(-26.325)*x))

rs.MoveObject(yjc_point1,(-((7.5)/3.46)* x,3.5 * x,((7.5)/1.00)*x))



rs.MoveObject(yjc_point3,(-((7.5)/3.46)* x,3.5 * x,((7.5)/1.00)*x))
rs.MoveObject(yjc_point4,(-((7.5)/3.46)* x,3.5 * x,((7.5)/1.00)*x))

rs.MoveObject(yjc_point3,(-(174.6)* x,0,(-52.65)*x))
#单个檩条
distance = []
yjc_point5 = rs.DivideCurve(sq_curve1_zj,17)
for i in range(len(yjc_point5)):
    yjc_disatnce_cr1 = rs.AddLine(yjc_point2,yjc_point5[i])
    disantce1 = rs.Distance(rs.CurveStartPoint(yjc_disatnce_cr1),rs.CurveEndPoint(yjc_disatnce_cr1))
    distance.append(disantce1)
yjc_face = rs.AddLine(yjc_point1,rs.MoveObject(rs.CopyObject(yjc_point1),(0,-7 * x,0)))
yjc_face = rs.ExtrudeCurve(yjc_face,rs.AddLine(rs.AddPoint(0,0,0),rs.AddPoint(0,0,7 * x)))
rs.RotateObject(yjc_face,yjc_point2,16.78,[0,x,0],copy=False)
rs.MoveObject(yjc_face,(0,0,-4*x))
yjc_breps = []

for i in range(len(distance)):
    distance[i] = distance[i] - math.cos(i/(len(distance) * 32)) * 200*x * 1 +160 * x

distance[-1] = distance[-1] + 10 * x
distance[-2] = distance[-2] + 3 * x
distance[-3] = distance[-3] - 2* x
distance[-4] = distance[-4] - 6 * x
distance[-5] = distance[-5] - 8 * x
distance[-6] = distance[-6] - 11 * x
distance[-7] = distance[-7] - 11 * x
distance[-8] = distance[-8] - 11 * x
distance[-9] = distance[-9] - 10 * x
distance[-10] = distance[-10] - 7 * x
distance[-11] = distance[-11] - 6 * x
distance[0] = distance[0] +0 * x
distance[1] = distance[1] + 1 * x
distance[2] = distance[2] + 1.5 * x
distance[3] = distance[3] + 1 * x
distance[4] = distance[4] + 0 * x
distance[5] = distance[5] - 2 * x
distance[6] = distance[6] - 4 * x

for i in range(len(yjc_point5)):
    yjc_breps1 = rs.ExtrudeSurface(yjc_face,rs.AddLine(rs.AddPoint(0,0,0),rs.AddPoint(-distance[i] ,0,0)))
    rs.RotateObject(yjc_breps1,yjc_point1,-18.1,[0,x,0],copy=False)
    rs.RotateObject(yjc_breps1,yjc_point2,(-math.cos(i/34) * 3* x + 3 * x),[0,x,0],copy=False)
    yjc_breps.append(yjc_breps1)

for i in range(len(yjc_breps)):
    rs.RotateObject(yjc_breps[i],yjc_point2,44.05/17 * (i),copy=False)

#面扩第一层椽剪切

chuan_trimed_front = rs.ExplodePolysurfaces(yjc_breps[0])[1]
chuan_trimed_front = rs.CurveEndPoint(rs.DuplicateEdgeCurves(chuan_trimed_front)[2])
rs.MoveObject(chuan_trimed_front,(0,-x,-50 * x))

chuan_trimed_front = rs.AddLine(chuan_trimed_front,rs.MoveObject(rs.CopyObject(chuan_trimed_front),(0,0,240  * x)))

chuan_trimed_front = rs.ExtrudeCurve(chuan_trimed_front,rs.AddLine(rs.AddPoint(0,0,0),rs.AddPoint(-50 * x,0,0)))
chuan_trimed_front = rs.ExtrudeSurface(chuan_trimed_front,rs.AddLine(rs.AddPoint(0,0,0),rs.AddPoint(0,MianKuo * MianKuo_length * x,0)))

chuan_trimed_jinshen = rs.MirrorObject(chuan_trimed_front,yjc_point2,rs.MoveObject(rs.CopyObject(yjc_point2),(-x,-x,0)),copy=True)

for i in range(len(chuan_jinshen)):
    chuan_jinshen[i] = rs.BooleanUnion([chuan_jinshen[i],chuan_trimed_jinshen],delete_input=False)[0]
del(chuan_jinshen[0])
del(chuan_jinshen[-1])

for i in range(len(chuan)):
    chuan[i] = rs.BooleanDifference(chuan[i],chuan_trimed_front,delete_input=False)[0]
del(chuan[0])
del(chuan[-1])


yjc_trimed = rs.ExplodePolysurfaces(chuan2[0])[0]
yjc_trimed = rs.DuplicateEdgeCurves(yjc_trimed)[3]
yjc_trimed = rs.ExtrudeCurve(yjc_trimed,rs.AddLine(rs.AddPoint(0,0,0),rs.AddPoint(0,-250 * x,0)))
yjc_trimed = rs.ExtrudeSurface(yjc_trimed,rs.AddLine(rs.AddPoint(0,0,0),rs.AddPoint(0,0,50 * x)))

rs.MoveObjects(yjc_trimed,(39 *x,0,0))

yjc_trimed2 =  rs.ExplodePolysurfaces(yjc_trimed)[2]
yjc_trimed2  = rs.DuplicateEdgeCurves(yjc_trimed2)[2]
rs.MoveObject(yjc_trimed2,(-39 *x,0,0))
yjc_trimed2 = rs.ExtrudeCurve(yjc_trimed2,rs.AddLine(rs.AddPoint(0,0,0),rs.AddPoint(-250 * x,0,0)))
yjc_trimed2 = rs.ExtrudeSurface(yjc_trimed2,rs.AddLine(rs.AddPoint(0,0,0),rs.AddPoint(0,0,-150 * x)))

yjc_breps2 = []
for i in range(len(yjc_breps)):
    yjc_breps2_1 = rs.BooleanDifference(yjc_trimed2,yjc_breps[i],delete_input=False)[0]
    yjc_breps2.append(yjc_breps2_1)

for i in range(len(yjc_breps)):
    yjc_breps[i] = rs.BooleanDifference(yjc_trimed,yjc_breps[i],delete_input=False)[1]
rs.RotateObjects(yjc_breps2,yjc_point2,44.05/34,copy=False)
rs.RotateObjects(yjc_breps2,yjc_point2,-0.1,[0,x,0],copy=False)

del(yjc_breps2[-1])

########

yjc_trimed3 = rs.AddLine(ZhuTou_point,rs.MoveObject(rs.CopyObject(ZhuTou_point),(-4 * j * x,0,0)))
yjc_trimed3 = rs.ExtrudeCurve(yjc_trimed3,rs.AddLine(rs.AddPoint(0,0,0),rs.AddPoint(0,-500 * x,0)))
yjc_trimed3 = rs.ExtrudeSurface(yjc_trimed3,rs.AddLine(rs.AddPoint(0,0,0),rs.AddPoint(0,0,1000 * x)))
rs.MoveObject(yjc_trimed3,(600 * x,5 * x,0))
rs.RotateObject(yjc_trimed3,ZhuTou_point,45,[0,0,x],copy=False)

yjc_breps[-1] = rs.BooleanIntersection(yjc_trimed3,yjc_breps[-1],delete_input=False)[0]

yjc_breps2[-1] = rs.BooleanIntersection(yjc_trimed3,yjc_breps2[-1],delete_input=False)[0]
yjc_breps2[-2] = rs.BooleanIntersection(yjc_trimed3,yjc_breps2[-2],delete_input=False)[0]
yjc_breps2[-3] = rs.BooleanIntersection(yjc_trimed3,yjc_breps2[-3],delete_input=False)[0]
yjc_breps2[-4] = rs.BooleanIntersection(yjc_trimed3,yjc_breps2[-4],delete_input=False)[0]
yjc_breps2[-5] = rs.BooleanIntersection(yjc_trimed3,yjc_breps2[-5],delete_input=False)[0]
yjc_breps2[-6] = rs.BooleanIntersection(yjc_trimed3,yjc_breps2[-6],delete_input=False)[0]
yjc_breps2[-7] = rs.BooleanIntersection(yjc_trimed3,yjc_breps2[-7],delete_input=False)[0]
yjc_breps2[-8] = rs.BooleanIntersection(yjc_trimed3,yjc_breps2[-8],delete_input=False)[0]
yjc_breps2[-9] = rs.BooleanIntersection(yjc_trimed3,yjc_breps2[-9],delete_input=False)[0]
yjc_breps2[-10] = rs.BooleanIntersection(yjc_trimed3,yjc_breps2[-10],delete_input=False)[0]
yjc_breps2[-11] = rs.BooleanIntersection(yjc_trimed3,yjc_breps2[-11],delete_input=False)[0]

rs.RotateObjects(yjc_breps,rs.MoveObject(rs.CopyObject(yjc_point2),(-210 * x,0,-40)),1.25,[0,x,0],copy=False)

yjc_breps_jinshen = rs.MirrorObjects(yjc_breps,yjc_point2,rs.MoveObject(rs.CopyObject(yjc_point2),(-x,-x,0)),copy=True)

yjc_breps_jinshen2 = rs.MirrorObjects(yjc_breps2,yjc_point2,rs.MoveObject(rs.CopyObject(yjc_point2),(-x,-x,0)),copy=True)

wb_points2 = []
for i in range(len(yjc_breps)):
    wb_points2_1 = rs.ExplodePolysurfaces(yjc_breps[i])[4]
    wb_points2_1 = rs.CurveEndPoint(rs.DuplicateEdgeCurves(wb_points2_1)[2])
    rs.MoveObject(wb_points2_1,(0,3.5 * x,0))
    wb_points2.append(wb_points2_1)
rs.MoveObject(wb_points2[0],(1.2*x,0,0))

wb_points2= wb_points2[::-1]

wb_points3 = rs.MirrorObjects(wb_points2,rs.MoveObject(rs.CopyObject(ZhuTou_point),(0,(MianKuo_length * (MianKuo - 2) * x + 2 * j * x)/2 ,0)),rs.MoveObject(rs.CopyObject(ZhuTou_point),(x,(MianKuo_length * (MianKuo - 2) * x + 2 * j * x)/2 ,0)),copy=True)

wb_points3= wb_points3[::-1]



rs.RotateObjects(yjc_breps_jinshen[0: len(yjc_breps_jinshen)-2] ,rs.MoveObject(rs.CopyObject(yjc_point2),(-210 * x,-40,0)),-0.4,[x,0,0],copy=False)

rs.RotateObjects(yjc_breps_jinshen2,yjc_point2,-0.1,[x,0,0],copy=False)

yjc_breps = yjc_breps + yjc_breps2 + yjc_breps_jinshen + yjc_breps_jinshen2


yjc_breps_houyan = rs.MirrorObjects(yjc_breps,rs.MoveObject(rs.CopyObject(ZhuTou_point),(4 * j/2 * x,0,0)),rs.MoveObject(rs.CopyObject(ZhuTou_point),(4 * j/2 * x,x,0)),copy=True)

yjc_breps = yjc_breps + yjc_breps_houyan

yjc_breps_left  = rs.MirrorObjects(yjc_breps,rs.MoveObject(rs.CopyObject(ZhuTou_point),(0,(MianKuo_length * (MianKuo - 2) * x + 2 * j * x)/2 ,0)),rs.MoveObject(rs.CopyObject(ZhuTou_point),(x,(MianKuo_length * (MianKuo - 2) * x + 2 * j * x)/2 ,0)),copy=True)

yjc_breps = yjc_breps + yjc_breps_left


chuans = chuan + chuan2 +chuan3 +chuan4+chuan5

chuans_houyan = rs.MirrorObjects(chuans,rs.MoveObject(rs.CopyObject(ZhuTou_point),(4 * j/2 * x,0,0)),rs.MoveObject(rs.CopyObject(ZhuTou_point),(4 * j/2 * x,x,0)),copy=True)

chuans = chuans + chuans_houyan

chuans_jinshen = chuan_jinshen+chuan2_jinshen+chuan3_jinshen+chuan4_jinshen+chuan5_jinshen


chuans_jinshen_left  = rs.MirrorObjects(chuans_jinshen,rs.MoveObject(rs.CopyObject(ZhuTou_point),(0,(MianKuo_length * (MianKuo - 2) * x + 2 * j * x)/2 ,0)),rs.MoveObject(rs.CopyObject(ZhuTou_point),(x,(MianKuo_length * (MianKuo - 2) * x + 2 * j * x)/2 ,0)),copy=True)

chuans_jinshen = chuans_jinshen +chuans_jinshen_left



#望板生成

#望板出檐曲线

wb_points = []
for i in range(len(chuan)):
    wb_points_1 = rs.ExplodePolysurfaces(chuan[i])[4]
    wb_points_1 = rs.CurveEndPoint(rs.DuplicateEdgeCurves(wb_points_1)[2])
    rs.MoveObject(wb_points_1,(0,3.5 * x,0))
    wb_points.append(wb_points_1)



wb_cr1 = rs.AddPolyline(wb_points)
wb_cr2 = rs.MoveObject(rs.CopyObject(wb_cr1 ),(240 * x,0,71 * x))
wb_cr3 = rs.MoveObject(rs.CopyObject(wb_cr2 ),(122.8 * x,0,50 * x))
wb_cr4 = rs.MoveObject(rs.CopyObject(wb_cr3 ),(92.5 * x,0,49.5 * x))
wb_cr5 = rs.MoveObject(rs.CopyObject(wb_cr4 ),(100 * x,0,59 * x))

rs.RebuildCurve(wb_cr1)

rs.MoveObject(wb_cr1,(-1.94 *x,0,-0.585 * x))



rs.MoveObject(wb_cr2,(0,0,1.6 * x))
wb1 = rs.AddLoftSrf([wb_cr1,wb_cr2])

wb1 = rs.ExtrudeSurface(wb1,rs.AddLine(rs.AddPoint(0,0,0),rs.AddPoint(0,0,10  * x)))

wb2 = rs.AddLoftSrf([wb_cr2,wb_cr3])

wb2 = rs.ExtrudeSurface(wb2,rs.AddLine(rs.AddPoint(0,0,0),rs.AddPoint(0,0,10 * x)))

wb3 = rs.AddLoftSrf([wb_cr3,wb_cr4])

wb3 = rs.ExtrudeSurface(wb3,rs.AddLine(rs.AddPoint(0,0,0),rs.AddPoint(0,0,10 * x)))

wb4 = rs.AddLoftSrf([wb_cr4,wb_cr5])

wb4 = rs.ExtrudeSurface(wb4,rs.AddLine(rs.AddPoint(0,0,0),rs.AddPoint(0,0,10 * x)))


chuan_trimed_lateral2 = rs.MirrorObject(chuan_trimed_lateral,rs.MoveObject(rs.CopyObject(ZhuTou_point),(0,(MianKuo_length * (MianKuo - 2) * x + 2 * j * x)/2 ,0)),rs.MoveObject(rs.CopyObject(ZhuTou_point),(x,(MianKuo_length * (MianKuo - 2) * x + 2 * j * x)/2 ,0)),copy=True)


wb3 = rs.BooleanDifference(chuan_trimed_lateral2,wb3,delete_input=False)
wb3 = rs.BooleanIntersection(chuan_trimed_lateral,wb3,delete_input=False)

wb4 = rs.BooleanDifference(chuan_trimed_lateral2,wb4,delete_input=False)
wb4 = rs.BooleanIntersection(chuan_trimed_lateral,wb4,delete_input=False)

wb_points2.append(wb_points[0])

#############################################
rs.MoveObject(wb_points2[0],(-6*x,-21 *x,14 *x))
rs.MoveObject(wb_points2[1],(-3*x,-14 * x,4 *x))
rs.MoveObject(wb_points2[2],(0,0,2 *x))
rs.MoveObject(wb_points2[3],(0,0,3 *x))
rs.MoveObject(wb_points2[4],(0,0,1 *x))
rs.MoveObject(wb_points2[5],(0,0,1 *x))
rs.MoveObject(wb_points2[6],(0,0,1 *x))
rs.MoveObject(wb_points2[9],(0,0,2 *x))
rs.MoveObject(wb_points2[10],(0,0,1 *x))
rs.MoveObject(wb_points2[11],(0,0,1 *x))
rs.MoveObjects(wb_points2[11:18],(0,0,1 *x))
wb_jinjian_cr1 = rs.AddInterpCurve(wb_points2)


rs.RebuildCurve(wb_jinjian_cr1,degree=3,point_count=8)


wb_jinjian_cr2 = rs.MoveObject(rs.CopyObject(wb_jinjian_cr1 ),(240 * x,0,72.5 * x))
rs.ScaleObject(wb_jinjian_cr2,rs.CurveEndPoint(wb_jinjian_cr2 ),[1,1,2],copy=False)

wb_jinjian_cr3 = rs.MoveObject(rs.CopyObject(wb_jinjian_cr2 ),(122.8 * x,0,48.5 * x))
rs.MoveObject(wb_jinjian_cr1,(-1.94 *x,0,-0.585 * x))
wb1_jinjian = rs.AddLoftSrf([wb_jinjian_cr1,wb_jinjian_cr2])

wb1_jinjian = rs.ExtrudeSurface(wb1_jinjian,rs.AddLine(rs.AddPoint(0,0,0),rs.AddPoint(0,0,10  * x)))

wb2_jinjian = rs.AddLoftSrf([wb_jinjian_cr2,wb_jinjian_cr3])

wb2_jinjian = rs.ExtrudeSurface(wb2_jinjian,rs.AddLine(rs.AddPoint(0,0,0),rs.AddPoint(0,0,10  * x)))

wb1_jinjian = rs.BooleanDifference(rs.MoveObject(rs.CopyObject(chuan_trimed_lateral),(-j *x,-j *x,0)),wb1_jinjian,delete_input=False)
wb2_jinjian = rs.BooleanDifference(rs.MoveObject(rs.CopyObject(chuan_trimed_lateral),(-j *x,-j *x,0)),wb2_jinjian,delete_input=False)[0]






#进深方向的望板

wb_jinshen_points = []
for i in range(len(chuan_jinshen)):
    wb_jinshen_points_1 = rs.ExplodePolysurfaces(chuan_jinshen[i])[4]
    wb_jinshen_points_1 = rs.CurveEndPoint(rs.DuplicateEdgeCurves(wb_jinshen_points_1)[2])
    rs.MoveObject(wb_jinshen_points_1,(3.5 * x,0,0))
    wb_jinshen_points.append(wb_jinshen_points_1)

wb_jinshen_cr1 = rs.AddInterpCurve(wb_jinshen_points)
rs.RebuildCurve(wb_jinshen_cr1)

wb_jinshen_cr2 = rs.MoveObject(rs.CopyObject(wb_jinshen_cr1 ),(0,240 * x,72.5 * x))
wb_jinshen_cr3 = rs.MoveObject(rs.CopyObject(wb_jinshen_cr2 ),(0,122.8 * x,47.1 * x))
wb_jinshen_cr4 = rs.MoveObject(rs.CopyObject(wb_jinshen_cr3 ),(0,92.5 * x,52.3 * x))
wb_jinshen_cr5 = rs.MoveObject(rs.CopyObject(wb_jinshen_cr4 ),(0,100 * x,60.2 * x))
rs.MoveObject(wb_jinshen_cr1,(0,-1.94 *x,-0.585 * x))

wb_jinshen1 = rs.AddLoftSrf([wb_jinshen_cr1,wb_jinshen_cr2])

wb_jinshen1 = rs.ExtrudeSurface(wb_jinshen1,rs.AddLine(rs.AddPoint(0,0,0),rs.AddPoint(0,0,10  * x)))

wb_jinshen2 = rs.AddLoftSrf([wb_jinshen_cr2,wb_jinshen_cr3])

wb_jinshen2 = rs.ExtrudeSurface(wb_jinshen2,rs.AddLine(rs.AddPoint(0,0,0),rs.AddPoint(0,0,10 * x)))

wb_jinshen3 = rs.AddLoftSrf([wb_jinshen_cr3,wb_jinshen_cr4])

wb_jinshen3 = rs.ExtrudeSurface(wb_jinshen3,rs.AddLine(rs.AddPoint(0,0,0),rs.AddPoint(0,0,10 * x)))

wb_jinshen4 = rs.AddLoftSrf([wb_jinshen_cr4,wb_jinshen_cr5])

wb_jinshen4 = rs.ExtrudeSurface(wb_jinshen4,rs.AddLine(rs.AddPoint(0,0,0),rs.AddPoint(0,0,10 * x)))
rs.MoveObject(chuan_trimed_lateral3,(x,x,0))
chuan_trimed_lateral4 = rs.MirrorObjects(chuan_trimed_lateral3,rs.MoveObject(rs.CopyObject(ZhuTou_point),(4 * j/2 * x,0,0)),rs.MoveObject(rs.CopyObject(ZhuTou_point),(4 * j/2 * x,x,0)),copy=True)

wb_jinshen2 = rs.BooleanUnion([chuan_trimed_lateral3,wb_jinshen2],delete_input=False)
wb_jinshen2 = rs.BooleanUnion([chuan_trimed_lateral4,wb_jinshen2],delete_input=False)


wb_jinshen3 = rs.BooleanUnion([chuan_trimed_lateral3,wb_jinshen3],delete_input=False)
wb_jinshen3 = rs.BooleanUnion([chuan_trimed_lateral4,wb_jinshen3],delete_input=False)

wb_jinshen4 = rs.BooleanUnion([chuan_trimed_lateral3,wb_jinshen4],delete_input=False)
wb_jinshen4 = rs.BooleanUnion([chuan_trimed_lateral4,wb_jinshen4],delete_input=False)
#######进深方向尽间网板
wb_jinshen_points2 = rs.MirrorObjects(wb_points2,ZhuTou_point,rs.MoveObject(rs.CopyObject(ZhuTou_point),(j*x,j*x,0)),copy=True)

rs.MoveObjects(wb_jinshen_points2[1:19],(0,0,1.5 * x))
rs.MoveObjects(wb_jinshen_points2[3:12],(0,0,1.5 * x))
rs.MoveObjects(wb_jinshen_points2[3:5],(0,0,2 * x))

rs.MoveObject(wb_jinshen_points2[9],(0,0,1.5 * x))
rs.MoveObject(wb_jinshen_points2[10],(0,0,1.5 * x))
rs.MoveObject(wb_jinshen_points2[11],(0,0,1.5* x))
rs.MoveObject(wb_jinshen_points2[12],(0,0,1* x))
rs.MoveObject(wb_jinshen_points2[13],(0,0,1* x))


wb_jinshen_trimed = rs.CopyObject(wb_jinshen_points2[-1])
wb_jinshen_trimed = rs.AddLine(wb_jinshen_trimed,rs.MoveObject(rs.CopyObject(wb_jinshen_trimed),(0,2 * x * j,0)))
wb_jinshen_trimed = rs.ExtrudeCurve(wb_jinshen_trimed,rs.AddLine(rs.AddPoint(0,0,0),rs.AddPoint(0,0,500 * x)))
wb_jinshen_trimed = rs.ExtrudeSurface(wb_jinshen_trimed,rs.AddLine(rs.AddPoint(0,0,0),rs.AddPoint(-500 * x,0,0)))

rs.MoveObject(wb_jinshen_trimed,(0,-5 * x,-20 * x))
wb_jinshen_trimed2 = rs.MirrorObjects(wb_jinshen_trimed,rs.MoveObject(rs.CopyObject(ZhuTou_point),(4 * j/2 * x,0,0)),rs.MoveObject(rs.CopyObject(ZhuTou_point),(4 * j/2 * x,x,0)),copy=True)

wb_jinshen1 = rs.BooleanUnion([wb_jinshen_trimed,wb_jinshen1],delete_input=False)
wb_jinshen1 = rs.BooleanUnion([wb_jinshen_trimed2,wb_jinshen1],delete_input=False)

wb_jinshen2 = rs.BooleanUnion([wb_jinshen_trimed,wb_jinshen2],delete_input=False)
wb_jinshen2 = rs.BooleanUnion([wb_jinshen_trimed2,wb_jinshen2],delete_input=False)

wb_jinshen_jinjian_cr1 = rs.AddInterpCurve(wb_jinshen_points2)


rs.RebuildCurve(wb_jinshen_jinjian_cr1,degree=3,point_count=8)

wb_jinshen_points2_2 = rs.MoveObjects(rs.CopyObjects(wb_jinshen_points2),(0,240 * x,72.3 * x))






rs.MoveObject(wb_jinshen_jinjian_cr1,(0,-1.94 *x,-0.585 * x))
rs.ScaleObjects(wb_jinshen_points2_2,wb_jinshen_points2_2[-1],[1,1,0.3],copy=False)

rs.MoveObjects(wb_jinshen_points2_2[0:9],(0,0,3 * x))
rs.MoveObjects(wb_jinshen_points2_2[0:6],(0,0,4 * x))
rs.MoveObject(wb_jinshen_points2_2[6],(0,0,1.5 * x))
rs.MoveObject(wb_jinshen_points2_2[7],(0,0,1 * x))
rs.MoveObject(wb_jinshen_points2_2[0],(0,0,1 * x))
rs.MoveObjects(wb_jinshen_points2_2[1:3],(0,0,6 * x))
rs.MoveObject(wb_jinshen_points2_2[3],(0,0,4 * x))
rs.MoveObject(wb_jinshen_points2_2[4],(0,0,2 * x))
rs.MoveObject(wb_jinshen_points2_2[9],(0,0,0.5 * x))

wb_jinshen_points2_3 = rs.MoveObjects(rs.CopyObjects(wb_jinshen_points2_2),(0,122.8 * x,47.2 * x))

rs.MoveObjects(wb_jinshen_points2_3[9:18],(0,0,1 * x))
rs.MoveObject(wb_jinshen_points2_3[11],(0,0,-6* x))
rs.MoveObject(wb_jinshen_points2_3[12],(0,0,-2.2* x))
rs.MoveObject(wb_jinshen_points2_3[13],(0,0,-2* x))
rs.MoveObject(wb_jinshen_points2_3[14],(0,0,-0.5* x))
rs.MoveObject(wb_jinshen_points2_3[15],(0,0,-0.8* x))
rs.MoveObject(wb_jinshen_points2_3[16],(0,0,-0.7* x))
rs.MoveObject(wb_jinshen_points2_3[17],(0,0,-0.3* x))

wb_jinshen_jinjian_cr2 = rs.AddInterpCurve(wb_jinshen_points2_2 )



wb_jinshen_jinjian_cr3 = rs.AddInterpCurve(wb_jinshen_points2_3)


wb_jinshen1_jinjian = rs.AddLoftSrf([wb_jinshen_jinjian_cr1,wb_jinshen_jinjian_cr2])

wb_jinshen1_jinjian = rs.ExtrudeSurface(wb_jinshen1_jinjian,rs.AddLine(rs.AddPoint(0,0,0),rs.AddPoint(0,0,10  * x)))

wb_jinshen2_jinjian = rs.AddLoftSrf([wb_jinshen_jinjian_cr2,wb_jinshen_jinjian_cr3])


wb_jinshen2_jinjian = rs.ExtrudeSurface(wb_jinshen2_jinjian,rs.AddLine(rs.AddPoint(0,0,0),rs.AddPoint(0,0,10  * x)))

wb_jinshen1_jinjian = rs.BooleanDifference(wb_jinshen1_jinjian,rs.MoveObject(rs.CopyObject(chuan_trimed_lateral4),(-j*x,-j*x,0)),delete_input=False)
wb_jinshen2_jinjian = rs.BooleanDifference(wb_jinshen2_jinjian,rs.MoveObject(rs.CopyObject(chuan_trimed_lateral4),(-j*x,-j*x,0)),delete_input=False)[0]

wb_jinjian = [wb1_jinjian[0],wb2_jinjian,wb_jinshen1_jinjian[0],wb_jinshen2_jinjian]

wb_jinjian_houyan = rs.MirrorObjects(wb_jinjian,rs.MoveObject(rs.CopyObject(ZhuTou_point),(4 * j/2 * x,0,0)),rs.MoveObject(rs.CopyObject(ZhuTou_point),(4 * j/2 * x,x,0)),copy=True)

wb_jinjian = wb_jinjian + wb_jinjian_houyan
wb_jinjian_left  = rs.MirrorObjects(wb_jinjian,rs.MoveObject(rs.CopyObject(ZhuTou_point),(0,(MianKuo_length * (MianKuo - 2) * x + 2 * j * x)/2 ,0)),rs.MoveObject(rs.CopyObject(ZhuTou_point),(x,(MianKuo_length * (MianKuo - 2) * x + 2 * j * x)/2 ,0)),copy=True)

wb_jinjian = wb_jinjian_left + wb_jinjian


wb_miankuo = [wb1,wb2,wb3[0],wb4[0]]
wb_miankuo_houyan = rs.MirrorObjects(wb_miankuo,rs.MoveObject(rs.CopyObject(ZhuTou_point),(4 * j/2 * x,0,0)),rs.MoveObject(rs.CopyObject(ZhuTou_point),(4 * j/2 * x,x,0)),copy=True)
wb_miankuo = wb_miankuo + wb_miankuo_houyan

wb_jinshen = [wb_jinshen1[0],wb_jinshen2[0],wb_jinshen3[0],wb_jinshen4[0]]

wb_jinshen_left  = rs.MirrorObjects(wb_jinshen,rs.MoveObject(rs.CopyObject(ZhuTou_point),(0,(MianKuo_length * (MianKuo - 2) * x + 2 * j * x)/2 ,0)),rs.MoveObject(rs.CopyObject(ZhuTou_point),(x,(MianKuo_length * (MianKuo - 2) * x + 2 * j * x)/2 ,0)),copy=True)

wb_jinshen = wb_jinshen_left + wb_jinshen
# ---------- end 斗拱编辑器_2 ----------
斗拱编辑器_3 = Python3Script(
    CaiFen=number_slider_2,
    HuaGong_CaiFen_left=number_slider_13,
    HuaGong_CaiFen_right=number_slider_11,
    NiDaoGong_CaiFen_left=number_slider_14,
    NiDaoGong_CaiFen_right=number_slider_14,
    MianKuo=number_slider_3)  # -> roof_jia; inputs CaiFen: Int32
# ---------- 斗拱编辑器_3: Python ----------
#佛光寺东大殿柱基
#每一跳为21分
import rhinoscriptsyntax as rs
import Rhino.Geometry as rg
import itertools as it
import math
#材分可调变量x
x = CaiFen
#柱头点
ZhuTou_point = rs.AddPoint(HuaGong_CaiFen_left * x,5 *x,0)
#原点
BasePoint = 0
pt_o = rs.AddPoint(BasePoint * 500,0,0)
#进深为14倍材广,一材广为15材分(j的单位为分)
j = 14 * 15
MianKuo_length = 16 * 15

#   面扩七开间，五进深,明间为16倍材广为240分，除了尽间，面阔皆为240分，尽间面扩为210分。进深开间 = 尽间开间也为210分
if (MianKuo % 2 == 0) | (MianKuo < 5):
    raise ValueError(f"开间最小数不能低于5,且为单数")

zhu_pt1 = rs.CopyObject(ZhuTou_point)
rs.MoveObject(zhu_pt1,(0,j * x,0))
zhu_pt2 = rs.CopyObject(zhu_pt1,(0,MianKuo_length * (MianKuo - 2) * x,0))
zhu_cr = rs.AddLine(zhu_pt1,zhu_pt2)
zhutou_pt = rs.DivideCurve(zhu_cr,MianKuo-2)
zhu_pt3 = rs.CopyObject(ZhuTou_point)
zhu_pt4 =rs.MoveObject(rs.CopyObject(zhutou_pt[-1]),(0, j * x,0))
zhutou_pt.insert(0,zhu_pt3)
zhutou_pt.append(zhu_pt4)
zhutou_pt2 = rs.MoveObjects(rs.CopyObjects(zhutou_pt),(j * x,0,0))

zhutou_pt3 = rs.MoveObjects(rs.CopyObjects(zhutou_pt2[0:2] ),(j * x,0,0))

zhutou_pt3_1 = rs.MoveObjects(rs.CopyObjects(zhutou_pt2[len(zhutou_pt2)-2:len(zhutou_pt2)] ),(j * x,0,0))

zhutou_pt3 = zhutou_pt3 + zhutou_pt3_1

zhutou_pt4 = rs.MoveObjects(rs.CopyObjects(zhutou_pt2),(2 * j * x,0,0))

zhutou_pt5 = rs.MoveObjects(rs.CopyObjects(zhutou_pt2),(3 * j * x,0,0))


#柱高
#当心间的柱高为237.5分

#生起的规律

zhutou_pt_up =rs.CopyObjects(zhutou_pt)
rs.MoveObjects(zhutou_pt_up,(0,0,237.5 * x))

zhutou_pt_up2 =rs.CopyObjects(zhutou_pt2)
rs.MoveObjects(zhutou_pt_up2,(0,0,237.5 * x))

zhutou_pt_up3 =rs.CopyObjects(zhutou_pt3)
rs.MoveObjects(zhutou_pt_up3,(0,0,237.5 * x))

if MianKuo > 5:
    #前檐
    rs.MoveObjects([zhutou_pt_up[0],zhutou_pt_up[-1]],(0,0,10.5 * x))
    rs.MoveObjects([zhutou_pt_up[1],zhutou_pt_up[-2]],(0,0,6 * x))
    rs.MoveObjects([zhutou_pt_up[2],zhutou_pt_up[-3]],(0,0,2.5 * x))
    #内檐
    rs.MoveObjects([zhutou_pt_up2[0],zhutou_pt_up2[-1]],(0,0,7.5 * x))
    rs.MoveObjects([zhutou_pt_up2[1],zhutou_pt_up2[-2]],(0,0,5 * x))
    rs.MoveObjects([zhutou_pt_up2[2],zhutou_pt_up2[-3]],(0,0,2.5 * x))
    #中柱
    rs.MoveObjects([zhutou_pt_up3[1],zhutou_pt_up3[-2]],(0,0, 2.5* x))
 
else: 
    #前檐
    rs.MoveObjects([zhutou_pt_up[0],zhutou_pt_up[-1]],(0,0,6 * x))
    rs.MoveObjects([zhutou_pt_up[1],zhutou_pt_up[-2]],(0,0,2.5 * x))
    #内檐
    rs.MoveObjects([zhutou_pt_up2[0],zhutou_pt_up2[-1]],(0,0,5 * x))
    rs.MoveObjects([zhutou_pt_up2[1],zhutou_pt_up2[-2]],(0,0,2.5 * x))



zhutou_pt_up4 = rs.CopyObjects(zhutou_pt_up2,(2 * j * x,0,0))
zhutou_pt_up5 = rs.CopyObjects(zhutou_pt_up,(4 * j * x,0,0))



# 阑额生成,佛光寺东大殿阑额高度也就是15分，厚度为10分，长度至两柱的柱中心

# 生起曲线

le_breps = []
le_brep_trimed_g = []
le_trimed2 = rs.CopyObjects(zhutou_pt_up[0:len(zhutou_pt_up)-1])
rs.MoveObjects(le_trimed2,(0,0,0))
le_trimed1 = rs.CopyObjects(zhutou_pt_up[1:len(zhutou_pt_up)])
rs.MoveObjects(le_trimed1,(0,0,0))
sq_cr = rs.AddInterpCurve(zhutou_pt_up)
sq_sr = rs.ExtrudeCurve(sq_cr,rs.AddLine(rs.AddPoint(0,0,0),rs.AddPoint(5 * x,0,0)))

sq_curves = []
for i in range(len(le_trimed1)):
    cr1 = rs.AddLine(le_trimed1[i],le_trimed2[i])
    rs.MoveObject(cr1,(5 * x,0,21 * x))
    cr1 = rs.ProjectCurveToSurface(cr1,sq_sr,[0,0,x])

    sq_curves.append(cr1[0])

    le_brep = rs.ExtrudeCurve(cr1,rs.AddLine(rs.AddPoint(0,0,0),rs.AddPoint(-10 * x ,0,0)))
    le_brep = rs.ExtrudeSurface(le_brep,rs.AddLine(rs.AddPoint(0,0,0),rs.AddPoint(0 ,0,-15 * x)))
    
    le_brep_trimed = rs.ExtrudeCurve(cr1,rs.AddLine(rs.AddPoint(0,0,0),rs.AddPoint(-10 * x ,0,0)))
    le_brep_trimed = rs.ExtrudeSurface(le_brep_trimed,rs.AddLine(rs.AddPoint(0,0,0),rs.AddPoint(0 ,0,-22 * x)))
    rs.MoveObject(le_brep_trimed,(0,0,5 * x))
    le_brep_trimed_g.append(le_brep_trimed)

rs.MoveObjects(le_brep_trimed_g,(0,0,130 * x))


#第五层素枋上的拱眼壁
rs.ScaleObjects(le_brep_trimed_g,ZhuTou_point,[0.8,1,1],copy=False)

#压槽枋
# 生起曲线

ycf_breps = []
ycf_trimed2 = rs.CopyObjects(zhutou_pt_up[0:len(zhutou_pt_up)-1])
rs.MoveObjects(ycf_trimed2,(0,0,0))
ycf_trimed1 = rs.CopyObjects(zhutou_pt_up[1:len(zhutou_pt_up)])
rs.MoveObjects(ycf_trimed1,(0,0,0))
sq_cr = rs.AddInterpCurve(zhutou_pt_up)
sq_sr = rs.ExtrudeCurve(sq_cr,rs.AddLine(rs.AddPoint(0,0,0),rs.AddPoint(5 * x,0,0)))

sq_curves = []
for i in range(len(ycf_trimed1)):
    cr1 = rs.AddLine(ycf_trimed1[i],ycf_trimed2[i])
    rs.MoveObject(cr1,(5 * x,0,21 * x))
    cr1 = rs.ProjectCurveToSurface(cr1,sq_sr,[0,0,x])

    sq_curves.append(cr1[0])

    ycf_brep = rs.ExtrudeCurve(cr1,rs.AddLine(rs.AddPoint(0,0,0),rs.AddPoint(-10 * x ,0,0)))
    ycf_brep = rs.ExtrudeSurface(ycf_brep,rs.AddLine(rs.AddPoint(0,0,0),rs.AddPoint(0 ,0,-15 * x)))
    
    ycf_brep_trimed = rs.ExtrudeCurve(cr1,rs.AddLine(rs.AddPoint(0,0,0),rs.AddPoint(-10 * x ,0,0)))
    ycf_brep_trimed = rs.ExtrudeSurface(ycf_brep_trimed,rs.AddLine(rs.AddPoint(0,0,0),rs.AddPoint(0 ,0,-15* x)))
    rs.MoveObject(ycf_brep_trimed,(0,0,5 * x))
    ycf_breps.append(ycf_brep_trimed)

rs.MoveObjects(ycf_breps,(0,0,145 * x))

#平棋枋生成

crf_brep = rs.MoveObject(rs.CopyObject(ZhuTou_point),(j * x,-5 * x,0))
crf_brep = rs.AddLine(crf_brep,rs.MoveObject(rs.CopyObject(crf_brep),(-j*x - 15*x,0,0)))
crf_brep = rs.AddLoftSrf([crf_brep,rs.MoveObject(rs.CopyObject(crf_brep),(0,10 * x,0))])
crf_brep = rs.ExtrudeSurface(crf_brep,rs.AddLine(rs.AddPoint(0,0,0),rs.AddPoint(0,0,15 * x)))

rs.MoveObject(crf_brep,(0,j * x + (MianKuo-((MianKuo+1)/2+1)) * 16 * 15 * x,252 * x +120 * x))

#草乳袱组

crf_brep_g_qianyan = [rs.CopyObject(crf_brep)]

sq_rule = [0,0,0,0,0,0,0,0,0,0,0,0,0,0,0,0,0,0,0,0,2.5,5]
for i in range(int((MianKuo - 3)/2)+1):
    if i + 1 < len(range(int((MianKuo - 3)/2)+1)):
        crf_brep1 = rs.MoveObject(rs.CopyObject(crf_brep),(0,-(MianKuo_length * (i+1)) * x,sq_rule[-(int((MianKuo - 3)/2-i))] * x))
        crf_brep_g_qianyan.append(crf_brep1)


crf_brep_g_qianyan_left  = rs.MirrorObjects(crf_brep_g_qianyan,rs.MoveObject(rs.CopyObject(ZhuTou_point),(0,(MianKuo_length * (MianKuo - 2) * x + 2 * j * x)/2 ,0)),rs.MoveObject(rs.CopyObject(ZhuTou_point),(x,(MianKuo_length * (MianKuo - 2) * x + 2 * j * x)/2 ,0)),copy=True)

crf_brep_g_qianyan_left = crf_brep_g_qianyan_left[::-1]

crf_breps = crf_brep_g_qianyan_left + crf_brep_g_qianyan

#草乳袱剪切
crf_brep_trimed = rs.MoveObject(rs.CopyObject(sq_cr),(5 * x,0,143 * x))
crf_brep_trimed = rs.ExtrudeCurve(crf_brep_trimed,rs.AddLine(rs.AddPoint(0,0,0),rs.AddPoint(-10 * x,0,0)))
crf_brep_trimed = rs.ExtrudeSurface(crf_brep_trimed,rs.AddLine(rs.AddPoint(0,0,0),rs.AddPoint(0,0,-21 * x)))


#草乳袱剪切
crf_brep_g = []
for i  in range(len(crf_breps)):
    crf_brep1 = rs.BooleanUnion([crf_breps[i],crf_brep_trimed],delete_input=False)
    crf_brep_g.append(crf_brep1[0])

#草乳袱上的缴背

jb_brep = rs.MoveObject(rs.CopyObject(ZhuTou_point),(j * x + 20 * x,-5 * x,0))
jb_brep = rs.AddLine(jb_brep,rs.MoveObject(rs.CopyObject(jb_brep),(-j*x - 15*x + 75 * x,0,0)))
jb_brep = rs.AddLoftSrf([jb_brep,rs.MoveObject(rs.CopyObject(jb_brep),(0,10 * x,0))])
jb_brep = rs.ExtrudeSurface(jb_brep,rs.AddLine(rs.AddPoint(0,0,0),rs.AddPoint(0,0,6.5 * x)))

rs.MoveObject(jb_brep,(0,j * x + (MianKuo-((MianKuo+1)/2+1)) * 16 * 15 * x,252 * x +135 * x))

#草乳袱上的缴背

jb_brep2 = rs.MoveObject(rs.CopyObject(ZhuTou_point),(j * x - 65 * x,-5 * x,0))
jb_brep2 = rs.AddLine(jb_brep2,rs.MoveObject(rs.CopyObject(jb_brep2),(-j*x - 15*x + 161 * x,0,0)))
jb_brep2 = rs.AddLoftSrf([jb_brep2,rs.MoveObject(rs.CopyObject(jb_brep2),(0,10 * x,0))])
jb_brep2 = rs.ExtrudeSurface(jb_brep2,rs.AddLine(rs.AddPoint(0,0,0),rs.AddPoint(0,0,6.5 * x)))

rs.MoveObject(jb_brep2,(0,j * x + (MianKuo-((MianKuo+1)/2+1)) * 16 * 15 * x,252 * x +141.5 * x))

jb_brep = rs.BooleanIntersection(jb_brep2,jb_brep,delete_input=False)

#佛光寺大殿,替木


if NiDaoGong_CaiFen_left !=  NiDaoGong_CaiFen_right:
    raise ValueError(f"两边必须一样长")

tm_pt_o = rs.CopyObject(ZhuTou_point)
if (NiDaoGong_CaiFen_left > 25) & (NiDaoGong_CaiFen_right > 25):
    rs.MoveObject(tm_pt_o,(0,(NiDaoGong_CaiFen_left + 20) * x,0))
else : raise ValueError(f"必须大于26分")

tm_pt_z1 = rs.CopyObject(tm_pt_o)
rs.MoveObject(tm_pt_z1,(0,0,4 * x))
tm_cr_z = rs.AddLine(tm_pt_o,tm_pt_z1)
tm_pt_y1 = rs.CopyObject(tm_pt_o)
rs.MoveObject(tm_pt_y1 ,(0,-12 * x,0))
tm_cr_y = rs.AddLine(tm_pt_y1,tm_pt_o)
div_cr_z =rs.DivideCurve(tm_cr_z,4)
div_cr_y =rs.DivideCurve(tm_cr_y,4)
#卷杀
CrossCurves_gzg = []
for i in range(len(div_cr_z)):
    divide_y = div_cr_y[i]
    divide_z = div_cr_z[i]
    CrossCurve_gzg = rs.AddLine(divide_y,divide_z)
    CrossCurves_gzg.append(CrossCurve_gzg)
CrossCurves_gzg = CrossCurves_gzg[1:len(CrossCurves_gzg)-1]
#选择交点
CrossCurves_points_gzg = []
for i in range(len(CrossCurves_gzg)):
    CrossCurves_point_gzg = rs.CurveCurveIntersection(CrossCurves_gzg[i],CrossCurves_gzg[i-1])[0][1]
    CrossCurves_points_gzg.append(CrossCurves_point_gzg)
CrossCurves_points_gzg = CrossCurves_points_gzg[1:len(CrossCurves_points_gzg)]
CrossCurves_points_gzg.insert(0,rs.CurveStartPoint(tm_cr_y))
CrossCurves_points_gzg.insert(len(CrossCurves_points_gzg)+1,rs.CurveEndPoint(tm_cr_z))
tm_pt_z2 = rs.CopyObject(tm_pt_z1)
rs.MoveObject(tm_pt_z2,(0,0, 4 * x))

CrossCurves_points_gzg.append(tm_pt_z2)
CrossCurves_points_tm_right = rs.MirrorObjects(CrossCurves_points_gzg,ZhuTou_point,rs.MoveObject(rs.CopyObject(ZhuTou_point),(x,0,x)),copy=True)
rs.MoveObjects(CrossCurves_points_tm_right,(0,(NiDaoGong_CaiFen_left - NiDaoGong_CaiFen_right) * x,0))

CrossCurves_points_gzg.insert(0,CrossCurves_points_tm_right[0])
CrossCurves_points_gzg.insert(0,CrossCurves_points_tm_right[1])
CrossCurves_points_gzg.insert(0,CrossCurves_points_tm_right[2])
CrossCurves_points_gzg.insert(0,CrossCurves_points_tm_right[3])
CrossCurves_points_gzg.insert(0,CrossCurves_points_tm_right[4])
tm_curve_left1 = rs.AddPolyline(CrossCurves_points_gzg)
tm_curve_left1 = rs.JoinCurves([tm_curve_left1,rs.AddLine(rs.CurveEndPoint(tm_curve_left1),rs.CurveStartPoint(tm_curve_left1))])
rs.MoveObject(tm_curve_left1,(5 *x,0,0))
tm_sr_left1 = rs.AddPlanarSrf(tm_curve_left1)

tm_brep = rs.ExtrudeSurface(tm_sr_left1,rs.AddLine(rs.AddPoint(0,0,0),rs.AddPoint(-10 * x,0,0)))

#替木修建

#挑檐椽
tyc_cr =  rs.AddCircle(ZhuTou_point,(17/2) * x)
rs.RotateObject(tyc_cr,ZhuTou_point,90,[x,0,0])
rs.MoveObject(tyc_cr,(0,(NiDaoGong_CaiFen_left + 20) * x,14.75 * x))
tyc_cr = rs.ExtrudeCurve(tyc_cr,rs.AddLine(rs.AddPoint(0,0,0),rs.AddPoint(0,-2 * (NiDaoGong_CaiFen_left + 20) * x,0)))
rs.CapPlanarHoles(tyc_cr)

tm_brep = rs.BooleanDifference(tm_brep,tyc_cr,delete_input=False)

rs.MoveObject(tm_brep,((j/2)* x,j * x + (MianKuo-((MianKuo+1)/2+1)) * 16 * 15 * x,395 * x))

#缴背被替木剪切
jb_brep = rs.BooleanUnion([jb_brep,tm_brep],delete_input=False)


#压槽枋被草乳袱剪切
ycf_breps = ycf_breps[::-1]
ycf_breps_1 = ycf_breps[1:len(ycf_breps)-1]
crf_brep_g_1 = crf_brep_g[1:len(crf_brep_g)]
crf_brep_g_2 = crf_brep_g[0:len(crf_brep_g)-1]
ycf_breps_g = []
for i in range(len(ycf_breps_1)):
    ycf_breps_1_1 = rs.BooleanIntersection(ycf_breps_1[i],crf_brep_g_1[i],delete_input=False)
    ycf_breps_1_1 = rs.BooleanIntersection(ycf_breps_1_1,crf_brep_g_2[i],delete_input=False)
    ycf_breps_g.append(ycf_breps_1_1[0])

ycf_breps_first = rs.BooleanIntersection(ycf_breps[0],crf_brep_g[0],delete_input=False)

ycf_breps_last = rs.BooleanIntersection(ycf_breps[-1],crf_brep_g[-1],delete_input=False)
ycf_breps_g.insert(0,ycf_breps_first[0])
ycf_breps_g.append(ycf_breps_last[0])

#缴背前的小托架

tj = rs.ExplodePolysurfaces(jb_brep)[4]
tj = rs.CurveEndPoint(rs.DuplicateEdgeCurves(tj)[3])
rs.MoveObject(tj,(0,0,5 * x))

tj2 = rs.MoveObject(rs.CopyObject(tj),(- 63*x,0,-31* x))


tj = rs.AddLine(tj,tj2)
tj = rs.ExtrudeCurve(tj,rs.AddLine(rs.AddPoint(0,0,0),rs.AddPoint(0,0,5 * x)))
rs.MoveObject(tj,(0,0,0))
tj = rs.ExtrudeSurface(tj,rs.AddLine(rs.AddPoint(0,0,0),rs.AddPoint(0,-10 * x,0)))


#缴背被小托架剪切

jb_brep = rs.BooleanUnion([jb_brep,tj],delete_input=False)[0]

#托架被草乳袱剪切
tj = rs.BooleanIntersection(crf_brep,tj,delete_input=False)
#托架缩放

tj_point = rs.ExplodePolysurfaces(tj)[2]
tj_point = rs.CurveEndPoint(rs.DuplicateEdgeCurves(tj_point)[0])
rs.MoveObject(tj_point,(0,5 * x,0))

#托架下的插销

cx_tj = rs.MoveObject(rs.CopyObject(tj_point),(-x,2 * x,0))
cx_tj = rs.AddLine(cx_tj,rs.MoveObject(rs.CopyObject(cx_tj),(0,-4 * x,0)))
cx_tj = rs.ExtrudeCurve(cx_tj,rs.AddLine(rs.AddPoint(0,0,0),rs.AddPoint(-8 * x,0,0)))
cx_tj = rs.ExtrudeSurface(cx_tj,rs.AddLine(rs.AddPoint(0,0,0),rs.AddPoint(0,0,-4 * x)))
tj = rs.ScaleObject(tj,tj_point,[1,0.8,1],copy=False)

tj = rs.BooleanDifference(cx_tj,tj,delete_input=False)



#檩条生成

# 生起曲线

lt_breps = []
lt_trimed2 = rs.CopyObjects(zhutou_pt_up[0:len(zhutou_pt_up)-1])
rs.MoveObjects(lt_trimed2,(0,0,0))
lt_trimed1 = rs.CopyObjects(zhutou_pt_up[1:len(zhutou_pt_up)])
rs.MoveObjects(lt_trimed1,(0,0,0))
sq_cr = rs.AddInterpCurve(zhutou_pt_up)
sq_sr = rs.ExtrudeCurve(sq_cr,rs.AddLine(rs.AddPoint(0,0,0),rs.AddPoint(5 * x,0,0)))

sq_curves = []
lt_breps = []
for i in range(len(lt_trimed1)):
    cr1 = rs.AddLine(lt_trimed1[i],lt_trimed2[i])
    rs.MoveObject(cr1,(5 * x,0,21 * x))
    cr1 = rs.ProjectCurveToSurface(cr1,sq_sr,[0,0,x])
    
    #扫略的面
    sweep_sr = rs.AddCircle(rs.CurveEndPoint(cr1),7.5 * x)
    sweep_sr2 = rs.AddCircle(rs.CurveStartPoint(cr1),7.5 * x)
    rs.RotateObject(sweep_sr,rs.CurveEndPoint(cr1),90,[x,0,0],copy=False)
    rs.RotateObject(sweep_sr2,rs.CurveStartPoint(cr1),90,[x,0,0],copy=False)
    rs.MoveObject(sweep_sr,(0,0,7.5 * x))   
    rs.MoveObject(sweep_sr2,(0,0,7.5 * x)) 
    lt1 = rs.AddSweep2([sweep_sr,sweep_sr2],cr1,closed = True)
    rs.CapPlanarHoles(lt1)
    lt_breps.append(lt1[0])
rs.MoveObjects(lt_breps,(-94 * x,0,105 * x))
lt_breps = lt_breps[::-1]
#两端檩条延长出檐
lt1_1 = rs.ExplodePolysurfaces(lt_breps[0])[5]
lt1_1 = rs.ExtrudeSurface(lt1_1,rs.AddLine(rs.AddPoint(0,0,0),rs.AddPoint(0,137 *x,0)))
lt_breps[0] = rs.BooleanDifference(lt1_1,lt_breps[0],delete_input =False)[0]

lt1_2 = rs.ExplodePolysurfaces(lt_breps[-1])[4]
lt1_2 = rs.ExtrudeSurface(lt1_2,rs.AddLine(rs.AddPoint(0,0,0),rs.AddPoint(0,-137 *x,0)))
lt_breps[-1] = rs.BooleanDifference(lt1_2,lt_breps[-1],delete_input =False)[0]
lt_breps_or = rs.MoveObjects(rs.CopyObjects(lt_breps),((89)* x,0,-354.5 * x))

#第五折檩条
lt5_breps = rs.MoveObjects(rs.CopyObjects(lt_breps_or),(2 *j * x,0,585.5 * x))[1 : len(lt_breps_or)-1]

lt5_breps[-1] = rs.BooleanUnion([lt5_breps[-2],lt5_breps[-1]],delete_input=False)[0]

del(lt5_breps[-2])
del(lt5_breps[1])
lt5_breps[0] = rs.MirrorObjects(lt5_breps[-1],rs.MoveObject(rs.CopyObject(ZhuTou_point),(0,(MianKuo_length * (MianKuo - 2) * x + 2 * j * x)/2 ,0)),rs.MoveObject(rs.CopyObject(ZhuTou_point),(x,(MianKuo_length * (MianKuo - 2) * x + 2 * j * x)/2 ,0)),copy=True)[0]
#第四折檩条
lt4_breps = rs.MoveObjects(rs.CopyObjects(lt_breps_or),(2 *j * x - j/2 * x,0,523.5 * x))[1 : len(lt_breps_or)-1]
#第三折檩条
lt3_breps = rs.MoveObjects(rs.CopyObjects(lt_breps_or),(j * x,0,468.5 * x))

#第二折檩条
lt2_breps = rs.MoveObjects(rs.CopyObjects(lt_breps_or),(j * x/2,0,428.5 * x))

JiaoLiang_trimed2 = rs.CopyObjects(lt2_breps)

#侧面的檩条
# 生起曲线
lt_breps_jingshen = []
shan_mian_pt_up = [zhutou_pt_up[0],zhutou_pt_up2[0],zhutou_pt_up3[0],zhutou_pt_up4[0],zhutou_pt_up5[0]]
le_trimed2_3 = rs.CopyObjects(shan_mian_pt_up[0:len(zhutou_pt_up)-1])
rs.MoveObjects(le_trimed2_3,((0) * x,0,0))
le_trimed1_3 = rs.CopyObjects(shan_mian_pt_up[1:len(zhutou_pt_up)])
rs.MoveObjects(le_trimed1_3,(-(0) * x,0,0))
sq_cr_3 = rs.AddInterpCurve(shan_mian_pt_up)
sq_sr_3 = rs.ExtrudeCurve(sq_cr_3,rs.AddLine(rs.AddPoint(0,0,0),rs.AddPoint(0,5 * x,0)))
for i in range(len(le_trimed1_3)):
    cr1_3 = rs.AddLine(le_trimed1_3[i],le_trimed2_3[i])
    rs.MoveObject(cr1_3,(0,5 * x,21 * x))
    cr1_3 = rs.ProjectCurveToSurface(cr1_3,sq_sr_3,[0,0,x])

    #扫略的面
    sweep_sr = rs.AddCircle(rs.CurveEndPoint(cr1_3),7.5 * x)
    sweep_sr2 = rs.AddCircle(rs.CurveStartPoint(cr1_3),7.5 * x)
    rs.RotateObject(sweep_sr,rs.CurveEndPoint(cr1_3),90,[0,x,0],copy=False)
    rs.RotateObject(sweep_sr2,rs.CurveStartPoint(cr1_3),90,[0,x,0],copy=False)
    rs.MoveObject(sweep_sr,(0,0,7.5 * x))   
    rs.MoveObject(sweep_sr2,(0,0,7.5 * x)) 
    lt1 = rs.AddSweep2([sweep_sr,sweep_sr2],cr1_3,closed = True)
    rs.CapPlanarHoles(lt1)
    lt_breps_jingshen.append(lt1[0])
rs.MoveObjects(lt_breps_jingshen,(0,-94 * x,105 * x))
lt_breps_jingshen = lt_breps_jingshen[::-1]

#两端檩条延长出檐
lt1_1_jingshen = rs.ExplodePolysurfaces(lt_breps_jingshen[0])[4]
lt1_1_jingshen = rs.ExtrudeSurface(lt1_1_jingshen,rs.AddLine(rs.AddPoint(0,0,0),rs.AddPoint(137 *x,0,0)))
lt_breps_jingshen[0] = rs.BooleanDifference(lt1_1_jingshen,lt_breps_jingshen[0],delete_input =False)[0]

lt1_2 = rs.ExplodePolysurfaces(lt_breps_jingshen[-1])[5]
lt1_2 = rs.ExtrudeSurface(lt1_2,rs.AddLine(rs.AddPoint(0,0,0),rs.AddPoint(-137 *x,0,0)))
lt_breps_jingshen[-1] = rs.BooleanDifference(lt1_2,lt_breps_jingshen[-1],delete_input =False)[0]
lt_breps_or_jingshen = rs.MoveObjects(rs.CopyObjects(lt_breps_jingshen),(0,(89)* x,-354.5 * x))

#侧面第四折檩条
lt4_breps_jingshen = rs.MoveObjects(rs.CopyObjects(lt_breps_or_jingshen),(0,315 * x,523.5 * x))[1 : len(lt_breps_or_jingshen)-1]

#侧面第三折檩条
lt3_breps_jingshen = rs.MoveObjects(rs.CopyObjects(lt_breps_or_jingshen),(0,j * x,468.5 * x))

#侧面第二折檩条
lt2_breps_jingshen = rs.MoveObjects(rs.CopyObjects(lt_breps_or_jingshen),(0,j * x/2,428.5 * x))
JiaoLiang_trimed3 = rs.CopyObjects(lt2_breps_jingshen)

#第二折檩条剪切
lt2_breps_trimed = rs.ExplodePolysurfaces(lt2_breps[-1])[5]
lt2_breps_trimed = rs.CurveEndPoint(rs.DuplicateEdgeCurves(lt2_breps_trimed)[1])

rs.MoveObject(lt2_breps_trimed,(-7.5 * x,-j/2 * x + 7.5 * x,2 * x- 0.5 * x))
lt2_breps_trimed = rs.AddLine(lt2_breps_trimed,rs.MoveObject(rs.CopyObject(lt2_breps_trimed),(0,-15 * x,0)))
lt2_breps_trimed = rs.ExtrudeCurve(lt2_breps_trimed,rs.AddLine(rs.AddPoint(0,0,0),rs.AddPoint(15 * x,0,0)))
lt2_breps_trimed = rs.ExtrudeSurface(lt2_breps_trimed,rs.AddLine(rs.AddPoint(0,0,0),rs.AddPoint(0,0,8.5 * x)))
lt2_breps_trimed2 = rs.MoveObject(rs.CopyObject(lt2_breps_trimed),(0,0,8.5 * x))
lt2_breps_trimed3 = rs.BooleanIntersection(lt2_breps_trimed2,lt2_breps_trimed,delete_input=False)
lt2_breps_trimed3_point = rs.ExplodePolysurfaces(lt2_breps_trimed3)[0]
lt2_breps_trimed3_point = rs.CurveEndPoint(rs.DuplicateEdgeCurves(lt2_breps_trimed3_point)[0])
rs.MoveObject(lt2_breps_trimed3_point,(7.5 * x,-7.5 * x,0))
rs.ScaleObject(lt2_breps_trimed3,lt2_breps_trimed3_point,[2,1,1],copy=False)



lt2_breps_trimed4 = rs.MoveObject(rs.CopyObject(lt2_breps_trimed3 ),(0,-21 * x,0))
lt2_breps_trimed5 = rs.CopyObject(lt2_breps_trimed3)
rs.ScaleObject(lt2_breps_trimed5,lt2_breps_trimed3_point,[0.5,2,1],copy=False)
rs.MoveObject(lt2_breps_trimed5,(-21 * x,0,0))

lt2_breps[-1] = rs.BooleanDifference(lt2_breps_trimed,lt2_breps[-1],delete_input=False)[0]
lt2_breps[-1] = rs.BooleanIntersection(lt2_breps_trimed4,lt2_breps[-1],delete_input=False)[0]


lt2_breps[0] = rs.MirrorObjects(lt2_breps[-1],rs.MoveObject(rs.CopyObject(ZhuTou_point),(0,(MianKuo_length * (MianKuo - 2) * x + 2 * j * x)/2 ,0)),rs.MoveObject(rs.CopyObject(ZhuTou_point),(x,(MianKuo_length * (MianKuo - 2) * x + 2 * j * x)/2 ,0)),copy=True)[0]
#
lt2_breps_jingshen[-1] =  rs.BooleanDifference(lt2_breps_trimed2,lt2_breps_jingshen[-1],delete_input=False)[0]
lt2_breps_jingshen[-1] = rs.BooleanIntersection(lt2_breps_trimed5,lt2_breps_jingshen[-1],delete_input=False)[1]

lt2_breps_jingshen[0] = rs.MirrorObjects(lt2_breps_jingshen[-1] ,rs.MoveObject(rs.CopyObject(ZhuTou_point),(4 * j/2 * x,0,0)),rs.MoveObject(rs.CopyObject(ZhuTou_point),(4 * j/2 * x,x,0)),copy=True)[0]

#第三折檩条
lt3_breps[-1] = rs.BooleanDifference(lt3_breps[-1],lt3_breps[-2],delete_input=False)[0]
del lt3_breps[-2]
del lt3_breps[1]
lt3_breps[0] = rs.MirrorObjects(lt3_breps[-1],rs.MoveObject(rs.CopyObject(ZhuTou_point),(0,(MianKuo_length * (MianKuo - 2) * x + 2 * j * x)/2 ,0)),rs.MoveObject(rs.CopyObject(ZhuTou_point),(x,(MianKuo_length * (MianKuo - 2) * x + 2 * j * x)/2 ,0)),copy=True)[0]

#
lt3_breps_jingshen[-1] = rs.BooleanDifference(lt3_breps_jingshen[-1],lt3_breps_jingshen[-2],delete_input=False)[0]

del lt3_breps_jingshen[-2]
del lt3_breps_jingshen[1]
lt3_breps_jingshen[0] = rs.MirrorObjects(lt3_breps_jingshen[-1] ,rs.MoveObject(rs.CopyObject(ZhuTou_point),(4 * j/2 * x,0,0)),rs.MoveObject(rs.CopyObject(ZhuTou_point),(4 * j/2 * x,x,0)),copy=True)[0]

lt3_breps_trimed = rs.MoveObject(rs.CopyObject(lt2_breps_trimed),(105 * x,105 * x,37* x))
lt3_breps_trimed2 = rs.MoveObject(rs.CopyObject(lt3_breps_trimed),(0,0,8.5 * x))
lt3_breps_trimed2 = rs.BooleanIntersection(rs.MoveObject(rs.CopyObject(lt3_breps_trimed2 ),(0,0,7.5 * x)),lt3_breps_trimed2 ,delete_input=False)
rs.MoveObject(lt3_breps_trimed2,(0,7.5 * x,0))
lt3_breps_trimed2 = rs.BooleanIntersection(rs.MoveObject(rs.CopyObject(lt3_breps_trimed2 ),(0,-15 *x,0)),lt3_breps_trimed2 ,delete_input=False)
lt3_breps_trimed4 = rs.MoveObject(rs.CopyObject(lt2_breps_trimed4),(105 * x,105 * x,38* x))
lt3_breps_trimed5 = rs.MoveObject(rs.CopyObject(lt2_breps_trimed5),(105 * x,105 * x,39* x))

lt3_breps[-1] = rs.BooleanDifference(lt3_breps_trimed,lt3_breps[-1],delete_input=False)[0]
lt3_breps[-1] = rs.BooleanIntersection(lt3_breps_trimed4,lt3_breps[-1],delete_input=False)[1]

lt3_breps[0] = rs.MirrorObjects(lt3_breps[-1],rs.MoveObject(rs.CopyObject(ZhuTou_point),(0,(MianKuo_length * (MianKuo - 2) * x + 2 * j * x)/2 ,0)),rs.MoveObject(rs.CopyObject(ZhuTou_point),(x,(MianKuo_length * (MianKuo - 2) * x + 2 * j * x)/2 ,0)),copy=True)[0]

#
lt3_breps_jingshen[-1] = rs.BooleanDifference(lt3_breps_trimed5,lt3_breps_jingshen[-1],delete_input=False)[1]

lt3_breps_jingshen[-1] = rs.BooleanIntersection(lt3_breps_trimed2,lt3_breps_jingshen[-1],delete_input=False)[0]









lt3_breps_jingshen[0] = rs.MirrorObjects(lt3_breps_jingshen[-1] ,rs.MoveObject(rs.CopyObject(ZhuTou_point),(4 * j/2 * x,0,0)),rs.MoveObject(rs.CopyObject(ZhuTou_point),(4 * j/2 * x,x,0)),copy=True)[0]




lt4_breps_trimed4 = rs.MoveObject(rs.CopyObject(lt3_breps_trimed4),(105 * x,105 * x,53* x))
lt4_breps_trimed5 = rs.MoveObject(rs.CopyObject(lt3_breps_trimed5),(105 * x,105 * x,51.5* x))
lt4_breps_trimed5 = rs.BooleanIntersection(lt4_breps_trimed5,rs.MoveObject(rs.CopyObject(lt4_breps_trimed5),(0,0,5 * x)),delete_input=False)

lt4_breps_trimed = rs.MoveObject(rs.CopyObject(lt3_breps_trimed),(105 * x,105 * x,51 * x))
lt4_breps_trimed2 = rs.MoveObject(rs.CopyObject(lt3_breps_trimed2),(105 * x,105 * x,51 * x))

lt4_breps[-1] = rs.BooleanIntersection(lt4_breps_trimed,lt4_breps[-1],delete_input=False)[0]
lt4_breps[-1] = rs.BooleanIntersection(lt4_breps_trimed4,lt4_breps[-1],delete_input=False)[0]
lt4_breps[0] = rs.MirrorObjects(lt4_breps[-1],rs.MoveObject(rs.CopyObject(ZhuTou_point),(0,(MianKuo_length * (MianKuo - 2) * x + 2 * j * x)/2 ,0)),rs.MoveObject(rs.CopyObject(ZhuTou_point),(x,(MianKuo_length * (MianKuo - 2) * x + 2 * j * x)/2 ,0)),copy=True)[0]

#
lt4_breps_jingshen[-1] =  rs.BooleanIntersection(lt4_breps_trimed2,lt4_breps_jingshen[-1],delete_input=False)[0]
lt4_breps_jingshen[-1] =  rs.BooleanIntersection(rs.MoveObject(rs.CopyObject(lt4_breps_trimed2),(0,0,2 * x)),lt4_breps_jingshen[-1],delete_input=False)[0]
lt4_breps_jingshen[-1] =  rs.BooleanIntersection(rs.MoveObject(rs.CopyObject(lt4_breps_trimed2),(0,2 * x,0)),lt4_breps_jingshen[-1],delete_input=False)[0]
lt4_breps_jingshen[-1] =  rs.BooleanIntersection(rs.MoveObject(rs.CopyObject(lt4_breps_trimed2),(0,-2 * x,0)),lt4_breps_jingshen[-1],delete_input=False)[0]
lt4_breps_jingshen[-1] = rs.BooleanIntersection(lt4_breps_trimed5,lt4_breps_jingshen[-1],delete_input=False)[0]

lt4_breps_jingshen[0] = rs.MirrorObjects(lt4_breps_jingshen[-1] ,rs.MoveObject(rs.CopyObject(ZhuTou_point),(4 * j/2 * x,0,0)),rs.MoveObject(rs.CopyObject(ZhuTou_point),(4 * j/2 * x,x,0)),copy=True)[0]

#第一折檩条剪切

lt_breps_trimed = rs.MoveObject(rs.CopyObject(lt2_breps_trimed),(-194 * x,-194 * x,-72 * x))
lt_breps_trimed2 = rs.MoveObject(rs.CopyObject(lt_breps_trimed),(0,0,8.5 * x))

lt_breps[-1] = rs.BooleanDifference(lt_breps_trimed,lt_breps[-1],delete_input=False)[0]
lt_breps[0] = rs.MirrorObjects(lt_breps[-1],rs.MoveObject(rs.CopyObject(ZhuTou_point),(0,(MianKuo_length * (MianKuo - 2) * x + 2 * j * x)/2 ,0)),rs.MoveObject(rs.CopyObject(ZhuTou_point),(x,(MianKuo_length * (MianKuo - 2) * x + 2 * j * x)/2 ,0)),copy=True)[0]

#
lt_breps_jingshen[-1] =  rs.BooleanDifference(lt_breps_trimed2,lt_breps_jingshen[-1],delete_input=False)[0]
lt_breps_jingshen[0] = rs.MirrorObjects(lt_breps_jingshen[-1] ,rs.MoveObject(rs.CopyObject(ZhuTou_point),(4 * j/2 * x,0,0)),rs.MoveObject(rs.CopyObject(ZhuTou_point),(4 * j/2 * x,x,0)),copy=True)[0]



#四椽草袱生成
sccf_brep1 = rs.ExplodePolysurfaces(jb_brep)[2]
rs.MoveObject(sccf_brep1,(21 * x,0,0))
sccf_brep_pt = rs.CurveEndPoint(rs.DuplicateEdgeCurves(sccf_brep1)[0])
sccf_brep1 = rs.ExtrudeSurface(sccf_brep1,rs.AddLine(rs.AddPoint(0,0,0),rs.AddPoint(73 * x,0,0)))
sccf_brep2 = rs.MoveObject(rs.CopyObject(sccf_brep1),(0,0,6.5*x))
sccf_brep3 = rs.MoveObject(rs.CopyObject(sccf_brep1),(0,0,13*x))
rs.ScaleObject(sccf_brep2,sccf_brep_pt,[1.1,1,1],copy=False)
rs.ScaleObject(sccf_brep3,sccf_brep_pt,[1.2,1,1],copy=False)
sccf_brep4 = rs.MoveObject(rs.CopyObject(sccf_brep_pt),(0,0,19.5 * x))

rs.MoveObject(sccf_brep4,(0,-2 * x,0))

sccf_brep4 = rs.AddLine(sccf_brep4,rs.MoveObject(rs.CopyObject(sccf_brep4),(0,14 * x,0)))

sccf_brep4 = rs.ExtrudeCurve(sccf_brep4,rs.AddLine(rs.AddPoint(0,0,0),rs.AddPoint(0,0,27 * x)))
sccf_brep4 = rs.ExtrudeSurface(sccf_brep4,rs.AddLine(rs.AddPoint(0,0,0),rs.AddPoint((44+ j)* x,0,0)))

sccf_brep = rs.BooleanUnion([sccf_brep3,sccf_brep2,sccf_brep1],delete_input=False)
sccf_brep = rs.BooleanDifference(sccf_brep4,sccf_brep,delete_input=False)

#替木2
tm_brep2 = rs.MoveObject(rs.CopyObject(tm_brep),(105 * x,0,40.5 * x))

#替木3 

tm_brep3 = rs.MoveObject(rs.CopyObject(tm_brep2),(105 * x,0,55 * x))

#替木4
tm_brep4 = rs.MoveObject(rs.CopyObject(tm_brep3),(105 * x,0,62 * x))

#四椽草袱被替木剪切
sccf_brep = rs.BooleanUnion([tm_brep2,sccf_brep],delete_input=False)

#四椽草袱上的栌斗底座

sccf_ld_base = rs.ExplodePolysurfaces(sccf_brep4)[3]
sccf_ld_base = rs.CurveEndPoint(rs.DuplicateEdgeCurves(sccf_ld_base)[2])
sccf_ld_base = rs.AddLine(sccf_ld_base,rs.MoveObject(rs.CopyObject(sccf_ld_base),(-84 * x,0,0)))
rs.MoveObject(sccf_ld_base ,(0,x,0))
sccf_ld_base = rs.ExtrudeCurve(sccf_ld_base,rs.AddLine(rs.AddPoint(0,0,0),rs.AddPoint(0,12 * x,0)))
sccf_ld_base = rs.ExtrudeSurface(sccf_ld_base,rs.AddLine(rs.AddPoint(0,0,0),rs.AddPoint(0,0,21 * x)))
rs.MoveObject(sccf_ld_base,(-j/2 * x + 42*x,0,0))
#佛光寺大殿蜀柱栌斗

#栌斗.深15分,广15分
szld_pt_o = rs.AddPoint(0,0,0)
szld_pt2 = rs.AddPoint(23 * x,0,0)
#栌斗,欹,厚6分
szld_pt_z1 = rs.AddPoint(-3 * x,0, 6 * x)
szld_cr_1 = rs.AddLine(szld_pt_o,szld_pt_z1)

szld_cr_6 = rs.AddLine(szld_pt_o,szld_pt_z1)

szld_pt_z2 = rs.CurveMidPoint(szld_cr_1)
direction_left = (x, 0, 2 * x)  # 任意方向向量 
distance = 1 * x # 移动距离 
# 单位化方向向量并计算实际位移 
unit_vector_left = rs.VectorUnitize(direction_left)
displacement_left = rs.VectorScale(unit_vector_left, distance)
rs.MoveObject(szld_pt_z2, displacement_left)
szld_cr_1 = rs.AddCurve([szld_pt_o,szld_pt_z2,szld_pt_z1])
szld_pt_3 = rs.MoveObject(rs.CopyObject(szld_pt_o),(0,2 * x,0))
szld_sr1 = rs.AddLine(szld_pt_3,rs.MoveObject(rs.CopyObject(szld_pt_3),(-6.5 * x,-6.5 * x,0)))
szld_sr1 = rs.AddLoftSrf([szld_sr1,rs.MoveObject(rs.CopyObject(szld_sr1),(0,0,8.5 * x))])
szld_cr_1 =rs.ProjectCurveToSurface(szld_cr_1,szld_sr1,[0,1,0])
szld_cr_2 = rs.MoveObject(rs.CopyObject(szld_cr_1),(0,15 * x,0 ))
szld_cr_2 = rs.RotateObject(szld_cr_2, rs.CurveStartPoint(szld_cr_2),-90,[0,0,1],copy=True)
szld_cr_3 = rs.MoveObject(rs.CopyObject(szld_cr_2),(15 * x,0,0 ))
szld_cr_3 = rs.RotateObject(szld_cr_3, rs.CurveStartPoint(szld_cr_3),-90,[0,0,1],copy=True)
szld_cr_4 = rs.MoveObject(rs.CopyObject(szld_cr_1),(15 * x,0,0 ))
szld_cr_4 = rs.RotateObject(szld_cr_4, rs.CurveStartPoint(szld_cr_4),90,[0,0,1],copy=True)
szld_down_Brep = rs.AddLoftSrf([szld_cr_1,szld_cr_2,szld_cr_3,szld_cr_4],loft_type=2,closed=True)
rs.CapPlanarHoles(szld_down_Brep)
#栌斗,平,厚3分
szld_sr2 = rs.ExplodePolysurfaces(szld_down_Brep)
szld_sr2 = szld_sr2[2]
LuDou_SZ_center_point = rs.SurfaceAreaCentroid(rs.ExplodePolysurfaces(szld_down_Brep)[1])
LuDou_SZ_center_point = rs.AddPoint(LuDou_SZ_center_point[0])
szld_mid_Brep = rs.ExtrudeSurface(szld_sr2,rs.AddLine(rs.CurveEndPoint(szld_cr_2),rs.MoveObject(rs.CurveEndPoint(szld_cr_2),(0,0, 3 * x))))
#栌斗,耳,厚6分
szld_up_brep1 = rs.CopyObject(rs.CurveEndPoint(szld_cr_1))
rs.MoveObject(szld_up_brep1,(0,0,3 * x))
szld_up_brep1 = rs.AddLine(szld_up_brep1,rs.MoveObject(rs.CopyObject(szld_up_brep1),(5.5 * x,0,0)))
szld_up_brep1 = rs.ExtrudeCurve(szld_up_brep1,rs.AddLine(szld_pt_o,rs.MoveObject(rs.CopyObject(szld_pt_o),(0,5.5 * x,0))))
szld_up_brep1 = rs.ExtrudeSurface(szld_up_brep1,rs.AddLine(szld_pt_o,rs.MoveObject(rs.CopyObject(szld_pt_o),(0,0,6 * x))))
szld_up_brep2 = rs.MirrorObject(szld_up_brep1,LuDou_SZ_center_point,rs.MoveObject(rs.CopyObject(LuDou_SZ_center_point),(x,0,0)),copy=True)
szld_up_brep3 = rs.MirrorObject(szld_up_brep2,LuDou_SZ_center_point,rs.MoveObject(rs.CopyObject(LuDou_SZ_center_point),(0,x,0)),copy=True)
szld_up_brep4 = rs.MirrorObject(szld_up_brep3,LuDou_SZ_center_point,rs.MoveObject(rs.CopyObject(LuDou_SZ_center_point),(x,0,0)),copy=True)

szld_up_brep5 = rs.CopyObject(rs.CurveEndPoint(szld_cr_1))
rs.MoveObject(szld_up_brep5,(2.5 * x,5.5 * x,3 * x))
szld_up_brep5 = rs.AddLine(szld_up_brep5,rs.MoveObject(rs.CopyObject(szld_up_brep5),(0,10 * x,0)))
szld_up_brep5 = rs.ExtrudeCurve(szld_up_brep5,rs.AddLine(szld_pt_o,rs.MoveObject(rs.CopyObject(szld_pt_o),(3 * x,0,0))))
szld_up_brep5 = rs.ExtrudeSurface(szld_up_brep5,rs.AddLine(szld_pt_o,rs.MoveObject(rs.CopyObject(szld_pt_o),(0,0,3 * x))))
szld_up_brep6 = rs.MirrorObject(szld_up_brep5,LuDou_SZ_center_point,rs.MoveObject(rs.CopyObject(LuDou_SZ_center_point),(0,x,0)),copy=True)






LuDou_SZ = rs.BooleanDifference(szld_mid_Brep,szld_down_Brep,delete_input=False)
LuDou_SZ = rs.BooleanIntersection(LuDou_SZ,szld_up_brep1,delete_input=False)
LuDou_SZ = rs.BooleanIntersection(LuDou_SZ,szld_up_brep2,delete_input=False)
LuDou_SZ = rs.BooleanIntersection(LuDou_SZ,szld_up_brep3,delete_input=False)
LuDou_SZ = rs.BooleanIntersection(LuDou_SZ,szld_up_brep4,delete_input=False)
LuDou_SZ = rs.BooleanDifference(LuDou_SZ,szld_up_brep5,delete_input=False)
LuDou_SZ = rs.BooleanDifference(LuDou_SZ,szld_up_brep6,delete_input=False)
rs.MoveObject(LuDou_SZ,((HuaGong_CaiFen_left-7.5) * x,-4.5 * x,0))

rs.MoveObject(LuDou_SZ,((j/2 + j)* x,j * x + (MianKuo-((MianKuo+1)/2+1)) * 16 * 15 * x,469* x-15 *x+6.5 * x))


##佛光寺大殿泥道拱生成
if NiDaoGong_CaiFen_left != NiDaoGong_CaiFen_right:
    raise ValueError(f"两边必须一样长")

ndg_pt_o = rs.CopyObject(ZhuTou_point)
if (NiDaoGong_CaiFen_left > 25) & (NiDaoGong_CaiFen_right > 25):
    rs.MoveObject(ndg_pt_o,(0,(NiDaoGong_CaiFen_left) * x,0))
else : raise ValueError(f"必须大于26分")

ndg_pt_z1 = rs.CopyObject(ndg_pt_o)
rs.MoveObject(ndg_pt_z1,(0,0,9 * x))
ndg_cr_z = rs.AddLine(ndg_pt_o,ndg_pt_z1)
ndg_pt_y1 = rs.CopyObject(ndg_pt_o)
rs.MoveObject(ndg_pt_y1 ,(0,-14 * x,0))
ndg_cr_y = rs.AddLine(ndg_pt_y1,ndg_pt_o)
div_cr_z =rs.DivideCurve(ndg_cr_z,5)
div_cr_y =rs.DivideCurve(ndg_cr_y,5)
#卷杀
CrossCurves_ndg = []
for i in range(len(div_cr_z)):
    divide_y = div_cr_y[i]
    divide_z = div_cr_z[i]
    CrossCurve_ndg = rs.AddLine(divide_y,divide_z)
    CrossCurves_ndg.append(CrossCurve_ndg)
CrossCurves_ndg = CrossCurves_ndg[1:len(CrossCurves_ndg)-1]
#选择交点
CrossCurves_points_ndg = []
for i in range(len(CrossCurves_ndg)):
    CrossCurves_point_ndg = rs.CurveCurveIntersection(CrossCurves_ndg[i],CrossCurves_ndg[i-1])[0][1]
    CrossCurves_points_ndg.append(CrossCurves_point_ndg)
CrossCurves_points_ndg = CrossCurves_points_ndg[1:len(CrossCurves_points_ndg)]
CrossCurves_points_ndg.insert(0,rs.CurveStartPoint(ndg_cr_y))
CrossCurves_points_ndg.insert(len(CrossCurves_points_ndg)+1,rs.CurveEndPoint(ndg_cr_z))
ndg_pt_z2 = rs.CopyObject(ndg_pt_z1)
rs.MoveObject(ndg_pt_z2,(0,0, 6 * x))
ndg_pt_z3 = rs.CopyObject(ndg_pt_z2)
rs.MoveObject(ndg_pt_z3,(0,-10 * x,0))
ndg_pt_y_1 = rs.CopyObject(ZhuTou_point)
rs.MoveObject(ndg_pt_y_1,(0,0,5 * x))
ndg_pt_y_2 = rs.CopyObject(ndg_pt_y_1)
rs.MoveObject(ndg_pt_y_2,(0,4 * x,0))
ndg_pt_y_3 = rs.CopyObject(ndg_pt_y_2)
rs.MoveObject(ndg_pt_y_3,(0,0,10 * x))
CrossCurves_points_ndg.append(ndg_pt_z2)
CrossCurves_points_ndg.append(ndg_pt_z3)
CrossCurves_points_ndg_right = rs.MirrorObjects(CrossCurves_points_ndg,ZhuTou_point,rs.MoveObject(rs.CopyObject(ZhuTou_point),(x,0,0)),copy=True)
rs.MoveObjects(CrossCurves_points_ndg_right,(0,(NiDaoGong_CaiFen_left - NiDaoGong_CaiFen_left) * x,0))
ndg_mid_pt1 = rs.CopyObject(ZhuTou_point)
ndg_mid_pt1 = rs.MoveObject(ndg_mid_pt1,(0,-4 * x,15 * x))
ndg_mid_pt4 = rs.CopyObject(ZhuTou_point)
ndg_mid_pt4 = rs.MoveObject(ndg_mid_pt4,(0,4 * x,15 * x))
ndg_mid_pt2 = rs.CopyObject(ndg_mid_pt1)
rs.MoveObject(ndg_mid_pt2,(0,0,-10 * x))
ndg_mid_pt3 = rs.CopyObject(ndg_mid_pt2)
rs.MoveObject(ndg_mid_pt3,(0,8 * x,0))
CrossCurves_points_ndg.insert(0,CrossCurves_points_ndg_right[0])
CrossCurves_points_ndg.insert(0,CrossCurves_points_ndg_right[1])
CrossCurves_points_ndg.insert(0,CrossCurves_points_ndg_right[2])
CrossCurves_points_ndg.insert(0,CrossCurves_points_ndg_right[3])
CrossCurves_points_ndg.insert(0,CrossCurves_points_ndg_right[4])
CrossCurves_points_ndg.insert(0,CrossCurves_points_ndg_right[5])
CrossCurves_points_ndg.insert(0,CrossCurves_points_ndg_right[6])
CrossCurves_points_ndg.insert(0,ndg_mid_pt1)
CrossCurves_points_ndg.insert(0,ndg_mid_pt2)
CrossCurves_points_ndg.insert(0,ndg_mid_pt3)
CrossCurves_points_ndg.insert(0,ndg_mid_pt4)

ndg_curve_left1 = rs.AddPolyline(CrossCurves_points_ndg)
ndg_curve_left1 = rs.JoinCurves([ndg_curve_left1,rs.AddLine(rs.CurveEndPoint(ndg_curve_left1),rs.CurveStartPoint(ndg_curve_left1))])
rs.MoveObject(ndg_curve_left1,(5 *x,0,0))
ndg_sr_left1 = rs.AddPlanarSrf(ndg_curve_left1)

ndg_brep = rs.ExtrudeSurface(ndg_sr_left1,rs.AddLine(rs.AddPoint(0,0,0),rs.AddPoint(-10 * x,0,0)))

# 拱眼
ndg_gyy_pt1 = rs.CopyObject(ndg_pt_z3)
rs.MoveObject(ndg_gyy_pt1,(-5 * x,0,x))
ndg_gyy_pt2 = rs.CopyObject(ndg_gyy_pt1)
rs.MoveObject(ndg_gyy_pt2,(0,0,-2 * x))
ndg_gyy_pt4 = rs.CopyObject(ndg_mid_pt4)
rs.MoveObject(ndg_gyy_pt4,(-5 * x, 1.625 * x,x))
ndg_gyy_pt3 = rs.CopyObject(ndg_gyy_pt4)
rs.MoveObject(ndg_gyy_pt3,(0,0,-2 * x))
ndg_gyy_cr1 = rs.AddLine(ndg_gyy_pt1,ndg_gyy_pt2)
ndg_gyy_cr2 = rs.AddLine(ndg_gyy_pt2,ndg_gyy_pt3)
ndg_gyy_cr3 = rs.AddLine(ndg_gyy_pt3,ndg_gyy_pt4)
ndg_gyy_cr1 = rs.AddFilletCurve(ndg_gyy_cr1,ndg_gyy_cr2,x)
ndg_gyy_cr2 = rs.AddFilletCurve(ndg_gyy_cr3,ndg_gyy_cr2,x)
ndg_gyy_cr3 = rs.AddLine(rs.CurveEndPoint(ndg_gyy_cr1),rs.CurveEndPoint(ndg_gyy_cr2))
ndg_gyy_cr4 = rs.AddLine(rs.CurveStartPoint(ndg_gyy_cr1),rs.MoveObject(rs.CopyObject(ndg_gyy_pt1),(0,0,x)))
ndg_gyy_cr5 = rs.AddLine(rs.CurveStartPoint(ndg_gyy_cr2),rs.MoveObject(rs.CopyObject(ndg_gyy_pt4),(0,0,x)))
ndg_gyy_1 =rs.JoinCurves([ndg_gyy_cr1,ndg_gyy_cr2,ndg_gyy_cr3,ndg_gyy_cr4,ndg_gyy_cr5])
ndg_gyy_1 =rs.JoinCurves([ndg_gyy_1,rs.AddLine(rs.CurveStartPoint(ndg_gyy_1),rs.CurveEndPoint(ndg_gyy_1))])
rs.MoveObject(ndg_gyy_1,(-x,0,0)) 
ndg_gyy_1 = rs.AddPlanarSrf(ndg_gyy_1)
ndg_gyy_1 = rs.ExtrudeSurface(ndg_gyy_1,rs.AddLine(ZhuTou_point,rs.MoveObject(rs.CopyObject(ZhuTou_point),(2 * x,0,0))))
ndg_gyy_2 = rs.MirrorObject(ndg_gyy_1,ZhuTou_point,rs.MoveObject(rs.CopyObject(ZhuTou_point),(0,x,0)),copy=True)
ndg_gyy_3 = rs.MirrorObject(ndg_gyy_1,ZhuTou_point,rs.MoveObject(rs.CopyObject(ZhuTou_point),(x,0,0)),copy=True)
ndg_gyy_4 = rs.MirrorObject(ndg_gyy_2,ZhuTou_point,rs.MoveObject(rs.CopyObject(ZhuTou_point),(x,0,0)),copy=True)
ndg_brep = rs.BooleanDifference(ndg_brep,ndg_gyy_1)
ndg_brep = rs.BooleanDifference(ndg_brep,ndg_gyy_2)
ndg_brep = rs.BooleanDifference(ndg_brep,ndg_gyy_3)
lg_brep = rs.BooleanDifference(ndg_brep,ndg_gyy_4)
#泥道拱上的馒头榫
mts_lg = rs.ExplodePolysurfaces(lg_brep)[15]
mts_lg = rs.CurveEndPoint(rs.DuplicateEdgeCurves(mts_lg)[0])
rs.MoveObject(mts_lg,(-3.75 * x,-3.75 * x,0))

mts_lg = rs.AddLine(mts_lg,rs.MoveObject(rs.CopyObject(mts_lg),(-2.5 * x,0,0)))
mts_lg = rs.ExtrudeCurve(mts_lg,rs.AddLine(rs.AddPoint(0,0,0),rs.AddPoint(0,-2.5 * x,0)))
mts_lg = rs.ExtrudeSurface(mts_lg,rs.AddLine(rs.AddPoint(0,0,0),rs.AddPoint(0,0,2.5 * x)))
mts2_lg = rs.MirrorObject(mts_lg,ZhuTou_point,rs.MoveObject(rs.CopyObject(ZhuTou_point),(x,0,0)),copy=True)

lg_brep = rs.BooleanDifference(mts_lg,lg_brep,delete_input=False)
lg_brep = rs.BooleanIntersection(mts2_lg,lg_brep,delete_input=False)

rs.MoveObject(lg_brep,((j/2 + j)* x,j * x + (MianKuo-((MianKuo+1)/2+1)) * 16 * 15 * x,469* x + 9 * x-15 * x +6.5 *x))
#散斗,深12分,广10分,华拱/散斗.深10分,广12分,泥道栱
sd_pt_o = rs.AddPoint(0,0,0)
sd_pt2 = rs.AddPoint(10 * x,0,0)
sd_pt_z1 = rs.AddPoint(- 2 * x,0, 4 * x)
sd_cr_1 = rs.AddLine(sd_pt_o,sd_pt_z1)
#散斗,欹
sd_pt_z2 = rs.CurveMidPoint(sd_cr_1)
direction_left = (x, 0, 2 * x)  # 任意方向向量 
distance = 0.5 * x # 移动距离 
# 单位化方向向量并计算实际位移 
unit_vector_left = rs.VectorUnitize(direction_left)
displacement_left = rs.VectorScale(unit_vector_left, distance)
rs.MoveObject(sd_pt_z2, displacement_left)
sd_cr_1 = rs.AddCurve([sd_pt_o,sd_pt_z2,sd_pt_z1])
sd_pt_3 = rs.MoveObject(rs.CopyObject(sd_pt_o),(0,2 * x,0))
sd_sr1 = rs.AddLine(sd_pt_3,rs.MoveObject(rs.CopyObject(sd_pt_3),(-2 * x,-2 * x,0)))
sd_sr1 = rs.AddLoftSrf([sd_sr1,rs.MoveObject(rs.CopyObject(sd_sr1),(0,0,4* x))])
sd_cr_1 =rs.ProjectCurveToSurface(sd_cr_1,sd_sr1,[0,1,0])
sd_cr_2 = rs.MoveObject(rs.CopyObject(sd_cr_1),(0,10 * x,0 ))
sd_cr_2 = rs.RotateObject(sd_cr_2, rs.CurveStartPoint(sd_cr_2),-90,[0,0,1],copy=True)
sd_cr_3 = rs.MoveObject(rs.CopyObject(sd_cr_2),(10 * x,0,0 ))
sd_cr_3 = rs.RotateObject(sd_cr_3, rs.CurveStartPoint(sd_cr_3),-90,[0,0,1],copy=True)
sd_cr_4 = rs.MoveObject(rs.CopyObject(sd_cr_1),(10 * x,0,0 ))
sd_cr_4 = rs.RotateObject(sd_cr_4, rs.CurveStartPoint(sd_cr_4),90,[0,0,1],copy=True)
sd_down_Brep = rs.AddLoftSrf([sd_cr_1,sd_cr_2,sd_cr_3,sd_cr_4],loft_type=2,closed=True)
rs.CapPlanarHoles(sd_down_Brep)
#散斗,平
sd_sr2 = rs.ExplodePolysurfaces(sd_down_Brep)
sd_sr2 = sd_sr2[2]
sd_mid_Brep = rs.ExtrudeSurface(sd_sr2,rs.AddLine(rs.CurveEndPoint(sd_cr_2),rs.MoveObject(rs.CurveEndPoint(sd_cr_2),(0,0,2 * x))))
sd_sr3_curve= rs.DuplicateEdgeCurves(sd_mid_Brep)[9]
sd_sr3 = rs.AddLoftSrf([sd_sr3_curve,rs.MoveObject(rs.CopyObject(sd_sr3_curve),(0,-2 * x,0))])
sd_source_point = rs.SurfaceAreaCentroid(rs.ExplodePolysurfaces(sd_down_Brep)[1])[0]
sd_up_brep1 = rs.ExtrudeSurface(sd_sr3,rs.AddLine(sd_pt_o,rs.MoveObject(rs.CopyObject(sd_pt_o),(0,0,3.5* x))))
sd_up_brep2 =rs.CopyObject(sd_up_brep1)
rs.MoveObject(sd_up_brep2,(0, -12 * x ,0))


SanDou_up = rs.BooleanDifference(sd_mid_Brep,sd_up_brep2,delete_input=False)
SanDou_up = rs.BooleanDifference(SanDou_up,sd_up_brep1,delete_input=False)
SanDou = rs.BooleanDifference(SanDou_up,sd_down_Brep,delete_input=False)

#散斗被馒头榫剪切
mts_sandou = rs.ExplodePolysurfaces(SanDou)[16]
mts_sandou = rs.CurveEndPoint(rs.DuplicateEdgeCurves(mts_sandou)[0])
rs.MoveObject(mts_sandou,(3.75 * x,3.75 * x,0))
mts_sandou = rs.AddLine(mts_sandou,rs.MoveObject(rs.CopyObject(mts_sandou),(0,2.5 * x,0)))
mts_sandou = rs.ExtrudeCurve(mts_sandou,rs.AddLine(rs.AddPoint(0,0,0),rs.AddPoint(2.5 * x,0,0)))
mts_sandou = rs.ExtrudeSurface(mts_sandou,rs.AddLine(rs.AddPoint(0,0,0),rs.AddPoint(0,0,2.5 * x)))

SanDou = rs.BooleanUnion([SanDou,mts_sandou],delete_input=False)
SanDou_jingshen = rs.CopyObject(SanDou)
rs.RotateObject(SanDou,rs.MoveObject(rs.CopyObject(ZhuTou_point),(-(HuaGong_CaiFen_left-5) * x,2 * x,0)),90,[0,0,x],copy=False)
rs.MoveObject(SanDou,((HuaGong_CaiFen_left-5) * x,(NiDaoGong_CaiFen_right-7) * x,0))

rs.MoveObject(SanDou,((j/2 + j)* x,j * x + (MianKuo-((MianKuo+1)/2+1)) * 16 * 15 * x,469* x + 9 * x-15 * x +21.5 * x))

SanDou2 = rs.MoveObject(rs.CopyObject(SanDou),(0,-(2*NiDaoGong_CaiFen_left - 10)*x,0))
SanDou3 = rs.MoveObject(rs.CopyObject(SanDou),(0,-(2*NiDaoGong_CaiFen_left - 10)*x/2,0))

SanDous = [SanDou[0],SanDou2,SanDou3]

#托脚生成
TuoJiao_brep = rs.ExplodePolysurfaces(lg_brep)[11]
TuoJiao_brep = rs.CurveEndPoint(rs.DuplicateEdgeCurves(TuoJiao_brep)[0])
rs.MoveObject(TuoJiao_brep,(-10 * x,-x,-2 *x))
TuoJiao_brep = rs.AddLine(TuoJiao_brep,rs.MoveObject(rs.CopyObject(TuoJiao_brep),(0,10 * x,0)))
TuoJiao_brep = rs.ExtrudeCurve(TuoJiao_brep,rs.AddLine(rs.AddPoint(0,0,0),rs.AddPoint(0,0,15 * x)))
TuoJiao_brep = rs.ExtrudeSurface(TuoJiao_brep,rs.AddLine(rs.AddPoint(0,0,0),rs.AddPoint(-88 * x,0,-47 * x)))

#托脚被四椽乳袱剪切
TuoJiao_brep = rs.BooleanIntersection(sccf_brep,TuoJiao_brep,delete_input=False)
#托脚被栌斗剪切
TuoJiao_brep = rs.BooleanIntersection(LuDou_SZ,TuoJiao_brep,delete_input=False)
#托脚被散斗剪切
TuoJiao_brep = rs.BooleanIntersection(SanDou3,TuoJiao_brep,delete_input=False)

#栌斗基座被托脚剪切
sccf_ld_base = rs.BooleanDifference(sccf_ld_base,rs.MoveObject(rs.CopyObject(TuoJiao_brep),(0,2*x,0)),delete_input=False)
sccf_ld_base = rs.BooleanDifference(sccf_ld_base,rs.MoveObject(rs.CopyObject(TuoJiao_brep),(0,-2*x,0)),delete_input=False)

#托脚下面的插销
cx_TuoJiao = rs.ExplodePolysurfaces(TuoJiao_brep)[3]
cx_TuoJiao = rs.CurveEndPoint(rs.DuplicateEdgeCurves(cx_TuoJiao)[0])
rs.MoveObject(cx_TuoJiao,(0,3 *x,0))
cx_TuoJiao = rs.AddLine(cx_TuoJiao,rs.MoveObject(rs.CopyObject(cx_TuoJiao),(0,4 * x,0)))
cx_TuoJiao = rs.ExtrudeCurve(cx_TuoJiao,rs.AddLine(rs.AddPoint(0,0,0),rs.AddPoint(-12 *x,0,0)))
cx_TuoJiao = rs.ExtrudeSurface(cx_TuoJiao,rs.AddLine(rs.AddPoint(0,0,0),rs.AddPoint(0,0,-6 * x)))
rs.MoveObject(cx_TuoJiao,(-8 * x,0,0))

TuoJiao_brep = rs.BooleanUnion([TuoJiao_brep,cx_TuoJiao],delete_input=False)

#四椽草袱被托脚剪切
sccf_brep = rs.BooleanUnion([cx_TuoJiao,sccf_brep],delete_input=False)

#栌斗基座下的插销

cx_sccf = rs.MoveObject(rs.CopyObject(cx_TuoJiao),(50 * x,0,6 * x))
cx2_sccf = rs.MoveObject(rs.CopyObject(cx_sccf),( 59 * x,0,0))

sccf_brep = rs.BooleanDifference(sccf_brep,cx_sccf,delete_input=False)
sccf_brep = rs.BooleanDifference(sccf_brep,cx2_sccf,delete_input=False)

#栌斗底座被四椽草袱剪切

sccf_ld_base = rs.BooleanIntersection(sccf_ld_base,sccf_brep,delete_input=False)

#四椽草袱剪切

sccf_brep_trimed = rs.ExplodePolysurfaces(sccf_brep1)[0]
sccf_brep_trimed2 = rs.DuplicateEdgeCurves(sccf_brep_trimed)[0]
sccf_brep_trimed2 = rs.ExtrudeCurve(sccf_brep_trimed2,rs.AddLine(rs.AddPoint(0,0,0),rs.AddPoint(0,0,26 * x)))
sccf_brep_trimed2 = rs.ExtrudeSurface(sccf_brep_trimed2,rs.AddLine(rs.AddPoint(0,0,0),rs.AddPoint(10 * x,0,0)))
rs.MoveObject(sccf_brep_trimed2,(39 * x,0,0))

sccf_brep_trimed = rs.ExtrudeSurface(sccf_brep_trimed,rs.AddLine(rs.AddPoint(0,0,0),rs.AddPoint(6 * x,0,0)))
rs.MoveObject(sccf_brep_trimed,(0,0,6.5 * x))

sccf_brep = rs.BooleanUnion([sccf_brep,sccf_brep_trimed],delete_input=False)
sccf_brep = rs.BooleanUnion([sccf_brep,sccf_brep_trimed2],delete_input=False)

#四椽草袱对称连接
sccf_brep_2 = rs.MirrorObject(sccf_brep,rs.MoveObject(rs.CopyObject(ZhuTou_point),(2 * j * x,0,0)),rs.MoveObject(rs.CopyObject(ZhuTou_point),(2 * j * x,x,0)),copy=True)
sccf_brep = rs.BooleanIntersection(sccf_brep_2,sccf_brep,delete_input=False)

#平梁生成

pl_brep1 = rs.ExplodePolysurfaces(TuoJiao_brep)[14]
pl_brep1 = rs.ExtrudeSurface(pl_brep1,rs.AddLine(rs.AddPoint(0,0,0),rs.AddPoint(10 * x,0,0)))

pl_brep2 = rs.ExplodePolysurfaces(pl_brep1)[5]
pl_brep2 = rs.CurveEndPoint(rs.DuplicateEdgeCurves(pl_brep2)[0])
rs.MoveObject(pl_brep2,(0,-2.5 * x,6 * x))
pl_brep2 = rs.AddLine(pl_brep2 ,rs.MoveObject(rs.CopyObject(pl_brep2 ),(0,15 * x,0)))
pl_brep2 = rs.ExtrudeCurve(pl_brep2,rs.AddLine(rs.AddPoint(0,0,0),rs.AddPoint(0,0,-21 * x)))

pl_brep2 = rs.ExtrudeSurface(pl_brep2,rs.AddLine(rs.AddPoint(0,0,0),rs.AddPoint(j/2 * x-5 * x,0,0)))
pl_brep = rs.BooleanDifference(pl_brep1,pl_brep2,delete_input=False)

#平梁被令拱剪切
pl_brep = rs.BooleanDifference(lg_brep,pl_brep,delete_input=False)
#平梁被斗拱剪切
pl_brep = rs.BooleanIntersection(pl_brep,LuDou_SZ,delete_input=False)
#平梁被散斗剪切
pl_brep = rs.BooleanIntersection(pl_brep,rs.MoveObject(rs.CopyObject(SanDou3),(0,4 * x,0)),delete_input=False)
pl_brep = rs.BooleanIntersection(pl_brep,rs.MoveObject(rs.CopyObject(SanDou3),(0,-4 * x,0)),delete_input=False)
#平梁上的馒头榫
mts_pl_brep = rs.ExplodePolysurfaces(SanDou3)[0]
mts_pl_brep = rs.ExtrudeSurface(mts_pl_brep,rs.AddLine(rs.AddPoint(0,0,0),rs.AddPoint(0,2.5 * x,0)))

pl_brep = rs.BooleanUnion([pl_brep,mts_pl_brep],delete_input=False)

#令拱2 
lg_brep2 = rs.MoveObject(rs.CopyObject(lg_brep),(105 * x,0,62 * x))

#令拱2上的散斗群
SanDous2 = rs.MoveObjects(rs.CopyObjects(SanDous),(105 * x,0,62 * x))

#叉手生成
chashou_brep = rs.ExplodePolysurfaces(lg_brep2)[11]
chashou_mid_brep = rs.ExtrudeSurface(rs.CopyObject(chashou_brep),rs.AddLine(rs.AddPoint(0,0,0),rs.AddPoint(0,0,10 * x)))


chashou_brep = rs.DuplicateEdgeCurves(chashou_brep)[2]
chashou_brep = rs.ExtrudeCurve(chashou_brep,rs.AddLine(rs.AddPoint(0,0,0),rs.AddPoint(0,0,18 *x)))
rs.MoveObject(chashou_brep,(2 *x,0,-5 * x))
chashou_brep = rs.ExtrudeSurface(chashou_brep,rs.AddLine(rs.AddPoint(0,0,0),rs.AddPoint(-(math.sqrt(2)*(62 *x)),0,-62 * x)))

#叉手被平梁剪切

chashou_brep = rs.BooleanDifference(chashou_brep,pl_brep,delete_input=False)
chashou_brep_trimed = rs.MoveObject(rs.CopyObjects(pl_brep),(0,0,77 *x))
chashou_brep = rs.BooleanDifference(chashou_brep,chashou_brep_trimed,delete_input=False)

#叉手下的插销
cx_chashou = rs.ExplodePolysurfaces(chashou_brep)[5]
cx_chashou = rs.CurveEndPoint(rs.DuplicateEdgeCurves(cx_chashou )[0])

rs.MoveObject(cx_chashou,(0,3 *x,0))
cx_chashou = rs.AddLine(cx_chashou,rs.MoveObject(rs.CopyObject(cx_chashou),(0,4 * x,0)))
cx_chashou = rs.ExtrudeCurve(cx_chashou,rs.AddLine(rs.AddPoint(0,0,0),rs.AddPoint(-12 *x,0,0)))
cx_chashou = rs.ExtrudeSurface(cx_chashou,rs.AddLine(rs.AddPoint(0,0,0),rs.AddPoint(0,0,-6 * x)))

rs.MoveObject(cx_chashou,(-7 *x,0,0))

chashou_brep = rs.BooleanUnion([chashou_brep,cx_chashou],delete_input=False)

#平梁被叉手剪切
pl_brep = rs.BooleanDifference(pl_brep,cx_chashou,delete_input=False)

#叉手中间段上的馒头榫

mts_chashou = rs.ExplodePolysurfaces(SanDous2[2])[0]
mts_chashou = rs.ExtrudeSurface(mts_chashou,rs.AddLine(rs.AddPoint(0,0,0),rs.AddPoint(0,2.5 * x,0)))

chashou_mid_brep = rs.BooleanUnion([chashou_mid_brep,mts_chashou],delete_input=False)

chashou_brep2 = rs.MirrorObject(chashou_brep,rs.MoveObject(rs.CopyObject(ZhuTou_point),(4 * j/2 * x,0,0)),rs.MoveObject(rs.CopyObject(ZhuTou_point),(4 * j/2 * x,x,0)),copy=True)

chashou_brep = rs.BooleanUnion([chashou_brep,chashou_mid_brep,chashou_brep2],delete_input=False)

#令拱2被叉手剪切

lg_brep2 = rs.BooleanUnion([chashou_brep,lg_brep2],delete_input=False)

pl_brep2 = rs.MirrorObject(pl_brep,rs.MoveObject(rs.CopyObject(ZhuTou_point),(4 * j/2 * x,0,0)),rs.MoveObject(rs.CopyObject(ZhuTou_point),(4 * j/2 * x,x,0)),copy=True)

pl_brep = rs.BooleanUnion([pl_brep,pl_brep2],delete_input=False)

#托架成组
tj_g_qianyan = [rs.CopyObject(tj)]

sq_rule = [0,0,0,0,0,0,0,0,0,0,0,0,0,0,0,0,0,0,0,0,2.5,5]
for i in range(int((MianKuo - 3)/2)+1):
    if i + 1 < len(range(int((MianKuo - 3)/2)+1)):
        tj1 = rs.MoveObject(rs.CopyObject(tj),(0,-(MianKuo_length * (i+1)) * x,sq_rule[-(int((MianKuo - 3)/2-i))] * x))
        tj_g_qianyan.append(tj1)


tj_g_qianyan_left  = rs.MirrorObjects(tj_g_qianyan,rs.MoveObject(rs.CopyObject(ZhuTou_point),(0,(MianKuo_length * (MianKuo - 2) * x + 2 * j * x)/2 ,0)),rs.MoveObject(rs.CopyObject(ZhuTou_point),(x,(MianKuo_length * (MianKuo - 2) * x + 2 * j * x)/2 ,0)),copy=True)

tj_g_qianyan_left = tj_g_qianyan_left[::-1]

tjs = tj_g_qianyan_left + tj_g_qianyan


#椽乳袱被托架剪切

crf_brep_g1 = []
for i in range(len(crf_brep_g)):
    crf_brep_g1_1 = rs.BooleanDifference(tjs[i],crf_brep_g[i],delete_input=False)
    crf_brep_g1.append(crf_brep_g1_1[0])
crf_brep_g = crf_brep_g1


tj1_jinshen = rs.RotateObject(tjs[-1],rs.MoveObject(rs.CopyObject(ZhuTou_point),(j * x,j * x,0)),90,[0,0,x],copy=True)

#托架被檩条剪切

tj_trimed = rs.BooleanUnion(lt2_breps,delete_input=False)

tj_g = []
for i in range(len(crf_brep_g)):
    tj_g1 = rs.BooleanUnion([tjs[i],tj_trimed],delete_input=False)
    tj_g.append(tj_g1[0])

#进深方向的拱眼壁
le2_brep_trimed_g_3 = []
shan_mian_pt_up = [zhutou_pt_up[0],zhutou_pt_up2[0],zhutou_pt_up3[0],zhutou_pt_up4[0],zhutou_pt_up5[0]]
le_trimed2_3 = rs.CopyObjects(shan_mian_pt_up[0:len(zhutou_pt_up)-1])
rs.MoveObjects(le_trimed2_3,((0) * x,0,0))
le_trimed1_3 = rs.CopyObjects(shan_mian_pt_up[1:len(zhutou_pt_up)])
rs.MoveObjects(le_trimed1_3,(-(0) * x,0,0))
sq_cr_3 = rs.AddInterpCurve(shan_mian_pt_up)
sq_sr_3 = rs.ExtrudeCurve(sq_cr_3,rs.AddLine(rs.AddPoint(0,0,0),rs.AddPoint(0,5 * x,0)))
for i in range(len(le_trimed1_3)):
    cr1_3 = rs.AddLine(le_trimed1_3[i],le_trimed2_3[i])
    rs.MoveObject(cr1_3,(0,5 * x,21 * x))
    cr1_3 = rs.ProjectCurveToSurface(cr1_3,sq_sr_3,[0,0,x])

    le2_brep_3 = rs.ExtrudeCurve(cr1_3,rs.AddLine(rs.AddPoint(0,0,0),rs.AddPoint(0,-10 * x ,0)))
    le2_brep_3 = rs.ExtrudeSurface(le2_brep_3,rs.AddLine(rs.AddPoint(0,0,0),rs.AddPoint(0 ,0,-15 * x)))
    
    le2_brep_trimed_3 = rs.ExtrudeCurve(cr1_3,rs.AddLine(rs.AddPoint(0,0,0),rs.AddPoint(0,-10 * x ,0)))
    le2_brep_trimed_3 = rs.ExtrudeSurface(le2_brep_trimed_3,rs.AddLine(rs.AddPoint(0,0,0),rs.AddPoint(0 ,0,-22 * x)))
    rs.MoveObject(le2_brep_trimed_3,(0,0,5 * x))
    le2_brep_trimed_g_3.append(le2_brep_trimed_3)

rs.MoveObjects(le2_brep_trimed_g_3,(0,0,130 * x))
#第五层素枋上的拱眼壁
rs.ScaleObjects(le2_brep_trimed_g_3,ZhuTou_point,[1,0.8,1],copy=False)

#进深方向的压槽枋
ycf2_brep_trimed_g_3= []
shan_mian_pt_up = [zhutou_pt_up[0],zhutou_pt_up2[0],zhutou_pt_up3[0],zhutou_pt_up4[0],zhutou_pt_up5[0]]
ycf_trimed2_3 = rs.CopyObjects(shan_mian_pt_up[0:len(zhutou_pt_up)-1])
rs.MoveObjects(ycf_trimed2_3,((0) * x,0,0))
ycf_trimed1_3 = rs.CopyObjects(shan_mian_pt_up[1:len(zhutou_pt_up)])
rs.MoveObjects(ycf_trimed1_3,(-(0) * x,0,0))
sq_cr_3 = rs.AddInterpCurve(shan_mian_pt_up)
sq_sr_3 = rs.ExtrudeCurve(sq_cr_3,rs.AddLine(rs.AddPoint(0,0,0),rs.AddPoint(0,5 * x,0)))
for i in range(len(ycf_trimed1_3)):
    cr1_3 = rs.AddLine(ycf_trimed1_3[i],ycf_trimed2_3[i])
    rs.MoveObject(cr1_3,(0,5 * x,21 * x))
    cr1_3 = rs.ProjectCurveToSurface(cr1_3,sq_sr_3,[0,0,x])

    ycf2_brep_3 = rs.ExtrudeCurve(cr1_3,rs.AddLine(rs.AddPoint(0,0,0),rs.AddPoint(0,-10 * x ,0)))
    ycf2_brep_3 = rs.ExtrudeSurface(ycf2_brep_3,rs.AddLine(rs.AddPoint(0,0,0),rs.AddPoint(0 ,0,-15 * x)))
    
    ycf2_brep_trimed_3 = rs.ExtrudeCurve(cr1_3,rs.AddLine(rs.AddPoint(0,0,0),rs.AddPoint(0,-10 * x ,0)))
    ycf2_brep_trimed_3 = rs.ExtrudeSurface(ycf2_brep_trimed_3,rs.AddLine(rs.AddPoint(0,0,0),rs.AddPoint(0 ,0,-15 * x)))
    rs.MoveObject(ycf2_brep_trimed_3,(0,0,5 * x))
    ycf2_brep_trimed_g_3.append(ycf2_brep_trimed_3)

rs.MoveObjects(ycf2_brep_trimed_g_3,(0,0,145 * x))
ycf_breps_jinshen = ycf2_brep_trimed_g_3

#进深方向的椽乳袱

crf_brep_jinshen1 = rs.RotateObject(crf_brep_g[-1],rs.MoveObject(rs.CopyObject(ZhuTou_point),(j * x,j * x,0)),90,[0,0,x],copy=True)

crf_brep_jinshen2 = rs.MoveObject(rs.CopyObject(crf_brep_jinshen1),(j * x,0,-5.5 * x))

crf_brep_jinshen3 = rs.MoveObject(rs.CopyObject(crf_brep_jinshen1),(2 *j * x,0,0))

crf_brep_g_jinshen = [crf_brep_jinshen1,crf_brep_jinshen2,crf_brep_jinshen3]

#进深方向的抬架




tj2_jinshen = rs.MoveObject(rs.CopyObject(tj1_jinshen),(j * x,0,-5.5 * x))

tj3_jinshen = rs.MoveObject(rs.CopyObject(tj1_jinshen),(2 *j * x,0,0))

tj_g_jinshen= [tj1_jinshen,tj2_jinshen,tj3_jinshen]
#托脚被檩条剪切
tj_trimed_jinshen = rs.BooleanUnion(lt2_breps_jingshen,delete_input=False)

tj_g_jinshen[0] = rs.BooleanUnion([tj_trimed_jinshen,tj_g_jinshen[0]],delete_input=False)[0]
tj_g_jinshen[1] = rs.BooleanUnion([tj_trimed_jinshen,tj_g_jinshen[1]],delete_input=False)[0]
tj_g_jinshen[2] = rs.BooleanUnion([tj_trimed_jinshen,tj_g_jinshen[2]],delete_input=False)[0]

#进深方向的缴背

jb_brep_jinshen = rs.MoveObject(rs.CopyObject(jb_brep),(0,-(MianKuo-3)/2*MianKuo_length*x,5 * x))

rs.RotateObject(jb_brep_jinshen,rs.MoveObject(rs.CopyObject(ZhuTou_point),(j * x,j * x,0)),90,[0,0,x],copy=False)

jb2_brep_jinshen = rs.MoveObject(rs.CopyObject(jb_brep_jinshen),(j * x,0,-5.5 * x))

jb3_brep_jinshen = rs.MoveObject(rs.CopyObject(jb_brep_jinshen),(2 *j * x,0,0))

jb_brep_g_jinshen = [jb_brep_jinshen,jb2_brep_jinshen,jb3_brep_jinshen]

#面扩方向的缴背连接

# 生起曲线

le5_breps_2 = []
le5_brep_trimed_g_2 = []
le5_trimed2_2 = rs.CopyObjects(zhutou_pt_up2[1:len(zhutou_pt_up)-2])
rs.MoveObjects(le5_trimed2_2,(0,(0) * x,0))
le5_trimed1_2 = rs.CopyObjects(zhutou_pt_up2[2:len(zhutou_pt_up)-1])
rs.MoveObjects(le5_trimed1_2,(0,-(0) * x,0))
sq_cr_2 = rs.AddInterpCurve(zhutou_pt_up2[1:len(zhutou_pt_up)-1])
sq_sr_2 = rs.ExtrudeCurve(sq_cr_2,rs.AddLine(rs.AddPoint(0,0,0),rs.AddPoint(5 * x,0,0)))
for i in range(len(le5_trimed1_2)):
    cr1_2 = rs.AddLine(le5_trimed1_2[i],le5_trimed2_2[i])
    rs.MoveObject(cr1_2,(5 * x,0,21 * x))
    cr1_2 = rs.ProjectCurveToSurface(cr1_2,sq_sr_2,[0,0,x])

    le5_brep_2 = rs.ExtrudeCurve(cr1_2,rs.AddLine(rs.AddPoint(0,0,0),rs.AddPoint(-10 * x ,0,0)))
    le5_brep_2 = rs.ExtrudeSurface(le5_brep_2,rs.AddLine(rs.AddPoint(0,0,0),rs.AddPoint(0 ,0,-14.5 * x)))
    
    le5_brep_trimed_2 = rs.ExtrudeCurve(cr1_2,rs.AddLine(rs.AddPoint(0,0,0),rs.AddPoint(-10 * x ,0,0)))
    le5_brep_trimed_2 = rs.ExtrudeSurface(le5_brep_trimed_2,rs.AddLine(rs.AddPoint(0,0,0),rs.AddPoint(0 ,0,-26 * x)))
    rs.MoveObject(le5_brep_trimed_2,(0,0,5 * x))
    le5_brep_trimed_g_2.append(le5_brep_trimed_2)

rs.MoveObjects(le5_brep_trimed_g_2,(0,0,44.5 * x + 132.5 * x))

jbbs_mk = le5_brep_trimed_g_2
#延长两端
jbbs_mk_head1 = rs.ExplodePolysurfaces(jb_brep_jinshen)[2]
rs.MoveObject(jbbs_mk_head1,(0,65 * x,0))
jbbs_mk_head2 = rs.ExtrudeSurface(jbbs_mk_head1,rs.AddLine(rs.AddPoint(0,0,0),rs.AddPoint(0,-36 * x,0)))
rs.MoveObject(jbbs_mk_head2,(0,0,6.5 * x))
jbbs_mk_head1 = rs.ExtrudeSurface(jbbs_mk_head1,rs.AddLine(rs.AddPoint(0,0,0),rs.AddPoint(0,-42 * x,0)))
jbbs_mk_head3 = rs.MoveObject(rs.CopyObject(jbbs_mk_head1),(0,0,13 * x))
jbbs_mk_head4 = rs.MoveObject(rs.CopyObject(jbbs_mk_head1),(0,0,19.5 * x))
jbbs_mk_head = rs.BooleanIntersection(jbbs_mk_head1,jbbs_mk_head2,delete_input=False)
jbbs_mk_head = rs.BooleanIntersection(jbbs_mk_head,jbbs_mk_head3,delete_input=False)
jbbs_mk_head = rs.BooleanIntersection(jbbs_mk_head,jbbs_mk_head4,delete_input=False)


jbbs_mk = jbbs_mk[::-1]


jbbs_mk[-1] = rs.BooleanDifference(jbbs_mk_head,jbbs_mk[-1],delete_input=False)[0]

#剪切
jbbs_mk_trimed = rs.ExplodePolysurfaces(jbbs_mk_head)[0]
jbbs_mk_trimed = rs.DuplicateEdgeCurves(jbbs_mk_trimed)[0]
jbbs_mk_trimed = rs.ExtrudeCurve(jbbs_mk_trimed,rs.AddLine(rs.AddPoint(0,0,0),rs.AddPoint(0,-10 * x,0)))
rs.MoveObject(jbbs_mk_trimed,(0,5 * x,-x))
jbbs_mk_trimed = rs.ExtrudeSurface(jbbs_mk_trimed,rs.AddLine(rs.AddPoint(0,0,0),rs.AddPoint(0,0,14 * x)))
jbbs_mk_trimed2 = rs.MoveObject(rs.CopyObject(jbbs_mk_trimed),(0,0,14 * x))

jbbs_mk[-1] = rs.BooleanUnion([jbbs_mk_trimed,jbbs_mk[-1]],delete_input=False)[0]


jbbs_mk[0] = rs.MirrorObject(jbbs_mk[-1],rs.MoveObject(rs.CopyObject(ZhuTou_point),(0,(MianKuo_length * (MianKuo - 2) * x + 2 * j * x)/2 ,0)),rs.MoveObject(rs.CopyObject(ZhuTou_point),(x,(MianKuo_length * (MianKuo - 2) * x + 2 * j * x)/2 ,0)),copy=True)


#进深方向的缴背连接

le5_brep_trimed_g_4 = []
shan_mian_pt_up_2 = [zhutou_pt_up2[1],zhutou_pt_up3[1],zhutou_pt_up4[1]]
le5_trimed2_4 = rs.CopyObjects(shan_mian_pt_up_2[0:len(zhutou_pt_up)-1])
rs.MoveObjects(le5_trimed2_4,((0) * x,0,0))
le5_trimed1_4 = rs.CopyObjects(shan_mian_pt_up_2[1:len(zhutou_pt_up)])
rs.MoveObjects(le5_trimed1_4,(-(0) * x,0,0))
sq_cr_4 = rs.AddInterpCurve(shan_mian_pt_up_2)
sq_sr_4 = rs.ExtrudeCurve(sq_cr_4,rs.AddLine(rs.AddPoint(0,0,0),rs.AddPoint(0,5 * x,0)))
for i in range(len(le5_trimed1_4)):
    cr1_4 = rs.AddLine(le5_trimed1_4[i],le5_trimed2_4[i])
    rs.MoveObject(cr1_4,(0,5 * x,21 * x))
    cr1_4 = rs.ProjectCurveToSurface(cr1_4,sq_sr_4,[0,0,x])

    le5_brep_4 = rs.ExtrudeCurve(cr1_4,rs.AddLine(rs.AddPoint(0,0,0),rs.AddPoint(0,-10 * x ,0)))
    le5_brep_4 = rs.ExtrudeSurface(le5_brep_4,rs.AddLine(rs.AddPoint(0,0,0),rs.AddPoint(0 ,0,-14.5 * x)))
    
    le5_brep_trimed_4 = rs.ExtrudeCurve(cr1_4,rs.AddLine(rs.AddPoint(0,0,0),rs.AddPoint(0,-10 * x ,0)))
    le5_brep_trimed_4 = rs.ExtrudeSurface(le5_brep_trimed_4,rs.AddLine(rs.AddPoint(0,0,0),rs.AddPoint(0 ,0,-26 * x)))
    rs.MoveObject(le5_brep_trimed_4,(0,0,5 * x))
    le5_brep_trimed_g_4.append(le5_brep_trimed_4)

rs.MoveObjects(le5_brep_trimed_g_4,(0,0,44.5 * x +132.5 * x))

jbbs_mk_jinshen = le5_brep_trimed_g_4

jbbs_mk_head_jinshen = rs.RotateObject(jbbs_mk_head,rs.MoveObject(rs.CopyObject(ZhuTou_point),(j * x,j * x,0)),-90,[0,0,x],copy=True)

jbbs_mk_jinshen = jbbs_mk_jinshen[::-1]

jbbs_mk_jinshen[-1] = rs.BooleanDifference(jbbs_mk_head_jinshen,jbbs_mk_jinshen[-1],delete_input=False)[0]

jbbs_mk_jinshen[-1] = rs.BooleanUnion([jbbs_mk_jinshen[-1],jbbs_mk_trimed2],delete_input=False)[0]
jbbs_mk_trimed3 = rs.MoveObject(rs.CopyObject(jbbs_mk_trimed2),(j * x,0,0))
jbbs_mk_jinshen[-1] = rs.BooleanUnion([jbbs_mk_jinshen[-1],jbbs_mk_trimed3],delete_input=False)[0]
jbbs_mk_jinshen[0] = rs.MirrorObject(jbbs_mk_jinshen[-1],rs.MoveObject(rs.CopyObject(ZhuTou_point),(4 * j/2 * x,0,0)),rs.MoveObject(rs.CopyObject(ZhuTou_point),(4 * j/2 * x,x,0)),copy=True)


#进深方向第二折檩条下的替木

tm_brep_jinshen = rs.MoveObject(rs.CopyObject(tm_brep),(0,-(MianKuo-3)/2*MianKuo_length*x,5 * x))
rs.RotateObject(tm_brep_jinshen,rs.MoveObject(rs.CopyObject(ZhuTou_point),(j * x,j * x,0)),90,[0,0,x],copy=False)

tm_brep_jinshen2 = rs.MoveObject(rs.CopyObject(tm_brep_jinshen),(j * x,0,-5 * x))

tm_brep_jinshen3 = rs.MoveObject(rs.CopyObject(tm_brep_jinshen),(2 *j * x,0,0))


tm_breps_jinshen = [tm_brep_jinshen,tm_brep_jinshen2,tm_brep_jinshen3]

#
jb_brep_g_jinshen[1] = rs.BooleanUnion([jb_brep_g_jinshen[1] ,tm_brep_jinshen2],delete_input=False)[0]

#面扩方向中间缴背出头

jbbs_mk_head_mid = rs.MoveObject(rs.CopyObject(jbbs_mk_head),(j * x,0,-1.5 * x))

jbbs_mk_head_mid2 = rs.ExplodePolysurfaces(jbbs_mk_head_mid)[0]
jbbs_mk_head_mid2 = rs.DuplicateEdgeCurves(jbbs_mk_head_mid2)[0]
jbbs_mk_head_mid2 = rs.ExtrudeCurve(jbbs_mk_head_mid2,rs.AddLine(rs.AddPoint(0,0,0),rs.AddPoint(0,0,26 * x)))
jbbs_mk_head_mid2 = rs.ExtrudeSurface(jbbs_mk_head_mid2,rs.AddLine(rs.AddPoint(0,0,0),rs.AddPoint(0,35 * x,0)))

jbbs_mk_head_mid = rs.BooleanDifference(jbbs_mk_head_mid,jbbs_mk_head_mid2,delete_input=False)
jbbs_mk_head_mid = rs.BooleanDifference(jbbs_mk_jinshen[0],jbbs_mk_head_mid,delete_input=False)
jbbs_mk_head_mid = rs.BooleanIntersection(jbbs_mk_jinshen[1],jbbs_mk_head_mid,delete_input=False)

#进深方向的四草乳袱

#四草乳袱成组

sccf_brep_g_qianyan = [rs.CopyObject(sccf_brep)]

sq_rule = [0,0,0,0,0,0,0,0,0,0,0,0,0,0,0,0,0,0,0,0,2.5,5]
for i in range(int((MianKuo - 3)/2)+1):
    if i + 1 < len(range(int((MianKuo - 3)/2))):
        sccf_brep1 = rs.MoveObject(rs.CopyObject(sccf_brep),(0,-(MianKuo_length * (i+1)) * x,sq_rule[-(int((MianKuo - 3)/2-i))] * x))
        sccf_brep_g_qianyan.append(sccf_brep1)


sccf_brep_g_qianyan_left  = rs.MirrorObjects(sccf_brep_g_qianyan,rs.MoveObject(rs.CopyObject(ZhuTou_point),(0,(MianKuo_length * (MianKuo - 2) * x + 2 * j * x)/2 ,0)),rs.MoveObject(rs.CopyObject(ZhuTou_point),(x,(MianKuo_length * (MianKuo - 2) * x + 2 * j * x)/2 ,0)),copy=True)

sccf_brep_g_qianyan_left = sccf_brep_g_qianyan_left[::-1]

sccf_brep_g = sccf_brep_g_qianyan_left + sccf_brep_g_qianyan


sccf_brep_jinshen = rs.ExplodePolysurfaces(jbbs_mk_head_mid)[14]
sccf_brep_jinshen = rs.CurveEndPoint(rs.DuplicateEdgeCurves(sccf_brep_jinshen)[0])

rs.MoveObject(sccf_brep_jinshen,(0,-20 * x,0))
sccf_brep_jinshen_cr1 = rs.AddLine(sccf_brep_jinshen,rs.MoveObject(rs.CopyObject(sccf_brep_jinshen),(0,55 * x,0)))
sccf_brep_jinshen_cr2 = rs.CurveEndPoint(sccf_brep_jinshen_cr1)

sccf_brep_jinshen_cr2 = rs.AddInterpCurve([sccf_brep_jinshen_cr2,rs.MoveObject(rs.CopyObject(sccf_brep_jinshen_cr2),(0,140* x,13 * x)),rs.MoveObject(rs.CopyObject(sccf_brep_jinshen_cr2),(0,180* x,16 * x)),rs.MoveObject(rs.CopyObject(sccf_brep_jinshen_cr2),(0,212 * x,18 * x))])
sccf_brep_jinshen_cr = rs.JoinCurves([sccf_brep_jinshen_cr1,sccf_brep_jinshen_cr2])
sccf_brep_jinshen = rs.ExtrudeCurve(sccf_brep_jinshen_cr,rs.AddLine(rs.AddPoint(0,0,0),rs.AddPoint(0,0,30 * x)))
sccf_brep_jinshen2 = rs.ExtrudeSurface(sccf_brep_jinshen,rs.AddLine(rs.AddPoint(0,0,0),rs.AddPoint(14 * x,0,0)))
rs.MoveObject(sccf_brep_jinshen2,(-2 * x,0,0))

#进深方向的第二层替木

tm2_brep_jinshen2 = rs.MoveObject(rs.CopyObject(tm_brep_jinshen2),(0,105 * x,40 * x))
tm2_brep_jinshen1 = rs.MoveObject(rs.CopyObject(tm_brep_jinshen),(0,105 * x,40 * x))


sccf_brep_jinshen1 = rs.MoveObject(rs.CopyObject(sccf_brep_jinshen2),(-j*x/2,0,0))

#四草乳袱尽间上的插销剪切

sccf_brep_g_trimed = rs.ExplodePolysurfaces(sccf_brep_g[-1])[9]
sccf_brep_g_trimed = rs.DuplicateEdgeCurves(sccf_brep_g_trimed)[3]
sccf_brep_g_trimed = rs.ExtrudeCurve(sccf_brep_g_trimed,rs.AddLine(rs.AddPoint(0,0,0),rs.AddPoint(-700 * x,0,0)))
sccf_brep_g_trimed = rs.ExtrudeSurface(sccf_brep_g_trimed,rs.AddLine(rs.AddPoint(0,0,0),rs.AddPoint(0,0,10 * x)))

sccf_brep_g[-1] = rs.BooleanUnion([sccf_brep_g[-1],sccf_brep_g_trimed],delete_input=False)[0]
sccf_brep_g[0] = rs.MirrorObject(sccf_brep_g[-1],rs.MoveObject(rs.CopyObject(ZhuTou_point),(0,(MianKuo_length * (MianKuo - 2) * x + 2 * j * x)/2 ,0)),rs.MoveObject(rs.CopyObject(ZhuTou_point),(x,(MianKuo_length * (MianKuo - 2) * x + 2 * j * x)/2 ,0)),copy=True)

#进深方向的四草乳袱被面扩方向的四草乳袱剪切


sccf_brep_jinshen2 = rs.BooleanDifference(sccf_brep_g[-1],sccf_brep_jinshen2,delete_input=False)

#进深方向的四草乳袱被替木剪切
sccf_brep_jinshen2 = rs.BooleanDifference(sccf_brep_jinshen2,tm2_brep_jinshen2,delete_input=False)
sccf_brep_jinshen2 = rs.BooleanDifference(sccf_brep_jinshen2,rs.MoveObject(rs.CopyObject(tm2_brep_jinshen2),(0,0,6.5 * x)),delete_input=False)
sccf_brep_jinshen2 = rs.BooleanDifference(sccf_brep_jinshen2,rs.MoveObject(rs.CopyObject(tm2_brep_jinshen2),(0,0,13 * x)),delete_input=False)
#四草乳袱上的栌斗成组

ld_brep_g_qianyan = [rs.CopyObject(LuDou_SZ)]

sq_rule = [0,0,0,0,0,0,0,0,0,0,0,0,0,0,0,0,0,0,0,0,2.5,5]
for i in range(int((MianKuo - 3)/2)+1):
    if i + 1 < len(range(int((MianKuo - 3)/2))):
        ld_brep1 = rs.MoveObject(rs.CopyObject(LuDou_SZ),(0,-(MianKuo_length * (i+1)) * x,sq_rule[-(int((MianKuo - 3)/2-i))] * x))
        ld_brep_g_qianyan.append(ld_brep1)


ld_brep_g_qianyan_left  = rs.MirrorObjects(ld_brep_g_qianyan,rs.MoveObject(rs.CopyObject(ZhuTou_point),(0,(MianKuo_length * (MianKuo - 2) * x + 2 * j * x)/2 ,0)),rs.MoveObject(rs.CopyObject(ZhuTou_point),(x,(MianKuo_length * (MianKuo - 2) * x + 2 * j * x)/2 ,0)),copy=True)

ld_brep_g_qianyan_left = ld_brep_g_qianyan_left[::-1]

ld_brep_g = ld_brep_g_qianyan_left + ld_brep_g_qianyan

#进深方向的四草乳袱被栌斗剪切
sccf_brep_jinshen1 = rs.BooleanDifference(ld_brep_g[-1],sccf_brep_jinshen1,delete_input=False)

sccf_brep_jinshen3 = rs.MoveObject(rs.CopyObject(sccf_brep_jinshen1),(j *x,0,0))

#第二层面扩方向的替木生成


tm_brep2_g_qianyan = [rs.CopyObject(tm_brep2)]

sq_rule = [0,0,0,0,0,0,0,0,0,0,0,0,0,0,0,0,0,0,0,0,2.5,5]
for i in range(int((MianKuo - 3)/2)+1):
    if i + 1 < len(range(int((MianKuo - 3)/2)+1)):
        tm_brep21 = rs.MoveObject(rs.CopyObject(tm_brep2),(0,-(MianKuo_length * (i+1)) * x,sq_rule[-(int((MianKuo - 3)/2-i))] * x))
        tm_brep2_g_qianyan.append(tm_brep21)


tm_brep2_g_qianyan_left  = rs.MirrorObjects(tm_brep2_g_qianyan,rs.MoveObject(rs.CopyObject(ZhuTou_point),(0,(MianKuo_length * (MianKuo - 2) * x + 2 * j * x)/2 ,0)),rs.MoveObject(rs.CopyObject(ZhuTou_point),(x,(MianKuo_length * (MianKuo - 2) * x + 2 * j * x)/2 ,0)),copy=True)

tm_brep2_g_qianyan_left = tm_brep2_g_qianyan_left[::-1]

tm_brep2_g = tm_brep2_g_qianyan_left + tm_brep2_g_qianyan
tm_brep2_g_trimed = rs.ExplodePolysurfaces(tm_brep2_g[-1])[0]
tm_brep2_g_trimed = rs.CurveEndPoint(rs.DuplicateEdgeCurves(tm_brep2_g_trimed)[8])
rs.MoveObject(tm_brep2_g_trimed,(0,(NiDaoGong_CaiFen_left + 25) * x,x))
tm_brep2_g_trimed = rs.AddLine(tm_brep2_g_trimed,rs.MoveObject(rs.CopyObject(tm_brep2_g_trimed),(0,-10 * x,0)))
tm_brep2_g_trimed = rs.ExtrudeCurve(tm_brep2_g_trimed,rs.AddLine(rs.AddPoint(0,0,0),rs.AddPoint(-10 * x,0,0)))
tm_brep2_g_trimed = rs.ExtrudeSurface(tm_brep2_g_trimed,rs.AddLine(rs.AddPoint(0,0,0),rs.AddPoint(0,0,-5 * x)))
tm_brep2_g_trimed2 = rs.MoveObject(rs.CopyObject(tm_brep2_g_trimed),(0,0,-5 * x))

tm_brep2_g[-1] = rs.BooleanIntersection(tm_brep2_g_trimed,tm_brep2_g[-1],delete_input=False)[0]

tm_brep2_g[0]  = rs.MirrorObject(tm_brep2_g[-1],rs.MoveObject(rs.CopyObject(ZhuTou_point),(0,(MianKuo_length * (MianKuo - 2) * x + 2 * j * x)/2 ,0)),rs.MoveObject(rs.CopyObject(ZhuTou_point),(x,(MianKuo_length * (MianKuo - 2) * x + 2 * j * x)/2 ,0)),copy=True)

tm2_brep_jinshen1 = rs.BooleanIntersection(tm_brep2_g_trimed2,tm2_brep_jinshen1,delete_input=False)

tm2_brep_jinshen3 = rs.MoveObject(rs.CopyObject(tm2_brep_jinshen1),(2 *j *x,0,0))

#转角替木下的基座

tm_base = rs.ExplodePolysurfaces(tm_brep2_g_trimed)[5]
rs.MoveObject(tm_base,(0,0,-20 * x))

rs.ScaleObject(tm_base,rs.MoveObject(rs.CopyObject(ZhuTou_point),(0,j * x,0)),[1,5,1],copy=False)
tm_base = rs.ExtrudeSurface(tm_base,rs.AddLine(rs.AddPoint(0,0,0),rs.AddPoint(0,0,16 * x)))
tm_base1 = rs.RotateObject(tm_base,rs.MoveObject(rs.CopyObject(ZhuTou_point),(j * x,j * x,0)),90,[0,0,x],copy=True)

tm_base =rs.BooleanIntersection(tm_base,tm_base1,delete_input=False)


#令拱成组

lg_brep_g_qianyan = [rs.CopyObject(lg_brep)]

sq_rule = [0,0,0,0,0,0,0,0,0,0,0,0,0,0,0,0,0,0,0,0,2.5,5]
for i in range(int((MianKuo - 3)/2)+1):
    if i + 1 < len(range(int((MianKuo - 3)/2))):
        lg_brep1 = rs.MoveObject(rs.CopyObject(lg_brep),(0,-(MianKuo_length * (i+1)) * x,sq_rule[-(int((MianKuo - 3)/2-i))] * x))
        lg_brep_g_qianyan.append(lg_brep1)


lg_brep_g_qianyan_left  = rs.MirrorObjects(lg_brep_g_qianyan,rs.MoveObject(rs.CopyObject(ZhuTou_point),(0,(MianKuo_length * (MianKuo - 2) * x + 2 * j * x)/2 ,0)),rs.MoveObject(rs.CopyObject(ZhuTou_point),(x,(MianKuo_length * (MianKuo - 2) * x + 2 * j * x)/2 ,0)),copy=True)

lg_brep_g_qianyan_left = lg_brep_g_qianyan_left[::-1]

lg_brep_g = lg_brep_g_qianyan_left + lg_brep_g_qianyan

#将头尾的令拱延长成令拱交影
lg_brep_jy1 = rs.MoveObject(rs.CopyObject(lg_brep_g[-1]),(0,-(NiDaoGong_CaiFen_left-5) * x,0))

lg_brep_jy2 = rs.MoveObject(rs.CopyObject(lg_brep_g[-1]),(0,-(MianKuo_length-105) * x,0))

lg_brep_jy3 = rs.MoveObject(rs.CopyObject(lg_brep_g[-1]),(0,-(NiDaoGong_CaiFen_left*3-15) * x,0))
lg_brep_jy3_trimed = rs.ExplodePolysurfaces(lg_brep_jy3)[19]
lg_brep_jy3_trimed=rs.ExtrudeSurface(lg_brep_jy3_trimed,rs.AddLine(rs.AddPoint(0,0,0),rs.AddPoint(0,0,21 * x)))
lg_brep_jy3_1 = rs.BooleanDifference(lg_brep_jy3_trimed,lg_brep_jy3,delete_input=False)[1]
lg_brep_jy3 = rs.BooleanDifference(lg_brep_jy3_trimed,lg_brep_jy3,delete_input=False)[0]
rs.MoveObject(lg_brep_jy3,(0,-2.5 * x,0))
lg_brep_jy3_trimed = rs.ExplodePolysurfaces(lg_brep_jy3)[13]
lg_brep_jy3_trimed = rs.ExtrudeSurface(lg_brep_jy3_trimed,rs.AddLine(rs.AddPoint(0,0,0),rs.AddPoint(0,(NiDaoGong_CaiFen_left+6.5)*x,0)))

lg_brep_jy3 = rs.BooleanDifference(lg_brep_jy3_trimed,lg_brep_jy3,delete_input=False)
lg_brep_jy3 = rs.BooleanDifference(lg_brep_jy3,lg_brep_jy3_1,delete_input=False)

lg_brep_jy = rs.BooleanIntersection(lg_brep_jy1,lg_brep_jy3,delete_input=False)
lg_brep_jy = rs.BooleanIntersection(lg_brep_jy,lg_brep_jy2,delete_input=False)
lg_brep_jy = rs.BooleanIntersection(lg_brep_jy,lg_brep_g[-1],delete_input=False)


#将底部补齐
lg_brep_jy_down = rs.ExplodePolysurfaces(lg_brep_jy)[13]
lg_brep_jy_down = rs.DuplicateEdgeCurves(lg_brep_jy_down)[0]

lg_brep_jy_down = rs.ExtrudeCurve(lg_brep_jy_down,rs.AddLine(rs.AddPoint(0,0,0),rs.AddPoint(0,-75 * x,0)))
lg_brep_jy_down = rs.ExtrudeSurface(lg_brep_jy_down,rs.AddLine(rs.AddPoint(0,0,0),rs.AddPoint(0,0,6 * x)))

lg_brep_jy = rs.BooleanDifference(lg_brep_jy,lg_brep_jy_down ,delete_input=False)

#剪切
lg_brep_jy3_trimed = rs.ExplodePolysurfaces(lg_brep_g[-1])[11]
lg_brep_jy3_trimed = rs.ExtrudeSurface(lg_brep_jy3_trimed,rs.AddLine(rs.AddPoint(0,0,0),rs.AddPoint(0,0,21 * x)))

lg_brep_jy = rs.BooleanUnion([lg_brep_jy,lg_brep_jy3_trimed],delete_input=False)
#平梁组

pl_brep_g_qianyan = [rs.CopyObject(pl_brep)]

sq_rule = [0,0,0,0,0,0,0,0,0,0,0,0,0,0,0,0,0,0,0,0,2.5,5]
for i in range(int((MianKuo - 3)/2)+1):
    if i + 1 < len(range(int((MianKuo - 3)/2))):
        pl_brep1 = rs.MoveObject(rs.CopyObject(pl_brep),(0,-(MianKuo_length * (i+1)) * x,sq_rule[-(int((MianKuo - 3)/2-i))] * x))
        pl_brep_g_qianyan.append(pl_brep1)


pl_brep_g_qianyan_left  = rs.MirrorObjects(pl_brep_g_qianyan,rs.MoveObject(rs.CopyObject(ZhuTou_point),(0,(MianKuo_length * (MianKuo - 2) * x + 2 * j * x)/2 ,0)),rs.MoveObject(rs.CopyObject(ZhuTou_point),(x,(MianKuo_length * (MianKuo - 2) * x + 2 * j * x)/2 ,0)),copy=True)

pl_brep_g_qianyan_left = pl_brep_g_qianyan_left[::-1]

pl_brep_g = pl_brep_g_qianyan_left + pl_brep_g_qianyan

pl_brep_last = rs.MoveObject(rs.CopyObject(pl_brep_g[-1]),(0,-(NiDaoGong_CaiFen_left-5)*x,0))
pl_brep_g.append(pl_brep_last)
pl_brep_g.insert(0,rs.MirrorObject(pl_brep_last,rs.MoveObject(rs.CopyObject(ZhuTou_point),(0,(MianKuo_length * (MianKuo - 2) * x + 2 * j * x)/2 ,0)),rs.MoveObject(rs.CopyObject(ZhuTou_point),(x,(MianKuo_length * (MianKuo - 2) * x + 2 * j * x)/2 ,0)),copy=True))

lg_brep_g[-1] = lg_brep_jy[0]

#令拱交影被平梁剪切


lg_brep_g[-1] = rs.BooleanUnion([lg_brep_g[-1],pl_brep_g[-1]],delete_input=False)[0]



lg_brep_g[0] = rs.MirrorObject(lg_brep_g[-1],rs.MoveObject(rs.CopyObject(ZhuTou_point),(0,(MianKuo_length * (MianKuo - 2) * x + 2 * j * x)/2 ,0)),rs.MoveObject(rs.CopyObject(ZhuTou_point),(x,(MianKuo_length * (MianKuo - 2) * x + 2 * j * x)/2 ,0)),copy=True)


#尽间的栌斗

ld_jinjian = rs.MoveObject(rs.CopyObject(ld_brep_g[-1]),(0,-(MianKuo_length-105) * x,0))

ld_brep_g.append(ld_jinjian)
ld_brep_g.insert(0,rs.MirrorObject(ld_jinjian,rs.MoveObject(rs.CopyObject(ZhuTou_point),(0,(MianKuo_length * (MianKuo - 2) * x + 2 * j * x)/2 ,0)),rs.MoveObject(rs.CopyObject(ZhuTou_point),(x,(MianKuo_length * (MianKuo - 2) * x + 2 * j * x)/2 ,0)),copy=True))

#进深四椽草袱上栌斗的基座
sccf_ld_base_jingshen = rs.ExplodePolysurfaces(ld_brep_g[-1])[5]
sccf_ld_base_jingshen = rs.CurveEndPoint(rs.DuplicateEdgeCurves(sccf_ld_base_jingshen)[0])
rs.MoveObject(sccf_ld_base_jingshen,(0,-21 * x,0))
sccf_ld_base_jingshen = rs.AddLine(sccf_ld_base_jingshen,rs.MoveObject(rs.CopyObject(sccf_ld_base_jingshen),(0,105 *x,0)))
sccf_ld_base_jingshen = rs.ExtrudeCurve(sccf_ld_base_jingshen,rs.AddLine(rs.AddPoint(0,0,0),rs.AddPoint(15 * x,0,0)))
sccf_ld_base_jingshen = rs.ExtrudeSurface(sccf_ld_base_jingshen,rs.AddLine(rs.AddPoint(0,0,0),rs.AddPoint(0,0,-10 * x)))

sccf_ld_base_jingshen = rs.BooleanUnion([sccf_ld_base_jingshen,rs.MoveObject(rs.CopyObject(sccf_brep_jinshen1),(x,0,0))],delete_input=False)
sccf_ld_base_jingshen = rs.BooleanUnion([sccf_ld_base_jingshen,rs.MoveObject(rs.CopyObject(sccf_brep_jinshen1),(-x,0,0))],delete_input=False)

#令拱交影上的令拱

lg_brep_jyy = rs.CopyObject(lg_brep_jy2)

rs.RotateObject(lg_brep_jyy,rs.MoveObject(rs.CopyObject(ZhuTou_point),(j*x+105 * x,j*x+105 * x)),90,[0,0,x],copy=False)

lg_brep_jyy_1 = rs.ExplodePolysurfaces(lg_brep_jyy)[11]
lg_brep_jyy_1 = rs.ExtrudeSurface(lg_brep_jyy_1,rs.AddLine(rs.AddPoint(0,0,0),rs.AddPoint(0,0,10 * x)))

lg_brep_jyy = rs.BooleanDifference(lg_brep_jyy,lg_brep_jyy_1,delete_input=False)
lg_brep_jyy = rs.BooleanUnion([rs.MoveObject(lg_brep_jyy_1,(0,0,-10 * x)),lg_brep_jyy],delete_input=False)

#令拱中间的馒头榫
mts_lg_brep_jyy = rs.ExplodePolysurfaces(lg_brep_jyy)[0]
mts_lg_brep_jyy = rs.ExtrudeSurface(mts_lg_brep_jyy,rs.AddLine(rs.AddPoint(0,0,0),rs.AddPoint(2.5 * x,0,0)))
rs.MoveObject(mts_lg_brep_jyy,(-(NiDaoGong_CaiFen_left-2.5) * x,0,0))

lg_brep_jyy = rs.BooleanDifference(lg_brep_jyy,mts_lg_brep_jyy,delete_input=False)

#第一层令拱上的散斗组

SanDous_g_qianyan = rs.CopyObjects(SanDous)

sq_rule = [0,0,0,0,0,0,0,0,0,0,0,0,0,0,0,0,0,0,0,0,2.5,5]
for i in range(int((MianKuo - 3)/2)+1):
    if i + 1 < len(range(int((MianKuo - 3)/2))):
        SanDous1 = rs.MoveObjects(rs.CopyObjects(SanDous),(0,-(MianKuo_length * (i+1)) * x,sq_rule[-(int((MianKuo - 3)/2-i))] * x))
        SanDous_g_qianyan = SanDous_g_qianyan + SanDous1


SanDous_g_qianyan_left  = rs.MirrorObjects(SanDous_g_qianyan,rs.MoveObject(rs.CopyObject(ZhuTou_point),(0,(MianKuo_length * (MianKuo - 2) * x + 2 * j * x)/2 ,0)),rs.MoveObject(rs.CopyObject(ZhuTou_point),(x,(MianKuo_length * (MianKuo - 2) * x + 2 * j * x)/2 ,0)),copy=True)

SanDous_g_qianyan_left = SanDous_g_qianyan_left[::-1]

SanDous_g = SanDous_g_qianyan_left + SanDous_g_qianyan

SanDous_g_last = rs.MoveObjects(rs.CopyObjects(SanDous_g[len(SanDous_g)-3:len(SanDous_g)]),(0,-(MianKuo_length-105) * x,0))
SanDous_g_last.insert(0,rs.MoveObject(rs.CopyObject(SanDous_g[-2]),(0,-(NiDaoGong_CaiFen_left-5)*x,0)))

SanDous_g_first = rs.MirrorObjects(SanDous_g_last,rs.MoveObject(rs.CopyObject(ZhuTou_point),(0,(MianKuo_length * (MianKuo - 2) * x + 2 * j * x)/2 ,0)),rs.MoveObject(rs.CopyObject(ZhuTou_point),(x,(MianKuo_length * (MianKuo - 2) * x + 2 * j * x)/2 ,0)),copy=True)

SanDous_g = SanDous_g_first + SanDous_g + SanDous_g_last

#叉手组
chashou_brep_g_qianyan = [rs.CopyObject(chashou_brep)]

sq_rule = [0,0,0,0,0,0,0,0,0,0,0,0,0,0,0,0,0,0,0,0,2.5,5]
for i in range(int((MianKuo - 3)/2)+1):
    if i + 1 < len(range(int((MianKuo - 3)/2))):
        chashou_brep1 = rs.MoveObject(rs.CopyObject(chashou_brep),(0,-(MianKuo_length * (i+1)) * x,sq_rule[-(int((MianKuo - 3)/2-i))] * x))
        chashou_brep_g_qianyan.append(chashou_brep1)


chashou_brep_g_qianyan_left  = rs.MirrorObjects(chashou_brep_g_qianyan,rs.MoveObject(rs.CopyObject(ZhuTou_point),(0,(MianKuo_length * (MianKuo - 2) * x + 2 * j * x)/2 ,0)),rs.MoveObject(rs.CopyObject(ZhuTou_point),(x,(MianKuo_length * (MianKuo - 2) * x + 2 * j * x)/2 ,0)),copy=True)

chashou_brep_g_qianyan_left = chashou_brep_g_qianyan_left[::-1]

chashou_brep_g = chashou_brep_g_qianyan_left + chashou_brep_g_qianyan

chashou_brep_last = rs.MoveObject(rs.CopyObject(chashou_brep_g[-1]),(0,-(NiDaoGong_CaiFen_left-5)*x,0))

chashou_brep_g.append(chashou_brep_last)
chashou_brep_g.insert(0,rs.MirrorObject(chashou_brep_last,rs.MoveObject(rs.CopyObject(ZhuTou_point),(0,(MianKuo_length * (MianKuo - 2) * x + 2 * j * x)/2 ,0)),rs.MoveObject(rs.CopyObject(ZhuTou_point),(x,(MianKuo_length * (MianKuo - 2) * x + 2 * j * x)/2 ,0)),copy=True))

#最顶层的令拱组

lg_brep2_g_qianyan = [rs.CopyObject(lg_brep2)]

sq_rule = [0,0,0,0,0,0,0,0,0,0,0,0,0,0,0,0,0,0,0,0,2.5,5]
for i in range(int((MianKuo - 3)/2)+1):
    if i + 1 < len(range(int((MianKuo - 3)/2))):
        lg_brep21 = rs.MoveObject(rs.CopyObject(lg_brep2),(0,-(MianKuo_length * (i+1)) * x,sq_rule[-(int((MianKuo - 3)/2-i))] * x))
        lg_brep2_g_qianyan.append(lg_brep21)


lg_brep2_g_qianyan_left  = rs.MirrorObjects(lg_brep2_g_qianyan,rs.MoveObject(rs.CopyObject(ZhuTou_point),(0,(MianKuo_length * (MianKuo - 2) * x + 2 * j * x)/2 ,0)),rs.MoveObject(rs.CopyObject(ZhuTou_point),(x,(MianKuo_length * (MianKuo - 2) * x + 2 * j * x)/2 ,0)),copy=True)

lg_brep2_g_qianyan_left = lg_brep2_g_qianyan_left[::-1]

lg_brep2_g = lg_brep2_g_qianyan_left + lg_brep2_g_qianyan
lg_brep2_g[-1] = rs.MoveObject(rs.CopyObject(lg_brep_g[-1]),(105 * x,0,62 * x))


lg_brep2_trimed = rs.ExplodePolysurfaces(lg_brep2_g[-1])[90]
lg_brep2_trimed = rs.DuplicateEdgeCurves(lg_brep2_trimed )[3]

rs.MoveObject(lg_brep2_trimed,(0,-99 * x,3 * x))
lg_brep2_trimed = rs.AddLoftSrf([lg_brep2_trimed,rs.MoveObject(rs.CopyObject(lg_brep2_trimed),(0,-150 * x,0))])
lg_brep2_trimed = rs.ExtrudeSurface(lg_brep2_trimed,rs.AddLine(rs.AddPoint(0,0,0),rs.AddPoint(0,0,-50 * x)))

lg_brep2_g[-1] = rs.BooleanDifference(lg_brep2_trimed,lg_brep2_g[-1],delete_input=False)[0]

lg_brep2_g[0] = rs.MirrorObjects(lg_brep2_g[-1],rs.MoveObject(rs.CopyObject(ZhuTou_point),(0,(MianKuo_length * (MianKuo - 2) * x + 2 * j * x)/2 ,0)),rs.MoveObject(rs.CopyObject(ZhuTou_point),(x,(MianKuo_length * (MianKuo - 2) * x + 2 * j * x)/2 ,0)),copy=True)[0]

#顶层令拱上的散斗组

SanDous2_g_qianyan = rs.CopyObjects(SanDous2)

sq_rule = [0,0,0,0,0,0,0,0,0,0,0,0,0,0,0,0,0,0,0,0,2.5,5]
for i in range(int((MianKuo - 3)/2)+1):
    if i + 1 < len(range(int((MianKuo - 3)/2))):
        SanDous21 = rs.MoveObjects(rs.CopyObjects(SanDous2),(0,-(MianKuo_length * (i+1)) * x,sq_rule[-(int((MianKuo - 3)/2-i))] * x))
        SanDous2_g_qianyan = SanDous2_g_qianyan + SanDous21


SanDous2_g_qianyan_left  = rs.MirrorObjects(SanDous2_g_qianyan,rs.MoveObject(rs.CopyObject(ZhuTou_point),(0,(MianKuo_length * (MianKuo - 2) * x + 2 * j * x)/2 ,0)),rs.MoveObject(rs.CopyObject(ZhuTou_point),(x,(MianKuo_length * (MianKuo - 2) * x + 2 * j * x)/2 ,0)),copy=True)

SanDous2_g_qianyan_left = SanDous2_g_qianyan_left[::-1]

SanDous2_g = SanDous2_g_qianyan_left + SanDous2_g_qianyan

SanDous2_g.append(rs.MoveObject(rs.CopyObject(SanDous2_g[-2]),(0,-(NiDaoGong_CaiFen_left-5)*x,0)))


SanDous2_g.insert(0,rs.MirrorObjects(SanDous2_g[-1],rs.MoveObject(rs.CopyObject(ZhuTou_point),(0,(MianKuo_length * (MianKuo - 2) * x + 2 * j * x)/2 ,0)),rs.MoveObject(rs.CopyObject(ZhuTou_point),(x,(MianKuo_length * (MianKuo - 2) * x + 2 * j * x)/2 ,0)),copy=True)[0])

#剪切最上方的檩条
lt5_breps_trimed = rs.ExplodePolysurfaces(lg_brep2_trimed)[1]

lt5_breps_trimed = rs.ExtrudeSurface(lt5_breps_trimed,rs.AddLine(rs.AddPoint(0,0,0),rs.AddPoint(-20 * x,0,0)))

rs.MoveObject(lt5_breps_trimed,(5 * x,0,35 * x))


lt5_breps[-1] = rs.BooleanIntersection(lt5_breps_trimed,lt5_breps[-1],delete_input=False)[0]

lt5_breps_trimed = rs.ExplodePolysurfaces(lt5_breps[-1])[10]
lt5_breps_trimed = rs.ExtrudeSurface(lt5_breps_trimed,rs.AddLine(rs.AddPoint(0,0,0),rs.AddPoint(0,0,20 * x)))

rs.MoveObject(lt5_breps_trimed,(0,0,-5 * x))

lt5_breps[-1] = rs.BooleanDifference(lt5_breps[-1],lt5_breps_trimed,delete_input=False)[0]
lt5_breps[0] = rs.MirrorObject(lt5_breps[-1],rs.MoveObject(rs.CopyObject(ZhuTou_point),(0,(MianKuo_length * (MianKuo - 2) * x + 2 * j * x)/2 ,0)),rs.MoveObject(rs.CopyObject(ZhuTou_point),(x,(MianKuo_length * (MianKuo - 2) * x + 2 * j * x)/2 ,0)),copy=True)



lt_breps_g=  rs.MoveObjects(lt2_breps+lt3_breps+lt4_breps+lt5_breps+lt2_breps_jingshen+lt3_breps_jingshen+lt4_breps_jingshen,(0,0,-15 * x))

lt_breps_g = lt_breps + lt_breps_g + lt_breps_jingshen


#"jbbs_mk_head_mid" 延长
jbbs_mk_head_mid_extrend = rs.ExplodePolysurfaces(jbbs_mk_head_mid)[22]
jbbs_mk_head_mid_extrend = rs.ExtrudeSurface(jbbs_mk_head_mid_extrend,rs.AddLine(rs.AddPoint(0,0,0),rs.AddPoint(0,0,-4 * x)))

jbbs_mk_head_mid = rs.BooleanDifference(jbbs_mk_head_mid_extrend,jbbs_mk_head_mid,delete_input=False)


#四椽草袱被檩条剪切
sccf_brep_jinshen1 = rs.BooleanDifference(sccf_brep_jinshen1,lt3_breps_jingshen[-1],delete_input=False)
sccf_brep_jinshen3 = rs.BooleanDifference(sccf_brep_jinshen3,lt3_breps_jingshen[0],delete_input=False)


sccf_brep_jinshen2_trimed = rs.BooleanUnion([lt3_breps_jingshen[-1],lt3_breps_jingshen[0]],delete_input=False)
sccf_brep_jinshen2 = rs.BooleanDifference(sccf_brep_jinshen2,sccf_brep_jinshen2_trimed,delete_input=False)



#第三层替木组

tm_brep3_g_qianyan = [rs.CopyObject(tm_brep3)]

sq_rule = [0,0,0,0,0,0,0,0,0,0,0,0,0,0,0,0,0,0,0,0,2.5,5]
for i in range(int((MianKuo - 3)/2)+1):
    if i + 1 < len(range(int((MianKuo - 3)/2))):
        tm_brep31 = rs.MoveObject(rs.CopyObject(tm_brep3),(0,-(MianKuo_length * (i+1)) * x,sq_rule[-(int((MianKuo - 3)/2-i))] * x))
        tm_brep3_g_qianyan.append(tm_brep31)


tm_brep3_g_qianyan_left  = rs.MirrorObjects(tm_brep3_g_qianyan,rs.MoveObject(rs.CopyObject(ZhuTou_point),(0,(MianKuo_length * (MianKuo - 2) * x + 2 * j * x)/2 ,0)),rs.MoveObject(rs.CopyObject(ZhuTou_point),(x,(MianKuo_length * (MianKuo - 2) * x + 2 * j * x)/2 ,0)),copy=True)

tm_brep3_g_qianyan_left = tm_brep3_g_qianyan_left[::-1]

tm_brep3_g = tm_brep3_g_qianyan_left + tm_brep3_g_qianyan

#第三层两头替木延长

tm_brep3_trimed = rs.ExplodePolysurfaces(tm_brep3_g[-1])[5]

tm_brep3_trimed = rs.ExtrudeSurface(tm_brep3_trimed,rs.AddLine(rs.AddPoint(0,0,0),rs.AddPoint(0,0,21 * x)))

tm_brep3_head1 = rs.BooleanDifference(tm_brep3_g[-1],tm_brep3_trimed,delete_input=False)[0]
tm_brep3_head2 = rs.BooleanDifference(tm_brep3_g[-1],tm_brep3_trimed,delete_input=False)[1]
tm_brep4_head2 = rs.MoveObject(rs.CopyObject(tm_brep3_head2),(105 * x,0,62 * x))
rs.MoveObject(tm_brep3_head1,(0,-118 * x,0))

tm_brep3_mid = rs.ExplodePolysurfaces(tm_brep3_head2)[7]
tm_brep4_mid = rs.MoveObject(rs.CopyObject(tm_brep3_mid),(105 * x,0,62 * x))
tm_brep3_mid = rs.ExtrudeSurface(tm_brep3_mid,rs.AddLine(rs.AddPoint(0,0,0),rs.AddPoint(0,-197 * x,0)))
tm_brep4_mid = rs.ExtrudeSurface(tm_brep4_mid,rs.AddLine(rs.AddPoint(0,0,0),rs.AddPoint(0,-107 * x,0)))
tm_brep3_g[-1] = rs.BooleanDifference(tm_brep3_mid,tm_brep3_head2,delete_input=False)[0]
tm_brep3_g[-1] = rs.BooleanDifference(tm_brep3_g[-1],tm_brep3_head1,delete_input=False)[0]

tm_brep3_g[0] = rs.MirrorObject(tm_brep3_g[-1],rs.MoveObject(rs.CopyObject(ZhuTou_point),(0,(MianKuo_length * (MianKuo - 2) * x + 2 * j * x)/2 ,0)),rs.MoveObject(rs.CopyObject(ZhuTou_point),(x,(MianKuo_length * (MianKuo - 2) * x + 2 * j * x)/2 ,0)),copy=True)

#第四层替木组

tm_brep4_g_qianyan = [rs.CopyObject(tm_brep4)]

sq_rule = [0,0,0,0,0,0,0,0,0,0,0,0,0,0,0,0,0,0,0,0,2.5,5]
for i in range(int((MianKuo - 3)/2)+1):
    if i + 1 < len(range(int((MianKuo - 3)/2))):
        tm_brep41 = rs.MoveObject(rs.CopyObject(tm_brep4),(0,-(MianKuo_length * (i+1)) * x,sq_rule[-(int((MianKuo - 3)/2-i))] * x))
        tm_brep4_g_qianyan.append(tm_brep41)


tm_brep4_g_qianyan_left  = rs.MirrorObjects(tm_brep4_g_qianyan,rs.MoveObject(rs.CopyObject(ZhuTou_point),(0,(MianKuo_length * (MianKuo - 2) * x + 2 * j * x)/2 ,0)),rs.MoveObject(rs.CopyObject(ZhuTou_point),(x,(MianKuo_length * (MianKuo - 2) * x + 2 * j * x)/2 ,0)),copy=True)

tm_brep4_g_qianyan_left = tm_brep4_g_qianyan_left[::-1]

tm_brep4_g = tm_brep4_g_qianyan_left + tm_brep4_g_qianyan

tm_brep4_g[-1] = rs.BooleanDifference(tm_brep4_mid,tm_brep4_head2,delete_input=False)[0]
tm_brep4_g[0] = rs.MirrorObject(tm_brep4_g[-1],rs.MoveObject(rs.CopyObject(ZhuTou_point),(0,(MianKuo_length * (MianKuo - 2) * x + 2 * j * x)/2 ,0)),rs.MoveObject(rs.CopyObject(ZhuTou_point),(x,(MianKuo_length * (MianKuo - 2) * x + 2 * j * x)/2 ,0)),copy=True)


#四椽草袱进深方向头向上延伸


sccf_brep_jinshen2_head = rs.ExplodePolysurfaces(sccf_brep_jinshen2)[14]
sccf_brep_jinshen2_head = rs.ExtrudeSurface(sccf_brep_jinshen2_head,rs.AddLine(rs.AddPoint(0,0,0),rs.AddPoint(0,0,2 * x)))
sccf_brep_jinshen2 = rs.BooleanDifference(sccf_brep_jinshen2_head,sccf_brep_jinshen2,delete_input=False)

#被平梁剪切

sccf_brep_jinshen2 =  rs.BooleanUnion([pl_brep_g[-2],sccf_brep_jinshen2],delete_input=False)

#四椽草袱进深方向上的令拱

lg_brep_jyy2 = rs.MoveObject(rs.CopyObject(lg_brep_jyy),(j/2*x,0,0))

lg_brep_jyy3 = rs.MoveObject(rs.CopyObject(lg_brep_jyy),(j*x,0,0))
#补齐
lg_brep_jyy2_fix = rs.ExplodePolysurfaces(lg_brep_jyy2)[47]

lg_brep_jyy2_fix  = rs.ExtrudeSurface(lg_brep_jyy2_fix ,rs.AddLine(rs.AddPoint(0,0,0),rs.AddPoint(0,0,-5 * x)))

lg_brep_jyy2 = rs.BooleanDifference(lg_brep_jyy2,lg_brep_jyy2_fix,delete_input=False)

#四椽草袱进深方向上的栌斗
ld2_jinshen = rs.MoveObject(rs.CopyObject(ld_brep_g[-1]),(j/2*x,0,0))

#补齐
ld2_jinshen_fix = rs.ExplodePolysurfaces(ld2_jinshen)[34]
ld2_jinshen_fix = rs.ExtrudeSurface(ld2_jinshen_fix ,rs.AddLine(rs.AddPoint(0,0,0),rs.AddPoint(0,0,6 * x)))

ld2_jinshen = rs.BooleanDifference(ld2_jinshen,ld2_jinshen_fix,delete_input=False)

#被上面的令拱剪切

ld2_jinshen = rs.BooleanDifference(lg_brep_jyy2,ld2_jinshen,delete_input=False)

#四椽草袱进深方向上的栌斗下的基座

sccf_ld_base_jingshen2 = rs.MoveObject(rs.CopyObject(sccf_ld_base_jingshen),(j/2*x,0,0))

#被四椽草袱剪切

sccf_ld_base_jingshen2 = rs.BooleanDifference(rs.MoveObject(rs.CopyObject(sccf_brep_jinshen2),(x,0,0)),sccf_ld_base_jingshen2,delete_input=False)
sccf_ld_base_jingshen2 = rs.BooleanIntersection(rs.MoveObject(rs.CopyObject(sccf_brep_jinshen2),(-x,0,0)),sccf_ld_base_jingshen2,delete_input=False)

#进深方向第四层替木

tm3_brep_jinshen = rs.MoveObject(rs.CopyObject(tm2_brep_jinshen2),(0,105 * x,58 * x))

tm3_brep_jinshen_trimed = rs.ExplodePolysurfaces(tm3_brep_jinshen)[5]

tm3_brep_jinshen_trimed = rs.ExtrudeSurface(tm3_brep_jinshen_trimed,rs.AddLine(rs.AddPoint(0,0,0),rs.AddPoint(0,0,21 * x)))

tm3_brep_jinshen_head1 = rs.BooleanDifference(tm3_brep_jinshen,tm3_brep_jinshen_trimed,delete_input=False)[0]
tm3_brep_jinshen_head2 = rs.BooleanDifference(tm3_brep_jinshen,tm3_brep_jinshen_trimed,delete_input=False)[1]

rs.MoveObject(tm3_brep_jinshen_head1,(86 * x,0,0))
rs.MoveObject(tm3_brep_jinshen_head2,(-86* x,0,0))
tm3_brep_jinshen_mid = rs.ExplodePolysurfaces(tm3_brep_jinshen_head2)[7]

tm3_brep_jinshen_mid = rs.ExtrudeSurface(tm3_brep_jinshen_mid,rs.AddLine(rs.AddPoint(0,0,0),rs.AddPoint(251 * x,0,0)))

tm3_brep_jinshen = rs.BooleanDifference(tm3_brep_jinshen_mid ,tm3_brep_jinshen_head2,delete_input=False)
tm3_brep_jinshen = rs.BooleanDifference(tm3_brep_jinshen  ,tm3_brep_jinshen_head1,delete_input=False)


#令拱上的散斗 

SanDous1_jinshen =rs.RotateObject(SanDous_g[-1],rs.MoveObject(rs.CopyObject(ZhuTou_point),((j + 105) * x,(j + 105) * x,0)),90,[0,0,x],copy=True)

rs.MoveObject(SanDous1_jinshen,(-(NiDaoGong_CaiFen_left-5) * x,0,0))

SanDous2_jinshen = rs.MoveObject(rs.CopyObject(SanDous1_jinshen),(2 * NiDaoGong_CaiFen_left * x -10 * x,0,0))

SanDous3_jinshen = rs.MoveObject(rs.CopyObject(SanDous1_jinshen),(j/2 * x,0,0))

SanDous4_jinshen = rs.MoveObject(rs.CopyObject(SanDous3_jinshen),((NiDaoGong_CaiFen_left-5) * x,0,0))

SanDous5_jinshen = rs.MoveObject(rs.CopyObject(SanDous2_jinshen),(j/2 * x,0,0))

SanDous6_jinshen = rs.MoveObject(rs.CopyObject(SanDous1_jinshen),(j * x,0,0))

SanDous7_jinshen = rs.MoveObject(rs.CopyObject(SanDous2_jinshen),(j * x,0,0))

SanDous_jinshen_g = [SanDous1_jinshen ,SanDous2_jinshen ,SanDous3_jinshen ,SanDous4_jinshen ,SanDous5_jinshen ,SanDous6_jinshen ,SanDous7_jinshen ]

##

SanDous_g[-1] = rs.BooleanDifference(tm3_brep_jinshen,SanDous_g[-1],delete_input=False)[0]

SanDous_g[3] = rs.MirrorObject(SanDous_g[-1],rs.MoveObject(rs.CopyObject(ZhuTou_point),(0,(MianKuo_length * (MianKuo - 2) * x + 2 * j * x)/2 ,0)),rs.MoveObject(rs.CopyObject(ZhuTou_point),(x,(MianKuo_length * (MianKuo - 2) * x + 2 * j * x)/2 ,0)),copy=True)

#第一层替木成组
tm_brep_g_qianyan = [rs.CopyObject(tm_brep)]

sq_rule = [0,0,0,0,0,0,0,0,0,0,0,0,0,0,0,0,0,0,0,0,2.5,5]
for i in range(int((MianKuo - 3)/2)+1):
    if i + 1 < len(range(int((MianKuo - 3)/2)+1)):
        tm_brep1 = rs.MoveObject(rs.CopyObject(tm_brep),(0,-(MianKuo_length * (i+1)) * x,sq_rule[-(int((MianKuo - 3)/2-i))] * x))
        tm_brep_g_qianyan.append(tm_brep1)


tm_brep_g_qianyan_left  = rs.MirrorObjects(tm_brep_g_qianyan,rs.MoveObject(rs.CopyObject(ZhuTou_point),(0,(MianKuo_length * (MianKuo - 2) * x + 2 * j * x)/2 ,0)),rs.MoveObject(rs.CopyObject(ZhuTou_point),(x,(MianKuo_length * (MianKuo - 2) * x + 2 * j * x)/2 ,0)),copy=True)

tm_brep_g_qianyan_left = tm_brep_g_qianyan_left[::-1]

tm_brep_g = tm_brep_g_qianyan_left + tm_brep_g_qianyan

#面扩方向缴背成组

jb_brep_g_qianyan = [rs.CopyObject(jb_brep)]

sq_rule = [0,0,0,0,0,0,0,0,0,0,0,0,0,0,0,0,0,0,0,0,2.5,5]
for i in range(int((MianKuo - 3)/2)+1):
    if i + 1 < len(range(int((MianKuo - 3)/2)+1)):
        jb_brep1 = rs.MoveObject(rs.CopyObject(jb_brep),(0,-(MianKuo_length * (i+1)) * x,sq_rule[-(int((MianKuo - 3)/2-i))] * x))
        jb_brep_g_qianyan.append(jb_brep1)


jb_brep_g_qianyan_left  = rs.MirrorObjects(jb_brep_g_qianyan,rs.MoveObject(rs.CopyObject(ZhuTou_point),(0,(MianKuo_length * (MianKuo - 2) * x + 2 * j * x)/2 ,0)),rs.MoveObject(rs.CopyObject(ZhuTou_point),(x,(MianKuo_length * (MianKuo - 2) * x + 2 * j * x)/2 ,0)),copy=True)

jb_brep_g_qianyan_left = jb_brep_g_qianyan_left[::-1]

jb_brep_g = jb_brep_g_qianyan_left + jb_brep_g_qianyan

#栌斗基座成组

sccf_ld_base_g_qianyan = [rs.CopyObject(sccf_ld_base)]

sq_rule = [0,0,0,0,0,0,0,0,0,0,0,0,0,0,0,0,0,0,0,0,2.5,5]
for i in range(int((MianKuo - 3)/2)+1):
    if i + 1 < len(range(int((MianKuo - 3)/2)-1)):
        sccf_ld_base1 = rs.MoveObject(rs.CopyObject(sccf_ld_base),(0,-(MianKuo_length * (i+1)) * x,sq_rule[-(int((MianKuo - 3)/2-i))] * x))
        sccf_ld_base_g_qianyan.append(sccf_ld_base1)


sccf_ld_base_g_qianyan_left  = rs.MirrorObjects(sccf_ld_base_g_qianyan,rs.MoveObject(rs.CopyObject(ZhuTou_point),(0,(MianKuo_length * (MianKuo - 2) * x + 2 * j * x)/2 ,0)),rs.MoveObject(rs.CopyObject(ZhuTou_point),(x,(MianKuo_length * (MianKuo - 2) * x + 2 * j * x)/2 ,0)),copy=True)

sccf_ld_base_g_qianyan_left = sccf_ld_base_g_qianyan_left[::-1]

sccf_ld_base_g = sccf_ld_base_g_qianyan_left + sccf_ld_base_g_qianyan

tm_base2 = rs.MirrorObject(tm_base,rs.MoveObject(rs.CopyObject(ZhuTou_point),(4 * j/2 * x,0,0)),rs.MoveObject(rs.CopyObject(ZhuTou_point),(4 * j/2 * x,x,0)),copy=True)

sccf_ld_base_jingshen3 = rs.MirrorObject(sccf_ld_base_jingshen,rs.MoveObject(rs.CopyObject(ZhuTou_point),(4 * j/2 * x,0,0)),rs.MoveObject(rs.CopyObject(ZhuTou_point),(4 * j/2 * x,x,0)),copy=True)

############################################

#转角草乳袱生成

crf_zj_pt0 = rs.MoveObject(rs.CopyObject(ZhuTou_point),(j * x,j * x,377 * x))

crf_zj_brep = rs.AddLine(crf_zj_pt0,rs.MoveObject(rs.CopyObject(crf_zj_pt0),(-j * x -150 * x,0,0)))

rs.MoveObject(crf_zj_brep,(5 * x,5 * x,0))
crf_zj_brep = rs.ExtrudeCurve(crf_zj_brep,rs.AddLine(rs.AddPoint(0,0,0),rs.AddPoint(0,-10 * x,0)))
crf_zj_brep = rs.ExtrudeSurface(crf_zj_brep,rs.AddLine(rs.AddPoint(0,0,0),rs.AddPoint(0,0,15 * x)))
rs.RotateObject(crf_zj_brep,crf_zj_pt0,45,[0,0,x],copy=False)

#草乳袱上的缴背

jb_zj_brep = rs.ExplodePolysurfaces(crf_zj_brep)[5]
jb_zj_brep = rs.ExtrudeSurface(jb_zj_brep,rs.AddLine(rs.AddPoint(0,0,0),rs.AddPoint(0,0,6.5* x)))

#大角梁生成

JiaoLiang_brep = rs.AddLine(crf_zj_pt0,rs.MoveObject(rs.CopyObject(crf_zj_pt0),(-math.sqrt(2) * 2 * j * x + 76 * x,0,0)))

JiaoLiang_brep_pt = rs.CurveStartPoint(JiaoLiang_brep)
JiaoLiang_brep = rs.ExtrudeCurve(JiaoLiang_brep,rs.AddLine(rs.AddPoint(0,0,0),rs.AddPoint(0,0,25 * x)))

rs.MoveObject(JiaoLiang_brep,(-12 * x,5 * x,0))

JiaoLiang_brep = rs.ExtrudeSurface(JiaoLiang_brep,rs.AddLine(rs.AddPoint(0,0,0),rs.AddPoint(0,-10 * x,0)))

#大角梁进行剪切

JiaoLiang_trimed = rs.ExplodePolysurfaces(JiaoLiang_brep)[0]
JiaoLiang_trimed = rs.CurveEndPoint(rs.DuplicateEdgeCurves(JiaoLiang_trimed)[0])
rs.MoveObject(JiaoLiang_trimed,(30 * x,0,0))

JiaoLiang_trimed_pts = [JiaoLiang_trimed,rs.MoveObject(rs.CopyObject(JiaoLiang_trimed),(-3 * x,0,2.5 * x)),rs.MoveObject(rs.CopyObject(JiaoLiang_trimed),(-1 * x,0,4* x)),rs.MoveObject(rs.CopyObject(JiaoLiang_trimed),(-1 * x,0,6* x)),rs.MoveObject(rs.CopyObject(JiaoLiang_trimed),(-4 * x,0,6.5* x)),rs.MoveObject(rs.CopyObject(JiaoLiang_trimed),(-10 * x,0,7* x)),rs.MoveObject(rs.CopyObject(JiaoLiang_trimed),(-25 * x,0,9* x)),rs.MoveObject(rs.CopyObject(JiaoLiang_trimed),(-29.5 * x,0,15* x)),rs.MoveObject(rs.CopyObject(JiaoLiang_trimed),(-30 * x,0,25* x)),]


JiaoLiang_trimed = rs.AddInterpCurve(JiaoLiang_trimed_pts)
rs.MoveObject(JiaoLiang_trimed,(0,x,0))
JiaoLiang_trimed = rs.ExtrudeCurve(JiaoLiang_trimed,rs.AddLine(rs.AddPoint(0,0,0),rs.AddPoint(0,-12 * x,0)))
JiaoLiang_trimed = rs.ExtrudeSurface(JiaoLiang_trimed,rs.AddLine(rs.AddPoint(0,0,0),rs.AddPoint(-35 * x,0,0)))


JiaoLiang_brep = rs.BooleanDifference(JiaoLiang_brep,JiaoLiang_trimed,delete_input=True)

rs.RotateObject(JiaoLiang_brep,JiaoLiang_brep_pt,-9,[0,x,0],copy=False)

rs.RotateObject(JiaoLiang_brep,crf_zj_pt0,45,[0,0,x],copy=False)

rs.MoveObject(JiaoLiang_brep,(0,0,54.5 * x))

#子角梁生成

ZiJiaoLiang_brep = rs.DuplicateEdgeCurves(rs.ExplodePolysurfaces(JiaoLiang_brep)[0])[1]

ZiJiaoLiang_brep = rs.DivideCurveLength(ZiJiaoLiang_brep,103* x,create_points=True)[1]

rs.RotateObject(ZiJiaoLiang_brep,crf_zj_pt0,-45,[0,0,x],copy=False)
ZiJiaoLiang_brep_pt = rs.CopyObject(ZiJiaoLiang_brep)

rs.MoveObject(ZiJiaoLiang_brep,(0,0,0))
ZiJiaoLiang_brep = rs.AddLine(ZiJiaoLiang_brep,rs.MoveObject(rs.CopyObject(ZiJiaoLiang_brep),(-121 * x,0,0)))
ZiJiaoLiang_brep= rs.ExtrudeCurve(ZiJiaoLiang_brep,rs.AddLine(rs.AddPoint(0,0,0),rs.AddPoint(0,-10 * x,0)))
ZiJiaoLiang_brep= rs.ExtrudeSurface(ZiJiaoLiang_brep,rs.AddLine(rs.AddPoint(0,0,0),rs.AddPoint(0,0,-8 * x)))

rs.RotateObject(ZiJiaoLiang_brep,ZiJiaoLiang_brep_pt,-4.5,[0,x,0],copy=False)
rs.RotateObject(ZiJiaoLiang_brep,crf_zj_pt0,45,[0,0,x],copy=False)

#子角梁被大角昂剪切
ZiJiaoLiang_brep = rs.BooleanDifference(ZiJiaoLiang_brep,JiaoLiang_brep,delete_input=False)

#子角梁的头
ZiJiaoLiang_brep_head= rs.ExplodePolysurfaces(ZiJiaoLiang_brep)[1]

rs.RotateObject(ZiJiaoLiang_brep_head,crf_zj_pt0,-45,[0,0,x],copy=False)

ZiJiaoLiang_brep_head = rs.DuplicateEdgeCurves(ZiJiaoLiang_brep_head)[2]
rs.MoveObject(ZiJiaoLiang_brep_head,(0,0,-1.5 * x))

ZiJiaoLiang_brep_head_trimed = rs.CurveStartPoint(ZiJiaoLiang_brep_head)

ZiJiaoLiang_brep_head = rs.ExtrudeCurve(ZiJiaoLiang_brep_head,rs.AddLine(rs.AddPoint(0,0,0),rs.AddPoint(0,0,11 * x)))
ZiJiaoLiang_brep_head = rs.ExtrudeSurface(ZiJiaoLiang_brep_head,rs.AddLine(rs.AddPoint(0,0,0),rs.AddPoint(-13 * x,0,x)))

rs.MoveObject(ZiJiaoLiang_brep_head_trimed,(0,0,x))

ZiJiaoLiang_brep_head_trimed = rs.AddInterpCurve([ZiJiaoLiang_brep_head_trimed,rs.MoveObject(rs.CopyObject(ZiJiaoLiang_brep_head_trimed),(-0.1 * x,0,-0.5 * x)),rs.MoveObject(rs.CopyObject(ZiJiaoLiang_brep_head_trimed),(-x,0,-x)),rs.MoveObject(rs.CopyObject(ZiJiaoLiang_brep_head_trimed),(-5 * x,0,0.2 * x)),rs.MoveObject(rs.CopyObject(ZiJiaoLiang_brep_head_trimed),(-10 * x,0,3 * x)),rs.MoveObject(rs.CopyObject(ZiJiaoLiang_brep_head_trimed),(-12 * x,0,5 * x)),rs.MoveObject(rs.CopyObject(ZiJiaoLiang_brep_head_trimed),(-13 * x,0,5 * x)),rs.MoveObject(rs.CopyObject(ZiJiaoLiang_brep_head_trimed),(-12 * x,0,6 * x)),rs.MoveObject(rs.CopyObject(ZiJiaoLiang_brep_head_trimed),(-13 * x,0,7 * x)),rs.MoveObject(rs.CopyObject(ZiJiaoLiang_brep_head_trimed),(-15 * x,0,10 * x))])
ZiJiaoLiang_brep_head_trimed2 = rs.CurveEndPoint(ZiJiaoLiang_brep_head_trimed)

ZiJiaoLiang_brep_head_trimed2 = rs.AddInterpCurve([ZiJiaoLiang_brep_head_trimed2,rs.MoveObject(rs.CopyObject(ZiJiaoLiang_brep_head_trimed2),(-0.5 * x,0,0.5 * x)),rs.MoveObject(rs.CopyObject(ZiJiaoLiang_brep_head_trimed2),(1 * x,0,0.5 * x)),rs.MoveObject(rs.CopyObject(ZiJiaoLiang_brep_head_trimed2),(2 * x,0,-0.3 * x)),rs.MoveObject(rs.CopyObject(ZiJiaoLiang_brep_head_trimed2),(3 * x,0,0.05 * x)),rs.MoveObject(rs.CopyObject(ZiJiaoLiang_brep_head_trimed2),(3.5 * x,0,0.06 * x)),rs.MoveObject(rs.CopyObject(ZiJiaoLiang_brep_head_trimed2),(4 * x,0,0.15 * x)),rs.MoveObject(rs.CopyObject(ZiJiaoLiang_brep_head_trimed2),(4.5 * x,0,0.3 * x)),rs.MoveObject(rs.CopyObject(ZiJiaoLiang_brep_head_trimed2),(5 * x,0,0.8 * x)),rs.MoveObject(rs.CopyObject(ZiJiaoLiang_brep_head_trimed2),(7 * x,0,0.8 * x))])
ZiJiaoLiang_brep_head_trimed3 = rs.CurveEndPoint(ZiJiaoLiang_brep_head_trimed2)

ZiJiaoLiang_brep_head_trimed3 = rs.AddInterpCurve([ZiJiaoLiang_brep_head_trimed3,rs.MoveObject(rs.CopyObject(ZiJiaoLiang_brep_head_trimed3),(0.5 * x,0,1 * x)),rs.MoveObject(rs.CopyObject(ZiJiaoLiang_brep_head_trimed3),(1 * x,0,-0.1 * x)),rs.MoveObject(rs.CopyObject(ZiJiaoLiang_brep_head_trimed3),(2 * x,0,-0.5 * x)),rs.MoveObject(rs.CopyObject(ZiJiaoLiang_brep_head_trimed3),(7 * x,0,-1 * x)),rs.MoveObject(rs.CopyObject(ZiJiaoLiang_brep_head_trimed3),(8 * x,0,-2 * x))])

ZiJiaoLiang_brep_head = rs.JoinCurves([ZiJiaoLiang_brep_head_trimed,ZiJiaoLiang_brep_head_trimed2,ZiJiaoLiang_brep_head_trimed3])
ZiJiaoLiang_brep_head = rs.JoinCurves([ZiJiaoLiang_brep_head,rs.AddLine(rs.CurveStartPoint(ZiJiaoLiang_brep_head),rs.CurveEndPoint(ZiJiaoLiang_brep_head))])
ZiJiaoLiang_brep_head =rs.ExtrudeCurve(ZiJiaoLiang_brep_head,rs.AddLine(rs.AddPoint(0,0,0),rs.AddPoint(0,-10 * x,0)))
rs.CapPlanarHoles(ZiJiaoLiang_brep_head)
rs.RotateObject(ZiJiaoLiang_brep_head,crf_zj_pt0,45,[0,0,x],copy=False)

ZiJiaoLiang_brep = rs.BooleanUnion([ZiJiaoLiang_brep_head,ZiJiaoLiang_brep],delete_input=False)

#草乳袱被角梁剪切

crf_zj_brep = rs.BooleanUnion([JiaoLiang_brep,crf_zj_brep],delete_input=False)

jb_zj_brep = rs.BooleanDifference(jb_zj_brep,JiaoLiang_brep,delete_input=False)[0]

#角梁两侧的架子

JiaoLiang_jia_brep1 = rs.MoveObject(rs.CopyObject(ZhuTou_point),(-(HuaGong_CaiFen_left + 57-5) * x,j * x/2-21 * x,368 * x))
JiaoLiang_jia_brep_point = rs.MoveObject(rs.CopyObject(JiaoLiang_jia_brep1),(-5,0,0))
JiaoLiang_jia_brep1 = rs.AddLine(JiaoLiang_jia_brep1,rs.MoveObject(rs.CopyObject(JiaoLiang_jia_brep1),(-10 * x,0,0)))

JiaoLiang_jia_brep1 = rs.ExtrudeCurve(JiaoLiang_jia_brep1,rs.AddLine(rs.AddPoint(0,0,0),rs.AddPoint(0,0,2 * x)))





JiaoLiang_jia_brep1 = rs.JoinCurves(rs.DuplicateEdgeCurves(JiaoLiang_jia_brep1))
JiaoLiang_jia2_brep1 = rs.MoveObject(rs.CopyObject(JiaoLiang_jia_brep1),(0,-56 * x,0))
JiaoLiang_jia2_brep2 = rs.MoveObject(rs.CopyObject(JiaoLiang_jia_brep1),(0,-170 * x,0))
rs.ScaleObject(JiaoLiang_jia2_brep2,JiaoLiang_jia_brep_point,[1,1,6],copy=False)


JiaoLiang_jia_brep2 = rs.MoveObject(rs.CopyObject(JiaoLiang_jia_brep1),(0,-215 * x,0))
rs.ScaleObject(JiaoLiang_jia_brep2,JiaoLiang_jia_brep_point,[1,1,6],copy=False)

JiaoLiang_jia_brep = rs.AddLoftSrf([JiaoLiang_jia_brep1,JiaoLiang_jia_brep2])
rs.CapPlanarHoles(JiaoLiang_jia_brep)

JiaoLiang_jia2_brep = rs.AddLoftSrf([JiaoLiang_jia2_brep1,JiaoLiang_jia2_brep2])
rs.CapPlanarHoles(JiaoLiang_jia2_brep)

rs.RotateObject(JiaoLiang_jia_brep,JiaoLiang_jia_brep_point,-10,[0,0,x],copy=False)

#架子被大角昂剪切

JiaoLiang_jia_brep = rs.BooleanDifference(JiaoLiang_jia_brep,JiaoLiang_brep,delete_input=False)
JiaoLiang_jia2_brep = rs.BooleanDifference(JiaoLiang_jia2_brep,JiaoLiang_brep,delete_input=False)




#架子的插销

cx_JiaoLiang_jia_brep = rs.ExplodePolysurfaces(JiaoLiang_jia_brep)[2]
cx_JiaoLiang_jia_brep = rs.CurveEndPoint(rs.DuplicateEdgeCurves(cx_JiaoLiang_jia_brep))

rs.MoveObject(cx_JiaoLiang_jia_brep,(-2.5 * x,-2.5 * x,-3 * x))
cx_JiaoLiang_jia_brep = rs.AddLine(cx_JiaoLiang_jia_brep,rs.MoveObject(rs.CopyObject(cx_JiaoLiang_jia_brep),(-7 * x,-7 *x,0)))
cx_JiaoLiang_jia_brep = rs.ExtrudeCurve(cx_JiaoLiang_jia_brep,rs.AddLine(rs.AddPoint(0,0,0),rs.AddPoint(0,0,-4.5 * x)))
cx_JiaoLiang_jia_brep = rs.ExtrudeSurface(cx_JiaoLiang_jia_brep,rs.AddLine(rs.AddPoint(0,0,0),rs.AddPoint(2.5 * x,-2.5 * x,0)))

JiaoLiang_jia_brep = rs.BooleanDifference(cx_JiaoLiang_jia_brep,JiaoLiang_jia_brep,delete_input=False)
JiaoLiang_jia_brep2 = rs.MirrorObject(JiaoLiang_jia_brep,crf_zj_pt0,rs.MoveObject(rs.CopyObject(crf_zj_pt0),(x,x,0)),copy=True)

#大角梁被架子剪切
JiaoLiang_brep = rs.BooleanIntersection(JiaoLiang_brep,JiaoLiang_jia_brep,delete_input=False)
JiaoLiang_brep = rs.BooleanIntersection(JiaoLiang_jia_brep2,JiaoLiang_brep,delete_input=False)

cx_JiaoLiang_jia2_brep = rs.ExplodePolysurfaces(JiaoLiang_jia2_brep)[3]

cx_JiaoLiang_jia2_brep = rs.CurveEndPoint(rs.DuplicateEdgeCurves(cx_JiaoLiang_jia2_brep)[0])

rs.MoveObject(cx_JiaoLiang_jia2_brep,(-1.5 * x,-1.5 * x,-3 * x))
cx_JiaoLiang_jia2_brep = rs.AddLine(cx_JiaoLiang_jia2_brep,rs.MoveObject(rs.CopyObject(cx_JiaoLiang_jia2_brep),(-7 * x,-7 *x,0)))
cx_JiaoLiang_jia2_brep = rs.ExtrudeCurve(cx_JiaoLiang_jia2_brep,rs.AddLine(rs.AddPoint(0,0,0),rs.AddPoint(0,0,-4.5 * x)))
cx_JiaoLiang_jia2_brep = rs.ExtrudeSurface(cx_JiaoLiang_jia2_brep,rs.AddLine(rs.AddPoint(0,0,0),rs.AddPoint(2.5 * x,-2.5 * x,0)))

JiaoLiang_jia2_brep = rs.BooleanDifference(cx_JiaoLiang_jia2_brep,JiaoLiang_jia2_brep,delete_input=False)
JiaoLiang_jia2_brep2 = rs.MirrorObject(JiaoLiang_jia2_brep,crf_zj_pt0,rs.MoveObject(rs.CopyObject(crf_zj_pt0),(x,x,0)),copy=True)
#大角梁被架子剪切
JiaoLiang_brep = rs.BooleanIntersection(JiaoLiang_jia2_brep,JiaoLiang_brep,delete_input=False)
JiaoLiang_brep = rs.BooleanIntersection(JiaoLiang_jia2_brep2,JiaoLiang_brep,delete_input=False)

#草乳袱上的插销
cx_crf = rs.ExplodePolysurfaces(crf_zj_brep)[5]
cx_crf = rs.DuplicateEdgeCurves(cx_crf)[2]
rs.MoveObject(cx_crf,(3 * x,-3 * x,0))
cx_crf  = rs.ExtrudeCurve(cx_crf,rs.AddLine(rs.AddPoint(0,0,0),rs.AddPoint(2 * x,-2 * x,0)))
cx_crf  = rs.ExtrudeSurface(cx_crf,rs.AddLine(rs.AddPoint(0,0,0),rs.AddPoint(0,0,6 * x)))

crf_zj_brep = rs.BooleanDifference(crf_zj_brep,cx_crf,delete_input=False)

#大角梁被草乳袱剪切
JiaoLiang_brep = rs.BooleanIntersection(crf_zj_brep,JiaoLiang_brep,delete_input=False)

#大角梁上的插销
cx_JiaoLiang = rs.ExplodePolysurfaces(JiaoLiang_brep)[22]
cx_JiaoLiang = rs.CurveEndPoint(rs.DuplicateEdgeCurves(cx_JiaoLiang)[0])

rs.MoveObject(cx_JiaoLiang,(2 * x,2 * x,0))
rs.MoveObject(cx_JiaoLiang,(3 * x,-3 * x,0))

cx_JiaoLiang = rs.AddLine(cx_JiaoLiang,rs.MoveObject(rs.CopyObject(cx_JiaoLiang),((2 * x,-2 * x,0))))
cx_JiaoLiang  = rs.ExtrudeCurve(cx_JiaoLiang,rs.AddLine(rs.AddPoint(0,0,0),rs.AddPoint(27 * x,27 * x,0)))
cx_JiaoLiang  = rs.ExtrudeSurface(cx_JiaoLiang,rs.AddLine(rs.AddPoint(0,0,0),rs.AddPoint(0,0,6 * x)))





JiaoLiang_brep = rs.BooleanDifference(cx_JiaoLiang,JiaoLiang_brep,delete_input=False)



crf_zj_brep_trimed = rs.ExplodePolysurfaces(crf_zj_brep)[0]
crf_zj_brep_trimed = rs.ExtrudeSurface(crf_zj_brep_trimed,rs.AddLine(rs.AddPoint(0,0,0),rs.AddPoint(0,0,45* x)))

rs.MoveObject(crf_zj_brep_trimed,(0,0,-21 * x))

le_brep_trimed_g[0] = rs.BooleanIntersection(le_brep_trimed_g[0],crf_zj_brep_trimed ,delete_input=False)[0]

le_brep_trimed_g[-1] =  rs.MirrorObject(le_brep_trimed_g[0],rs.MoveObject(rs.CopyObject(ZhuTou_point),(0,(MianKuo_length * (MianKuo - 2) * x + 2 * j * x)/2 ,0)),rs.MoveObject(rs.CopyObject(ZhuTou_point),(x,(MianKuo_length * (MianKuo - 2) * x + 2 * j * x)/2 ,0)),copy=True)


ycf_breps_g[-1] = rs.BooleanIntersection(ycf_breps_g[-1],crf_zj_brep_trimed ,delete_input=False)[0]

ycf_breps_g[0] =  rs.MirrorObject(ycf_breps_g[-1],rs.MoveObject(rs.CopyObject(ZhuTou_point),(0,(MianKuo_length * (MianKuo - 2) * x + 2 * j * x)/2 ,0)),rs.MoveObject(rs.CopyObject(ZhuTou_point),(x,(MianKuo_length * (MianKuo - 2) * x + 2 * j * x)/2 ,0)),copy=True)

le2_brep_trimed_g_3[0] = rs.BooleanIntersection(le2_brep_trimed_g_3[0],crf_zj_brep_trimed ,delete_input=False)[0]

le2_brep_trimed_g_3[-1] = rs.MirrorObjects(le2_brep_trimed_g_3[0],rs.MoveObject(rs.CopyObject(ZhuTou_point),(4 * j/2 * x,0,0)),rs.MoveObject(rs.CopyObject(ZhuTou_point),(4 * j/2 * x,x,0)),copy=True)[0]



ycf_breps_jinshen[0] = rs.BooleanIntersection(ycf_breps_jinshen[0],crf_zj_brep_trimed ,delete_input=False)[0]

ycf_breps_jinshen[-1] = rs.MirrorObjects(ycf_breps_jinshen[0],rs.MoveObject(rs.CopyObject(ZhuTou_point),(4 * j/2 * x,0,0)),rs.MoveObject(rs.CopyObject(ZhuTou_point),(4 * j/2 * x,x,0)),copy=True)[0]

crf_brep_g[-1] = rs.BooleanIntersection(crf_brep_g[-1],crf_zj_brep_trimed ,delete_input=False)[0]

crf_brep_g[0] =  rs.MirrorObject(crf_brep_g[-1],rs.MoveObject(rs.CopyObject(ZhuTou_point),(0,(MianKuo_length * (MianKuo - 2) * x + 2 * j * x)/2 ,0)),rs.MoveObject(rs.CopyObject(ZhuTou_point),(x,(MianKuo_length * (MianKuo - 2) * x + 2 * j * x)/2 ,0)),copy=True)

crf_brep_g_jinshen[0] = rs.BooleanIntersection(crf_brep_g_jinshen[0],crf_zj_brep_trimed ,delete_input=False)[0]

crf_brep_g_jinshen[-1] = rs.MirrorObjects(crf_brep_g_jinshen[0],rs.MoveObject(rs.CopyObject(ZhuTou_point),(4 * j/2 * x,0,0)),rs.MoveObject(rs.CopyObject(ZhuTou_point),(4 * j/2 * x,x,0)),copy=True)[0]

jb_brep_g[-1] = rs.BooleanDifference(crf_zj_brep_trimed ,jb_brep_g[-1],delete_input=False)[1]
jb_brep_g[0] =  rs.MirrorObject(jb_brep_g[-1],rs.MoveObject(rs.CopyObject(ZhuTou_point),(0,(MianKuo_length * (MianKuo - 2) * x + 2 * j * x)/2 ,0)),rs.MoveObject(rs.CopyObject(ZhuTou_point),(x,(MianKuo_length * (MianKuo - 2) * x + 2 * j * x)/2 ,0)),copy=True)

jb_brep_g_jinshen[0] = rs.BooleanDifference(crf_zj_brep_trimed ,jb_brep_g_jinshen[0],delete_input=False)[1]
jb_brep_g_jinshen[-1] = rs.MirrorObjects(jb_brep_g_jinshen[0],rs.MoveObject(rs.CopyObject(ZhuTou_point),(4 * j/2 * x,0,0)),rs.MoveObject(rs.CopyObject(ZhuTou_point),(4 * j/2 * x,x,0)),copy=True)[0]

JiaoLiang_brep = rs.BooleanDifference(rs.MoveObject(JiaoLiang_trimed2[-1],(0,0,-15 * x)),JiaoLiang_brep,delete_input=False)[0]

JiaoLiang_brep = rs.BooleanIntersection(JiaoLiang_brep,rs.MoveObject(JiaoLiang_trimed3[-1],(0,0,-15 * x)),delete_input=False)


Jiao_breps = [crf_zj_brep[0],jb_zj_brep,JiaoLiang_brep[0],ZiJiaoLiang_brep[0],JiaoLiang_jia_brep2,JiaoLiang_jia_brep[0],JiaoLiang_jia2_brep[0],JiaoLiang_jia2_brep2,]


Jiao_breps_left = rs.MirrorObjects(Jiao_breps,rs.MoveObject(rs.CopyObject(ZhuTou_point),(0,(MianKuo_length * (MianKuo - 2) * x + 2 * j * x)/2 ,0)),rs.MoveObject(rs.CopyObject(ZhuTou_point),(x,(MianKuo_length * (MianKuo - 2) * x + 2 * j * x)/2 ,0)),copy=True)

Jiao_breps = Jiao_breps_left + Jiao_breps

Jiao_breps_houyan = rs.MirrorObjects(Jiao_breps,rs.MoveObject(rs.CopyObject(ZhuTou_point),(4 * j/2 * x,0,0)),rs.MoveObject(rs.CopyObject(ZhuTou_point),(4 * j/2 * x,x,0)),copy=True)

Jiao_breps = Jiao_breps + Jiao_breps_houyan

#屋顶组件面扩方向

roof_jia_miankuo = le_brep_trimed_g + ycf_breps_g + crf_brep_g + jb_brep_g + jbbs_mk + tj_g + tm_brep_g + tm_brep2_g + tm_brep3_g + sccf_ld_base_g + ld_brep_g + lg_brep_g + SanDous_g + lt_breps + lt2_breps + lt3_breps + lt4_breps
roof_jia_jinshen = le2_brep_trimed_g_3 + ycf_breps_jinshen + crf_brep_g_jinshen + jb_brep_g_jinshen + jbbs_mk_jinshen + tj_g_jinshen + tm_breps_jinshen + SanDous_jinshen_g + [sccf_ld_base_jingshen[0],sccf_ld_base_jingshen2[0],sccf_ld_base_jingshen3,ld2_jinshen[0],lg_brep_jyy[0],lg_brep_jyy2[0],lg_brep_jyy3,jbbs_mk_head_mid[0],sccf_brep_jinshen1[0],sccf_brep_jinshen2[0],sccf_brep_jinshen3[0],tm2_brep_jinshen1[0],tm2_brep_jinshen2,tm2_brep_jinshen3,tm3_brep_jinshen[0],tm_base[0],tm_base2] + lt_breps_jingshen +  lt2_breps_jingshen +  lt3_breps_jingshen +  lt4_breps_jingshen

roof_jia_miankuo_houyan = rs.MirrorObjects(roof_jia_miankuo,rs.MoveObject(rs.CopyObject(ZhuTou_point),(4 * j/2 * x,0,0)),rs.MoveObject(rs.CopyObject(ZhuTou_point),(4 * j/2 * x,x,0)),copy=True)

roof_jia_miankuo = roof_jia_miankuo + roof_jia_miankuo_houyan

roof_jia_jinshen_left = rs.MirrorObjects(roof_jia_jinshen,rs.MoveObject(rs.CopyObject(ZhuTou_point),(0,(MianKuo_length * (MianKuo - 2) * x + 2 * j * x)/2 ,0)),rs.MoveObject(rs.CopyObject(ZhuTou_point),(x,(MianKuo_length * (MianKuo - 2) * x + 2 * j * x)/2 ,0)),copy=True)

roof_jia_jinshen = roof_jia_jinshen_left + roof_jia_jinshen

roof_jia_jinshen_up = tm_brep4_g + sccf_brep_g +  lg_brep2_g + SanDous2_g + pl_brep_g + chashou_brep_g + pl_brep_g +lt5_breps

roof_jia = roof_jia_miankuo + roof_jia_jinshen + roof_jia_jinshen_up + Jiao_breps
# ---------- end 斗拱编辑器_3 ----------
python_3_script_9 = Python3Script(CaiFen=number_slider_2, HuaGong_CaiFen_left=number_slider_16, MianKuo=number_slider_3)  # -> out, zhuzi_breps, Laner_breps
# ---------- python_3_script_9: Python ----------
#佛光寺东大殿柱基
#每一跳为21分
import rhinoscriptsyntax as rs
import Rhino.Geometry as rg
import itertools as it
#材分可调变量x
x = CaiFen
#柱头点
ZhuTou_point = rs.AddPoint(HuaGong_CaiFen_left * x,5 *x,0)
#原点
BasePoint = 0
pt_o = rs.AddPoint(BasePoint * 500,0,0)
#进深为14倍材广,一材广为15材分(j的单位为分)
j = 14 * 15
MianKuo_length = 16 * 15

#   面扩七开间，五进深,明间为16倍材广为240分，除了尽间，面阔皆为240分，尽间面扩为210分。进深开间 = 尽间开间也为210分
if (MianKuo % 2 == 0) | (MianKuo < 5):
    raise ValueError(f"开间最小数不能低于5,且为单数")

zhu_pt1 = rs.CopyObject(ZhuTou_point)
rs.MoveObject(zhu_pt1,(0,j * x,0))
zhu_pt2 = rs.CopyObject(zhu_pt1,(0,MianKuo_length * (MianKuo - 2) * x,0))
zhu_cr = rs.AddLine(zhu_pt1,zhu_pt2)
zhutou_pt = rs.DivideCurve(zhu_cr,MianKuo-2)
zhu_pt3 = rs.CopyObject(ZhuTou_point)
zhu_pt4 =rs.MoveObject(rs.CopyObject(zhutou_pt[-1]),(0, j * x,0))
zhutou_pt.insert(0,zhu_pt3)
zhutou_pt.append(zhu_pt4)
zhutou_pt2 = rs.MoveObjects(rs.CopyObjects(zhutou_pt),(j * x,0,0))

zhutou_pt3 = rs.MoveObjects(rs.CopyObjects(zhutou_pt2[0:2] ),(j * x,0,0))

zhutou_pt3_1 = rs.MoveObjects(rs.CopyObjects(zhutou_pt2[len(zhutou_pt2)-2:len(zhutou_pt2)] ),(j * x,0,0))

zhutou_pt3 = zhutou_pt3 + zhutou_pt3_1

zhutou_pt4 = rs.MoveObjects(rs.CopyObjects(zhutou_pt2),(2 * j * x,0,0))

zhutou_pt5 = rs.MoveObjects(rs.CopyObjects(zhutou_pt2),(3 * j * x,0,0))


#柱高
#当心间的柱高为237.5分

#生起的规律

zhutou_pt_up =rs.CopyObjects(zhutou_pt)
rs.MoveObjects(zhutou_pt_up,(0,0,237.5 * x))

zhutou_pt_up2 =rs.CopyObjects(zhutou_pt2)
rs.MoveObjects(zhutou_pt_up2,(0,0,237.5 * x))

zhutou_pt_up3 =rs.CopyObjects(zhutou_pt3)
rs.MoveObjects(zhutou_pt_up3,(0,0,237.5 * x))

if MianKuo > 5:
    #前檐
    rs.MoveObjects([zhutou_pt_up[0],zhutou_pt_up[-1]],(0,0,10.5 * x))
    rs.MoveObjects([zhutou_pt_up[1],zhutou_pt_up[-2]],(0,0,6 * x))
    rs.MoveObjects([zhutou_pt_up[2],zhutou_pt_up[-3]],(0,0,2.5 * x))
    #内檐
    rs.MoveObjects([zhutou_pt_up2[0],zhutou_pt_up2[-1]],(0,0,7.5 * x))
    rs.MoveObjects([zhutou_pt_up2[1],zhutou_pt_up2[-2]],(0,0,5 * x))
    rs.MoveObjects([zhutou_pt_up2[2],zhutou_pt_up2[-3]],(0,0,2.5 * x))
    #中柱
    rs.MoveObjects([zhutou_pt_up3[1],zhutou_pt_up3[-2]],(0,0, 2.5* x))
 
else: 
    #前檐
    rs.MoveObjects([zhutou_pt_up[0],zhutou_pt_up[-1]],(0,0,6 * x))
    rs.MoveObjects([zhutou_pt_up[1],zhutou_pt_up[-2]],(0,0,2.5 * x))
    #内檐
    rs.MoveObjects([zhutou_pt_up2[0],zhutou_pt_up2[-1]],(0,0,5 * x))
    rs.MoveObjects([zhutou_pt_up2[1],zhutou_pt_up2[-2]],(0,0,2.5 * x))



zhutou_pt_up4 = rs.CopyObjects(zhutou_pt_up2,(2 * j * x,0,0))
zhutou_pt_up5 = rs.CopyObjects(zhutou_pt_up,(4 * j * x,0,0))

#平均柱径为28分
zhutou_pt_group = zhutou_pt + zhutou_pt2 + zhutou_pt3 + zhutou_pt4 + zhutou_pt5
zhutou_pt_up_group = zhutou_pt_up + zhutou_pt_up2 + zhutou_pt_up3 + zhutou_pt_up4 + zhutou_pt_up5

zhuzi_x_points= rs.MoveObjects(rs.CopyObjects(zhutou_pt_up_group),(14 * x,0,0))
zhuzi_curves = []
zhuzi_z_points= []
zz_juansha_curves = []

zhuzi_breps = []
for i in range(len(zhutou_pt_group)):
    zhuzi_cr = rs.AddLine(zhutou_pt_group[i],zhutou_pt_up_group[i])
    zhuzi_curves.append(zhuzi_cr)
    zhuzi_z_pt = rs.MoveObject(rs.CopyObject(zhutou_pt_up_group[i]),(0,0,-rs.Distance(zhutou_pt_group[i],zhutou_pt_up_group[i])/3))
    zhuzi_z_points.append(zhuzi_z_pt)
rs.MoveObjects(zhuzi_z_points,(14 * x,0,0))
zhuzi_x_points2 = rs.CopyObjects(zhuzi_x_points)
rs.MoveObject(zhuzi_x_points2,(-1 * x,0,0))
zhuzi_x_points3 = rs.CopyObjects(zhuzi_x_points2)
rs.MoveObject(zhuzi_x_points3,(-1.5 * x,0,0))
zhuzi_z_points3 = rs.CopyObjects(zhuzi_x_points2)
rs.MoveObject(zhuzi_z_points3,(0,0,-1.5 * x))

zhutou_pt_group2 = rs.CopyObjects(zhutou_pt_group )
rs.MoveObjects(zhutou_pt_group2,(14 * x,0,0))
for i in range(len(zhutou_pt_group)):
    zz_juansha_cr1 = rs.AddLine(zhuzi_x_points[i],zhuzi_x_points2[i])
    zz_juansha_cr2 = rs.AddLine(zhuzi_z_points[i],zhuzi_x_points[i])
    zz_juansha_curves_pt1 = rs.DivideCurve(zz_juansha_cr1,3)
    zz_juansha_curves_pt2 = rs.DivideCurve(zz_juansha_cr2,3)

    zz_juansha_cr4 = rs.AddLine(zhuzi_x_points[i],zhuzi_x_points3[i])
    zz_juansha_cr5 = rs.AddLine(zhuzi_z_points3[i],zhuzi_x_points[i])
    zz_juansha_curves_pt5 = rs.DivideCurve(zz_juansha_cr4,4)
    zz_juansha_curves_pt6 = rs.DivideCurve(zz_juansha_cr5,4)



    
    zz_juansha_cr3 = [rs.AddLine(zz_juansha_curves_pt1[0],zz_juansha_curves_pt2[0]),rs.AddLine(zz_juansha_curves_pt1[1],zz_juansha_curves_pt2[1]),rs.AddLine(zz_juansha_curves_pt1[2],zz_juansha_curves_pt2[2])]
    zz_juansha_curves_pt3 = [rs.CurveCurveIntersection(zz_juansha_cr3[0],zz_juansha_cr3[1])[0][1],rs.CurveCurveIntersection(zz_juansha_cr3[1],zz_juansha_cr3[2])[0][1]]
    
    
    zz_juansha_cr7 = [rs.AddLine(zz_juansha_curves_pt5[0],zz_juansha_curves_pt6[0]),rs.AddLine(zz_juansha_curves_pt5[1],zz_juansha_curves_pt6[1]),rs.AddLine(zz_juansha_curves_pt5[2],zz_juansha_curves_pt6[2]),rs.AddLine(zz_juansha_curves_pt5[3],zz_juansha_curves_pt6[3])]
    zz_juansha_curves_pt7 = [rs.CurveCurveIntersection(zz_juansha_cr7[0],zz_juansha_cr7[1])[0][1],rs.CurveCurveIntersection(zz_juansha_cr7[1],zz_juansha_cr7[2])[0][1],rs.CurveCurveIntersection(zz_juansha_cr7[2],zz_juansha_cr7[3])[0][1]]
    zz_juansha_curves_pt4 = [zhutou_pt_group2[i],zhuzi_z_points[i],zz_juansha_curves_pt3[0],zz_juansha_curves_pt3[1],zz_juansha_curves_pt7[0],zz_juansha_curves_pt7[1],zz_juansha_curves_pt7[2],zhuzi_x_points3[i]]
    zz_juansha_cr = rs.AddPolyline(zz_juansha_curves_pt4)
    zhuzi_brep = rs.AddRevSrf(zz_juansha_cr,zhuzi_curves[i],)
    rs.CapPlanarHoles(zhuzi_brep)
    zhuzi_breps.append(zhuzi_brep)
zhuzi_qianyan = zhuzi_breps[0:len(zhutou_pt)]

# 阑额生成,佛光寺东大殿阑额高度也就是15分，厚度为10分，长度至两柱的柱中心

# 生起曲线
yws_brep1_g = []
yws_brep2_g = []
zhuzi_qy = []
le_breps = []
le_brep_trimed_g = []
le_trimed2 = rs.CopyObjects(zhutou_pt_up[0:len(zhutou_pt_up)-1])
rs.MoveObjects(le_trimed2,(0,11.5 * x,0))
le_trimed1 = rs.CopyObjects(zhutou_pt_up[1:len(zhutou_pt_up)])
rs.MoveObjects(le_trimed1,(0,-11.5 * x,0))
sq_cr = rs.AddInterpCurve(zhutou_pt_up)
sq_sr = rs.ExtrudeCurve(sq_cr,rs.AddLine(rs.AddPoint(0,0,0),rs.AddPoint(5 * x,0,0)))

sq_curves = []
for i in range(len(le_trimed1)):
    cr1 = rs.AddLine(le_trimed1[i],le_trimed2[i])
    rs.MoveObject(cr1,(5 * x,0,21 * x))
    cr1 = rs.ProjectCurveToSurface(cr1,sq_sr,[0,0,x])

    sq_curves.append(cr1[0])

    le_brep = rs.ExtrudeCurve(cr1,rs.AddLine(rs.AddPoint(0,0,0),rs.AddPoint(-10 * x ,0,0)))
    le_brep = rs.ExtrudeSurface(le_brep,rs.AddLine(rs.AddPoint(0,0,0),rs.AddPoint(0 ,0,-15 * x)))
    
    le_brep_trimed = rs.ExtrudeCurve(cr1,rs.AddLine(rs.AddPoint(0,0,0),rs.AddPoint(-10 * x ,0,0)))
    le_brep_trimed = rs.ExtrudeSurface(le_brep_trimed,rs.AddLine(rs.AddPoint(0,0,0),rs.AddPoint(0 ,0,-20 * x)))
    rs.MoveObject(le_brep_trimed,(0,0,5 * x))
    le_brep_trimed_g.append(le_brep_trimed)

    #燕尾榫生成
    yws_cr1 = rs.AddLine(le_trimed2[i],rs.MoveObject(rs.CopyObject(le_trimed2[i]),(0,-6 * x,0)))
    rs.RotateObject(yws_cr1,le_trimed2[i],20,[0,0,x])
    rs.MoveObject(yws_cr1,(2.5 * x,0,0))

    yws_brep1 = rs.AddLoftSrf([yws_cr1,rs.MirrorObject(yws_cr1,zhutou_pt[0],rs.MoveObject(rs.CopyObject(zhutou_pt[0]),(0,x,0)),copy=True)])
    yws_brep1 = rs.ExtrudeSurface(yws_brep1,rs.AddLine(rs.AddPoint(0,0,0),rs.AddPoint(0 ,0,-15 * x)))
    yws_brep1_g.append(yws_brep1)

    yws_cr2 = rs.AddLine(le_trimed1[i],rs.MoveObject(rs.CopyObject(le_trimed1[i]),(0,6 * x,0)))
    rs.RotateObject(yws_cr2,le_trimed1[i],-20,[0,0,x])
    rs.MoveObject(yws_cr2,(2.5 * x,0,0))

    yws_brep2 = rs.AddLoftSrf([yws_cr2,rs.MirrorObject(yws_cr2,zhutou_pt[0],rs.MoveObject(rs.CopyObject(zhutou_pt[0]),(0,x,0)),copy=True)])
    yws_brep2 = rs.ExtrudeSurface(yws_brep2,rs.AddLine(rs.AddPoint(0,0,0),rs.AddPoint(0 ,0,-15 * x))) 
    yws_brep2_g.append(yws_brep2)

    le_brep =rs.BooleanUnion([le_brep,yws_brep1],delete_input=False)
    le_brep =rs.BooleanDifference(yws_brep2,le_brep,delete_input=False)
    le_breps.append(le_brep[0])

# 柱子修建
for i in range(len(zhuzi_qianyan)-1):
    zhuzi = rs.BooleanDifference(zhuzi_qianyan[0:len(zhuzi_qianyan)-1][i],le_brep_trimed_g[i],delete_input=False)
    zhuzi = rs.BooleanDifference(zhuzi,yws_brep1_g[i],delete_input=False)
    zhuzi_qy.append(zhuzi[0])

zhuzi_qy.append(zhuzi_qianyan[-1])
zhuzi_qianyan = zhuzi_qy

zhuzi2_qy = []

for i in range(len(zhuzi_qianyan)-1):
    zhuzi = rs.BooleanDifference(zhuzi_qianyan[1:len(zhuzi_qianyan)][i],le_brep_trimed_g[0:len(le_brep_trimed_g)][i],delete_input=False)
    zhuzi = rs.BooleanIntersection(zhuzi,yws_brep2_g[0:len(yws_brep2_g)][i],delete_input=False)
    zhuzi2_qy.append(zhuzi[0])
    
zhuzi2_qy.insert(0,zhuzi_qianyan[0])
zhuzi_qianyan = zhuzi2_qy
zhuzi_houyan = rs.CopyObjects(zhuzi_qianyan)
rs.MoveObjects(zhuzi_houyan,(4 * j * x,0,0))

zhuzi_neiyan = zhuzi_breps[len(zhutou_pt)+1 : (len(zhutou_pt))+int(MianKuo)]

# 生起曲线
yws_brep1_g_2 = []
yws_brep2_g_2 = []
zhuzi_qy_2 = []
le_breps_2 = []
le_brep_trimed_g_2 = []
le_trimed2_2 = rs.CopyObjects(zhutou_pt_up2[1:len(zhutou_pt_up)-2])
rs.MoveObjects(le_trimed2_2,(0,11.5 * x,0))
le_trimed1_2 = rs.CopyObjects(zhutou_pt_up2[2:len(zhutou_pt_up)-1])
rs.MoveObjects(le_trimed1_2,(0,-11.5 * x,0))
sq_cr_2 = rs.AddInterpCurve(zhutou_pt_up2[1:len(zhutou_pt_up)-1])
sq_sr_2 = rs.ExtrudeCurve(sq_cr_2,rs.AddLine(rs.AddPoint(0,0,0),rs.AddPoint(5 * x,0,0)))
for i in range(len(le_trimed1_2)):
    cr1_2 = rs.AddLine(le_trimed1_2[i],le_trimed2_2[i])
    rs.MoveObject(cr1_2,(5 * x,0,21 * x))
    cr1_2 = rs.ProjectCurveToSurface(cr1_2,sq_sr_2,[0,0,x])

    le_brep_2 = rs.ExtrudeCurve(cr1_2,rs.AddLine(rs.AddPoint(0,0,0),rs.AddPoint(-10 * x ,0,0)))
    le_brep_2 = rs.ExtrudeSurface(le_brep_2,rs.AddLine(rs.AddPoint(0,0,0),rs.AddPoint(0 ,0,-15 * x)))
    
    le_brep_trimed_2 = rs.ExtrudeCurve(cr1_2,rs.AddLine(rs.AddPoint(0,0,0),rs.AddPoint(-10 * x ,0,0)))
    le_brep_trimed_2 = rs.ExtrudeSurface(le_brep_trimed_2,rs.AddLine(rs.AddPoint(0,0,0),rs.AddPoint(0 ,0,-20 * x)))
    rs.MoveObject(le_brep_trimed_2,(0,0,5 * x))
    le_brep_trimed_g_2.append(le_brep_trimed_2)

    #燕尾榫生成
    yws_cr1_2 = rs.AddLine(le_trimed2_2[i],rs.MoveObject(rs.CopyObject(le_trimed2_2[i]),(0,-6 * x,0)))
    rs.RotateObject(yws_cr1_2,le_trimed2_2[i],20,[0,0,x])
    rs.MoveObject(yws_cr1_2,(2.5 * x,0,0))

    yws_brep1_2 = rs.AddLoftSrf([yws_cr1_2,rs.MirrorObject(yws_cr1_2,zhutou_pt2[0],rs.MoveObject(rs.CopyObject(zhutou_pt2[0]),(0,x,0)),copy=True)])
    yws_brep1_2 = rs.ExtrudeSurface(yws_brep1_2,rs.AddLine(rs.AddPoint(0,0,0),rs.AddPoint(0 ,0,-15 * x)))
    yws_brep1_g_2.append(yws_brep1_2)

    yws_cr2_2 = rs.AddLine(le_trimed1_2[i],rs.MoveObject(rs.CopyObject(le_trimed1_2[i]),(0,6 * x,0)))
    rs.RotateObject(yws_cr2_2,le_trimed1_2[i],-20,[0,0,x])
    rs.MoveObject(yws_cr2_2,(2.5 * x,0,0))

    yws_brep2_2 = rs.AddLoftSrf([yws_cr2_2,rs.MirrorObject(yws_cr2_2,zhutou_pt2[0],rs.MoveObject(rs.CopyObject(zhutou_pt2[0]),(0,x,0)),copy=True)])
    yws_brep2_2 = rs.ExtrudeSurface(yws_brep2_2,rs.AddLine(rs.AddPoint(0,0,0),rs.AddPoint(0 ,0,-15 * x))) 
    yws_brep2_g_2.append(yws_brep2_2)

    le_brep_2 =rs.BooleanUnion([le_brep_2,yws_brep1_2],delete_input=False)
    le_brep_2 =rs.BooleanDifference(yws_brep2_2,le_brep_2,delete_input=False)
    le_breps_2.append(le_brep_2[0])

# 柱子修建
for i in range(len(zhuzi_neiyan)-1):
    zhuzi_2 = rs.BooleanDifference(zhuzi_neiyan[0:len(zhuzi_neiyan)-1][i],le_brep_trimed_g_2[i],delete_input=False)
    zhuzi_2 = rs.BooleanDifference(zhuzi_2,yws_brep1_g_2[i],delete_input=False)
    zhuzi_qy_2.append(zhuzi_2[0])

zhuzi_qy_2.append(zhuzi_neiyan[-1])
zhuzi_neiyan = zhuzi_qy_2

zhuzi2_qy_2 = []

for i in range(len(zhuzi_neiyan)-1):
    zhuzi_2 = rs.BooleanDifference(zhuzi_neiyan[1:len(zhuzi_neiyan)][i],le_brep_trimed_g_2[0:len(le_brep_trimed_g_2)][i],delete_input=False)
    zhuzi_2 = rs.BooleanIntersection(zhuzi_2,yws_brep2_g_2[0:len(yws_brep2_g_2)][i],delete_input=False)
    zhuzi2_qy_2.append(zhuzi_2[0])
    
zhuzi2_qy_2.insert(0,zhuzi_neiyan[0])
zhuzi_neiyan = zhuzi2_qy_2


zhuzi_neiyan2 = rs.CopyObjects(zhuzi_neiyan)
rs.MoveObjects(zhuzi_neiyan2,(2 * j * x,0,0))


zhuzi_shanmian = [zhuzi_breps[len(zhutou_pt)],zhuzi_breps[2*len(zhutou_pt)],zhuzi_breps[2*len(zhutou_pt) +4]]

zhuzi_shanmian.insert(0,zhuzi_qianyan[0])
zhuzi_shanmian.append(zhuzi_houyan[0])


# 生起曲线
yws_brep1_g_3 = []
yws_brep2_g_3 = []
zhuzi_qy_3 = []
le_breps_3 = []
le_brep_trimed_g_3 = []
shan_mian_pt_up = [zhutou_pt_up[0],zhutou_pt_up2[0],zhutou_pt_up3[0],zhutou_pt_up4[0],zhutou_pt_up5[0]]
le_trimed2_3 = rs.CopyObjects(shan_mian_pt_up[0:len(zhutou_pt_up)-1])
rs.MoveObjects(le_trimed2_3,(11.5 * x,0,0))
le_trimed1_3 = rs.CopyObjects(shan_mian_pt_up[1:len(zhutou_pt_up)])
rs.MoveObjects(le_trimed1_3,(-11.5 * x,0,0))
sq_cr_3 = rs.AddInterpCurve(shan_mian_pt_up)
sq_sr_3 = rs.ExtrudeCurve(sq_cr_3,rs.AddLine(rs.AddPoint(0,0,0),rs.AddPoint(0,5 * x,0)))
for i in range(len(le_trimed1_3)):
    cr1_3 = rs.AddLine(le_trimed1_3[i],le_trimed2_3[i])
    rs.MoveObject(cr1_3,(0,5 * x,21 * x))
    cr1_3 = rs.ProjectCurveToSurface(cr1_3,sq_sr_3,[0,0,x])

    le_brep_3 = rs.ExtrudeCurve(cr1_3,rs.AddLine(rs.AddPoint(0,0,0),rs.AddPoint(0,-10 * x ,0)))
    le_brep_3 = rs.ExtrudeSurface(le_brep_3,rs.AddLine(rs.AddPoint(0,0,0),rs.AddPoint(0 ,0,-15 * x)))
    
    le_brep_trimed_3 = rs.ExtrudeCurve(cr1_3,rs.AddLine(rs.AddPoint(0,0,0),rs.AddPoint(0,-10 * x ,0)))
    le_brep_trimed_3 = rs.ExtrudeSurface(le_brep_trimed_3,rs.AddLine(rs.AddPoint(0,0,0),rs.AddPoint(0 ,0,-20 * x)))
    rs.MoveObject(le_brep_trimed_3,(0,0,5 * x))
    le_brep_trimed_g_3.append(le_brep_trimed_3)

   #燕尾榫生成
    yws_cr1_3 = rs.AddLine(le_trimed2_3[i],rs.MoveObject(rs.CopyObject(le_trimed2_3[i]),(-6 * x,0,0)))
    rs.RotateObject(yws_cr1_3,le_trimed2_3[i],-20,[0,0,x])
    rs.MoveObject(yws_cr1_3,(0,2.5 * x,0))

    yws_brep1_3 = rs.AddLoftSrf([yws_cr1_3,rs.MirrorObject(yws_cr1_3,zhutou_pt[0],rs.MoveObject(rs.CopyObject(zhutou_pt[0]),(x,0,0)),copy=True)])
    yws_brep1_3 = rs.ExtrudeSurface(yws_brep1_3,rs.AddLine(rs.AddPoint(0,0,0),rs.AddPoint(0 ,0,-15 * x)))
    yws_brep1_g_3.append(yws_brep1_3)

    yws_cr2_3 = rs.AddLine(le_trimed1_3[i],rs.MoveObject(rs.CopyObject(le_trimed1_3[i]),(6 * x,0,0)))
    rs.RotateObject(yws_cr2_3,le_trimed1_3[i],20,[0,0,x])
    rs.MoveObject(yws_cr2_3,(0,2.5 * x,0))

    yws_brep2_3 = rs.AddLoftSrf([yws_cr2_3,rs.MirrorObject(yws_cr2_3,zhutou_pt[0],rs.MoveObject(rs.CopyObject(zhutou_pt[0]),(x,0,0)),copy=True)])
    yws_brep2_3 = rs.ExtrudeSurface(yws_brep2_3,rs.AddLine(rs.AddPoint(0,0,0),rs.AddPoint(0 ,0,-15 * x))) 
    yws_brep2_g_3.append(yws_brep2_3)

    le_brep_3 =rs.BooleanDifference(yws_brep1_3,le_brep_3,delete_input=False)
    le_brep_3 =rs.BooleanDifference(le_brep_3,yws_brep2_3,delete_input=False)
    le_breps_3.append(le_brep_3[0])

# 柱子修建
for i in range(len(zhuzi_shanmian)-1):
    zhuzi_3 = rs.BooleanDifference(zhuzi_shanmian[0:len(zhuzi_shanmian)-1][i],le_brep_trimed_g_3[i],delete_input=False)
    zhuzi_3 = rs.BooleanIntersection(zhuzi_3,yws_brep1_g_3[i],delete_input=False)
    zhuzi_qy_3.append(zhuzi_3[0])

zhuzi_qy_3.append(zhuzi_shanmian[-1])
zhuzi_shanmian = zhuzi_qy_3

zhuzi2_qy_3 = []

for i in range(len(zhuzi_shanmian)-1):
    zhuzi_3 = rs.BooleanDifference(zhuzi_shanmian[1:len(zhuzi_shanmian)][i],le_brep_trimed_g_3[0:len(le_brep_trimed_g_3)][i],delete_input=False)
    zhuzi_3 = rs.BooleanDifference(zhuzi_3,yws_brep2_g_3[0:len(yws_brep2_g_3)][i],delete_input=False)
    zhuzi2_qy_3.append(zhuzi_3[0])
    
zhuzi2_qy_3.insert(0,zhuzi_shanmian[0])
zhuzi_shanmian = zhuzi2_qy_3



zhuzi_shanmian2 = [zhuzi_breps[2*len(zhutou_pt)+1]]

zhuzi_shanmian2.insert(0,zhuzi_neiyan[0])
zhuzi_shanmian2.append(zhuzi_neiyan2[0])


# 生起曲线
yws_brep1_g_4 = []
yws_brep2_g_4 = []
zhuzi_qy_4 = []
le_breps_4 = []
le_brep_trimed_g_4 = []
shan_mian_pt_up_2 = [zhutou_pt_up2[1],zhutou_pt_up3[1],zhutou_pt_up4[1]]
le_trimed2_4 = rs.CopyObjects(shan_mian_pt_up_2[0:len(zhutou_pt_up)-1])
rs.MoveObjects(le_trimed2_4,(11.5 * x,0,0))
le_trimed1_4 = rs.CopyObjects(shan_mian_pt_up_2[1:len(zhutou_pt_up)])
rs.MoveObjects(le_trimed1_4,(-11.5 * x,0,0))
sq_cr_4 = rs.AddInterpCurve(shan_mian_pt_up_2)
sq_sr_4 = rs.ExtrudeCurve(sq_cr_4,rs.AddLine(rs.AddPoint(0,0,0),rs.AddPoint(0,5 * x,0)))
for i in range(len(le_trimed1_4)):
    cr1_4 = rs.AddLine(le_trimed1_4[i],le_trimed2_4[i])
    rs.MoveObject(cr1_4,(0,5 * x,21 * x))
    cr1_4 = rs.ProjectCurveToSurface(cr1_4,sq_sr_4,[0,0,x])

    le_brep_4 = rs.ExtrudeCurve(cr1_4,rs.AddLine(rs.AddPoint(0,0,0),rs.AddPoint(0,-10 * x ,0)))
    le_brep_4 = rs.ExtrudeSurface(le_brep_4,rs.AddLine(rs.AddPoint(0,0,0),rs.AddPoint(0 ,0,-15 * x)))
    
    le_brep_trimed_4 = rs.ExtrudeCurve(cr1_4,rs.AddLine(rs.AddPoint(0,0,0),rs.AddPoint(0,-10 * x ,0)))
    le_brep_trimed_4 = rs.ExtrudeSurface(le_brep_trimed_4,rs.AddLine(rs.AddPoint(0,0,0),rs.AddPoint(0 ,0,-20 * x)))
    rs.MoveObject(le_brep_trimed_4,(0,0,5 * x))
    le_brep_trimed_g_4.append(le_brep_trimed_4)

   #燕尾榫生成
    yws_cr1_4 = rs.AddLine(le_trimed2_4[i],rs.MoveObject(rs.CopyObject(le_trimed2_4[i]),(-6 * x,0,0)))
    rs.RotateObject(yws_cr1_4,le_trimed2_4[i],-20,[0,0,x])
    rs.MoveObject(yws_cr1_4,(0,2.5 * x,0))

    yws_brep1_4 = rs.AddLoftSrf([yws_cr1_4,rs.MirrorObject(yws_cr1_4,zhutou_pt[1],rs.MoveObject(rs.CopyObject(zhutou_pt[1]),(x,0,0)),copy=True)])
    yws_brep1_4 = rs.ExtrudeSurface(yws_brep1_4,rs.AddLine(rs.AddPoint(0,0,0),rs.AddPoint(0 ,0,-15 * x)))
    yws_brep1_g_4.append(yws_brep1_4)

    yws_cr2_4 = rs.AddLine(le_trimed1_4[i],rs.MoveObject(rs.CopyObject(le_trimed1_4[i]),(6 * x,0,0)))
    rs.RotateObject(yws_cr2_4,le_trimed1_4[i],20,[0,0,x])
    rs.MoveObject(yws_cr2_4,(0,2.5 * x,0))

    yws_brep2_4 = rs.AddLoftSrf([yws_cr2_4,rs.MirrorObject(yws_cr2_4,zhutou_pt[1],rs.MoveObject(rs.CopyObject(zhutou_pt[1]),(x,0,0)),copy=True)])
    yws_brep2_4 = rs.ExtrudeSurface(yws_brep2_4,rs.AddLine(rs.AddPoint(0,0,0),rs.AddPoint(0 ,0,-15 * x))) 
    yws_brep2_g_4.append(yws_brep2_4)

    le_brep_4 =rs.BooleanDifference(yws_brep1_4,le_brep_4,delete_input=False)
    le_brep_4 =rs.BooleanDifference(le_brep_4,yws_brep2_4,delete_input=False)
    le_breps_4.append(le_brep_4[0])

# 柱子修建
for i in range(len(zhuzi_shanmian2)-1):
    zhuzi_4 = rs.BooleanDifference(zhuzi_shanmian2[0:len(zhuzi_shanmian2)-1][i],le_brep_trimed_g_4[i],delete_input=False)
    zhuzi_4 = rs.BooleanIntersection(zhuzi_4,yws_brep1_g_4[i],delete_input=False)
    zhuzi_qy_4.append(zhuzi_4[0])

zhuzi_qy_4.append(zhuzi_shanmian2[-1])
zhuzi_shanmian2 = zhuzi_qy_4

zhuzi2_qy_4 = []

for i in range(len(zhuzi_shanmian2)-1):
    zhuzi_4 = rs.BooleanDifference(zhuzi_shanmian2[1:len(zhuzi_shanmian2)][i],le_brep_trimed_g_4[0:len(le_brep_trimed_g_4)][i],delete_input=False)
    zhuzi_4 = rs.BooleanDifference(zhuzi_4,yws_brep2_g_4[0:len(yws_brep2_g_4)][i],delete_input=False)
    zhuzi2_qy_4.append(zhuzi_4[0])
    
zhuzi2_qy_4.insert(0,zhuzi_shanmian2[0])
zhuzi_shanmian2 = zhuzi2_qy_4

zhuzi_breps = zhuzi_qianyan[1:len(zhuzi_qianyan)-1] + zhuzi_houyan[1:len(zhuzi_houyan)-1] + zhuzi_neiyan[1:len(zhuzi_neiyan)-1] + zhuzi_neiyan2[1:len(zhuzi_neiyan2)-1] + zhuzi_shanmian + rs.MirrorObjects(zhuzi_shanmian,rs.MoveObject(rs.CopyObject(ZhuTou_point),(0,((2 * j +(MianKuo-2)*MianKuo_length)*x/2),0)),rs.MoveObject(rs.CopyObject(ZhuTou_point),(x,((2 * j +(MianKuo-2)*MianKuo_length)*x/2),0)),copy=True) + zhuzi_shanmian2 + rs.MirrorObjects(zhuzi_shanmian2,rs.MoveObject(rs.CopyObject(ZhuTou_point),(0,((2 * j +(MianKuo-2)*MianKuo_length)*x/2),0)),rs.MoveObject(rs.CopyObject(ZhuTou_point),(x,((2 * j +(MianKuo-2)*MianKuo_length)*x/2),0)),copy=True)

Laner_breps = le_breps + rs.MoveObjects(rs.CopyObjects(le_breps),(4 * j * x,0,0)) + le_breps_2 + rs.MoveObjects(rs.CopyObjects(le_breps_2),(2 * j * x,0,0)) + le_breps_3 + rs.MirrorObjects(le_breps_3,rs.MoveObject(rs.CopyObject(ZhuTou_point),(0,((2 * j +(MianKuo-2)*MianKuo_length)*x/2),0)),rs.MoveObject(rs.CopyObject(ZhuTou_point),(x,((2 * j +(MianKuo-2)*MianKuo_length)*x/2),0)),copy=True) + le_breps_4 + rs.MirrorObjects(le_breps_4,rs.MoveObject(rs.CopyObject(ZhuTou_point),(0,((2 * j +(MianKuo-2)*MianKuo_length)*x/2),0)),rs.MoveObject(rs.CopyObject(ZhuTou_point),(x,((2 * j +(MianKuo-2)*MianKuo_length)*x/2),0)),copy=True)
# ---------- end python_3_script_9 ----------

brep_10 = Brep()
number_slider_21 = Slider(9, range=0..100)
custom_preview_3 = CustomPreview(
    Geometry=brep_6,
    Material={diffuse=RGB(221, 160, 221), emission=RGB(66, 48, 66), shine=0.5, specular=RGB(255, 255, 255), transparency=0})
brep_11 = Brep()
brep_12 = Brep()
brep_13 = Brep()
brep_14 = Brep()
curve_10 = Curve()
brep_15 = Brep()
custom_preview_4 = CustomPreview(Material=create_material)
python_3_script_10 = Python3Script(
    CaiFen=number_slider_2,
    HuaGong_CaiFen_left=number_slider_2,
    NiDaoGong_CaiFen_left=number_slider_16,
    NiDaoGong_CaiFen_right=number_slider_17)  # -> out, mg_brep, tm_brep, tyc_cr
# ---------- python_3_script_10: Python ----------
import rhinoscriptsyntax as rs
import Rhino.Geometry as rg
import itertools as it
x = CaiFen
#柱头点
ZhuTou_point = rs.AddPoint(HuaGong_CaiFen_left * x,5 *x,0)
#佛光寺大殿,替木


if NiDaoGong_CaiFen_left !=  NiDaoGong_CaiFen_right:
    raise ValueError(f"两边必须一样长")

tm_pt_o = rs.CopyObject(ZhuTou_point)
if (NiDaoGong_CaiFen_left > 25) & (NiDaoGong_CaiFen_right > 25):
    rs.MoveObject(tm_pt_o,(0,(NiDaoGong_CaiFen_left + 20) * x,0))
else : raise ValueError(f"必须大于26分")

tm_pt_z1 = rs.CopyObject(tm_pt_o)
rs.MoveObject(tm_pt_z1,(0,0,4 * x))
tm_cr_z = rs.AddLine(tm_pt_o,tm_pt_z1)
tm_pt_y1 = rs.CopyObject(tm_pt_o)
rs.MoveObject(tm_pt_y1 ,(0,-12 * x,0))
tm_cr_y = rs.AddLine(tm_pt_y1,tm_pt_o)
div_cr_z =rs.DivideCurve(tm_cr_z,4)
div_cr_y =rs.DivideCurve(tm_cr_y,4)
#卷杀
CrossCurves_gzg = []
for i in range(len(div_cr_z)):
    divide_y = div_cr_y[i]
    divide_z = div_cr_z[i]
    CrossCurve_gzg = rs.AddLine(divide_y,divide_z)
    CrossCurves_gzg.append(CrossCurve_gzg)
CrossCurves_gzg = CrossCurves_gzg[1:len(CrossCurves_gzg)-1]
#选择交点
CrossCurves_points_gzg = []
for i in range(len(CrossCurves_gzg)):
    CrossCurves_point_gzg = rs.CurveCurveIntersection(CrossCurves_gzg[i],CrossCurves_gzg[i-1])[0][1]
    CrossCurves_points_gzg.append(CrossCurves_point_gzg)
CrossCurves_points_gzg = CrossCurves_points_gzg[1:len(CrossCurves_points_gzg)]
CrossCurves_points_gzg.insert(0,rs.CurveStartPoint(tm_cr_y))
CrossCurves_points_gzg.insert(len(CrossCurves_points_gzg)+1,rs.CurveEndPoint(tm_cr_z))
tm_pt_z2 = rs.CopyObject(tm_pt_z1)
rs.MoveObject(tm_pt_z2,(0,0, 4 * x))

CrossCurves_points_gzg.append(tm_pt_z2)
CrossCurves_points_tm_right = rs.MirrorObjects(CrossCurves_points_gzg,ZhuTou_point,rs.MoveObject(rs.CopyObject(ZhuTou_point),(x,0,x)),copy=True)
rs.MoveObjects(CrossCurves_points_tm_right,(0,(NiDaoGong_CaiFen_left - NiDaoGong_CaiFen_right) * x,0))

CrossCurves_points_gzg.insert(0,CrossCurves_points_tm_right[0])
CrossCurves_points_gzg.insert(0,CrossCurves_points_tm_right[1])
CrossCurves_points_gzg.insert(0,CrossCurves_points_tm_right[2])
CrossCurves_points_gzg.insert(0,CrossCurves_points_tm_right[3])
CrossCurves_points_gzg.insert(0,CrossCurves_points_tm_right[4])
tm_curve_left1 = rs.AddPolyline(CrossCurves_points_gzg)
tm_curve_left1 = rs.JoinCurves([tm_curve_left1,rs.AddLine(rs.CurveEndPoint(tm_curve_left1),rs.CurveStartPoint(tm_curve_left1))])
rs.MoveObject(tm_curve_left1,(5 *x,0,0))
tm_sr_left1 = rs.AddPlanarSrf(tm_curve_left1)

tm_brep = rs.ExtrudeSurface(tm_sr_left1,rs.AddLine(rs.AddPoint(0,0,0),rs.AddPoint(-10 * x,0,0)))

#替木修建

#挑檐椽
tyc_cr =  rs.AddCircle(ZhuTou_point,(17/2) * x)
rs.RotateObject(tyc_cr,ZhuTou_point,90,[x,0,0])
rs.MoveObject(tyc_cr,(0,(NiDaoGong_CaiFen_left + 20) * x,14.75 * x))
tyc_cr = rs.ExtrudeCurve(tyc_cr,rs.AddLine(rs.AddPoint(0,0,0),rs.AddPoint(0,-2 * (NiDaoGong_CaiFen_left + 20) * x,0)))
rs.CapPlanarHoles(tyc_cr)

tm_brep = rs.BooleanDifference(tm_brep,tyc_cr,delete_input=False)
# ---------- end python_3_script_10 ----------
curve_11 = Curve()
curve_12 = Curve()
number_slider_22 = Slider(10, range=0..10)
curve_13 = Curve()
curve_14 = Curve()
curve_15 = Curve()
brep_16 = Brep()
merge = Merge()
list_item_4 = ListItem(Index=0, Wrap=True)
list_item_5 = ListItem(Index=Slider(2, range=0..100), Wrap=True)
brep_17 = Brep([斗拱编辑器_2.wb_miankuo, 斗拱编辑器_2.wb_jinshen, 斗拱编辑器_2.wb_jinjian])
list_item_6 = ListItem(Index=0, Wrap=True)
brep_18 = Brep()
list_item_7 = ListItem(Index=number_slider_21, Wrap=True)
colour_swatch_3 = ColourSwatch(SwatchColor=RGB(255, 255, 255))
brep_19 = Brep()
brep_20 = Brep()
brep_21 = Brep()
brep_22 = Brep()
list_item_8 = ListItem(List=brep_22, Index=Slider(0, range=0..100), Wrap=True)
brep_23 = Brep()
brep_24 = Brep()
brep_25 = Brep()
brep_26 = Brep()
brep_27 = Brep()
list_item_9 = ListItem(Index=Slider(3, range=0..100), Wrap=True)
brep_28 = Brep()
number_slider_23 = Slider(19, range=0..100)
number_slider_24 = Slider(10, range=0..10)
number_slider_25 = Slider(0, range=-1..0)
panel_5 = Panel(brep_22)
brep_29 = Brep()
panel_6 = Panel(list_item_8)
brep_30 = Brep()
brep_31 = Brep(python_3_script_9.Laner_breps)
python_3_script_11 = Python3Script(
    CaiFen=number_slider_2,
    HuaGong_CaiFen_left=number_slider_2,
    NiDaoGong_CaiFen_left=number_slider_16,
    NiDaoGong_CaiFen_right=number_slider_17)  # -> out, gzg_brep, gzg_gyy_1
# ---------- python_3_script_11: Python ----------
import rhinoscriptsyntax as rs
import Rhino.Geometry as rg
import itertools as it
x = CaiFen
#柱头点
ZhuTou_point = rs.AddPoint(HuaGong_CaiFen_left * x,5 *x,0)
#佛光寺大殿,瓜子拱,慢拱生成


if NiDaoGong_CaiFen_left !=  NiDaoGong_CaiFen_right:
    raise ValueError(f"两边必须一样长")

gzg_pt_o = rs.CopyObject(ZhuTou_point)
if (NiDaoGong_CaiFen_left > 25) & (NiDaoGong_CaiFen_right > 25):
    rs.MoveObject(gzg_pt_o,(0,(NiDaoGong_CaiFen_left - 6) * x,0))
else : raise ValueError(f"必须大于26分")

gzg_pt_z1 = rs.CopyObject(gzg_pt_o)
rs.MoveObject(gzg_pt_z1,(0,0,9 * x))
gzg_cr_z = rs.AddLine(gzg_pt_o,gzg_pt_z1)
gzg_pt_y1 = rs.CopyObject(gzg_pt_o)
rs.MoveObject(gzg_pt_y1 ,(0,-16 * x,0))
gzg_cr_y = rs.AddLine(gzg_pt_y1,gzg_pt_o)
div_cr_z =rs.DivideCurve(gzg_cr_z,5)
div_cr_y =rs.DivideCurve(gzg_cr_y,5)
#卷杀
CrossCurves_gzg = []
for i in range(len(div_cr_z)):
    divide_y = div_cr_y[i]
    divide_z = div_cr_z[i]
    CrossCurve_gzg = rs.AddLine(divide_y,divide_z)
    CrossCurves_gzg.append(CrossCurve_gzg)
CrossCurves_gzg = CrossCurves_gzg[1:len(CrossCurves_gzg)-1]
#选择交点
CrossCurves_points_gzg = []
for i in range(len(CrossCurves_gzg)):
    CrossCurves_point_gzg = rs.CurveCurveIntersection(CrossCurves_gzg[i],CrossCurves_gzg[i-1])[0][1]
    CrossCurves_points_gzg.append(CrossCurves_point_gzg)
CrossCurves_points_gzg = CrossCurves_points_gzg[1:len(CrossCurves_points_gzg)]
CrossCurves_points_gzg.insert(0,rs.CurveStartPoint(gzg_cr_y))
CrossCurves_points_gzg.insert(len(CrossCurves_points_gzg)+1,rs.CurveEndPoint(gzg_cr_z))
gzg_pt_z2 = rs.CopyObject(gzg_pt_z1)
rs.MoveObject(gzg_pt_z2,(0,0, 6 * x))
gzg_pt_z3 = rs.CopyObject(gzg_pt_z2)
rs.MoveObject(gzg_pt_z3,(0,-10 * x,0))
gzg_pt_y_1 = rs.CopyObject(ZhuTou_point)
rs.MoveObject(gzg_pt_y_1,(0,0,5 * x))
gzg_pt_y_2 = rs.CopyObject(gzg_pt_y_1)
rs.MoveObject(gzg_pt_y_2,(0,4 * x,0))
gzg_pt_y_3 = rs.CopyObject(gzg_pt_y_2)
rs.MoveObject(gzg_pt_y_3,(0,0,10 * x))
CrossCurves_points_gzg.append(gzg_pt_z2)
CrossCurves_points_gzg.append(gzg_pt_z3)
CrossCurves_points_gzg_right = rs.MirrorObjects(CrossCurves_points_gzg,ZhuTou_point,rs.MoveObject(rs.CopyObject(ZhuTou_point),(x,0,x)),copy=True)
rs.MoveObjects(CrossCurves_points_gzg_right,(0,(NiDaoGong_CaiFen_left - NiDaoGong_CaiFen_right) * x,0))
gzg_mid_pt1 = rs.CopyObject(ZhuTou_point)
gzg_mid_pt1 = rs.MoveObject(gzg_mid_pt1,(0,-4 * x,15 * x))
gzg_mid_pt4 = rs.CopyObject(ZhuTou_point)
gzg_mid_pt4 = rs.MoveObject(gzg_mid_pt4,(0,4 * x,15 * x))
gzg_mid_pt2 = rs.CopyObject(gzg_mid_pt1)
rs.MoveObject(gzg_mid_pt2,(0,0,-5 * x))
gzg_mid_pt3 = rs.CopyObject(gzg_mid_pt2)
rs.MoveObject(gzg_mid_pt3,(0,8 * x,0))
gzg_mid_pt5 = rs.CopyObject(gzg_mid_pt3)
rs.MoveObject(gzg_mid_pt5,(0,0,-10 * x))
gzg_mid_pt6 = rs.CopyObject(gzg_mid_pt2)
rs.MoveObject(gzg_mid_pt6,(0,0,-10 * x))
CrossCurves_points_gzg.insert(0,gzg_mid_pt5)
CrossCurves_points_gzg.insert(0,gzg_mid_pt3)
CrossCurves_points_gzg.insert(0,gzg_mid_pt2)
CrossCurves_points_gzg.insert(0,gzg_mid_pt6)
CrossCurves_points_gzg.insert(0,CrossCurves_points_gzg_right[0])
CrossCurves_points_gzg.insert(0,CrossCurves_points_gzg_right[1])
CrossCurves_points_gzg.insert(0,CrossCurves_points_gzg_right[2])
CrossCurves_points_gzg.insert(0,CrossCurves_points_gzg_right[3])
CrossCurves_points_gzg.insert(0,CrossCurves_points_gzg_right[4])
CrossCurves_points_gzg.insert(0,CrossCurves_points_gzg_right[5])
CrossCurves_points_gzg.insert(0,CrossCurves_points_gzg_right[6])
CrossCurves_points_gzg.insert(0,gzg_mid_pt1)
CrossCurves_points_gzg.insert(0,gzg_mid_pt4)
gzg_curve_left1 = rs.AddPolyline(CrossCurves_points_gzg)
gzg_curve_left1 = rs.JoinCurves([gzg_curve_left1,rs.AddLine(rs.CurveEndPoint(gzg_curve_left1),rs.CurveStartPoint(gzg_curve_left1))])
rs.MoveObject(gzg_curve_left1,(5 *x,0,0))
gzg_sr_left1 = rs.AddPlanarSrf(gzg_curve_left1)

gzg_brep = rs.ExtrudeSurface(gzg_sr_left1,rs.AddLine(rs.AddPoint(0,0,0),rs.AddPoint(-10 * x,0,0)))

# 拱眼
gzg_gyy_pt1 = rs.CopyObject(gzg_pt_z3)
rs.MoveObject(gzg_gyy_pt1,(-5 * x,0,x))
gzg_gyy_pt2 = rs.CopyObject(gzg_gyy_pt1)
rs.MoveObject(gzg_gyy_pt2,(0,0,-2 * x))
gzg_gyy_pt4 = rs.CopyObject(gzg_mid_pt4)
rs.MoveObject(gzg_gyy_pt4,(-5 * x, 1.625 * x,x))
gzg_gyy_pt3 = rs.CopyObject(gzg_gyy_pt4)
rs.MoveObject(gzg_gyy_pt3,(0,0,-2 * x))
gzg_gyy_cr1 = rs.AddLine(gzg_gyy_pt1,gzg_gyy_pt2)
gzg_gyy_cr2 = rs.AddLine(gzg_gyy_pt2,gzg_gyy_pt3)
gzg_gyy_cr3 = rs.AddLine(gzg_gyy_pt3,gzg_gyy_pt4)
gzg_gyy_cr1 = rs.AddFilletCurve(gzg_gyy_cr1,gzg_gyy_cr2,x)
gzg_gyy_cr2_1 = rs.AddFilletCurve(gzg_gyy_cr3,gzg_gyy_cr2,x)
gzg_gyy_cr3 = rs.AddLine(rs.CurveEndPoint(gzg_gyy_cr1),rs.CurveEndPoint(gzg_gyy_cr2_1))
gzg_gyy_cr4 = rs.AddLine(rs.CurveStartPoint(gzg_gyy_cr1),rs.MoveObject(rs.CopyObject(gzg_gyy_pt1),(0,0,x)))
gzg_gyy_cr5 = rs.AddLine(rs.CurveStartPoint(gzg_gyy_cr2_1),rs.MoveObject(rs.CopyObject(gzg_gyy_pt4),(0,0,x)))
gzg_gyy_1 =rs.JoinCurves([gzg_gyy_cr1,gzg_gyy_cr2_1,gzg_gyy_cr3,gzg_gyy_cr4,gzg_gyy_cr5])
gzg_gyy_1 =rs.JoinCurves([gzg_gyy_1,rs.AddLine(rs.CurveStartPoint(gzg_gyy_1),rs.CurveEndPoint(gzg_gyy_1))])
gzg_gyy_sr = rs.AddPlanarSrf(gzg_gyy_1)
rs.MoveObject(gzg_gyy_sr,(0,0,0))
gzg_gyy_1_1= rs.MoveObject(rs.CopyObject(gzg_gyy_1),(5 * x,0 , x))
rs.ScaleObject(gzg_gyy_1_1,rs.CurveMidPoint(gzg_gyy_cr2),[1,0.5,1])
gzg_gyy_1 =rs.AddLoftSrf([gzg_gyy_1,gzg_gyy_1_1])
gzg_gyy_2 =rs.MirrorObject(gzg_gyy_1,ZhuTou_point,rs.MoveObject(rs.CopyObject(ZhuTou_point),(x,0,0)),copy=True)
gzg_gyy_3 =rs.MirrorObject(gzg_gyy_1,ZhuTou_point,rs.MoveObject(rs.CopyObject(ZhuTou_point),(0,x,0)),copy=True)
gzg_gyy_4 =rs.MirrorObject(gzg_gyy_2,ZhuTou_point,rs.MoveObject(rs.CopyObject(ZhuTou_point),(0,x,0)),copy=True)
rs.CapPlanarHoles(gzg_gyy_1)
gzg_brep = rs.BooleanDifference(gzg_brep,gzg_gyy_1)
gzg_brep = rs.BooleanDifference(gzg_brep,gzg_gyy_2)
gzg_brep = rs.BooleanDifference(gzg_brep,gzg_gyy_3)
gzg_brep = rs.BooleanDifference(gzg_brep,gzg_gyy_4)
# ---------- end python_3_script_11 ----------
list_item_10 = ListItem(List=brep_29, Index=Slider(7, range=0..100), Wrap=True)
brep_32 = Brep()
brep_33 = Brep()

斗拱编辑器_4 = Python3Script(
    CaiFen=number_slider_2,
    HuaGong_CaiFen_left=number_slider_19,
    HuaGong_CaiFen_right=number_slider_19,
    NiDaoGong_CaiFen_left=number_slider_20,
    NiDaoGong_CaiFen_right=number_slider_20,
    MianKuo=number_slider_3)  # -> PuZuo_waiyan_g, PuZuo_neiyan_g; inputs CaiFen: Int32
# ---------- 斗拱编辑器_4: Python ----------
#佛光寺大殿华拱生成
#每一跳为21分
import rhinoscriptsyntax as rs
import Rhino.Geometry as rg
import itertools as it
#材分可调变量x
x = CaiFen
#柱头点
ZhuTou_point = rs.AddPoint(HuaGong_CaiFen_left * x,5 *x,0)
#原点
BasePoint = 0
j = 14 * 15
MianKuo_length = 16 * 15

pt_o = rs.AddPoint(BasePoint * 500,0,0)
#卷杀结束y点
pt_1 = rs.AddPoint(BasePoint * 500,0,9 * x)
#卷杀结束x点
pt_2 = rs.AddPoint(BasePoint * 500 + 16 * x, 0 ,0)
#生成要进行拆分的曲线
curve_x = rs.AddLine(pt_2,pt_o)
curve_y = rs.AddLine(pt_o,pt_1)
#拆分曲线生成点
divide_curve_x_points = rs.DivideCurve(curve_x,5)
divide_curve_y_points = rs.DivideCurve(curve_y,5)
#卷杀
CrossCurves = []
for i in range(len(divide_curve_x_points)):
    divide_x = divide_curve_x_points[i]
    divide_y = divide_curve_y_points[i]
    CrossCurve = rs.AddLine(divide_x,divide_y)
    CrossCurves.append(CrossCurve)
CrossCurves = CrossCurves[1:len(CrossCurves)-1]
#选择交点
CrossCurves_points = []
for i in range(len(CrossCurves)):
    CrossCurves_point = rs.CurveCurveIntersection(CrossCurves[i],CrossCurves[i-1])[0][1]
    CrossCurves_points.append(CrossCurves_point)
CrossCurves_points = CrossCurves_points[1:len(CrossCurves_points)]
CrossCurves_points.insert(0,rs.CurveStartPoint(curve_x))
CrossCurves_points.insert(len(CrossCurves_points)+1,rs.CurveEndPoint(curve_y))
#卷杀线
JuanSha_curve = rs.AddPolyline(CrossCurves_points)
pt_3z = rs.CopyObject(pt_1)
rs.MoveObject(pt_3z,(0,0,6 * x))
pt_4z = rs.CopyObject(pt_3z)
rs.MoveObject(pt_4z,(12 * x,0,0))
pt_3x = rs.CopyObject(pt_2)
if HuaGong_CaiFen_left > 25:
    rs.MoveObject(pt_3x,((HuaGong_CaiFen_left - 16.5 /2 - 16) * x ,0,0))
pt_4x = rs.CopyObject(pt_3x)
#中间材，材广为16.5分
zjc_pt1 = rs.CopyObject(pt_3x)
zjc_pt1 = rs.MoveObject(zjc_pt1,(16.5 * x,0,0))
zjc_curve = rs.AddLine(pt_3x,zjc_pt1)
#右边斗拱的线
pt_3x_right = rs.CopyObject(zjc_pt1)
pt_2x_right = rs.CopyObject(zjc_pt1)
if HuaGong_CaiFen_right > 25:
    rs.MoveObject(pt_2x_right,((HuaGong_CaiFen_right - 16 - 16.5/2) * x,0,0))
else: rs.MoveObject(pt_2x_right,(0,0,0))
#卷杀结束x点
pt_1_right = rs.CopyObject(pt_2x_right)
rs.MoveObject(pt_1_right,(16 * x,0,0))
pt_2_right = rs.CopyObject(pt_1_right)
rs.MoveObject(pt_2_right,(0,0,9 * x))
curve_x_right = rs.AddLine(pt_2x_right,pt_1_right)
curve_y_right = rs.AddLine(pt_1_right,pt_2_right)
#拆分曲线生成点
divide_curve_x_points_right = rs.DivideCurve(curve_x_right,5)
divide_curve_y_points_right = rs.DivideCurve(curve_y_right,5)
#卷杀
CrossCurves_right = []
for i in range(len(divide_curve_x_points_right)):
    divide_x = divide_curve_x_points_right[i]
    divide_y = divide_curve_y_points_right[i]
    CrossCurve_right = rs.AddLine(divide_x,divide_y)
    CrossCurves_right.append(CrossCurve_right)
del CrossCurves_right[-1]
del CrossCurves_right[0]
CrossCurves_points_right = []
for i in range(len(CrossCurves_right)):
    CrossCurves_point_right = rs.CurveCurveIntersection(CrossCurves_right[i],CrossCurves_right[i-1])[0][1]
    CrossCurves_points_right.append(CrossCurves_point_right)
CrossCurves_points_right = CrossCurves_points_right[1:len(CrossCurves_points_right)]
pt_3x_right = rs.CopyObject(CrossCurves_points_right[0])
pt_4x_right = rs.CopyObject(CrossCurves_points_right[1])
pt_5x_right = rs.CopyObject(CrossCurves_points_right[2])
pt_3z_right = rs.CopyObject(pt_2_right)
rs.MoveObject(pt_3z_right,(0,0,6 * x))
pt_4z_right = rs.CopyObject(pt_3z_right)
rs.MoveObject(pt_4z_right,(-12 * x,0,0))
#华拱下弧线
CrossCurves_points.append(pt_3z)
CrossCurves_points.append(pt_4z)
CrossCurves_points.insert(0,pt_3x)
CrossCurves_points.insert(0,pt_4x)
CrossCurves_points.insert(0,pt_2x_right)
CrossCurves_points.insert(0,pt_3x_right)
CrossCurves_points.insert(0,pt_4x_right)
CrossCurves_points.insert(0,pt_5x_right)
CrossCurves_points.insert(0,pt_2_right)
CrossCurves_points.insert(0,pt_3z_right)
CrossCurves_points.insert(0,pt_4z_right)
JuanSha_curve = rs.AddPolyline(CrossCurves_points)
#欹幽
#左
qa_left_2 = rs.CopyObject(pt_4z)
rs.MoveObject(qa_left_2,(2 * x,0,4 * x))
qa_curve_left_1 = rs.AddLine(pt_4z,qa_left_2)

qa_left_3 = rs.CurveMidPoint(qa_curve_left_1)
direction_left = (-x, 0, 2 * x)  # 任意方向向量 
distance = 0.5 * x # 移动距离 
# 单位化方向向量并计算实际位移 
unit_vector_left = rs.VectorUnitize(direction_left)
displacement_left = rs.VectorScale(unit_vector_left, distance)
rs.MoveObject(qa_left_3, displacement_left)
qa_curve_left_1 = rs.AddCurve([pt_4z,qa_left_3,qa_left_2])
#欹幽
#右
qa_right_2 = rs.CopyObject(pt_4z_right)
rs.MoveObject(qa_right_2,(-2 * x,0,4 * x))
qa_curve_right_1 = rs.AddLine(pt_4z_right,qa_right_2)

qa_right_3 = rs.CurveMidPoint(qa_curve_right_1)
direction_right = (x, 0, 2 * x)  # 任意方向向量 
distance = 0.5 * x # 移动距离 
# 单位化方向向量并计算实际位移 
unit_vector_right = rs.VectorUnitize(direction_right)
displacement_right = rs.VectorScale(unit_vector_right, distance)
rs.MoveObject(qa_right_3, displacement_right)
qa_curve_right_1 = rs.AddCurve([pt_4z_right,qa_right_3,qa_right_2])
#拱眼上部
gy_left_up_1 = rs.CopyObject(qa_left_2)
rs.MoveObject(gy_left_up_1,(0,0,2 * x))
gy_right_up_1 = rs.CopyObject(qa_right_2)
rs.MoveObject(gy_right_up_1,(0,0,2 * x))
gy_up_curve = rs.AddPolyline([qa_left_2,gy_left_up_1,gy_right_up_1,qa_right_2])
#华拱未剪切前
HuaGong_untrimed = rs.JoinCurves([JuanSha_curve,qa_curve_left_1,qa_curve_right_1,gy_up_curve ])
HuaGong_untrimed = rs.AddPlanarSrf(HuaGong_untrimed)
extrude_curve1 = rs.AddLine(pt_o,rs.MoveObject(rs.CopyObject(pt_o),(0,10 * x,0)))
HuaGong_untrimed = rs.ExtrudeSurface(HuaGong_untrimed,extrude_curve1)
#剪切斗拱下部
#斗拱下部 广16.5分,厚为5分
HuaGong_dowm_curve = rs.AddLine(pt_3x,zjc_pt1)
HuaGong_dowm_curve2 =rs.CopyObject(HuaGong_dowm_curve)
rs.MoveObject(HuaGong_dowm_curve2,(0,0,5 * x))
HuaGong_dowm = rs.AddLoftSrf([HuaGong_dowm_curve,HuaGong_dowm_curve2])
HuaGong_dowm = rs.ExtrudeSurface(HuaGong_dowm,extrude_curve1)
HuaGong = rs.BooleanDifference(HuaGong_dowm,HuaGong_untrimed,delete_input = False)
#剪切斗拱中部
#斗拱下部 广10.25分,厚为10.125分
HuaGong_mid_curve_pt1 = rs.CopyObject(rs.CurveStartPoint(HuaGong_dowm_curve2))
rs.MoveObject(HuaGong_mid_curve_pt1,(3.125 * x,0,0))
HuaGong_mid_curve_pt2 = rs.CopyObject(HuaGong_mid_curve_pt1)
rs.MoveObject(HuaGong_mid_curve_pt2,(10.25 * x,0,0))
HuaGong_mid_curve1 = rs.AddLine(HuaGong_mid_curve_pt1,HuaGong_mid_curve_pt2)
HuaGong_mid_curve2 =rs.CopyObject(HuaGong_mid_curve1)
rs.MoveObject(HuaGong_mid_curve2,(0,0,10* x))
HuaGong_mid = rs.AddLoftSrf([HuaGong_mid_curve1,HuaGong_mid_curve2])
rs.MoveObject(HuaGong_mid,(0,1.125 * x,0))
extrude_curve2 = rs.AddLine(HuaGong_mid_curve_pt1,rs.MoveObject(rs.CopyObject(HuaGong_mid_curve_pt1),(0,-1.125*x,0)))
HuaGong_mid = rs.ExtrudeSurface(HuaGong_mid,extrude_curve2)
HuaGong_mid2 =rs.CopyObject(HuaGong_mid)
rs.MoveObject(HuaGong_mid2,(0,8.875 * x,0))
HuaGong_mid = [HuaGong_mid,HuaGong_mid2]
HuaGong = rs.BooleanDifference(HuaGong,HuaGong_mid,delete_input = False)
#剪切拱眼
#左
gy_left_pt_1 = rs.CopyObject(rs.CurveStartPoint(HuaGong_mid_curve2))
rs.MoveObject(gy_left_pt_1,(-1.75/2 * x,0,0))
gy_right_pt_1 = rs.CopyObject(rs.CurveEndPoint(HuaGong_mid_curve2))
rs.MoveObject(gy_right_pt_1,(1.75/2 * x,0,0))


qa_left_2_2 = rs.CopyObject(gy_left_pt_1)
rs.MoveObject(qa_left_2_2,(-2 * x,0,4 * x))
qa_curve_left_1_2 = rs.AddLine(gy_left_pt_1,qa_left_2_2)

qa_left_3_2 = rs.CurveMidPoint(qa_curve_left_1_2)
direction_left_2 = (x, 0, 2 * x)  # 任意方向向量 
distance = 0.5 * x # 移动距离 
# 单位化方向向量并计算实际位移 
unit_vector_left_2 = rs.VectorUnitize(direction_left_2)
displacement_left_2 = rs.VectorScale(unit_vector_left_2, distance)
rs.MoveObject(qa_left_3_2, displacement_left_2)
qa_curve_left_1_2 = rs.AddCurve([gy_left_pt_1,qa_left_3_2,qa_left_2_2])


qa_right_2_2 = rs.CopyObject(gy_right_pt_1)
rs.MoveObject(qa_right_2_2,(2 * x,0,4 * x))
qa_curve_right_1_2 = rs.AddLine(gy_right_pt_1,qa_right_2_2)
qa_right_3_2 = rs.CurveMidPoint(qa_curve_right_1_2)
direction_right_2 = (-x, 0, 2 * x)  # 任意方向向量 
distance = 0.5 * x # 移动距离 
# 单位化方向向量并计算实际位移 
unit_vector_right_2 = rs.VectorUnitize(direction_right_2)
displacement_right_2 = rs.VectorScale(unit_vector_right_2, distance)
rs.MoveObject(qa_right_3_2, displacement_right_2)
qa_curve_right_1_2 = rs.AddCurve([gy_right_pt_1,qa_right_3_2,qa_right_2_2])

#拱眼出头
gy_up_1 = rs.CopyObject(qa_left_2_2)
rs.MoveObject(gy_up_1,(0,0,2 * x))
gy_up_2 = rs.CopyObject(qa_right_2_2)
rs.MoveObject(gy_up_2,(0,0,2 * x))
gy_curve_1_left = rs.AddLine(qa_left_2_2,gy_up_1)
gy_curve_1_right = rs.AddLine(qa_right_2_2,gy_up_2)

#拱眼隐去部深1分
#左
gy_y_l1 = rs.CopyObject(pt_4z)
rs.MoveObject(gy_y_l1,(0,0,-x))
gy_y_l2 = rs.CopyObject(gy_left_pt_1)
rs.MoveObject(gy_y_l2,(0,0,-x))
gy_y_curve = rs.AddPolyline([pt_4z,gy_y_l1,gy_y_l2,gy_left_pt_1])
gy_y_curve_1 = rs.AddFilletCurve(rs.AddLine(pt_4z,gy_y_l1),rs.AddLine(gy_y_l1,gy_y_l2),radius = x)
gy_y_curve_2 = rs.AddFilletCurve(rs.AddLine(gy_left_pt_1,gy_y_l2),rs.AddLine(gy_y_l2,gy_y_l1),radius = x)
gy_y_curve = rs.JoinCurves([gy_y_curve_1,rs.AddLine(rs.CurveEndPoint(gy_y_curve_1),rs.CurveEndPoint(gy_y_curve_2)),gy_y_curve_2])
#右
gy_y_r1 = rs.CopyObject(pt_4z_right)
rs.MoveObject(gy_y_r1,(0,0,-x))
gy_y_r2 = rs.CopyObject(gy_right_pt_1)
rs.MoveObject(gy_y_r2,(0,0,-x))
gy_y_curve_right = rs.AddPolyline([pt_4z_right,gy_y_r1,gy_y_l2,gy_right_pt_1])
gy_y_curve_1_right = rs.AddFilletCurve(rs.AddLine(pt_4z_right,gy_y_r1),rs.AddLine(gy_y_r1,gy_y_r2),radius = x)
gy_y_curve_2_right = rs.AddFilletCurve(rs.AddLine(gy_right_pt_1,gy_y_r2),rs.AddLine(gy_y_r2,gy_y_r1),radius = x)
gy_y_curve_right = rs.JoinCurves([gy_y_curve_1_right,rs.AddLine(rs.CurveEndPoint(gy_y_curve_1_right),rs.CurveEndPoint(gy_y_curve_2_right)),gy_y_curve_2_right])
#拱眼出头左
gy_ct_curve_left = rs.AddPolyline([qa_left_2,gy_left_up_1,gy_up_1,qa_left_2_2])
#拱眼出头右
gy_ct_curve_right = rs.AddPolyline([qa_right_2,gy_right_up_1,gy_up_2,qa_right_2_2])

gy_0 = rs.AddLine(qa_left_2,gy_left_up_1)
gy_1 = rs.JoinCurves([qa_curve_left_1,gy_0 ])
gy_2 = rs.CopyObject(gy_1)
rs.MoveObject(gy_2,(-x,0,0))
gy_3 = rs.AddLine(rs.CurveEndPoint(gy_1),rs.CurveEndPoint(gy_2))
gy_4 = rs.AddLine(rs.CurveStartPoint(gy_1),rs.CurveStartPoint(gy_2))
gy_5 = rs.AddPolyline([gy_left_up_1,gy_up_1,qa_left_2_2])
gy_0_r = rs.AddLine(qa_right_2,gy_right_up_1)
gy_1_r = rs.JoinCurves([qa_curve_right_1,gy_0_r ])
gy_2_r = rs.CopyObject(gy_1_r)
rs.MoveObject(gy_2_r,(x,0,0))
gy_3_r = rs.AddLine(rs.CurveEndPoint(gy_1_r),rs.CurveEndPoint(gy_2_r))
gy_4_r = rs.AddLine(rs.CurveStartPoint(gy_1_r),rs.CurveStartPoint(gy_2_r))
gy_5_r = rs.AddPolyline([gy_right_up_1,gy_up_2,qa_right_2_2])

gy_curve_left = rs.JoinCurves([gy_5,qa_curve_left_1_2,gy_y_curve,gy_2,gy_3,gy_4])
gy_curve_right = rs.JoinCurves([gy_5_r,qa_curve_right_1_2,gy_y_curve_right,gy_2_r,gy_3_r,gy_4_r])
gy_surface_left = rs.AddPlanarSrf(gy_curve_left)
gy_surface_right = rs.AddPlanarSrf(gy_curve_right)
extrude_curve3 = rs.AddLine(pt_o,rs.MoveObject(rs.CopyObject(pt_o),(0,x,0)))
gy_brep_left = rs.ExtrudeSurface(gy_surface_left,extrude_curve3)
gy_brep_right = rs.ExtrudeSurface(gy_surface_right,extrude_curve3)
gy_brep1 = gy_brep_left
gy_brep2 = gy_brep_right
gy_brep3 = rs.CopyObject(gy_brep1)
rs.MoveObjects(gy_brep3,(0,9 * x,0))
gy_brep4 = rs.CopyObject(gy_brep2)
rs.MoveObjects(gy_brep4,(0,9 * x,0))
HuaGong = rs.BooleanDifference(HuaGong,gy_brep2,delete_input = True)
HuaGong = rs.BooleanDifference(HuaGong,gy_brep4,delete_input = True)
HuaGong = rs.BooleanIntersection(gy_brep1,HuaGong,delete_input=True)
HuaGong = rs.BooleanIntersection(gy_brep3,HuaGong,delete_input=True)
#馒头榫,广为2.5分,厚为2.5分,深为2.5分
mts_base_point = rs.AddPoint(0,0,0)
mts_pt_1 = rs.AddPoint(2.5 * x,0,0)
mts_cr_1 = rs.AddLine(mts_base_point,mts_pt_1)
mts_cr_2 = rs.CopyObject(mts_cr_1)
rs.MoveObject(mts_cr_2,(0,2.5 * x,0))
mts_sr = rs.AddLoftSrf([mts_cr_1,mts_cr_2])
mts = rs.ExtrudeSurface(mts_sr,rs.AddLine(mts_base_point,rs.MoveObject(rs.CopyObject(mts_base_point),(0,0,2.5 * x))))
mts_source = [2.5/2 *x,2.5/2 * x,0]
source_x = [2.5/2 * x + 1,2.5/2 * x,0]            # X 轴方向点
source_y = [2.5/2 * x,2.5/2 * x + 1,0] 
source = [mts_source, source_x, source_y]           # Y 轴方向点
#馒头榫投射点 左
mts_project_left = [6 * x,5 * x,15 * x]
target_x_left = [6 * x + 1,5 * x,15 * x]            # 新 X 轴方向点（向右）
target_y_left = [6 * x,5 * x + 1,15 * x]            # 新 Y 轴方向点（向上）
target_left = [mts_project_left, target_x_left, target_y_left]
#馒头榫投射 左
mts1 = rs.OrientObject(rs.CopyObject(mts), source, target_left,)


#馒头榫投射点 右
if (HuaGong_CaiFen_left > 25) & (HuaGong_CaiFen_right >25):
    mts_project_right= [(HuaGong_CaiFen_left + HuaGong_CaiFen_right - 6) * x ,5 * x,15 * x]
    target_x_right = [(HuaGong_CaiFen_left + HuaGong_CaiFen_right - 6) * x + 1,5 * x,15 * x]            # 新 X 轴方向点（向右）
    target_y_right = [(HuaGong_CaiFen_left + HuaGong_CaiFen_right - 6) * x,5 * x + 1,15 * x]           # 新 Y 轴方向点（向上）
else : raise ValueError(f"必须大于26分")
target_right = [mts_project_right, target_x_right, target_y_right]
#馒头榫投射 右
mts2 = rs.OrientObject(rs.CopyObject(mts), source, target_right)
HuaGong = rs.BooleanUnion([rs.CopyObject(HuaGong),rs.CopyObject(mts1),rs.CopyObject(mts2)],delete_input=True)

#拱眼上的插栓,广4分,厚4分,深2.5分
gy_cs_base_point =rs.AddPoint(0,0,0)
gy_cx_pt1 = rs.AddPoint(4 * x,0,0)
gy_cx_cr1 = rs.AddLine(gy_cs_base_point,gy_cx_pt1)
gy_cx_cr2 = rs.CopyObject(gy_cx_cr1)
rs.MoveObject(gy_cx_cr2,(0,0,4 * x))
gy_cx =rs.AddLoftSrf([gy_cx_cr1,gy_cx_cr2])
gy_cx = rs.ExtrudeSurface(gy_cx,rs.AddLine(mts_base_point,rs.MoveObject(rs.CopyObject(mts_base_point),(0,2.5 * x,0))))

gy_cs_source = [2 *x,2.5/2 * x,0]
source_x_cs = [2 * x + 1,2.5/2 * x,0]            # X 轴方向点
source_y_cs = [2 * x,2.5/2 * x + 1,0] 
source_cs = [gy_cs_source,source_x_cs,source_y_cs]           # Y 轴方向点
#拱眼上的插栓榫投射点 左
gy_cs_project_left = [(16 + (HuaGong_CaiFen_left - 26)/2) * x,5 * x,21 * x]
target_x_left_cs = [(16 + (HuaGong_CaiFen_left - 26)/2) * x + 1,5 * x,21 * x]            # 新 X 轴方向点（向右）
target_y_left_cs = [(16 + (HuaGong_CaiFen_left - 26)/2) * x,5 * x + 1,21 * x]            # 新 Y 轴方向点（向上）
target_left_cs = [gy_cs_project_left, target_x_left_cs, target_y_left_cs]
#拱眼上的插栓 左
gy_cx1 = rs.OrientObject(rs.CopyObject(gy_cx), source_cs, target_left_cs)

#拱眼上的插栓 右
if (HuaGong_CaiFen_left > 25) & (HuaGong_CaiFen_right >25):
    gy_cs_project_right = [(HuaGong_CaiFen_left + 10 + (HuaGong_CaiFen_right - 26)/2) * x,5 * x,21 * x]
    target_x_right_cs = [(HuaGong_CaiFen_left + 10 + (HuaGong_CaiFen_right - 26)/2) * x + 1,5 * x,21 * x]            # 新 X 轴方向点（向右）
    target_y_right_cs = [(HuaGong_CaiFen_left + 10 + (HuaGong_CaiFen_right - 26)/2) * x,5 * x + 1,21 * x]            # 新 Y 轴方向点（向上）
target_right_cs = [gy_cs_project_right, target_x_right_cs, target_y_right_cs]
#拱眼上的插栓 右
gy_cx2 = rs.OrientObject(rs.CopyObject(gy_cx), source_cs, target_right_cs)

HuaGong = rs.BooleanDifference(rs.CopyObject(gy_cx2),rs.CopyObject(HuaGong),delete_input = True)
HuaGong = rs.BooleanIntersection(rs.CopyObject(gy_cx1),rs.CopyObject(HuaGong),delete_input = True)

#佛光寺大殿散斗

x = CaiFen
#散斗,深12分,广10分,华拱/散斗.深10分,广12分,泥道栱
sd_pt_o = rs.AddPoint(0,0,0)
sd_pt2 = rs.AddPoint(12 * x,0,0)
sd_pt_z1 = rs.AddPoint(- 2 * x,0, 4 * x)
sd_cr_1 = rs.AddLine(sd_pt_o,sd_pt_z1)
#散斗,欹
sd_pt_z2 = rs.CurveMidPoint(sd_cr_1)
direction_left = (x, 0, 2 * x)  # 任意方向向量 
distance = 0.5 * x # 移动距离 
# 单位化方向向量并计算实际位移 
unit_vector_left = rs.VectorUnitize(direction_left)
displacement_left = rs.VectorScale(unit_vector_left, distance)
rs.MoveObject(sd_pt_z2, displacement_left)
sd_cr_1 = rs.AddCurve([sd_pt_o,sd_pt_z2,sd_pt_z1])
sd_pt_3 = rs.MoveObject(rs.CopyObject(sd_pt_o),(0,2 * x,0))
sd_sr1 = rs.AddLine(sd_pt_3,rs.MoveObject(rs.CopyObject(sd_pt_3),(-2 * x,-2 * x,0)))
sd_sr1 = rs.AddLoftSrf([sd_sr1,rs.MoveObject(rs.CopyObject(sd_sr1),(0,0,4 * x))])
sd_cr_1 =rs.ProjectCurveToSurface(sd_cr_1,sd_sr1,[0,1,0])
sd_cr_2 = rs.MoveObject(rs.CopyObject(sd_cr_1),(0,10 * x,0 ))
sd_cr_2 = rs.RotateObject(sd_cr_2, rs.CurveStartPoint(sd_cr_2),-90,[0,0,1],copy=True)
sd_cr_3 = rs.MoveObject(rs.CopyObject(sd_cr_2),(12 * x,0,0 ))
sd_cr_3 = rs.RotateObject(sd_cr_3, rs.CurveStartPoint(sd_cr_3),-90,[0,0,1],copy=True)
sd_cr_4 = rs.MoveObject(rs.CopyObject(sd_cr_1),(12 * x,0,0 ))
sd_cr_4 = rs.RotateObject(sd_cr_4, rs.CurveStartPoint(sd_cr_4),90,[0,0,1],copy=True)
sd_down_Brep = rs.AddLoftSrf([sd_cr_1,sd_cr_2,sd_cr_3,sd_cr_4],loft_type=2,closed=True)
rs.CapPlanarHoles(sd_down_Brep)
#散斗,平
sd_sr2 = rs.ExplodePolysurfaces(sd_down_Brep)
sd_sr2 = sd_sr2[2]
sd_mid_Brep = rs.ExtrudeSurface(sd_sr2,rs.AddLine(rs.CurveEndPoint(sd_cr_2),rs.MoveObject(rs.CurveEndPoint(sd_cr_2),(0,0,2 * x))))
sd_sr3_curve= rs.DuplicateEdgeCurves(sd_mid_Brep)[9]
sd_sr3 = rs.AddLoftSrf([sd_sr3_curve,rs.MoveObject(rs.CopyObject(sd_sr3_curve),(0,-2 * x,0))])
sd_source_point = rs.SurfaceAreaCentroid(rs.ExplodePolysurfaces(sd_down_Brep)[1])[0]
sd_up_brep1 = rs.ExtrudeSurface(sd_sr3,rs.AddLine(sd_pt_o,rs.MoveObject(rs.CopyObject(sd_pt_o),(0,0,4 * x))))
sd_up_brep2 =rs.CopyObject(sd_up_brep1)
rs.MoveObject(sd_up_brep2,(0, -12 * x ,0))

#馒头榫投射点 
mts_project_sd = [6 * x,7 * x,0]
target_x_sd= [6 * x + 1,7 * x,0] # 新 X 轴方向点（向右）
target_y_sd = [6 * x,7 * x + 1,0] # 新 Y 轴方向点（向上）
target_sd = [mts_project_sd, target_x_sd, target_y_sd]
#馒头榫投射 
mts_sd = rs.OrientObject(rs.CopyObject(mts), source, target_sd)
SanDou = rs.BooleanDifference(sd_down_Brep,mts_sd,delete_input=False)
SanDou_up = rs.BooleanDifference(sd_mid_Brep,sd_up_brep2,delete_input=False)
SanDou_up = rs.BooleanDifference(SanDou_up,sd_up_brep1,delete_input=False)
SanDou = rs.BooleanDifference(SanDou_up,SanDou,delete_input=False)

SanDou_left = rs.OrientObject(rs.CopyObject(SanDou),target_sd,target_left)
SanDou_right = rs.OrientObject(rs.CopyObject(SanDou),target_sd,target_right)

SanDou_g = [SanDou_left,SanDou_right]

##佛光寺大殿泥道拱生成
if NiDaoGong_CaiFen_left != NiDaoGong_CaiFen_right:
    raise ValueError(f"两边必须一样长")

ndg_pt_o = rs.CopyObject(ZhuTou_point)
if (NiDaoGong_CaiFen_left > 25) & (NiDaoGong_CaiFen_right > 25):
    rs.MoveObject(ndg_pt_o,(0,(NiDaoGong_CaiFen_left) * x,0))
else : raise ValueError(f"必须大于26分")

ndg_pt_z1 = rs.CopyObject(ndg_pt_o)
rs.MoveObject(ndg_pt_z1,(0,0,9 * x))
ndg_cr_z = rs.AddLine(ndg_pt_o,ndg_pt_z1)
ndg_pt_y1 = rs.CopyObject(ndg_pt_o)
rs.MoveObject(ndg_pt_y1 ,(0,-14 * x,0))
ndg_cr_y = rs.AddLine(ndg_pt_y1,ndg_pt_o)
div_cr_z =rs.DivideCurve(ndg_cr_z,5)
div_cr_y =rs.DivideCurve(ndg_cr_y,5)
#卷杀
CrossCurves_ndg = []
for i in range(len(div_cr_z)):
    divide_y = div_cr_y[i]
    divide_z = div_cr_z[i]
    CrossCurve_ndg = rs.AddLine(divide_y,divide_z)
    CrossCurves_ndg.append(CrossCurve_ndg)
CrossCurves_ndg = CrossCurves_ndg[1:len(CrossCurves_ndg)-1]
#选择交点
CrossCurves_points_ndg = []
for i in range(len(CrossCurves_ndg)):
    CrossCurves_point_ndg = rs.CurveCurveIntersection(CrossCurves_ndg[i],CrossCurves_ndg[i-1])[0][1]
    CrossCurves_points_ndg.append(CrossCurves_point_ndg)
CrossCurves_points_ndg = CrossCurves_points_ndg[1:len(CrossCurves_points_ndg)]
CrossCurves_points_ndg.insert(0,rs.CurveStartPoint(ndg_cr_y))
CrossCurves_points_ndg.insert(len(CrossCurves_points_ndg)+1,rs.CurveEndPoint(ndg_cr_z))
ndg_pt_z2 = rs.CopyObject(ndg_pt_z1)
rs.MoveObject(ndg_pt_z2,(0,0, 6 * x))
ndg_pt_z3 = rs.CopyObject(ndg_pt_z2)
rs.MoveObject(ndg_pt_z3,(0,-10 * x,0))
ndg_pt_y_1 = rs.CopyObject(ZhuTou_point)
rs.MoveObject(ndg_pt_y_1,(0,0,5 * x))
ndg_pt_y_2 = rs.CopyObject(ndg_pt_y_1)
rs.MoveObject(ndg_pt_y_2,(0,4 * x,0))
ndg_pt_y_3 = rs.CopyObject(ndg_pt_y_2)
rs.MoveObject(ndg_pt_y_3,(0,0,10 * x))
CrossCurves_points_ndg.append(ndg_pt_z2)
CrossCurves_points_ndg.append(ndg_pt_z3)
CrossCurves_points_ndg_right = rs.MirrorObjects(CrossCurves_points_ndg,ZhuTou_point,rs.MoveObject(rs.CopyObject(ZhuTou_point),(x,0,0)),copy=True)
rs.MoveObjects(CrossCurves_points_ndg_right,(0,(NiDaoGong_CaiFen_left - NiDaoGong_CaiFen_left) * x,0))
ndg_mid_pt1 = rs.CopyObject(ZhuTou_point)
ndg_mid_pt1 = rs.MoveObject(ndg_mid_pt1,(0,-4 * x,15 * x))
ndg_mid_pt4 = rs.CopyObject(ZhuTou_point)
ndg_mid_pt4 = rs.MoveObject(ndg_mid_pt4,(0,4 * x,15 * x))
ndg_mid_pt2 = rs.CopyObject(ndg_mid_pt1)
rs.MoveObject(ndg_mid_pt2,(0,0,-10 * x))
ndg_mid_pt3 = rs.CopyObject(ndg_mid_pt2)
rs.MoveObject(ndg_mid_pt3,(0,8 * x,0))
CrossCurves_points_ndg.insert(0,CrossCurves_points_ndg_right[0])
CrossCurves_points_ndg.insert(0,CrossCurves_points_ndg_right[1])
CrossCurves_points_ndg.insert(0,CrossCurves_points_ndg_right[2])
CrossCurves_points_ndg.insert(0,CrossCurves_points_ndg_right[3])
CrossCurves_points_ndg.insert(0,CrossCurves_points_ndg_right[4])
CrossCurves_points_ndg.insert(0,CrossCurves_points_ndg_right[5])
CrossCurves_points_ndg.insert(0,CrossCurves_points_ndg_right[6])
CrossCurves_points_ndg.insert(0,ndg_mid_pt1)
CrossCurves_points_ndg.insert(0,ndg_mid_pt2)
CrossCurves_points_ndg.insert(0,ndg_mid_pt3)
CrossCurves_points_ndg.insert(0,ndg_mid_pt4)

ndg_curve_left1 = rs.AddPolyline(CrossCurves_points_ndg)
ndg_curve_left1 = rs.JoinCurves([ndg_curve_left1,rs.AddLine(rs.CurveEndPoint(ndg_curve_left1),rs.CurveStartPoint(ndg_curve_left1))])
rs.MoveObject(ndg_curve_left1,(5 *x,0,0))
ndg_sr_left1 = rs.AddPlanarSrf(ndg_curve_left1)

ndg_brep = rs.ExtrudeSurface(ndg_sr_left1,rs.AddLine(rs.AddPoint(0,0,0),rs.AddPoint(-10 * x,0,0)))

# 拱眼
ndg_gyy_pt1 = rs.CopyObject(ndg_pt_z3)
rs.MoveObject(ndg_gyy_pt1,(-5 * x,0,x))
ndg_gyy_pt2 = rs.CopyObject(ndg_gyy_pt1)
rs.MoveObject(ndg_gyy_pt2,(0,0,-2 * x))
ndg_gyy_pt4 = rs.CopyObject(ndg_mid_pt4)
rs.MoveObject(ndg_gyy_pt4,(-5 * x, 1.625 * x,x))
ndg_gyy_pt3 = rs.CopyObject(ndg_gyy_pt4)
rs.MoveObject(ndg_gyy_pt3,(0,0,-2 * x))
ndg_gyy_cr1 = rs.AddLine(ndg_gyy_pt1,ndg_gyy_pt2)
ndg_gyy_cr2 = rs.AddLine(ndg_gyy_pt2,ndg_gyy_pt3)
ndg_gyy_cr3 = rs.AddLine(ndg_gyy_pt3,ndg_gyy_pt4)
ndg_gyy_cr1 = rs.AddFilletCurve(ndg_gyy_cr1,ndg_gyy_cr2,x)
ndg_gyy_cr2 = rs.AddFilletCurve(ndg_gyy_cr3,ndg_gyy_cr2,x)
ndg_gyy_cr3 = rs.AddLine(rs.CurveEndPoint(ndg_gyy_cr1),rs.CurveEndPoint(ndg_gyy_cr2))
ndg_gyy_cr4 = rs.AddLine(rs.CurveStartPoint(ndg_gyy_cr1),rs.MoveObject(rs.CopyObject(ndg_gyy_pt1),(0,0,x)))
ndg_gyy_cr5 = rs.AddLine(rs.CurveStartPoint(ndg_gyy_cr2),rs.MoveObject(rs.CopyObject(ndg_gyy_pt4),(0,0,x)))
ndg_gyy_1 =rs.JoinCurves([ndg_gyy_cr1,ndg_gyy_cr2,ndg_gyy_cr3,ndg_gyy_cr4,ndg_gyy_cr5])
ndg_gyy_1 =rs.JoinCurves([ndg_gyy_1,rs.AddLine(rs.CurveStartPoint(ndg_gyy_1),rs.CurveEndPoint(ndg_gyy_1))])
rs.MoveObject(ndg_gyy_1,(-x,0,0)) 
ndg_gyy_1 = rs.AddPlanarSrf(ndg_gyy_1)
ndg_gyy_1 = rs.ExtrudeSurface(ndg_gyy_1,rs.AddLine(ZhuTou_point,rs.MoveObject(rs.CopyObject(ZhuTou_point),(2 * x,0,0))))
ndg_gyy_2 = rs.MirrorObject(ndg_gyy_1,ZhuTou_point,rs.MoveObject(rs.CopyObject(ZhuTou_point),(0,x,0)),copy=True)
ndg_gyy_3 = rs.MirrorObject(ndg_gyy_1,ZhuTou_point,rs.MoveObject(rs.CopyObject(ZhuTou_point),(x,0,0)),copy=True)
ndg_gyy_4 = rs.MirrorObject(ndg_gyy_2,ZhuTou_point,rs.MoveObject(rs.CopyObject(ZhuTou_point),(x,0,0)),copy=True)
ndg_brep = rs.BooleanDifference(ndg_brep,ndg_gyy_1)
ndg_brep = rs.BooleanDifference(ndg_brep,ndg_gyy_2)
ndg_brep = rs.BooleanDifference(ndg_brep,ndg_gyy_3)
ndg_brep = rs.BooleanDifference(ndg_brep,ndg_gyy_4)
#泥道拱上的馒头榫
#馒头榫投射点 
mts_project_ndg_left = [HuaGong_CaiFen_left * x,NiDaoGong_CaiFen_left * x,15 * x]
target_x_ndg_left= [HuaGong_CaiFen_left * x + 1,NiDaoGong_CaiFen_left * x,15 * x]   # 新 X 轴方向点（向右）
target_y_ndg_left = [HuaGong_CaiFen_left * x,NiDaoGong_CaiFen_left * x + 1,15 * x]  # 新 Y 轴方向点（向上）
target_ndg_left = [mts_project_ndg_left, target_x_ndg_left, target_y_ndg_left]

mts_project_ndg_right = [HuaGong_CaiFen_left * x,(-NiDaoGong_CaiFen_right + 10) * x,15 * x]
target_x_ndg_right= [HuaGong_CaiFen_left * x + 1,(-NiDaoGong_CaiFen_right + 10) * x,15 * x] # 新 X 轴方向点（向右）
target_y_ndg_right = [HuaGong_CaiFen_left * x,(-NiDaoGong_CaiFen_right + 10) * x + 1,15 * x]    # 新 Y 轴方向点（向上）
target_ndg_right = [mts_project_ndg_right, target_x_ndg_right, target_y_ndg_right]

#馒头榫投射 
mts_ndg_left = rs.OrientObject(rs.CopyObject(mts), source, target_ndg_left)
mts_ndg_right = rs.OrientObject(rs.CopyObject(mts), source, target_ndg_right)

ndg_brep = rs.BooleanUnion([ndg_brep,mts_ndg_left,mts_ndg_right], delete_input=False)

#𬮴契
aq_pt_1 = rs.AddPoint(ndg_pt_y_3)
rs.MoveObject(aq_pt_1,(-5 * x,x,0))
aq_pt_2 = rs.AddPoint(ndg_gyy_pt1)
rs.MoveObject(aq_pt_2,(0,0,-x))
aq_pt_4 = rs.CopyObject(aq_pt_2)
rs.MoveObject(aq_pt_4,(0,-2 * x,4 * x))
aq_cr_1_1 = rs.AddLine(aq_pt_2,aq_pt_4)

aq_pt_3 = rs.CurveMidPoint(aq_cr_1_1)
direction_left_aq = (0, x, 2 * x)   # 任意方向向量 
distance = 0.5 * x # 移动距离 
# 单位化方向向量并计算实际位移 
unit_vector_left_aq = rs.VectorUnitize(direction_left_aq)
displacement_left_aq = rs.VectorScale(unit_vector_left_aq, distance)
rs.MoveObject(aq_pt_3, displacement_left_aq )
aq_cr_1 = rs.AddCurve([aq_pt_2,aq_pt_3,aq_pt_4])

aq_pt_5 = rs.CopyObject(aq_pt_4)
rs.MoveObject(aq_pt_5,(0,0,2 *x))
aq_pt_6 = rs.CopyObject(aq_pt_1)
rs.MoveObject(aq_pt_6,(0,0,6 *x))
aq_cr_2 = rs.AddPolyline([aq_pt_2,aq_pt_1,aq_pt_6,aq_pt_5,aq_pt_4])
aq_cr = rs.JoinCurves([aq_cr_1,aq_cr_2])

aq_sr_left = rs.AddPlanarSrf(aq_cr)
rs.MoveObject(aq_sr_left,(3 * x,0,0))
aq_left = rs.ExtrudeSurface(aq_sr_left,rs.AddLine(ZhuTou_point,rs.MoveObject(rs.CopyObject(ZhuTou_point),(4 * x,0,0))))
#𬮴契插栓
aq_left_up_cr =rs.AddLine(aq_pt_6,aq_pt_5)
aq_cs_pt1 = rs.CopyObject(aq_pt_5)
rs.CurveLength(aq_left_up_cr)
rs.MoveObject(aq_cs_pt1,(3.75 * x,-rs.CurveLength(aq_left_up_cr)/2 + 2 * x,0))
aq_cs_pt2 = rs.CopyObject(aq_cs_pt1)
rs.MoveObject(aq_cs_pt2,(0,-4 * x,0))
aq_cs_cr1 = rs.AddLine(aq_cs_pt1,aq_cs_pt2)
aq_cs_cr2 =rs.CopyObject(aq_cs_cr1)
rs.MoveObject(aq_cs_cr2,(2.5 * x,0,0))
aq_cs_sr1 = rs.AddLoftSrf([aq_cs_cr1,aq_cs_cr2])
rs.MoveObject(aq_cs_sr1,(0,0,-10 * x))
aq_cs = rs.ExtrudeSurface(aq_cs_sr1,rs.AddLine(ZhuTou_point,rs.MoveObject(rs.CopyObject(ZhuTou_point),(0,0,14 * x))))
aq_left = rs.BooleanDifference(aq_left,aq_cs,delete_input=True)
aq_right = rs.MirrorObject(aq_left,ZhuTou_point,rs.MoveObject(rs.CopyObject(ZhuTou_point),(x,0,0)),copy=True)
ndg_brep = rs.BooleanIntersection(ndg_brep,aq_left,delete_input=False)
ndg_brep = rs.BooleanIntersection(ndg_brep,aq_right,delete_input=False)
aq_brep = [rs.CopyObject(aq_left),rs.CopyObject(aq_right)]

#佛光寺大殿散斗 泥道拱上

x = CaiFen
#散斗.深10分,广10分,泥道栱
sd_ndg_pt_o = rs.AddPoint(0,0,0)
sd_ndg_pt2 = rs.AddPoint(10 * x,0,0)
sd_ndg_pt_z1 = rs.AddPoint(- 2 * x,0, 4 * x)
sd_ndg_cr_1 = rs.AddLine(sd_ndg_pt_o,sd_ndg_pt_z1)
#散斗,欹
sd_ndg_pt_z2 = rs.CurveMidPoint(sd_ndg_cr_1)
direction_left = (x, 0, 2 * x)  # 任意方向向量 
distance = 0.5 * x # 移动距离 
# 单位化方向向量并计算实际位移 
unit_vector_left = rs.VectorUnitize(direction_left)
displacement_left = rs.VectorScale(unit_vector_left, distance)
rs.MoveObject(sd_ndg_pt_z2, displacement_left)
sd_ndg_cr_1 = rs.AddCurve([sd_ndg_pt_o,sd_ndg_pt_z2,sd_ndg_pt_z1])
sd_ndg_pt_3 = rs.MoveObject(rs.CopyObject(sd_ndg_pt_o),(0,2 * x,0))
sd_ndg_sr1 = rs.AddLine(sd_ndg_pt_3,rs.MoveObject(rs.CopyObject(sd_ndg_pt_3),(-2 * x,-2 * x,0)))
sd_ndg_sr1 = rs.AddLoftSrf([sd_ndg_sr1,rs.MoveObject(rs.CopyObject(sd_ndg_sr1),(0,0,4 * x))])
sd_ndg_cr_1 =rs.ProjectCurveToSurface(sd_ndg_cr_1,sd_ndg_sr1,[0,1,0])
sd_ndg_cr_2 = rs.MoveObject(rs.CopyObject(sd_ndg_cr_1),(0,10 * x,0 ))
sd_ndg_cr_2 = rs.RotateObject(sd_ndg_cr_2, rs.CurveStartPoint(sd_ndg_cr_2),-90,[0,0,1],copy=True)
sd_ndg_cr_3 = rs.MoveObject(rs.CopyObject(sd_ndg_cr_2),(10 * x,0,0 ))
sd_ndg_cr_3 = rs.RotateObject(sd_ndg_cr_3, rs.CurveStartPoint(sd_ndg_cr_3),-90,[0,0,1],copy=True)
sd_ndg_cr_4 = rs.MoveObject(rs.CopyObject(sd_ndg_cr_1),(10 * x,0,0 ))
sd_ndg_cr_4 = rs.RotateObject(sd_ndg_cr_4, rs.CurveStartPoint(sd_ndg_cr_4),90,[0,0,1],copy=True)
sd_ndg_down_Brep = rs.AddLoftSrf([sd_ndg_cr_1,sd_ndg_cr_2,sd_ndg_cr_3,sd_ndg_cr_4],loft_type=2,closed=True)
rs.CapPlanarHoles(sd_ndg_down_Brep)
#散斗,平
sd_ndg_sr2 = rs.ExplodePolysurfaces(sd_ndg_down_Brep)
sd_ndg_sr2 = sd_ndg_sr2[2]
sd_ndg_mid_Brep = rs.ExtrudeSurface(sd_ndg_sr2,rs.AddLine(rs.CurveEndPoint(sd_ndg_cr_2),rs.MoveObject(rs.CurveEndPoint(sd_ndg_cr_2),(0,0,2 * x))))
sd_ndg_sr3_curve= rs.DuplicateEdgeCurves(sd_ndg_mid_Brep)[9]
sd_ndg_sr3 = rs.AddLoftSrf([sd_ndg_sr3_curve,rs.MoveObject(rs.CopyObject(sd_ndg_sr3_curve),(0,-2 * x,0))])
sd_ndg_source_point = rs.SurfaceAreaCentroid(rs.ExplodePolysurfaces(sd_ndg_down_Brep)[1])[0]
sd_ndg_up_brep1 = rs.ExtrudeSurface(sd_ndg_sr3,rs.AddLine(sd_ndg_pt_o,rs.MoveObject(rs.CopyObject(sd_ndg_pt_o),(0,0,4 * x))))
sd_ndg_up_brep2 =rs.MirrorObject(sd_ndg_up_brep1,sd_ndg_source_point,rs.MoveObject(rs.CopyObject(sd_ndg_source_point),(x,0,0)),copy=True)

#馒头榫投射点 
mts_project_sd_ndg = [5 * x,7 * x,0]
target_x_sd_ndg= [5 * x + 1,7 * x,0] # 新 X 轴方向点（向右）
target_y_sd_ndg = [5 * x,7 * x + 1,0] # 新 Y 轴方向点（向上）
target_sd_ndg = [mts_project_sd_ndg, target_x_sd_ndg, target_y_sd_ndg]
#馒头榫投射 
mts_sd_ndg = rs.OrientObject(rs.CopyObject(mts), source, target_sd_ndg)

SanDou_ndg = rs.BooleanDifference(sd_ndg_mid_Brep,sd_ndg_down_Brep,delete_input=True)
SanDou_ndg = rs.BooleanDifference(SanDou_ndg,sd_ndg_up_brep1,delete_input=True)
SanDou_ndg = rs.BooleanDifference(SanDou_ndg,sd_ndg_up_brep2,delete_input=True)
SanDou_ndg = rs.BooleanUnion([SanDou_ndg,mts_sd_ndg] ,delete_input=False)
rs.RotateObject(SanDou_ndg,(5 * x,7 * x,0),90,[0,0,1])

#泥道拱上的散斗投射
SanDou_ndg_left = rs.OrientObject(rs.CopyObject(SanDou_ndg), target_sd_ndg, target_ndg_left)
SanDou_ndg_right = rs.OrientObject(rs.CopyObject(SanDou_ndg), target_sd_ndg, target_ndg_right)
SanDou_ndg_g = [SanDou_ndg_left,SanDou_ndg_right]

#栌斗.深23分,广23分
ld_pt_o = rs.AddPoint(0,0,0)
ld_pt2 = rs.AddPoint(23 * x,0,0)
#栌斗,欹,厚8.5分
ld_pt_z1 = rs.AddPoint(- 4.5 * x,0, 8.5 * x)
ld_cr_1 = rs.AddLine(ld_pt_o,ld_pt_z1)

ld_cr_6 = rs.AddLine(ld_pt_o,ld_pt_z1)

ld_pt_z2 = rs.CurveMidPoint(ld_cr_1)
direction_left = (x, 0, 2 * x)  # 任意方向向量 
distance = 1 * x # 移动距离 
# 单位化方向向量并计算实际位移 
unit_vector_left = rs.VectorUnitize(direction_left)
displacement_left = rs.VectorScale(unit_vector_left, distance)
rs.MoveObject(ld_pt_z2, displacement_left)
ld_cr_1 = rs.AddCurve([ld_pt_o,ld_pt_z2,ld_pt_z1])
ld_pt_3 = rs.MoveObject(rs.CopyObject(ld_pt_o),(0,2 * x,0))
ld_sr1 = rs.AddLine(ld_pt_3,rs.MoveObject(rs.CopyObject(ld_pt_3),(-4.5 * x,-4.5 * x,0)))
ld_sr1 = rs.AddLoftSrf([ld_sr1,rs.MoveObject(rs.CopyObject(ld_sr1),(0,0,8.5 * x))])
ld_cr_1 =rs.ProjectCurveToSurface(ld_cr_1,ld_sr1,[0,1,0])
ld_cr_2 = rs.MoveObject(rs.CopyObject(ld_cr_1),(0,23 * x,0 ))
ld_cr_2 = rs.RotateObject(ld_cr_2, rs.CurveStartPoint(ld_cr_2),-90,[0,0,1],copy=True)
ld_cr_3 = rs.MoveObject(rs.CopyObject(ld_cr_2),(23 * x,0,0 ))
ld_cr_3 = rs.RotateObject(ld_cr_3, rs.CurveStartPoint(ld_cr_3),-90,[0,0,1],copy=True)
ld_cr_4 = rs.MoveObject(rs.CopyObject(ld_cr_1),(23 * x,0,0 ))
ld_cr_4 = rs.RotateObject(ld_cr_4, rs.CurveStartPoint(ld_cr_4),90,[0,0,1],copy=True)
ld_down_Brep = rs.AddLoftSrf([ld_cr_1,ld_cr_2,ld_cr_3,ld_cr_4],loft_type=2,closed=True)
rs.CapPlanarHoles(ld_down_Brep)
#栌斗,平,厚6分
ld_sr2 = rs.ExplodePolysurfaces(ld_down_Brep)
ld_sr2 = ld_sr2[2]
LuDou_center_point = rs.SurfaceAreaCentroid(rs.ExplodePolysurfaces(ld_down_Brep)[1])
LuDou_center_point = rs.AddPoint(LuDou_center_point[0])
ld_mid_Brep = rs.ExtrudeSurface(ld_sr2,rs.AddLine(rs.CurveEndPoint(ld_cr_2),rs.MoveObject(rs.CurveEndPoint(ld_cr_2),(0,0, 6* x))))
#栌斗,耳,厚6分
ld_up_brep1 = rs.CopyObject(rs.CurveEndPoint(ld_cr_1))
rs.MoveObject(ld_up_brep1,(0,0,6 * x))
ld_up_brep1 = rs.AddLine(ld_up_brep1,rs.MoveObject(rs.CopyObject(ld_up_brep1),(11 * x,0,0)))
ld_up_brep1 = rs.ExtrudeCurve(ld_up_brep1,rs.AddLine(ld_pt_o,rs.MoveObject(rs.CopyObject(ld_pt_o),(0,11 * x,0))))
ld_up_brep1 = rs.ExtrudeSurface(ld_up_brep1,rs.AddLine(ld_pt_o,rs.MoveObject(rs.CopyObject(ld_pt_o),(0,0,6 * x))))
ld_up_brep2 = rs.MirrorObject(ld_up_brep1,LuDou_center_point,rs.MoveObject(rs.CopyObject(LuDou_center_point),(x,0,0)),copy=True)
ld_up_brep3 = rs.MirrorObject(ld_up_brep2,LuDou_center_point,rs.MoveObject(rs.CopyObject(LuDou_center_point),(0,x,0)),copy=True)
ld_up_brep4 = rs.MirrorObject(ld_up_brep3,LuDou_center_point,rs.MoveObject(rs.CopyObject(LuDou_center_point),(x,0,0)),copy=True)

ld_up_brep5 = rs.CopyObject(rs.CurveEndPoint(ld_cr_1))
rs.MoveObject(ld_up_brep5,(8 * x,11 * x,6 * x))
ld_up_brep5 = rs.AddLine(ld_up_brep5,rs.MoveObject(rs.CopyObject(ld_up_brep5),(0,10 * x,0)))
ld_up_brep5 = rs.ExtrudeCurve(ld_up_brep5,rs.AddLine(ld_pt_o,rs.MoveObject(rs.CopyObject(ld_pt_o),(3 * x,0,0))))
ld_up_brep5 = rs.ExtrudeSurface(ld_up_brep5,rs.AddLine(ld_pt_o,rs.MoveObject(rs.CopyObject(ld_pt_o),(0,0,3 * x))))
ld_up_brep6 = rs.MirrorObject(ld_up_brep5,LuDou_center_point,rs.MoveObject(rs.CopyObject(LuDou_center_point),(0,x,0)),copy=True)


#柱头馒头榫2.75分
mts_zt_base_point = rs.AddPoint(0,0,0)
mts_zt_pt_1 = rs.AddPoint(2.75 * x,0,0)
mts_zt_cr_1 = rs.AddLine(mts_zt_base_point,mts_zt_pt_1)
mts_zt_cr_2 = rs.CopyObject(mts_zt_cr_1)
rs.MoveObject(mts_zt_cr_2,(0,2.75 * x,0))
mts_zt_sr = rs.AddLoftSrf([mts_zt_cr_1,mts_zt_cr_2])
mts_zt = rs.ExtrudeSurface(mts_zt_sr,rs.AddLine(mts_zt_base_point,rs.MoveObject(rs.CopyObject(mts_zt_base_point),(0,0,2.75 * x))))
mts_zt_source = [2.75/2 *x,2.75/2 * x,0]
source_x_zt = [2.75/2 * x + 1,2.75/2 * x,0]            # X 轴方向点
source_y_zt = [2.75/2 * x,2.75/2 * x + 1,0] 
source_zt = [mts_zt_source, source_x_zt, source_y_zt]           # Y 轴方向点

#馒头榫投射点 
mts_project_ld = [11.5 * x,13.5 * x,0]
target_x_ld= [11.5 * x + 1,13.5 * x,0] # 新 X 轴方向点（向右）
target_y_ld = [11.5 * x,13.5 * x + 1,0] # 新 Y 轴方向点（向上）
target_ld = [mts_project_ld, target_x_ld, target_y_ld]

#馒头榫投射 
mts_ld = rs.OrientObject(rs.CopyObject(mts_zt), source_zt, target_ld)

LuDou = rs.BooleanDifference(ld_mid_Brep,ld_down_Brep,delete_input=True)
LuDou = rs.BooleanIntersection(LuDou,ld_up_brep1,delete_input=True)
LuDou = rs.BooleanIntersection(LuDou,ld_up_brep2,delete_input=True)
LuDou = rs.BooleanIntersection(LuDou,ld_up_brep3,delete_input=True)
LuDou = rs.BooleanIntersection(LuDou,ld_up_brep4,delete_input=True)
LuDou = rs.BooleanDifference(LuDou,ld_up_brep5,delete_input=True)
LuDou = rs.BooleanDifference(LuDou,ld_up_brep6,delete_input=True)
LuDou = rs.BooleanUnion([mts_ld,LuDou],delete_input=False)
rs.MoveObject(LuDou,((HuaGong_CaiFen_left - 11.5) * x,-8.5 * x,-14.5 * x))


#第二跳华拱
CrossCurves_points_2_1 =rs.CopyObjects(CrossCurves_points)[9:15]
CrossCurves_points_2_2 =rs.CopyObject(CrossCurves_points[1])
rs.MoveObjects(CrossCurves_points_2_1,(-21 * x,0,21 * x))
rs.MoveObjects(CrossCurves_points_2_2,(2 * x,0,6 * x))
CrossCurves_points_2_3 = rs.CopyObject(CrossCurves_points_2_2)
rs.MoveObjects(CrossCurves_points_2_3,(0,0,21 * x))
CrossCurves_points_2 = rs.CopyObjects(CrossCurves_points_2_1)
CrossCurves_points_2.insert(0,CrossCurves_points_2_2)
CrossCurves_points_2.insert(0,CrossCurves_points_2_3)
JuanSha_curve_2 =rs.AddPolyline(CrossCurves_points_2)

JuanSha_curve_2_2 = rs.CopyObject(qa_curve_left_1)
rs.MoveObject(JuanSha_curve_2_2,(-21 * x,0,21 * x))
JuanSha_curve_2_3 = rs.AddLine(rs.CurveEndPoint(JuanSha_curve_2_2),rs.MoveObject(rs.CurveEndPoint(rs.CopyObject(JuanSha_curve_2_2)),(0,0,2 * x)))
JuanSha_curve_2_4 = rs.AddLine(rs.CurveEndPoint(JuanSha_curve_2),rs.CurveStartPoint(JuanSha_curve_2_2))
JuanSha_curve_2_5 = rs.AddLine(rs.CurveStartPoint(JuanSha_curve_2),rs.CurveEndPoint(JuanSha_curve_2_3))

JuanSha_curve_2 =rs.JoinCurves([JuanSha_curve_2,JuanSha_curve_2_2,JuanSha_curve_2_3,JuanSha_curve_2_4,JuanSha_curve_2_5])
HuaGong_untrimed_2 = rs.AddPlanarSrf(JuanSha_curve_2)
HuaGong_untrimed_2 = rs.ExtrudeSurface(HuaGong_untrimed_2,rs.AddLine(rs.AddPoint(0,0,0),rs.AddPoint(0,10 * x,0)))
#第二跳斗拱修剪
#左
gy_curve_left_2 = rs.CopyObjects(gy_curve_left)
start_gy_curve_left_2,end_gy_curve_left_2 = rs.CurveDomain(gy_curve_left_2)
gy_curve_left_2_1 = rs.TrimCurve(gy_curve_left_2,(start_gy_curve_left_2 + (end_gy_curve_left_2 - start_gy_curve_left_2) * 0.5,start_gy_curve_left_2 + (end_gy_curve_left_2 - start_gy_curve_left_2) * 0.99),delete_input=False)
gy_curve_left_2_2 = rs.TrimCurve(gy_curve_left_2,(start_gy_curve_left_2 + (end_gy_curve_left_2 - start_gy_curve_left_2) * 0.99,start_gy_curve_left_2 + (end_gy_curve_left_2 - start_gy_curve_left_2) * 0.5),delete_input=False)
rs.MoveObjects(gy_curve_left_2_1,(-21 * x,0,21 * x))
rs.MoveObjects(gy_curve_left_2_2,(0,0,21 * x))
gy_curve_left_2 = rs.JoinCurves([gy_curve_left_2_1,gy_curve_left_2_2,rs.AddLine(rs.CurveStartPoint(gy_curve_left_2_1),rs.CurveEndPoint(gy_curve_left_2_2)),rs.AddLine(rs.CurveStartPoint(gy_curve_left_2_2),rs.CurveEndPoint(gy_curve_left_2_1))])
#右
gy_curve_right_2 = rs.CopyObjects(gy_curve_right)
start_gy_curve_right_2,end_gy_curve_right_2 = rs.CurveDomain(gy_curve_right_2)
gy_curve_right_2_1 = rs.TrimCurve(gy_curve_right_2,(start_gy_curve_right_2 + (end_gy_curve_right_2 - start_gy_curve_right_2) * 0.5,start_gy_curve_right_2 + (end_gy_curve_right_2 - start_gy_curve_right_2) * 0.99),delete_input=False)
gy_curve_right_2_2 = rs.TrimCurve(gy_curve_right_2,(start_gy_curve_right_2 + (end_gy_curve_right_2 - start_gy_curve_right_2) * 0.99,start_gy_curve_right_2 + (end_gy_curve_right_2 - start_gy_curve_right_2) * 0.5),delete_input=False)
rs.MoveObjects(gy_curve_right_2_1,(21 * x,0,21 * x))

rs.MoveObjects(gy_curve_right_2_2,(0,0,21 * x))
gy_curve_right_2 = rs.JoinCurves([gy_curve_right_2_1,gy_curve_right_2_2,rs.AddLine(rs.CurveStartPoint(gy_curve_right_2_1),rs.CurveEndPoint(gy_curve_right_2_2)),rs.AddLine(rs.CurveStartPoint(gy_curve_right_2_2),rs.CurveEndPoint(gy_curve_right_2_1))])
gy_surface_left_2 = rs.AddPlanarSrf(gy_curve_left_2)
gy_surface_right_2 = rs.AddPlanarSrf(gy_curve_right_2)

gy_brep_left_2 = rs.ExtrudeSurface(gy_surface_left_2,extrude_curve3)
gy_brep_right_2 = rs.ExtrudeSurface(gy_surface_right_2,extrude_curve3)
gy_brep1_2 = gy_brep_left_2
gy_brep2_2 = gy_brep_right_2
gy_brep3_2 = rs.CopyObject(gy_brep1_2)
rs.MoveObjects(gy_brep3_2,(0,9 * x,0))
gy_brep4_2 = rs.CopyObject(gy_brep2_2)
rs.MoveObjects(gy_brep4_2,(0,9 * x,0))

#第二跳华拱下面剪切
HuaGong_down_2 = rs.CopyObject(HuaGong_dowm)
rs.MoveObject(HuaGong_down_2,(0,0,21 * x))
rs.ScaleObject(HuaGong_down_2,ZhuTou_point,[20.5/33,1.5,1])

#第二跳华拱中部剪切
HuaGong_mid_2 = rs.CopyObjects(HuaGong_mid)
rs.MoveObject(HuaGong_mid_2,(0,0,21 * x))

#馒头榫投射点 左
mts_project_left_hg2 = [-15 * x,5 * x,36 * x]
target_x_left_hg2 = [-15 * x + 1,5 * x,36 * x]            # 新 X 轴方向点（向右）
target_y_left_hg2 = [-15 * x,5 * x + 1,36 * x]            # 新 Y 轴方向点（向上）
target_left_hg2 = [mts_project_left_hg2, target_x_left_hg2, target_y_left_hg2]
#馒头榫投射 
mts_hg2 = rs.OrientObject(rs.CopyObject(mts), source,target_left_hg2)

#拱眼上的插栓 左
gy_cx1_hg2 = rs.CopyObject(gy_cx1)
rs.MoveObject(gy_cx1_hg2,(-21/2 * x,0,21 * x))
#拱眼上的插栓 右
gy_cx2_hg2 = rs.CopyObject(gy_cx2)
rs.MoveObject(gy_cx2_hg2,(21/2 * x,0,21 * x))


HuaGong_2 = rs.BooleanUnion([HuaGong_untrimed_2,gy_brep2_2],delete_input = False)

HuaGong_2 = rs.BooleanUnion([HuaGong_2 ,gy_brep4_2],delete_input = False)
HuaGong_2 = rs.BooleanDifference(gy_brep3_2,HuaGong_2 ,delete_input = False)

HuaGong_2 = rs.BooleanIntersection(HuaGong_2 ,gy_brep1_2,delete_input = False)

HuaGong_2 = rs.BooleanIntersection(HuaGong_down_2,HuaGong_2 ,delete_input = False)

HuaGong_2 = rs.BooleanDifference(HuaGong_2 ,HuaGong_mid_2,delete_input = False)

HuaGong_2 = rs.BooleanUnion([HuaGong_2 ,mts_hg2],delete_input = False)
btf_brep = rs.CopyObject(HuaGong_2)
HuaGong_2 = rs.BooleanDifference(gy_cx1_hg2,HuaGong_2 ,delete_input = False)
HuaGong_2 = rs.BooleanIntersection(HuaGong_2 ,gy_cx2_hg2,delete_input = False)
HuaGong_2 = rs.BooleanDifference(gy_cx1,HuaGong_2,delete_input = False)
HuaGong_2 = rs.BooleanIntersection(HuaGong_2,gy_cx2,delete_input = False)
#第二跳华拱上的散斗
SanDou_hg2 = rs.CopyObject(SanDou_g[0])
rs.MoveObject(SanDou_hg2,(-21 * x,0,21 * x))
SanDou_g.append(SanDou_hg2)

#第二跳华拱月梁
yl_pt_1 =rs.CopyObject(CrossCurves_points_2_3)
rs.MoveObject(yl_pt_1,(-20 * x,0,-7 *x))
yl_pt_2 = rs.CopyObject(yl_pt_1)
rs.MoveObject(yl_pt_2,(0,-6.875 * x,0))
yl_pt_3 = rs.CopyObject(yl_pt_2)
rs.MoveObject(yl_pt_3,(40 * x,0,0))
yl_pt_4 = rs.CopyObject(CrossCurves_points_2_3)
rs.MoveObject(yl_pt_4,(71 * x,-6.875 * x,-7 *x))
#卷杀1
#生成要进行拆分的曲线
curve_x_yl1 = rs.AddLine(yl_pt_2,yl_pt_1)
curve_y_yl1 = rs.AddLine(yl_pt_3,yl_pt_2)
#拆分曲线生成点
divide_curve_x_points_yl1 = rs.DivideCurve(curve_x_yl1,5)
divide_curve_y_points_yl1 = rs.DivideCurve(curve_y_yl1,5)

CrossCurves_yl1 = []
for i in range(len(divide_curve_x_points_yl1)):
    divide_x_yl1 = divide_curve_x_points_yl1[i]
    divide_y_yl1 = divide_curve_y_points_yl1[i]
    CrossCurve_yl1 = rs.AddLine(divide_x_yl1,divide_y_yl1)
    CrossCurves_yl1.append(CrossCurve_yl1)
CrossCurves_yl1 = CrossCurves_yl1[1:len(CrossCurves_yl1)-1]
#选择交点
CrossCurves_points_yl1 = []
for i in range(len(CrossCurves_yl1)):
    CrossCurves_point_yl1 = rs.CurveCurveIntersection(CrossCurves_yl1[i],CrossCurves_yl1[i-1])[0][1]
    CrossCurves_points_yl1.append(CrossCurves_point_yl1)
CrossCurves_points_yl1 = CrossCurves_points_yl1[1:len(CrossCurves_points_yl1)]
CrossCurves_points_yl1.insert(0,rs.CurveStartPoint(curve_y_yl1))
CrossCurves_points_yl1.insert(len(CrossCurves_points_yl1)+1,rs.CurveEndPoint(curve_x_yl1))
CrossCurves_points_yl1.insert(0,yl_pt_4)
#卷杀线
JuanSha_curve_yl1_1 = rs.AddPolyline(CrossCurves_points_yl1)
rs.MoveObject(JuanSha_curve_yl1_1,(0,0,7 * x))
JuanSha_curve_yl1_2 =  rs.MirrorObjects(JuanSha_curve_yl1_1,ZhuTou_point,rs.MoveObject(rs.CopyObject(ZhuTou_point),(x,0,0)),copy=True)
JuanSha_curve_yl1 = rs.JoinCurves([JuanSha_curve_yl1_1,JuanSha_curve_yl1_2,rs.AddLine(rs.CurveStartPoint(JuanSha_curve_yl1_1),rs.CurveStartPoint(JuanSha_curve_yl1_2)),rs.AddLine(rs.CurveEndPoint(JuanSha_curve_yl1_1),rs.CurveEndPoint(JuanSha_curve_yl1_2))])
YueLiang_sr_1 = rs.AddPlanarSrf(JuanSha_curve_yl1)
YueLiang_untrimed = rs.ExtrudeSurface(YueLiang_sr_1,rs.AddLine(rs.AddPoint(0,0,0),rs.AddPoint(20 * x,0,-19 * x)))

#卷杀2
yl_pt_5 = rs.CopyObject(CrossCurves_points_2_3)
rs.MoveObject(yl_pt_5,(-13 * x,-7 * x,-7 * x))
yl_pt_6 = rs.CopyObject(yl_pt_5)
rs.MoveObject(yl_pt_6,(0,0,7 * x))
yl_pt_7 = rs.CopyObject(yl_pt_6)
rs.MoveObject(yl_pt_7,(14 * x,0,0))

#生成要进行拆分的曲线
curve_x_yl2 = rs.AddLine(yl_pt_6,yl_pt_5)
curve_y_yl2 = rs.AddLine(yl_pt_7,yl_pt_6)
#拆分曲线生成点
divide_curve_x_points_yl2 = rs.DivideCurve(curve_x_yl2,6)
divide_curve_y_points_yl2 = rs.DivideCurve(curve_y_yl2,6)

CrossCurves_yl2 = []
for i in range(len(divide_curve_x_points_yl2)):
    divide_x_yl2 = divide_curve_x_points_yl2[i]
    divide_y_yl2 = divide_curve_y_points_yl2[i]
    CrossCurve_yl2 = rs.AddLine(divide_x_yl2,divide_y_yl2)
    CrossCurves_yl2.append(CrossCurve_yl2)
CrossCurves_yl2 = CrossCurves_yl2[1:len(CrossCurves_yl2)-1]
#选择交点
CrossCurves_points_yl2 = []
for i in range(len(CrossCurves_yl2)):
    CrossCurves_point_yl2 = rs.CurveCurveIntersection(CrossCurves_yl2[i],CrossCurves_yl2[i-1])[0][1]
    CrossCurves_points_yl2.append(CrossCurves_point_yl2)
CrossCurves_points_yl2 = CrossCurves_points_yl2[1:len(CrossCurves_points_yl2)]
CrossCurves_points_yl2.insert(0,rs.CurveStartPoint(curve_y_yl2))
CrossCurves_points_yl2.insert(len(CrossCurves_points_yl2)+1,rs.CurveEndPoint(curve_x_yl2))
CrossCurves_points_yl2.insert(0,yl_pt_7)
#卷杀线
JuanSha_curve_yl2_1 = rs.AddPolyline(CrossCurves_points_yl2)
JuanSha_curve_yl2_2 = rs.MirrorObjects(JuanSha_curve_yl2_1,ZhuTou_point,rs.MoveObject(rs.CopyObject(ZhuTou_point),(x,0,0)),copy=True)
YueLiang_sr_2 = rs.AddLoftSrf([JuanSha_curve_yl2_1,JuanSha_curve_yl2_2])
YueLiang_trime = rs.ExtrudeSurface(YueLiang_sr_2,rs.AddLine(rs.AddPoint(0,0,0),rs.AddPoint(-20 * x,0,19 * x)))


#整和
#前檐铺作

#第二层华拱交互斗
#交互斗.深12分,广10分
jhd_pt_o = rs.AddPoint(0,0,0)
jhd_pt2 = rs.AddPoint(12 * x,0,0)
#交互斗,欹,厚4分
jhd_pt_z1 = rs.AddPoint(-2 * x,0, 4 * x)
jhd_cr_1 = rs.AddLine(jhd_pt_o,jhd_pt_z1)

jhd_cr_6 = rs.AddLine(jhd_pt_o,jhd_pt_z1)

jhd_pt_z2 = rs.CurveMidPoint(jhd_cr_1)
direction_left = (x, 0, 2 * x)  # 任意方向向量 
distance = 0.5 * x # 移动距离 
# 单位化方向向量并计算实际位移 
unit_vector_left = rs.VectorUnitize(direction_left)
displacement_left = rs.VectorScale(unit_vector_left, distance)
rs.MoveObject(jhd_pt_z2, displacement_left)
jhd_cr_1 = rs.AddCurve([jhd_pt_o,jhd_pt_z2,jhd_pt_z1])
jhd_pt_3 = rs.MoveObject(rs.CopyObject(jhd_pt_o),(0,2 * x,0))
jhd_sr1 = rs.AddLine(jhd_pt_3,rs.MoveObject(rs.CopyObject(jhd_pt_3),(-4.5 * x,-4.5 * x,0)))
jhd_sr1 = rs.AddLoftSrf([jhd_sr1,rs.MoveObject(rs.CopyObject(jhd_sr1),(0,0,8.5 * x))])
jhd_cr_1 =rs.ProjectCurveToSurface(jhd_cr_1,jhd_sr1,[0,1,0])
jhd_cr_2 = rs.MoveObject(rs.CopyObject(jhd_cr_1),(0,10 * x,0 ))
jhd_cr_2 = rs.RotateObject(jhd_cr_2, rs.CurveStartPoint(jhd_cr_2),-90,[0,0,1],copy=True)
jhd_cr_3 = rs.MoveObject(rs.CopyObject(jhd_cr_2),(12 * x,0,0 ))
jhd_cr_3 = rs.RotateObject(jhd_cr_3, rs.CurveStartPoint(jhd_cr_3),-90,[0,0,1],copy=True)
jhd_cr_4 = rs.MoveObject(rs.CopyObject(jhd_cr_1),(12 * x,0,0 ))
jhd_cr_4 = rs.RotateObject(jhd_cr_4, rs.CurveStartPoint(jhd_cr_4),90,[0,0,1],copy=True)
jhd_down_Brep = rs.AddLoftSrf([jhd_cr_1,jhd_cr_2,jhd_cr_3,jhd_cr_4],loft_type=2,closed=True)
rs.CapPlanarHoles(jhd_down_Brep)
#交互斗,平,厚2分
jhd_sr2 = rs.ExplodePolysurfaces(jhd_down_Brep)
jhd_sr2 = jhd_sr2[2]
JiaoHuDou_center_point = rs.SurfaceAreaCentroid(rs.ExplodePolysurfaces(jhd_down_Brep)[1])
JiaoHuDou_center_point = rs.AddPoint(JiaoHuDou_center_point[0])
jhd_mid_Brep = rs.ExtrudeSurface(jhd_sr2,rs.AddLine(rs.CurveEndPoint(jhd_cr_2),rs.MoveObject(rs.CurveEndPoint(jhd_cr_2),(0,0, 2* x))))
#交互斗,耳,厚3.5分
jhd_up_brep1 = rs.CopyObject(rs.CurveEndPoint(jhd_cr_1))
rs.MoveObject(jhd_up_brep1,(0,0,2 * x))
jhd_up_brep1 = rs.AddLine(jhd_up_brep1,rs.MoveObject(rs.CopyObject(jhd_up_brep1),(3 * x,0,0)))
jhd_up_brep1 = rs.ExtrudeCurve(jhd_up_brep1,rs.AddLine(jhd_pt_o,rs.MoveObject(rs.CopyObject(jhd_pt_o),(0, 2 * x,0))))
jhd_up_brep1 = rs.ExtrudeSurface(jhd_up_brep1,rs.AddLine(jhd_pt_o,rs.MoveObject(rs.CopyObject(jhd_pt_o),(0,0,4 * x))))
jhd_up_brep2 = rs.MirrorObject(jhd_up_brep1,JiaoHuDou_center_point,rs.MoveObject(rs.CopyObject(JiaoHuDou_center_point),(x,0,0)),copy=True)
jhd_up_brep3 = rs.MirrorObject(jhd_up_brep2,JiaoHuDou_center_point,rs.MoveObject(rs.CopyObject(JiaoHuDou_center_point),(0,x,0)),copy=True)
jhd_up_brep4 = rs.MirrorObject(jhd_up_brep3,JiaoHuDou_center_point,rs.MoveObject(rs.CopyObject(JiaoHuDou_center_point),(x,0,0)),copy=True)
jhd_up_brep5 = rs.ExplodePolysurfaces(jhd_up_brep1)[0]
jhd_up_brep5 = rs.CurveStartPoint(rs.DuplicateEdgeCurves(jhd_up_brep5)[2])

jhd_up_brep5 = rs.AddLine(jhd_up_brep5,rs.MoveObject(rs.CopyObject(jhd_up_brep5),(0,10 * x,0)))
jhd_up_brep5 = rs.ExtrudeCurve(jhd_up_brep5,rs.AddLine(rs.AddPoint(0,0,0),rs.AddPoint(-1.5 * x,0,0)))
jhd_up_brep5 = rs.ExtrudeSurface(jhd_up_brep5,rs.AddLine(rs.AddPoint(0,0,0),rs.AddPoint(0,0,2 * x)))
jhd_up_brep6 = rs.MirrorObject(jhd_up_brep5,JiaoHuDou_center_point,rs.MoveObject(rs.CopyObject(JiaoHuDou_center_point),(0,x,0)),copy=True)








JiaoHuDou = rs.BooleanDifference(jhd_mid_Brep,jhd_down_Brep,delete_input=False)
JiaoHuDou = rs.BooleanIntersection(JiaoHuDou,jhd_up_brep1,delete_input=False)
JiaoHuDou = rs.BooleanIntersection(JiaoHuDou,jhd_up_brep2,delete_input=False)
JiaoHuDou = rs.BooleanIntersection(JiaoHuDou,jhd_up_brep3,delete_input=False)
JiaoHuDou = rs.BooleanIntersection(JiaoHuDou,jhd_up_brep4,delete_input=False)
JiaoHuDou = rs.BooleanIntersection(jhd_up_brep5,JiaoHuDou,delete_input=False)
JiaoHuDou = rs.BooleanIntersection(jhd_up_brep6,JiaoHuDou,delete_input=False)

rs.MoveObject(JiaoHuDou,(-21 * x,j * x + (MianKuo-((MianKuo+1)/2+1)) * MianKuo_length * x - 2* x,252 * x+36 * x))








PuZuo_waiyan_g = [HuaGong[0],HuaGong_2[0],LuDou[0],SanDou_ndg_g[0],SanDou_ndg_g[1],aq_brep[0],aq_brep[1],ndg_brep[0],SanDou_g[0],SanDou_g[1]]

rs.MoveObjects(PuZuo_waiyan_g ,(0,j * x + (MianKuo-((MianKuo+1)/2+1)) * MianKuo_length * x,252 * x))

#第三层半驼峰
rs.MoveObject(btf_brep ,(0,j * x + (MianKuo-((MianKuo+1)/2+1)) * MianKuo_length * x,252 * x))


HuaGong_4 = rs.CopyObject(btf_brep)

btf_brep = rs.MoveObject(rs.CopyObject(btf_brep),(0,0,21 * x))
#进行剪切延长
btf_brep_trimed = rs.ExplodePolysurfaces(btf_brep)[11]
btf_brep_trimed = rs.CurveEndPoint(rs.DuplicateEdgeCurves(btf_brep_trimed)[2])

rs.MoveObject(btf_brep_trimed,(0,0,5 * x))

btf_brep_trimed = rs.AddLine(btf_brep_trimed,rs.MoveObject(rs.CopyObject(btf_brep_trimed),(0,-10 * x,0)))
btf_brep_trimed =rs.ExtrudeCurve(btf_brep_trimed ,rs.AddLine(rs.AddPoint(0,0,0),rs.AddPoint(-x,0,0)))
btf_brep_trimed =rs.ExtrudeSurface(btf_brep_trimed ,rs.AddLine(rs.AddPoint(0,0,0),rs.AddPoint(0,0,-25 * x)))
rs.MoveObject(btf_brep_trimed,(-2*x,0,0))
btf_brep_head = rs.BooleanIntersection(btf_brep_trimed,btf_brep,delete_input=False)[1]
btf_brep_head2 = rs.MirrorObject(btf_brep_head,ZhuTou_point,rs.MoveObject(rs.CopyObject(ZhuTou_point),(0,x,0)),copy=True)
btf_brep_mid = rs.BooleanIntersection(btf_brep_trimed,btf_brep,delete_input=False)[0]




rs.MoveObject(btf_brep_head,(-21 * x,0,0))
#头延长
btf_brep_head_1 = rs.ExplodePolysurfaces(btf_brep_head)[23]
btf_brep_head_1 = rs.ExtrudeSurface(btf_brep_head_1,rs.AddLine(rs.AddPoint(0,0,0),rs.AddPoint(22 * x,0,0)))


btf_brep_head = rs.BooleanDifference(btf_brep_head_1,btf_brep_head,delete_input=False)

btf_brep = rs.BooleanDifference(btf_brep_head,btf_brep_mid,delete_input=False)
btf_brep = rs.BooleanDifference(btf_brep,btf_brep_head2,delete_input=False)

#加上半驼峰

btf_brep_pt1 = rs.ExplodePolysurfaces(btf_brep)[92]
btf_brep_pt1 = rs.CurveEndPoint(rs.DuplicateEdgeCurves(btf_brep_pt1)[2])

btf_htz_trimed_brep2_pt1 = rs.CopyObject(btf_brep_pt1)
btf_htz_trimed_brep2_pt2 = rs.CopyObject(btf_htz_trimed_brep2_pt1)
rs.MoveObject(btf_htz_trimed_brep2_pt2,((16 + 15) * x ,0,0))
btf_htz_trimed_brep2_pt3 = rs.CopyObject(btf_htz_trimed_brep2_pt2)
rs.MoveObject(btf_htz_trimed_brep2_pt3,(0 ,0,7.5 * x))
btf_htz_trimed_brep2_pt4 = rs.CopyObject(btf_htz_trimed_brep2_pt3)
rs.MoveObject(btf_htz_trimed_brep2_pt4,(-7.5 * x ,0,0))
btf_htz_trimed_brep2_pt5 = rs.CopyObject(btf_htz_trimed_brep2_pt4)
rs.MoveObject(btf_htz_trimed_brep2_pt5,(-7.5 * x ,0,0))
btf_htz_trimed_brep2_pt6 = rs.CopyObject(btf_htz_trimed_brep2_pt5)
rs.MoveObject(btf_htz_trimed_brep2_pt6,(0 ,0,7.5 * x))
btf_htz_trimed_brep2_pt7 = rs.CopyObject(btf_htz_trimed_brep2_pt6)
rs.MoveObject(btf_htz_trimed_brep2_pt7,(-16 * x ,0,-15 * x))



btf_htz_trimed_brep2_cr1 = rs.AddLine(btf_htz_trimed_brep2_pt2,btf_htz_trimed_brep2_pt3)
btf_htz_trimed_brep2_cr2 = rs.AddLine(btf_htz_trimed_brep2_pt3,btf_htz_trimed_brep2_pt4)
btf_htz_trimed_brep2_cr3 = rs.AddLine(btf_htz_trimed_brep2_pt4,btf_htz_trimed_brep2_pt5)
btf_htz_trimed_brep2_cr4 = rs.AddLine(btf_htz_trimed_brep2_pt5,btf_htz_trimed_brep2_pt6)

btf_htz_trimed_brep2_cr6 = rs.AddFilletCurve(btf_htz_trimed_brep2_cr1,btf_htz_trimed_brep2_cr2,7.5 * x)
btf_htz_trimed_brep2_cr7 = rs.AddFilletCurve(btf_htz_trimed_brep2_cr3,btf_htz_trimed_brep2_cr4,7.5 * x)
btf_htz_trimed_brep2_cr8 = rs.AddPolyline([btf_htz_trimed_brep2_pt7,btf_htz_trimed_brep2_pt1,btf_htz_trimed_brep2_pt2])
btf_htz_trimed_brep2 = rs.JoinCurves([btf_htz_trimed_brep2_cr6,btf_htz_trimed_brep2_cr7,btf_htz_trimed_brep2_cr8])
btf_htz_trimed_brep2 = rs.JoinCurves([btf_htz_trimed_brep2,rs.AddLine(rs.CurveStartPoint(btf_htz_trimed_brep2),rs.CurveEndPoint(btf_htz_trimed_brep2))])
btf_htz_trimed_brep2 = rs.AddPlanarSrf(btf_htz_trimed_brep2)
btf_htz_trimed_brep2 = rs.ExtrudeSurface(btf_htz_trimed_brep2,(rs.AddLine(rs.AddPoint(0,0,0),rs.AddPoint(0,10 * x,0))))

btf_brep_1 = rs.CopyObject(btf_htz_trimed_brep2)

btf_neiyan = rs.MirrorObject(btf_brep_1,rs.MoveObject(rs.CopyObject(ZhuTou_point),(j*x/2,0,0)),rs.MoveObject(rs.CopyObject(ZhuTou_point),(j*x/2,x,0)),copy=True)

btf_brep = rs.BooleanDifference(btf_brep,btf_brep_1,delete_input=False)

#半驼峰第二跳华拱剪切

btf_brep = rs.BooleanUnion([HuaGong_2,btf_brep],delete_input=False)

btf_brep_neiyan = rs.CopyObject(btf_brep)
#第四跳华拱

huagong_4_head = rs.MoveObject(rs.CopyObject(btf_brep_head),(-21 * x,0,21 * x))
huagong_4_head_1 = rs.ExplodePolysurfaces(huagong_4_head)[8]
huagong_4_head_1 =rs.ExtrudeSurface(huagong_4_head_1,rs.AddLine(rs.AddPoint(0,0,0),rs.AddPoint(22 * x,0,0)))

huagong_4_mid =  rs.MoveObject(rs.CopyObject(btf_brep_mid),(0,0,21 * x))
huagong_4_head2 = rs.MoveObject(rs.CopyObject(btf_brep_head2),(21 * x,0,21 * x))

huagong_4_head = rs.BooleanDifference(huagong_4_head,huagong_4_head_1,delete_input=False)

HuaGong_4 = rs.BooleanDifference(huagong_4_head,huagong_4_mid,delete_input=False)

HuaGong_4 = rs.BooleanDifference(HuaGong_4 ,huagong_4_head2,delete_input=False)

HuaGong_4_neiyan = rs.CopyObject(HuaGong_4)



#昂生成

ang1_pt_o = rs.ExplodePolysurfaces(JiaoHuDou)[15]
ang1_pt_o = rs.CurveStartPoint(rs.DuplicateEdgeCurves(ang1_pt_o)[1])

ang1_pt1 = rs.MoveObject(rs.CopyObject(ang1_pt_o),(0,0,-14 * x))
ang1_pt2 = rs.MoveObject(rs.CopyObject(ang1_pt1),(-40.5 * x,0,0))
ang1_pt3 = rs.MoveObject(rs.CopyObject(ang1_pt2),(0,0,2 * x))
ang1_pt0 = rs.CopyObject(ang1_pt_o)
rs.MoveObject(ang1_pt0,(0,0,0 * x))
ang1_pt4 = rs.MoveObject(rs.CopyObject(ang1_pt0),(-18.75 * x,0,0))
ang1_pt5 = rs.MoveObject(rs.CopyObject(ang1_pt0),(200 * x,0,0))
ang1_pt6 = rs.MoveObject(rs.CopyObject(ang1_pt1),(200 * x,0,0))
ang1_cr1 = rs.AddPolyline([ang1_pt6,ang1_pt1,ang1_pt2,ang1_pt3])
rs.RotateObject(ang1_cr1,ang1_pt1,-24.08,[0,x,0],copy=False)
ang1_cr2 = rs.AddPolyline([rs.MoveObject(ang1_pt4,(-x,0,0)),ang1_pt0,ang1_pt5])
rs.RotateObject(ang1_cr2,ang1_pt0,-24.08,[0,x,0],copy=False)

ang1_untrimrd_brep = rs.JoinCurves([ang1_cr1,ang1_cr2,rs.AddLine(rs.CurveStartPoint(ang1_cr2),rs.CurveEndPoint(ang1_cr1)),rs.AddLine(rs.CurveStartPoint(ang1_cr1),rs.CurveEndPoint(ang1_cr2))])
ang1_untrimrd_brep = rs.AddPlanarSrf(ang1_untrimrd_brep)
ang1_untrimrd_brep_1 = rs.ExtrudeSurface(ang1_untrimrd_brep,rs.AddLine(rs.AddPoint(0,0,0),rs.AddPoint(0,10 * x,0)))
rs.RotateObject(ang1_untrimrd_brep_1,ang1_pt1,24.08,[0,x,0],copy=False)
rs.MoveObject(ang1_untrimrd_brep_1,(0,0,14 * x))
rs.RotateObject(ang1_untrimrd_brep_1,ang1_pt_o,-24.08,[0,x,0],copy=False)

#第二抄昂
ang2_brep = rs.MoveObject(rs.CopyObject(ang1_untrimrd_brep_1),(0,0,21 * x))
rs.RotateObject(ang2_brep,rs.MoveObject(rs.CopyObject(ang1_pt_o),(0,0,21 * x)),24.08,[0,x,0],copy=False)
rs.MoveObject(ang2_brep,(-21 * x,0,0))
rs.RotateObject(ang2_brep,rs.MoveObject(rs.CopyObject(ang1_pt_o),(0,0,21 * x)),-24.08,[0,x,0],copy=False)

ang1_up = rs.ExplodePolysurfaces(ang1_untrimrd_brep_1)[1:3]
ang1_up_1 = rs.ExtrudeSurface(ang1_up[0],rs.AddLine(rs.AddPoint(0,0,0),rs.AddPoint(0,0,8 * x)))
ang1_up_2 = rs.ExtrudeSurface(ang1_up[1],rs.AddLine(rs.AddPoint(0,0,0),rs.AddPoint(0,0,8 * x)))
ang1_up = rs.BooleanIntersection(ang1_up_1,ang1_up_2,delete_input = False)
rs.ScaleObject(ang1_up,rs.MoveObject(rs.CopyObject(ang1_pt_o),(0,5 * x,0)),[1,0.8,1],copy = False)

ang1_up_trimed = rs.MoveObject(rs.CopyObject(ang1_untrimrd_brep_1),(0,0,21 * x))

ang1_up = rs.BooleanUnion([ang1_up,ang1_up_trimed],delete_input = False)

ang1_brep = rs.BooleanDifference(ang1_up,ang1_untrimrd_brep_1,delete_input=False)

#泥道栱被一抄昂剪切

btf_brep = rs.BooleanDifference(ang1_brep,btf_brep,delete_input=False)[2]

#半驼峰上的插栓

btf_brep_cx = rs.CopyObject(gy_cx2_hg2)
rs.MoveObject(btf_brep_cx ,(0,j * x + (MianKuo-((MianKuo+1)/2+1)) * MianKuo_length * x,252 * x+21 * x))

btf_brep = rs.BooleanDifference(btf_brep_cx,btf_brep,delete_input=False)

#第四层影刻华拱被昂剪切

HuaGong_4yk = rs.BooleanDifference(ang1_brep,HuaGong_4,delete_input=False)[2]

#第一抄昂上的骑昂斗

#骑昂斗

x = CaiFen
#散斗,深12分,广10分,华拱/散斗.深10分,广12分,泥道栱
sd_zj_ang_pt_o = rs.AddPoint(0,0,0)
sd_zj_ang_pt2 = rs.AddPoint(12 * x,0,0)
sd_zj_ang_pt_z1 = rs.AddPoint(- 2 * x,0, 4 * x)
sd_zj_ang_cr_1 = rs.AddLine(sd_zj_ang_pt_o,sd_zj_ang_pt_z1)
#散斗,欹
sd_zj_ang_pt_z2 = rs.CurveMidPoint(sd_zj_ang_cr_1)
direction_left = (x, 0, 2 * x)  # 任意方向向量 
distance = 0.5 * x # 移动距离 
# 单位化方向向量并计算实际位移 
unit_vector_left = rs.VectorUnitize(direction_left)
displacement_left = rs.VectorScale(unit_vector_left, distance)
rs.MoveObject(sd_zj_ang_pt_z2, displacement_left)
sd_zj_ang_cr_1 = rs.AddCurve([sd_zj_ang_pt_o,sd_zj_ang_pt_z2,sd_zj_ang_pt_z1])
sd_zj_ang_pt_3 = rs.MoveObject(rs.CopyObject(sd_zj_ang_pt_o),(0,2 * x,0))
sd_zj_ang_sr1 = rs.AddLine(sd_zj_ang_pt_3,rs.MoveObject(rs.CopyObject(sd_zj_ang_pt_3),(-2 * x,-2 * x,0)))
sd_zj_ang_sr1 = rs.AddLoftSrf([sd_zj_ang_sr1,rs.MoveObject(rs.CopyObject(sd_zj_ang_sr1),(0,0,4* x))])
sd_zj_ang_cr_1 =rs.ProjectCurveToSurface(sd_zj_ang_cr_1,sd_zj_ang_sr1,[0,1,0])

sd_zj_ang_cr_2 = rs.CopyObject(sd_zj_ang_cr_1)
rs.MoveObject(sd_zj_ang_cr_2,(12 * x,0,0))
rs.RotateObject(sd_zj_ang_cr_2,rs.CurveStartPoint(sd_zj_ang_cr_2),90,[0,0,x])
sd_zj_ang_cr_3 = rs.AddLine(rs.CurveStartPoint(sd_zj_ang_cr_1),rs.CurveStartPoint(sd_zj_ang_cr_2))
sd_zj_ang_cr_2_1 = rs.JoinCurves([sd_zj_ang_cr_3,sd_zj_ang_cr_2])
rs.RotateObject(sd_zj_ang_cr_2_1,rs.CurveStartPoint(sd_zj_ang_cr_1),24.08,[0,x,0])
sd_zj_ang_cr_2 = rs.ExplodeCurves(sd_zj_ang_cr_2_1)[1]

rs.RotateObject(sd_zj_ang_cr_2,rs.CurveStartPoint(sd_zj_ang_cr_2),24.08                 ,[0,x,0])

sd_zj_ang_cr_3 = rs.CopyObject(sd_zj_ang_cr_1)
rs.MoveObject(sd_zj_ang_cr_3,(0,10 * x,0))
rs.RotateObject(sd_zj_ang_cr_3,rs.CurveStartPoint(sd_zj_ang_cr_3),-90,[0,0,x])
sd_zj_ang_cr_4 = rs.CopyObject(sd_zj_ang_cr_3)
rs.MoveObject(sd_zj_ang_cr_4,(12 * x,0,0))
rs.RotateObject(sd_zj_ang_cr_4,rs.CurveStartPoint(sd_zj_ang_cr_4),-90,[0,0,x])



sd_zj_ang_cr_5 = rs.AddLine(rs.CurveStartPoint(sd_zj_ang_cr_3),rs.CurveStartPoint(sd_zj_ang_cr_4))
sd_zj_ang_cr_4_1 = rs.JoinCurves([sd_zj_ang_cr_5,sd_zj_ang_cr_4])
rs.RotateObject(sd_zj_ang_cr_4_1,rs.CurveStartPoint(sd_zj_ang_cr_3),24.08,[0,x,0])
sd_zj_ang_cr_4 = rs.ExplodeCurves(sd_zj_ang_cr_4_1)[1]

rs.RotateObject(sd_zj_ang_cr_4,rs.CurveStartPoint(sd_zj_ang_cr_2),24.08                 ,[0,x,0])

sd_zj_ang_cr_5 = rs.AddLine(rs.CurveEndPoint(sd_zj_ang_cr_2),rs.CurveEndPoint(sd_zj_ang_cr_4))
sd_zj_ang_cr_6 =rs.AddLine(rs.CurveEndPoint(sd_zj_ang_cr_1),rs.CurveEndPoint(sd_zj_ang_cr_3))
sd_zj_ang_cr_7 = rs.AddLine(rs.CurveStartPoint(sd_zj_ang_cr_2),rs.CurveStartPoint(sd_zj_ang_cr_4))
sd_zj_ang_cr_8 =rs.AddLine(rs.CurveStartPoint(sd_zj_ang_cr_1),rs.CurveStartPoint(sd_zj_ang_cr_3))
sd_zj_ang_down = rs.AddLoftSrf([sd_zj_ang_cr_1,sd_zj_ang_cr_2,sd_zj_ang_cr_4,sd_zj_ang_cr_3],loft_type=2,closed=True)

sd_zj_ang_down_sr1 =rs.AddLoftSrf([sd_zj_ang_cr_5,sd_zj_ang_cr_6])
sd_zj_ang_down_sr2 =rs.AddLoftSrf([sd_zj_ang_cr_7,sd_zj_ang_cr_8])

sd_zj_ang_down =rs.JoinSurfaces([sd_zj_ang_down,sd_zj_ang_down_sr1,sd_zj_ang_down_sr2])

#散斗,平
sd_zj_ang_mid = rs.ExtrudeSurface(sd_zj_ang_down_sr1,rs.AddLine(rs.AddPoint(0,0,0),rs.AddPoint(0,0,4 * x)))

#散斗,耳
sd_zj_ang_up1 = rs.AddLine(rs.CurveEndPoint(sd_zj_ang_cr_1),rs.CurveEndPoint(sd_zj_ang_cr_2))
rs.MoveObject(sd_zj_ang_up1,(0,0,2 * x))
sd_zj_ang_up1 = rs.AddLoftSrf([sd_zj_ang_up1,rs.MoveObject(rs.CopyObject(sd_zj_ang_up1),(0,3 * x,0))])
sd_zj_ang_up1 = rs.ExtrudeSurface(sd_zj_ang_up1,rs.AddLine(rs.AddPoint(0,0,0),rs.AddPoint(0,0,4 * x)))

sd_zj_ang_up2 = rs.CopyObject(sd_zj_ang_up1)
rs.MoveObject(sd_zj_ang_up2,(0,11 * x,0))

QIAngDou_ang1_or = rs.BooleanUnion([sd_zj_ang_mid,sd_zj_ang_down,sd_zj_ang_up1,sd_zj_ang_up2], delete_input=False)

rs.RotateObject(QIAngDou_ang1_or,ZhuTou_point,180,[0,0,x],copy=False)

#投射骑昂斗

#一层下昂上的放射点

ang1_projecct_pt1 = rs.ExplodePolysurfaces(ang1_brep)[11]
ang1_projecct_pt1 = rs.CurveStartPoint(rs.DuplicateEdgeCurves(ang1_projecct_pt1)[2])

ang1_projecct_pt1_x = rs.MoveObject(rs.CopyObject(ang1_projecct_pt1),(1,0,0))
ang1_projecct_pt1_y = rs.MoveObject(rs.CopyObject(ang1_projecct_pt1),(0,1,0))

ang1_projecct_pt = [ang1_projecct_pt1,ang1_projecct_pt1_x,ang1_projecct_pt1_y]




ang1_projecct_pt1_x = rs.MoveObject(rs.CopyObject(ang1_projecct_pt1),(1,0,0))
ang1_projecct_pt1_y = rs.MoveObject(rs.CopyObject(ang1_projecct_pt1),(0,1,0))

ang1_projecct_pt = [ang1_projecct_pt1,ang1_projecct_pt1_x,ang1_projecct_pt1_y]

#起始点
QIAngDou_ang1_origin_pt1 = rs.ExplodePolysurfaces(QIAngDou_ang1_or )[3]
QIAngDou_ang1_origin_pt1 = rs.CurveEndPoint(rs.DuplicateEdgeCurves(QIAngDou_ang1_origin_pt1)[3])


QIAngDou_ang1_origin_pt1_x = rs.MoveObject(rs.CopyObject(QIAngDou_ang1_origin_pt1),(1,0,0))
QIAngDou_ang1_origin_pt1_y = rs.MoveObject(rs.CopyObject(QIAngDou_ang1_origin_pt1),(0,1,0))

QIAngDou_ang1_origin_pt = [QIAngDou_ang1_origin_pt1,QIAngDou_ang1_origin_pt1_x,QIAngDou_ang1_origin_pt1_y]

QIAngDou_ang1 = rs.OrientObject(rs.CopyObject(QIAngDou_ang1_or[0]),QIAngDou_ang1_origin_pt,ang1_projecct_pt)


#骑昂斗下的馒头榫剪切

mts_qad = rs.SurfaceAreaCentroid(rs.ExplodePolysurfaces(QIAngDou_ang1)[3])[0]
rs.MoveObject(mts_qad,(-2.75/2 * x,-2.75/2 * x,-2.75/2 * x))

mts_qad = rs.AddLine(mts_qad,rs.MoveObject(rs.CopyObject(mts_qad),(2.75 * x,0,0)))

mts_qad = rs.ExtrudeCurve(mts_qad,rs.AddLine(rs.AddPoint(0,0,0),rs.AddPoint(0,2.75 * x,0)))

mts_qad = rs.ExtrudeSurface(mts_qad,rs.AddLine(rs.AddPoint(0,0,0),rs.AddPoint(0,0,2.75 * x)))
#
QIAngDou_ang1 = rs.BooleanIntersection(mts_qad,QIAngDou_ang1,delete_input = True)

#下一层昂被骑昂斗剪切

ang1_brep = rs.BooleanUnion([QIAngDou_ang1,ang1_brep],delete_input = False)
ang2_brep = rs.BooleanDifference(ang2_brep,QIAngDou_ang1,delete_input = False)

#交互斗被第二跳华拱剪切
JiaoHuDou = rs.BooleanUnion([HuaGong_2,JiaoHuDou],delete_input=False)

#第二抄昂上的交互斗

JiaoHuDou_ang2 = rs.MoveObject(rs.CopyObject(JiaoHuDou),(-42 * x,0,21 * x))

#第二抄昂被交互斗剪切

ang2_brep = rs.BooleanIntersection(JiaoHuDou_ang2,ang2_brep,delete_input = False)[0]
ang2_brep_triemd = rs.ExplodePolysurfaces(JiaoHuDou_ang2)[31]

ang2_brep_triemd = rs.ExtrudeSurface(ang2_brep_triemd,rs.AddLine(rs.AddPoint(0,0,0),rs.AddPoint(0,0,5 * x)))

ang2_brep = rs.BooleanDifference(ang2_brep,ang2_brep_triemd,delete_input = False)

import rhinoscriptsyntax as rs
import Rhino.Geometry as rg
import itertools as it
x = CaiFen
#柱头点
ZhuTou_point = rs.AddPoint(HuaGong_CaiFen_left * x,5 *x,0)


#佛光寺大殿,瓜子拱,慢拱生成


if NiDaoGong_CaiFen_left !=  NiDaoGong_CaiFen_right:
    raise ValueError(f"两边必须一样长")

gzg_pt_o = rs.CopyObject(ZhuTou_point)
if (NiDaoGong_CaiFen_left > 25) & (NiDaoGong_CaiFen_right > 25):
    rs.MoveObject(gzg_pt_o,(0,(NiDaoGong_CaiFen_left - 2.5) * x,0))
else : raise ValueError(f"必须大于26分")

gzg_pt_z1 = rs.CopyObject(gzg_pt_o)
rs.MoveObject(gzg_pt_z1,(0,0,9 * x))
gzg_cr_z = rs.AddLine(gzg_pt_o,gzg_pt_z1)
gzg_pt_y1 = rs.CopyObject(gzg_pt_o)
rs.MoveObject(gzg_pt_y1 ,(0,-16 * x,0))
gzg_cr_y = rs.AddLine(gzg_pt_y1,gzg_pt_o)
div_cr_z =rs.DivideCurve(gzg_cr_z,5)
div_cr_y =rs.DivideCurve(gzg_cr_y,5)
#卷杀
CrossCurves_gzg = []
for i in range(len(div_cr_z)):
    divide_y = div_cr_y[i]
    divide_z = div_cr_z[i]
    CrossCurve_gzg = rs.AddLine(divide_y,divide_z)
    CrossCurves_gzg.append(CrossCurve_gzg)
CrossCurves_gzg = CrossCurves_gzg[1:len(CrossCurves_gzg)-1]
#选择交点
CrossCurves_points_gzg = []
for i in range(len(CrossCurves_gzg)):
    CrossCurves_point_gzg = rs.CurveCurveIntersection(CrossCurves_gzg[i],CrossCurves_gzg[i-1])[0][1]
    CrossCurves_points_gzg.append(CrossCurves_point_gzg)
CrossCurves_points_gzg = CrossCurves_points_gzg[1:len(CrossCurves_points_gzg)]
CrossCurves_points_gzg.insert(0,rs.CurveStartPoint(gzg_cr_y))
CrossCurves_points_gzg.insert(len(CrossCurves_points_gzg)+1,rs.CurveEndPoint(gzg_cr_z))
gzg_pt_z2 = rs.CopyObject(gzg_pt_z1)
rs.MoveObject(gzg_pt_z2,(0,0, 6 * x))
gzg_pt_z3 = rs.CopyObject(gzg_pt_z2)
rs.MoveObject(gzg_pt_z3,(0,-10 * x,0))
gzg_pt_y_1 = rs.CopyObject(ZhuTou_point)
rs.MoveObject(gzg_pt_y_1,(0,0,5 * x))
gzg_pt_y_2 = rs.CopyObject(gzg_pt_y_1)
rs.MoveObject(gzg_pt_y_2,(0,4 * x,0))
gzg_pt_y_3 = rs.CopyObject(gzg_pt_y_2)
rs.MoveObject(gzg_pt_y_3,(0,0,10 * x))
CrossCurves_points_gzg.append(gzg_pt_z2)
CrossCurves_points_gzg.append(gzg_pt_z3)
CrossCurves_points_gzg_right = rs.MirrorObjects(CrossCurves_points_gzg,ZhuTou_point,rs.MoveObject(rs.CopyObject(ZhuTou_point),(x,0,x)),copy=True)
rs.MoveObjects(CrossCurves_points_gzg_right,(0,(NiDaoGong_CaiFen_left - NiDaoGong_CaiFen_right) * x,0))
gzg_mid_pt1 = rs.CopyObject(ZhuTou_point)
gzg_mid_pt1 = rs.MoveObject(gzg_mid_pt1,(0,-4 * x,15 * x))
gzg_mid_pt4 = rs.CopyObject(ZhuTou_point)
gzg_mid_pt4 = rs.MoveObject(gzg_mid_pt4,(0,4 * x,15 * x))
gzg_mid_pt2 = rs.CopyObject(gzg_mid_pt1)
rs.MoveObject(gzg_mid_pt2,(0,0,-5 * x))
gzg_mid_pt3 = rs.CopyObject(gzg_mid_pt2)
rs.MoveObject(gzg_mid_pt3,(0,8 * x,0))
gzg_mid_pt5 = rs.CopyObject(gzg_mid_pt3)
rs.MoveObject(gzg_mid_pt5,(0,0,-10 * x))
gzg_mid_pt6 = rs.CopyObject(gzg_mid_pt2)
rs.MoveObject(gzg_mid_pt6,(0,0,-10 * x))
CrossCurves_points_gzg.insert(0,gzg_mid_pt5)
CrossCurves_points_gzg.insert(0,gzg_mid_pt3)
CrossCurves_points_gzg.insert(0,gzg_mid_pt2)
CrossCurves_points_gzg.insert(0,gzg_mid_pt6)
CrossCurves_points_gzg.insert(0,CrossCurves_points_gzg_right[0])
CrossCurves_points_gzg.insert(0,CrossCurves_points_gzg_right[1])
CrossCurves_points_gzg.insert(0,CrossCurves_points_gzg_right[2])
CrossCurves_points_gzg.insert(0,CrossCurves_points_gzg_right[3])
CrossCurves_points_gzg.insert(0,CrossCurves_points_gzg_right[4])
CrossCurves_points_gzg.insert(0,CrossCurves_points_gzg_right[5])
CrossCurves_points_gzg.insert(0,CrossCurves_points_gzg_right[6])
CrossCurves_points_gzg.insert(0,gzg_mid_pt1)
CrossCurves_points_gzg.insert(0,gzg_mid_pt4)
gzg_curve_left1 = rs.AddPolyline(CrossCurves_points_gzg)
gzg_curve_left1 = rs.JoinCurves([gzg_curve_left1,rs.AddLine(rs.CurveEndPoint(gzg_curve_left1),rs.CurveStartPoint(gzg_curve_left1))])
rs.MoveObject(gzg_curve_left1,(5 *x,0,0))
gzg_sr_left1 = rs.AddPlanarSrf(gzg_curve_left1)

gzg_brep = rs.ExtrudeSurface(gzg_sr_left1,rs.AddLine(rs.AddPoint(0,0,0),rs.AddPoint(-10 * x,0,0)))

# 拱眼
gzg_gyy_pt1 = rs.CopyObject(gzg_pt_z3)
rs.MoveObject(gzg_gyy_pt1,(-5 * x,0,x))
gzg_gyy_pt2 = rs.CopyObject(gzg_gyy_pt1)
rs.MoveObject(gzg_gyy_pt2,(0,0,-2 * x))
gzg_gyy_pt4 = rs.CopyObject(gzg_mid_pt4)
rs.MoveObject(gzg_gyy_pt4,(-5 * x, 1.625 * x,x))
gzg_gyy_pt3 = rs.CopyObject(gzg_gyy_pt4)
rs.MoveObject(gzg_gyy_pt3,(0,0,-2 * x))
gzg_gyy_cr1 = rs.AddLine(gzg_gyy_pt1,gzg_gyy_pt2)
gzg_gyy_cr2 = rs.AddLine(gzg_gyy_pt2,gzg_gyy_pt3)
gzg_gyy_cr3 = rs.AddLine(gzg_gyy_pt3,gzg_gyy_pt4)
gzg_gyy_cr1 = rs.AddFilletCurve(gzg_gyy_cr1,gzg_gyy_cr2,x)
gzg_gyy_cr2_1 = rs.AddFilletCurve(gzg_gyy_cr3,gzg_gyy_cr2,x)
gzg_gyy_cr3 = rs.AddLine(rs.CurveEndPoint(gzg_gyy_cr1),rs.CurveEndPoint(gzg_gyy_cr2_1))
gzg_gyy_cr4 = rs.AddLine(rs.CurveStartPoint(gzg_gyy_cr1),rs.MoveObject(rs.CopyObject(gzg_gyy_pt1),(0,0,x)))
gzg_gyy_cr5 = rs.AddLine(rs.CurveStartPoint(gzg_gyy_cr2_1),rs.MoveObject(rs.CopyObject(gzg_gyy_pt4),(0,0,x)))
gzg_gyy_1 =rs.JoinCurves([gzg_gyy_cr1,gzg_gyy_cr2_1,gzg_gyy_cr3,gzg_gyy_cr4,gzg_gyy_cr5])
gzg_gyy_1 =rs.JoinCurves([gzg_gyy_1,rs.AddLine(rs.CurveStartPoint(gzg_gyy_1),rs.CurveEndPoint(gzg_gyy_1))])
gzg_gyy_sr = rs.AddPlanarSrf(gzg_gyy_1)
rs.MoveObject(gzg_gyy_sr,(0,0,0))
gzg_gyy_1_1= rs.MoveObject(rs.CopyObject(gzg_gyy_1),(5 * x,0 , x))
rs.ScaleObject(gzg_gyy_1_1,rs.CurveMidPoint(gzg_gyy_cr2),[1,0.5,1])
gzg_gyy_1 =rs.AddLoftSrf([gzg_gyy_1,gzg_gyy_1_1])
gzg_gyy_2 =rs.MirrorObject(gzg_gyy_1,ZhuTou_point,rs.MoveObject(rs.CopyObject(ZhuTou_point),(x,0,0)),copy=True)
gzg_gyy_3 =rs.MirrorObject(gzg_gyy_1,ZhuTou_point,rs.MoveObject(rs.CopyObject(ZhuTou_point),(0,x,0)),copy=True)
gzg_gyy_4 =rs.MirrorObject(gzg_gyy_2,ZhuTou_point,rs.MoveObject(rs.CopyObject(ZhuTou_point),(0,x,0)),copy=True)
rs.CapPlanarHoles(gzg_gyy_1)
gzg_brep = rs.BooleanDifference(gzg_brep,gzg_gyy_1)
gzg_brep = rs.BooleanDifference(gzg_brep,gzg_gyy_2)
gzg_brep = rs.BooleanDifference(gzg_brep,gzg_gyy_3)
gzg_brep = rs.BooleanDifference(gzg_brep,gzg_gyy_4)

rs.MoveObject(gzg_brep ,(-47 * x,j * x + (MianKuo-((MianKuo+1)/2+1)) * MianKuo_length * x,252 * x +42 * x))

#瓜子拱剪切

gzg_trimed = rs.ExplodePolysurfaces(gzg_brep)[0]
gzg_trimed = rs.ExtrudeSurface(gzg_trimed,rs.AddLine(rs.AddPoint(0,0,0),rs.AddPoint(0,0,-5 * x)))
gzg_brep_1 = rs.BooleanDifference(gzg_brep,gzg_trimed,delete_input=False)[0]
gzg_brep_2 = rs.BooleanDifference(gzg_brep,gzg_trimed,delete_input=False)[1]
rs.MoveObject(gzg_trimed,(0,0,-10 * x))
gzg_brep = rs.BooleanUnion([gzg_brep_1,gzg_trimed,gzg_brep_2],delete_input=False)





#慢拱生成

if NiDaoGong_CaiFen_left !=  NiDaoGong_CaiFen_right:
    raise ValueError(f"两边必须一样长")

mg_pt_o = rs.CopyObject(ZhuTou_point)
if (NiDaoGong_CaiFen_left > 25) & (NiDaoGong_CaiFen_right > 25):
    rs.MoveObject(mg_pt_o,(0,(NiDaoGong_CaiFen_left + 22) * x,0))
else : raise ValueError(f"必须大于26分")

mg_pt_z1 = rs.CopyObject(mg_pt_o)
rs.MoveObject(mg_pt_z1,(0,0,9 * x))
mg_cr_z = rs.AddLine(mg_pt_o,mg_pt_z1)
mg_pt_y1 = rs.CopyObject(mg_pt_o)
rs.MoveObject(mg_pt_y1 ,(0,-12 * x,0))
mg_cr_y = rs.AddLine(mg_pt_y1,mg_pt_o)
div_cr_z =rs.DivideCurve(mg_cr_z,5)
div_cr_y =rs.DivideCurve(mg_cr_y,5)
#卷杀
CrossCurves_mg = []
for i in range(len(div_cr_z)):
    divide_y = div_cr_y[i]
    divide_z = div_cr_z[i]
    CrossCurve_mg = rs.AddLine(divide_y,divide_z)
    CrossCurves_mg.append(CrossCurve_mg)
CrossCurves_mg = CrossCurves_mg[1:len(CrossCurves_mg)-1]
#选择交点
CrossCurves_points_mg = []
for i in range(len(CrossCurves_mg)):
    CrossCurves_point_mg = rs.CurveCurveIntersection(CrossCurves_mg[i],CrossCurves_mg[i-1])[0][1]
    CrossCurves_points_mg.append(CrossCurves_point_mg)
CrossCurves_points_mg = CrossCurves_points_mg[1:len(CrossCurves_points_mg)]
CrossCurves_points_mg.insert(0,rs.CurveStartPoint(mg_cr_y))
CrossCurves_points_mg.insert(len(CrossCurves_points_mg)+1,rs.CurveEndPoint(mg_cr_z))
mg_pt_z2 = rs.CopyObject(mg_pt_z1)
rs.MoveObject(mg_pt_z2,(0,0, 6 * x))
mg_pt_z3 = rs.CopyObject(mg_pt_z2)
rs.MoveObject(mg_pt_z3,(0,-10 * x,0))
mg_pt_y_1 = rs.CopyObject(ZhuTou_point)
rs.MoveObject(mg_pt_y_1,(0,0,5 * x))
mg_pt_y_2 = rs.CopyObject(mg_pt_y_1)
rs.MoveObject(mg_pt_y_2,(0,4 * x,0))
mg_pt_y_3 = rs.CopyObject(mg_pt_y_2)
rs.MoveObject(mg_pt_y_3,(0,0,10 * x))
CrossCurves_points_mg.append(mg_pt_z2)
CrossCurves_points_mg.append(mg_pt_z3)
CrossCurves_points_mg_right = rs.MirrorObjects(CrossCurves_points_mg,ZhuTou_point,rs.MoveObject(rs.CopyObject(ZhuTou_point),(x,0,x)),copy=True)
rs.MoveObjects(CrossCurves_points_mg_right,(0,(NiDaoGong_CaiFen_left - NiDaoGong_CaiFen_right) * x,0))
mg_mid_pt1 = rs.CopyObject(ZhuTou_point)
mg_mid_pt1 = rs.MoveObject(mg_mid_pt1,(0,-4 * x,15 * x))
mg_mid_pt4 = rs.CopyObject(ZhuTou_point)
mg_mid_pt4 = rs.MoveObject(mg_mid_pt4,(0,4 * x,15 * x))
mg_mid_pt2 = rs.CopyObject(mg_mid_pt1)
rs.MoveObject(mg_mid_pt2,(0,0,-5 * x))
mg_mid_pt3 = rs.CopyObject(mg_mid_pt2)
rs.MoveObject(mg_mid_pt3,(0,8 * x,0))
mg_mid_pt5 = rs.CopyObject(mg_mid_pt3)
rs.MoveObject(mg_mid_pt5,(0,0,-10 * x))
mg_mid_pt6 = rs.CopyObject(mg_mid_pt2)
rs.MoveObject(mg_mid_pt6,(0,0,-10 * x))
CrossCurves_points_mg.insert(0,mg_mid_pt5)
CrossCurves_points_mg.insert(0,mg_mid_pt3)
CrossCurves_points_mg.insert(0,mg_mid_pt2)
CrossCurves_points_mg.insert(0,mg_mid_pt6)
CrossCurves_points_mg.insert(0,CrossCurves_points_mg_right[0])
CrossCurves_points_mg.insert(0,CrossCurves_points_mg_right[1])
CrossCurves_points_mg.insert(0,CrossCurves_points_mg_right[2])
CrossCurves_points_mg.insert(0,CrossCurves_points_mg_right[3])
CrossCurves_points_mg.insert(0,CrossCurves_points_mg_right[4])
CrossCurves_points_mg.insert(0,CrossCurves_points_mg_right[5])
CrossCurves_points_mg.insert(0,CrossCurves_points_mg_right[6])
CrossCurves_points_mg.insert(0,mg_mid_pt1)
CrossCurves_points_mg.insert(0,mg_mid_pt4)
mg_curve_left1 = rs.AddPolyline(CrossCurves_points_mg)
mg_curve_left1 = rs.JoinCurves([mg_curve_left1,rs.AddLine(rs.CurveEndPoint(mg_curve_left1),rs.CurveStartPoint(mg_curve_left1))])
rs.MoveObject(mg_curve_left1,(5 *x,0,0))
mg_sr_left1 = rs.AddPlanarSrf(mg_curve_left1)

mg_brep = rs.ExtrudeSurface(mg_sr_left1,rs.AddLine(rs.AddPoint(0,0,0),rs.AddPoint(-10 * x,0,0)))

# 拱眼
mg_gyy_pt1 = rs.CopyObject(mg_pt_z3)
rs.MoveObject(mg_gyy_pt1,(-5 * x,0,x))
mg_gyy_pt2 = rs.CopyObject(mg_gyy_pt1)
rs.MoveObject(mg_gyy_pt2,(0,0,-2 * x))
mg_gyy_pt4 = rs.CopyObject(mg_mid_pt4)
rs.MoveObject(mg_gyy_pt4,(-5 * x, 1.625 * x,x))
mg_gyy_pt3 = rs.CopyObject(mg_gyy_pt4)
rs.MoveObject(mg_gyy_pt3,(0,0,-2 * x))
mg_gyy_cr1 = rs.AddLine(mg_gyy_pt1,mg_gyy_pt2)
mg_gyy_cr2 = rs.AddLine(mg_gyy_pt2,mg_gyy_pt3)
mg_gyy_cr3 = rs.AddLine(mg_gyy_pt3,mg_gyy_pt4)
mg_gyy_cr1 = rs.AddFilletCurve(mg_gyy_cr1,mg_gyy_cr2,x)
mg_gyy_cr2_1 = rs.AddFilletCurve(mg_gyy_cr3,mg_gyy_cr2,x)
mg_gyy_cr3 = rs.AddLine(rs.CurveEndPoint(mg_gyy_cr1),rs.CurveEndPoint(mg_gyy_cr2_1))
mg_gyy_cr4 = rs.AddLine(rs.CurveStartPoint(mg_gyy_cr1),rs.MoveObject(rs.CopyObject(mg_gyy_pt1),(0,0,x)))
mg_gyy_cr5 = rs.AddLine(rs.CurveStartPoint(mg_gyy_cr2_1),rs.MoveObject(rs.CopyObject(mg_gyy_pt4),(0,0,x)))
mg_gyy_1 =rs.JoinCurves([mg_gyy_cr1,mg_gyy_cr2_1,mg_gyy_cr3,mg_gyy_cr4,mg_gyy_cr5])
mg_gyy_1 =rs.JoinCurves([mg_gyy_1,rs.AddLine(rs.CurveStartPoint(mg_gyy_1),rs.CurveEndPoint(mg_gyy_1))])
mg_gyy_sr = rs.AddPlanarSrf(mg_gyy_1)
rs.MoveObject(mg_gyy_sr,(0,0,0))
mg_gyy_1_1= rs.MoveObject(rs.CopyObject(mg_gyy_1),(5 * x,0 , x))
rs.ScaleObject(mg_gyy_1_1,rs.CurveMidPoint(mg_gyy_cr2),[1,0.8,1])
mg_gyy_1 =rs.AddLoftSrf([mg_gyy_1,mg_gyy_1_1])
mg_gyy_2 =rs.MirrorObject(mg_gyy_1,ZhuTou_point,rs.MoveObject(rs.CopyObject(ZhuTou_point),(x,0,0)),copy=True)
mg_gyy_3 =rs.MirrorObject(mg_gyy_1,ZhuTou_point,rs.MoveObject(rs.CopyObject(ZhuTou_point),(0,x,0)),copy=True)
mg_gyy_4 =rs.MirrorObject(mg_gyy_2,ZhuTou_point,rs.MoveObject(rs.CopyObject(ZhuTou_point),(0,x,0)),copy=True)
rs.CapPlanarHoles(mg_gyy_1)
mg_brep = rs.BooleanDifference(mg_brep,mg_gyy_1)
mg_brep = rs.BooleanDifference(mg_brep,mg_gyy_2)
mg_brep = rs.BooleanDifference(mg_brep,mg_gyy_3)
mg_brep = rs.BooleanDifference(mg_brep,mg_gyy_4)

#慢拱剪切


mg_brep_triemed = rs.ExplodePolysurfaces(mg_brep)[9]

mg_brep_triemed = rs.ExtrudeSurface(mg_brep_triemed,rs.AddLine(rs.AddPoint(0,0,0),rs.AddPoint(0,0,5 * x)))

mg_brep_1 = rs.BooleanDifference(mg_brep,mg_brep_triemed,delete_input=False)[1]
mg_brep_2 = rs.BooleanDifference(mg_brep,mg_brep_triemed,delete_input=False)[0]

rs.MoveObject(mg_brep_triemed,(0,0,-10 * x))

mg_brep = rs.BooleanUnion([mg_brep_1,mg_brep_triemed,mg_brep_2],delete_input=False)
rs.MoveObject(mg_brep ,(-47 * x,j * x + (MianKuo-((MianKuo+1)/2+1)) * MianKuo_length * x,252 * x +42 * x+21 * x))


#令拱生成

if NiDaoGong_CaiFen_left !=  NiDaoGong_CaiFen_right:
    raise ValueError(f"两边必须一样长")

lg_pt_o = rs.CopyObject(ZhuTou_point)
if (NiDaoGong_CaiFen_left > 25) & (NiDaoGong_CaiFen_right > 25):
    rs.MoveObject(lg_pt_o,(0,(NiDaoGong_CaiFen_left) * x,0))
else : raise ValueError(f"必须大于26分")

lg_pt_z1 = rs.CopyObject(lg_pt_o)
rs.MoveObject(lg_pt_z1,(0,0,9 * x))
lg_cr_z = rs.AddLine(lg_pt_o,lg_pt_z1)
lg_pt_y1 = rs.CopyObject(lg_pt_o)
rs.MoveObject(lg_pt_y1 ,(0,-20 * x,0))
lg_cr_y = rs.AddLine(lg_pt_y1,lg_pt_o)
div_cr_z =rs.DivideCurve(lg_cr_z,5)
div_cr_y =rs.DivideCurve(lg_cr_y,5)
#卷杀
CrossCurves_lg = []
for i in range(len(div_cr_z)):
    divide_y = div_cr_y[i]
    divide_z = div_cr_z[i]
    CrossCurve_lg = rs.AddLine(divide_y,divide_z)
    CrossCurves_lg.append(CrossCurve_lg)
CrossCurves_lg = CrossCurves_lg[1:len(CrossCurves_lg)-1]
#选择交点
CrossCurves_points_lg = []
for i in range(len(CrossCurves_lg)):
    CrossCurves_point_lg = rs.CurveCurveIntersection(CrossCurves_lg[i],CrossCurves_lg[i-1])[0][1]
    CrossCurves_points_lg.append(CrossCurves_point_lg)
CrossCurves_points_lg = CrossCurves_points_lg[1:len(CrossCurves_points_lg)]
CrossCurves_points_lg.insert(0,rs.CurveStartPoint(lg_cr_y))
CrossCurves_points_lg.insert(len(CrossCurves_points_lg)+1,rs.CurveEndPoint(lg_cr_z))
lg_pt_z2 = rs.CopyObject(lg_pt_z1)
rs.MoveObject(lg_pt_z2,(0,0, 6 * x))
lg_pt_z3 = rs.CopyObject(lg_pt_z2)
rs.MoveObject(lg_pt_z3,(0,-10 * x,0))
lg_pt_y_1 = rs.CopyObject(ZhuTou_point)
rs.MoveObject(lg_pt_y_1,(0,0,5 * x))
lg_pt_y_2 = rs.CopyObject(lg_pt_y_1)
rs.MoveObject(lg_pt_y_2,(0,4 * x,0))
lg_pt_y_3 = rs.CopyObject(lg_pt_y_2)
rs.MoveObject(lg_pt_y_3,(0,0,10 * x))
CrossCurves_points_lg.append(lg_pt_z2)
CrossCurves_points_lg.append(lg_pt_z3)
CrossCurves_points_lg_right = rs.MirrorObjects(CrossCurves_points_lg,ZhuTou_point,rs.MoveObject(rs.CopyObject(ZhuTou_point),(x,0,x)),copy=True)
rs.MoveObjects(CrossCurves_points_lg_right,(0,(NiDaoGong_CaiFen_left - NiDaoGong_CaiFen_right) * x,0))
lg_mid_pt1 = rs.CopyObject(ZhuTou_point)
lg_mid_pt1 = rs.MoveObject(lg_mid_pt1,(0,-4 * x,15 * x))
lg_mid_pt4 = rs.CopyObject(ZhuTou_point)
lg_mid_pt4 = rs.MoveObject(lg_mid_pt4,(0,4 * x,15 * x))
lg_mid_pt2 = rs.CopyObject(lg_mid_pt1)
rs.MoveObject(lg_mid_pt2,(0,0,-5 * x))
lg_mid_pt3 = rs.CopyObject(lg_mid_pt2)
rs.MoveObject(lg_mid_pt3,(0,8 * x,0))
lg_mid_pt5 = rs.CopyObject(lg_mid_pt3)
rs.MoveObject(lg_mid_pt5,(0,0,-10 * x))
lg_mid_pt6 = rs.CopyObject(lg_mid_pt2)
rs.MoveObject(lg_mid_pt6,(0,0,-10 * x))
CrossCurves_points_lg.insert(0,lg_mid_pt5)
CrossCurves_points_lg.insert(0,lg_mid_pt3)
CrossCurves_points_lg.insert(0,lg_mid_pt2)
CrossCurves_points_lg.insert(0,lg_mid_pt6)
CrossCurves_points_lg.insert(0,CrossCurves_points_lg_right[0])
CrossCurves_points_lg.insert(0,CrossCurves_points_lg_right[1])
CrossCurves_points_lg.insert(0,CrossCurves_points_lg_right[2])
CrossCurves_points_lg.insert(0,CrossCurves_points_lg_right[3])
CrossCurves_points_lg.insert(0,CrossCurves_points_lg_right[4])
CrossCurves_points_lg.insert(0,CrossCurves_points_lg_right[5])
CrossCurves_points_lg.insert(0,CrossCurves_points_lg_right[6])
CrossCurves_points_lg.insert(0,lg_mid_pt1)
CrossCurves_points_lg.insert(0,lg_mid_pt4)
lg_curve_left1 = rs.AddPolyline(CrossCurves_points_lg)
lg_curve_left1 = rs.JoinCurves([lg_curve_left1,rs.AddLine(rs.CurveEndPoint(lg_curve_left1),rs.CurveStartPoint(lg_curve_left1))])
rs.MoveObject(lg_curve_left1,(5 *x,0,0))
lg_sr_left1 = rs.AddPlanarSrf(lg_curve_left1)

lg_brep = rs.ExtrudeSurface(lg_sr_left1,rs.AddLine(rs.AddPoint(0,0,0),rs.AddPoint(-10 * x,0,0)))

# 拱眼
lg_gyy_pt1 = rs.CopyObject(lg_pt_z3)
rs.MoveObject(lg_gyy_pt1,(-5 * x,0,x))
lg_gyy_pt2 = rs.CopyObject(lg_gyy_pt1)
rs.MoveObject(lg_gyy_pt2,(0,0,-2 * x))
lg_gyy_pt4 = rs.CopyObject(lg_mid_pt4)
rs.MoveObject(lg_gyy_pt4,(-5 * x, 1.625 * x,x))
lg_gyy_pt3 = rs.CopyObject(lg_gyy_pt4)
rs.MoveObject(lg_gyy_pt3,(0,0,-2 * x))
lg_gyy_cr1 = rs.AddLine(lg_gyy_pt1,lg_gyy_pt2)
lg_gyy_cr2 = rs.AddLine(lg_gyy_pt2,lg_gyy_pt3)
lg_gyy_cr3 = rs.AddLine(lg_gyy_pt3,lg_gyy_pt4)
lg_gyy_cr1 = rs.AddFilletCurve(lg_gyy_cr1,lg_gyy_cr2,x)
lg_gyy_cr2_1 = rs.AddFilletCurve(lg_gyy_cr3,lg_gyy_cr2,x)
lg_gyy_cr3 = rs.AddLine(rs.CurveEndPoint(lg_gyy_cr1),rs.CurveEndPoint(lg_gyy_cr2_1))
lg_gyy_cr4 = rs.AddLine(rs.CurveStartPoint(lg_gyy_cr1),rs.MoveObject(rs.CopyObject(lg_gyy_pt1),(0,0,x)))
lg_gyy_cr5 = rs.AddLine(rs.CurveStartPoint(lg_gyy_cr2_1),rs.MoveObject(rs.CopyObject(lg_gyy_pt4),(0,0,x)))
lg_gyy_1 =rs.JoinCurves([lg_gyy_cr1,lg_gyy_cr2_1,lg_gyy_cr3,lg_gyy_cr4,lg_gyy_cr5])
lg_gyy_1 =rs.JoinCurves([lg_gyy_1,rs.AddLine(rs.CurveStartPoint(lg_gyy_1),rs.CurveEndPoint(lg_gyy_1))])
lg_gyy_sr = rs.AddPlanarSrf(lg_gyy_1)
rs.MoveObject(lg_gyy_sr,(0,0,0))
lg_gyy_1_1= rs.MoveObject(rs.CopyObject(lg_gyy_1),(5 * x,0 , x))
rs.ScaleObject(lg_gyy_1_1,rs.CurveMidPoint(lg_gyy_cr2),[1,0.5,1])
lg_gyy_1 =rs.AddLoftSrf([lg_gyy_1,lg_gyy_1_1])
lg_gyy_2 =rs.MirrorObject(lg_gyy_1,ZhuTou_point,rs.MoveObject(rs.CopyObject(ZhuTou_point),(x,0,0)),copy=True)
lg_gyy_3 =rs.MirrorObject(lg_gyy_1,ZhuTou_point,rs.MoveObject(rs.CopyObject(ZhuTou_point),(0,x,0)),copy=True)
lg_gyy_4 =rs.MirrorObject(lg_gyy_2,ZhuTou_point,rs.MoveObject(rs.CopyObject(ZhuTou_point),(0,x,0)),copy=True)
rs.CapPlanarHoles(lg_gyy_1)
lg_brep = rs.BooleanDifference(lg_brep,lg_gyy_1)
lg_brep = rs.BooleanDifference(lg_brep,lg_gyy_2)
lg_brep = rs.BooleanDifference(lg_brep,lg_gyy_3)
lg_brep = rs.BooleanDifference(lg_brep,lg_gyy_4)

rs.MoveObject(lg_brep ,(-89 * x,j * x + (MianKuo-((MianKuo+1)/2+1)) * MianKuo_length * x,252 * x +63* x))
#令拱剪切
lg_brep_trimed = rs.ExplodePolysurfaces(lg_brep)[0]
lg_trimed = rs.ExtrudeSurface(lg_brep_trimed,rs.AddLine(rs.AddPoint(0,0,0),rs.AddPoint(0,0,-5 * x)))
lg_brep_1 = rs.BooleanDifference(lg_brep,lg_trimed,delete_input=False)[0]
lg_brep_2 = rs.BooleanDifference(lg_brep,lg_trimed,delete_input=False)[1]
rs.MoveObject(lg_trimed,(0,0,-10 * x))
lg_brep = rs.BooleanUnion([lg_brep_1,lg_trimed,lg_brep_2],delete_input=False)
lg_brep_2 = rs.MirrorObject(lg_brep,ZhuTou_point,rs.MoveObject(rs.CopyObject(ZhuTou_point),(0,x,0)),copy=True)
rs.MoveObject(lg_brep_2,(-42 * x,0,0))





#瓜子拱上的散斗

SanDou_gzg1 = rs.MoveObject(rs.CopyObject(SanDou_ndg_left),(-(HuaGong_CaiFen_left +15 ) * x,-2.5 * x,42*x))
SanDou_gzg2 = rs.MoveObject(rs.CopyObject(SanDou_ndg_right),(-(HuaGong_CaiFen_left +15 ) * x,2.5 * x,42*x))
JiaoHuDou_gzg = rs.MoveObject(rs.CopyObject(JiaoHuDou),(0,0,21 * x))

#慢拱上的散斗
SanDou_mg1 = rs.MoveObject(rs.CopyObject(SanDou_ndg_left),(-(HuaGong_CaiFen_left +15 ) * x,22 * x,63*x))
SanDou_mg2 = rs.MoveObject(rs.CopyObject(SanDou_ndg_right),(-(HuaGong_CaiFen_left +15 ) * x,-22 * x,63*x))
SanDou_mg3 = rs.MoveObject(rs.CopyObject(SanDou_mg2 ),(0,(HuaGong_CaiFen_left +16.5 ) * x,0))


#令拱上的散斗

SanDou_lg1 = rs.MoveObject(rs.CopyObject(SanDou_ndg_left),(-(HuaGong_CaiFen_left +57 ) * x,0,63*x))
SanDou_lg2 = rs.MoveObject(rs.CopyObject(SanDou_ndg_right),(-(HuaGong_CaiFen_left +57 ) * x,0,63*x))

SanDou_lg3 = rs.MoveObject(rs.CopyObject(SanDou_lg2),(0,(HuaGong_CaiFen_left-5.5 ) * x,0))

SanDou_lg4 = rs.MirrorObject(SanDou_lg1,ZhuTou_point,rs.MoveObject(rs.CopyObject(ZhuTou_point),(0,x,0)),copy=True)
rs.MoveObject(SanDou_lg4,(-42 * x,0,0))

SanDou_lg5 = rs.MirrorObject(SanDou_lg2,ZhuTou_point,rs.MoveObject(rs.CopyObject(ZhuTou_point),(0,x,0)),copy=True)
rs.MoveObject(SanDou_lg5,(-42 * x,0,0))

#第四层影刻华拱上的散斗

SanDou_yk = rs.MoveObject(rs.CopyObject(SanDou_right),(42 * x,0,63 * x))

#半驼峰上的交斗
JiaoHuDou_btf =rs.MirrorObject(JiaoHuDou_ang2,ZhuTou_point,rs.MoveObject(rs.CopyObject(ZhuTou_point),(0,x,0)),copy=True)

rs.MoveObject(JiaoHuDou_btf,(-42 * x,0,0))
#第一抄昂被瓜拱剪切

ang1_brep = rs.BooleanUnion([gzg_brep,ang1_brep],delete_input=False)

#第一抄昂被第三层素枋剪切

ang1_brep = rs.BooleanUnion([rs.MoveObject(rs.CopyObject(ndg_brep),(0,0,63 * x)),ang1_brep],delete_input=False)
#第一抄昂被瓜子拱上的交互斗剪切


ang1_brep_trimed = rs.ExplodePolysurfaces(JiaoHuDou_gzg)[7]
ang1_brep_trimed = rs.DuplicateEdgeCurves(ang1_brep_trimed)[5]
ang1_brep_trimed = rs.ExtrudeCurve(ang1_brep_trimed,rs.AddLine(rs.AddPoint(0,0,0),rs.AddPoint(0,0,10 * x)))
ang1_brep_trimed = rs.ExtrudeSurface(ang1_brep_trimed,rs.AddLine(rs.AddPoint(0,0,0),rs.AddPoint(-18 * x,0,0)))

ang1_brep = rs.BooleanUnion([ang1_brep_trimed,ang1_brep],delete_input=False)
ang1_brep = rs.BooleanDifference(JiaoHuDou_gzg,ang1_brep,delete_input=False)

ang1_brep = rs.BooleanDifference(ang1_brep,rs.MoveObject(rs.CopyObject(ndg_brep),(47 * x,0,84 * x)),delete_input=False)

#第二抄昂被慢拱剪切

ang2_brep = rs.BooleanDifference(ang2_brep,mg_brep,delete_input=False)

#第二抄昂被第四层素枋剪切

ang2_brep = rs.BooleanDifference(ang2_brep,rs.MoveObject(rs.CopyObject(ndg_brep),(0,0,84 * x)),delete_input=False)

#第四层影刻华拱被交互斗剪切

HuaGong_4yk = rs.BooleanIntersection(HuaGong_4yk,JiaoHuDou_btf,delete_input=False)

#第四层影刻华拱被令拱剪切
HuaGong_4yk = rs.BooleanDifference(HuaGong_4yk,lg_brep_2,delete_input=False)

#耍头生成
#耍头起始点


st_pt_ang2 = rs.ExplodePolysurfaces(lg_brep)[0]
st_pt_ang2 = rs.CurveEndPoint(rs.DuplicateEdgeCurves(st_pt_ang2)[2])

#耍头
st_pt_0 =rs.CopyObject(st_pt_ang2)
st_pt_1 =rs.CopyObject(st_pt_0)
rs.MoveObject(st_pt_1,(-4 * x,0,0))
st_pt_2 =rs.CopyObject(st_pt_1)
rs.MoveObject(st_pt_2,(-12 * x,0,-3 * x))
st_pt_3 =rs.CopyObject(st_pt_2)
rs.MoveObject(st_pt_3,(0,0,-3 * x))
st_pt_4 =rs.CopyObject(st_pt_3)
rs.MoveObject(st_pt_4,(0,0,-9 * x))
st_pt_5 =rs.CopyObject(st_pt_0)
rs.MoveObject(st_pt_5,(-3 * x,0,-15 * x))
st_pt_6 =rs.CopyObject(st_pt_5)
rs.MoveObject(st_pt_6,(0,0,4 * x))
st_pt_7 =rs.CopyObject(st_pt_6)
rs.MoveObject(st_pt_7,(3 * x,0,0))
st_pt_8 =rs.CopyObject(st_pt_7)
rs.MoveObject(st_pt_8,(0,0,x))
st_pt_9 =rs.CopyObject(st_pt_8)
rs.MoveObject(st_pt_9,(15 * x,0,0))
st_pt_10 =rs.CopyObject(st_pt_9)
rs.MoveObject(st_pt_10,(0,0,-x))
st_pt_11 =rs.CopyObject(st_pt_10)
rs.MoveObject(st_pt_11,(3 * x,0,0))
st_pt_12 =rs.CopyObject(st_pt_11)
rs.MoveObject(st_pt_12,(0,0,-4 * x))
st_pt_13 =rs.CopyObject(st_pt_12)
rs.MoveObject(st_pt_13,(3 * x,0,0))
st_pt_15 =rs.CopyObject(st_pt_1)
rs.MoveObject(st_pt_15,(-6 * x,0,-3 * x))
st_cr_1 = rs.AddPolyline([st_pt_3,st_pt_2,st_pt_1,st_pt_0,rs.MoveObject(rs.CopyObject(st_pt_0),(50 * x,0,0)),st_pt_13])
st_cr_2 =rs.AddFilletCurve(rs.AddLine(st_pt_3,st_pt_4),rs.AddLine(st_pt_4,st_pt_5),9 * x,)
rs.ScaleObject(st_cr_2,st_pt_4,[rs.Distance(st_pt_4,st_pt_5)/(9 * x),1,1])
st_brep_untrimed = rs.JoinCurves([st_cr_1,st_cr_2])
st_brep_untrimed = rs.JoinCurves([st_brep_untrimed,rs.AddLine(rs.CurveStartPoint(st_brep_untrimed),rs.CurveEndPoint(st_brep_untrimed))])
st_brep_untrimed = rs.AddPlanarSrf(st_brep_untrimed)
st_brep_untrimed = rs.ExtrudeSurface(st_brep_untrimed,rs.AddLine(rs.AddPoint(0,0,0),rs.AddPoint(0,10 * x ,0)))
st_up1 = rs.AddCurve([st_pt_1,st_pt_15,st_pt_2])
st_up1 = rs.AddLoftSrf([st_up1,rs.MoveObject(rs.AddLine(st_pt_1,st_pt_2),(0,5 * x,0)),rs.MoveObject(rs.CopyObject(st_up1),(0,10 * x,0))],loft_type=2)
st_up1 =rs.ExtrudeSurface(st_up1,rs.AddLine(rs.AddPoint(0,0,0),rs.AddPoint(-2 * x,0,2 * x)))
st_brep = rs.BooleanDifference(st_up1 ,st_brep_untrimed ,delete_input = False)
rs.MoveObject(st_brep,(0,-9*x,10 * x))

#耍头被第二抄昂剪切

st_brep = rs.BooleanDifference(st_brep,ang2_brep,delete_input=False)[0]

#耍头被第二令拱剪切
st_brep = rs.BooleanDifference(st_brep,lg_brep,delete_input=False)

#耍头上的馒头榫
mts_st = rs.ExplodePolysurfaces(SanDou_lg3)[4]
mts_st = rs.ExtrudeSurface(mts_st,rs.AddLine(rs.AddPoint(0,0,0),rs.AddPoint(0,0,-3 * x)))

st_brep = rs.BooleanUnion([mts_st,st_brep],delete_input=False)

#佛光寺大殿,替木


if NiDaoGong_CaiFen_left !=  NiDaoGong_CaiFen_right:
    raise ValueError(f"两边必须一样长")

tm_pt_o = rs.CopyObject(ZhuTou_point)
if (NiDaoGong_CaiFen_left > 25) & (NiDaoGong_CaiFen_right > 25):
    rs.MoveObject(tm_pt_o,(0,(NiDaoGong_CaiFen_left + 20) * x,0))
else : raise ValueError(f"必须大于26分")

tm_pt_z1 = rs.CopyObject(tm_pt_o)
rs.MoveObject(tm_pt_z1,(0,0,4 * x))
tm_cr_z = rs.AddLine(tm_pt_o,tm_pt_z1)
tm_pt_y1 = rs.CopyObject(tm_pt_o)
rs.MoveObject(tm_pt_y1 ,(0,-12 * x,0))
tm_cr_y = rs.AddLine(tm_pt_y1,tm_pt_o)
div_cr_z =rs.DivideCurve(tm_cr_z,4)
div_cr_y =rs.DivideCurve(tm_cr_y,4)
#卷杀
CrossCurves_gzg = []
for i in range(len(div_cr_z)):
    divide_y = div_cr_y[i]
    divide_z = div_cr_z[i]
    CrossCurve_gzg = rs.AddLine(divide_y,divide_z)
    CrossCurves_gzg.append(CrossCurve_gzg)
CrossCurves_gzg = CrossCurves_gzg[1:len(CrossCurves_gzg)-1]
#选择交点
CrossCurves_points_gzg = []
for i in range(len(CrossCurves_gzg)):
    CrossCurves_point_gzg = rs.CurveCurveIntersection(CrossCurves_gzg[i],CrossCurves_gzg[i-1])[0][1]
    CrossCurves_points_gzg.append(CrossCurves_point_gzg)
CrossCurves_points_gzg = CrossCurves_points_gzg[1:len(CrossCurves_points_gzg)]
CrossCurves_points_gzg.insert(0,rs.CurveStartPoint(tm_cr_y))
CrossCurves_points_gzg.insert(len(CrossCurves_points_gzg)+1,rs.CurveEndPoint(tm_cr_z))
tm_pt_z2 = rs.CopyObject(tm_pt_z1)
rs.MoveObject(tm_pt_z2,(0,0, 4 * x))

CrossCurves_points_gzg.append(tm_pt_z2)
CrossCurves_points_tm_right = rs.MirrorObjects(CrossCurves_points_gzg,ZhuTou_point,rs.MoveObject(rs.CopyObject(ZhuTou_point),(x,0,x)),copy=True)
rs.MoveObjects(CrossCurves_points_tm_right,(0,(NiDaoGong_CaiFen_left - NiDaoGong_CaiFen_right) * x,0))

CrossCurves_points_gzg.insert(0,CrossCurves_points_tm_right[0])
CrossCurves_points_gzg.insert(0,CrossCurves_points_tm_right[1])
CrossCurves_points_gzg.insert(0,CrossCurves_points_tm_right[2])
CrossCurves_points_gzg.insert(0,CrossCurves_points_tm_right[3])
CrossCurves_points_gzg.insert(0,CrossCurves_points_tm_right[4])
tm_curve_left1 = rs.AddPolyline(CrossCurves_points_gzg)
tm_curve_left1 = rs.JoinCurves([tm_curve_left1,rs.AddLine(rs.CurveEndPoint(tm_curve_left1),rs.CurveStartPoint(tm_curve_left1))])
rs.MoveObject(tm_curve_left1,(5 *x,0,0))
tm_sr_left1 = rs.AddPlanarSrf(tm_curve_left1)

tm_brep = rs.ExtrudeSurface(tm_sr_left1,rs.AddLine(rs.AddPoint(0,0,0),rs.AddPoint(-10 * x,0,0)))

#替木修建

#挑檐椽
tyc_cr =  rs.AddCircle(ZhuTou_point,(17/2) * x)
rs.RotateObject(tyc_cr,ZhuTou_point,90,[x,0,0])
rs.MoveObject(tyc_cr,(0,(NiDaoGong_CaiFen_left + 20) * x,14.75 * x))
tyc_cr = rs.ExtrudeCurve(tyc_cr,rs.AddLine(rs.AddPoint(0,0,0),rs.AddPoint(0,-2 * (NiDaoGong_CaiFen_left + 20) * x,0)))
rs.CapPlanarHoles(tyc_cr)

tm_brep = rs.BooleanDifference(tm_brep,tyc_cr,delete_input=False)

rs.MoveObject(tm_brep,(-89* x,j * x + (MianKuo-((MianKuo+1)/2+1)) * MianKuo_length * x - 2* x,252 * x+84 * x))

#内檐斗拱


PuZuo_neiyan_g = rs.CopyObjects(PuZuo_waiyan_g)

#半驼峰内檐上的插栓
btf_brep_cx2 = rs.MirrorObject(btf_brep_cx,ZhuTou_point,rs.MoveObject(rs.CopyObject(ZhuTou_point),(0,x,0)),copy=True)
btf_brep_neiyan = rs.BooleanIntersection(btf_brep_cx,btf_brep_neiyan,delete_input=False)
btf_brep_neiyan = rs.BooleanIntersection(btf_brep_cx2,btf_brep_neiyan,delete_input=False)

#内檐第四跳华拱被半驼峰剪切

HuaGong_4_neiyan = rs.BooleanDifference(btf_brep_neiyan,HuaGong_4_neiyan,delete_input=False)



#内檐第二跳华拱上的散斗

SanDou_hg2_neiyan = rs.MoveObject(rs.CopyObject(SanDou_left),(-21 * x,0,21 * x))

PuZuo_neiyan_g.append(btf_brep_neiyan[0])

PuZuo_neiyan_g.append(rs.CopyObject(JiaoHuDou_btf))
PuZuo_neiyan_g.append(rs.CopyObject(SanDou_yk))
PuZuo_neiyan_g.append(rs.CopyObject(lg_brep_2))
PuZuo_neiyan_g.append(rs.CopyObject(SanDou_lg4))
PuZuo_neiyan_g.append(rs.CopyObject(SanDou_lg5))
PuZuo_neiyan_g.append(SanDou_hg2_neiyan)

rs.MirrorObjects(PuZuo_neiyan_g,rs.MoveObject(rs.CopyObject(ZhuTou_point),(j*x/2,0,0)),rs.MoveObject(rs.CopyObject(ZhuTou_point),(j*x/2,x,0)),copy=False)


#内檐半驼峰后的散斗

SanDou_btf_neiyan = rs.MoveObject(rs.CopyObject(SanDou_hg2_neiyan),(21 * x,0,21 * x))

#内檐第四跳华拱上的散斗
SanDou_hg4_neiyan = rs.MoveObject(rs.CopyObject(SanDou_btf_neiyan),(21 * x,0,21 * x))

PuZuo_neiyan_g.append(SanDou_btf_neiyan)
PuZuo_neiyan_g.append(SanDou_hg4_neiyan)


#第四跳华拱上的插销

HuaGong_4_neiyan_cx1 = rs.MirrorObject(btf_brep_cx,rs.MoveObject(rs.CopyObject(ZhuTou_point),(j*x/2,0,0)),rs.MoveObject(rs.CopyObject(ZhuTou_point),(j*x/2,x,0)),copy=True)
HuaGong_4_neiyan_cx2 = rs.MirrorObject(btf_brep_cx2,rs.MoveObject(rs.CopyObject(ZhuTou_point),(j*x/2,0,0)),rs.MoveObject(rs.CopyObject(ZhuTou_point),(j*x/2,x,0)),copy=True)
rs.MirrorObject(HuaGong_4_neiyan,rs.MoveObject(rs.CopyObject(ZhuTou_point),(j*x/2,0,0)),rs.MoveObject(rs.CopyObject(ZhuTou_point),(j*x/2,x,0)),copy=False)
rs.MoveObject(HuaGong_4_neiyan_cx1,(0,0,21 * x))
rs.MoveObject(HuaGong_4_neiyan_cx2,(21 * x,0,21 * x))

HuaGong_4_neiyan = rs.BooleanDifference(HuaGong_4_neiyan_cx2,HuaGong_4_neiyan,delete_input=False)
HuaGong_4_neiyan = rs.BooleanIntersection(HuaGong_4_neiyan,HuaGong_4_neiyan_cx1,delete_input=False)




PuZuo_neiyan_g.append(HuaGong_4_neiyan[0])

#内檐第五跳华拱
HuaGong_5_neiyan = rs.MoveObject(rs.CopyObject(HuaGong_4_neiyan),(0,0,21 * x))

HuaGong_5_neiyan_trimed = rs.ExplodePolysurfaces(HuaGong_5_neiyan)[19]

HuaGong_5_neiyan_trimed = rs.ExtrudeSurface(HuaGong_5_neiyan_trimed,rs.AddLine(rs.AddPoint(0,0,0),rs.AddPoint(0,0,25 * x)))
rs.MoveObject(HuaGong_5_neiyan_trimed,(-21 * x,0,0))
HuaGong_5_neiyan_trimed2 = rs.MirrorObject(HuaGong_5_neiyan_trimed,rs.MoveObject(rs.CopyObject(ZhuTou_point),(j*x,0,0)),rs.MoveObject(rs.CopyObject(ZhuTou_point),(j*x,x,0)),copy=True)


HuaGong_5_neiyan_mid = rs.BooleanDifference(HuaGong_5_neiyan_trimed,HuaGong_5_neiyan,delete_input=False)[1]
HuaGong_5_neiyan_mid = rs.BooleanIntersection(HuaGong_5_neiyan_trimed2,HuaGong_5_neiyan_mid,delete_input=False)[0]
HuaGong_5_neiyan_head1 = rs.ExplodePolysurfaces(HuaGong_5_neiyan_mid)[33]

HuaGong_5_neiyan_head1 = rs.ExtrudeSurface(HuaGong_5_neiyan_head1,rs.AddLine(rs.AddPoint(0,0,0),rs.AddPoint(87 * x,0,0)))
HuaGong_5_neiyan_head2 = rs.ExplodePolysurfaces(HuaGong_5_neiyan_mid)[42]

HuaGong_5_neiyan_head2 = rs.ExtrudeSurface(HuaGong_5_neiyan_head2,rs.AddLine(rs.AddPoint(0,0,0),rs.AddPoint(-22 * x,0,0)))

HuaGong_5_neiyan = rs.BooleanDifference(HuaGong_5_neiyan_head2,HuaGong_5_neiyan_mid,delete_input=False)

HuaGong_5_neiyan = rs.BooleanIntersection(HuaGong_5_neiyan_head1,HuaGong_5_neiyan,delete_input=False)

#第四层华拱被第四华拱剪切
HuaGong_5_neiyan = rs.BooleanDifference(HuaGong_4_neiyan,HuaGong_5_neiyan,delete_input=False)

#第层华拱上的插销
HuaGong_5_neiyan_cx1 = rs.MoveObject(rs.CopyObject(HuaGong_4_neiyan_cx2),(0,0,21 * x))

HuaGong_5_neiyan_cx2 = rs.MoveObject(rs.CopyObject(HuaGong_4_neiyan_cx1),(0,0,21 * x))

HuaGong_5_neiyan = rs.BooleanDifference(HuaGong_5_neiyan_cx1 ,HuaGong_5_neiyan,delete_input=False)
HuaGong_5_neiyan = rs.BooleanIntersection(HuaGong_5_neiyan,HuaGong_5_neiyan_cx2 ,delete_input=False)

#第六跳华拱半驼峰

rs.MoveObject(btf_neiyan,(-21 * x,0,63 * x))
rs.MirrorObject(btf_neiyan,rs.MoveObject(rs.CopyObject(ZhuTou_point),(j*x,0,0)),rs.MoveObject(rs.CopyObject(ZhuTou_point),(j*x,x,0)),copy=False)

btf_neiyan_tail = rs.MoveObject(rs.CopyObject(btf_brep_neiyan),(0,0,63 * x))

#填补尾

btf_neiyan_tail = rs.BooleanIntersection(btf_neiyan_tail,rs.MoveObject(rs.CopyObject(HuaGong_5_neiyan_cx1),(-21 * x,0,0)),delete_input=False)

btf_neiyan_tail = rs.BooleanIntersection(btf_neiyan_tail,rs.CopyObject(HuaGong_5_neiyan_cx2),delete_input=False)

#剪切
btf_neiyan_tail_trimed = rs.MoveObject(rs.CopyObject(HuaGong_5_neiyan_trimed),(-64 * x,0,21 * x))

btf_neiyan_tail = rs.BooleanDifference(btf_neiyan_tail_trimed,btf_neiyan_tail,delete_input=False)[1]

#链接后端半驼峰

btf_neiyan2 = rs.BooleanUnion([btf_neiyan_tail,btf_neiyan],delete_input=False)

#半驼峰上边剪切

btf_neiyan_trimed = rs.MoveObject(rs.CopyObject(btf_neiyan_tail_trimed),(41 * x,0,15 * x))
#缩放点

btf_neiyan_trimed_pt = rs.ExplodePolysurfaces(btf_neiyan_trimed)[0]
btf_neiyan_trimed_pt = rs.CurveEndPoint(rs.DuplicateEdgeCurves(btf_neiyan_trimed_pt)[0])

rs.ScaleObject(btf_neiyan_trimed,btf_neiyan_trimed_pt,[3,1,3],copy=False)

btf_neiyan2 = rs.BooleanIntersection(btf_neiyan2,btf_neiyan_trimed,delete_input=False)

#内檐第七跳华拱

HuaGong_7_neiyan = rs.MoveObject(rs.CopyObject(HuaGong_4_neiyan),(0,0,63 * x))

HuaGong_7_neiyan = rs.BooleanDifference(btf_neiyan_trimed,HuaGong_7_neiyan,delete_input=False)[0]


#内檐第七跳华拱上的令拱

lg2_neiyan = rs.MirrorObject(lg_brep,rs.MoveObject(rs.CopyObject(ZhuTou_point),(j*x/2,0,0)),rs.MoveObject(rs.CopyObject(ZhuTou_point),(j*x/2,x,0)),copy=True)

rs.MoveObject(lg2_neiyan,(-21 * x,0,63 * x))

#内檐第七跳华拱上的令拱上的散斗

Sandou1_lg_neiyan = rs.MirrorObject(SanDou_lg1,rs.MoveObject(rs.CopyObject(ZhuTou_point),(j*x/2,0,0)),rs.MoveObject(rs.CopyObject(ZhuTou_point),(j*x/2,x,0)),copy=True)

rs.MoveObject(Sandou1_lg_neiyan,(-21 * x,0,63 * x))

Sandou2_lg_neiyan = rs.MirrorObject(SanDou_lg2,rs.MoveObject(rs.CopyObject(ZhuTou_point),(j*x/2,0,0)),rs.MoveObject(rs.CopyObject(ZhuTou_point),(j*x/2,x,0)),copy=True)

rs.MoveObject(Sandou2_lg_neiyan,(-21 * x,0,63 * x))

#内檐第七跳华拱上的散斗

Sandou_hg7_neiyan = rs.MoveObject(rs.CopyObject(SanDou_hg4_neiyan),(0,0,63 * x))

#第七跳华拱被被令拱剪切

HuaGong_7_neiyan = rs.BooleanDifference(HuaGong_7_neiyan,lg2_neiyan,delete_input=False)



#内月梁生成

#第二跳转角铺作华拱的月梁生成


yl_pt1 = rs.ExplodePolysurfaces(HuaGong_5_neiyan)[21]
yl_pt1 = rs.CurveEndPoint(rs.DuplicateEdgeCurves(yl_pt1)[2])


yl_pt2 = rs.CopyObject(yl_pt1)
rs.MoveObject(yl_pt2,(0,-6.875 * x,0))

yl_pt3 = rs.CopyObject(yl_pt2)
rs.MoveObject(yl_pt3,(40 * x,0,0))

yl_pt_y = rs.DivideCurve(rs.AddLine(yl_pt2,yl_pt1),5)
yl_pt_x = rs.DivideCurve(rs.AddLine(yl_pt3,yl_pt2),5)

#月梁卷杀
yl_cross_crs = []
for i in range(len(yl_pt_y)):
    yl_cross_cr = rs.AddLine(yl_pt_y[i],yl_pt_x[i])
    yl_cross_crs.append(yl_cross_cr)

yl_cross_crs = yl_cross_crs[1:len(yl_cross_crs)-1]

yl_cross_pts = []
for i in range(len(yl_cross_crs)):
    if i+1 < len(yl_cross_crs):
        yl_cross_pt = rs.CurveCurveIntersection(yl_cross_crs[i],yl_cross_crs[i+1])
        yl_cross_pts.append(yl_cross_pt[0][1])
yl_cross_pts.append(yl_pt1)
yl_cross_pts.insert(0,yl_pt3)

yl_curve = rs.AddPolyline(yl_cross_pts)

yl_curve_2 = rs.MirrorObject(yl_curve,rs.MoveObject(rs.CopyObject(yl_pt1),(0,5 * x,0)),rs.MoveObject(rs.CopyObject(yl_pt1),(x,5 * x,0)),copy=True)

yl_curve = rs.JoinCurves([yl_curve,yl_curve_2,rs.AddLine(rs.CurveEndPoint(yl_curve),rs.CurveEndPoint(yl_curve_2))])

yl_curve2 = rs.MirrorObject(yl_curve,rs.MoveObject(rs.CopyObject(ZhuTou_point),(2*j * x,0,0)),rs.MoveObject(rs.CopyObject(ZhuTou_point),(2*j * x,x,0)),copy=True)
yl_curve = rs.JoinCurves([yl_curve,yl_curve2,rs.AddLine(rs.CurveStartPoint(yl_curve),rs.CurveStartPoint(yl_curve2)),rs.AddLine(rs.CurveEndPoint(yl_curve),rs.CurveEndPoint(yl_curve2))])

rs.MoveObject(yl_curve,(0,0,3.5 * x))
yl_curve2 = rs.MoveObject(rs.CopyObject(yl_curve),(0,0,23 * x))

rs.ScaleObject(yl_curve2,rs.MoveObject(rs.CopyObject(ZhuTou_point),(2 * j * x,0,0)),[1.2,1,1],copy=False)

YueLiang_neiyan = rs.AddLoftSrf([yl_curve,yl_curve2])

rs.CapPlanarHoles(YueLiang_neiyan)

#月梁卷杀2剪切
yl_pt4 = rs.CopyObject(yl_pt1)

yl_pt5 = rs.CopyObject(yl_pt4)
rs.MoveObject(yl_pt5,(0,0,6.5 * x))
yl_pt6 = rs.CopyObject(yl_pt5)
rs.MoveObject(yl_pt6,(14 * x,0,0))

yl_pt_y2 = rs.DivideCurve(rs.AddLine(yl_pt5,yl_pt4),5)
yl_pt_x2 = rs.DivideCurve(rs.AddLine(yl_pt6,yl_pt5),5)
yl_cross_crs2 = []

for i in range(len(yl_pt_y2)):
    yl_cross_cr = rs.AddLine(yl_pt_y2[i],yl_pt_x2[i])
    yl_cross_crs2.append(yl_cross_cr)

yl_cross_crs2 = yl_cross_crs2[1:len(yl_cross_crs2)-1]

yl_cross_pts2 = []
for i in range(len(yl_cross_crs2)):
    if i + 1 < len(yl_cross_crs2):
        yl_cross_pt = rs.CurveCurveIntersection(yl_cross_crs2[i],yl_cross_crs2[i+1])
        yl_cross_pts2.append(yl_cross_pt[0][1])

yl_cross_pts2.insert(0,yl_pt6)
yl_cross_pts2.append(yl_pt4)

yl_curve_up = rs.AddPolyline(yl_cross_pts2)

rs.MoveObject(yl_curve_up ,(0,-10 * x,3.5 * x))

yl_curve_up2 = rs.MoveObject(rs.CopyObject(yl_curve_up),(-17 * x,0,16.5* x))

yl_curve_up_2 = rs.MirrorObject(yl_curve_up,rs.MoveObject(rs.CopyObject(ZhuTou_point),(2*j * x,0,0)),rs.MoveObject(rs.CopyObject(ZhuTou_point),(2*j * x,x,0)),copy=True)


yl_curve_up = rs.JoinCurves([yl_curve_up,yl_curve_up_2,rs.AddLine(rs.CurveStartPoint(yl_curve_up),rs.CurveStartPoint(yl_curve_up_2))])



yl_curve_up2_2 = rs.MirrorObject(yl_curve_up2,rs.MoveObject(rs.CopyObject(ZhuTou_point),(2*j * x,0,0)),rs.MoveObject(rs.CopyObject(ZhuTou_point),(2*j * x,x,0)),copy=True)


yl_curve_up2 = rs.JoinCurves([yl_curve_up2,yl_curve_up2_2,rs.AddLine(rs.CurveStartPoint(yl_curve_up2),rs.CurveStartPoint(yl_curve_up2_2))])



yl_trimed1 = rs.ExtrudeCurve(yl_curve_up,rs.AddLine(rs.AddPoint(0,0,0),rs.AddPoint(0,40 * x,0)))

yl_trimed1 = rs.ExtrudeSurface(yl_trimed1,rs.AddLine(rs.AddPoint(0,0,0),rs.AddPoint(0,0,-20 * x)))

rs.ScaleObject(yl_trimed1,rs.MoveObject(rs.CopyObject(yl_pt1),(0,0,3.5 * x)),[1,1,0.5],copy=False)

yl_trimed2 = rs.ExtrudeCurve(yl_curve_up2,rs.AddLine(rs.AddPoint(0,0,0),rs.AddPoint(0,40 * x,0)))

yl_trimed2 = rs.ExtrudeSurface(yl_trimed2,rs.AddLine(rs.AddPoint(0,0,0),rs.AddPoint(0,0,20 * x)))

YueLiang_neiyan = rs.BooleanDifference(YueLiang_neiyan,yl_trimed1,delete_input = True)

YueLiang_neiyan = rs.BooleanIntersection(yl_trimed2,YueLiang_neiyan,delete_input = True)[2]

#月梁被半驼峰和第五层华拱剪切

YueLiang_neiyan = rs.BooleanDifference(YueLiang_neiyan,btf_neiyan2,delete_input=False)

YueLiang_neiyan = rs.BooleanDifference(YueLiang_neiyan,rs.MirrorObject(btf_neiyan2,rs.MoveObject(rs.CopyObject(ZhuTou_point),(2*j * x,0,0)),rs.MoveObject(rs.CopyObject(ZhuTou_point),(2*j * x,x,0)),copy=True),delete_input=False)

YueLiang_neiyan = rs.BooleanIntersection(HuaGong_5_neiyan,YueLiang_neiyan,delete_input=False)

YueLiang_neiyan = rs.BooleanIntersection(rs.MirrorObject(HuaGong_5_neiyan,rs.MoveObject(rs.CopyObject(ZhuTou_point),(2*j * x,0,0)),rs.MoveObject(rs.CopyObject(ZhuTou_point),(2*j * x,x,0)),copy=True),YueLiang_neiyan,delete_input=False)


#半驼峰上的交互斗

JiaoHuDou_btf2_neiyan = rs.MirrorObject(JiaoHuDou_btf,rs.MoveObject(rs.CopyObject(ZhuTou_point),(j*x/2,0,0)),rs.MoveObject(rs.CopyObject(ZhuTou_point),(j*x/2,x,0)),copy=True)

rs.MirrorObject(JiaoHuDou_btf2_neiyan,rs.MoveObject(rs.CopyObject(ZhuTou_point),(j*x,0,0)),rs.MoveObject(rs.CopyObject(ZhuTou_point),(j*x,x,0)),copy=False)
rs.MoveObject(JiaoHuDou_btf2_neiyan,(21 * x,0,63 * x))


#交互斗被第一层昂剪切
JiaoHuDou = rs.BooleanUnion([JiaoHuDou,ang1_brep],delete_input=False)

#第二抄昂被剪切
ang2_brep_trimed = rs.MoveObject(rs.CopyObject(ndg_brep),(0,0,99 * x))
rs.ScaleObject(ang2_brep_trimed,ZhuTou_point,[0.8,1,1],copy=False)

ang2_brep = rs.BooleanDifference(ang2_brep,ang2_brep_trimed,delete_input=False)

#平棋枋生成

pqf_brep = rs.MoveObject(rs.CopyObject(ZhuTou_point),(j * x,-5 * x,0))
pqf_brep = rs.AddLine(pqf_brep,rs.MoveObject(rs.CopyObject(pqf_brep),(-j*x - 15*x,0,0)))
pqf_brep = rs.AddLoftSrf([pqf_brep,rs.MoveObject(rs.CopyObject(pqf_brep),(0,10 * x,0))])
pqf_brep = rs.ExtrudeSurface(pqf_brep,rs.AddLine(rs.AddPoint(0,0,0),rs.AddPoint(0,0,15 * x)))

rs.MoveObject(pqf_brep,(0,j * x + (MianKuo-((MianKuo+1)/2+1)) * 16 * 15 * x,252 * x +120 * x))


#昂被平棋枋剪切

ang2_brep = rs.BooleanIntersection(pqf_brep,ang2_brep,delete_input=False)[0]
ang1_brep = rs.BooleanIntersection(pqf_brep,ang1_brep,delete_input=False)[0]



#整合

PuZuo_waiyan_g.append(btf_brep[0])
PuZuo_waiyan_g.append(JiaoHuDou[0])
PuZuo_waiyan_g.append(HuaGong_4yk[0])
PuZuo_waiyan_g.append(ang1_brep)
PuZuo_waiyan_g.append(ang2_brep)
PuZuo_waiyan_g.append(QIAngDou_ang1[0])
PuZuo_waiyan_g.append(gzg_brep[0])
PuZuo_waiyan_g.append(JiaoHuDou_ang2)
PuZuo_waiyan_g.append(mg_brep[0])
PuZuo_waiyan_g.append(lg_brep[0])
PuZuo_waiyan_g.append(lg_brep_2)
PuZuo_waiyan_g.append(SanDou_gzg1)
PuZuo_waiyan_g.append(SanDou_gzg2)
PuZuo_waiyan_g.append(JiaoHuDou_gzg)
PuZuo_waiyan_g.append(SanDou_mg1)
PuZuo_waiyan_g.append(SanDou_mg2)
PuZuo_waiyan_g.append(SanDou_mg3)
PuZuo_waiyan_g.append(SanDou_lg1)
PuZuo_waiyan_g.append(SanDou_lg2)
PuZuo_waiyan_g.append(SanDou_lg3)
PuZuo_waiyan_g.append(SanDou_lg4)
PuZuo_waiyan_g.append(SanDou_lg5)
PuZuo_waiyan_g.append(SanDou_yk)
PuZuo_waiyan_g.append(JiaoHuDou_btf)
PuZuo_waiyan_g.append(st_brep[0])
PuZuo_waiyan_g.append(tm_brep[0])

PuZuo_waiyan_g_jinshen = rs.MoveObjects(rs.CopyObjects(PuZuo_waiyan_g),(0,-(j * x + (MianKuo-((MianKuo+1)/2+1)) * MianKuo_length * x),0))

rs.RotateObjects(PuZuo_waiyan_g_jinshen,ZhuTou_point,90,[0,0,x],copy=False)

rs.MoveObjects(PuZuo_waiyan_g_jinshen,(j*x,0,7.5 * x))


PuZuo_neiyan_g.append(HuaGong_5_neiyan[0])
PuZuo_neiyan_g.append(btf_neiyan2[0])
PuZuo_neiyan_g.append(HuaGong_7_neiyan[0])
PuZuo_neiyan_g.append(lg2_neiyan)
PuZuo_neiyan_g.append(Sandou1_lg_neiyan)
PuZuo_neiyan_g.append(Sandou2_lg_neiyan)
PuZuo_neiyan_g.append(Sandou_hg7_neiyan)
PuZuo_neiyan_g.append(JiaoHuDou_btf2_neiyan)

PuZuo_neiyan_g_jinshen = rs.MoveObjects(rs.CopyObjects(PuZuo_neiyan_g),(0,-((MianKuo-((MianKuo+1)/2+1)) * MianKuo_length * x),0))

rs.RotateObjects(PuZuo_neiyan_g_jinshen,rs.MoveObject(rs.CopyObject(ZhuTou_point),(j * x, j * x,0)),90,[0,0,x],copy=False)

rs.MoveObjects(PuZuo_neiyan_g_jinshen,(j*x,0,2.5 * x))

PuZuo_waiyan_g_qianyan = PuZuo_waiyan_g

sq_rule = [0,0,0,0,0,0,0,0,0,0,0,0,0,0,0,0,0,0,0,0,2.5,6]
for i in range(int((MianKuo - 3)/2)+1):
    if i + 1 < len(range(int((MianKuo - 3)/2)+1)):
        PuZuo_weiyan1 = rs.MoveObjects(rs.CopyObjects(PuZuo_waiyan_g),(0,-(MianKuo_length * (i+1)) * x,sq_rule[-(int((MianKuo - 3)/2-i))] * x))
        PuZuo_waiyan_g_qianyan = PuZuo_waiyan_g_qianyan + PuZuo_weiyan1

PuZuo_waiyan_g_qianyan_left  = rs.MirrorObjects(PuZuo_waiyan_g_qianyan,rs.MoveObject(rs.CopyObject(ZhuTou_point),(0,(MianKuo_length * (MianKuo - 2) * x + 2 * j * x)/2 ,0)),rs.MoveObject(rs.CopyObject(ZhuTou_point),(x,(MianKuo_length * (MianKuo - 2) * x + 2 * j * x)/2 ,0)),copy=True)

PuZuo_waiyan_g_qianyan_left = PuZuo_waiyan_g_qianyan_left[::-1]

PuZuo_waiyan_g = PuZuo_waiyan_g_qianyan_left + PuZuo_waiyan_g_qianyan

PuZuo_waiyan_g_houyan = rs.MirrorObjects(PuZuo_waiyan_g,rs.MoveObject(rs.CopyObject(ZhuTou_point),(4 * j/2 * x,0,0)),rs.MoveObject(rs.CopyObject(ZhuTou_point),(4 * j/2 * x,x,0)),copy=True)


PuZuo_waiyan_g = PuZuo_waiyan_g + PuZuo_waiyan_g_houyan 


#内檐投射
PuZuo_neiyan_g_qianyan = PuZuo_neiyan_g

sq_rule = [0,0,0,0,0,0,0,0,0,0,0,0,0,0,0,0,0,0,0,0,2.5,5]
for i in range(int((MianKuo - 3)/2)+1):
    if i + 1 < len(range(int((MianKuo - 3)/2))):
        PuZuo_neiyan1 = rs.MoveObjects(rs.CopyObjects(PuZuo_neiyan_g),(0,-(MianKuo_length * (i+1)) * x,sq_rule[-(int((MianKuo - 3)/2-i))] * x))
        PuZuo_neiyan_g_qianyan = PuZuo_neiyan_g_qianyan + PuZuo_neiyan1


PuZuo_neiyan_g_qianyan_left  = rs.MirrorObjects(PuZuo_neiyan_g_qianyan,rs.MoveObject(rs.CopyObject(ZhuTou_point),(0,(MianKuo_length * (MianKuo - 2) * x + 2 * j * x)/2 ,0)),rs.MoveObject(rs.CopyObject(ZhuTou_point),(x,(MianKuo_length * (MianKuo - 2) * x + 2 * j * x)/2 ,0)),copy=True)

PuZuo_neiyan_g_qianyan_left = PuZuo_neiyan_g_qianyan_left[::-1]

PuZuo_neiyan_g = PuZuo_neiyan_g_qianyan_left + PuZuo_neiyan_g_qianyan

PuZuo_neiyan_g_houyan = rs.MirrorObjects(PuZuo_neiyan_g,rs.MoveObject(rs.CopyObject(ZhuTou_point),(4 * j/2 * x,0,0)),rs.MoveObject(rs.CopyObject(ZhuTou_point),(4 * j/2 * x,x,0)),copy=True)


PuZuo_neiyan_g = PuZuo_neiyan_g + PuZuo_neiyan_g_houyan 


#月梁投射

Yueliang_g = [YueLiang_neiyan[0]]

sq_rule = [0,0,0,0,0,0,0,0,0,0,0,0,0,0,0,0,0,0,0,0,2.5,5]
for i in range(int((MianKuo - 3)/2)+1):
    if i + 1 < len(range(int((MianKuo - 3)/2))):
        Yueliang_g1 = rs.MoveObjects(rs.CopyObjects(Yueliang_g),(0,-(MianKuo_length * (i+1)) * x,sq_rule[-(int((MianKuo - 3)/2-i))] * x))
        Yueliang_g.append(Yueliang_g1[0])


Yueliang_g_left  = rs.MirrorObjects(Yueliang_g,rs.MoveObject(rs.CopyObject(ZhuTou_point),(0,(MianKuo_length * (MianKuo - 2) * x + 2 * j * x)/2 ,0)),rs.MoveObject(rs.CopyObject(ZhuTou_point),(x,(MianKuo_length * (MianKuo - 2) * x + 2 * j * x)/2 ,0)),copy=True)

Yueliang_g_left = Yueliang_g_left[::-1]

Yueliang_g = Yueliang_g_left + Yueliang_g

PuZuo_waiyan_g_jinshen2 = rs.MoveObjects(rs.CopyObjects(PuZuo_waiyan_g_jinshen),(j * x,0,-7.5 * x))
PuZuo_waiyan_g_jinshen3 = rs.MoveObjects(rs.CopyObjects(PuZuo_waiyan_g_jinshen),(2 * j * x,0,0))

PuZuo_waiyan_g_jinshen = PuZuo_waiyan_g_jinshen + PuZuo_waiyan_g_jinshen2 + PuZuo_waiyan_g_jinshen3

PuZuo_waiyan_g_jinshen_left  = rs.MirrorObjects(PuZuo_waiyan_g_jinshen,rs.MoveObject(rs.CopyObject(ZhuTou_point),(0,(MianKuo_length * (MianKuo - 2) * x + 2 * j * x)/2 ,0)),rs.MoveObject(rs.CopyObject(ZhuTou_point),(x,(MianKuo_length * (MianKuo - 2) * x + 2 * j * x)/2 ,0)),copy=True)

PuZuo_waiyan_g_jinshen = PuZuo_waiyan_g_jinshen + PuZuo_waiyan_g_jinshen_left

PuZuo_neiyan_g_jinshen_left = rs.MirrorObjects(PuZuo_neiyan_g_jinshen,rs.MoveObject(rs.CopyObject(ZhuTou_point),(0,(MianKuo_length * (MianKuo - 2) * x + 2 * j * x)/2 ,0)),rs.MoveObject(rs.CopyObject(ZhuTou_point),(x,(MianKuo_length * (MianKuo - 2) * x + 2 * j * x)/2 ,0)),copy=True)

PuZuo_neiyan_g_jinshen = PuZuo_neiyan_g_jinshen + PuZuo_neiyan_g_jinshen_left

PuZuo_waiyan_g = PuZuo_waiyan_g + PuZuo_waiyan_g_jinshen

PuZuo_neiyan_g = PuZuo_neiyan_g + PuZuo_neiyan_g_jinshen + Yueliang_g
# ---------- end 斗拱编辑器_4 ----------
斗拱编辑器_5 = Python3Script(
    CaiFen=number_slider_2,
    HuaGong_CaiFen_left=number_slider_13,
    HuaGong_CaiFen_right=number_slider_11,
    NiDaoGong_CaiFen_left=number_slider_14,
    NiDaoGong_CaiFen_right=number_slider_14,
    MianKuo=number_slider_3)  # -> PuZuo_zhuanjiao; inputs CaiFen: Int32
# ---------- 斗拱编辑器_5: Python ----------
#佛光寺东大殿转角辅作生成
#每一跳为21分
import rhinoscriptsyntax as rs
import Rhino.Geometry as rg
import itertools as it
import math
#材分可调变量x
x = CaiFen
#柱头点
ZhuTou_point = rs.AddPoint(HuaGong_CaiFen_left * x,5 *x,0)

j = 14 * 15

#角栌斗.深27分,广27分
jld_pt_o = rs.AddPoint(0,0,0)
jld_pt2 = rs.AddPoint(27 * x,0,0)
#栌斗,欹,厚8.5分
jld_pt_z1 = rs.AddPoint(- 4.5 * x,0, 8.5 * x)
jld_cr_1 = rs.AddLine(jld_pt_o,jld_pt_z1)

jld_cr_6 = rs.AddLine(jld_pt_o,jld_pt_z1)

jld_pt_z2 = rs.CurveMidPoint(jld_cr_1)
direction_left = (x, 0, 2 * x)  # 任意方向向量 
distance = 1 * x # 移动距离 
# 单位化方向向量并计算实际位移 
unit_vector_left = rs.VectorUnitize(direction_left)
displacement_left = rs.VectorScale(unit_vector_left, distance)
rs.MoveObject(jld_pt_z2, displacement_left)
jld_cr_1 = rs.AddCurve([jld_pt_o,jld_pt_z2,jld_pt_z1])
jld_pt_3 = rs.MoveObject(rs.CopyObject(jld_pt_o),(0,2 * x,0))
jld_sr1 = rs.AddLine(jld_pt_3,rs.MoveObject(rs.CopyObject(jld_pt_3),(-4.5 * x,-4.5 * x,0)))
jld_sr1 = rs.AddLoftSrf([jld_sr1,rs.MoveObject(rs.CopyObject(jld_sr1),(0,0,8.5 * x))])
jld_cr_1 =rs.ProjectCurveToSurface(jld_cr_1,jld_sr1,[0,1,0])
jld_cr_2 = rs.MoveObject(rs.CopyObject(jld_cr_1),(0,27 * x,0 ))
jld_cr_2 = rs.RotateObject(jld_cr_2, rs.CurveStartPoint(jld_cr_2),-90,[0,0,1],copy=True)
jld_cr_3 = rs.MoveObject(rs.CopyObject(jld_cr_2),(27 * x,0,0 ))
jld_cr_3 = rs.RotateObject(jld_cr_3, rs.CurveStartPoint(jld_cr_3),-90,[0,0,1],copy=True)
jld_cr_4 = rs.MoveObject(rs.CopyObject(jld_cr_1),(27 * x,0,0 ))
jld_cr_4 = rs.RotateObject(jld_cr_4, rs.CurveStartPoint(jld_cr_4),90,[0,0,1],copy=True)
jld_down_Brep = rs.AddLoftSrf([jld_cr_1,jld_cr_2,jld_cr_3,jld_cr_4],loft_type=2,closed=True)
rs.CapPlanarHoles(jld_down_Brep)
#栌斗,平,厚6分
jld_sr2 = rs.ExplodePolysurfaces(jld_down_Brep)
jld_sr2 = jld_sr2[2]
JiaoLuDou_center_point = rs.SurfaceAreaCentroid(rs.ExplodePolysurfaces(jld_down_Brep)[1])
JiaoLuDou_center_point = rs.AddPoint(JiaoLuDou_center_point[0])
jld_mid_Brep = rs.ExtrudeSurface(jld_sr2,rs.AddLine(rs.CurveEndPoint(jld_cr_2),rs.MoveObject(rs.CurveEndPoint(jld_cr_2),(0,0, 6* x))))
#栌斗,耳,厚6分
jld_up_brep1 = rs.CopyObject(rs.CurveEndPoint(jld_cr_1))
rs.MoveObject(jld_up_brep1,(0,0,6 * x))
jld_up_brep1 = rs.AddLine(jld_up_brep1,rs.MoveObject(rs.CopyObject(jld_up_brep1),(13 * x,0,0)))
jld_up_brep1 = rs.ExtrudeCurve(jld_up_brep1,rs.AddLine(jld_pt_o,rs.MoveObject(rs.CopyObject(jld_pt_o),(0,13 * x,0))))
jld_up_brep1 = rs.ExtrudeSurface(jld_up_brep1,rs.AddLine(jld_pt_o,rs.MoveObject(rs.CopyObject(jld_pt_o),(0,0,6 * x))))
jld_up_brep2 = rs.MirrorObject(jld_up_brep1,JiaoLuDou_center_point,rs.MoveObject(rs.CopyObject(JiaoLuDou_center_point),(x,0,0)),copy=True)
jld_up_brep3 = rs.MirrorObject(jld_up_brep2,JiaoLuDou_center_point,rs.MoveObject(rs.CopyObject(JiaoLuDou_center_point),(0,x,0)),copy=True)
jld_up_brep4 = rs.MirrorObject(jld_up_brep3,JiaoLuDou_center_point,rs.MoveObject(rs.CopyObject(JiaoLuDou_center_point),(x,0,0)),copy=True)




#柱头馒头榫2.75分
mts_zt_base_point = rs.AddPoint(0,0,0)
mts_zt_pt_1 = rs.AddPoint(2.75 * x,0,0)
mts_zt_cr_1 = rs.AddLine(mts_zt_base_point,mts_zt_pt_1)
mts_zt_cr_2 = rs.CopyObject(mts_zt_cr_1)
rs.MoveObject(mts_zt_cr_2,(0,2.75 * x,0))
mts_zt_sr = rs.AddLoftSrf([mts_zt_cr_1,mts_zt_cr_2])
mts_zt = rs.ExtrudeSurface(mts_zt_sr,rs.AddLine(mts_zt_base_point,rs.MoveObject(rs.CopyObject(mts_zt_base_point),(0,0,2.75 * x))))
mts_zt_source = [2.75/2 *x,2.75/2 * x,0]
source_x_zt = [2.75/2 * x + 1,2.75/2 * x,0]            # X 轴方向点
source_y_zt = [2.75/2 * x,2.75/2 * x + 1,0] 
source_zt = [mts_zt_source, source_x_zt, source_y_zt]           # Y 轴方向点

#馒头榫投射点 
mts_project_jld = [13.5 * x,15.5 * x,0]
target_x_jld= [13.5 * x + 1,15.5 * x,0] # 新 X 轴方向点（向右）
target_y_jld = [13.5 * x,15.5 * x + 1,0] # 新 Y 轴方向点（向上）
target_jld = [mts_project_jld, target_x_jld, target_y_jld]

jld_pt4 = rs.AddPoint(13.5 * x,15.5 * x,0)
jld_cr_7 = rs.AddLine(jld_pt4,rs.MoveObject(rs.CopyObject(jld_pt4),(40 * x,0,0)))
rs.MoveObject(jld_cr_7,(-20 * x,0,14.5 * x))
jld_cr_8 = rs.AddLine(rs.MoveObject(rs.CurveEndPoint(jld_cr_7),(0,5*x,0)),rs.MoveObject(rs.CurveEndPoint(jld_cr_7),(0,-5*x,0)))
jld_trimed1 = rs.ExtrudeCurve(jld_cr_8 ,(rs.AddLine(rs.AddPoint(0,0,0),rs.AddPoint(-60* x,0,0))))
jld_trimed1 = rs.ExtrudeSurface(jld_trimed1 ,(rs.AddLine(rs.AddPoint(0,0,0),rs.AddPoint(0,0,10 * x))))
rs.MoveObject(jld_trimed1,(10*x,0,0))

rs.RotateObject(jld_trimed1,jld_pt4,45,[0,0,x])


#馒头榫投射 
mts_jld = rs.OrientObject(rs.CopyObject(mts_zt), source_zt, target_jld)

JiaoLuDou = rs.BooleanDifference(jld_mid_Brep,jld_down_Brep,delete_input=True)
JiaoLuDou = rs.BooleanIntersection(JiaoLuDou,jld_up_brep1,delete_input=True)
JiaoLuDou = rs.BooleanIntersection(JiaoLuDou,jld_up_brep2,delete_input=True)
JiaoLuDou = rs.BooleanIntersection(JiaoLuDou,jld_up_brep3,delete_input=True)
JiaoLuDou = rs.BooleanIntersection(JiaoLuDou,jld_up_brep4,delete_input=True)
JiaoLuDou = rs.BooleanUnion([mts_jld,JiaoLuDou],delete_input=False)
JiaoLuDou = rs.BooleanUnion([JiaoLuDou,jld_trimed1],delete_input=False)

rs.MoveObject(JiaoLuDou,(HuaGong_CaiFen_left * x-13.5*x,-10.5 * x,248 * x))

JiaoLuDou_neiyan = rs.CopyObject(JiaoLuDou)
rs.MoveObject(JiaoLuDou_neiyan,(j*x,j*x,-5.5*x))



#转角铺作华拱生成

hg_zj_pt1 = rs.CopyObject(ZhuTou_point)
rs.MoveObject(hg_zj_pt1,(HuaGong_CaiFen_left * x-32*x,0,262.5 * x))

hg_zj_pt2 = rs.CopyObject(hg_zj_pt1)
rs.MoveObject(hg_zj_pt2,(-(HuaGong_CaiFen_left+21) * x,0,0))

hg_zj_pt3 = rs.CopyObject(hg_zj_pt1)
rs.MoveObject(hg_zj_pt3,((HuaGong_CaiFen_left+21) * x,0,0))

hg_zj_pt2z = rs.CopyObject(hg_zj_pt2)
rs.MoveObject(hg_zj_pt2z,(0,0,9 * x))

hg_zj_pt3z = rs.CopyObject(hg_zj_pt3)
rs.MoveObject(hg_zj_pt3z,(0,0,9 * x))


hg_zj_pt2x = rs.CopyObject(hg_zj_pt2)
rs.MoveObject(hg_zj_pt2x,(16 * x,0,0))

hg_zj_pt3x = rs.CopyObject(hg_zj_pt3)
rs.MoveObject(hg_zj_pt3x,(-16 * x,0,0))

hg_zj_cr1z = rs.AddLine(hg_zj_pt2,hg_zj_pt2z)

hg_zj_cr1x = rs.AddLine(hg_zj_pt2x,hg_zj_pt2)

#卷杀生成
juansha_zj_crs = []

juansha_zj_pt1 = rs.DivideCurve(hg_zj_cr1z,5)

juansha_zj_pt2 = rs.DivideCurve(hg_zj_cr1x,5)

for i in range(len(juansha_zj_pt1)):
    juansha_zj_cr = rs.AddLine(juansha_zj_pt1[i],juansha_zj_pt2[i])
    juansha_zj_crs.append(juansha_zj_cr)

juansha_zj_crs = juansha_zj_crs[1:len(juansha_zj_crs)-1]

juansha_zj_pts = []

for i in range(len(juansha_zj_crs)):
    if i + 1 < len(juansha_zj_crs):
        juansha_pt = rs.CurveCurveIntersection(juansha_zj_crs[i],juansha_zj_crs[i+1])
        juansha_zj_pts.append(juansha_pt[0][1])
juansha_zj_pts.append(rs.CurveEndPoint(hg_zj_cr1z))
juansha_zj_pts.append(rs.MoveObject(rs.CopyObject(hg_zj_pt2z),(0,0,6 * x)))
juansha_zj_pts.append(rs.MoveObject(rs.CopyObject(hg_zj_pt2z),(12 * x,0,6 * x)))
juansha_zj_pts.insert(0,rs.CurveStartPoint(hg_zj_cr1x))

juansha_zj_curve = rs.AddPolyline(juansha_zj_pts)

#欹幽
#左
qa_zj_left_2 = rs.CopyObject(rs.MoveObject(rs.CopyObject(hg_zj_pt2z),(12 * x,0,6 * x)))
rs.MoveObject(qa_zj_left_2,(2 * x,0,4 * x))
qa_zj_curve_left_1 = rs.AddLine(rs.MoveObject(rs.CopyObject(hg_zj_pt2z),(12 * x,0,6 * x)),qa_zj_left_2)

qa_zj_left_3 = rs.CurveMidPoint(qa_zj_curve_left_1)
direction_left = (-x, 0, 2 * x)  # 任意方向向量 
distance = 0.5 * x # 移动距离 
# 单位化方向向量并计算实际位移 
unit_vector_left = rs.VectorUnitize(direction_left)
displacement_left = rs.VectorScale(unit_vector_left, distance)
rs.MoveObject(qa_zj_left_3, displacement_left)
qa_zj_curve_left_1 = rs.AddCurve([rs.MoveObject(rs.CopyObject(hg_zj_pt2z),(12 * x,0,6 * x)),qa_zj_left_3,qa_zj_left_2])
qa_zj_curve_left_1 = rs.JoinCurves([qa_zj_curve_left_1,rs.AddLine(rs.CurveEndPoint(qa_zj_curve_left_1),rs.MoveObject(rs.CurveEndPoint(qa_zj_curve_left_1),(0,0,2*x)))])

juansha_zj_curve = rs.JoinCurves([juansha_zj_curve,qa_zj_curve_left_1])

juansha_zj_brep_untrimed = rs.MirrorObject(juansha_zj_curve,hg_zj_pt1,rs.MoveObject(rs.CopyObject(hg_zj_pt1),(0,x,0)),copy=True)
rs.MoveObject(juansha_zj_brep_untrimed,((HuaGong_CaiFen_left - HuaGong_CaiFen_left)*x,0,0))

juansha_zj_brep_untrimed = rs.JoinCurves([juansha_zj_curve,juansha_zj_brep_untrimed ,rs.AddLine(rs.CurveStartPoint(juansha_zj_curve),rs.CurveStartPoint(juansha_zj_brep_untrimed)),rs.AddLine(rs.CurveEndPoint(juansha_zj_curve),rs.CurveEndPoint(juansha_zj_brep_untrimed))])
juansha_zj_brep_untrimed = rs.AddPlanarSrf(juansha_zj_brep_untrimed)
rs.MoveObject(juansha_zj_brep_untrimed,(0,5 * x,0))
juansha_zj_brep_untrimed = rs.ExtrudeSurface(juansha_zj_brep_untrimed,rs.AddLine(rs.AddPoint(0,0,0),rs.AddPoint(0,-10 * x ,0)))
#拱眼隐去部深1分
#左
gyy_zj_cr =rs.AddLine(rs.CurveStartPoint(qa_zj_curve_left_1),rs.MoveObject(rs.CurveStartPoint(qa_zj_curve_left_1),(0,0,-x)))
gyy_zj_cr_1 = rs.RotateObject(gyy_zj_cr,rs.CurveEndPoint(gyy_zj_cr),90,[0,x,0],copy=True)
gyy_zj_cr = rs.AddFilletCurve(gyy_zj_cr,gyy_zj_cr_1,x)
qa_zj_curve_left1 = rs.JoinCurves([qa_zj_curve_left_1,gyy_zj_cr])

qa_zj_curve_left2 = rs.RotateObject(qa_zj_curve_left1,rs.CurveEndPoint(qa_zj_curve_left1),180,[0,0,x],copy=True)
rs.MoveObject(qa_zj_curve_left2,((HuaGong_CaiFen_left +10 -14 - 7.875) * x,0,0))
qa_zj_curve_left = rs.JoinCurves([qa_zj_curve_left1,qa_zj_curve_left2,rs.AddLine(rs.CurveStartPoint(qa_zj_curve_left1),rs.CurveStartPoint(qa_zj_curve_left2)),rs.AddLine(rs.CurveEndPoint(qa_zj_curve_left1),rs.CurveEndPoint(qa_zj_curve_left2))])

qa_zj_curve_left = rs.AddPlanarSrf(qa_zj_curve_left)
qa_zj_curve_left_1 = rs.ExtrudeSurface(qa_zj_curve_left,rs.AddLine(rs.AddPoint(0,0,0),rs.AddPoint(0,-2 * x,0)))
rs.MoveObject(qa_zj_curve_left_1,(0,-4 * x ,0))
qa_zj_curve_left_2 = rs.MirrorObject(qa_zj_curve_left_1,hg_zj_pt1,rs.MoveObject(rs.CopyObject(hg_zj_pt1),(x,0,0)),copy=True)

qa_zj_curve_right2 =  rs.MirrorObject(qa_zj_curve_left2,hg_zj_pt1,rs.MoveObject(rs.CopyObject(hg_zj_pt1),(0,x,0)),copy=True)
qa_zj_curve_right1 =  rs.MirrorObject(qa_zj_curve_left1,hg_zj_pt1,rs.MoveObject(rs.CopyObject(hg_zj_pt1),(0,x,0)),copy=True)
rs.MoveObject(qa_zj_curve_right1,((HuaGong_CaiFen_left - HuaGong_CaiFen_left)*x,0,0))

qa_zj_curve_right_1 = rs.JoinCurves([qa_zj_curve_right1,qa_zj_curve_right2,rs.AddLine(rs.CurveStartPoint(qa_zj_curve_right1),rs.CurveStartPoint(qa_zj_curve_right2)),rs.AddLine(rs.CurveEndPoint(qa_zj_curve_right1),rs.CurveEndPoint(qa_zj_curve_right2))])
qa_zj_curve_right_1 = rs.AddPlanarSrf(qa_zj_curve_right_1)
qa_zj_curve_right_1 = rs.ExtrudeSurface(qa_zj_curve_right_1,rs.AddLine(rs.AddPoint(0,0,0),rs.AddPoint(0,-2 * x,0)))
rs.MoveObject(qa_zj_curve_right_1,(0,-4 * x ,0))
qa_zj_curve_right_2 = rs.MirrorObject(qa_zj_curve_right_1,hg_zj_pt1,rs.MoveObject(rs.CopyObject(hg_zj_pt1),(x,0,0)),copy=True)

#馒头榫生成
mts_zj_pt1 = rs.CopyObject(hg_zj_pt2z)
rs.MoveObject(mts_zj_pt1,(4.75 * x,-1.25 * x,6 * x))
mts_zj1 = rs.AddLine(mts_zj_pt1,rs.MoveObject(rs.CopyObject(mts_zj_pt1),(2.5 * x,0,0)))
mts_zj1 = rs.ExtrudeCurve(mts_zj1,rs.AddLine(rs.AddPoint(0,0,0),rs.AddPoint(0,2.5 * x,0)))
mts_zj1 = rs.ExtrudeSurface(mts_zj1,rs.AddLine(rs.AddPoint(0,0,0),rs.AddPoint(0,0,2.5 * x)))
mts_zj2 = rs.MirrorObject(mts_zj1,hg_zj_pt1,rs.MoveObject(rs.CopyObject(hg_zj_pt1),(0,x,0)),copy=True)
rs.MoveObject(mts_zj2,((HuaGong_CaiFen_left - HuaGong_CaiFen_left)*x,0,0))

#拱眼插销生成
#拱眼上的插栓,广4分,厚4分,深2.5分
gy_cx_zj1 = rs.CopyObject(rs.CurveEndPoint(qa_zj_curve_left1))
rs.MoveObject(gy_cx_zj1,(rs.Distance(rs.CurveEndPoint(qa_zj_curve_left1),rs.CurveEndPoint(qa_zj_curve_left2))/2-2*x,-1.25 * x,0))
gy_cx_zj1 = rs.AddLine(gy_cx_zj1,rs.MoveObject(rs.CopyObject(gy_cx_zj1),(4 * x,0,0)))
gy_cx_zj1 = rs.ExtrudeCurve(gy_cx_zj1,rs.AddLine(rs.AddPoint(0,0,0),rs.AddPoint(0,2.5 * x,0)))
gy_cx_zj1 = rs.ExtrudeSurface(gy_cx_zj1,rs.AddLine(rs.AddPoint(0,0,0),rs.AddPoint(0,0,4 * x)))
gy_cx_zj2 = rs.MirrorObject(gy_cx_zj1,hg_zj_pt1,rs.MoveObject(rs.CopyObject(hg_zj_pt1),(0,x,0)),copy=True)
rs.MoveObject(gy_cx_zj2,((HuaGong_CaiFen_left - HuaGong_CaiFen_left)*x/2,0,0))


#用于剪切华拱下部的体块

huagong_trimed_brep = rs.ExplodePolysurfaces(JiaoLuDou)[31]
huagong_trimed_brep = rs.CurveStartPoint(rs.DuplicateEdgeCurves(huagong_trimed_brep)[1])
rs.RotateObject(huagong_trimed_brep,hg_zj_pt1,-45,[0,0,x])
huagong_trimed_brep = rs.AddLine(huagong_trimed_brep,rs.MoveObject(rs.CopyObject(huagong_trimed_brep),(0,-14 * x,0)))
huagong_trimed_brep_1 = rs.MirrorObject(huagong_trimed_brep,hg_zj_pt1,rs.MoveObject(rs.CopyObject(hg_zj_pt1),(0,x,0)),copy=True)
huagong_trimed_brep = rs.AddLoftSrf([huagong_trimed_brep,huagong_trimed_brep_1])
huagong_trimed_brep = rs.ExtrudeSurface(huagong_trimed_brep,rs.AddLine(rs.AddPoint(0,0,0),rs.AddPoint(0,0,6 * x)))
rs.MoveObject(huagong_trimed_brep,(0,0,-6 * x))

huagong_trimed_brep2 = rs.CopyObject(hg_zj_pt1)
rs.MoveObject(huagong_trimed_brep2,(-5 * x,-6 * x,6 * x))
huagong_trimed_brep2 = rs.AddLine(huagong_trimed_brep2,rs.MoveObject(rs.CopyObject(huagong_trimed_brep2),((10 * x),0,0)))
huagong_trimed_brep2 = rs.ExtrudeCurve(huagong_trimed_brep2,rs.AddLine(rs.AddPoint(0,0,0),rs.AddPoint(0,12 * x,0)))
huagong_trimed_brep2 = rs.ExtrudeSurface(huagong_trimed_brep2,rs.AddLine(rs.AddPoint(0,0,0),rs.AddPoint(0,0,9 * x)))


#华拱剪切
HuaGong1_zj = rs.BooleanDifference(juansha_zj_brep_untrimed,qa_zj_curve_left_1,delete_input=False)
HuaGong1_zj = rs.BooleanDifference(HuaGong1_zj,qa_zj_curve_left_2,delete_input=False)
HuaGong1_zj = rs.BooleanIntersection(HuaGong1_zj,qa_zj_curve_right_1,delete_input=False)
HuaGong1_zj = rs.BooleanIntersection(HuaGong1_zj,qa_zj_curve_right_2,delete_input=False)
HuaGong1_zj = rs.BooleanDifference(mts_zj1,HuaGong1_zj,delete_input=False)
HuaGong1_zj = rs.BooleanIntersection(HuaGong1_zj,mts_zj2,delete_input=False)
HuaGong1_zj = rs.BooleanIntersection(HuaGong1_zj,gy_cx_zj1,delete_input=False)
HuaGong1_zj = rs.BooleanIntersection(HuaGong1_zj,gy_cx_zj2,delete_input=False)
HuaGong1_zj = rs.BooleanUnion([HuaGong1_zj,huagong_trimed_brep],delete_input=False)
HuaGong1_zj = rs.BooleanDifference(huagong_trimed_brep2,HuaGong1_zj,delete_input=False)

#转角铺作泥道拱生成

ndg_zj_pt1 = rs.CopyObject(hg_zj_pt1)
ndg_zj_pt2 = rs.CopyObject(ndg_zj_pt1)
rs.MoveObject(ndg_zj_pt2,(-HuaGong_CaiFen_left * x,0,0))
ndg_zj_ptz = rs.MoveObject(rs.CopyObject(ndg_zj_pt2),(0,0,9 * x))
ndg_zj_ptx = rs.MoveObject(rs.CopyObject(ndg_zj_pt2),(14 * x,0,0))

ndg_zj_crz = rs.AddLine(ndg_zj_pt2,ndg_zj_ptz)
ndg_zj_crx = rs.AddLine(ndg_zj_ptx,ndg_zj_pt2)

#卷杀生成

juansha_ndg_zj_crs = []

ndg_zj_ptsz = rs.DivideCurve(ndg_zj_crz,5)
ndg_zj_ptsx = rs.DivideCurve(ndg_zj_crx,5)
for i in range(len(ndg_zj_ptsz)):
    juansha_ndg_zj_cr = rs.AddLine(ndg_zj_ptsz[i],ndg_zj_ptsx[i])
    juansha_ndg_zj_crs.append(juansha_ndg_zj_cr)

juansha_ndg_zj_crs = juansha_ndg_zj_crs[1:len(juansha_ndg_zj_crs)-1]

juansha_ndg_zj_pts = []

for i in range(len(juansha_ndg_zj_crs)):
    if i + 1 < len(juansha_ndg_zj_crs):
        juansha_ndg_pt = rs.CurveCurveIntersection(juansha_ndg_zj_crs[i],juansha_ndg_zj_crs[i+1])
        juansha_ndg_zj_pts.append(juansha_ndg_pt[0][1])
juansha_ndg_zj_pts.append(rs.CurveEndPoint(ndg_zj_crz))
juansha_ndg_zj_pts.append(rs.MoveObject(rs.CopyObject(ndg_zj_ptz),(0,0,6 * x)))
juansha_ndg_zj_pts.append(rs.MoveObject(rs.CopyObject(ndg_zj_ptz),(10 * x,0,6 * x)))
juansha_ndg_zj_pts.insert(0,rs.CurveStartPoint(ndg_zj_crx ))

juansha_ndg_zj_curve = rs.AddPolyline(juansha_ndg_zj_pts)
juansha_ndg_zj_curve_1 = rs.MirrorObject(juansha_ndg_zj_curve,hg_zj_pt1,rs.MoveObject(rs.CopyObject(hg_zj_pt1),(0,x,0)),copy=True)

juansha_ndg_zj_curve = rs.JoinCurves([juansha_ndg_zj_curve,juansha_ndg_zj_curve_1,rs.AddLine(rs.CurveStartPoint(juansha_ndg_zj_curve),rs.CurveStartPoint(juansha_ndg_zj_curve_1)),rs.AddLine(rs.CurveEndPoint(juansha_ndg_zj_curve),rs.CurveEndPoint(juansha_ndg_zj_curve_1))])

ndg_untrimed_brep = rs.AddPlanarSrf(juansha_ndg_zj_curve)
rs.MoveObject(ndg_untrimed_brep,(0,-5 * x,0))
ndg_untrimed_brep = rs.ExtrudeSurface(ndg_untrimed_brep,rs.AddLine(rs.AddPoint(0,0,0),rs.AddPoint(0,10 * x,0)))

#泥道栱的馒头榫
mts_ndg_zj = rs.MoveObject(rs.CopyObject(ndg_zj_ptz),(3.75 * x,-1.25 * x,6 * x))
mts_ndg_zj = rs.AddLine(mts_ndg_zj,rs.MoveObject(rs.CopyObject(mts_ndg_zj),(2.5 * x,0,0)))
mts_ndg_zj = rs.ExtrudeCurve(mts_ndg_zj,rs.AddLine(rs.AddPoint(0,0,0),rs.AddPoint(0,2.5 * x,0)))
mts_ndg_zj = rs.ExtrudeSurface(mts_ndg_zj,rs.AddLine(rs.AddPoint(0,0,0),rs.AddPoint(0,0,2.5 * x)))
mts_ndg_zj2 = rs.MirrorObject(mts_ndg_zj,hg_zj_pt1,rs.MoveObject(rs.CopyObject(hg_zj_pt1),(0,x,0)),copy=True)
ndg_untrimed_brep = rs.BooleanDifference(mts_ndg_zj,ndg_untrimed_brep,delete_input=False)
ndg_untrimed_brep = rs.BooleanIntersection(mts_ndg_zj2,ndg_untrimed_brep,delete_input=False)

#泥道拱剪切

##拱眼隐去部深1分
#左
gyy_zj_cr_ndg = rs.CopyObject(ndg_zj_ptz)
rs.MoveObject(gyy_zj_cr_ndg,(10 * x,0,6 * x))
gyy_zj_cr_ndg_1 = rs.MoveObject(rs.CopyObject(gyy_zj_cr_ndg),(0,0,-x))
gyy_zj_cr_ndg_2 = rs.MoveObject(rs.CopyObject(gyy_zj_cr_ndg),(x,0,-x))
gyy_zj_cr_ndg_1_cr = rs.AddLine(gyy_zj_cr_ndg_1,gyy_zj_cr_ndg)
gyy_zj_cr_ndg_2_cr = rs.AddLine(gyy_zj_cr_ndg_2,gyy_zj_cr_ndg_1)
gyy_zj_cr_ndg = rs.AddFilletCurve(gyy_zj_cr_ndg_1_cr,gyy_zj_cr_ndg_2_cr,x)
gyy_zj_cr_ndg2 = rs.RotateObject(gyy_zj_cr_ndg,rs.CurveStartPoint(gyy_zj_cr_ndg),180,[0,0,x],copy=True)
rs.MoveObject(gyy_zj_cr_ndg2,((HuaGong_CaiFen_left +10 -14 - 7.875) * x,0,0))
gyy_zj_ndg = rs.AddLoftSrf([gyy_zj_cr_ndg,gyy_zj_cr_ndg2])
gyy_zj_ndg = rs.ExtrudeSurface(gyy_zj_ndg,rs.AddLine(rs.AddPoint(0,0,0),rs.AddPoint(0,-2 * x,0)))
rs.MoveObject(gyy_zj_ndg,(0,-4 * x,0))
gyy_zj_ndg2 = rs.MirrorObject(gyy_zj_ndg,hg_zj_pt1,rs.MoveObject(rs.CopyObject(hg_zj_pt1),(0,x,0)),copy=True)
gyy_zj_ndg3 = rs.MirrorObject(gyy_zj_ndg,hg_zj_pt1,rs.MoveObject(rs.CopyObject(hg_zj_pt1),(x,0,0)),copy=True)
gyy_zj_ndg4 = rs.MirrorObject(gyy_zj_ndg2,hg_zj_pt1,rs.MoveObject(rs.CopyObject(hg_zj_pt1),(x,0,0)),copy=True)



#泥道拱下部剪切
ndg_trimed_brep = rs.CopyObject(hg_zj_pt1)
rs.MoveObject(ndg_trimed_brep,(-5 * x,0,0))
ndg_trimed_brep = rs.AddLine(ndg_trimed_brep,rs.MoveObject(rs.CopyObject(ndg_trimed_brep),(10 * x,0,0)))
ndg_trimed_brep = rs.ExtrudeCurve(ndg_trimed_brep,rs.AddLine(rs.AddPoint(0,0,0),rs.AddPoint(0,-10 * x,0)))
ndg_trimed_brep = rs.ExtrudeSurface(ndg_trimed_brep,rs.AddLine(rs.AddPoint(0,0,0),rs.AddPoint(0,0,7.5 * x)))
rs.MoveObject(ndg_trimed_brep,(0,5 * x,7.5 * x))
ndg_trimed_brep2 = rs.RotateObject(ndg_untrimed_brep,hg_zj_pt1,45,[0,0,x],copy=True)
rs.MoveObject(ndg_trimed_brep2,(0,0,7.5 * x))
ndg_trimed_brep3 = rs.MoveObject(rs.CopyObject(ndg_trimed_brep),(0,0,-7.5 * x))
ndg_trimed_brep4 = rs.RotateObject(ndg_untrimed_brep,hg_zj_pt1,45,[0,0,x],copy=True)
rs.MoveObject(ndg_trimed_brep4,(0,0,-7.5 * x))

ndg1_zj = rs.BooleanUnion([gyy_zj_ndg,gyy_zj_ndg2,gyy_zj_ndg3,gyy_zj_ndg4,ndg_untrimed_brep],delete_input=False)

ndg1_zj2 = rs.RotateObject(ndg1_zj,hg_zj_pt1,90,[0,0,x],copy=True)





ndg1_zj = rs.BooleanUnion([ndg1_zj,ndg_trimed_brep],delete_input=False)
#转角内檐第五层华拱上平盘斗上的泥道栱
ndg6_neiyan = rs.CopyObject(ndg1_zj )


ndg1_zj = rs.BooleanDifference(ndg_trimed_brep2,ndg1_zj,delete_input=False)

ndg1_zj2 = rs.BooleanUnion([ndg1_zj2,ndg_trimed_brep3],delete_input=False)
#内檐第五层泥道栱
ndg5_neiyan = rs.CopyObject(ndg1_zj2 )

#转角内檐第五层华拱上平盘斗上的泥道栱
ndg6_neiyan2 = rs.CopyObject(ndg1_zj2 )

ndg1_zj2 = rs.BooleanDifference(ndg_trimed_brep4,ndg1_zj2,delete_input=False)

HuaGong1_zj_brep = rs.RotateObject(HuaGong1_zj,hg_zj_pt1,45,[0,0,x],copy=True)


#佛光寺东大殿散斗

x = CaiFen
#散斗,深12分,广10分,华拱/散斗.深10分,广12分,泥道栱
sd_zj_pt_o = rs.AddPoint(0,0,0)
sd_zj_pt2 = rs.AddPoint(12 * x,0,0)
sd_zj_pt_z1 = rs.AddPoint(- 2 * x,0, 4 * x)
sd_zj_cr_1 = rs.AddLine(sd_zj_pt_o,sd_zj_pt_z1)
#散斗,欹
sd_zj_pt_z2 = rs.CurveMidPoint(sd_zj_cr_1)
direction_left = (x, 0, 2 * x)  # 任意方向向量 
distance = 0.5 * x # 移动距离 
# 单位化方向向量并计算实际位移 
unit_vector_left = rs.VectorUnitize(direction_left)
displacement_left = rs.VectorScale(unit_vector_left, distance)
rs.MoveObject(sd_zj_pt_z2, displacement_left)
sd_zj_cr_1 = rs.AddCurve([sd_zj_pt_o,sd_zj_pt_z2,sd_zj_pt_z1])
sd_zj_pt_3 = rs.MoveObject(rs.CopyObject(sd_zj_pt_o),(0,2 * x,0))
sd_zj_sr1 = rs.AddLine(sd_zj_pt_3,rs.MoveObject(rs.CopyObject(sd_zj_pt_3),(-2 * x,-2 * x,0)))
sd_zj_sr1 = rs.AddLoftSrf([sd_zj_sr1,rs.MoveObject(rs.CopyObject(sd_zj_sr1),(0,0,4* x))])
sd_zj_cr_1 =rs.ProjectCurveToSurface(sd_zj_cr_1,sd_zj_sr1,[0,1,0])
sd_zj_cr_2 = rs.MoveObject(rs.CopyObject(sd_zj_cr_1),(0,10 * x,0 ))
sd_zj_cr_2 = rs.RotateObject(sd_zj_cr_2, rs.CurveStartPoint(sd_zj_cr_2),-90,[0,0,1],copy=True)
sd_zj_cr_3 = rs.MoveObject(rs.CopyObject(sd_zj_cr_2),(12 * x,0,0 ))
sd_zj_cr_3 = rs.RotateObject(sd_zj_cr_3, rs.CurveStartPoint(sd_zj_cr_3),-90,[0,0,1],copy=True)
sd_zj_cr_4 = rs.MoveObject(rs.CopyObject(sd_zj_cr_1),(12 * x,0,0 ))
sd_zj_cr_4 = rs.RotateObject(sd_zj_cr_4, rs.CurveStartPoint(sd_zj_cr_4),90,[0,0,1],copy=True)
sd_zj_down_Brep = rs.AddLoftSrf([sd_zj_cr_1,sd_zj_cr_2,sd_zj_cr_3,sd_zj_cr_4],loft_type=2,closed=True)
rs.CapPlanarHoles(sd_zj_down_Brep)
#散斗,平
sd_zj_sr2 = rs.ExplodePolysurfaces(sd_zj_down_Brep)
sd_zj_sr2 = sd_zj_sr2[2]
sd_zj_mid_Brep = rs.ExtrudeSurface(sd_zj_sr2,rs.AddLine(rs.CurveEndPoint(sd_zj_cr_2),rs.MoveObject(rs.CurveEndPoint(sd_zj_cr_2),(0,0,2 * x))))
sd_zj_sr3_curve= rs.DuplicateEdgeCurves(sd_zj_mid_Brep)[9]
sd_zj_sr3 = rs.AddLoftSrf([sd_zj_sr3_curve,rs.MoveObject(rs.CopyObject(sd_zj_sr3_curve),(0,-2 * x,0))])
sd_zj_source_point = rs.SurfaceAreaCentroid(rs.ExplodePolysurfaces(sd_zj_down_Brep)[1])[0]
sd_zj_up_brep1 = rs.ExtrudeSurface(sd_zj_sr3,rs.AddLine(sd_zj_pt_o,rs.MoveObject(rs.CopyObject(sd_zj_pt_o),(0,0,3.5* x))))
sd_zj_up_brep2 =rs.CopyObject(sd_zj_up_brep1)
rs.MoveObject(sd_zj_up_brep2,(0, -12 * x ,0))


SanDou = rs.BooleanDifference(sd_zj_mid_Brep,sd_zj_up_brep2,delete_input=False)
SanDou = rs.BooleanDifference(SanDou,sd_zj_up_brep1,delete_input=False)
SanDou = rs.BooleanDifference(SanDou,sd_zj_down_Brep,delete_input=False)
rs.MoveObject(SanDou,((HuaGong_CaiFen_left-53)* x,-2 * x,277.5 * x))

SanDou = rs.BooleanUnion([ndg1_zj,SanDou],delete_input=False)
SanDou_1 = rs.RotateObject(SanDou,hg_zj_pt1,45,[0,0,x],copy=True)



SanDou_1_2 = rs.MirrorObject(SanDou,hg_zj_pt1,rs.MoveObject(rs.CopyObject(hg_zj_pt1),(0,x,0)),copy=True)
rs.MoveObject(SanDou_1_2,((HuaGong_CaiFen_left - HuaGong_CaiFen_left)*x,0,0))



rs.RotateObject(SanDou_1_2,hg_zj_pt1,45,[0,0,x],copy=False)




#佛光寺东大殿散斗 泥道拱上


#散斗.深10分,广10分,泥道栱
sd_ndg_zj_pt_o = rs.AddPoint(0,0,0)
sd_ndg_zj_pt2 = rs.AddPoint(10 * x,0,0)
sd_ndg_zj_pt_z1 = rs.AddPoint(- 2 * x,0, 4 * x)
sd_ndg_zj_cr_1 = rs.AddLine(sd_ndg_zj_pt_o,sd_ndg_zj_pt_z1)
#散斗,欹
sd_ndg_zj_pt_z2 = rs.CurveMidPoint(sd_ndg_zj_cr_1)
direction_left = (x, 0, 2 * x)  # 任意方向向量 
distance = 0.5 * x # 移动距离 
# 单位化方向向量并计算实际位移 
unit_vector_left = rs.VectorUnitize(direction_left)
displacement_left = rs.VectorScale(unit_vector_left, distance)
rs.MoveObject(sd_ndg_zj_pt_z2, displacement_left)
sd_ndg_zj_cr_1 = rs.AddCurve([sd_ndg_zj_pt_o,sd_ndg_zj_pt_z2,sd_ndg_zj_pt_z1])
sd_ndg_zj_pt_3 = rs.MoveObject(rs.CopyObject(sd_ndg_zj_pt_o),(0,2 * x,0))
sd_ndg_zj_sr1 = rs.AddLine(sd_ndg_zj_pt_3,rs.MoveObject(rs.CopyObject(sd_ndg_zj_pt_3),(-2 * x,-2 * x,0)))
sd_ndg_zj_sr1 = rs.AddLoftSrf([sd_ndg_zj_sr1,rs.MoveObject(rs.CopyObject(sd_ndg_zj_sr1),(0,0,4* x))])
sd_ndg_zj_cr_1 =rs.ProjectCurveToSurface(sd_ndg_zj_cr_1,sd_ndg_zj_sr1,[0,1,0])
sd_ndg_zj_cr_2 = rs.MoveObject(rs.CopyObject(sd_ndg_zj_cr_1),(0,10 * x,0 ))
sd_ndg_zj_cr_2 = rs.RotateObject(sd_ndg_zj_cr_2, rs.CurveStartPoint(sd_ndg_zj_cr_2),-90,[0,0,1],copy=True)
sd_ndg_zj_cr_3 = rs.MoveObject(rs.CopyObject(sd_ndg_zj_cr_2),(10 * x,0,0 ))
sd_ndg_zj_cr_3 = rs.RotateObject(sd_ndg_zj_cr_3, rs.CurveStartPoint(sd_ndg_zj_cr_3),-90,[0,0,1],copy=True)
sd_ndg_zj_cr_4 = rs.MoveObject(rs.CopyObject(sd_ndg_zj_cr_1),(10 * x,0,0 ))
sd_ndg_zj_cr_4 = rs.RotateObject(sd_ndg_zj_cr_4, rs.CurveStartPoint(sd_ndg_zj_cr_4),90,[0,0,1],copy=True)
sd_ndg_zj_down_Brep = rs.AddLoftSrf([sd_ndg_zj_cr_1,sd_ndg_zj_cr_2,sd_ndg_zj_cr_3,sd_ndg_zj_cr_4],loft_type=2,closed=True)
rs.CapPlanarHoles(sd_ndg_zj_down_Brep)
#散斗,平
sd_ndg_zj_sr2 = rs.ExplodePolysurfaces(sd_ndg_zj_down_Brep)
sd_ndg_zj_sr2 = sd_ndg_zj_sr2[2]
sd_ndg_zj_mid_Brep = rs.ExtrudeSurface(sd_ndg_zj_sr2,rs.AddLine(rs.CurveEndPoint(sd_ndg_zj_cr_2),rs.MoveObject(rs.CurveEndPoint(sd_ndg_zj_cr_2),(0,0,2 * x))))
sd_ndg_zj_sr3_curve= rs.DuplicateEdgeCurves(sd_ndg_zj_mid_Brep)[9]
sd_ndg_zj_sr3 = rs.AddLoftSrf([sd_ndg_zj_sr3_curve,rs.MoveObject(rs.CopyObject(sd_ndg_zj_sr3_curve),(0,-2 * x,0))])
sd_ndg_zj_source_point = rs.SurfaceAreaCentroid(rs.ExplodePolysurfaces(sd_ndg_zj_down_Brep)[1])[0]
sd_ndg_zj_up_brep1 = rs.ExtrudeSurface(sd_ndg_zj_sr3,rs.AddLine(sd_ndg_zj_pt_o,rs.MoveObject(rs.CopyObject(sd_ndg_zj_pt_o),(0,0,3.5* x))))
sd_ndg_zj_up_brep2 =rs.MirrorObject(sd_ndg_zj_up_brep1,sd_ndg_zj_source_point,rs.MoveObject(rs.CopyObject(sd_ndg_zj_source_point),(x,0,0)),copy=True)


SanDou_ndg_zj = rs.BooleanDifference(sd_ndg_zj_mid_Brep,sd_ndg_zj_down_Brep,delete_input=True)
SanDou_ndg_zj = rs.BooleanDifference(SanDou_ndg_zj,sd_ndg_zj_up_brep1,delete_input=True)
SanDou_ndg_zj = rs.BooleanDifference(SanDou_ndg_zj,sd_ndg_zj_up_brep2,delete_input=True)
rs.MoveObject(SanDou_ndg_zj ,(HuaGong_CaiFen_left*x-32*x,-2 * x,277.5 * x))


SanDou_ndg_zj1 = rs.BooleanUnion([ndg1_zj,SanDou_ndg_zj],delete_input=False)
SanDou_ndg_zj1_2 = rs.MirrorObject(SanDou_ndg_zj1,hg_zj_pt1,rs.MoveObject(rs.CopyObject(hg_zj_pt1),(0,x,0)),copy=True)
SanDou_ndg_zj1_3 = rs.RotateObject(SanDou_ndg_zj1,hg_zj_pt1,90,[0,0,x],copy=True)
SanDou_ndg_zj1_4 = rs.RotateObject(SanDou_ndg_zj1,hg_zj_pt1,-90,[0,0,x],copy=True)











#转角铺作第二层华拱生成

hg_2_zj_pt1 = rs.CopyObject(ZhuTou_point)
rs.MoveObject(hg_2_zj_pt1,(HuaGong_CaiFen_left * x-32*x,0,262.5 * x))

hg_2_zj_pt2 = rs.CopyObject(hg_2_zj_pt1)
rs.MoveObject(hg_2_zj_pt2,(-(HuaGong_CaiFen_left+21+21) * x,0,0))

hg_2_zj_pt3 = rs.CopyObject(hg_2_zj_pt1)
rs.MoveObject(hg_2_zj_pt3,((HuaGong_CaiFen_left+21+21) * x,0,0))

hg_2_zj_pt2z = rs.CopyObject(hg_2_zj_pt2)
rs.MoveObject(hg_2_zj_pt2z,(0,0,9 * x))

hg_2_zj_pt3z = rs.CopyObject(hg_2_zj_pt3)
rs.MoveObject(hg_2_zj_pt3z,(0,0,9 * x))


hg_2_zj_pt2x = rs.CopyObject(hg_2_zj_pt2)
rs.MoveObject(hg_2_zj_pt2x,(16 * x,0,0))

hg_2_zj_pt3x = rs.CopyObject(hg_2_zj_pt3)
rs.MoveObject(hg_2_zj_pt3x,(-16 * x,0,0))

hg_2_zj_cr1z = rs.AddLine(hg_2_zj_pt2,hg_2_zj_pt2z)

hg_2_zj_cr1x = rs.AddLine(hg_2_zj_pt2x,hg_2_zj_pt2)

#卷杀生成
juansha_2_zj_crs = []

juansha_2_zj_pt1 = rs.DivideCurve(hg_2_zj_cr1z,5)

juansha_2_zj_pt2 = rs.DivideCurve(hg_2_zj_cr1x,5)

for i in range(len(juansha_2_zj_pt1)):
    juansha_2_zj_cr = rs.AddLine(juansha_2_zj_pt1[i],juansha_2_zj_pt2[i])
    juansha_2_zj_crs.append(juansha_2_zj_cr)

juansha_2_zj_crs = juansha_2_zj_crs[1:len(juansha_2_zj_crs)-1]

juansha_2_zj_pts = []

for i in range(len(juansha_2_zj_crs)):
    if i + 1 < len(juansha_2_zj_crs):
        juansha_pt = rs.CurveCurveIntersection(juansha_2_zj_crs[i],juansha_2_zj_crs[i+1])
        juansha_2_zj_pts.append(juansha_pt[0][1])
juansha_2_zj_pts.append(rs.CurveEndPoint(hg_2_zj_cr1z))
juansha_2_zj_pts.append(rs.MoveObject(rs.CopyObject(hg_2_zj_pt2z),(0,0,6 * x)))
juansha_2_zj_pts.append(rs.MoveObject(rs.CopyObject(hg_2_zj_pt2z),(12 * x,0,6 * x)))
juansha_2_zj_pts.insert(0,rs.CurveStartPoint(hg_2_zj_cr1x))

juansha_2_zj_curve = rs.AddPolyline(juansha_2_zj_pts)

#欹幽
#左
qa_2_zj_left_2 = rs.CopyObject(rs.MoveObject(rs.CopyObject(hg_2_zj_pt2z),(12 * x,0,6 * x)))
rs.MoveObject(qa_2_zj_left_2,(2 * x,0,4 * x))
qa_2_zj_curve_left_1 = rs.AddLine(rs.MoveObject(rs.CopyObject(hg_2_zj_pt2z),(12 * x,0,6 * x)),qa_2_zj_left_2)

qa_2_zj_left_3 = rs.CurveMidPoint(qa_2_zj_curve_left_1)
direction_left = (-x, 0, 2 * x)  # 任意方向向量 
distance = 0.5 * x # 移动距离 
# 单位化方向向量并计算实际位移 
unit_vector_left = rs.VectorUnitize(direction_left)
displacement_left = rs.VectorScale(unit_vector_left, distance)
rs.MoveObject(qa_2_zj_left_3, displacement_left)
qa_2_zj_curve_left_1 = rs.AddCurve([rs.MoveObject(rs.CopyObject(hg_2_zj_pt2z),(12 * x,0,6 * x)),qa_2_zj_left_3,qa_2_zj_left_2])
qa_2_zj_curve_left_1 = rs.JoinCurves([qa_2_zj_curve_left_1,rs.AddLine(rs.CurveEndPoint(qa_2_zj_curve_left_1),rs.MoveObject(rs.CurveEndPoint(qa_2_zj_curve_left_1),(0,0,2*x)))])

juansha_2_zj_curve = rs.JoinCurves([juansha_2_zj_curve,qa_2_zj_curve_left_1])

juansha_2_zj_brep_untrimed = rs.MirrorObject(juansha_2_zj_curve,hg_2_zj_pt1,rs.MoveObject(rs.CopyObject(hg_2_zj_pt1),(0,x,0)),copy=True)
rs.MoveObject(juansha_2_zj_brep_untrimed,((HuaGong_CaiFen_left - HuaGong_CaiFen_left)*x,0,0))

juansha_2_zj_brep_untrimed = rs.JoinCurves([juansha_2_zj_curve,juansha_2_zj_brep_untrimed ,rs.AddLine(rs.CurveStartPoint(juansha_2_zj_curve),rs.CurveStartPoint(juansha_2_zj_brep_untrimed)),rs.AddLine(rs.CurveEndPoint(juansha_2_zj_curve),rs.CurveEndPoint(juansha_2_zj_brep_untrimed))])
juansha_2_zj_brep_untrimed = rs.AddPlanarSrf(juansha_2_zj_brep_untrimed)
rs.MoveObject(juansha_2_zj_brep_untrimed,(0,5 * x,0))
juansha_2_zj_brep_untrimed = rs.ExtrudeSurface(juansha_2_zj_brep_untrimed,rs.AddLine(rs.AddPoint(0,0,0),rs.AddPoint(0,-10 * x ,0)))
#拱眼隐去部深1分
#左
gyy_2_zj_cr =rs.AddLine(rs.CurveStartPoint(qa_2_zj_curve_left_1),rs.MoveObject(rs.CurveStartPoint(qa_2_zj_curve_left_1),(0,0,-x)))
gyy_2_zj_cr_1 = rs.RotateObject(gyy_2_zj_cr,rs.CurveEndPoint(gyy_2_zj_cr),90,[0,x,0],copy=True)
gyy_2_zj_cr = rs.AddFilletCurve(gyy_2_zj_cr,gyy_2_zj_cr_1,x)
qa_2_zj_curve_left1 = rs.JoinCurves([qa_2_zj_curve_left_1,gyy_2_zj_cr])

qa_2_zj_curve_left2 = rs.RotateObject(qa_2_zj_curve_left1,rs.CurveEndPoint(qa_2_zj_curve_left1),180,[0,0,x],copy=True)
rs.MoveObject(qa_2_zj_curve_left2,((HuaGong_CaiFen_left +10 -14 - 7.875) * x,0,0))
qa_2_zj_curve_left = rs.JoinCurves([qa_2_zj_curve_left1,qa_2_zj_curve_left2,rs.AddLine(rs.CurveStartPoint(qa_2_zj_curve_left1),rs.CurveStartPoint(qa_2_zj_curve_left2)),rs.AddLine(rs.CurveEndPoint(qa_2_zj_curve_left1),rs.CurveEndPoint(qa_2_zj_curve_left2))])

qa_2_zj_curve_left = rs.AddPlanarSrf(qa_2_zj_curve_left)
qa_2_zj_curve_left_1 = rs.ExtrudeSurface(qa_2_zj_curve_left,rs.AddLine(rs.AddPoint(0,0,0),rs.AddPoint(0,-2 * x,0)))
rs.MoveObject(qa_2_zj_curve_left_1,(0,-4 * x ,0))
qa_2_zj_curve_left_2 = rs.MirrorObject(qa_2_zj_curve_left_1,hg_2_zj_pt1,rs.MoveObject(rs.CopyObject(hg_2_zj_pt1),(x,0,0)),copy=True)

qa_2_zj_curve_right2 =  rs.MirrorObject(qa_2_zj_curve_left2,hg_2_zj_pt1,rs.MoveObject(rs.CopyObject(hg_2_zj_pt1),(0,x,0)),copy=True)
qa_2_zj_curve_right1 =  rs.MirrorObject(qa_2_zj_curve_left1,hg_2_zj_pt1,rs.MoveObject(rs.CopyObject(hg_2_zj_pt1),(0,x,0)),copy=True)
rs.MoveObject(qa_2_zj_curve_right1,((HuaGong_CaiFen_left - HuaGong_CaiFen_left)*x,0,0))

qa_2_zj_curve_right_1 = rs.JoinCurves([qa_2_zj_curve_right1,qa_2_zj_curve_right2,rs.AddLine(rs.CurveStartPoint(qa_2_zj_curve_right1),rs.CurveStartPoint(qa_2_zj_curve_right2)),rs.AddLine(rs.CurveEndPoint(qa_2_zj_curve_right1),rs.CurveEndPoint(qa_2_zj_curve_right2))])
qa_2_zj_curve_right_1 = rs.AddPlanarSrf(qa_2_zj_curve_right_1)
qa_2_zj_curve_right_1 = rs.ExtrudeSurface(qa_2_zj_curve_right_1,rs.AddLine(rs.AddPoint(0,0,0),rs.AddPoint(0,-2 * x,0)))
rs.MoveObject(qa_2_zj_curve_right_1,(0,-4 * x ,0))
qa_2_zj_curve_right_2 = rs.MirrorObject(qa_2_zj_curve_right_1,hg_2_zj_pt1,rs.MoveObject(rs.CopyObject(hg_2_zj_pt1),(x,0,0)),copy=True)

#馒头榫生成
mts_2_zj_pt1 = rs.CopyObject(hg_2_zj_pt2z)
rs.MoveObject(mts_2_zj_pt1,(4.75 * x,-1.25 * x,6 * x))
mts_2_zj1 = rs.AddLine(mts_2_zj_pt1,rs.MoveObject(rs.CopyObject(mts_2_zj_pt1),(2.5 * x,0,0)))
mts_2_zj1 = rs.ExtrudeCurve(mts_2_zj1,rs.AddLine(rs.AddPoint(0,0,0),rs.AddPoint(0,2.5 * x,0)))
mts_2_zj1 = rs.ExtrudeSurface(mts_2_zj1,rs.AddLine(rs.AddPoint(0,0,0),rs.AddPoint(0,0,2.5 * x)))
mts_2_zj2 = rs.MirrorObject(mts_2_zj1,hg_2_zj_pt1,rs.MoveObject(rs.CopyObject(hg_2_zj_pt1),(0,x,0)),copy=True)
rs.MoveObject(mts_2_zj2,((HuaGong_CaiFen_left - HuaGong_CaiFen_left)*x,0,0))

#拱眼插销生成
#拱眼上的插栓,广4分,厚4分,深2.5分
gy_cx_2_zj1 = rs.CopyObject(rs.CurveEndPoint(qa_2_zj_curve_left1))
rs.MoveObject(gy_cx_2_zj1,(rs.Distance(rs.CurveEndPoint(qa_2_zj_curve_left1),rs.CurveEndPoint(qa_2_zj_curve_left2))/2-2*x,-1.25 * x,0))
gy_cx_2_zj1 = rs.AddLine(gy_cx_2_zj1,rs.MoveObject(rs.CopyObject(gy_cx_2_zj1),(4 * x,0,0)))
gy_cx_2_zj1 = rs.ExtrudeCurve(gy_cx_2_zj1,rs.AddLine(rs.AddPoint(0,0,0),rs.AddPoint(0,2.5 * x,0)))
gy_cx_2_zj1 = rs.ExtrudeSurface(gy_cx_2_zj1,rs.AddLine(rs.AddPoint(0,0,0),rs.AddPoint(0,0,4 * x)))



#用于剪切华拱下部的体块

huagong_trimed_brep = rs.ExplodePolysurfaces(JiaoLuDou)[31]
huagong_trimed_brep = rs.CurveStartPoint(rs.DuplicateEdgeCurves(huagong_trimed_brep)[1])
rs.RotateObject(huagong_trimed_brep,hg_2_zj_pt1,-45,[0,0,x])
huagong_trimed_brep = rs.AddLine(huagong_trimed_brep,rs.MoveObject(rs.CopyObject(huagong_trimed_brep),(0,-14 * x,0)))
huagong_trimed_brep_1 = rs.MirrorObject(huagong_trimed_brep,hg_2_zj_pt1,rs.MoveObject(rs.CopyObject(hg_2_zj_pt1),(0,x,0)),copy=True)
huagong_trimed_brep = rs.AddLoftSrf([huagong_trimed_brep,huagong_trimed_brep_1])
huagong_trimed_brep = rs.ExtrudeSurface(huagong_trimed_brep,rs.AddLine(rs.AddPoint(0,0,0),rs.AddPoint(0,0,6 * x)))
rs.MoveObject(huagong_trimed_brep,(0,0,-6 * x))

huagong_trimed_brep2 = rs.CopyObject(hg_2_zj_pt1)
rs.MoveObject(huagong_trimed_brep2,(-5 * x,-6 * x,6 * x))
huagong_trimed_brep2 = rs.AddLine(huagong_trimed_brep2,rs.MoveObject(rs.CopyObject(huagong_trimed_brep2),((10 * x),0,0)))
huagong_trimed_brep2 = rs.ExtrudeCurve(huagong_trimed_brep2,rs.AddLine(rs.AddPoint(0,0,0),rs.AddPoint(0,12 * x,0)))
huagong_trimed_brep2 = rs.ExtrudeSurface(huagong_trimed_brep2,rs.AddLine(rs.AddPoint(0,0,0),rs.AddPoint(0,0,9 * x)))


#华拱剪切
HuaGong1_2_zj = rs.BooleanDifference(juansha_2_zj_brep_untrimed,qa_2_zj_curve_left_1,delete_input=False)
HuaGong1_2_zj = rs.BooleanDifference(HuaGong1_2_zj,qa_2_zj_curve_left_2,delete_input=False)
HuaGong1_2_zj = rs.BooleanIntersection(HuaGong1_2_zj,qa_2_zj_curve_right_1,delete_input=False)
HuaGong1_2_zj = rs.BooleanIntersection(HuaGong1_2_zj,qa_2_zj_curve_right_2,delete_input=False)
HuaGong1_2_zj = rs.BooleanDifference(mts_2_zj1,HuaGong1_2_zj,delete_input=False)
HuaGong1_2_zj = rs.BooleanIntersection(HuaGong1_2_zj,mts_2_zj2,delete_input=False)
HuaGong1_2_zj = rs.BooleanIntersection(HuaGong1_2_zj,gy_cx_2_zj1,delete_input=False)

#
sf_zj1 = rs.CopyObject(HuaGong1_2_zj)

HuaGong1_2_zj = rs.BooleanUnion([HuaGong1_2_zj,huagong_trimed_brep],delete_input=False)
HuaGong1_2_zj = rs.BooleanDifference(huagong_trimed_brep2,HuaGong1_2_zj,delete_input=False)


HuaGong2_zj_brep = rs.RotateObject(HuaGong1_2_zj,hg_zj_pt1,45,[0,0,x],copy=True)
rs.MoveObject(HuaGong2_zj_brep,(0,0,21 * x))
HuaGong2_zj_brep = rs.BooleanDifference(HuaGong2_zj_brep,HuaGong1_zj_brep,delete_input=False)




#第二跳转角铺作华拱的月梁生成

yl_zj_pt1 = rs.CopyObject(hg_zj_pt1)
rs.MoveObject(yl_zj_pt1,((HuaGong_CaiFen_left+12.5 ) * x,-5 * x,42*x + 3.5 * x))

yl_zj_pt2 = rs.CopyObject(yl_zj_pt1)
rs.MoveObject(yl_zj_pt2,(0,-6.875 * x,0))

yl_zj_pt3 = rs.CopyObject(yl_zj_pt2)
rs.MoveObject(yl_zj_pt3,(40 * x,0,0))

yl_zj_pt_y = rs.DivideCurve(rs.AddLine(yl_zj_pt2,yl_zj_pt1),5)
yl_zj_pt_x = rs.DivideCurve(rs.AddLine(yl_zj_pt3,yl_zj_pt2),5)

#月梁卷杀
yl_cross_crs = []
for i in range(len(yl_zj_pt_y)):
    yl_cross_cr = rs.AddLine(yl_zj_pt_y[i],yl_zj_pt_x[i])
    yl_cross_crs.append(yl_cross_cr)

yl_cross_crs = yl_cross_crs[1:len(yl_cross_crs)-1]

yl_cross_pts = []
for i in range(len(yl_cross_crs)):
    if i+1 < len(yl_cross_crs):
        yl_cross_pt = rs.CurveCurveIntersection(yl_cross_crs[i],yl_cross_crs[i+1])
        yl_cross_pts.append(yl_cross_pt[0][1])
yl_cross_pts.append(yl_zj_pt1)
yl_cross_pts.insert(0,yl_zj_pt3)

yl_curve = rs.AddPolyline(yl_cross_pts)
yl_curve_1 = rs.MirrorObjects(yl_curve,hg_2_zj_pt1,rs.MoveObject(rs.CopyObject(hg_2_zj_pt1),(x,0,0)),copy=True)
yl_curve = rs.JoinCurves([yl_curve,yl_curve_1,rs.AddLine(rs.CurveEndPoint(yl_curve),rs.CurveEndPoint(yl_curve_1)),rs.AddLine(rs.CurveStartPoint(yl_curve_1),rs.CurveStartPoint(yl_curve))])
yl_brep1 = rs.AddPlanarSrf(yl_curve)
yl_brep1 = rs.ExtrudeSurface(yl_brep1,rs.AddLine(rs.AddPoint(0,0,0),rs.AddPoint(10 * x,0,-21 * x)))


rs.RotateObject(yl_brep1,hg_zj_pt1,45,[0,0,x],copy=False)

yl_brep2 = rs.RotateObject(yl_brep1,hg_zj_pt1,180,[0,0,x],copy=True)
rs.MoveObjects(yl_brep2 ,(j*x,j*x,-5.5*x))

yl_brep3 = rs.ExplodePolysurfaces(yl_brep1)[1]
yl_brep3_2 = rs.ExplodePolysurfaces(yl_brep2)[1]
yl_brep3 = rs.JoinCurves(rs.DuplicateEdgeCurves(yl_brep3))
yl_brep3_2 = rs.JoinCurves(rs.DuplicateEdgeCurves(yl_brep3_2))
rs.MirrorObject(yl_brep3_2,hg_zj_pt1,rs.MoveObject(rs.CopyObject(hg_zj_pt1),(x,x,0)))

yl_brep3 = rs.AddLoftSrf([yl_brep3,yl_brep3_2])
rs.CapPlanarHoles(yl_brep3)

yl_untrimed_brep = rs.BooleanDifference(yl_brep2,yl_brep3,delete_input=True)
yl_untrimed_brep = rs.BooleanIntersection(yl_brep1,yl_untrimed_brep,delete_input=True)

#月梁卷杀2剪切
yl_zj_pt4 = rs.CopyObject(yl_zj_pt1)
rs.MoveObject(yl_zj_pt4,(2.5 * x,5 * x,-6.5 * x))
yl_zj_pt5 = rs.CopyObject(yl_zj_pt4)
rs.MoveObject(yl_zj_pt5,(0,0,6.5 * x))
yl_zj_pt6 = rs.CopyObject(yl_zj_pt5)
rs.MoveObject(yl_zj_pt6,(14 * x,0,0))

yl_zj_pt_y2 = rs.DivideCurve(rs.AddLine(yl_zj_pt5,yl_zj_pt4),5)
yl_zj_pt_x2 = rs.DivideCurve(rs.AddLine(yl_zj_pt6,yl_zj_pt5),5)

yl_cross_crs2 = []

for i in range(len(yl_zj_pt_y2)):
    yl_cross_cr = rs.AddLine(yl_zj_pt_y2[i],yl_zj_pt_x2[i])
    yl_cross_crs2.append(yl_cross_cr)

yl_cross_crs2 = yl_cross_crs2[1:len(yl_cross_crs2)-1]

yl_cross_pts2 = []
for i in range(len(yl_cross_crs2)):
    if i + 1 < len(yl_cross_crs2):
        yl_cross_pt = rs.CurveCurveIntersection(yl_cross_crs2[i],yl_cross_crs2[i+1])
        yl_cross_pts2.append(yl_cross_pt[0][1])

yl_cross_pts2.insert(0,yl_zj_pt6)
yl_cross_pts2.append(yl_zj_pt4)

yl_curve_up = rs.AddPolyline(yl_cross_pts2)
rs.RotateObject(yl_curve_up,hg_zj_pt1,45,[0,0,x],copy=False)

yl_curve_up_1 = rs.RotateObject(yl_curve_up,hg_zj_pt1,180,[0,0,x],copy=True)
rs.MoveObjects(yl_curve_up_1 ,(j*x,j*x,-5.5*x)) 

yl_curve_up = rs.JoinCurves([yl_curve_up,yl_curve_up_1,rs.AddLine(rs.CurveStartPoint(yl_curve_up),rs.CurveStartPoint(yl_curve_up_1))])

yl_trimed_brep = rs.OffsetCurve(yl_curve_up,[-x,x,0],15*x)
yl_trimed_brep_1 = rs.OffsetCurve(yl_curve_up,[-x,x,0],-15*x)
yl_trimed_brep = rs.AddLoftSrf([yl_trimed_brep,yl_trimed_brep_1])
yl_trimed_brep = rs. ExtrudeSurface(yl_trimed_brep,rs.AddLine(rs.AddPoint(0,0,0),rs.AddPoint(0,0,8 * x)))

yl_trimed_brep2 = rs.MoveObjects(rs.CopyObjects(yl_cross_pts2),(8 * x,0,-11.5 * x))
yl_trimed_brep2 = rs.AddPolyline(yl_trimed_brep2)
rs.ScaleObject(yl_trimed_brep2,rs.MoveObject(rs.CopyObject(yl_zj_pt1),(0,0,-24 * x)),[1,1,0.5],copy=False)

rs.RotateObject(yl_trimed_brep2,hg_zj_pt1,45,[0,0,x],copy=False)

yl_trimed_brep2_1 = rs.RotateObject(yl_trimed_brep2,hg_zj_pt1,180,[0,0,x],copy=True)
rs.MoveObjects(yl_trimed_brep2_1,(j*x,j*x,-5.5*x)) 


yl_trimed_brep2 = rs.JoinCurves([yl_trimed_brep2,yl_trimed_brep2_1,rs.AddLine(rs.CurveStartPoint(yl_trimed_brep2),rs.CurveStartPoint(yl_trimed_brep2_1))])


yl_trimed_brep2 = rs.OffsetCurve(yl_trimed_brep2,[-x,x,0],15*x)
yl_trimed_brep2_1 = rs.OffsetCurve(yl_trimed_brep2,[-x,x,0],-30*x)

yl_trimed_brep2 = rs.AddLoftSrf([yl_trimed_brep2,yl_trimed_brep2_1])
yl_trimed_brep2 = rs. ExtrudeSurface(yl_trimed_brep2,rs.AddLine(rs.AddPoint(0,0,0),rs.AddPoint(0,0,-25 * x)))


yl_brep = rs.BooleanDifference(yl_trimed_brep,yl_untrimed_brep,delete_input=False)[1]
yl_brep = rs.BooleanDifference(yl_brep,yl_trimed_brep2,delete_input=False)







#转角铺作泥道拱生成

ndg_2_zj_pt1 = rs.CopyObject(hg_2_zj_pt1)
ndg_2_zj_pt2 = rs.CopyObject(ndg_2_zj_pt1)
rs.MoveObject(ndg_2_zj_pt2,(-(HuaGong_CaiFen_left + 21) * x,0,0))
ndg_2_zj_ptz = rs.MoveObject(rs.CopyObject(ndg_2_zj_pt2),(0,0,9 * x))
ndg_2_zj_ptx = rs.MoveObject(rs.CopyObject(ndg_2_zj_pt2),(14 * x,0,0))

ndg_2_zj_crz = rs.AddLine(ndg_2_zj_pt2,ndg_2_zj_ptz)
ndg_2_zj_crx = rs.AddLine(ndg_2_zj_ptx,ndg_2_zj_pt2)

#卷杀生成

juansha_ndg_2_zj_crs = []

ndg_2_zj_ptsz = rs.DivideCurve(ndg_2_zj_crz,5)
ndg_2_zj_ptsx = rs.DivideCurve(ndg_2_zj_crx,5)
for i in range(len(ndg_2_zj_ptsz)):
    juansha_ndg_2_zj_cr = rs.AddLine(ndg_2_zj_ptsz[i],ndg_2_zj_ptsx[i])
    juansha_ndg_2_zj_crs.append(juansha_ndg_2_zj_cr)

juansha_ndg_2_zj_crs = juansha_ndg_2_zj_crs[1:len(juansha_ndg_2_zj_crs)-1]

juansha_ndg_2_zj_pts = []

for i in range(len(juansha_ndg_2_zj_crs)):
    if i + 1 < len(juansha_ndg_2_zj_crs):
        juansha_ndg_pt = rs.CurveCurveIntersection(juansha_ndg_2_zj_crs[i],juansha_ndg_2_zj_crs[i+1])
        juansha_ndg_2_zj_pts.append(juansha_ndg_pt[0][1])
juansha_ndg_2_zj_pts.append(rs.CurveEndPoint(ndg_2_zj_crz))
juansha_ndg_2_zj_pts.append(rs.MoveObject(rs.CopyObject(ndg_2_zj_ptz),(0,0,6 * x)))
juansha_ndg_2_zj_pts.append(rs.MoveObject(rs.CopyObject(ndg_2_zj_ptz),(10 * x,0,6 * x)))
juansha_ndg_2_zj_pts.insert(0,rs.CurveStartPoint(ndg_2_zj_crx ))

juansha_ndg_2_zj_curve = rs.AddPolyline(juansha_ndg_2_zj_pts)
juansha_ndg_2_zj_curve_1 = rs.MirrorObject(juansha_ndg_2_zj_curve,hg_2_zj_pt1,rs.MoveObject(rs.CopyObject(hg_2_zj_pt1),(0,x,0)),copy=True)

juansha_ndg_2_zj_curve = rs.JoinCurves([juansha_ndg_2_zj_curve,juansha_ndg_2_zj_curve_1,rs.AddLine(rs.CurveStartPoint(juansha_ndg_2_zj_curve),rs.CurveStartPoint(juansha_ndg_2_zj_curve_1)),rs.AddLine(rs.CurveEndPoint(juansha_ndg_2_zj_curve),rs.CurveEndPoint(juansha_ndg_2_zj_curve_1))])

ndg_untrimed_brep = rs.AddPlanarSrf(juansha_ndg_2_zj_curve)
rs.MoveObject(ndg_untrimed_brep,(0,-5 * x,0))
ndg_untrimed_brep = rs.ExtrudeSurface(ndg_untrimed_brep,rs.AddLine(rs.AddPoint(0,0,0),rs.AddPoint(0,10 * x,0)))

#泥道栱的馒头榫
mts_ndg_2_zj = rs.MoveObject(rs.CopyObject(ndg_2_zj_ptz),(3.75 * x,-1.25 * x,6 * x))
mts_ndg_2_zj = rs.AddLine(mts_ndg_2_zj,rs.MoveObject(rs.CopyObject(mts_ndg_2_zj),(2.5 * x,0,0)))
mts_ndg_2_zj = rs.ExtrudeCurve(mts_ndg_2_zj,rs.AddLine(rs.AddPoint(0,0,0),rs.AddPoint(0,2.5 * x,0)))
mts_ndg_2_zj = rs.ExtrudeSurface(mts_ndg_2_zj,rs.AddLine(rs.AddPoint(0,0,0),rs.AddPoint(0,0,2.5 * x)))
mts_ndg_2_zj2 = rs.MirrorObject(mts_ndg_2_zj,hg_2_zj_pt1,rs.MoveObject(rs.CopyObject(hg_2_zj_pt1),(0,x,0)),copy=True)
ndg_untrimed_brep = rs.BooleanDifference(mts_ndg_2_zj,ndg_untrimed_brep,delete_input=False)
ndg_untrimed_brep = rs.BooleanIntersection(mts_ndg_2_zj2,ndg_untrimed_brep,delete_input=False)

#泥道拱剪切

##拱眼隐去部深1分
#左
gyy_2_zj_cr_ndg = rs.CopyObject(ndg_2_zj_ptz)
rs.MoveObject(gyy_2_zj_cr_ndg,(10 * x,0,6 * x))
gyy_2_zj_cr_ndg_1 = rs.MoveObject(rs.CopyObject(gyy_2_zj_cr_ndg),(0,0,-x))
gyy_2_zj_cr_ndg_2 = rs.MoveObject(rs.CopyObject(gyy_2_zj_cr_ndg),(x,0,-x))
gyy_2_zj_cr_ndg_1_cr = rs.AddLine(gyy_2_zj_cr_ndg_1,gyy_2_zj_cr_ndg)
gyy_2_zj_cr_ndg_2_cr = rs.AddLine(gyy_2_zj_cr_ndg_2,gyy_2_zj_cr_ndg_1)
gyy_2_zj_cr_ndg = rs.AddFilletCurve(gyy_2_zj_cr_ndg_1_cr,gyy_2_zj_cr_ndg_2_cr,x)
gyy_2_zj_cr_ndg2 = rs.RotateObject(gyy_2_zj_cr_ndg,rs.CurveStartPoint(gyy_2_zj_cr_ndg),180,[0,0,x],copy=True)
rs.MoveObject(gyy_2_zj_cr_ndg2,((HuaGong_CaiFen_left +10 +15 -14 - 7.875) * x,0,0))
gyy_2_zj_ndg = rs.AddLoftSrf([gyy_2_zj_cr_ndg,gyy_2_zj_cr_ndg2])
gyy_2_zj_ndg = rs.ExtrudeSurface(gyy_2_zj_ndg,rs.AddLine(rs.AddPoint(0,0,0),rs.AddPoint(0,-2 * x,0)))
rs.MoveObject(gyy_2_zj_ndg,(0,-4 * x,0))
gyy_2_zj_ndg2 = rs.MirrorObject(gyy_2_zj_ndg,hg_2_zj_pt1,rs.MoveObject(rs.CopyObject(hg_2_zj_pt1),(0,x,0)),copy=True)
gyy_2_zj_ndg3 = rs.MirrorObject(gyy_2_zj_ndg,hg_2_zj_pt1,rs.MoveObject(rs.CopyObject(hg_2_zj_pt1),(x,0,0)),copy=True)
gyy_2_zj_ndg4 = rs.MirrorObject(gyy_2_zj_ndg2,hg_2_zj_pt1,rs.MoveObject(rs.CopyObject(hg_2_zj_pt1),(x,0,0)),copy=True)



#泥道拱下部剪切
ndg_trimed_brep = rs.CopyObject(hg_2_zj_pt1)
rs.MoveObject(ndg_trimed_brep,(-5 * x,0,0))
ndg_trimed_brep = rs.AddLine(ndg_trimed_brep,rs.MoveObject(rs.CopyObject(ndg_trimed_brep),(10 * x,0,0)))
ndg_trimed_brep = rs.ExtrudeCurve(ndg_trimed_brep,rs.AddLine(rs.AddPoint(0,0,0),rs.AddPoint(0,-10 * x,0)))
ndg_trimed_brep = rs.ExtrudeSurface(ndg_trimed_brep,rs.AddLine(rs.AddPoint(0,0,0),rs.AddPoint(0,0,7.5 * x)))
rs.MoveObject(ndg_trimed_brep,(0,5 * x,7.5 * x))
ndg_trimed_brep2 = rs.RotateObject(ndg_untrimed_brep,hg_2_zj_pt1,45,[0,0,x],copy=True)
rs.MoveObject(ndg_trimed_brep2,(0,0,7.5 * x))
ndg_trimed_brep3 = rs.MoveObject(rs.CopyObject(ndg_trimed_brep),(0,0,-7.5 * x))
ndg_trimed_brep4 = rs.RotateObject(ndg_untrimed_brep,hg_2_zj_pt1,45,[0,0,x],copy=True)
rs.MoveObject(ndg_trimed_brep4,(0,0,-7.5 * x))

ndg1_2_zj = rs.BooleanUnion([gyy_2_zj_ndg,gyy_2_zj_ndg2,gyy_2_zj_ndg3,gyy_2_zj_ndg4,ndg_untrimed_brep],delete_input=False)

ang1_tail1 = rs.CopyObject(ndg1_2_zj)
ndg1_2_zj2 = rs.RotateObject(ndg1_2_zj,hg_2_zj_pt1,90,[0,0,x],copy=True)


ndg1_2_zj = rs.BooleanUnion([ndg1_2_zj,ndg_trimed_brep],delete_input=False)
ndg1_2_zj = rs.BooleanDifference(ndg_trimed_brep2,ndg1_2_zj,delete_input=False)

ndg1_2_zj2 = rs.BooleanUnion([ndg1_2_zj2,ndg_trimed_brep3],delete_input=False)
ndg1_2_zj2 = rs.BooleanDifference(ndg_trimed_brep4,ndg1_2_zj2,delete_input=False)

#内檐第二层泥道拱剪切

ndg1_2_zj3 = rs.CopyObject(ndg1_2_zj)
ndg1_2_zj4 = rs.CopyObject(ndg1_2_zj2)

#剪切的体

ndg_trimed_brep5 = rs.CopyObject(hg_zj_pt1)
rs.MoveObject(ndg_trimed_brep5,(6 * x,-(HuaGong_CaiFen_left+2)*x,0))
ndg_trimed_brep5 = rs.AddLine(ndg_trimed_brep5,rs.MoveObject(rs.CopyObject(ndg_trimed_brep5),(-12 * x ,0 ,0)))
ndg_trimed_brep5 = rs.ExtrudeCurve(ndg_trimed_brep5,rs.AddLine(rs.AddPoint(0,0,0),(0,-30 * x,0)))
ndg_trimed_brep5 = rs.ExtrudeSurface(ndg_trimed_brep5,rs.AddLine(rs.AddPoint(0,0,0),(0,0,20 * x)))

ndg_trimed_brep6 = rs.RotateObject(ndg_trimed_brep5,hg_2_zj_pt1,-90,[0,0,x],copy=True)

ndg1_2_zj3 = rs.BooleanIntersection(ndg1_2_zj3,ndg_trimed_brep6,delete_input=False)
ndg1_2_zj4 = rs.BooleanIntersection(ndg1_2_zj4,ndg_trimed_brep5,delete_input=False)

rs.MoveObjects([ndg1_2_zj,ndg1_2_zj2,ndg1_2_zj3,ndg1_2_zj4],(0,0,21 * x))

rs.MoveObjects([ndg1_2_zj3,ndg1_2_zj4],(j*x,j*x,-5.5*x))



#佛光寺东大殿第二层华拱上的平盘斗

x = CaiFen
#散斗,深12分,广10分,华拱/散斗.深10分,广12分,泥道栱
sd_2_zj_pt_o = rs.AddPoint(0,0,0)
sd_2_zj_pt2 = rs.AddPoint(12 * x,0,0)
sd_2_zj_pt_z1 = rs.AddPoint(- 2 * x,0, 4 * x)
sd_2_zj_cr_1 = rs.AddLine(sd_2_zj_pt_o,sd_2_zj_pt_z1)
#散斗,欹
sd_2_zj_pt_z2 = rs.CurveMidPoint(sd_2_zj_cr_1)
direction_left = (x, 0, 2 * x)  # 任意方向向量 
distance = 0.5 * x # 移动距离 
# 单位化方向向量并计算实际位移 
unit_vector_left = rs.VectorUnitize(direction_left)
displacement_left = rs.VectorScale(unit_vector_left, distance)
rs.MoveObject(sd_2_zj_pt_z2, displacement_left)
sd_2_zj_cr_1 = rs.AddCurve([sd_2_zj_pt_o,sd_2_zj_pt_z2,sd_2_zj_pt_z1])
sd_2_zj_pt_3 = rs.MoveObject(rs.CopyObject(sd_2_zj_pt_o),(0,2 * x,0))
sd_2_zj_sr1 = rs.AddLine(sd_2_zj_pt_3,rs.MoveObject(rs.CopyObject(sd_2_zj_pt_3),(-2 * x,-2 * x,0)))
sd_2_zj_sr1 = rs.AddLoftSrf([sd_2_zj_sr1,rs.MoveObject(rs.CopyObject(sd_2_zj_sr1),(0,0,4* x))])
sd_2_zj_cr_1 =rs.ProjectCurveToSurface(sd_2_zj_cr_1,sd_2_zj_sr1,[0,1,0])
sd_2_zj_cr_2 = rs.MoveObject(rs.CopyObject(sd_2_zj_cr_1),(0,10 * x,0 ))
sd_2_zj_cr_2 = rs.RotateObject(sd_2_zj_cr_2, rs.CurveStartPoint(sd_2_zj_cr_2),-90,[0,0,1],copy=True)
sd_2_zj_cr_3 = rs.MoveObject(rs.CopyObject(sd_2_zj_cr_2),(12 * x,0,0 ))
sd_2_zj_cr_3 = rs.RotateObject(sd_2_zj_cr_3, rs.CurveStartPoint(sd_2_zj_cr_3),-90,[0,0,1],copy=True)
sd_2_zj_cr_4 = rs.MoveObject(rs.CopyObject(sd_2_zj_cr_1),(12 * x,0,0 ))
sd_2_zj_cr_4 = rs.RotateObject(sd_2_zj_cr_4, rs.CurveStartPoint(sd_2_zj_cr_4),90,[0,0,1],copy=True)
sd_2_zj_down_Brep = rs.AddLoftSrf([sd_2_zj_cr_1,sd_2_zj_cr_2,sd_2_zj_cr_3,sd_2_zj_cr_4],loft_type=2,closed=True)
rs.CapPlanarHoles(sd_2_zj_down_Brep)





#散斗,平
sd_2_zj_sr2 = rs.ExplodePolysurfaces(sd_2_zj_down_Brep)
sd_2_zj_sr2 = sd_2_zj_sr2[2]
sd_2_zj_mid_Brep = rs.ExtrudeSurface(sd_2_zj_sr2,rs.AddLine(rs.CurveEndPoint(sd_2_zj_cr_2),rs.MoveObject(rs.CurveEndPoint(sd_2_zj_cr_2),(0,0,2 * x))))



SanDou_ppd = rs.BooleanDifference(sd_2_zj_mid_Brep,sd_2_zj_down_Brep,delete_input=False)
rs.MoveObject(SanDou_ppd,((HuaGong_CaiFen_left-42-32)* x,-2 * x,(277.5+21) * x))
rs.RotateObject(SanDou_ppd,hg_zj_pt1,45,[0,0,x],copy=False)

#平盘斗剪切
SanDou_ppd = rs.BooleanUnion([HuaGong2_zj_brep,SanDou_ppd] ,delete_input = False)



#转角铺作泥道栱上的散斗

SanDou_ndg_zj2_1 =rs.CopyObject(SanDou_ndg_zj1)
rs.MoveObject(SanDou_ndg_zj2_1,(-21 * x,0,21 * x))
rs.RotateObject(SanDou_ndg_zj2_1,hg_zj_pt1,-90,[0,0,x],copy=False)
SanDou_ndg_zj2_2 = rs.RotateObject(SanDou_ndg_zj2_1,hg_zj_pt1,-90,[0,0,x],copy=True)
SanDou_ndg_zj2_3 = rs.CopyObject(SanDou_ndg_zj2_1)
SanDou_ndg_zj2_4 = rs.CopyObject(SanDou_ndg_zj2_2)
rs.MoveObjects([SanDou_ndg_zj2_3,SanDou_ndg_zj2_4],(j*x,j*x,-5.5*x))




#转角铺作泥道栱上的交互斗

#交互斗.深12分,广10分
jhd_zj_pt_o = rs.AddPoint(0,0,0)
jhd_zj_pt2 = rs.AddPoint(12 * x,0,0)
#交互斗,欹,厚4分
jhd_zj_pt_z1 = rs.AddPoint(-2 * x,0, 4 * x)
jhd_zj_cr_1 = rs.AddLine(jhd_zj_pt_o,jhd_zj_pt_z1)

jhd_zj_cr_6 = rs.AddLine(jhd_zj_pt_o,jhd_zj_pt_z1)

jhd_zj_pt_z2 = rs.CurveMidPoint(jhd_zj_cr_1)
direction_left = (x, 0, 2 * x)  # 任意方向向量 
distance = 0.5 * x # 移动距离 
# 单位化方向向量并计算实际位移 
unit_vector_left = rs.VectorUnitize(direction_left)
displacement_left = rs.VectorScale(unit_vector_left, distance)
rs.MoveObject(jhd_zj_pt_z2, displacement_left)
jhd_zj_cr_1 = rs.AddCurve([jhd_zj_pt_o,jhd_zj_pt_z2,jhd_zj_pt_z1])
jhd_zj_pt_3 = rs.MoveObject(rs.CopyObject(jhd_zj_pt_o),(0,2 * x,0))
jhd_zj_sr1 = rs.AddLine(jhd_zj_pt_3,rs.MoveObject(rs.CopyObject(jhd_zj_pt_3),(-4.5 * x,-4.5 * x,0)))
jhd_zj_sr1 = rs.AddLoftSrf([jhd_zj_sr1,rs.MoveObject(rs.CopyObject(jhd_zj_sr1),(0,0,8.5 * x))])
jhd_zj_cr_1 =rs.ProjectCurveToSurface(jhd_zj_cr_1,jhd_zj_sr1,[0,1,0])
jhd_zj_cr_2 = rs.MoveObject(rs.CopyObject(jhd_zj_cr_1),(0,10 * x,0 ))
jhd_zj_cr_2 = rs.RotateObject(jhd_zj_cr_2, rs.CurveStartPoint(jhd_zj_cr_2),-90,[0,0,1],copy=True)
jhd_zj_cr_3 = rs.MoveObject(rs.CopyObject(jhd_zj_cr_2),(10 * x,0,0 ))
jhd_zj_cr_3 = rs.RotateObject(jhd_zj_cr_3, rs.CurveStartPoint(jhd_zj_cr_3),-90,[0,0,1],copy=True)
jhd_zj_cr_4 = rs.MoveObject(rs.CopyObject(jhd_zj_cr_1),(10 * x,0,0 ))
jhd_zj_cr_4 = rs.RotateObject(jhd_zj_cr_4, rs.CurveStartPoint(jhd_zj_cr_4),90,[0,0,1],copy=True)
jhd_zj_down_Brep = rs.AddLoftSrf([jhd_zj_cr_1,jhd_zj_cr_2,jhd_zj_cr_3,jhd_zj_cr_4],loft_type=2,closed=True)
rs.CapPlanarHoles(jhd_zj_down_Brep)
#交互斗,平,厚2分
jhd_zj_sr2 = rs.ExplodePolysurfaces(jhd_zj_down_Brep)
jhd_zj_sr2 = jhd_zj_sr2[2]
JiaoHuDou_zj_center_point = rs.SurfaceAreaCentroid(rs.ExplodePolysurfaces(jhd_zj_down_Brep)[1])
JiaoHuDou_zj_center_point = rs.AddPoint(JiaoHuDou_zj_center_point[0])
jhd_zj_mid_Brep = rs.ExtrudeSurface(jhd_zj_sr2,rs.AddLine(rs.CurveEndPoint(jhd_zj_cr_2),rs.MoveObject(rs.CurveEndPoint(jhd_zj_cr_2),(0,0, 2* x))))
#交互斗,耳,厚3.5分
jhd_zj_up_brep1 = rs.CopyObject(rs.CurveEndPoint(jhd_zj_cr_1))
rs.MoveObject(jhd_zj_up_brep1,(0,0,2 * x))
jhd_zj_up_brep1 = rs.AddLine(jhd_zj_up_brep1,rs.MoveObject(rs.CopyObject(jhd_zj_up_brep1),(2 * x,0,0)))
jhd_zj_up_brep1 = rs.ExtrudeCurve(jhd_zj_up_brep1,rs.AddLine(jhd_zj_pt_o,rs.MoveObject(rs.CopyObject(jhd_zj_pt_o),(0, 2 * x,0))))
jhd_zj_up_brep1 = rs.ExtrudeSurface(jhd_zj_up_brep1,rs.AddLine(jhd_zj_pt_o,rs.MoveObject(rs.CopyObject(jhd_zj_pt_o),(0,0,3.5 * x))))
jhd_zj_up_brep2 = rs.MirrorObject(jhd_zj_up_brep1,JiaoHuDou_zj_center_point,rs.MoveObject(rs.CopyObject(JiaoHuDou_zj_center_point),(x,0,0)),copy=True)
jhd_zj_up_brep3 = rs.MirrorObject(jhd_zj_up_brep2,JiaoHuDou_zj_center_point,rs.MoveObject(rs.CopyObject(JiaoHuDou_zj_center_point),(0,x,0)),copy=True)
jhd_zj_up_brep4 = rs.MirrorObject(jhd_zj_up_brep3,JiaoHuDou_zj_center_point,rs.MoveObject(rs.CopyObject(JiaoHuDou_zj_center_point),(x,0,0)),copy=True)





JiaoHuDou_zj = rs.BooleanDifference(jhd_zj_mid_Brep,jhd_zj_down_Brep,delete_input=False)
JiaoHuDou_zj = rs.BooleanIntersection(JiaoHuDou_zj,jhd_zj_up_brep1,delete_input=False)
JiaoHuDou_zj = rs.BooleanIntersection(JiaoHuDou_zj,jhd_zj_up_brep2,delete_input=False)
JiaoHuDou_zj = rs.BooleanIntersection(JiaoHuDou_zj,jhd_zj_up_brep3,delete_input=False)
JiaoHuDou_zj = rs.BooleanIntersection(JiaoHuDou_zj,jhd_zj_up_brep4,delete_input=False)

rs.MoveObject(JiaoHuDou_zj,((HuaGong_CaiFen_left-42-11)* x,-2 * x,(277.5+21) * x))

JiaoHuDou_zj1 = rs.BooleanUnion([ndg1_2_zj,JiaoHuDou_zj],delete_input=False)
JiaoHuDou_zj2 = rs.RotateObject(JiaoHuDou_zj1,hg_zj_pt1,90,[0,0,x],copy=True)

#内檐铺作第三层华拱的散斗

SanDou_ndg_zj3_1 = rs.MoveObject(rs.CopyObject(SanDou_1),(-15*x,-15*x,21*x))
rs.RotateObject(SanDou_ndg_zj3_1,hg_zj_pt1,180,[0,0,x],copy=False)
rs.MoveObject(SanDou_ndg_zj3_1,(j*x,j*x,-5.5*x))






#第二跳华拱剪切
huagong_trimed = rs.CopyObject(yl_trimed_brep2)
rs.MoveObject(huagong_trimed,(0,0,18 * x))

HuaGong2_zj_brep = rs.BooleanDifference(HuaGong2_zj_brep,huagong_trimed,delete_input=False)
HuaGong2_zj_brep = rs.BooleanDifference(HuaGong2_zj_brep,HuaGong1_zj_brep,delete_input=False)

#月梁剪切


HuaGong2_zj_brep2 = rs.CopyObject(HuaGong2_zj_brep)

rs.RotateObjects(HuaGong2_zj_brep2,hg_zj_pt1,180,[0,0,x])
rs.MoveObjects(HuaGong2_zj_brep2,(j*x,j*x,-5.5*x))

yl_brep = rs.BooleanDifference(yl_brep,rs.CopyObject(HuaGong2_zj_brep),delete_input=True)
yl_brep = rs.BooleanDifference(yl_brep,HuaGong2_zj_brep2,delete_input=True)




#瓜子栱-连栱交隐

gzg_lgjy_2_zj_pt1 = rs.CopyObject(hg_2_zj_pt1)
gzg_lgjy_2_zj_pt2 = rs.CopyObject(gzg_lgjy_2_zj_pt1)
rs.MoveObject(gzg_lgjy_2_zj_pt2,(-(HuaGong_CaiFen_left-3) * x,0,0))
gzg_lgjy_2_zj_ptz = rs.MoveObject(rs.CopyObject(gzg_lgjy_2_zj_pt2),(0,0,9 * x))
gzg_lgjy_2_zj_ptx = rs.MoveObject(rs.CopyObject(gzg_lgjy_2_zj_pt2),(16 * x,0,0))

gzg_lgjy_2_zj_crz = rs.AddLine(gzg_lgjy_2_zj_pt2,gzg_lgjy_2_zj_ptz)
gzg_lgjy_2_zj_crx = rs.AddLine(gzg_lgjy_2_zj_ptx,gzg_lgjy_2_zj_pt2)

#卷杀生成

juansha_gzg_lgjy_2_zj_crs = []

gzg_lgjy_2_zj_ptsz = rs.DivideCurve(gzg_lgjy_2_zj_crz,5)
gzg_lgjy_2_zj_ptsx = rs.DivideCurve(gzg_lgjy_2_zj_crx,5)
for i in range(len(gzg_lgjy_2_zj_ptsz)):
    juansha_gzg_lgjy_2_zj_cr = rs.AddLine(gzg_lgjy_2_zj_ptsz[i],gzg_lgjy_2_zj_ptsx[i])
    juansha_gzg_lgjy_2_zj_crs.append(juansha_gzg_lgjy_2_zj_cr)

juansha_gzg_lgjy_2_zj_crs = juansha_gzg_lgjy_2_zj_crs[1:len(juansha_gzg_lgjy_2_zj_crs)-1]

juansha_gzg_lgjy_2_zj_pts = []

for i in range(len(juansha_gzg_lgjy_2_zj_crs)):
    if i + 1 < len(juansha_gzg_lgjy_2_zj_crs):
        juansha_gzg_lgjy_pt = rs.CurveCurveIntersection(juansha_gzg_lgjy_2_zj_crs[i],juansha_gzg_lgjy_2_zj_crs[i+1])
        juansha_gzg_lgjy_2_zj_pts.append(juansha_gzg_lgjy_pt[0][1])
juansha_gzg_lgjy_2_zj_pts.append(rs.CurveEndPoint(gzg_lgjy_2_zj_crz))
juansha_gzg_lgjy_2_zj_pts.append(rs.MoveObject(rs.CopyObject(gzg_lgjy_2_zj_ptz),(0,0,6 * x)))
juansha_gzg_lgjy_2_zj_pts.append(rs.MoveObject(rs.CopyObject(gzg_lgjy_2_zj_ptz),(10 * x,0,6 * x)))
juansha_gzg_lgjy_2_zj_pts.insert(0,rs.CurveStartPoint(gzg_lgjy_2_zj_crx ))

juansha_gzg_lgjy_2_zj_curve = rs.AddPolyline(juansha_gzg_lgjy_2_zj_pts)
juansha_gzg_lgjy_2_zj_curve_1 = rs.MirrorObject(juansha_gzg_lgjy_2_zj_curve,hg_2_zj_pt1,rs.MoveObject(rs.CopyObject(hg_2_zj_pt1),(0,x,0)),copy=True)

juansha_gzg_lgjy_2_zj_curve = rs.JoinCurves([juansha_gzg_lgjy_2_zj_curve,juansha_gzg_lgjy_2_zj_curve_1,rs.AddLine(rs.CurveStartPoint(juansha_gzg_lgjy_2_zj_curve),rs.CurveStartPoint(juansha_gzg_lgjy_2_zj_curve_1)),rs.AddLine(rs.CurveEndPoint(juansha_gzg_lgjy_2_zj_curve),rs.CurveEndPoint(juansha_gzg_lgjy_2_zj_curve_1))])

gzg_lgjy_untrimed_brep = rs.AddPlanarSrf(juansha_gzg_lgjy_2_zj_curve)
rs.MoveObject(gzg_lgjy_untrimed_brep,(0,-5 * x,0))
gzg_lgjy_untrimed_brep = rs.ExtrudeSurface(gzg_lgjy_untrimed_brep,rs.AddLine(rs.AddPoint(0,0,0),rs.AddPoint(0,10 * x,0)))

#泥道栱的馒头榫
mts_gzg_lgjy_2_zj = rs.MoveObject(rs.CopyObject(gzg_lgjy_2_zj_ptz),(3.75 * x,-1.25 * x,6 * x))
mts_gzg_lgjy_2_zj = rs.AddLine(mts_gzg_lgjy_2_zj,rs.MoveObject(rs.CopyObject(mts_gzg_lgjy_2_zj),(2.5 * x,0,0)))
mts_gzg_lgjy_2_zj = rs.ExtrudeCurve(mts_gzg_lgjy_2_zj,rs.AddLine(rs.AddPoint(0,0,0),rs.AddPoint(0,2.5 * x,0)))
mts_gzg_lgjy_2_zj = rs.ExtrudeSurface(mts_gzg_lgjy_2_zj,rs.AddLine(rs.AddPoint(0,0,0),rs.AddPoint(0,0,2.5 * x)))
mts_gzg_lgjy_2_zj2 = rs.MirrorObject(mts_gzg_lgjy_2_zj,hg_2_zj_pt1,rs.MoveObject(rs.CopyObject(hg_2_zj_pt1),(0,x,0)),copy=True)
gzg_lgjy_untrimed_brep = rs.BooleanDifference(mts_gzg_lgjy_2_zj,gzg_lgjy_untrimed_brep,delete_input=False)
gzg_lgjy_untrimed_brep = rs.BooleanIntersection(mts_gzg_lgjy_2_zj2,gzg_lgjy_untrimed_brep,delete_input=False)

#泥道拱剪切

##拱眼隐去部深1分
#左
gyy_2_zj_cr_gzg_lgjy = rs.CopyObject(gzg_lgjy_2_zj_ptz)
rs.MoveObject(gyy_2_zj_cr_gzg_lgjy,(10 * x,0,6 * x))
gyy_2_zj_cr_gzg_lgjy_1 = rs.MoveObject(rs.CopyObject(gyy_2_zj_cr_gzg_lgjy),(0,0,-x))
gyy_2_zj_cr_gzg_lgjy_2 = rs.MoveObject(rs.CopyObject(gyy_2_zj_cr_gzg_lgjy),(x,0,-x))
gyy_2_zj_cr_gzg_lgjy_1_cr = rs.AddLine(gyy_2_zj_cr_gzg_lgjy_1,gyy_2_zj_cr_gzg_lgjy)
gyy_2_zj_cr_gzg_lgjy_2_cr = rs.AddLine(gyy_2_zj_cr_gzg_lgjy_2,gyy_2_zj_cr_gzg_lgjy_1)
gyy_2_zj_cr_gzg_lgjy = rs.AddFilletCurve(gyy_2_zj_cr_gzg_lgjy_1_cr,gyy_2_zj_cr_gzg_lgjy_2_cr,x)
gyy_2_zj_cr_gzg_lgjy2 = rs.RotateObject(gyy_2_zj_cr_gzg_lgjy,rs.CurveStartPoint(gyy_2_zj_cr_gzg_lgjy),180,[0,0,x],copy=True)
rs.MoveObject(gyy_2_zj_cr_gzg_lgjy2,((21 - 7.875) * x,0,0))
gyy_2_zj_gzg_lgjy = rs.AddLoftSrf([gyy_2_zj_cr_gzg_lgjy,gyy_2_zj_cr_gzg_lgjy2])
gyy_2_zj_gzg_lgjy = rs.ExtrudeSurface(gyy_2_zj_gzg_lgjy,rs.AddLine(rs.AddPoint(0,0,0),rs.AddPoint(0,-2 * x,0)))
rs.MoveObject(gyy_2_zj_gzg_lgjy,(0,-4 * x,0))
gyy_2_zj_gzg_lgjy2 = rs.MirrorObject(gyy_2_zj_gzg_lgjy,hg_2_zj_pt1,rs.MoveObject(rs.CopyObject(hg_2_zj_pt1),(0,x,0)),copy=True)
gyy_2_zj_gzg_lgjy3 = rs.MirrorObject(gyy_2_zj_gzg_lgjy,hg_2_zj_pt1,rs.MoveObject(rs.CopyObject(hg_2_zj_pt1),(x,0,0)),copy=True)
gyy_2_zj_gzg_lgjy4 = rs.MirrorObject(gyy_2_zj_gzg_lgjy2,hg_2_zj_pt1,rs.MoveObject(rs.CopyObject(hg_2_zj_pt1),(x,0,0)),copy=True)



#瓜子下部剪切
gzg_lgjy_trimed_brep = rs.CopyObject(hg_2_zj_pt1)
rs.MoveObject(gzg_lgjy_trimed_brep,(-5 * x,0,0))
gzg_lgjy_trimed_brep = rs.AddLine(gzg_lgjy_trimed_brep,rs.MoveObject(rs.CopyObject(gzg_lgjy_trimed_brep),(10 * x,0,0)))
gzg_lgjy_trimed_brep = rs.ExtrudeCurve(gzg_lgjy_trimed_brep,rs.AddLine(rs.AddPoint(0,0,0),rs.AddPoint(0,-10 * x,0)))
gzg_lgjy_trimed_brep = rs.ExtrudeSurface(gzg_lgjy_trimed_brep,rs.AddLine(rs.AddPoint(0,0,0),rs.AddPoint(0,0,7.5 * x)))
rs.MoveObject(gzg_lgjy_trimed_brep,(0,5 * x,7.5 * x))
gzg_lgjy_trimed_brep2 = rs.RotateObject(gzg_lgjy_untrimed_brep,hg_2_zj_pt1,45,[0,0,x],copy=True)
rs.MoveObject(gzg_lgjy_trimed_brep2,(0,0,7.5 * x))
gzg_lgjy_trimed_brep3 = rs.CopyObject(gzg_lgjy_trimed_brep)
rs.MoveObject(gzg_lgjy_trimed_brep3,(0,0,-3.75* x ))

gzg_lgjy_trimed_brep4 = rs.CopyObject(gzg_lgjy_trimed_brep3)
rs.MoveObject(gzg_lgjy_trimed_brep4,(0,0,-7.5* x ))



gzg_lgjy1_2_zj = rs.BooleanUnion([gyy_2_zj_gzg_lgjy,gyy_2_zj_gzg_lgjy2,gyy_2_zj_gzg_lgjy3,gyy_2_zj_gzg_lgjy4,gzg_lgjy_untrimed_brep],delete_input=False)



gzg_lgjy1_2_zj2 = rs.RotateObject(gzg_lgjy1_2_zj,hg_2_zj_pt1,90,[0,0,x],copy=True)



gzg_lgjy1_2_zj = rs.BooleanUnion([gzg_lgjy1_2_zj,gzg_lgjy_trimed_brep],delete_input=False)







#瓜子拱合并
gzg_lgjy_union1 = rs.MoveObject(rs.CopyObject(gzg_lgjy1_2_zj),((32 - HuaGong_CaiFen_left) * x,-(HuaGong_CaiFen_left+(16))*x,42*x))
gzg_lgjy_union2 = rs.RotateObject(gzg_lgjy_union1,hg_2_zj_pt1,-90,[0,0,x],copy=True)

gzg_lgjy1_2_zj = rs.BooleanDifference(gzg_lgjy_trimed_brep2,gzg_lgjy1_2_zj,delete_input=False)

#华头子不出头


gzg_lgjy1_2_zj = rs.BooleanDifference(gzg_lgjy1_2_zj,gzg_lgjy_trimed_brep3,delete_input=False)



gzg_lgjy1_2_zj2 = rs.BooleanUnion([gzg_lgjy1_2_zj2,gzg_lgjy_trimed_brep],delete_input=False)
gzg_lgjy1_2_zj2 = rs.BooleanDifference(gzg_lgjy_trimed_brep2,gzg_lgjy1_2_zj2,delete_input=False)




#华头子不出头


gzg_lgjy1_2_zj2 = rs.BooleanDifference(gzg_lgjy1_2_zj2,gzg_lgjy_trimed_brep4,delete_input=False)
htz_untrimed_brep = rs.CopyObject(gzg_lgjy1_2_zj)
htz_untrimed_brep2 = rs.CopyObject(gzg_lgjy1_2_zj2)

htz1 = rs.MoveObject(rs.CopyObject(htz_untrimed_brep),(0,0,42 * x))
htz2 = rs.MoveObject(rs.CopyObject(htz_untrimed_brep2),(0,0,42 * x))

rs.MoveObjects([gzg_lgjy1_2_zj,gzg_lgjy1_2_zj2],(-(HuaGong_CaiFen_left+(16))*x,-(HuaGong_CaiFen_left+(16))*x,42*x))

rs.MoveObject(gzg_lgjy_union1,(((HuaGong_CaiFen_left - 32)*2) * x,0,0))


gzg_lgjy1_2_zj2 = rs.BooleanDifference(gzg_lgjy_union2,gzg_lgjy1_2_zj2,delete_input=True)
gzg_lgjy1_2_zj = rs.BooleanDifference(gzg_lgjy_union1,gzg_lgjy1_2_zj,delete_input=True)






#华头子 不出头 生成

htz_pt1 = rs.MoveObject(rs.CopyObject(hg_zj_pt1),(-(HuaGong_CaiFen_left+11) * x,-4 * x,57 * x))
htz_head = rs.AddLine(htz_pt1, rs.MoveObject(rs.CopyObject(htz_pt1),(0,8 * x,0)))
htz_head = rs.ExtrudeCurve(htz_head,rs.AddLine(rs.AddPoint(0,0,0),rs.AddPoint(0,0,-15 * x)))
htz_head = rs.ExtrudeSurface(htz_head,rs.AddLine(rs.AddPoint(0,0,0),rs.AddPoint((HuaGong_CaiFen_left-1) * x,0,0)))
htz_head2 = rs.RotateObject(htz_head,hg_2_zj_pt1,90,[0,0,x],copy=True)


htz1 = rs.BooleanUnion([htz_head,htz1],delete_input=True)
htz2 = rs.BooleanUnion([htz_head2,htz2],delete_input=True)


#转角第一层上的华拱上的散斗被第一层华拱剪切
SanDou_1 = rs.BooleanUnion([HuaGong1_zj_brep,SanDou_1],delete_input=False)
SanDou_1_2 = rs.BooleanUnion([HuaGong1_zj_brep,SanDou_1_2],delete_input=False)





#华头子-半驼峰
btf_htz = rs.CopyObject(HuaGong1_2_zj)
rs.MoveObject(btf_htz,(0,0,42 * x))

#华头子-半驼峰剪切


#耍头-半驼峰剪切
btf_htz2 = rs.CopyObject(btf_htz)
st_zjbtf = rs.MoveObject(rs.CopyObject(hg_zj_pt1),(-(HuaGong_CaiFen_left +21 +21) * x,-5 * x,57 * x))
#耍头
st_zjpt_0 =rs.CopyObject(st_zjbtf)
st_zjpt_1 =rs.CopyObject(st_zjpt_0)
rs.MoveObject(st_zjpt_1,(-4 * x,0,0))
st_zjpt_2 =rs.CopyObject(st_zjpt_1)
rs.MoveObject(st_zjpt_2,(-12 * x,0,-3 * x))
st_zjpt_3 =rs.CopyObject(st_zjpt_2)
rs.MoveObject(st_zjpt_3,(0,0,-3 * x))
st_zjpt_4 =rs.CopyObject(st_zjpt_3)
rs.MoveObject(st_zjpt_4,(0,0,-9 * x))
st_zjpt_5 =rs.CopyObject(st_zjpt_0)
rs.MoveObject(st_zjpt_5,(-3 * x,0,-15 * x))
st_zjpt_6 =rs.CopyObject(st_zjpt_5)
rs.MoveObject(st_zjpt_6,(0,0,4 * x))
st_zjpt_7 =rs.CopyObject(st_zjpt_6)
rs.MoveObject(st_zjpt_7,(3 * x,0,0))
st_zjpt_8 =rs.CopyObject(st_zjpt_7)
rs.MoveObject(st_zjpt_8,(0,0,x))
st_zjpt_9 =rs.CopyObject(st_zjpt_8)
rs.MoveObject(st_zjpt_9,(10 * x,0,0))
st_zjpt_10 =rs.CopyObject(st_zjpt_9)
rs.MoveObject(st_zjpt_10,(0,0,-x))
st_zjpt_11 =rs.CopyObject(st_zjpt_10)
rs.MoveObject(st_zjpt_11,(3 * x,0,0))
st_zjpt_12 =rs.CopyObject(st_zjpt_11)
rs.MoveObject(st_zjpt_12,(0,0,-4 * x))
st_zjpt_13 =rs.CopyObject(st_zjpt_12)
rs.MoveObject(st_zjpt_13,(3 * x,0,0))
st_zjpt_15 =rs.CopyObject(st_zjpt_1)
rs.MoveObject(st_zjpt_15,(-6 * x,0,-3 * x))
st_zjcr_1 = rs.AddPolyline([st_zjpt_3,st_zjpt_2,st_zjpt_1,st_zjpt_0,st_zjpt_13])
st_zjcr_2 =rs.AddFilletCurve(rs.AddLine(st_zjpt_3,st_zjpt_4),rs.AddLine(st_zjpt_4,st_zjpt_5),9 * x,)
rs.ScaleObject(st_zjcr_2,st_zjpt_4,[rs.Distance(st_zjpt_4,st_zjpt_5)/(9 * x),1,1])
st_zjbrep_untrimed = rs.JoinCurves([st_zjcr_1,st_zjcr_2])
st_zjbrep_untrimed = rs.JoinCurves([st_zjbrep_untrimed,rs.AddLine(rs.CurveStartPoint(st_zjbrep_untrimed),rs.CurveEndPoint(st_zjbrep_untrimed))])
st_zjbrep_untrimed = rs.AddPlanarSrf(st_zjbrep_untrimed)
st_zjbrep_untrimed = rs.ExtrudeSurface(st_zjbrep_untrimed,rs.AddLine(rs.AddPoint(0,0,0),rs.AddPoint(0,10 * x ,0)))


st_zjup1 = rs.AddCurve([st_zjpt_1,st_zjpt_15,st_zjpt_2])
st_zjup1 = rs.AddLoftSrf([st_zjup1,rs.MoveObject(rs.AddLine(st_zjpt_1,st_zjpt_2),(0,5 * x,0)),rs.MoveObject(rs.CopyObject(st_zjup1),(0,10 * x,0))],loft_type=2)
st_zjup1 =rs.ExtrudeSurface(st_zjup1,rs.AddLine(rs.AddPoint(0,0,0),rs.AddPoint(-2 * x,0,2 * x)))
st_zj_brep = rs.BooleanDifference(st_zjup1 ,st_zjbrep_untrimed ,delete_input = False)

btf_htz2 = rs.BooleanUnion([btf_htz2,st_zj_brep],delete_input = False)







btf_htz_trimed_brep1 = rs.ExplodePolysurfaces(gzg_lgjy1_2_zj)[71]
btf_htz_trimed_brep1 = rs.DuplicateEdgeCurves(btf_htz_trimed_brep1)[0]
btf_htz_trimed_brep1 = rs. CurveStartPoint(btf_htz_trimed_brep1)
rs.RotateObject(btf_htz_trimed_brep1,hg_2_zj_pt1,-45,[0,0,x],copy=False)
btf_htz_trimed_brep1 = rs.AddLine(btf_htz_trimed_brep1,rs.MoveObject(rs.CopyObject(btf_htz_trimed_brep1),(0,30 * x,0)))
btf_htz_trimed_brep1 = rs.ExtrudeCurve(btf_htz_trimed_brep1,rs.AddLine(rs.AddPoint(0,0,0),rs.AddPoint(-30 * x,0,0)))
btf_htz_trimed_brep1 = rs.ExtrudeSurface(btf_htz_trimed_brep1,rs.AddLine(rs.AddPoint(0,0,0),rs.AddPoint(0,0,30 * x)))
rs.MoveObject(btf_htz_trimed_brep1,(0,0,-15 * x))


##
btf_htz = rs.BooleanIntersection(btf_htz_trimed_brep1,btf_htz,delete_input=False)




btf_htz_trimed_brep2_pt1 = rs.MoveObject(rs.CopyObject(hg_zj_pt1),((HuaGong_CaiFen_left + 21 +21 - 16) * x,-5 * x,42 * x))
btf_htz_trimed_brep2_pt2 = rs.CopyObject(btf_htz_trimed_brep2_pt1)
rs.MoveObject(btf_htz_trimed_brep2_pt2,((16 + 15) * x ,0,0))
btf_htz_trimed_brep2_pt3 = rs.CopyObject(btf_htz_trimed_brep2_pt2)
rs.MoveObject(btf_htz_trimed_brep2_pt3,(0 ,0,7.5 * x))
btf_htz_trimed_brep2_pt4 = rs.CopyObject(btf_htz_trimed_brep2_pt3)
rs.MoveObject(btf_htz_trimed_brep2_pt4,(-7.5 * x ,0,0))
btf_htz_trimed_brep2_pt5 = rs.CopyObject(btf_htz_trimed_brep2_pt4)
rs.MoveObject(btf_htz_trimed_brep2_pt5,(-7.5 * x ,0,0))
btf_htz_trimed_brep2_pt6 = rs.CopyObject(btf_htz_trimed_brep2_pt5)
rs.MoveObject(btf_htz_trimed_brep2_pt6,(0 ,0,7.5 * x))
btf_htz_trimed_brep2_pt7 = rs.CopyObject(btf_htz_trimed_brep2_pt6)
rs.MoveObject(btf_htz_trimed_brep2_pt7,(-16 * x ,0,-15 * x))



btf_htz_trimed_brep2_cr1 = rs.AddLine(btf_htz_trimed_brep2_pt2,btf_htz_trimed_brep2_pt3)
btf_htz_trimed_brep2_cr2 = rs.AddLine(btf_htz_trimed_brep2_pt3,btf_htz_trimed_brep2_pt4)
btf_htz_trimed_brep2_cr3 = rs.AddLine(btf_htz_trimed_brep2_pt4,btf_htz_trimed_brep2_pt5)
btf_htz_trimed_brep2_cr4 = rs.AddLine(btf_htz_trimed_brep2_pt5,btf_htz_trimed_brep2_pt6)

btf_htz_trimed_brep2_cr6 = rs.AddFilletCurve(btf_htz_trimed_brep2_cr1,btf_htz_trimed_brep2_cr2,7.5 * x)
btf_htz_trimed_brep2_cr7 = rs.AddFilletCurve(btf_htz_trimed_brep2_cr3,btf_htz_trimed_brep2_cr4,7.5 * x)
btf_htz_trimed_brep2_cr8 = rs.AddPolyline([btf_htz_trimed_brep2_pt7,btf_htz_trimed_brep2_pt1,btf_htz_trimed_brep2_pt2])
btf_htz_trimed_brep2 = rs.JoinCurves([btf_htz_trimed_brep2_cr6,btf_htz_trimed_brep2_cr7,btf_htz_trimed_brep2_cr8])
btf_htz_trimed_brep2 = rs.JoinCurves([btf_htz_trimed_brep2,rs.AddLine(rs.CurveStartPoint(btf_htz_trimed_brep2),rs.CurveEndPoint(btf_htz_trimed_brep2))])
btf_htz_trimed_brep2 = rs.AddPlanarSrf(btf_htz_trimed_brep2)
btf_htz_trimed_brep2 = rs.ExtrudeSurface(btf_htz_trimed_brep2,(rs.AddLine(rs.AddPoint(0,0,0),rs.AddPoint(0,10 * x,0))))

btf_brep = rs.CopyObject(btf_htz_trimed_brep2)


btf_htz = rs.BooleanUnion([btf_htz_trimed_brep2,btf_htz],delete_input=False)

#半驼峰上的插销
btf_cx = rs.MoveObject(rs.CopyObject(gy_cx_zj2),(21 * x,0,42 * x))








btf_htz = rs.BooleanDifference(btf_cx,btf_htz,delete_input=False)




rs.RotateObject(btf_htz,hg_2_zj_pt1,45,[0,0,x],copy=False)



btf_htz = rs.BooleanUnion([HuaGong2_zj_brep,btf_htz],delete_input=False)




btf_htz = rs.BooleanUnion([btf_htz,yl_brep],delete_input=False)


#耍头_半驼峰

btf_htz2 = rs.BooleanUnion([btf_htz_trimed_brep2,btf_htz2],delete_input=False)
btf_htz2 = rs.BooleanDifference(btf_cx,btf_htz2,delete_input=False)
rs.RotateObject(btf_htz2,hg_2_zj_pt1,45,[0,0,x],copy=False)
btf_htz2 = rs.BooleanUnion([btf_htz2,HuaGong2_zj_brep],delete_input=False)

rs.RotateObject(btf_htz2,hg_2_zj_pt1,180,[0,0,x],copy=False)
rs.MoveObjects(btf_htz2,(j*x,j*x,-5.5*x))

btf_htz2 = rs.BooleanUnion([btf_htz2,yl_brep],delete_input=False)


#瓜子拱交影上的散斗
SanDou_gzgjy1_zj = rs.MoveObject(rs.CopyObject(SanDou_ndg_zj1_3),(-(HuaGong_CaiFen_left + 16) * x,((HuaGong_CaiFen_left + 3 + HuaGong_CaiFen_left-32) - HuaGong_CaiFen_left) * x,42 * x))
SanDou_gzgjy2_zj = rs.MoveObject(rs.CopyObject(SanDou_gzgjy1_zj),(0,(HuaGong_CaiFen_left-8)*2 * x,0))

SanDou_gzgjy3_zj = rs.MirrorObject(SanDou_gzgjy1_zj,hg_zj_pt1,rs.MoveObject(rs.CopyObject(hg_zj_pt1),(x,x,0)),copy=True)
SanDou_gzgjy4_zj = rs.MirrorObject(SanDou_gzgjy2_zj,hg_zj_pt1,rs.MoveObject(rs.CopyObject(hg_zj_pt1),(x,x,0)),copy=True)

SanDou_gzgjy5_zj = rs.MoveObject(rs.CopyObject(SanDou_gzgjy1_zj),(0,-(HuaGong_CaiFen_left-8)*2 * x,0))
SanDou_gzgjy6_zj = rs.MirrorObject(SanDou_gzgjy5_zj,hg_zj_pt1,rs.MoveObject(rs.CopyObject(hg_zj_pt1),(x,x,0)),copy=True)




#华头子上的散斗
SanDou_htz1 = rs.MoveObject(rs.CopyObject(SanDou_gzgjy2_zj),((HuaGong_CaiFen_left+16) * x,-(HuaGong_CaiFen_left - 32) * x,0))
SanDou_htz2 = rs.MirrorObject(SanDou_htz1,hg_zj_pt1,rs.MoveObject(rs.CopyObject(hg_zj_pt1),(x,x,0)),copy=True)

#半驼峰上的散斗
SanDou_btf1 = rs.MoveObject(rs.CopyObject(SanDou_1_2),(21/math.sqrt(2) * x,21/math.sqrt(2) * x,42 * x))

#半驼峰 耍头上的散斗
SanDou_btf_st = rs.MoveObject(rs.CopyObject(SanDou_btf1),(j*x,j*x,-5.5*x))





#转角铺作第一层下昂

ang1_zj_pt1 = rs.MoveObject(rs.CopyObject(htz_pt1),(-10 * x,-x,-14 * x))
ang1_zj_pt2 = rs.MoveObject(rs.CopyObject(ang1_zj_pt1),(-43.5 * x,0,0))
ang1_zj_pt3 = rs.MoveObject(rs.CopyObject(ang1_zj_pt2),(0,0,2 * x))
ang1_zj_pt0 = rs.CopyObject(hg_zj_pt1)
rs.MoveObject(ang1_zj_pt0,(-(HuaGong_CaiFen_left + 21) * x,-5 * x,57 * x))
ang1_zj_pt4 = rs.MoveObject(rs.CopyObject(ang1_zj_pt0),(-21.75 * x,0,0))
ang1_zj_pt5 = rs.MoveObject(rs.CopyObject(ang1_zj_pt0),(180 * x,0,0))
ang1_zj_pt6 = rs.MoveObject(rs.CopyObject(ang1_zj_pt1),(180 * x,0,0))
ang1_zj_cr1 = rs.AddPolyline([ang1_zj_pt6,ang1_zj_pt1,ang1_zj_pt2,ang1_zj_pt3])
rs.RotateObject(ang1_zj_cr1,ang1_zj_pt1,-24.08,[0,x,0],copy=False)
ang1_zj_cr2 = rs.AddPolyline([rs.MoveObject(ang1_zj_pt4,(-x,0,0)),ang1_zj_pt0,ang1_zj_pt5])
rs.RotateObject(ang1_zj_cr2,ang1_zj_pt0,-24.08,[0,x,0],copy=False)

ang1_zj_untrimrd_brep = rs.JoinCurves([ang1_zj_cr1,ang1_zj_cr2,rs.AddLine(rs.CurveStartPoint(ang1_zj_cr2),rs.CurveEndPoint(ang1_zj_cr1)),rs.AddLine(rs.CurveStartPoint(ang1_zj_cr1),rs.CurveEndPoint(ang1_zj_cr2))])
ang1_zj_untrimrd_brep = rs.AddPlanarSrf(ang1_zj_untrimrd_brep)
ang1_zj_untrimrd_brep_1 = rs.ExtrudeSurface(ang1_zj_untrimrd_brep,rs.AddLine(rs.AddPoint(0,0,0),rs.AddPoint(0,10 * x,0)))

#一层下昂修建

ang1_trimed = rs.MoveObject(rs.CopyObject(hg_zj_pt1),(90 * x,-10 * x,84 * x))
ang1_trimed = rs.AddLine(ang1_trimed,rs.MoveObject(rs.CopyObject(ang1_trimed),(-100 * x,0,0)))
ang1_trimed = rs.ExtrudeCurve(ang1_trimed,rs.AddLine(rs.AddPoint(0,0,0),rs.AddPoint(0,20 * x,0)))
ang1_trimed = rs.ExtrudeSurface(ang1_trimed,rs.AddLine(rs.AddPoint(0,0,0),rs.AddPoint(0,0,20 * x)))

ang1_zj_untrimrd_brep = rs.BooleanDifference(ang1_zj_untrimrd_brep_1,ang1_trimed,delete_input=False)[0]

#昂上部

ang1_zj_up = rs.ExplodePolysurfaces(ang1_zj_untrimrd_brep)[1:3]
ang1_zj_up_1 = rs.ExtrudeSurface(ang1_zj_up[0],rs.AddLine(rs.AddPoint(0,0,0),rs.AddPoint(0,0,8 * x)))
ang1_zj_up_2 = rs.ExtrudeSurface(ang1_zj_up[1],rs.AddLine(rs.AddPoint(0,0,0),rs.AddPoint(0,0,8 * x)))
ang1_zj_up = rs.BooleanIntersection(ang1_zj_up_1,ang1_zj_up_2,delete_input = False)
ang1_zj_up = rs.BooleanUnion([rs.MoveObject(rs.CopyObject(ang1_zj_untrimrd_brep),(0,0,21 * x)),ang1_zj_up],delete_input = False)
ang1_zj_up = rs.BooleanUnion([ang1_zj_up,ang1_trimed],delete_input=False)[0]
rs.ScaleObject(ang1_zj_up,hg_zj_pt1,[1,0.8,1],copy = False)


#一层下昂后尾

ang1_tail = rs.MoveObject(rs.CopyObject(ang1_tail1),(0,0,63 * x))
ang1_tail = rs.BooleanUnion([ang1_zj_untrimrd_brep,ang1_tail],delete_input=False)[0]

ang1_zj_untrimrd_brep = rs.BooleanDifference(ang1_tail,ang1_zj_untrimrd_brep,delete_input =False)
ang1_zj_untrimrd_brep = rs.BooleanIntersection(ang1_zj_up,ang1_zj_untrimrd_brep,delete_input =False)
#
ang1_trimed1 = rs.MoveObject(rs.CopyObject(huagong_trimed_brep),(0,0,57 * x))

ang1_zj_untrimrd_brep = rs.BooleanUnion([ang1_trimed1,ang1_zj_untrimrd_brep],delete_input =False)

ang1_zj_untrimrd_brep2 = rs.RotateObject(ang1_zj_untrimrd_brep,hg_zj_pt1,90,[0,0,x],copy = True)

#一层下昂剪切

ang1_trimed2 = rs.MoveObject(rs.CopyObject(huagong_trimed_brep2),(0,0,57 * x))
rs.ScaleObject(ang1_trimed2,rs.MoveObject(rs.CopyObject(hg_zj_pt1),(0,0,63 * x)),[1,1,10/9])
ang1_trimed3 = rs.ScaleObject(ang1_trimed2,rs.MoveObject(rs.CopyObject(hg_zj_pt1),(0,0,63 * x)),[1,1,1.5],copy =True)
rs.MoveObject(ang1_trimed3,(0,0,10 * x))
rs.RotateObject(ang1_trimed3,hg_zj_pt1,90,[0,0,x],copy = False)



ang1_zj_untrimrd_brep = rs.BooleanDifference(ang1_trimed2,ang1_zj_untrimrd_brep,delete_input =False)
ang1_zj_untrimrd_brep2 = rs.BooleanDifference(ang1_trimed3,ang1_zj_untrimrd_brep2,delete_input =False)

#一层下昂后的散斗
SanDou_ang1_zj1 = rs.MoveObject(rs.CopyObject(SanDou_ndg_zj2_2),(0,0,42 * x))
SanDou_ang1_zj2 = rs.RotateObject(SanDou_ang1_zj1,hg_zj_pt1,90,[0,0,x],copy = True)

#花头子被昂剪切
htz1 = rs.BooleanDifference(htz1,ang1_zj_untrimrd_brep,delete_input = False)
htz2 = rs.BooleanDifference(htz2,ang1_zj_untrimrd_brep2,delete_input = False)

#一层下昂被瓜子拱剪切
ang1_zj_untrimrd_brep = rs.BooleanIntersection(ang1_zj_untrimrd_brep,gzg_lgjy1_2_zj2,delete_input =False)
ang1_zj_untrimrd_brep2 = rs.BooleanIntersection(ang1_zj_untrimrd_brep2,gzg_lgjy1_2_zj,delete_input =False)

#角昂


ang_jiao_zj_pt1 = rs.MoveObject(rs.CopyObject(htz_pt1),(-10 * x,-x,-14 * x))
ang_jiao_zj_pt2 = rs.MoveObject(rs.CopyObject(ang_jiao_zj_pt1),(-43.5 * x- 31.5 * x,0,0))
ang_jiao_zj_pt3 = rs.MoveObject(rs.CopyObject(ang_jiao_zj_pt2),(0,0,2 * x))
ang_jiao_zj_pt0 = rs.CopyObject(hg_zj_pt1)
rs.MoveObject(ang_jiao_zj_pt0,(-(HuaGong_CaiFen_left + 21) * x,-5 * x,57 * x))
ang_jiao_zj_pt4 = rs.MoveObject(rs.CopyObject(ang_jiao_zj_pt0),(-21.75 * x- 31.5 * x,0,0))
ang_jiao_zj_pt5 = rs.MoveObject(rs.CopyObject(ang_jiao_zj_pt0),(180 * x,0,0))
ang_jiao_zj_pt6 = rs.MoveObject(rs.CopyObject(ang_jiao_zj_pt1),(180 * x,0,0))

ang_jiao_zj_cr1 = rs.AddPolyline([ang_jiao_zj_pt6,ang_jiao_zj_pt1,ang_jiao_zj_pt2,ang_jiao_zj_pt3])
rs.RotateObject(ang_jiao_zj_cr1,rs.MoveObject(rs.CopyObject(ang_jiao_zj_pt1),(-21 * x,0,0)),-24.08,[0,x,0],copy=False)
ang_jiao_zj_cr2 = rs.AddPolyline([rs.MoveObject(ang_jiao_zj_pt4,(-x,0,0)),ang_jiao_zj_pt0,ang_jiao_zj_pt5])
rs.RotateObject(ang_jiao_zj_cr2,rs.MoveObject(rs.CopyObject(ang_jiao_zj_pt0),(-21 * x,0,0)),-24.08,[0,x,0],copy=False)

ang_jiao_zj_untrimrd_brep = rs.JoinCurves([ang_jiao_zj_cr1,ang_jiao_zj_cr2,rs.AddLine(rs.CurveStartPoint(ang_jiao_zj_cr2),rs.CurveEndPoint(ang_jiao_zj_cr1)),rs.AddLine(rs.CurveStartPoint(ang_jiao_zj_cr1),rs.CurveEndPoint(ang_jiao_zj_cr2))])
ang_jiao_zj_untrimrd_brep = rs.AddPlanarSrf(ang_jiao_zj_untrimrd_brep)
ang_jiao_zj_untrimrd_brep = rs.ExtrudeSurface(ang_jiao_zj_untrimrd_brep,rs.AddLine(rs.AddPoint(0,0,0),rs.AddPoint(0,10 * x,0)))

rs.RotateObject(ang_jiao_zj_untrimrd_brep,hg_zj_pt1,45,[0,0,x],copy = False)



#一层下昂角昂剪切
ang1_zj_untrimrd_brep = rs.BooleanDifference(ang1_zj_untrimrd_brep,ang_jiao_zj_untrimrd_brep,delete_input =False)
ang1_zj_untrimrd_brep2 = rs.BooleanDifference(ang1_zj_untrimrd_brep2,ang_jiao_zj_untrimrd_brep,delete_input =False)



#角昂上部
ang1_jiao_zj_up = rs.ExplodePolysurfaces(ang_jiao_zj_untrimrd_brep)[1:3]
ang1_jiao_zj_up_1 = rs.ExtrudeSurface(ang1_jiao_zj_up[0],rs.AddLine(rs.AddPoint(0,0,0),rs.AddPoint(0,0,8 * x)))
ang1_jiao_zj_up_2 = rs.ExtrudeSurface(ang1_jiao_zj_up[1],rs.AddLine(rs.AddPoint(0,0,0),rs.AddPoint(0,0,8 * x)))
ang1_jiao_zj_up  = rs.BooleanIntersection(ang1_jiao_zj_up_1,ang1_jiao_zj_up_2,delete_input = False)

ang1_jiao_zj_up = rs.BooleanUnion([rs.MoveObject(rs.CopyObject(ang_jiao_zj_untrimrd_brep),(0,0,21 * x)),ang1_jiao_zj_up],delete_input = False)
rs.RotateObject(ang1_jiao_zj_up,hg_zj_pt1,-45,[0,0,x])
rs.ScaleObject(ang1_jiao_zj_up,hg_zj_pt1,[1,0.8,1],copy = False)
rs.RotateObject(ang1_jiao_zj_up,hg_zj_pt1,45,[0,0,x])

ang_jiao_zj_untrimrd_brep = rs.BooleanDifference(ang1_jiao_zj_up,ang_jiao_zj_untrimrd_brep,delete_input =False)

ang_jiao_zj_untrimrd_brep_1 = ang_jiao_zj_untrimrd_brep

#转角铺作 素枋

sf_zj1 = rs.MoveObject(rs.CopyObject(sf_zj1),(21 * x,0,63 *x))
rs.RotateObject(sf_zj1,hg_zj_pt1,45,[0,0,x],copy = False)


#素枋剪切
sf_trimed_brep = rs.MoveObject(rs.CopyObject(huagong_trimed_brep),(0,0,63 * x))
rs.RotateObject(sf_trimed_brep,hg_zj_pt1,45,[0,0,x],copy = False)
rs.ScaleObject(sf_trimed_brep,rs.MoveObject(rs.CopyObject(hg_zj_pt1),(0,0,63 * x)),[1,1,5])

sf_zj1 = rs.BooleanUnion([sf_trimed_brep,sf_zj1],delete_input = False)[1]

#素枋被昂剪切
sf_zj1 = rs.BooleanDifference(ang_jiao_zj_untrimrd_brep,sf_zj1,delete_input = False)

#素枋上的散斗
SanDou_sf = rs.MoveObject(rs.CopyObject(rs.RotateObject(SanDou,hg_zj_pt1,180,[0,0,x],copy = True)),(42 * x,0,63 * x))
rs.RotateObject(SanDou_sf,hg_zj_pt1,45,[0,0,x],copy=False)

#素枋上的散斗被素枋剪切
SanDou_sf = rs.BooleanUnion([SanDou_sf,sf_zj1],delete_input=False)








# 角昂被瓜子拱剪切
ang_jiao_zj_untrimrd_brep = rs.BooleanDifference(gzg_lgjy1_2_zj,ang_jiao_zj_untrimrd_brep,delete_input =False)
ang_jiao_zj_untrimrd_brep = rs.BooleanIntersection(rs.MoveObject(rs.CopyObject(gzg_lgjy1_2_zj),(0,0,-5 *x)),ang_jiao_zj_untrimrd_brep,delete_input =False)

ang_jiao_zj_untrimrd_brep = rs.BooleanIntersection(gzg_lgjy1_2_zj2,ang_jiao_zj_untrimrd_brep,delete_input =False)
ang_jiao_zj_untrimrd_brep = rs.BooleanIntersection(rs.MoveObject(rs.CopyObject(gzg_lgjy1_2_zj2),(0,0,-5 * x)),ang_jiao_zj_untrimrd_brep,delete_input =False)


#半驼峰被角昂剪切
btf_htz = rs.BooleanUnion([ang_jiao_zj_untrimrd_brep,btf_htz],delete_input = False)




#平棋枋
pqf_zj_cr1 = rs.ExplodePolysurfaces(sf_zj1)[29]
pqf_zj_cr1 = rs.DuplicateEdgeCurves(pqf_zj_cr1)[5]

pqf_zj_cr2 = rs.ExplodePolysurfaces(sf_zj1)[0]
pqf_zj_cr2 = rs.DuplicateEdgeCurves(pqf_zj_cr2)[3]
pqf_zj_cr2 = rs.OffsetCurve(pqf_zj_cr2,[x,x,0],-2 * x)
rs.MoveObject(pqf_zj_cr2,(0,0,6 * x))
pqf_zj_cr2 = rs.AddLine(rs.CurveEndPoint(pqf_zj_cr2),rs.CurveStartPoint(pqf_zj_cr2))

pqf_zj_sr1 = rs.AddLoftSrf([pqf_zj_cr1,pqf_zj_cr2])

pqf_zj = rs.ExtrudeSurface(pqf_zj_sr1,rs.AddLine(rs.AddPoint(0,0,0),rs.AddPoint(0,0,15 * x)))

pqf_zj = rs.BooleanDifference(pqf_zj,ang_jiao_zj_untrimrd_brep,delete_input = False)


#平棋枋被角昂剪切




#素枋被半驼峰剪切
sf_zj1 = rs.BooleanIntersection(btf_htz,sf_zj1,delete_input = False)




#骑昂斗

x = CaiFen
#散斗,深12分,广10分,华拱/散斗.深10分,广12分,泥道栱
sd_zj_ang_pt_o = rs.AddPoint(0,0,0)
sd_zj_ang_pt2 = rs.AddPoint(12 * x,0,0)
sd_zj_ang_pt_z1 = rs.AddPoint(- 2 * x,0, 4 * x)
sd_zj_ang_cr_1 = rs.AddLine(sd_zj_ang_pt_o,sd_zj_ang_pt_z1)
#散斗,欹
sd_zj_ang_pt_z2 = rs.CurveMidPoint(sd_zj_ang_cr_1)
direction_left = (x, 0, 2 * x)  # 任意方向向量 
distance = 0.5 * x # 移动距离 
# 单位化方向向量并计算实际位移 
unit_vector_left = rs.VectorUnitize(direction_left)
displacement_left = rs.VectorScale(unit_vector_left, distance)
rs.MoveObject(sd_zj_ang_pt_z2, displacement_left)
sd_zj_ang_cr_1 = rs.AddCurve([sd_zj_ang_pt_o,sd_zj_ang_pt_z2,sd_zj_ang_pt_z1])
sd_zj_ang_pt_3 = rs.MoveObject(rs.CopyObject(sd_zj_ang_pt_o),(0,2 * x,0))
sd_zj_ang_sr1 = rs.AddLine(sd_zj_ang_pt_3,rs.MoveObject(rs.CopyObject(sd_zj_ang_pt_3),(-2 * x,-2 * x,0)))
sd_zj_ang_sr1 = rs.AddLoftSrf([sd_zj_ang_sr1,rs.MoveObject(rs.CopyObject(sd_zj_ang_sr1),(0,0,4* x))])
sd_zj_ang_cr_1 =rs.ProjectCurveToSurface(sd_zj_ang_cr_1,sd_zj_ang_sr1,[0,1,0])

sd_zj_ang_cr_2 = rs.CopyObject(sd_zj_ang_cr_1)
rs.MoveObject(sd_zj_ang_cr_2,(12 * x,0,0))
rs.RotateObject(sd_zj_ang_cr_2,rs.CurveStartPoint(sd_zj_ang_cr_2),90,[0,0,x])
sd_zj_ang_cr_3 = rs.AddLine(rs.CurveStartPoint(sd_zj_ang_cr_1),rs.CurveStartPoint(sd_zj_ang_cr_2))
sd_zj_ang_cr_2_1 = rs.JoinCurves([sd_zj_ang_cr_3,sd_zj_ang_cr_2])
rs.RotateObject(sd_zj_ang_cr_2_1,rs.CurveStartPoint(sd_zj_ang_cr_1),24.08,[0,x,0])
sd_zj_ang_cr_2 = rs.ExplodeCurves(sd_zj_ang_cr_2_1)[1]

rs.RotateObject(sd_zj_ang_cr_2,rs.CurveStartPoint(sd_zj_ang_cr_2),24.08                 ,[0,x,0])

sd_zj_ang_cr_3 = rs.CopyObject(sd_zj_ang_cr_1)
rs.MoveObject(sd_zj_ang_cr_3,(0,10 * x,0))
rs.RotateObject(sd_zj_ang_cr_3,rs.CurveStartPoint(sd_zj_ang_cr_3),-90,[0,0,x])
sd_zj_ang_cr_4 = rs.CopyObject(sd_zj_ang_cr_3)
rs.MoveObject(sd_zj_ang_cr_4,(12 * x,0,0))
rs.RotateObject(sd_zj_ang_cr_4,rs.CurveStartPoint(sd_zj_ang_cr_4),-90,[0,0,x])



sd_zj_ang_cr_5 = rs.AddLine(rs.CurveStartPoint(sd_zj_ang_cr_3),rs.CurveStartPoint(sd_zj_ang_cr_4))
sd_zj_ang_cr_4_1 = rs.JoinCurves([sd_zj_ang_cr_5,sd_zj_ang_cr_4])
rs.RotateObject(sd_zj_ang_cr_4_1,rs.CurveStartPoint(sd_zj_ang_cr_3),24.08,[0,x,0])
sd_zj_ang_cr_4 = rs.ExplodeCurves(sd_zj_ang_cr_4_1)[1]

rs.RotateObject(sd_zj_ang_cr_4,rs.CurveStartPoint(sd_zj_ang_cr_2),24.08                 ,[0,x,0])

sd_zj_ang_cr_5 = rs.AddLine(rs.CurveEndPoint(sd_zj_ang_cr_2),rs.CurveEndPoint(sd_zj_ang_cr_4))
sd_zj_ang_cr_6 =rs.AddLine(rs.CurveEndPoint(sd_zj_ang_cr_1),rs.CurveEndPoint(sd_zj_ang_cr_3))
sd_zj_ang_cr_7 = rs.AddLine(rs.CurveStartPoint(sd_zj_ang_cr_2),rs.CurveStartPoint(sd_zj_ang_cr_4))
sd_zj_ang_cr_8 =rs.AddLine(rs.CurveStartPoint(sd_zj_ang_cr_1),rs.CurveStartPoint(sd_zj_ang_cr_3))
sd_zj_ang_down = rs.AddLoftSrf([sd_zj_ang_cr_1,sd_zj_ang_cr_2,sd_zj_ang_cr_4,sd_zj_ang_cr_3],loft_type=2,closed=True)

sd_zj_ang_down_sr1 =rs.AddLoftSrf([sd_zj_ang_cr_5,sd_zj_ang_cr_6])
sd_zj_ang_down_sr2 =rs.AddLoftSrf([sd_zj_ang_cr_7,sd_zj_ang_cr_8])

sd_zj_ang_down =rs.JoinSurfaces([sd_zj_ang_down,sd_zj_ang_down_sr1,sd_zj_ang_down_sr2])

#散斗,平
sd_zj_ang_mid = rs.ExtrudeSurface(sd_zj_ang_down_sr1,rs.AddLine(rs.AddPoint(0,0,0),rs.AddPoint(0,0,4 * x)))

#散斗,耳
sd_zj_ang_up1 = rs.AddLine(rs.CurveEndPoint(sd_zj_ang_cr_1),rs.CurveEndPoint(sd_zj_ang_cr_2))
rs.MoveObject(sd_zj_ang_up1,(0,0,2 * x))
sd_zj_ang_up1 = rs.AddLoftSrf([sd_zj_ang_up1,rs.MoveObject(rs.CopyObject(sd_zj_ang_up1),(0,3 * x,0))])
sd_zj_ang_up1 = rs.ExtrudeSurface(sd_zj_ang_up1,rs.AddLine(rs.AddPoint(0,0,0),rs.AddPoint(0,0,4 * x)))

sd_zj_ang_up2 = rs.CopyObject(sd_zj_ang_up1)
rs.MoveObject(sd_zj_ang_up2,(0,11 * x,0))

QIAngDou_ang1_zj_or = rs.BooleanUnion([sd_zj_ang_mid,sd_zj_ang_down,sd_zj_ang_up1,sd_zj_ang_up2], delete_input=False)

rs.RotateObject(QIAngDou_ang1_zj_or,hg_zj_pt1,180,[0,0,x],copy=False)

#投射骑昂斗

#一层下昂上的放射点

ang1_projecct_pt1 = rs.ExplodePolysurfaces(ang1_zj_untrimrd_brep)[28]
ang1_projecct_pt1 = rs.CurveStartPoint(rs.DuplicateEdgeCurves(ang1_projecct_pt1)[3])

ang1_projecct_pt1_x = rs.MoveObject(rs.CopyObject(ang1_projecct_pt1),(1,0,0))
ang1_projecct_pt1_y = rs.MoveObject(rs.CopyObject(ang1_projecct_pt1),(0,1,0))

ang1_projecct_pt = [ang1_projecct_pt1,ang1_projecct_pt1_x,ang1_projecct_pt1_y]




ang1_projecct_pt1_x = rs.MoveObject(rs.CopyObject(ang1_projecct_pt1),(1,0,0))
ang1_projecct_pt1_y = rs.MoveObject(rs.CopyObject(ang1_projecct_pt1),(0,1,0))

ang1_projecct_pt = [ang1_projecct_pt1,ang1_projecct_pt1_x,ang1_projecct_pt1_y]

#角昂上的放射点
ang_jiao_projecct_pt1 = rs.ExplodePolysurfaces(ang_jiao_zj_untrimrd_brep)[12]
ang_jiao_projecct_pt1 = rs.CurveEndPoint(rs.DuplicateEdgeCurves(ang_jiao_projecct_pt1)[2])
ang_jiao_projecct_pt1_x = rs.MoveObject(rs.CopyObject(ang_jiao_projecct_pt1),(1,0,0))
ang_jiao_projecct_pt1_y = rs.MoveObject(rs.CopyObject(ang_jiao_projecct_pt1),(0,1,0))

ang_jiao_projecct_pt = [ang_jiao_projecct_pt1,ang_jiao_projecct_pt1_x,ang_jiao_projecct_pt1_y]


#起始点
QIAngDou_ang1_zj_origin_pt1 = rs.ExplodePolysurfaces(QIAngDou_ang1_zj_or )[3]
QIAngDou_ang1_zj_origin_pt1 = rs.CurveEndPoint(rs.DuplicateEdgeCurves(QIAngDou_ang1_zj_origin_pt1)[3])


QIAngDou_ang1_zj_origin_pt1_x = rs.MoveObject(rs.CopyObject(QIAngDou_ang1_zj_origin_pt1),(1,0,0))
QIAngDou_ang1_zj_origin_pt1_y = rs.MoveObject(rs.CopyObject(QIAngDou_ang1_zj_origin_pt1),(0,1,0))

QIAngDou_ang1_zj_origin_pt = [QIAngDou_ang1_zj_origin_pt1,QIAngDou_ang1_zj_origin_pt1_x,QIAngDou_ang1_zj_origin_pt1_y]

QIAngDou_ang1_zj = rs.OrientObject(rs.CopyObject(QIAngDou_ang1_zj_or[0]),QIAngDou_ang1_zj_origin_pt,ang1_projecct_pt)



#骑昂斗下的馒头榫剪切

mts_qad = rs.SurfaceAreaCentroid(rs.ExplodePolysurfaces(QIAngDou_ang1_zj)[3])[0]
rs.MoveObject(mts_qad,(-2.75/2 * x,-2.75/2 * x,-2.75/2 * x))

mts_qad = rs.AddLine(mts_qad,rs.MoveObject(rs.CopyObject(mts_qad),(2.75 * x,0,0)))

mts_qad = rs.ExtrudeCurve(mts_qad,rs.AddLine(rs.AddPoint(0,0,0),rs.AddPoint(0,2.75 * x,0)))

mts_qad = rs.ExtrudeSurface(mts_qad,rs.AddLine(rs.AddPoint(0,0,0),rs.AddPoint(0,0,2.75 * x)))
#

QIAngDou_ang1_zj = rs.BooleanIntersection(mts_qad,QIAngDou_ang1_zj,delete_input = True)
QIAngDou_ang1_zj2 = rs.RotateObject(QIAngDou_ang1_zj,hg_zj_pt1,90,[0,0,x],copy=True)

#将骑昂斗投射到角昂上
QIAngDou_ang_jiao_zj = rs.OrientObject(rs.CopyObject(QIAngDou_ang1_zj),ang1_projecct_pt,ang_jiao_projecct_pt)
rs.RotateObject(QIAngDou_ang_jiao_zj,ang_jiao_projecct_pt1,45,[0,0,x],copy=False)

#下一层昂被骑昂斗剪切

ang1_zj_untrimrd_brep = rs.BooleanDifference(ang1_zj_untrimrd_brep,QIAngDou_ang1_zj,delete_input = False)
ang1_zj_untrimrd_brep2 = rs.BooleanDifference(ang1_zj_untrimrd_brep2,QIAngDou_ang1_zj2,delete_input = False)


#角昂被骑昂斗剪切
ang_jiao_zj_untrimrd_brep = rs.BooleanDifference(ang_jiao_zj_untrimrd_brep,QIAngDou_ang_jiao_zj,delete_input = False)




# 慢栱-连栱交隐

mg_lgjy_untrimed = rs.CopyObject(gzg_lgjy1_2_zj)

mg_lgjy_trimed = rs.ExplodePolysurfaces(mg_lgjy_untrimed)[55]
mg_lgjy_trimed = rs.CurveStartPoint(rs.DuplicateEdgeCurves(mg_lgjy_trimed)[1])
rs.MoveObject(mg_lgjy_trimed,(0,x,0))

mg_lgjy_trimed = rs.AddLine(mg_lgjy_trimed,rs.MoveObject(rs.CopyObject(mg_lgjy_trimed),(0,-12 * x,0)))
mg_lgjy_trimed = rs.ExtrudeCurve(mg_lgjy_trimed,rs.AddLine(rs.AddPoint(0,0,0),rs.AddPoint(x,0,0)))

mg_lgjy_trimed = rs.ExtrudeSurface(mg_lgjy_trimed,rs.AddLine(rs.AddPoint(0,0,0),rs.AddPoint(0,0,20 * x)))
mg_lgjy_trimed2 = rs.MoveObject(rs.CopyObject(mg_lgjy_trimed),((HuaGong_CaiFen_left*2 + 9) *x,0,0))

mg_lgjy_head = rs.BooleanDifference(mg_lgjy_trimed,mg_lgjy_untrimed,delete_input=False)[1]
mg_lgjy_tail1 = rs.BooleanDifference(mg_lgjy_trimed,mg_lgjy_untrimed,delete_input=False)[0]
mg_lgjy_tail = rs.BooleanIntersection(mg_lgjy_trimed2,mg_lgjy_tail1,delete_input=False)[0]
mg_lgjy_head2 = rs.BooleanIntersection(mg_lgjy_trimed2,mg_lgjy_tail1,delete_input=False)[1]

rs.MoveObject(mg_lgjy_head,(-18 * x,0,0))
rs.MoveObject(mg_lgjy_head2,(18 * x,0,0))

#中间连接
mg_lgjy_mid = rs.ExplodePolysurfaces(mg_lgjy_head)[15]

mg_lgjy_mid = rs.ExtrudeSurface(mg_lgjy_mid,rs.AddLine(rs.AddPoint(0,0,0),rs.AddPoint(19 *x,0,0)))
mg_lgjy_mid2 = rs.MoveObject(rs.CopyObject(mg_lgjy_mid),((HuaGong_CaiFen_left*2 + 27) *x,0,0))

mg_lgjy_untrimed1 = rs.BooleanDifference(mg_lgjy_mid,mg_lgjy_head,delete_input = False)
mg_lgjy_untrimed1 = rs.BooleanDifference(mg_lgjy_untrimed1,mg_lgjy_tail,delete_input = False)
mg_lgjy_untrimed1 = rs.BooleanIntersection(mg_lgjy_untrimed1,mg_lgjy_mid2,delete_input = False)
mg_lgjy_untrimed1 = rs.BooleanDifference(mg_lgjy_untrimed1,mg_lgjy_head2,delete_input = True)

rs.MoveObject(mg_lgjy_untrimed1,(0,0,21 * x))

# 慢栱-连栱交隐2
# 面扩方向

mg_lgjy_untrimed2 = rs.CopyObject(gzg_lgjy1_2_zj2)

mg_lgjy_trimed2_1 = rs.ExplodePolysurfaces(mg_lgjy_untrimed2)[19]
mg_lgjy_trimed2_1 = rs.CurveEndPoint(rs.DuplicateEdgeCurves(mg_lgjy_trimed2_1)[1])
rs.MoveObject(mg_lgjy_trimed2_1,(-x,0,0))
mg_lgjy_trimed2_1 = rs.AddLine(mg_lgjy_trimed2_1,rs.MoveObject(rs.CopyObject(mg_lgjy_trimed2_1),(12 * x,0,0)))
mg_lgjy_trimed2_1 = rs.ExtrudeCurve(mg_lgjy_trimed2_1,rs.AddLine(rs.AddPoint(0,0,0),rs.AddPoint(0,-x,0)))
mg_lgjy_trimed2_1 = rs.ExtrudeSurface(mg_lgjy_trimed2_1,rs.AddLine(rs.AddPoint(0,0,0),rs.AddPoint(0,0,20 * x)))

mg_lgjy_trimed2_2 = rs.MoveObject(rs.CopyObject(mg_lgjy_trimed2_1),(0,-(HuaGong_CaiFen_left*2 + 9) *x,0))

mg_lgjy_head2_1 = rs.BooleanUnion([mg_lgjy_trimed2_1,mg_lgjy_untrimed2],delete_input=False)[1]

rs.MoveObject(mg_lgjy_head2_1,(0,18 * x,0))

mg_lgjy_untrimed2 = rs.BooleanUnion([mg_lgjy_trimed2_1,mg_lgjy_untrimed2],delete_input=False)[0]

mg_lgjy_head2_2 = rs.BooleanUnion([mg_lgjy_trimed2_2,mg_lgjy_untrimed2],delete_input=False)[1]

rs.MoveObject(mg_lgjy_head2_2,(0,-18 * x,0))

mg_lgjy_untrimed2_1 = rs.BooleanUnion([mg_lgjy_trimed2_2,mg_lgjy_untrimed2],delete_input=False)[0]

#中间连接
mg_lgjy_mid2_1 = rs.ExplodePolysurfaces(mg_lgjy_head2_1)[20]

mg_lgjy_mid2_1 = rs.ExtrudeSurface(mg_lgjy_mid2_1,rs.AddLine(rs.AddPoint(0,0,0),rs.AddPoint(0,-19 * x,0)))

mg_lgjy_mid2_2 = rs.MoveObject(rs.CopyObject(mg_lgjy_mid2_1),(0,-(HuaGong_CaiFen_left*2 + 27) *x,0))

mg_lgjy_untrimed2 = rs.BooleanDifference(mg_lgjy_head2_1,mg_lgjy_mid2_1,delete_input = False)

mg_lgjy_untrimed2 = rs.BooleanIntersection(mg_lgjy_untrimed2_1,mg_lgjy_untrimed2,delete_input = False)

mg_lgjy_untrimed2 = rs.BooleanDifference(mg_lgjy_untrimed2,mg_lgjy_mid2_2,delete_input = False)

mg_lgjy_untrimed2 = rs.BooleanIntersection(mg_lgjy_head2_2,mg_lgjy_untrimed2,delete_input = True)

rs.MoveObject(mg_lgjy_untrimed2,(0,0,21 * x))

#慢栱-连栱交隐上的散斗

SanDou_mgjy1_zj = rs.MoveObject(rs.CopyObject(SanDou_gzgjy1_zj),(0,0,21 * x))
SanDou_mgjy2_zj = rs.MoveObject(rs.CopyObject(SanDou_gzgjy2_zj),(0,18 * x,21 * x))

SanDou_mgjy3_zj = rs.MirrorObject(SanDou_mgjy1_zj,hg_zj_pt1,rs.MoveObject(rs.CopyObject(hg_zj_pt1),(x,x,0)),copy=True)
SanDou_mgjy4_zj = rs.MirrorObject(SanDou_mgjy2_zj,hg_zj_pt1,rs.MoveObject(rs.CopyObject(hg_zj_pt1),(x,x,0)),copy=True)

SanDou_mgjy5_zj = rs.MoveObject(rs.CopyObject(SanDou_mgjy1_zj ),(-42 * x,-24 * x,0))
SanDou_mgjy6_zj = rs.MirrorObject(SanDou_mgjy5_zj,hg_zj_pt1,rs.MoveObject(rs.CopyObject(hg_zj_pt1),(x,x,0)),copy=True)

#下一层昂被慢拱剪切

ang1_zj_untrimrd_brep = rs.BooleanIntersection(mg_lgjy_untrimed2,ang1_zj_untrimrd_brep,delete_input = False)

ang1_zj_untrimrd_brep2 = rs.BooleanIntersection(mg_lgjy_untrimed1,ang1_zj_untrimrd_brep2,delete_input = False)

#角昂被慢拱剪切

ang_jiao_zj_untrimrd_brep = rs.BooleanIntersection(mg_lgjy_untrimed2,ang_jiao_zj_untrimrd_brep,delete_input = False)

ang_jiao_zj_untrimrd_brep = rs.BooleanIntersection(rs.MoveObject(rs.CopyObject(mg_lgjy_untrimed2),(0,0,5 * x)),ang_jiao_zj_untrimrd_brep,delete_input = False)

ang_jiao_zj_untrimrd_brep = rs.BooleanIntersection(mg_lgjy_untrimed1,ang_jiao_zj_untrimrd_brep,delete_input = False)

ang_jiao_zj_untrimrd_brep = rs.BooleanIntersection(rs.MoveObject(rs.CopyObject(mg_lgjy_untrimed1),(0,0,5 * x)),ang_jiao_zj_untrimrd_brep,delete_input = False)




#二层下昂
ang2_zj_untrimrd_brep_1 =rs.CopyObject(ang1_zj_untrimrd_brep_1)
rs.RotateObject(ang2_zj_untrimrd_brep_1,ang1_zj_pt1,24.08,[0,x,0])
rs.MoveObject(ang2_zj_untrimrd_brep_1,(-21 *x,0,0))
rs.RotateObject(ang2_zj_untrimrd_brep_1,ang1_zj_pt1,-24.08,[0,x,0])
rs.MoveObject(ang2_zj_untrimrd_brep_1,(0,0,21 * x))

#二层下昂上部

ang2_zj_up = rs.ExplodePolysurfaces(ang2_zj_untrimrd_brep_1)[1:3]

ang2_zj_up_1 = rs.ExtrudeSurface(ang2_zj_up[0],rs.AddLine(rs.AddPoint(0,0,0),rs.AddPoint(0,0,8 * x)))
ang2_zj_up_2 = rs.ExtrudeSurface(ang2_zj_up[1],rs.AddLine(rs.AddPoint(0,0,0),rs.AddPoint(0,0,8 * x)))

ang2_zj_up = rs.BooleanIntersection(ang2_zj_up_1,ang2_zj_up_2,delete_input = False)

ang2_zj_up = rs.BooleanUnion([ang2_zj_up,rs.MoveObject(rs.CopyObject(ang2_zj_untrimrd_brep_1),(0,0,21 * x))],delete_input = False)
rs.ScaleObject(ang2_zj_up,hg_zj_pt1,[1,0.8,1],copy=False)

#上下合并
ang2_zj_untrimrd_brep_1 = rs.BooleanDifference(ang2_zj_up,ang2_zj_untrimrd_brep_1,delete_input = True)

#昂上部剪切

ang2_zj_trimrd_brep = rs.MoveObject(rs.CopyObject(ang1_trimed),(0,0,21 * x))

ang2_zj_untrimrd_brep_1 = rs.BooleanUnion([ang2_zj_trimrd_brep,ang2_zj_untrimrd_brep_1],delete_input = False)[0]

#二层下昂被骑昂斗剪切

ang2_zj_untrimrd_brep_1 = rs.BooleanUnion([QIAngDou_ang1_zj,ang2_zj_untrimrd_brep_1],delete_input = False)

#二层下昂被慢拱斗剪切

ang2_zj_untrimrd_brep_1 = rs.BooleanDifference(mg_lgjy_untrimed2,ang2_zj_untrimrd_brep_1,delete_input = False)



ang2_zj_untrimrd_brep_2 = rs.MirrorObject(ang2_zj_untrimrd_brep_1,hg_zj_pt1,rs.MoveObject(rs.CopyObject(hg_zj_pt1),(x,x,0)),copy=True)






#昂下部剪切

ang2_down1 = rs.MoveObject(rs.CopyObject(ang1_trimed2),(0,0,21 * x))

ang2_zj_untrimrd_brep_1 = rs.BooleanIntersection(ang2_down1,ang2_zj_untrimrd_brep_1,delete_input = False)

ang2_down2 = rs.MoveObject(rs.CopyObject(ang1_trimed3),(0,0,21 * x))

ang2_zj_untrimrd_brep_2 = rs.BooleanIntersection(ang2_down2,ang2_zj_untrimrd_brep_2,delete_input = False)


#角昂被二层下昂剪切

ang_jiao_zj_untrimrd_brep = rs.BooleanDifference(ang_jiao_zj_untrimrd_brep,ang2_zj_untrimrd_brep_1,delete_input = False)
ang_jiao_zj_untrimrd_brep = rs.BooleanDifference(ang_jiao_zj_untrimrd_brep,ang2_zj_untrimrd_brep_2,delete_input = False)


#第二层下昂上的交互斗


#交互斗的源点

jiaohdou_origin_pt1 = rs.ExplodePolysurfaces(JiaoHuDou_zj)[5]
jiaohdou_origin_pt1 = rs.CurveStartPoint(rs.DuplicateEdgeCurves(jiaohdou_origin_pt1)[0])

jiaohdou_origin_pt_x = rs.MoveObject(rs.CopyObject(jiaohdou_origin_pt1),(1,0,0))

jiaohdou_origin_pt_y = rs.MoveObject(rs.CopyObject(jiaohdou_origin_pt1),(0,1,0))

jiaohdou_origin_pt = [jiaohdou_origin_pt1,jiaohdou_origin_pt_x,jiaohdou_origin_pt_y]


#交互斗的投射点在第二层下昂上

ang2_project_pt1 = rs.ExplodePolysurfaces(ang2_zj_untrimrd_brep_1)[10]
ang2_project_pt1 = rs.CurveEndPoint(rs.DuplicateEdgeCurves(ang2_project_pt1)[2])

ang2_project_pt_x = rs.MoveObject(rs.CopyObject(ang2_project_pt1),(1,0,0))

ang2_project_pt_y = rs.MoveObject(rs.CopyObject(ang2_project_pt1),(0,1,0))

ang2_project_pt = [ang2_project_pt1,ang2_project_pt_x,ang2_project_pt_y]


JiaoHuDou_ang2 = rs.OrientObject(rs.CopyObject(JiaoHuDou_zj1),jiaohdou_origin_pt,ang2_project_pt)
JiaoHuDou_ang2 = rs.MoveObject(rs.CopyObject(JiaoHuDou_zj1),(-42 * x,0,21 * x))
JiaoHuDou_ang2_2 = rs.MirrorObject(JiaoHuDou_ang2,hg_zj_pt1,rs.MoveObject(rs.CopyObject(hg_zj_pt1),(x,x,0)),copy=True)



#第二层下昂被交互斗剪切

JiaoHuDou_ang2_trimed = rs.ExplodePolysurfaces(JiaoHuDou_ang2)[21]

JiaoHuDou_ang2_trimed1 = rs.ExtrudeSurface(JiaoHuDou_ang2_trimed,rs.AddLine(rs.AddPoint(0,0,0),rs.AddPoint(0,0,10 * x)))
JiaoHuDou_ang2_trimed1 = rs.BooleanDifference(JiaoHuDou_ang2,JiaoHuDou_ang2_trimed1,delete_input = False)

JiaoHuDou_ang2_trimed2 = rs.MirrorObject(JiaoHuDou_ang2_trimed1,hg_zj_pt1,rs.MoveObject(rs.CopyObject(hg_zj_pt1),(x,x,0)),copy=True)

ang2_zj_untrimrd_brep_1 = rs.BooleanIntersection(JiaoHuDou_ang2_trimed1,ang2_zj_untrimrd_brep_1,delete_input=False)

ang2_zj_untrimrd_brep_2 = rs.BooleanIntersection(JiaoHuDou_ang2_trimed2,ang2_zj_untrimrd_brep_2,delete_input=False)



#第二层角昂
ang2_jiao_untrimed = rs.CopyObject(ang_jiao_zj_untrimrd_brep_1)
rs.RotateObject(ang2_jiao_untrimed,hg_zj_pt1,-45,[0,0,x],copy=False)
rs.RotateObject(ang2_jiao_untrimed,rs.MoveObject(rs.CopyObject(ang_jiao_zj_pt1),(0,0,0)),24.08,[0,x,0],copy=False)
rs.MoveObject(ang2_jiao_untrimed,(-21 * x,0,0))
rs.RotateObject(ang2_jiao_untrimed,rs.MoveObject(rs.CopyObject(ang_jiao_zj_pt1),(0,0,0)),-24.08,[0,x,0],copy=False)
rs.MoveObject(ang2_jiao_untrimed,(0,0,21 * x))
rs.RotateObject(ang2_jiao_untrimed,hg_zj_pt1,45,[0,0,x],copy=False)




#调整第二层角昂长度

ang2_jiao_untrimed_2 = rs.CopyObject(ang2_jiao_untrimed)

rs.RotateObject(ang2_jiao_untrimed_2,hg_zj_pt1,-45,[0,0,x],copy=False)

rs.MoveObject(ang2_jiao_untrimed_2,(21 * x,0,-21 * x))

rs.RotateObject(ang2_jiao_untrimed_2,ang1_zj_pt1,24.08,[0,x,0],copy=False)

ang2_trimed = rs.ExplodePolysurfaces(ang2_jiao_untrimed_2)[11]
ang2_trimed = rs.JoinCurves([rs.DuplicateEdgeCurves(ang2_trimed )[0],rs.DuplicateEdgeCurves(ang2_trimed )[2],rs.DuplicateEdgeCurves(ang2_trimed )[5]])
rs.MoveObject(ang2_trimed,(2 * x,0,10 * x))

ang2_trimed = rs.ExtrudeCurve(ang2_trimed,rs.AddLine(rs.AddPoint(0,0,0),rs.AddPoint(x,0,0)))
ang2_trimed = rs.ExtrudeSurface(ang2_trimed,rs.AddLine(rs.AddPoint(0,0,0),rs.AddPoint(0,0,-40 * x)))

ang2_jiao_untrimed_2_1 = rs.BooleanUnion([ang2_jiao_untrimed_2,ang2_trimed],delete_input=False)[1]

ang2_jiao_untrimed_2_2 = rs.BooleanUnion([ang2_jiao_untrimed_2,ang2_trimed],delete_input=False)[0]

rs.MoveObject(ang2_jiao_untrimed_2_1,(-6.3 * x,0,0))


ang2_jiao_untrimed_2_3 = rs.ExplodePolysurfaces(ang2_jiao_untrimed_2_1)[3]
ang2_jiao_untrimed_2_3 = rs.ExtrudeSurface(ang2_jiao_untrimed_2_3,rs.AddLine(rs.AddPoint(0,0,0),rs.AddPoint(7.3 * x,0,0)))



ang2_jiao_untrimed_2 = rs.BooleanDifference(ang2_jiao_untrimed_2_1,ang2_jiao_untrimed_2_3,delete_input = False)

ang2_jiao_untrimed_2 = rs.BooleanIntersection(ang2_jiao_untrimed_2,ang2_jiao_untrimed_2_2,delete_input = False)

rs.RotateObject(ang2_jiao_untrimed_2,ang1_zj_pt1,-24.08,[0,x,0],copy=False)

rs.MoveObject(ang2_jiao_untrimed_2,(-21 * x,0,21 * x))

ang2_jiao_untrimed = rs.RotateObject(ang2_jiao_untrimed_2,hg_zj_pt1,45,[0,0,x],copy=False)













#第二层角昂被骑昂斗剪切

ang2_jiao_untrimed = rs.BooleanUnion([QIAngDou_ang_jiao_zj,ang2_jiao_untrimed],delete_input=False)

#第二层角昂被慢拱剪切

ang2_jiao_untrimed = rs.BooleanDifference(mg_lgjy_untrimed1,ang2_jiao_untrimed,delete_input=False)

ang2_jiao_untrimed = rs.BooleanIntersection(rs.MoveObject(rs.CopyObject(mg_lgjy_untrimed1),(0,0,-2 * x)),ang2_jiao_untrimed,delete_input=False)

ang2_jiao_untrimed = rs.BooleanIntersection(mg_lgjy_untrimed2,ang2_jiao_untrimed,delete_input=False)

ang2_jiao_untrimed = rs.BooleanIntersection(rs.MoveObject(rs.CopyObject(mg_lgjy_untrimed2),(0,0,-2 * x)),ang2_jiao_untrimed,delete_input=False)



#第二层下昂被第二层角昂剪切

ang2_zj_untrimrd_brep_1 = rs.BooleanDifference(ang2_zj_untrimrd_brep_1,ang2_jiao_untrimed,delete_input=False)

ang2_zj_untrimrd_brep_2 = rs.BooleanDifference(ang2_zj_untrimrd_brep_2,ang2_jiao_untrimed,delete_input=False)


#第二层角昂上的平盘斗

#平板斗的投射源点

SanDou_ppd_origin_pt1 = rs.ExplodePolysurfaces(SanDou_ppd)[5]
SanDou_ppd_origin_pt1 = rs.CurveStartPoint(rs.DuplicateEdgeCurves(SanDou_ppd_origin_pt1)[0])


SanDou_ppd_origin_pt_x = rs.MoveObject(rs.CopyObject(SanDou_ppd_origin_pt1),(1,0,0))

SanDou_ppd_origin_pt_y = rs.MoveObject(rs.CopyObject(SanDou_ppd_origin_pt1),(0,1,0))

SanDou_ppd_origin_pt = [SanDou_ppd_origin_pt1,SanDou_ppd_origin_pt_x,SanDou_ppd_origin_pt_y]


#平板斗的投射点

ang2_jiao_project_pt1 = rs.ExplodePolysurfaces(ang2_jiao_untrimed)[12]
ang2_jiao_project_pt1 = rs.CurveStartPoint(rs.DuplicateEdgeCurves(ang2_jiao_project_pt1)[3])


ang2_jiao_project_pt_x = rs.MoveObject(rs.CopyObject(ang2_jiao_project_pt1),(1,0,0))

ang2_jiao_project_pt_y = rs.MoveObject(rs.CopyObject(ang2_jiao_project_pt1),(0,1,0))

ang2_jiao_project_pt = [ang2_jiao_project_pt1,ang2_jiao_project_pt_x,ang2_jiao_project_pt_y]



SanDou_ppd_ang2_jiao = rs.OrientObject(rs.CopyObject(SanDou_ppd),SanDou_ppd_origin_pt,ang2_jiao_project_pt)

SanDou_ppd_ang2_jiao = rs.MoveObject(rs.CopyObject(SanDou_ppd),(-39.1 * x,-39.1 * x,21 * x))










#第二层角昂被平盘斗剪切

SanDou_ppd_trimed = rs.ExplodePolysurfaces(SanDou_ppd_ang2_jiao)[4]

SanDou_ppd_trimed = rs.ExtrudeSurface(SanDou_ppd_trimed,rs.AddLine(rs.AddPoint(0,0,0),rs.AddPoint(0,0,8 * x)))

SanDou_ppd_trimed = rs.BooleanDifference(SanDou_ppd_ang2_jiao,SanDou_ppd_trimed,delete_input=False)



ang2_jiao_untrimed = rs.BooleanIntersection(SanDou_ppd_trimed,ang2_jiao_untrimed,delete_input = True)


#罗汉枋

lhf_zj_untrimed = rs.ExplodePolysurfaces(SanDou_mgjy2_zj)[16]

lhf_zj_untrimed = rs.CurveEndPoint(rs.DuplicateEdgeCurves(lhf_zj_untrimed)[0])
lhf_zj_untrimed = rs.AddLine(lhf_zj_untrimed,rs.MoveObject(rs.CopyObject(lhf_zj_untrimed),(10 * x,0,0)))
lhf_zj_untrimed1 = rs.ExtrudeCurve(lhf_zj_untrimed,rs.AddLine(rs.AddPoint(0,0,0),rs.AddPoint(0,-(HuaGong_CaiFen_left*3+6) * x,0)))
lhf_zj_untrimed1 = rs.ExtrudeSurface(lhf_zj_untrimed1,rs.AddLine(rs.AddPoint(0,0,0),rs.AddPoint(0,0,15 * x)))

lhf_zj_untrimed2 = rs.MirrorObject(lhf_zj_untrimed1,hg_zj_pt1,rs.MoveObject(rs.CopyObject(hg_zj_pt1),(x,x,0)),copy=True)

#罗汉枋剪切

lhf_trimed_brep = rs.ExplodePolysurfaces(lhf_zj_untrimed1)[3]

lhf_trimed_brep = rs.DuplicateEdgeCurves(lhf_trimed_brep)[0]
lhf_trimed_brep = rs.ExtrudeCurve(lhf_trimed_brep,rs.AddLine(rs.AddPoint(0,0,0),rs.AddPoint(0,10 * x,0)))
lhf_trimed_brep = rs.ExtrudeSurface(lhf_trimed_brep,rs.AddLine(rs.AddPoint(0,0,0),rs.AddPoint(0,0,7.5 * x)))
lhf_trimed_brep2 = rs.MoveObject(rs.CopyObject(lhf_trimed_brep),(0,0,7.5 * x))
#

lhf_zj_untrimed1 = rs.BooleanIntersection(lhf_zj_untrimed1,lhf_trimed_brep,delete_input = True)
lhf_zj_untrimed2 = rs.BooleanIntersection(lhf_zj_untrimed2,lhf_trimed_brep2,delete_input = True)








#第二层角昂被罗汉枋剪切

ang2_jiao_untrimed = rs.BooleanDifference(ang2_jiao_untrimed,lhf_zj_untrimed1,delete_input=False)
ang2_jiao_untrimed = rs.BooleanDifference(ang2_jiao_untrimed,lhf_zj_untrimed2,delete_input=False)

#第二层下昂被罗汉枋剪切

ang2_zj_untrimrd_brep_1 = rs.BooleanDifference(ang2_zj_untrimrd_brep_1,lhf_zj_untrimed1,delete_input = False)

ang2_zj_untrimrd_brep_2 = rs.BooleanDifference(ang2_zj_untrimrd_brep_2,lhf_zj_untrimed2,delete_input = False)


#泥道栱上的素枋生成

sf_hg_zj1 = rs.ExplodePolysurfaces(SanDou_ang1_zj2)[16]
sf_hg_zj1 = rs.DuplicateEdgeCurves(sf_hg_zj1)[1]
sf_hg_zj1 = rs.ExtrudeCurve(sf_hg_zj1,rs.AddLine(rs.AddPoint(0,0,0),rs.AddPoint(0,-(HuaGong_CaiFen_left + 18) * x,0)))
sf_hg_zj1 = rs.ExtrudeSurface(sf_hg_zj1,rs.AddLine(rs.AddPoint(0,0,0),rs.AddPoint(0,0,15 * x)))

#素枋被第二层下昂剪切

sf_hg_zj1_1 = rs.BooleanIntersection(ang2_zj_untrimrd_brep_2,sf_hg_zj1,delete_input=False)

sf_hg_zj1 = rs.BooleanDifference(sf_hg_zj1,sf_hg_zj1_1,delete_input=False)[0]
sf_hg_zj2 = rs.MirrorObject(sf_hg_zj1,hg_zj_pt1,rs.MoveObject(rs.CopyObject(hg_zj_pt1),(x,x,0)),copy=True)



#令拱生成

#转角铺作令拱生成

lg_zj_pt1 = rs.CopyObject(hg_zj_pt1)
lg_zj_pt2 = rs.CopyObject(lg_zj_pt1)
rs.MoveObject(lg_zj_pt2,(-(HuaGong_CaiFen_left-5) * x,0,0))
lg_zj_ptz = rs.MoveObject(rs.CopyObject(lg_zj_pt2),(0,0,9 * x))
lg_zj_ptx = rs.MoveObject(rs.CopyObject(lg_zj_pt2),(20 * x,0,0))

lg_zj_crz = rs.AddLine(lg_zj_pt2,lg_zj_ptz)
lg_zj_crx = rs.AddLine(lg_zj_ptx,lg_zj_pt2)

#卷杀生成

juansha_lg_zj_crs = []

lg_zj_ptsz = rs.DivideCurve(lg_zj_crz,5)
lg_zj_ptsx = rs.DivideCurve(lg_zj_crx,5)
for i in range(len(lg_zj_ptsz)):
    juansha_lg_zj_cr = rs.AddLine(lg_zj_ptsz[i],lg_zj_ptsx[i])
    juansha_lg_zj_crs.append(juansha_lg_zj_cr)

juansha_lg_zj_crs = juansha_lg_zj_crs[1:len(juansha_lg_zj_crs)-1]

juansha_lg_zj_pts = []

for i in range(len(juansha_lg_zj_crs)):
    if i + 1 < len(juansha_lg_zj_crs):
        juansha_lg_pt = rs.CurveCurveIntersection(juansha_lg_zj_crs[i],juansha_lg_zj_crs[i+1])
        juansha_lg_zj_pts.append(juansha_lg_pt[0][1])
juansha_lg_zj_pts.append(rs.CurveEndPoint(lg_zj_crz))
juansha_lg_zj_pts.append(rs.MoveObject(rs.CopyObject(lg_zj_ptz),(0,0,6 * x)))
juansha_lg_zj_pts.append(rs.MoveObject(rs.CopyObject(lg_zj_ptz),(10 * x,0,6 * x)))
juansha_lg_zj_pts.insert(0,rs.CurveStartPoint(lg_zj_crx ))

juansha_lg_zj_curve = rs.AddPolyline(juansha_lg_zj_pts)
juansha_lg_zj_curve_1 = rs.MirrorObject(juansha_lg_zj_curve,hg_zj_pt1,rs.MoveObject(rs.CopyObject(hg_zj_pt1),(0,x,0)),copy=True)

juansha_lg_zj_curve = rs.JoinCurves([juansha_lg_zj_curve,juansha_lg_zj_curve_1,rs.AddLine(rs.CurveStartPoint(juansha_lg_zj_curve),rs.CurveStartPoint(juansha_lg_zj_curve_1)),rs.AddLine(rs.CurveEndPoint(juansha_lg_zj_curve),rs.CurveEndPoint(juansha_lg_zj_curve_1))])

lg_untrimed_brep = rs.AddPlanarSrf(juansha_lg_zj_curve)
rs.MoveObject(lg_untrimed_brep,(0,-5 * x,0))
lg_untrimed_brep = rs.ExtrudeSurface(lg_untrimed_brep,rs.AddLine(rs.AddPoint(0,0,0),rs.AddPoint(0,10 * x,0)))

#令栱的馒头榫
mts_lg_zj = rs.MoveObject(rs.CopyObject(lg_zj_ptz),(3.75 * x,-1.25 * x,6 * x))
mts_lg_zj = rs.AddLine(mts_lg_zj,rs.MoveObject(rs.CopyObject(mts_lg_zj),(2.5 * x,0,0)))
mts_lg_zj = rs.ExtrudeCurve(mts_lg_zj,rs.AddLine(rs.AddPoint(0,0,0),rs.AddPoint(0,2.5 * x,0)))
mts_lg_zj = rs.ExtrudeSurface(mts_lg_zj,rs.AddLine(rs.AddPoint(0,0,0),rs.AddPoint(0,0,2.5 * x)))
mts_lg_zj2 = rs.MirrorObject(mts_lg_zj,hg_zj_pt1,rs.MoveObject(rs.CopyObject(hg_zj_pt1),(0,x,0)),copy=True)
lg_untrimed_brep = rs.BooleanDifference(mts_lg_zj,lg_untrimed_brep,delete_input=False)
lg_untrimed_brep = rs.BooleanIntersection(mts_lg_zj2,lg_untrimed_brep,delete_input=False)

#令拱剪切

##拱眼隐去部深1分
#左
gyy_zj_cr_lg = rs.CopyObject(lg_zj_ptz)
rs.MoveObject(gyy_zj_cr_lg,(10 * x,0,6 * x))
gyy_zj_cr_lg_1 = rs.MoveObject(rs.CopyObject(gyy_zj_cr_lg),(0,0,-x))
gyy_zj_cr_lg_2 = rs.MoveObject(rs.CopyObject(gyy_zj_cr_lg),(x,0,-x))
gyy_zj_cr_lg_1_cr = rs.AddLine(gyy_zj_cr_lg_1,gyy_zj_cr_lg)
gyy_zj_cr_lg_2_cr = rs.AddLine(gyy_zj_cr_lg_2,gyy_zj_cr_lg_1)
gyy_zj_cr_lg = rs.AddFilletCurve(gyy_zj_cr_lg_1_cr,gyy_zj_cr_lg_2_cr,x)
gyy_zj_cr_lg2 = rs.RotateObject(gyy_zj_cr_lg,rs.CurveStartPoint(gyy_zj_cr_lg),180,[0,0,x],copy=True)
rs.MoveObject(gyy_zj_cr_lg2,((HuaGong_CaiFen_left +10 -14 - 7.875) * x,0,0))
gyy_zj_lg = rs.AddLoftSrf([gyy_zj_cr_lg,gyy_zj_cr_lg2])
gyy_zj_lg = rs.ExtrudeSurface(gyy_zj_lg,rs.AddLine(rs.AddPoint(0,0,0),rs.AddPoint(0,-2 * x,0)))
rs.MoveObject(gyy_zj_lg,(0,-4 * x,0))
gyy_zj_lg2 = rs.MirrorObject(gyy_zj_lg,hg_zj_pt1,rs.MoveObject(rs.CopyObject(hg_zj_pt1),(0,x,0)),copy=True)
gyy_zj_lg3 = rs.MirrorObject(gyy_zj_lg,hg_zj_pt1,rs.MoveObject(rs.CopyObject(hg_zj_pt1),(x,0,0)),copy=True)
gyy_zj_lg4 = rs.MirrorObject(gyy_zj_lg2,hg_zj_pt1,rs.MoveObject(rs.CopyObject(hg_zj_pt1),(x,0,0)),copy=True)



#令拱下部剪切
lg_trimed_brep = rs.CopyObject(hg_zj_pt1)
rs.MoveObject(lg_trimed_brep,(-5 * x,0,0))
lg_trimed_brep = rs.AddLine(lg_trimed_brep,rs.MoveObject(rs.CopyObject(lg_trimed_brep),(10 * x,0,0)))
lg_trimed_brep = rs.ExtrudeCurve(lg_trimed_brep,rs.AddLine(rs.AddPoint(0,0,0),rs.AddPoint(0,-10 * x,0)))
lg_trimed_brep = rs.ExtrudeSurface(lg_trimed_brep,rs.AddLine(rs.AddPoint(0,0,0),rs.AddPoint(0,0,10 * x)))
rs.MoveObject(lg_trimed_brep,(0,5 * x,5 * x))
lg_trimed_brep2 = rs.RotateObject(lg_untrimed_brep,hg_zj_pt1,45,[0,0,x],copy=True)
rs.MoveObject(lg_trimed_brep2,(0,0,7.5 * x))
lg_trimed_brep3 = rs.MoveObject(rs.CopyObject(lg_trimed_brep),(0,0,-10* x))
lg_trimed_brep4 = rs.MoveObject(rs.CopyObject(lg_trimed_brep3),(0,0,15 * x))

lg1_zj = rs.BooleanUnion([gyy_zj_lg,gyy_zj_lg2,gyy_zj_lg3,gyy_zj_lg4,lg_untrimed_brep],delete_input=False)
lg1_zj2 = rs.RotateObject(lg1_zj,hg_zj_pt1,90,[0,0,x],copy=True)


lg1_zj = rs.BooleanUnion([lg1_zj,lg_trimed_brep],delete_input=False)


lg1_zj2 = rs.BooleanUnion([lg1_zj2,lg_trimed_brep3],delete_input=False)
lg1_zj2 = rs.BooleanUnion([lg_trimed_brep4,lg1_zj2],delete_input=False)




rs.MoveObjects([lg1_zj,lg1_zj2],(-90 * x,-90 * x,63 * x))






#第二层下昂上的令拱

lg_ang2 = rs.MoveObject(rs.CopyObject(lg1_zj),((HuaGong_CaiFen_left + 58) * x,0,0))

lg2_ang2 = rs.MirrorObject(lg_ang2,hg_zj_pt1,rs.MoveObject(rs.CopyObject(hg_zj_pt1),(x,x,0)),copy=True)



#令拱上的散斗

SanDou_lg1 = rs.MoveObject(rs.CopyObject(SanDou_mgjy5_zj),(0,26 * x,0))
SanDou_lg2 = rs.MoveObject(rs.CopyObject(SanDou_lg1),(0,44 * x,0))

SanDou_lg3 = rs.MirrorObject(SanDou_lg1,hg_zj_pt1,rs.MoveObject(rs.CopyObject(hg_zj_pt1),(x,x,0)),copy=True)

SanDou_lg4 = rs.MirrorObject(SanDou_lg2,hg_zj_pt1,rs.MoveObject(rs.CopyObject(hg_zj_pt1),(x,x,0)),copy=True)

SanDou_lg5 = rs.MoveObject(rs.CopyObject(SanDou_lg1),(0,-(HuaGong_CaiFen_left + 58) * x,0))

SanDou_lg6 = rs.MoveObject(rs.CopyObject(SanDou_lg2),(0,-(HuaGong_CaiFen_left + 58) * x,0))

SanDou_lg7 = rs.MirrorObject(SanDou_lg5,hg_zj_pt1,rs.MoveObject(rs.CopyObject(hg_zj_pt1),(x,x,0)),copy=True)

SanDou_lg8 = rs.MirrorObject(SanDou_lg6,hg_zj_pt1,rs.MoveObject(rs.CopyObject(hg_zj_pt1),(x,x,0)),copy=True)





#由昂


ang_you_jiao_untrimed_zj_pt1 = rs.MoveObject(rs.CopyObject(htz_pt1),(-10 * x,-x,-14 * x))
ang_you_jiao_untrimed_zj_pt2 = rs.MoveObject(rs.CopyObject(ang_you_jiao_untrimed_zj_pt1),(-43.5 * x- 31.5 * x- 31.5 * x- 31.5 * x,0,0))
ang_you_jiao_untrimed_zj_pt3 = rs.MoveObject(rs.CopyObject(ang_you_jiao_untrimed_zj_pt2),(0,0,2 * x))
ang_you_jiao_untrimed_zj_pt0 = rs.CopyObject(hg_zj_pt1)
rs.MoveObject(ang_you_jiao_untrimed_zj_pt0,(-(HuaGong_CaiFen_left + 21) * x,-5 * x,57 * x))
ang_you_jiao_untrimed_zj_pt4 = rs.MoveObject(rs.CopyObject(ang_you_jiao_untrimed_zj_pt0),(-21.75 * x- 31.5 * x- 31.5 * x- 31.5 * x,0,0))
ang_you_jiao_untrimed_zj_pt5 = rs.MoveObject(rs.CopyObject(ang_you_jiao_untrimed_zj_pt0),(180 * x,0,0))
ang_you_jiao_untrimed_zj_pt6 = rs.MoveObject(rs.CopyObject(ang_you_jiao_untrimed_zj_pt1),(180 * x,0,0))

ang_you_jiao_untrimed_zj_cr1 = rs.AddPolyline([ang_you_jiao_untrimed_zj_pt6,ang_you_jiao_untrimed_zj_pt1,ang_you_jiao_untrimed_zj_pt2,ang_you_jiao_untrimed_zj_pt3])
rs.RotateObject(ang_you_jiao_untrimed_zj_cr1,rs.MoveObject(rs.CopyObject(ang_you_jiao_untrimed_zj_pt1),(-21 * x,0,0)),-24.08,[0,x,0],copy=False)
ang_you_jiao_untrimed_zj_cr2 = rs.AddPolyline([rs.MoveObject(ang_you_jiao_untrimed_zj_pt4,(-x,0,0)),ang_you_jiao_untrimed_zj_pt0,ang_you_jiao_untrimed_zj_pt5])
rs.RotateObject(ang_you_jiao_untrimed_zj_cr2,rs.MoveObject(rs.CopyObject(ang_you_jiao_untrimed_zj_pt0),(-21 * x,0,0)),-24.08,[0,x,0],copy=False)

ang_you_jiao_untrimed_zj_untrimrd_brep = rs.JoinCurves([ang_you_jiao_untrimed_zj_cr1,ang_you_jiao_untrimed_zj_cr2,rs.AddLine(rs.CurveStartPoint(ang_you_jiao_untrimed_zj_cr2),rs.CurveEndPoint(ang_you_jiao_untrimed_zj_cr1)),rs.AddLine(rs.CurveStartPoint(ang_you_jiao_untrimed_zj_cr1),rs.CurveEndPoint(ang_you_jiao_untrimed_zj_cr2))])
ang_you_jiao_untrimed_zj_untrimrd_brep = rs.AddPlanarSrf(ang_you_jiao_untrimed_zj_untrimrd_brep)
ang_you_jiao_untrimed_zj_untrimrd_brep = rs.ExtrudeSurface(ang_you_jiao_untrimed_zj_untrimrd_brep,rs.AddLine(rs.AddPoint(0,0,0),rs.AddPoint(0,10 * x,0)))

rs.RotateObject(ang_you_jiao_untrimed_zj_untrimrd_brep,hg_zj_pt1,45,[0,0,x],copy = False)

rs.MoveObject(ang_you_jiao_untrimed_zj_untrimrd_brep,(0,0,42 * x))


#由昂上端

ang_you_jiao_untrimed_zj_untrimrd_brep_up = rs.ExplodePolysurfaces(ang_you_jiao_untrimed_zj_untrimrd_brep)[1:3]
ang_you_jiao_untrimed_zj_untrimrd_brep_up_1 = rs.ExtrudeSurface(ang_you_jiao_untrimed_zj_untrimrd_brep_up[0],rs.AddLine(rs.AddPoint(0,0,0),rs.AddPoint(0,0,8 * x)))
ang_you_jiao_untrimed_zj_untrimrd_brep_up_2 = rs.ExtrudeSurface(ang_you_jiao_untrimed_zj_untrimrd_brep_up[1],rs.AddLine(rs.AddPoint(0,0,0),rs.AddPoint(0,0,8 * x)))

ang_you_jiao_untrimed_zj_untrimrd_brep_up = rs.BooleanIntersection(ang_you_jiao_untrimed_zj_untrimrd_brep_up_1,ang_you_jiao_untrimed_zj_untrimrd_brep_up_2,delete_input=False)

rs.RotateObject(ang_you_jiao_untrimed_zj_untrimrd_brep_up,hg_zj_pt1,45,[0,0,x],copy=False)
rs.ScaleObject(ang_you_jiao_untrimed_zj_untrimrd_brep_up,hg_zj_pt1,[0.8,1,1])
rs.RotateObject(ang_you_jiao_untrimed_zj_untrimrd_brep_up,hg_zj_pt1,-45,[0,0,x],copy=False)

ang_you_jiao_untrimed_zj_untrimrd_brep = rs.BooleanDifference(ang_you_jiao_untrimed_zj_untrimrd_brep_up,ang_you_jiao_untrimed_zj_untrimrd_brep,delete_input = False)


#由昂被罗汉枋剪切

ang_you_jiao_untrimed_zj_untrimrd_brep = rs.BooleanUnion([lhf_zj_untrimed1,ang_you_jiao_untrimed_zj_untrimrd_brep],delete_input=False)

ang_you_jiao_untrimed_zj_untrimrd_brep = rs.BooleanUnion([lhf_zj_untrimed2,ang_you_jiao_untrimed_zj_untrimrd_brep],delete_input=False)

#平盘斗被由昂剪切

SanDou_ppd_ang2_jiao = rs.BooleanDifference(ang_you_jiao_untrimed_zj_untrimrd_brep,SanDou_ppd_ang2_jiao,delete_input=False)


#由昂被令拱剪切
lg_trimed_brep_ang_you_1 = rs.ExplodePolysurfaces(lg1_zj)[16:19]

lg_trimed_brep_ang_you_1_1 = rs.ExtrudeSurface(lg_trimed_brep_ang_you_1[0],rs.AddLine(rs.AddPoint(0,0,0),rs.AddPoint(0,0,15 * x)))
lg_trimed_brep_ang_you_1_2 = rs.ExtrudeSurface(lg_trimed_brep_ang_you_1[1],rs.AddLine(rs.AddPoint(0,0,0),rs.AddPoint(0,0,15 * x)))
lg_trimed_brep_ang_you_1_3 = rs.ExtrudeSurface(lg_trimed_brep_ang_you_1[2],rs.AddLine(rs.AddPoint(0,0,0),rs.AddPoint(0,0,15 * x)))

lg_trimed_brep_ang_you_1 = rs.BooleanIntersection(lg_trimed_brep_ang_you_1_1,lg_trimed_brep_ang_you_1_2,delete_input=False)
lg_trimed_brep_ang_you_1 = rs.BooleanIntersection(lg_trimed_brep_ang_you_1,lg_trimed_brep_ang_you_1_3,delete_input=False)


lg_trimed_brep_ang_you_2 = rs.MirrorObject(lg_trimed_brep_ang_you_1,hg_zj_pt1,rs.MoveObject(rs.CopyObject(hg_zj_pt1),(x,x,0)),copy=True)
lg_trimed_brep_ang_you = rs.BooleanIntersection(lg_trimed_brep_ang_you_2,lg_trimed_brep_ang_you_1,delete_input = False)


ang_you_jiao_untrimed_zj_untrimrd_brep = rs.BooleanDifference(lg_trimed_brep_ang_you,ang_you_jiao_untrimed_zj_untrimrd_brep,delete_input=False)


#第二层下昂上令拱上的耍头

#耍头起始点

st_pt_ang2 = rs.ExplodePolysurfaces(lg2_ang2)[0]
st_pt_ang2 = rs.CurveStartPoint(rs.DuplicateEdgeCurves(st_pt_ang2)[2])

#耍头
st_ang2zjpt_0 =rs.CopyObject(st_pt_ang2)
st_ang2zjpt_1 =rs.CopyObject(st_ang2zjpt_0)
rs.MoveObject(st_ang2zjpt_1,(-4 * x,0,0))
st_ang2zjpt_2 =rs.CopyObject(st_ang2zjpt_1)
rs.MoveObject(st_ang2zjpt_2,(-12 * x,0,-3 * x))
st_ang2zjpt_3 =rs.CopyObject(st_ang2zjpt_2)
rs.MoveObject(st_ang2zjpt_3,(0,0,-3 * x))
st_ang2zjpt_4 =rs.CopyObject(st_ang2zjpt_3)
rs.MoveObject(st_ang2zjpt_4,(0,0,-9 * x))
st_ang2zjpt_5 =rs.CopyObject(st_ang2zjpt_0)
rs.MoveObject(st_ang2zjpt_5,(-3 * x,0,-15 * x))
st_ang2zjpt_6 =rs.CopyObject(st_ang2zjpt_5)
rs.MoveObject(st_ang2zjpt_6,(0,0,4 * x))
st_ang2zjpt_7 =rs.CopyObject(st_ang2zjpt_6)
rs.MoveObject(st_ang2zjpt_7,(3 * x,0,0))
st_ang2zjpt_8 =rs.CopyObject(st_ang2zjpt_7)
rs.MoveObject(st_ang2zjpt_8,(0,0,x))
st_ang2zjpt_9 =rs.CopyObject(st_ang2zjpt_8)
rs.MoveObject(st_ang2zjpt_9,(10 * x,0,0))
st_ang2zjpt_10 =rs.CopyObject(st_ang2zjpt_9)
rs.MoveObject(st_ang2zjpt_10,(0,0,-x))
st_ang2zjpt_11 =rs.CopyObject(st_ang2zjpt_10)
rs.MoveObject(st_ang2zjpt_11,(3 * x,0,0))
st_ang2zjpt_12 =rs.CopyObject(st_ang2zjpt_11)
rs.MoveObject(st_ang2zjpt_12,(0,0,-4 * x))
st_ang2zjpt_13 =rs.CopyObject(st_ang2zjpt_12)
rs.MoveObject(st_ang2zjpt_13,(3 * x,0,0))
st_ang2zjpt_15 =rs.CopyObject(st_ang2zjpt_1)
rs.MoveObject(st_ang2zjpt_15,(-6 * x,0,-3 * x))
st_ang2zjcr_1 = rs.AddPolyline([st_ang2zjpt_3,st_ang2zjpt_2,st_ang2zjpt_1,st_ang2zjpt_0,rs.MoveObject(rs.CopyObject(st_ang2zjpt_0),(30 * x,0,0)),st_ang2zjpt_13])
st_ang2zjcr_2 =rs.AddFilletCurve(rs.AddLine(st_ang2zjpt_3,st_ang2zjpt_4),rs.AddLine(st_ang2zjpt_4,st_ang2zjpt_5),9 * x,)
rs.ScaleObject(st_ang2zjcr_2,st_ang2zjpt_4,[rs.Distance(st_ang2zjpt_4,st_ang2zjpt_5)/(9 * x),1,1])
st_ang2zjbrep_untrimed = rs.JoinCurves([st_ang2zjcr_1,st_ang2zjcr_2])
st_ang2zjbrep_untrimed = rs.JoinCurves([st_ang2zjbrep_untrimed,rs.AddLine(rs.CurveStartPoint(st_ang2zjbrep_untrimed),rs.CurveEndPoint(st_ang2zjbrep_untrimed))])
st_ang2zjbrep_untrimed = rs.AddPlanarSrf(st_ang2zjbrep_untrimed)
st_ang2zjbrep_untrimed = rs.ExtrudeSurface(st_ang2zjbrep_untrimed,rs.AddLine(rs.AddPoint(0,0,0),rs.AddPoint(0,10 * x ,0)))
st_ang2zjup1 = rs.AddCurve([st_ang2zjpt_1,st_ang2zjpt_15,st_ang2zjpt_2])
st_ang2zjup1 = rs.AddLoftSrf([st_ang2zjup1,rs.MoveObject(rs.AddLine(st_ang2zjpt_1,st_ang2zjpt_2),(0,5 * x,0)),rs.MoveObject(rs.CopyObject(st_ang2zjup1),(0,10 * x,0))],loft_type=2)
st_ang2zjup1 =rs.ExtrudeSurface(st_ang2zjup1,rs.AddLine(rs.AddPoint(0,0,0),rs.AddPoint(-2 * x,0,2 * x)))
st_ang2zj_brep = rs.BooleanDifference(st_ang2zjup1 ,st_ang2zjbrep_untrimed ,delete_input = False)

rs.MoveObject(st_ang2zj_brep,(0,0,10 * x))

#耍头被令拱剪切

st_ang2zj_brep = rs.BooleanIntersection(st_ang2zj_brep,lg2_ang2,delete_input=False)

#耍头被第二层下昂剪切

st_ang2zj_brep = rs.BooleanDifference(st_ang2zj_brep,rs.ScaleObject(rs.CopyObject(ang2_zj_untrimrd_brep_1),hg_zj_pt1,[1,2,1],copy=False),delete_input=False)


#耍头上的馒头榫
mts_st_ang2 = rs.ExplodePolysurfaces(st_ang2zj_brep)[2]
mts_st_ang2 = rs.CurveEndPoint(rs.DuplicateEdgeCurves(mts_st_ang2)[2])
rs.MoveObject(mts_st_ang2,(3.75 * x,-3.75 * x,0))
mts_st_ang2 = rs.AddLine(mts_st_ang2,rs.MoveObject(rs.CopyObject(mts_st_ang2),(2.5 * x,0,0)))
mts_st_ang2 = rs.ExtrudeCurve(mts_st_ang2,rs.AddLine(rs.AddPoint(0,0,0),rs.AddPoint(0,-2.5 * x,0)))
mts_st_ang2 = rs.ExtrudeSurface(mts_st_ang2,rs.AddLine(rs.AddPoint(0,0,0),rs.AddPoint(0,0,2.5 * x)))

st_ang2zj_brep = rs.BooleanUnion([st_ang2zj_brep,mts_st_ang2],delete_input=False)

st_ang2zj_brep2 = rs.MirrorObject(st_ang2zj_brep,hg_zj_pt1,rs.MoveObject(rs.CopyObject(hg_zj_pt1),(x,x,0)),copy=True)


#耍头上的散斗

SanDou_st_ang2 = rs.MoveObject(rs.CopyObject(SanDou_lg2),(0,-22 * x,0))
SanDou_st_ang2_2 = rs.MirrorObject(SanDou_st_ang2,hg_zj_pt1,rs.MoveObject(rs.CopyObject(hg_zj_pt1),(x,x,0)),copy=True)


#由昂上的宝瓶

#先对由昂头进行剪切


ang_you_baoping = rs.ExplodePolysurfaces(ang_you_jiao_untrimed_zj_untrimrd_brep)[20]
ang_you_baoping = rs.JoinCurves([rs.DuplicateEdgeCurves(ang_you_baoping)[0],rs.DuplicateEdgeCurves(ang_you_baoping)[2],rs.DuplicateEdgeCurves(ang_you_baoping)[5],])

ang_you_baoping = rs.ExtrudeCurve(ang_you_baoping,rs.AddLine(rs.AddPoint(0,0,0),rs.AddPoint(8 * x,8 * x,0)))
ang_you_baoping = rs.ExtrudeSurface(ang_you_baoping,rs.AddLine(rs.AddPoint(0,0,0),rs.AddPoint(0,0,21 * x)))

ang_you_jiao_untrimed_zj_untrimrd_brep = rs.BooleanDifference(ang_you_jiao_untrimed_zj_untrimrd_brep,ang_you_baoping,delete_input=False)


baoping_brep = rs.SurfaceAreaCentroid(rs.ExplodePolysurfaces(ang_you_baoping)[0])[0]

baoping_brep1 = rs.AddCircle(baoping_brep,5 * x)

baoping_brep1 = rs.AddPolyline(rs.DivideCurve(baoping_brep1,7))
baoping_brep1 = rs.JoinCurves([baoping_brep1,rs.AddLine(rs.CurveStartPoint(baoping_brep1),rs.CurveEndPoint(baoping_brep1))])

baoping_brep_crs = []
for i in range(48):

    baoping_brep_cr = rs.MoveObject(rs.CopyObject(baoping_brep1),(0,0,i * x*0.85))
    baoping_brep_crs.append(baoping_brep_cr)

rs.ScaleObject(baoping_brep_crs[4],baoping_brep,[0.8,0.8,1],copy=False)
rs.ScaleObject(baoping_brep_crs[5],baoping_brep,[0.7,0.7,1],copy=False)
rs.ScaleObject(baoping_brep_crs[6],baoping_brep,[0.65,0.65,1],copy=False)
rs.ScaleObjects(baoping_brep_crs[7:10],baoping_brep,[0.65,0.65,1],copy=False)
rs.ScaleObject(baoping_brep_crs[10],baoping_brep,[0.65,0.65,1],copy=False)
rs.ScaleObject(baoping_brep_crs[11],baoping_brep,[0.7,0.7,1],copy=False)
rs.ScaleObject(baoping_brep_crs[12],baoping_brep,[0.8,0.8,1],copy=False)
rs.ScaleObject(baoping_brep_crs[18],baoping_brep,[0.8,0.8,1],copy=False)
rs.ScaleObject(baoping_brep_crs[19],baoping_brep,[0.81,0.81,1],copy=False)
rs.ScaleObject(baoping_brep_crs[20],baoping_brep,[0.83,0.83,1],copy=False)
rs.ScaleObject(baoping_brep_crs[21],baoping_brep,[0.84,0.84,1],copy=False)
rs.ScaleObject(baoping_brep_crs[22],baoping_brep,[0.86,0.86,1],copy=False)
rs.ScaleObject(baoping_brep_crs[23],baoping_brep,[0.87,0.87,1],copy=False)
rs.ScaleObjects(baoping_brep_crs[24:26],baoping_brep,[0.87,0.87,1],copy=False)
rs.ScaleObject(baoping_brep_crs[26],baoping_brep,[0.85,0.85,1],copy=False)
rs.ScaleObject(baoping_brep_crs[27],baoping_brep,[0.82,0.82,1],copy=False)
rs.ScaleObject(baoping_brep_crs[28],baoping_brep,[0.80,0.80,1],copy=False)
rs.ScaleObject(baoping_brep_crs[29],baoping_brep,[0.78,0.78,1],copy=False)
rs.ScaleObject(baoping_brep_crs[30],baoping_brep,[0.75,0.75,1],copy=False)
rs.ScaleObject(baoping_brep_crs[31],baoping_brep,[0.70,0.70,1],copy=False)
rs.ScaleObjects(baoping_brep_crs[32:37],baoping_brep,[0.64,0.64,1],copy=False)
rs.ScaleObject(baoping_brep_crs[37],baoping_brep,[0.70,0.70,1],copy=False)
rs.ScaleObject(baoping_brep_crs[38],baoping_brep,[0.76,0.76,1],copy=False)
rs.ScaleObject(baoping_brep_crs[39],baoping_brep,[0.8,0.8,1],copy=False)
rs.ScaleObject(baoping_brep_crs[40],baoping_brep,[0.84,0.84,1],copy=False)
rs.ScaleObjects(baoping_brep_crs[41:49],baoping_brep,[0.84,0.84,1],copy=False)


baoping_brep = rs.AddLoftSrf(baoping_brep_crs,loft_type = 2)
rs.CapPlanarHoles(baoping_brep)




#佛光寺大殿,替木



tm_pt_o = rs.CopyObject(hg_zj_pt1)
rs.MoveObject(tm_pt_o,(0,(HuaGong_CaiFen_left + 60) * x,0))

tm_pt_z1 = rs.CopyObject(tm_pt_o)
rs.MoveObject(tm_pt_z1,(0,0,4 * x))
tm_cr_z = rs.AddLine(tm_pt_o,tm_pt_z1)
tm_pt_y1 = rs.CopyObject(tm_pt_o)
rs.MoveObject(tm_pt_y1 ,(0,-12 * x,0))
tm_cr_y = rs.AddLine(tm_pt_y1,tm_pt_o)
div_cr_z =rs.DivideCurve(tm_cr_z,4)
div_cr_y =rs.DivideCurve(tm_cr_y,4)
#卷杀
CrossCurves_gzg = []
for i in range(len(div_cr_z)):
    divide_y = div_cr_y[i]
    divide_z = div_cr_z[i]
    CrossCurve_gzg = rs.AddLine(divide_y,divide_z)
    CrossCurves_gzg.append(CrossCurve_gzg)
CrossCurves_gzg = CrossCurves_gzg[1:len(CrossCurves_gzg)-1]
#选择交点
CrossCurves_points_gzg = []
for i in range(len(CrossCurves_gzg)):
    CrossCurves_point_gzg = rs.CurveCurveIntersection(CrossCurves_gzg[i],CrossCurves_gzg[i-1])[0][1]
    CrossCurves_points_gzg.append(CrossCurves_point_gzg)
CrossCurves_points_gzg = CrossCurves_points_gzg[1:len(CrossCurves_points_gzg)]
CrossCurves_points_gzg.insert(0,rs.CurveStartPoint(tm_cr_y))
CrossCurves_points_gzg.insert(len(CrossCurves_points_gzg)+1,rs.CurveEndPoint(tm_cr_z))
tm_pt_z2 = rs.CopyObject(tm_pt_z1)
rs.MoveObject(tm_pt_z2,(0,0, 4 * x))

CrossCurves_points_gzg.append(tm_pt_z2)
CrossCurves_points_tm_right = rs.MirrorObjects(CrossCurves_points_gzg,ZhuTou_point,rs.MoveObject(rs.CopyObject(ZhuTou_point),(x,0,x)),copy=True)
rs.MoveObjects(CrossCurves_points_tm_right,(0,0,0))

CrossCurves_points_gzg.insert(0,CrossCurves_points_tm_right[0])
CrossCurves_points_gzg.insert(0,CrossCurves_points_tm_right[1])
CrossCurves_points_gzg.insert(0,CrossCurves_points_tm_right[2])
CrossCurves_points_gzg.insert(0,CrossCurves_points_tm_right[3])
CrossCurves_points_gzg.insert(0,CrossCurves_points_tm_right[4])
tm_curve_left1 = rs.AddPolyline(CrossCurves_points_gzg)
tm_curve_left1 = rs.JoinCurves([tm_curve_left1,rs.AddLine(rs.CurveEndPoint(tm_curve_left1),rs.CurveStartPoint(tm_curve_left1))])
rs.MoveObject(tm_curve_left1,(5 *x,0,0))
tm_sr_left1 = rs.AddPlanarSrf(tm_curve_left1)

tm_brep = rs.ExtrudeSurface(tm_sr_left1,rs.AddLine(rs.AddPoint(0,0,0),rs.AddPoint(-10 * x,0,0)))

rs.MoveObject(tm_brep,(-90 * x,-45 * x,84 * x))

tm_brep2 = rs.MirrorObject(tm_brep,hg_zj_pt1,rs.MoveObject(rs.CopyObject(hg_zj_pt1),(x,x,0)),copy=True)




#替木剪切
tm_brep1 = rs.BooleanDifference(tm_brep,rs.MoveObject(rs.CopyObject(tm_brep2),(0,0,2 * x)),delete_input=False)
tm_brep2 = rs.BooleanDifference(tm_brep2,rs.MoveObject(rs.CopyObject(tm_brep),(0,0,-2 * x)),delete_input=True)



#转角辅作内檐第三层泥道栱_半驼峰

#转角铺作泥道拱生成

ndg_zj_neiyan3_pt1 = rs.CopyObject(hg_zj_pt1)
ndg_zj_neiyan3_pt2 = rs.CopyObject(ndg_zj_neiyan3_pt1)
rs.MoveObject(ndg_zj_neiyan3_pt2,(-(HuaGong_CaiFen_left + 42) * x,0,0))
ndg_zj_neiyan3_ptz = rs.MoveObject(rs.CopyObject(ndg_zj_neiyan3_pt2),(0,0,9 * x))
ndg_zj_neiyan3_ptx = rs.MoveObject(rs.CopyObject(ndg_zj_neiyan3_pt2),(14 * x,0,0))

ndg_zj_neiyan3_crz = rs.AddLine(ndg_zj_neiyan3_pt2,ndg_zj_neiyan3_ptz)
ndg_zj_neiyan3_crx = rs.AddLine(ndg_zj_neiyan3_ptx,ndg_zj_neiyan3_pt2)

#卷杀生成

juansha_ndg_zj_neiyan3_crs = []

ndg_zj_neiyan3_ptsz = rs.DivideCurve(ndg_zj_neiyan3_crz,5)
ndg_zj_neiyan3_ptsx = rs.DivideCurve(ndg_zj_neiyan3_crx,5)
for i in range(len(ndg_zj_neiyan3_ptsz)):
    juansha_ndg_zj_neiyan3_cr = rs.AddLine(ndg_zj_neiyan3_ptsz[i],ndg_zj_neiyan3_ptsx[i])
    juansha_ndg_zj_neiyan3_crs.append(juansha_ndg_zj_neiyan3_cr)

juansha_ndg_zj_neiyan3_crs = juansha_ndg_zj_neiyan3_crs[1:len(juansha_ndg_zj_neiyan3_crs)-1]

juansha_ndg_zj_neiyan3_pts = []

for i in range(len(juansha_ndg_zj_neiyan3_crs)):
    if i + 1 < len(juansha_ndg_zj_neiyan3_crs):
        juansha_ndg_pt = rs.CurveCurveIntersection(juansha_ndg_zj_neiyan3_crs[i],juansha_ndg_zj_neiyan3_crs[i+1])
        juansha_ndg_zj_neiyan3_pts.append(juansha_ndg_pt[0][1])
juansha_ndg_zj_neiyan3_pts.append(rs.CurveEndPoint(ndg_zj_neiyan3_crz))
juansha_ndg_zj_neiyan3_pts.append(rs.MoveObject(rs.CopyObject(ndg_zj_neiyan3_ptz),(0,0,6 * x)))
juansha_ndg_zj_neiyan3_pts.append(rs.MoveObject(rs.CopyObject(ndg_zj_neiyan3_ptz),(10 * x,0,6 * x)))
juansha_ndg_zj_neiyan3_pts.insert(0,rs.CurveStartPoint(ndg_zj_neiyan3_crx ))

juansha_ndg_zj_neiyan3_curve = rs.AddPolyline(juansha_ndg_zj_neiyan3_pts)
juansha_ndg_zj_neiyan3_curve_1 = rs.MirrorObject(juansha_ndg_zj_neiyan3_curve,hg_zj_pt1,rs.MoveObject(rs.CopyObject(hg_zj_pt1),(0,x,0)),copy=True)

juansha_ndg_zj_neiyan3_curve = rs.JoinCurves([juansha_ndg_zj_neiyan3_curve,juansha_ndg_zj_neiyan3_curve_1,rs.AddLine(rs.CurveStartPoint(juansha_ndg_zj_neiyan3_curve),rs.CurveStartPoint(juansha_ndg_zj_neiyan3_curve_1)),rs.AddLine(rs.CurveEndPoint(juansha_ndg_zj_neiyan3_curve),rs.CurveEndPoint(juansha_ndg_zj_neiyan3_curve_1))])

ndg_untrimed_brep = rs.AddPlanarSrf(juansha_ndg_zj_neiyan3_curve)
rs.MoveObject(ndg_untrimed_brep,(0,-5 * x,0))
ndg_untrimed_brep = rs.ExtrudeSurface(ndg_untrimed_brep,rs.AddLine(rs.AddPoint(0,0,0),rs.AddPoint(0,10 * x,0)))

#泥道栱的馒头榫
mts_ndg_zj_neiyan3 = rs.MoveObject(rs.CopyObject(ndg_zj_neiyan3_ptz),(3.75 * x,-1.25 * x,6 * x))
mts_ndg_zj_neiyan3 = rs.AddLine(mts_ndg_zj_neiyan3,rs.MoveObject(rs.CopyObject(mts_ndg_zj_neiyan3),(2.5 * x,0,0)))
mts_ndg_zj_neiyan3 = rs.ExtrudeCurve(mts_ndg_zj_neiyan3,rs.AddLine(rs.AddPoint(0,0,0),rs.AddPoint(0,2.5 * x,0)))
mts_ndg_zj_neiyan3 = rs.ExtrudeSurface(mts_ndg_zj_neiyan3,rs.AddLine(rs.AddPoint(0,0,0),rs.AddPoint(0,0,2.5 * x)))
mts_ndg_zj_neiyan32 = rs.MirrorObject(mts_ndg_zj_neiyan3,hg_zj_pt1,rs.MoveObject(rs.CopyObject(hg_zj_pt1),(0,x,0)),copy=True)
ndg_untrimed_brep = rs.BooleanDifference(mts_ndg_zj_neiyan3,ndg_untrimed_brep,delete_input=False)
ndg_untrimed_brep = rs.BooleanIntersection(mts_ndg_zj_neiyan32,ndg_untrimed_brep,delete_input=False)

#泥道拱剪切

##拱眼隐去部深1分
#左
gyy_zj_cr_ndg = rs.CopyObject(ndg_zj_neiyan3_ptz)
rs.MoveObject(gyy_zj_cr_ndg,(10 * x,0,6 * x))
gyy_zj_cr_ndg_1 = rs.MoveObject(rs.CopyObject(gyy_zj_cr_ndg),(0,0,-x))
gyy_zj_cr_ndg_2 = rs.MoveObject(rs.CopyObject(gyy_zj_cr_ndg),(x,0,-x))
gyy_zj_cr_ndg_1_cr = rs.AddLine(gyy_zj_cr_ndg_1,gyy_zj_cr_ndg)
gyy_zj_cr_ndg_2_cr = rs.AddLine(gyy_zj_cr_ndg_2,gyy_zj_cr_ndg_1)
gyy_zj_cr_ndg = rs.AddFilletCurve(gyy_zj_cr_ndg_1_cr,gyy_zj_cr_ndg_2_cr,x)
gyy_zj_cr_ndg2 = rs.RotateObject(gyy_zj_cr_ndg,rs.CurveStartPoint(gyy_zj_cr_ndg),180,[0,0,x],copy=True)
rs.MoveObject(gyy_zj_cr_ndg2,((HuaGong_CaiFen_left +10 -14 - 7.875) * x,0,0))
gyy_zj_ndg = rs.AddLoftSrf([gyy_zj_cr_ndg,gyy_zj_cr_ndg2])
gyy_zj_ndg = rs.ExtrudeSurface(gyy_zj_ndg,rs.AddLine(rs.AddPoint(0,0,0),rs.AddPoint(0,-2 * x,0)))
rs.MoveObject(gyy_zj_ndg,(0,-4 * x,0))
gyy_zj_ndg2 = rs.MirrorObject(gyy_zj_ndg,hg_zj_pt1,rs.MoveObject(rs.CopyObject(hg_zj_pt1),(0,x,0)),copy=True)
gyy_zj_ndg3 = rs.MirrorObject(gyy_zj_ndg,hg_zj_pt1,rs.MoveObject(rs.CopyObject(hg_zj_pt1),(x,0,0)),copy=True)
gyy_zj_ndg4 = rs.MirrorObject(gyy_zj_ndg2,hg_zj_pt1,rs.MoveObject(rs.CopyObject(hg_zj_pt1),(x,0,0)),copy=True)



#泥道拱下部剪切
ndg_trimed_brep = rs.CopyObject(hg_zj_pt1)
rs.MoveObject(ndg_trimed_brep,(-5 * x,0,0))
ndg_trimed_brep = rs.AddLine(ndg_trimed_brep,rs.MoveObject(rs.CopyObject(ndg_trimed_brep),(10 * x,0,0)))
ndg_trimed_brep = rs.ExtrudeCurve(ndg_trimed_brep,rs.AddLine(rs.AddPoint(0,0,0),rs.AddPoint(0,-10 * x,0)))
ndg_trimed_brep = rs.ExtrudeSurface(ndg_trimed_brep,rs.AddLine(rs.AddPoint(0,0,0),rs.AddPoint(0,0,7.5 * x)))
rs.MoveObject(ndg_trimed_brep,(0,5 * x,7.5 * x))
ndg_trimed_brep2 = rs.RotateObject(ndg_untrimed_brep,hg_zj_pt1,45,[0,0,x],copy=True)
rs.MoveObject(ndg_trimed_brep2,(0,0,7.5 * x))
ndg_trimed_brep3 = rs.MoveObject(rs.CopyObject(ndg_trimed_brep),(0,0,-7.5 * x))
ndg_trimed_brep4 = rs.RotateObject(ndg_untrimed_brep,hg_zj_pt1,45,[0,0,x],copy=True)
rs.MoveObject(ndg_trimed_brep4,(0,0,-7.5 * x))

ndg3_zj_neiyan = rs.BooleanUnion([gyy_zj_ndg,gyy_zj_ndg2,gyy_zj_ndg3,gyy_zj_ndg4,ndg_untrimed_brep],delete_input=False)
ndg3_zj_neiyan2 = rs.RotateObject(ndg3_zj_neiyan,hg_zj_pt1,90,[0,0,x],copy=True)


ndg3_zj_neiyan = rs.BooleanUnion([ndg3_zj_neiyan,ndg_trimed_brep],delete_input=False)
ndg3_zj_neiyan = rs.BooleanDifference(ndg_trimed_brep2,ndg3_zj_neiyan,delete_input=False)

ndg3_zj_neiyan2 = rs.BooleanUnion([ndg3_zj_neiyan2,ndg_trimed_brep3],delete_input=False)
ndg3_zj_neiyan2 = rs.BooleanDifference(ndg_trimed_brep4,ndg3_zj_neiyan2,delete_input=False)

rs.MoveObjects([ndg3_zj_neiyan,ndg3_zj_neiyan2],(j*x,j*x,(-5.5+42)*x))

#第三层泥道拱剪切

#
ndg3_neiyan_trimed = rs.ExplodePolysurfaces(ndg3_zj_neiyan)[44]
ndg3_neiyan_trimed = rs.CurveEndPoint(rs.DuplicateEdgeCurves(ndg3_neiyan_trimed)[0])
ndg3_neiyan_trimed = rs.AddLine(ndg3_neiyan_trimed,rs.MoveObject(rs.CopyObject(ndg3_neiyan_trimed),(0,10 * x)))
ndg3_neiyan_trimed = rs.ExtrudeCurve(ndg3_neiyan_trimed,rs.AddLine(rs.AddPoint(0,0,0),rs.AddPoint(21 * x,0,0)))
ndg3_neiyan_trimed = rs.ExtrudeSurface(ndg3_neiyan_trimed,rs.AddLine(rs.AddPoint(0,0,0),rs.AddPoint(0,0,-16 * x)))
rs.MoveObject(ndg3_neiyan_trimed,(0,-x,0))

ndg3_zj_neiyan = rs.BooleanIntersection(ndg3_zj_neiyan,ndg3_neiyan_trimed,delete_input = False)

ndg3_zj_neiyan2 = rs.BooleanIntersection(ndg3_zj_neiyan2,rs.MirrorObject(ndg3_neiyan_trimed,hg_zj_pt1,rs.MoveObject(rs.CopyObject(hg_zj_pt1),(x,x,0)),copy=True),delete_input = False)[0]




#半驼峰
rs.MirrorObject(btf_brep,hg_zj_pt1,rs.MoveObject(rs.CopyObject(hg_zj_pt1),(0,x,0)),copy=False)
rs.MoveObject(btf_brep,(j*x,j*x,(-5.5)*x))

btf_brep = rs.BooleanUnion([ndg3_zj_neiyan[1],btf_brep],delete_input = True)
rs.MoveObject(btf_brep,(21 * x,0,0))


ndg3_zj_neiyan = rs.BooleanUnion([btf_brep,ndg3_zj_neiyan[0]],delete_input = False)
ndg3_zj_neiyan2 = rs.BooleanUnion([rs.MirrorObject(btf_brep,hg_zj_pt1,rs.MoveObject(rs.CopyObject(hg_zj_pt1),(x,x,0)),copy=True),ndg3_zj_neiyan2],delete_input = False)


#内檐第三层泥道栱的交互斗

JiaoHuDou_ndg3_neiyan = rs.MoveObject(rs.CopyObject(JiaoHuDou_zj1),(j*x,j*x,(-5.5+21)*x))
JiaoHuDou2_ndg3_neiyan = rs.MirrorObject(JiaoHuDou_ndg3_neiyan,hg_zj_pt1,rs.MoveObject(rs.CopyObject(hg_zj_pt1),(x,x,0)),copy=True)
''
#内檐第三层泥道栱的散斗

SanDou_ndg3_neiyan = rs.MoveObject(rs.CopyObject(SanDou_ndg_zj2_1),(j*x,j*x+21 * x,(-5.5+21)*x))
SanDou2_ndg3_neiyan = rs.MirrorObject(SanDou_ndg3_neiyan,hg_zj_pt1,rs.MoveObject(rs.CopyObject(hg_zj_pt1),(x,x,0)),copy=True)






#内檐第四层华拱
#转角铺作华拱生成

hg4_zj_neiyan_pt1 = rs.CopyObject(ZhuTou_point)
rs.MoveObject(hg4_zj_neiyan_pt1,(HuaGong_CaiFen_left * x-32*x,0,262.5 * x))

hg4_zj_neiyan_pt2 = rs.CopyObject(hg4_zj_neiyan_pt1)
rs.MoveObject(hg4_zj_neiyan_pt2,(-(HuaGong_CaiFen_left+63) * x,0,0))

hg4_zj_neiyan_pt3 = rs.CopyObject(hg4_zj_neiyan_pt1)
rs.MoveObject(hg4_zj_neiyan_pt3,((HuaGong_CaiFen_left+63) * x,0,0))

hg4_zj_neiyan_pt2z = rs.CopyObject(hg4_zj_neiyan_pt2)
rs.MoveObject(hg4_zj_neiyan_pt2z,(0,0,9 * x))

hg4_zj_neiyan_pt3z = rs.CopyObject(hg4_zj_neiyan_pt3)
rs.MoveObject(hg4_zj_neiyan_pt3z,(0,0,9 * x))


hg4_zj_neiyan_pt2x = rs.CopyObject(hg4_zj_neiyan_pt2)
rs.MoveObject(hg4_zj_neiyan_pt2x,(16 * x,0,0))

hg4_zj_neiyan_pt3x = rs.CopyObject(hg4_zj_neiyan_pt3)
rs.MoveObject(hg4_zj_neiyan_pt3x,(-16 * x,0,0))

hg4_zj_neiyan_cr1z = rs.AddLine(hg4_zj_neiyan_pt2,hg4_zj_neiyan_pt2z)

hg4_zj_neiyan_cr1x = rs.AddLine(hg4_zj_neiyan_pt2x,hg4_zj_neiyan_pt2)

#卷杀生成
juansha_zj_crs = []

juansha_zj_pt1 = rs.DivideCurve(hg4_zj_neiyan_cr1z,5)

juansha_zj_pt2 = rs.DivideCurve(hg4_zj_neiyan_cr1x,5)

for i in range(len(juansha_zj_pt1)):
    juansha_zj_cr = rs.AddLine(juansha_zj_pt1[i],juansha_zj_pt2[i])
    juansha_zj_crs.append(juansha_zj_cr)

juansha_zj_crs = juansha_zj_crs[1:len(juansha_zj_crs)-1]

juansha_zj_pts = []

for i in range(len(juansha_zj_crs)):
    if i + 1 < len(juansha_zj_crs):
        juansha_pt = rs.CurveCurveIntersection(juansha_zj_crs[i],juansha_zj_crs[i+1])
        juansha_zj_pts.append(juansha_pt[0][1])
juansha_zj_pts.append(rs.CurveEndPoint(hg4_zj_neiyan_cr1z))
juansha_zj_pts.append(rs.MoveObject(rs.CopyObject(hg4_zj_neiyan_pt2z),(0,0,6 * x)))
juansha_zj_pts.append(rs.MoveObject(rs.CopyObject(hg4_zj_neiyan_pt2z),(12 * x,0,6 * x)))
juansha_zj_pts.insert(0,rs.CurveStartPoint(hg4_zj_neiyan_cr1x))

juansha_zj_curve = rs.AddPolyline(juansha_zj_pts)

#欹幽
#左
qa_zj_left_2 = rs.CopyObject(rs.MoveObject(rs.CopyObject(hg4_zj_neiyan_pt2z),(12 * x,0,6 * x)))
rs.MoveObject(qa_zj_left_2,(2 * x,0,4 * x))
qa_zj_curve_left_1 = rs.AddLine(rs.MoveObject(rs.CopyObject(hg4_zj_neiyan_pt2z),(12 * x,0,6 * x)),qa_zj_left_2)

qa_zj_left_3 = rs.CurveMidPoint(qa_zj_curve_left_1)
direction_left = (-x, 0, 2 * x)  # 任意方向向量 
distance = 0.5 * x # 移动距离 
# 单位化方向向量并计算实际位移 
unit_vector_left = rs.VectorUnitize(direction_left)
displacement_left = rs.VectorScale(unit_vector_left, distance)
rs.MoveObject(qa_zj_left_3, displacement_left)
qa_zj_curve_left_1 = rs.AddCurve([rs.MoveObject(rs.CopyObject(hg4_zj_neiyan_pt2z),(12 * x,0,6 * x)),qa_zj_left_3,qa_zj_left_2])
qa_zj_curve_left_1 = rs.JoinCurves([qa_zj_curve_left_1,rs.AddLine(rs.CurveEndPoint(qa_zj_curve_left_1),rs.MoveObject(rs.CurveEndPoint(qa_zj_curve_left_1),(0,0,2*x)))])

juansha_zj_curve = rs.JoinCurves([juansha_zj_curve,qa_zj_curve_left_1])

juansha_zj_brep_untrimed = rs.MirrorObject(juansha_zj_curve,hg4_zj_neiyan_pt1,rs.MoveObject(rs.CopyObject(hg4_zj_neiyan_pt1),(0,x,0)),copy=True)
rs.MoveObject(juansha_zj_brep_untrimed,((HuaGong_CaiFen_left - HuaGong_CaiFen_left)*x,0,0))

juansha_zj_brep_untrimed = rs.JoinCurves([juansha_zj_curve,juansha_zj_brep_untrimed ,rs.AddLine(rs.CurveStartPoint(juansha_zj_curve),rs.CurveStartPoint(juansha_zj_brep_untrimed)),rs.AddLine(rs.CurveEndPoint(juansha_zj_curve),rs.CurveEndPoint(juansha_zj_brep_untrimed))])
juansha_zj_brep_untrimed = rs.AddPlanarSrf(juansha_zj_brep_untrimed)
rs.MoveObject(juansha_zj_brep_untrimed,(0,5 * x,0))
juansha_zj_brep_untrimed = rs.ExtrudeSurface(juansha_zj_brep_untrimed,rs.AddLine(rs.AddPoint(0,0,0),rs.AddPoint(0,-10 * x ,0)))
#拱眼隐去部深1分
#左
gyy_zj_cr =rs.AddLine(rs.CurveStartPoint(qa_zj_curve_left_1),rs.MoveObject(rs.CurveStartPoint(qa_zj_curve_left_1),(0,0,-x)))
gyy_zj_cr_1 = rs.RotateObject(gyy_zj_cr,rs.CurveEndPoint(gyy_zj_cr),90,[0,x,0],copy=True)
gyy_zj_cr = rs.AddFilletCurve(gyy_zj_cr,gyy_zj_cr_1,x)
qa_zj_curve_left1 = rs.JoinCurves([qa_zj_curve_left_1,gyy_zj_cr])

qa_zj_curve_left2 = rs.RotateObject(qa_zj_curve_left1,rs.CurveEndPoint(qa_zj_curve_left1),180,[0,0,x],copy=True)
rs.MoveObject(qa_zj_curve_left2,((HuaGong_CaiFen_left +10 -14 - 7.875) * x,0,0))
qa_zj_curve_left = rs.JoinCurves([qa_zj_curve_left1,qa_zj_curve_left2,rs.AddLine(rs.CurveStartPoint(qa_zj_curve_left1),rs.CurveStartPoint(qa_zj_curve_left2)),rs.AddLine(rs.CurveEndPoint(qa_zj_curve_left1),rs.CurveEndPoint(qa_zj_curve_left2))])

qa_zj_curve_left = rs.AddPlanarSrf(qa_zj_curve_left)
qa_zj_curve_left_1 = rs.ExtrudeSurface(qa_zj_curve_left,rs.AddLine(rs.AddPoint(0,0,0),rs.AddPoint(0,-2 * x,0)))
rs.MoveObject(qa_zj_curve_left_1,(0,-4 * x ,0))
qa_zj_curve_left_2 = rs.MirrorObject(qa_zj_curve_left_1,hg4_zj_neiyan_pt1,rs.MoveObject(rs.CopyObject(hg4_zj_neiyan_pt1),(x,0,0)),copy=True)

qa_zj_curve_right2 =  rs.MirrorObject(qa_zj_curve_left2,hg4_zj_neiyan_pt1,rs.MoveObject(rs.CopyObject(hg4_zj_neiyan_pt1),(0,x,0)),copy=True)
qa_zj_curve_right1 =  rs.MirrorObject(qa_zj_curve_left1,hg4_zj_neiyan_pt1,rs.MoveObject(rs.CopyObject(hg4_zj_neiyan_pt1),(0,x,0)),copy=True)
rs.MoveObject(qa_zj_curve_right1,((HuaGong_CaiFen_left - HuaGong_CaiFen_left)*x,0,0))

qa_zj_curve_right_1 = rs.JoinCurves([qa_zj_curve_right1,qa_zj_curve_right2,rs.AddLine(rs.CurveStartPoint(qa_zj_curve_right1),rs.CurveStartPoint(qa_zj_curve_right2)),rs.AddLine(rs.CurveEndPoint(qa_zj_curve_right1),rs.CurveEndPoint(qa_zj_curve_right2))])
qa_zj_curve_right_1 = rs.AddPlanarSrf(qa_zj_curve_right_1)
qa_zj_curve_right_1 = rs.ExtrudeSurface(qa_zj_curve_right_1,rs.AddLine(rs.AddPoint(0,0,0),rs.AddPoint(0,-2 * x,0)))
rs.MoveObject(qa_zj_curve_right_1,(0,-4 * x ,0))
qa_zj_curve_right_2 = rs.MirrorObject(qa_zj_curve_right_1,hg4_zj_neiyan_pt1,rs.MoveObject(rs.CopyObject(hg4_zj_neiyan_pt1),(x,0,0)),copy=True)

#馒头榫生成
mts_zj_pt1 = rs.CopyObject(hg4_zj_neiyan_pt2z)
rs.MoveObject(mts_zj_pt1,(4.75 * x,-1.25 * x,6 * x))
mts_zj1 = rs.AddLine(mts_zj_pt1,rs.MoveObject(rs.CopyObject(mts_zj_pt1),(2.5 * x,0,0)))
mts_zj1 = rs.ExtrudeCurve(mts_zj1,rs.AddLine(rs.AddPoint(0,0,0),rs.AddPoint(0,2.5 * x,0)))
mts_zj1 = rs.ExtrudeSurface(mts_zj1,rs.AddLine(rs.AddPoint(0,0,0),rs.AddPoint(0,0,2.5 * x)))
mts_zj2 = rs.MirrorObject(mts_zj1,hg4_zj_neiyan_pt1,rs.MoveObject(rs.CopyObject(hg4_zj_neiyan_pt1),(0,x,0)),copy=True)
rs.MoveObject(mts_zj2,((HuaGong_CaiFen_left - HuaGong_CaiFen_left)*x,0,0))

#拱眼插销生成
#拱眼上的插栓,广4分,厚4分,深2.5分
gy_cx_zj1 = rs.CopyObject(rs.CurveEndPoint(qa_zj_curve_left1))
rs.MoveObject(gy_cx_zj1,(rs.Distance(rs.CurveEndPoint(qa_zj_curve_left1),rs.CurveEndPoint(qa_zj_curve_left2))/2-2*x,-1.25 * x,0))
gy_cx_zj1 = rs.AddLine(gy_cx_zj1,rs.MoveObject(rs.CopyObject(gy_cx_zj1),(4 * x,0,0)))
gy_cx_zj1 = rs.ExtrudeCurve(gy_cx_zj1,rs.AddLine(rs.AddPoint(0,0,0),rs.AddPoint(0,2.5 * x,0)))
gy_cx_zj1 = rs.ExtrudeSurface(gy_cx_zj1,rs.AddLine(rs.AddPoint(0,0,0),rs.AddPoint(0,0,4 * x)))
gy_cx_zj2 = rs.MirrorObject(gy_cx_zj1,hg4_zj_neiyan_pt1,rs.MoveObject(rs.CopyObject(hg4_zj_neiyan_pt1),(0,x,0)),copy=True)
rs.MoveObject(gy_cx_zj2,((HuaGong_CaiFen_left - HuaGong_CaiFen_left)*x/2,0,0))


#用于剪切华拱下部的体块

huagong4_trimed_brep = rs.ExplodePolysurfaces(JiaoLuDou)[31]
huagong4_trimed_brep = rs.CurveStartPoint(rs.DuplicateEdgeCurves(huagong4_trimed_brep)[1])
rs.RotateObject(huagong4_trimed_brep,hg4_zj_neiyan_pt1,-45,[0,0,x])
huagong4_trimed_brep = rs.AddLine(huagong4_trimed_brep,rs.MoveObject(rs.CopyObject(huagong4_trimed_brep),(0,-14 * x,0)))
huagong4_trimed_brep_1 = rs.MirrorObject(huagong4_trimed_brep,hg4_zj_neiyan_pt1,rs.MoveObject(rs.CopyObject(hg4_zj_neiyan_pt1),(0,x,0)),copy=True)
huagong4_trimed_brep = rs.AddLoftSrf([huagong4_trimed_brep,huagong4_trimed_brep_1])
huagong4_trimed_brep = rs.ExtrudeSurface(huagong4_trimed_brep,rs.AddLine(rs.AddPoint(0,0,0),rs.AddPoint(0,0,6 * x)))
rs.MoveObject(huagong4_trimed_brep,(0,0,-6 * x))

huagong4_trimed_brep2 = rs.CopyObject(hg4_zj_neiyan_pt1)
rs.MoveObject(huagong4_trimed_brep2,(-5 * x,-6 * x,6 * x))
huagong4_trimed_brep2 = rs.AddLine(huagong4_trimed_brep2,rs.MoveObject(rs.CopyObject(huagong4_trimed_brep2),((10 * x),0,0)))
huagong4_trimed_brep2 = rs.ExtrudeCurve(huagong4_trimed_brep2,rs.AddLine(rs.AddPoint(0,0,0),rs.AddPoint(0,12 * x,0)))
huagong4_trimed_brep2 = rs.ExtrudeSurface(huagong4_trimed_brep2,rs.AddLine(rs.AddPoint(0,0,0),rs.AddPoint(0,0,9 * x)))


#华拱剪切
HuaGong4_zj_neiyan = rs.BooleanDifference(juansha_zj_brep_untrimed,qa_zj_curve_left_1,delete_input=False)
HuaGong4_zj_neiyan = rs.BooleanDifference(HuaGong4_zj_neiyan,qa_zj_curve_left_2,delete_input=False)
HuaGong4_zj_neiyan = rs.BooleanIntersection(HuaGong4_zj_neiyan,qa_zj_curve_right_1,delete_input=False)
HuaGong4_zj_neiyan = rs.BooleanIntersection(HuaGong4_zj_neiyan,qa_zj_curve_right_2,delete_input=False)
HuaGong4_zj_neiyan = rs.BooleanDifference(mts_zj1,HuaGong4_zj_neiyan,delete_input=False)
HuaGong4_zj_neiyan = rs.BooleanIntersection(HuaGong4_zj_neiyan,mts_zj2,delete_input=False)
HuaGong4_zj_neiyan = rs.BooleanIntersection(HuaGong4_zj_neiyan,gy_cx_zj1,delete_input=False)
HuaGong4_zj_neiyan = rs.BooleanIntersection(HuaGong4_zj_neiyan,gy_cx_zj2,delete_input=False)
HuaGong4_zj_neiyan = rs.BooleanUnion([HuaGong4_zj_neiyan,huagong4_trimed_brep],delete_input=False)
HuaGong4_zj_neiyan = rs.BooleanDifference(huagong4_trimed_brep2,HuaGong4_zj_neiyan,delete_input=False)

rs.RotateObject(HuaGong4_zj_neiyan,hg_zj_pt1,45,[0,0,x],copy=False)
rs.MoveObject(HuaGong4_zj_neiyan,(j*x,j*x,(-5.5+63)*x))



#内檐第四层华拱被半驼峰-耍头剪切
HuaGong4_zj_neiyan = rs.BooleanIntersection(btf_htz2,HuaGong4_zj_neiyan,delete_input=False)

#内檐第四层泥道栱

#转角铺作泥道拱生成

ndg_zj_neiyan4_pt1 = rs.CopyObject(hg_zj_pt1)
ndg_zj_neiyan4_pt2 = rs.CopyObject(ndg_zj_neiyan4_pt1)
rs.MoveObject(ndg_zj_neiyan4_pt2,(-(HuaGong_CaiFen_left + 63) * x,0,0))
ndg_zj_neiyan4_ptz = rs.MoveObject(rs.CopyObject(ndg_zj_neiyan4_pt2),(0,0,9 * x))
ndg_zj_neiyan4_ptx = rs.MoveObject(rs.CopyObject(ndg_zj_neiyan4_pt2),(14 * x,0,0))

ndg_zj_neiyan4_crz = rs.AddLine(ndg_zj_neiyan4_pt2,ndg_zj_neiyan4_ptz)
ndg_zj_neiyan4_crx = rs.AddLine(ndg_zj_neiyan4_ptx,ndg_zj_neiyan4_pt2)

#卷杀生成

juansha_ndg_zj_neiyan4_crs = []

ndg_zj_neiyan4_ptsz = rs.DivideCurve(ndg_zj_neiyan4_crz,5)
ndg_zj_neiyan4_ptsx = rs.DivideCurve(ndg_zj_neiyan4_crx,5)
for i in range(len(ndg_zj_neiyan4_ptsz)):
    juansha_ndg_zj_neiyan4_cr = rs.AddLine(ndg_zj_neiyan4_ptsz[i],ndg_zj_neiyan4_ptsx[i])
    juansha_ndg_zj_neiyan4_crs.append(juansha_ndg_zj_neiyan4_cr)

juansha_ndg_zj_neiyan4_crs = juansha_ndg_zj_neiyan4_crs[1:len(juansha_ndg_zj_neiyan4_crs)-1]

juansha_ndg_zj_neiyan4_pts = []

for i in range(len(juansha_ndg_zj_neiyan4_crs)):
    if i + 1 < len(juansha_ndg_zj_neiyan4_crs):
        juansha_ndg_pt = rs.CurveCurveIntersection(juansha_ndg_zj_neiyan4_crs[i],juansha_ndg_zj_neiyan4_crs[i+1])
        juansha_ndg_zj_neiyan4_pts.append(juansha_ndg_pt[0][1])
juansha_ndg_zj_neiyan4_pts.append(rs.CurveEndPoint(ndg_zj_neiyan4_crz))
juansha_ndg_zj_neiyan4_pts.append(rs.MoveObject(rs.CopyObject(ndg_zj_neiyan4_ptz),(0,0,6 * x)))
juansha_ndg_zj_neiyan4_pts.append(rs.MoveObject(rs.CopyObject(ndg_zj_neiyan4_ptz),(10 * x,0,6 * x)))
juansha_ndg_zj_neiyan4_pts.insert(0,rs.CurveStartPoint(ndg_zj_neiyan4_crx ))

juansha_ndg_zj_neiyan4_curve = rs.AddPolyline(juansha_ndg_zj_neiyan4_pts)
juansha_ndg_zj_neiyan4_curve_1 = rs.MirrorObject(juansha_ndg_zj_neiyan4_curve,hg_zj_pt1,rs.MoveObject(rs.CopyObject(hg_zj_pt1),(0,x,0)),copy=True)

juansha_ndg_zj_neiyan4_curve = rs.JoinCurves([juansha_ndg_zj_neiyan4_curve,juansha_ndg_zj_neiyan4_curve_1,rs.AddLine(rs.CurveStartPoint(juansha_ndg_zj_neiyan4_curve),rs.CurveStartPoint(juansha_ndg_zj_neiyan4_curve_1)),rs.AddLine(rs.CurveEndPoint(juansha_ndg_zj_neiyan4_curve),rs.CurveEndPoint(juansha_ndg_zj_neiyan4_curve_1))])

ndg_untrimed_brep = rs.AddPlanarSrf(juansha_ndg_zj_neiyan4_curve)
rs.MoveObject(ndg_untrimed_brep,(0,-5 * x,0))
ndg_untrimed_brep = rs.ExtrudeSurface(ndg_untrimed_brep,rs.AddLine(rs.AddPoint(0,0,0),rs.AddPoint(0,10 * x,0)))

#泥道栱的馒头榫
mts_ndg_zj_neiyan4 = rs.MoveObject(rs.CopyObject(ndg_zj_neiyan4_ptz),(3.75 * x,-1.25 * x,6 * x))
mts_ndg_zj_neiyan4 = rs.AddLine(mts_ndg_zj_neiyan4,rs.MoveObject(rs.CopyObject(mts_ndg_zj_neiyan4),(2.5 * x,0,0)))
mts_ndg_zj_neiyan4 = rs.ExtrudeCurve(mts_ndg_zj_neiyan4,rs.AddLine(rs.AddPoint(0,0,0),rs.AddPoint(0,2.5 * x,0)))
mts_ndg_zj_neiyan4 = rs.ExtrudeSurface(mts_ndg_zj_neiyan4,rs.AddLine(rs.AddPoint(0,0,0),rs.AddPoint(0,0,2.5 * x)))
mts_ndg_zj_neiyan42 = rs.MirrorObject(mts_ndg_zj_neiyan4,hg_zj_pt1,rs.MoveObject(rs.CopyObject(hg_zj_pt1),(0,x,0)),copy=True)
ndg_untrimed_brep = rs.BooleanDifference(mts_ndg_zj_neiyan4,ndg_untrimed_brep,delete_input=False)
ndg_untrimed_brep = rs.BooleanIntersection(mts_ndg_zj_neiyan42,ndg_untrimed_brep,delete_input=False)

#泥道拱剪切

##拱眼隐去部深1分
#左
gyy_zj_cr_ndg = rs.CopyObject(ndg_zj_neiyan4_ptz)
rs.MoveObject(gyy_zj_cr_ndg,(10 * x,0,6 * x))
gyy_zj_cr_ndg_1 = rs.MoveObject(rs.CopyObject(gyy_zj_cr_ndg),(0,0,-x))
gyy_zj_cr_ndg_2 = rs.MoveObject(rs.CopyObject(gyy_zj_cr_ndg),(x,0,-x))
gyy_zj_cr_ndg_1_cr = rs.AddLine(gyy_zj_cr_ndg_1,gyy_zj_cr_ndg)
gyy_zj_cr_ndg_2_cr = rs.AddLine(gyy_zj_cr_ndg_2,gyy_zj_cr_ndg_1)
gyy_zj_cr_ndg = rs.AddFilletCurve(gyy_zj_cr_ndg_1_cr,gyy_zj_cr_ndg_2_cr,x)
gyy_zj_cr_ndg2 = rs.RotateObject(gyy_zj_cr_ndg,rs.CurveStartPoint(gyy_zj_cr_ndg),180,[0,0,x],copy=True)
rs.MoveObject(gyy_zj_cr_ndg2,((HuaGong_CaiFen_left +10 -14 - 7.875) * x,0,0))
gyy_zj_ndg = rs.AddLoftSrf([gyy_zj_cr_ndg,gyy_zj_cr_ndg2])
gyy_zj_ndg = rs.ExtrudeSurface(gyy_zj_ndg,rs.AddLine(rs.AddPoint(0,0,0),rs.AddPoint(0,-2 * x,0)))
rs.MoveObject(gyy_zj_ndg,(0,-4 * x,0))
gyy_zj_ndg2 = rs.MirrorObject(gyy_zj_ndg,hg_zj_pt1,rs.MoveObject(rs.CopyObject(hg_zj_pt1),(0,x,0)),copy=True)
gyy_zj_ndg3 = rs.MirrorObject(gyy_zj_ndg,hg_zj_pt1,rs.MoveObject(rs.CopyObject(hg_zj_pt1),(x,0,0)),copy=True)
gyy_zj_ndg4 = rs.MirrorObject(gyy_zj_ndg2,hg_zj_pt1,rs.MoveObject(rs.CopyObject(hg_zj_pt1),(x,0,0)),copy=True)



#泥道拱下部剪切
ndg_trimed_brep = rs.CopyObject(hg_zj_pt1)
rs.MoveObject(ndg_trimed_brep,(-5 * x,0,0))
ndg_trimed_brep = rs.AddLine(ndg_trimed_brep,rs.MoveObject(rs.CopyObject(ndg_trimed_brep),(10 * x,0,0)))
ndg_trimed_brep = rs.ExtrudeCurve(ndg_trimed_brep,rs.AddLine(rs.AddPoint(0,0,0),rs.AddPoint(0,-10 * x,0)))
ndg_trimed_brep = rs.ExtrudeSurface(ndg_trimed_brep,rs.AddLine(rs.AddPoint(0,0,0),rs.AddPoint(0,0,7.5 * x)))
rs.MoveObject(ndg_trimed_brep,(0,5 * x,7.5 * x))
ndg_trimed_brep2 = rs.RotateObject(ndg_untrimed_brep,hg_zj_pt1,45,[0,0,x],copy=True)
rs.MoveObject(ndg_trimed_brep2,(0,0,7.5 * x))
ndg_trimed_brep3 = rs.MoveObject(rs.CopyObject(ndg_trimed_brep),(0,0,-7.5 * x))
ndg_trimed_brep4 = rs.RotateObject(ndg_untrimed_brep,hg_zj_pt1,45,[0,0,x],copy=True)
rs.MoveObject(ndg_trimed_brep4,(0,0,-7.5 * x))

ndg4_zj_neiyan = rs.BooleanUnion([gyy_zj_ndg,gyy_zj_ndg2,gyy_zj_ndg3,gyy_zj_ndg4,ndg_untrimed_brep],delete_input=False)
ndg4_zj_neiyan2 = rs.RotateObject(ndg4_zj_neiyan,hg_zj_pt1,90,[0,0,x],copy=True)


ndg4_zj_neiyan = rs.BooleanUnion([ndg4_zj_neiyan,ndg_trimed_brep],delete_input=False)
ndg4_zj_neiyan = rs.BooleanDifference(ndg_trimed_brep2,ndg4_zj_neiyan,delete_input=False)

ndg4_zj_neiyan2 = rs.BooleanUnion([ndg4_zj_neiyan2,ndg_trimed_brep3],delete_input=False)
ndg4_zj_neiyan2 = rs.BooleanDifference(ndg_trimed_brep4,ndg4_zj_neiyan2,delete_input=False)

rs.MoveObjects([ndg4_zj_neiyan,ndg4_zj_neiyan2],(j*x,j*x,(-5.5+63)*x))


#内檐第四层泥道栱剪切

ndg4_zj_neiyan = rs.BooleanIntersection(ndg4_zj_neiyan,rs.MoveObject(rs.CopyObject(ndg3_neiyan_trimed),(0,0,21 * x)),delete_input = True)
rs.MoveObject(ndg4_zj_neiyan[1],(21 * x,0,0))

ndg4_zj_neiyan = rs.BooleanUnion(ndg4_zj_neiyan,delete_input = True)

ndg4_zj_neiyan2 = rs.BooleanIntersection(ndg4_zj_neiyan2,rs.MoveObject(rs.MirrorObject(ndg3_neiyan_trimed,hg_2_zj_pt1,rs.MoveObject(rs.CopyObject(hg_zj_pt1),(x,x,0)),copy=True),(0,0,21 * x)),delete_input = True)
rs.MoveObject(ndg4_zj_neiyan2[1],(0,21 * x,0))

ndg4_zj_neiyan2 = rs.BooleanUnion(ndg4_zj_neiyan2,delete_input = True)

#内檐第四层泥道栱上的散斗

SanDou_ndg4_neiyan = rs.MoveObject(rs.CopyObject(SanDou_ndg3_neiyan),(0,21 * x,21 * x))
SanDou2_ndg4_neiyan = rs.MirrorObject(SanDou_ndg4_neiyan,hg_zj_pt1,rs.MoveObject(rs.CopyObject(hg_zj_pt1),(x,x,0)),copy=True)
SanDou3_ndg4_neiyan = rs.MoveObject(rs.CopyObject(SanDou_ndg_zj1),(j*x-42 *x,j*x,(-5.5+63)*x))
SanDou4_ndg4_neiyan = rs.MirrorObject(SanDou3_ndg4_neiyan,hg_zj_pt1,rs.MoveObject(rs.CopyObject(hg_zj_pt1),(x,x,0)),copy=True)

#转角内檐第四层华拱上的散斗

SanDou_huagong4_neiyan = rs.MirrorObject(SanDou_sf,rs.MoveObject(rs.CopyObject(hg_zj_pt1),(j*x/2,j*x/2,0)),rs.MoveObject(rs.CopyObject(hg_zj_pt1),(j*x/2-x,j*x/2+x,0)),copy=True)

rs.MoveObject(SanDou_huagong4_neiyan,(0,0,-5.5 * x))

SanDou2_huagong4_neiyan = rs.MirrorObject(SanDou_sf,hg_zj_pt1,rs.MoveObject(rs.CopyObject(hg_zj_pt1),(-x,x,0)),copy=True)
rs.MirrorObject(SanDou2_huagong4_neiyan,rs.MoveObject(rs.CopyObject(hg_zj_pt1),(j*x/2,j*x/2,0)),rs.MoveObject(rs.CopyObject(hg_zj_pt1),(j*x/2-x,j*x/2+x,0)),copy=False)

rs.MoveObject(SanDou2_huagong4_neiyan,(0,0,-5.5 * x))


#转角内檐第五层华拱-耍头

HuaGong5_zj_neiyan = rs.MoveObject(rs.CopyObject(st_zjbrep_untrimed),(-21 * x,0,0))
rs.RotateObject(HuaGong5_zj_neiyan,hg_zj_pt1,45,[0,0,x],copy=False)

rs.MirrorObject(HuaGong5_zj_neiyan,rs.MoveObject(rs.CopyObject(hg_zj_pt1),(j*x/2,j*x/2,0)),rs.MoveObject(rs.CopyObject(hg_zj_pt1),(j*x/2-x,j*x/2+x,0)),copy=False)

rs.MoveObject(HuaGong5_zj_neiyan,(0,0,42 * x-5.5 *x))

#耍头后尾
HuaGong5_zj_neiyan_tail = rs.ExplodePolysurfaces(HuaGong5_zj_neiyan)[5]
HuaGong5_zj_neiyan_tail = rs.ExtrudeSurface(HuaGong5_zj_neiyan_tail,rs.AddLine(rs.AddPoint(0,0,0),rs.AddPoint(-84 * x,-84 * x,0)))

HuaGong5_zj_neiyan  = rs.BooleanDifference(HuaGong5_zj_neiyan,HuaGong5_zj_neiyan_tail,delete_input=False)

#转角内檐第五层华拱-耍头被转角第四层内檐铺作剪切

HuaGong5_zj_neiyan = rs.BooleanUnion([HuaGong4_zj_neiyan,HuaGong5_zj_neiyan],delete_input=False)

#转角内檐第五层华拱剪切
HuaGong5_zj_neiyan_trimed = rs.ExplodePolysurfaces(ndg4_zj_neiyan)[23]
HuaGong5_zj_neiyan_trimed = rs.DuplicateEdgeCurves(HuaGong5_zj_neiyan_trimed)[0]
HuaGong5_zj_neiyan_trimed = rs.JoinCurves([HuaGong5_zj_neiyan_trimed,rs.MoveObject(rs.CopyObject(HuaGong5_zj_neiyan_trimed),(0,0,7.5 * x))])

HuaGong5_zj_neiyan_trimed = rs.ExtrudeCurve(HuaGong5_zj_neiyan_trimed,rs.AddLine(rs.AddPoint(0,0,0),rs.AddPoint(0,15 * x,0)))
HuaGong5_zj_neiyan_trimed = rs.ExtrudeSurface(HuaGong5_zj_neiyan_trimed,rs.AddLine(rs.AddPoint(0,0,0),rs.AddPoint(-15 * x,0,0)))
rs.MoveObject(HuaGong5_zj_neiyan_trimed,(0,-x,13.5 * x))

HuaGong5_zj_neiyan = rs.BooleanDifference(HuaGong5_zj_neiyan_trimed,HuaGong5_zj_neiyan,delete_input=True)[0]





#第五层泥道拱
rs.MoveObject(ndg5_neiyan,(j*x,j*x,-5.5*x+84 * x))


#转角内檐第五层华拱后尾

HuaGong5_zj_neiyan_tail2 = rs.ExplodePolysurfaces(ndg5_neiyan)[0]

HuaGong5_zj_neiyan_tail2 = rs.ExtrudeSurface(HuaGong5_zj_neiyan_tail2,rs.AddLine(rs.AddPoint(0,0,0),rs.AddPoint(0,-10 * x,0)))

HuaGong5_zj_neiyan = rs.BooleanUnion([HuaGong5_zj_neiyan_tail2,HuaGong5_zj_neiyan],delete_input=True)

#转角内檐第五层华拱上的平盘斗

SanDou_ppd_ang5_neiyan = rs.RotateObject(SanDou_ppd,hg_zj_pt1,-45,[0,0,x],copy=True)
rs.MoveObject(SanDou_ppd_ang5_neiyan,(-21 *x,0,0))
rs.RotateObject(SanDou_ppd_ang5_neiyan,hg_zj_pt1,45,[0,0,x],copy=False)

rs.MirrorObject(SanDou_ppd_ang5_neiyan,rs.MoveObject(rs.CopyObject(hg_zj_pt1),(j*x/2,j*x/2,0)),rs.MoveObject(rs.CopyObject(hg_zj_pt1),(j*x/2-x,j*x/2+x,0)),copy=False)

rs.MoveObject(SanDou_ppd_ang5_neiyan,(0,0,63 * x-5.5 * x))


#转角内檐第五层华拱上的馒头榫

mts_huagong5_neiyan = rs.ExplodePolysurfaces(SanDou_ppd_ang5_neiyan)[10]
mts_huagong5_neiyan = rs.ExtrudeSurface(mts_huagong5_neiyan,rs.AddLine(rs.AddPoint(0,0,0),rs.AddPoint(0,0,-2.5 * x)))


HuaGong5_zj_neiyan = rs.BooleanUnion([mts_huagong5_neiyan,HuaGong5_zj_neiyan],delete_input=False)

#第五层泥道拱上的散斗

SanDou_ndg5_neiyan = rs.MoveObject(rs.CopyObject(SanDou_ndg4_neiyan),(0,-63 * x,21 * x))
SanDou2_ndg5_neiyan = rs.MoveObject(rs.CopyObject(SanDou_ndg5_neiyan),(0,-(HuaGong_CaiFen_left*2-10) * x,0))


#转角内檐第五层华拱上平盘斗上的泥道栱

rs.MoveObjects([ndg6_neiyan,ndg6_neiyan2],(j*x + 63 *x,j*x + 63 *x,-5.5*x+105 * x))

#转角内檐第五层华拱上平盘斗上泥道栱上的散斗

SanDou_ndg6_neiyan = rs.MoveObject(rs.CopyObject(SanDou_ndg5_neiyan),(63 * x,63 * x,21 * x))

SanDou3_ndg6_neiyan  = rs.MirrorObject(SanDou_ndg6_neiyan,hg_zj_pt1,rs.MoveObject(rs.CopyObject(hg_zj_pt1),(x,x,0)),copy=True)


SanDou2_ndg6_neiyan = rs.MoveObject(rs.CopyObject(SanDou2_ndg5_neiyan),(63 * x,63 * x,21 * x))

SanDou4_ndg6_neiyan  = rs.MirrorObject(SanDou2_ndg6_neiyan,hg_zj_pt1,rs.MoveObject(rs.CopyObject(hg_zj_pt1),(x,x,0)),copy=True)





#昂剪切


ang_trimed6 = rs.AddLine(ZhuTou_point,rs.MoveObject(rs.CopyObject(ZhuTou_point),(150 * x,0,0)))
ang_trimed6 = rs.ExtrudeCurve(ang_trimed6,rs.AddLine(rs.AddPoint(0,0,0),rs.AddPoint(0,150 * x,0)))
ang_trimed6 = rs.ExtrudeSurface(ang_trimed6,rs.AddLine(rs.AddPoint(0,0,0),rs.AddPoint(0,0,100 * x)))

rs.MoveObject(ang_trimed6,(-50 * x,-50 * x,377 * x))

ang_jiao_zj_untrimrd_brep = rs.BooleanIntersection(ang_trimed6,ang_jiao_zj_untrimrd_brep,delete_input=False)


ang2_jiao_untrimed = rs.BooleanIntersection(ang_trimed6,ang2_jiao_untrimed,delete_input=False)

ang_you_jiao_untrimed_zj_untrimrd_brep = rs.BooleanIntersection(ang_trimed6,ang_you_jiao_untrimed_zj_untrimrd_brep,delete_input=False)







Dou_g_waiyan_zj = [JiaoLuDou[0],SanDou_1[0],SanDou_1_2[0],SanDou_ndg_zj1[0],SanDou_ndg_zj1_2,SanDou_ndg_zj1_3,SanDou_ndg_zj1_4,SanDou_btf1]
Dou_g_neiyan_zj = rs.CopyObjects(Dou_g_waiyan_zj)
rs.RotateObjects(Dou_g_neiyan_zj,hg_zj_pt1,180,[0,0,x])
rs.MoveObjects(Dou_g_neiyan_zj,(j*x,j*x,-5.5*x))

Gong_waiyan_zj = [HuaGong1_zj_brep,ndg1_zj[0],ndg1_zj2[0],HuaGong2_zj_brep[0]]
Gong_neiyan_zj = rs.CopyObjects(Gong_waiyan_zj)
rs.RotateObjects(Gong_neiyan_zj,hg_zj_pt1,180,[0,0,x])
rs.MoveObjects(Gong_neiyan_zj,(j*x,j*x,-5.5*x))

Gong_waiyan_zj.append(gzg_lgjy1_2_zj2[0])
Gong_waiyan_zj.append(gzg_lgjy1_2_zj[0])
Gong_waiyan_zj.append(ndg1_2_zj[0])
Gong_waiyan_zj.append(ndg1_2_zj2[0])
Gong_waiyan_zj.append(htz1[0])
Gong_waiyan_zj.append(htz2[0])
Gong_waiyan_zj.append(btf_htz[0])
Gong_waiyan_zj.append(ang1_zj_untrimrd_brep[0])
Gong_waiyan_zj.append(ang1_zj_untrimrd_brep2[0])
Gong_waiyan_zj.append(ang_jiao_zj_untrimrd_brep[0])
Gong_waiyan_zj.append(sf_zj1[0])
Gong_waiyan_zj.append(pqf_zj[0])
Gong_waiyan_zj.append(mg_lgjy_untrimed1[0])
Gong_waiyan_zj.append(mg_lgjy_untrimed2[0])
Gong_waiyan_zj.append(ang2_zj_untrimrd_brep_1[0])
Gong_waiyan_zj.append(ang2_zj_untrimrd_brep_2[0])
Gong_waiyan_zj.append(ang2_jiao_untrimed[0])
Gong_waiyan_zj.append(lhf_zj_untrimed1[0])
Gong_waiyan_zj.append(lhf_zj_untrimed2[0])
Gong_waiyan_zj.append(sf_hg_zj1)
Gong_waiyan_zj.append(sf_hg_zj2)
Gong_waiyan_zj.append(lg1_zj[0])
Gong_waiyan_zj.append(lg1_zj2[0])
Gong_waiyan_zj.append(lg_ang2)
Gong_waiyan_zj.append(lg2_ang2)
Gong_waiyan_zj.append(ang_you_jiao_untrimed_zj_untrimrd_brep[0])
Gong_waiyan_zj.append(st_ang2zj_brep[0])
Gong_waiyan_zj.append(st_ang2zj_brep2)
Gong_waiyan_zj.append(baoping_brep[0])
Gong_waiyan_zj.append(tm_brep1[0])
Gong_waiyan_zj.append(tm_brep2[0])








rs.MoveObjects([ndg6_neiyan,ndg6_neiyan2,SanDou_ndg6_neiyan,SanDou2_ndg6_neiyan,SanDou3_ndg6_neiyan,SanDou4_ndg6_neiyan],(6 * x,6 * x,0))

Gong_neiyan_zj.append(ndg1_2_zj3[0])
Gong_neiyan_zj.append(ndg1_2_zj4[0])
Gong_neiyan_zj.append(btf_htz2[0])
Gong_neiyan_zj.append(ndg3_zj_neiyan[0])
Gong_neiyan_zj.append(ndg3_zj_neiyan2[0])
Gong_neiyan_zj.append(ndg4_zj_neiyan[0])
Gong_neiyan_zj.append(ndg4_zj_neiyan2[0])
Gong_neiyan_zj.append(HuaGong4_zj_neiyan[0])
Gong_neiyan_zj.append(HuaGong5_zj_neiyan[0])
Gong_neiyan_zj.append(ndg5_neiyan)
Gong_neiyan_zj.append(ndg6_neiyan)
Gong_neiyan_zj.append(ndg6_neiyan2)







Dou_g_waiyan_zj.append(SanDou_ppd[0])
Dou_g_waiyan_zj.append(JiaoHuDou_zj1[0])
Dou_g_waiyan_zj.append(JiaoHuDou_zj2)
Dou_g_waiyan_zj.append(SanDou_ndg_zj2_1)
Dou_g_waiyan_zj.append(SanDou_ndg_zj2_2)
Dou_g_waiyan_zj.append(SanDou_gzgjy1_zj)
Dou_g_waiyan_zj.append(SanDou_gzgjy2_zj)
Dou_g_waiyan_zj.append(SanDou_gzgjy3_zj)
Dou_g_waiyan_zj.append(SanDou_gzgjy4_zj)
Dou_g_waiyan_zj.append(SanDou_gzgjy5_zj)
Dou_g_waiyan_zj.append(SanDou_gzgjy6_zj)
Dou_g_waiyan_zj.append(QIAngDou_ang1_zj[0])
Dou_g_waiyan_zj.append(QIAngDou_ang1_zj2)
Dou_g_waiyan_zj.append(QIAngDou_ang_jiao_zj)
Dou_g_waiyan_zj.append(SanDou_htz1)
Dou_g_waiyan_zj.append(SanDou_htz2)
Dou_g_waiyan_zj.append(SanDou_ang1_zj1)
Dou_g_waiyan_zj.append(SanDou_ang1_zj2)
Dou_g_waiyan_zj.append(SanDou_sf[0])
Dou_g_waiyan_zj.append(SanDou_mgjy1_zj)
Dou_g_waiyan_zj.append(SanDou_mgjy2_zj)
Dou_g_waiyan_zj.append(SanDou_mgjy3_zj)
Dou_g_waiyan_zj.append(SanDou_mgjy4_zj)
Dou_g_waiyan_zj.append(SanDou_mgjy5_zj)
Dou_g_waiyan_zj.append(SanDou_mgjy6_zj)
Dou_g_waiyan_zj.append(JiaoHuDou_ang2)
Dou_g_waiyan_zj.append(JiaoHuDou_ang2_2)
Dou_g_waiyan_zj.append(SanDou_ppd_ang2_jiao[0])
Dou_g_waiyan_zj.append(SanDou_lg1)
Dou_g_waiyan_zj.append(SanDou_lg2)
Dou_g_waiyan_zj.append(SanDou_lg3)
Dou_g_waiyan_zj.append(SanDou_lg4)
Dou_g_waiyan_zj.append(SanDou_lg5)
Dou_g_waiyan_zj.append(SanDou_lg6)
Dou_g_waiyan_zj.append(SanDou_lg7)
Dou_g_waiyan_zj.append(SanDou_lg8)
Dou_g_waiyan_zj.append(SanDou_st_ang2)
Dou_g_waiyan_zj.append(SanDou_st_ang2_2)

















Dou_g_neiyan_zj.append(SanDou_ndg_zj2_3)
Dou_g_neiyan_zj.append(SanDou_ndg_zj2_4)
Dou_g_neiyan_zj.append(SanDou_ndg_zj3_1)
Dou_g_neiyan_zj.append(SanDou_btf_st)
Dou_g_neiyan_zj.append(JiaoHuDou_ndg3_neiyan)
Dou_g_neiyan_zj.append(JiaoHuDou2_ndg3_neiyan)
Dou_g_neiyan_zj.append(SanDou_ndg3_neiyan)
Dou_g_neiyan_zj.append(SanDou2_ndg3_neiyan)
Dou_g_neiyan_zj.append(SanDou_ndg4_neiyan)
Dou_g_neiyan_zj.append(SanDou2_ndg4_neiyan)
Dou_g_neiyan_zj.append(SanDou3_ndg4_neiyan)
Dou_g_neiyan_zj.append(SanDou4_ndg4_neiyan)
Dou_g_neiyan_zj.append(SanDou_huagong4_neiyan)
Dou_g_neiyan_zj.append(SanDou2_huagong4_neiyan)
Dou_g_neiyan_zj.append(SanDou_ppd_ang5_neiyan)
Dou_g_neiyan_zj.append(SanDou_ndg5_neiyan)
Dou_g_neiyan_zj.append(SanDou2_ndg5_neiyan)
Dou_g_neiyan_zj.append(SanDou_ndg6_neiyan)
Dou_g_neiyan_zj.append(SanDou2_ndg6_neiyan)
Dou_g_neiyan_zj.append(SanDou3_ndg6_neiyan)
Dou_g_neiyan_zj.append(SanDou4_ndg6_neiyan)

MianKuo_length = 16 * 15

PuZuo_zhuanjiao_1 = Gong_waiyan_zj + Gong_neiyan_zj + Dou_g_waiyan_zj + Dou_g_neiyan_zj + yl_brep



PuZuo_zhuanjiao_2 = rs.MirrorObjects(PuZuo_zhuanjiao_1,rs.MoveObject(rs.CopyObject(hg_zj_pt1),(2 * j * x,0,0)),rs.MoveObject(rs.CopyObject(hg_zj_pt1),(2 * j * x,x,0)),copy=True)

PuZuo_zhuanjiao_right = PuZuo_zhuanjiao_1 + PuZuo_zhuanjiao_2

PuZuo_zhuanjiao_left = rs.MirrorObjects(PuZuo_zhuanjiao_right,rs.MoveObject(rs.CopyObject(hg_zj_pt1),(0,(MianKuo_length * (MianKuo - 2) * x + 2 * j * x)/2 ,0)),rs.MoveObject(rs.CopyObject(hg_zj_pt1),(x,(MianKuo_length * (MianKuo - 2) * x + 2 * j * x)/2 ,0)),copy=True)

PuZuo_zhuanjiao = PuZuo_zhuanjiao_left + PuZuo_zhuanjiao_right
# ---------- end 斗拱编辑器_5 ----------

brep_34 = Brep(斗拱编辑器_4.PuZuo_neiyan_g)
list_item_11 = ListItem(Index=number_slider_21, Wrap=True)
# ---- group: Python 3 Script
# 面扩方向横向构件-外檐
python_3_script_12 = Python3Script(
    CaiFen=number_slider_2,
    HuaGong_CaiFen_left=number_slider_16,
    HuaGong_CaiFen_right=number_slider_16,
    NiDaoGong_CaiFen_left=number_slider_14,
    NiDaoGong_CaiFen_right=number_slider_14,
    MianKuo=number_slider_3)  # -> out, sufang_breps, HuaGong1_pj_g, SanDou_g, SanDou_g_2, SanDou_g_3, sufang2_breps, HuaGong2_pj_g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
# ---------- python_3_script_12: Python ----------
#佛光寺东大殿柱基
#每一跳为21分
import rhinoscriptsyntax as rs
import Rhino.Geometry as rg
import itertools as it
#材分可调变量x
x = CaiFen
#柱头点
ZhuTou_point = rs.AddPoint(HuaGong_CaiFen_left * x,5 *x,0)
#原点
BasePoint = 0
pt_o = rs.AddPoint(BasePoint * 500,0,0)
#进深为14倍材广,一材广为15材分(j的单位为分)
j = 14 * 15
MianKuo_length = 16 * 15




#铺间辅作
##佛光寺东大殿柱头铺作生成





#泥道栱
if NiDaoGong_CaiFen_left != NiDaoGong_CaiFen_right:
    raise ValueError(f"两边必须一样长")

ndg_bj1_pt_o = rs.CopyObject(ZhuTou_point)
if (NiDaoGong_CaiFen_left > 25) & (NiDaoGong_CaiFen_right > 25):
    rs.MoveObject(ndg_bj1_pt_o,(0,(NiDaoGong_CaiFen_left) * x,0))
else : raise ValueError(f"必须大于26分")

ndg_bj1_pt_z1 = rs.CopyObject(ndg_bj1_pt_o)
rs.MoveObject(ndg_bj1_pt_z1,(0,0,9 * x))
ndg_bj1_cr_z = rs.AddLine(ndg_bj1_pt_o,ndg_bj1_pt_z1)
ndg_bj1_pt_y1 = rs.CopyObject(ndg_bj1_pt_o)
rs.MoveObject(ndg_bj1_pt_y1 ,(0,-12 * x,0))
ndg_bj1_cr_y = rs.AddLine(ndg_bj1_pt_y1,ndg_bj1_pt_o)
div_cr_z =rs.DivideCurve(ndg_bj1_cr_z,5)
div_cr_y =rs.DivideCurve(ndg_bj1_cr_y,5)
#卷杀
CrossCurves_ndg_bj1 = []
for i in range(len(div_cr_z)):
    divide_y = div_cr_y[i]
    divide_z = div_cr_z[i]
    CrossCurve_ndg_bj1 = rs.AddLine(divide_y,divide_z)
    CrossCurves_ndg_bj1.append(CrossCurve_ndg_bj1)
CrossCurves_ndg_bj1 = CrossCurves_ndg_bj1[1:len(CrossCurves_ndg_bj1)-1]
#选择交点
CrossCurves_points_ndg_bj1 = []
for i in range(len(CrossCurves_ndg_bj1)):
    CrossCurves_point_ndg_bj1 = rs.CurveCurveIntersection(CrossCurves_ndg_bj1[i],CrossCurves_ndg_bj1[i-1])[0][1]
    CrossCurves_points_ndg_bj1.append(CrossCurves_point_ndg_bj1)
CrossCurves_points_ndg_bj1 = CrossCurves_points_ndg_bj1[1:len(CrossCurves_points_ndg_bj1)]
CrossCurves_points_ndg_bj1.insert(0,rs.CurveStartPoint(ndg_bj1_cr_y))
CrossCurves_points_ndg_bj1.insert(len(CrossCurves_points_ndg_bj1)+1,rs.CurveEndPoint(ndg_bj1_cr_z))
ndg_bj1_pt_z2 = rs.CopyObject(ndg_bj1_pt_z1)
rs.MoveObject(ndg_bj1_pt_z2,(0,0, 6 * x))
ndg_bj1_pt_z3 = rs.CopyObject(ndg_bj1_pt_z2)
rs.MoveObject(ndg_bj1_pt_z3,(0,-10 * x,0))
ndg_bj1_pt_y_1 = rs.CopyObject(ZhuTou_point)
rs.MoveObject(ndg_bj1_pt_y_1,(0,0,5 * x))
ndg_bj1_pt_y_2 = rs.CopyObject(ndg_bj1_pt_y_1)
rs.MoveObject(ndg_bj1_pt_y_2,(0,4 * x,0))
ndg_bj1_pt_y_3 = rs.CopyObject(ndg_bj1_pt_y_2)
rs.MoveObject(ndg_bj1_pt_y_3,(0,0,10 * x))
CrossCurves_points_ndg_bj1.append(ndg_bj1_pt_z2)
CrossCurves_points_ndg_bj1.append(ndg_bj1_pt_z3)
CrossCurves_points_ndg_bj1_right = rs.MirrorObjects(CrossCurves_points_ndg_bj1,ZhuTou_point,rs.MoveObject(rs.CopyObject(ZhuTou_point),(x,0,x)),copy=True)
rs.MoveObjects(CrossCurves_points_ndg_bj1_right,(0,(NiDaoGong_CaiFen_left - NiDaoGong_CaiFen_right) * x,0))
ndg_bj1_mid_pt1 = rs.CopyObject(ZhuTou_point)
ndg_bj1_mid_pt1 = rs.MoveObject(ndg_bj1_mid_pt1,(0,-4 * x,15 * x))
ndg_bj1_mid_pt4 = rs.CopyObject(ZhuTou_point)
ndg_bj1_mid_pt4 = rs.MoveObject(ndg_bj1_mid_pt4,(0,4 * x,15 * x))
ndg_bj1_mid_pt2 = rs.CopyObject(ndg_bj1_mid_pt1)
rs.MoveObject(ndg_bj1_mid_pt2,(0,0,-10 * x))
ndg_bj1_mid_pt3 = rs.CopyObject(ndg_bj1_mid_pt2)
rs.MoveObject(ndg_bj1_mid_pt3,(0,8 * x,0))
CrossCurves_points_ndg_bj1.insert(0,CrossCurves_points_ndg_bj1_right[0])
CrossCurves_points_ndg_bj1.insert(0,CrossCurves_points_ndg_bj1_right[1])
CrossCurves_points_ndg_bj1.insert(0,CrossCurves_points_ndg_bj1_right[2])
CrossCurves_points_ndg_bj1.insert(0,CrossCurves_points_ndg_bj1_right[3])
CrossCurves_points_ndg_bj1.insert(0,CrossCurves_points_ndg_bj1_right[4])
CrossCurves_points_ndg_bj1.insert(0,CrossCurves_points_ndg_bj1_right[5])
CrossCurves_points_ndg_bj1.insert(0,CrossCurves_points_ndg_bj1_right[6])
CrossCurves_points_ndg_bj1.insert(0,ndg_bj1_mid_pt1)
CrossCurves_points_ndg_bj1.insert(0,ndg_bj1_mid_pt2)
CrossCurves_points_ndg_bj1.insert(0,ndg_bj1_mid_pt3)
CrossCurves_points_ndg_bj1.insert(0,ndg_bj1_mid_pt4)
ndg_bj1_curve_left1 = rs.AddPolyline(CrossCurves_points_ndg_bj1)
ndg_bj1_curve_left1 = rs.JoinCurves([ndg_bj1_curve_left1,rs.AddLine(rs.CurveEndPoint(ndg_bj1_curve_left1),rs.CurveStartPoint(ndg_bj1_curve_left1))])
rs.MoveObject(ndg_bj1_curve_left1,(5 *x,0,0))




ndg_bj1_sr_left1 = rs.AddPlanarSrf(ndg_bj1_curve_left1)


ndg_bj1_brep = rs.ExtrudeSurface(ndg_bj1_sr_left1,rs.AddLine(rs.AddPoint(0,0,0),rs.AddPoint(-10 * x,0,0)))

# 拱眼
ndg_bj1_gyy_pt1 = rs.CopyObject(ndg_bj1_pt_z3)
rs.MoveObject(ndg_bj1_gyy_pt1,(-5 * x,0,x))
ndg_bj1_gyy_pt2 = rs.CopyObject(ndg_bj1_gyy_pt1)
rs.MoveObject(ndg_bj1_gyy_pt2,(0,0,-2 * x))
ndg_bj1_gyy_pt4 = rs.CopyObject(ndg_bj1_mid_pt4)
rs.MoveObject(ndg_bj1_gyy_pt4,(-5 * x, 1.625 * x,x))
ndg_bj1_gyy_pt3 = rs.CopyObject(ndg_bj1_gyy_pt4)
rs.MoveObject(ndg_bj1_gyy_pt3,(0,0,-2 * x))
ndg_bj1_gyy_cr1 = rs.AddLine(ndg_bj1_gyy_pt1,ndg_bj1_gyy_pt2)
ndg_bj1_gyy_cr2 = rs.AddLine(ndg_bj1_gyy_pt2,ndg_bj1_gyy_pt3)
ndg_bj1_gyy_cr3 = rs.AddLine(ndg_bj1_gyy_pt3,ndg_bj1_gyy_pt4)
ndg_bj1_gyy_cr1 = rs.AddFilletCurve(ndg_bj1_gyy_cr1,ndg_bj1_gyy_cr2,x)
ndg_bj1_gyy_cr2 = rs.AddFilletCurve(ndg_bj1_gyy_cr3,ndg_bj1_gyy_cr2,x)
ndg_bj1_gyy_cr3 = rs.AddLine(rs.CurveEndPoint(ndg_bj1_gyy_cr1),rs.CurveEndPoint(ndg_bj1_gyy_cr2))
ndg_bj1_gyy_cr4 = rs.AddLine(rs.CurveStartPoint(ndg_bj1_gyy_cr1),rs.MoveObject(rs.CopyObject(ndg_bj1_gyy_pt1),(0,0,x)))
ndg_bj1_gyy_cr5 = rs.AddLine(rs.CurveStartPoint(ndg_bj1_gyy_cr2),rs.MoveObject(rs.CopyObject(ndg_bj1_gyy_pt4),(0,0,x)))
ndg_bj1_gyy_1 =rs.JoinCurves([ndg_bj1_gyy_cr1,ndg_bj1_gyy_cr2,ndg_bj1_gyy_cr3,ndg_bj1_gyy_cr4,ndg_bj1_gyy_cr5])
ndg_bj1_gyy_1 =rs.JoinCurves([ndg_bj1_gyy_1,rs.AddLine(rs.CurveStartPoint(ndg_bj1_gyy_1),rs.CurveEndPoint(ndg_bj1_gyy_1))])
rs.MoveObject(ndg_bj1_gyy_1,(-x,0,0)) 
ndg_bj1_gyy_1 = rs.AddPlanarSrf(ndg_bj1_gyy_1)
ndg_bj1_gyy_1 = rs.ExtrudeSurface(ndg_bj1_gyy_1,rs.AddLine(ZhuTou_point,rs.MoveObject(rs.CopyObject(ZhuTou_point),(2 * x,0,0))))
ndg_bj1_gyy_2 = rs.MirrorObject(ndg_bj1_gyy_1,ZhuTou_point,rs.MoveObject(rs.CopyObject(ZhuTou_point),(0,x,0)),copy=True)
ndg_bj1_gyy_3 = rs.MirrorObject(ndg_bj1_gyy_1,ZhuTou_point,rs.MoveObject(rs.CopyObject(ZhuTou_point),(x,0,0)),copy=True)
ndg_bj1_gyy_4 = rs.MirrorObject(ndg_bj1_gyy_2,ZhuTou_point,rs.MoveObject(rs.CopyObject(ZhuTou_point),(x,0,0)),copy=True)
ndg_bj1_brep = rs.BooleanDifference(ndg_bj1_brep,ndg_bj1_gyy_1)
ndg_bj1_brep = rs.BooleanDifference(ndg_bj1_brep,ndg_bj1_gyy_2)
ndg_bj1_brep = rs.BooleanDifference(ndg_bj1_brep,ndg_bj1_gyy_3)
ndg_bj1_brep = rs.BooleanDifference(ndg_bj1_brep,ndg_bj1_gyy_4)

#素枋的馒头榫生成
mts_ndg_bj1 = rs.ExplodePolysurfaces(ndg_bj1_brep)[15]
mts_ndg_bj1 = rs.CurveEndPoint(rs.DuplicateEdgeCurves(mts_ndg_bj1)[0])
rs.MoveObject(mts_ndg_bj1,(-3.75 * x,-3.75 * x,0))
mts1_ndg_bj1 = rs.AddLine(mts_ndg_bj1,rs.MoveObject(rs.CopyObject(mts_ndg_bj1),(-2.5 * x,0,0)))
mts1_ndg_bj1 = rs.ExtrudeCurve(mts1_ndg_bj1,rs.AddLine(rs.AddPoint(0,0,0),rs.AddPoint(0,-2.5 * x,0)))
mts1_ndg_bj1 = rs.ExtrudeSurface(mts1_ndg_bj1,rs.AddLine(rs.AddPoint(0,0,0),rs.AddPoint(0,0,2.5 * x)))
mts1_ndg_bj2 = rs.MirrorObject(mts1_ndg_bj1,ZhuTou_point,rs.MoveObject(rs.CopyObject(ZhuTou_point),(x,0,0)),copy=True)

ndg_bj1_brep = rs.BooleanDifference(mts1_ndg_bj1,ndg_bj1_brep,delete_input=False)

ndg_bj1_brep = rs.BooleanIntersection(ndg_bj1_brep,mts1_ndg_bj2,delete_input=False)


#素枋被泥道栱的插销剪切

ndg_bj_2_cx_ndg_bj1 = rs.ExplodePolysurfaces(ndg_bj1_brep)[14]
ndg_bj_2_cx_ndg_bj1 = rs.CurveEndPoint(rs.DuplicateEdgeCurves(ndg_bj_2_cx_ndg_bj1)[0])
rs.MoveObject(ndg_bj_2_cx_ndg_bj1,(-3.75 * x,-3.75 * x,0))
ndg_bj_2_cx1_ndg_bj1 = rs.AddLine(ndg_bj_2_cx_ndg_bj1,rs.MoveObject(rs.CopyObject(ndg_bj_2_cx_ndg_bj1),(-2.5 * x,0,0)))
ndg_bj_2_cx1_ndg_bj1 = rs.ExtrudeCurve(ndg_bj_2_cx1_ndg_bj1,rs.AddLine(rs.AddPoint(0,0,0),rs.AddPoint(0,-4 * x,0)))
ndg_bj_2_cx1_ndg_bj1 = rs.ExtrudeSurface(ndg_bj_2_cx1_ndg_bj1,rs.AddLine(rs.AddPoint(0,0,0),rs.AddPoint(0,0,4 * x)))
rs.MoveObject(ndg_bj_2_cx1_ndg_bj1,(0,-(NiDaoGong_CaiFen_left-8) * x,0))

ndg_bj_2_cx2_ndg_bj1 = rs.MirrorObject(ndg_bj_2_cx1_ndg_bj1,ZhuTou_point,rs.MoveObject(rs.CopyObject(ZhuTou_point),(x,0,0)),copy=True)

ndg_bj1_brep = rs.BooleanDifference(ndg_bj_2_cx1_ndg_bj1,ndg_bj1_brep,delete_input=False)
ndg_bj1_brep = rs.BooleanIntersection(ndg_bj_2_cx2_ndg_bj1,ndg_bj1_brep,delete_input=False)
ndg_bj1_brep_jinshen = rs.CopyObject(ndg_bj1_brep)


rs.MoveObject(ndg_bj1_brep ,(0,j * x + (MianKuo-((MianKuo+1)/2+1)) * 16 * 15 * x + (MianKuo_length * x)/2,252 * x +21 * x))



ndg_bj_breps = [ndg_bj1_brep[0]]
ndg_bj2_brep = rs.CopyObject(ndg_bj1_brep)

sq_rule = [0,0,0,0,0,0,0,0,0,0,0,0,0,0,0,0,0,0,0,0,1.25,4.25]
for i in range(int((MianKuo - 3)/2)+1):
    if i + 1 < len(range(int((MianKuo - 3)/2)+1)):
        ndg_bj_brep1 = rs.MoveObject(rs.CopyObject(ndg_bj1_brep),(0,-(MianKuo_length * (i+1)) * x,sq_rule[-(int((MianKuo - 3)/2-i))] * x))
        ndg_bj_breps.append(ndg_bj_brep1)

ndg_bj_breps_left  = rs.MirrorObjects(ndg_bj_breps[1 : len(ndg_bj_breps)],rs.MoveObject(rs.CopyObject(ZhuTou_point),(0,(MianKuo_length * (MianKuo - 2) * x + 2 * j * x)/2 ,0)),rs.MoveObject(rs.CopyObject(ZhuTou_point),(x,(MianKuo_length * (MianKuo - 2) * x + 2 * j * x)/2 ,0)),copy=True)

ndg_bj_breps_left = ndg_bj_breps_left[::-1]

ndg_bj_breps = ndg_bj_breps_left + ndg_bj_breps

ndg_bj_breps_last = rs.MoveObject(rs.CopyObject(ndg_bj_breps[-1]),(0,-(MianKuo_length * x/2) - j * x/2,5.75 * x))
ndg_bj_breps_first = rs.MirrorObject(ndg_bj_breps_last,rs.MoveObject(rs.CopyObject(ZhuTou_point),(0,(MianKuo_length * (MianKuo - 2) * x + 2 * j * x)/2 ,0)),rs.MoveObject(rs.CopyObject(ZhuTou_point),(x,(MianKuo_length * (MianKuo - 2) * x + 2 * j * x)/2 ,0)),copy=True)

ndg_bj_breps.insert(0,ndg_bj_breps_first)
ndg_bj_breps.append(ndg_bj_breps_last)
#素枋横向连接构件


#柱头点
#   面扩七开间，五进深,明间为16倍材广为240分，除了尽间，面阔皆为240分，尽间面扩为210分。进深开间 = 尽间开间也为210分
if (MianKuo % 2 == 0) | (MianKuo < 5):
    raise ValueError(f"开间最小数不能低于5,且为单数")

zhu_pt1 = rs.CopyObject(ZhuTou_point)
rs.MoveObject(zhu_pt1,(0,j * x,0))
zhu_pt2 = rs.CopyObject(zhu_pt1,(0,MianKuo_length * (MianKuo - 2) * x,0))
zhu_cr = rs.AddLine(zhu_pt1,zhu_pt2)
zhutou_pt = rs.DivideCurve(zhu_cr,MianKuo-2)
zhu_pt3 = rs.CopyObject(ZhuTou_point)
zhu_pt4 =rs.MoveObject(rs.CopyObject(zhutou_pt[-1]),(0, j * x,0))
zhutou_pt.insert(0,zhu_pt3)
zhutou_pt.append(zhu_pt4)
zhutou_pt2 = rs.MoveObjects(rs.CopyObjects(zhutou_pt),(j * x,0,0))

zhutou_pt3 = rs.MoveObjects(rs.CopyObjects(zhutou_pt2[0:2] ),(j * x,0,0))

zhutou_pt3_1 = rs.MoveObjects(rs.CopyObjects(zhutou_pt2[len(zhutou_pt2)-2:len(zhutou_pt2)] ),(j * x,0,0))

zhutou_pt3 = zhutou_pt3 + zhutou_pt3_1

zhutou_pt4 = rs.MoveObjects(rs.CopyObjects(zhutou_pt2),(2 * j * x,0,0))

zhutou_pt5 = rs.MoveObjects(rs.CopyObjects(zhutou_pt2),(3 * j * x,0,0))


#柱高
#当心间的柱高为237.5分

#生起的规律

zhutou_pt_up =rs.CopyObjects(zhutou_pt)
rs.MoveObjects(zhutou_pt_up,(0,0,237.5 * x))

zhutou_pt_up2 =rs.CopyObjects(zhutou_pt2)
rs.MoveObjects(zhutou_pt_up2,(0,0,237.5 * x))

zhutou_pt_up3 =rs.CopyObjects(zhutou_pt3)
rs.MoveObjects(zhutou_pt_up3,(0,0,237.5 * x))

if MianKuo > 5:
    #前檐
    rs.MoveObjects([zhutou_pt_up[0],zhutou_pt_up[-1]],(0,0,10.5 * x))
    rs.MoveObjects([zhutou_pt_up[1],zhutou_pt_up[-2]],(0,0,6 * x))
    rs.MoveObjects([zhutou_pt_up[2],zhutou_pt_up[-3]],(0,0,2.5 * x))
    #内檐
    rs.MoveObjects([zhutou_pt_up2[0],zhutou_pt_up2[-1]],(0,0,7.5 * x))
    rs.MoveObjects([zhutou_pt_up2[1],zhutou_pt_up2[-2]],(0,0,5 * x))
    rs.MoveObjects([zhutou_pt_up2[2],zhutou_pt_up2[-3]],(0,0,2.5 * x))
    #中柱
    rs.MoveObjects([zhutou_pt_up3[1],zhutou_pt_up3[-2]],(0,0, 2.5* x))
 
else: 
    #前檐
    rs.MoveObjects([zhutou_pt_up[0],zhutou_pt_up[-1]],(0,0,6 * x))
    rs.MoveObjects([zhutou_pt_up[1],zhutou_pt_up[-2]],(0,0,2.5 * x))
    #内檐
    rs.MoveObjects([zhutou_pt_up2[0],zhutou_pt_up2[-1]],(0,0,5 * x))
    rs.MoveObjects([zhutou_pt_up2[1],zhutou_pt_up2[-2]],(0,0,2.5 * x))



zhutou_pt_up4 = rs.CopyObjects(zhutou_pt_up2,(2 * j * x,0,0))
zhutou_pt_up5 = rs.CopyObjects(zhutou_pt_up,(4 * j * x,0,0))

# 生起曲线
yws_brep1_g = []
yws_brep2_g = []
zhuzi_qy = []
le_breps = []
le_brep_trimed_g = []
le_trimed2 = rs.CopyObjects(zhutou_pt_up[0:len(zhutou_pt_up)-1])
rs.MoveObjects(le_trimed2,(0,(NiDaoGong_CaiFen_left+2) * x,0))
le_trimed1 = rs.CopyObjects(zhutou_pt_up[1:len(zhutou_pt_up)])
rs.MoveObjects(le_trimed1,(0,-(NiDaoGong_CaiFen_left+2) * x,0))
sq_cr = rs.AddInterpCurve(zhutou_pt_up)
sq_sr = rs.ExtrudeCurve(sq_cr,rs.AddLine(rs.AddPoint(0,0,0),rs.AddPoint(5 * x,0,0)))

sq_curves = []
for i in range(len(le_trimed1)):
    cr1 = rs.AddLine(le_trimed1[i],le_trimed2[i])
    rs.MoveObject(cr1,(4 * x,0,21 * x))
    cr1 = rs.ProjectCurveToSurface(cr1,sq_sr,[0,0,x])

    sq_curves.append(cr1[0])

    le_brep = rs.ExtrudeCurve(cr1,rs.AddLine(rs.AddPoint(0,0,0),rs.AddPoint(-10 * x ,0,0)))
    le_brep = rs.ExtrudeSurface(le_brep,rs.AddLine(rs.AddPoint(0,0,0),rs.AddPoint(0 ,0,-14.5 * x)))
    
    le_brep_trimed = rs.ExtrudeCurve(cr1,rs.AddLine(rs.AddPoint(0,0,0),rs.AddPoint(-8 * x ,0,0)))
    le_brep_trimed = rs.ExtrudeSurface(le_brep_trimed,rs.AddLine(rs.AddPoint(0,0,0),rs.AddPoint(0 ,0,-15 * x)))
    rs.MoveObject(le_brep_trimed,(0,0,5 * x))
    le_brep_trimed_g.append(le_brep_trimed)
rs.MoveObjects(le_brep_trimed_g,(0,0,44.5 * x))



#第一层素上的散斗

#佛光寺东大殿散斗

x = CaiFen
#散斗,深12分,广10分,华拱/散斗.深10分,广12分,泥道栱
sd_pt_o = rs.AddPoint(0,0,0)
sd_pt2 = rs.AddPoint(10 * x,0,0)
sd_pt_z1 = rs.AddPoint(- 2 * x,0, 4 * x)
sd_cr_1 = rs.AddLine(sd_pt_o,sd_pt_z1)
#散斗,欹
sd_pt_z2 = rs.CurveMidPoint(sd_cr_1)
direction_left = (x, 0, 2 * x)  # 任意方向向量 
distance = 0.5 * x # 移动距离 
# 单位化方向向量并计算实际位移 
unit_vector_left = rs.VectorUnitize(direction_left)
displacement_left = rs.VectorScale(unit_vector_left, distance)
rs.MoveObject(sd_pt_z2, displacement_left)
sd_cr_1 = rs.AddCurve([sd_pt_o,sd_pt_z2,sd_pt_z1])
sd_pt_3 = rs.MoveObject(rs.CopyObject(sd_pt_o),(0,2 * x,0))
sd_sr1 = rs.AddLine(sd_pt_3,rs.MoveObject(rs.CopyObject(sd_pt_3),(-2 * x,-2 * x,0)))
sd_sr1 = rs.AddLoftSrf([sd_sr1,rs.MoveObject(rs.CopyObject(sd_sr1),(0,0,4* x))])
sd_cr_1 =rs.ProjectCurveToSurface(sd_cr_1,sd_sr1,[0,1,0])
sd_cr_2 = rs.MoveObject(rs.CopyObject(sd_cr_1),(0,10 * x,0 ))
sd_cr_2 = rs.RotateObject(sd_cr_2, rs.CurveStartPoint(sd_cr_2),-90,[0,0,1],copy=True)
sd_cr_3 = rs.MoveObject(rs.CopyObject(sd_cr_2),(10 * x,0,0 ))
sd_cr_3 = rs.RotateObject(sd_cr_3, rs.CurveStartPoint(sd_cr_3),-90,[0,0,1],copy=True)
sd_cr_4 = rs.MoveObject(rs.CopyObject(sd_cr_1),(10 * x,0,0 ))
sd_cr_4 = rs.RotateObject(sd_cr_4, rs.CurveStartPoint(sd_cr_4),90,[0,0,1],copy=True)
sd_down_Brep = rs.AddLoftSrf([sd_cr_1,sd_cr_2,sd_cr_3,sd_cr_4],loft_type=2,closed=True)
rs.CapPlanarHoles(sd_down_Brep)
#散斗,平
sd_sr2 = rs.ExplodePolysurfaces(sd_down_Brep)
sd_sr2 = sd_sr2[2]
sd_mid_Brep = rs.ExtrudeSurface(sd_sr2,rs.AddLine(rs.CurveEndPoint(sd_cr_2),rs.MoveObject(rs.CurveEndPoint(sd_cr_2),(0,0,2 * x))))
sd_sr3_curve= rs.DuplicateEdgeCurves(sd_mid_Brep)[9]
sd_sr3 = rs.AddLoftSrf([sd_sr3_curve,rs.MoveObject(rs.CopyObject(sd_sr3_curve),(0,-2 * x,0))])
sd_source_point = rs.SurfaceAreaCentroid(rs.ExplodePolysurfaces(sd_down_Brep)[1])[0]
sd_up_brep1 = rs.ExtrudeSurface(sd_sr3,rs.AddLine(sd_pt_o,rs.MoveObject(rs.CopyObject(sd_pt_o),(0,0,3.5* x))))
sd_up_brep2 =rs.CopyObject(sd_up_brep1)
rs.MoveObject(sd_up_brep2,(0, -12 * x ,0))


SanDou_up = rs.BooleanDifference(sd_mid_Brep,sd_up_brep2,delete_input=False)
SanDou_up = rs.BooleanDifference(SanDou_up,sd_up_brep1,delete_input=False)
SanDou = rs.BooleanDifference(SanDou_up,sd_down_Brep,delete_input=False)

#散斗被馒头榫剪切
mts_sandou = rs.ExplodePolysurfaces(SanDou)[16]
mts_sandou = rs.CurveEndPoint(rs.DuplicateEdgeCurves(mts_sandou)[0])
rs.MoveObject(mts_sandou,(3.75 * x,3.75 * x,0))
mts_sandou = rs.AddLine(mts_sandou,rs.MoveObject(rs.CopyObject(mts_sandou),(0,2.5 * x,0)))
mts_sandou = rs.ExtrudeCurve(mts_sandou,rs.AddLine(rs.AddPoint(0,0,0),rs.AddPoint(2.5 * x,0,0)))
mts_sandou = rs.ExtrudeSurface(mts_sandou,rs.AddLine(rs.AddPoint(0,0,0),rs.AddPoint(0,0,2.5 * x)))

SanDou = rs.BooleanUnion([SanDou,mts_sandou],delete_input=False)
SanDou_jingshen = rs.CopyObject(SanDou)
rs.RotateObject(SanDou,rs.MoveObject(rs.CopyObject(ZhuTou_point),(-(HuaGong_CaiFen_left-5) * x,2 * x,0)),90,[0,0,x],copy=False)


#佛光寺东大殿散斗_华拱

x = CaiFen
#散斗,深12分,广10分,华拱/散斗.深10分,广12分,泥道栱
sd_hg_pt_o = rs.AddPoint(0,0,0)
sd_hg_pt2 = rs.AddPoint(10 * x,0,0)
sd_hg_pt_z1 = rs.AddPoint(- 2 * x,0, 4 * x)
sd_hg_cr_1 = rs.AddLine(sd_hg_pt_o,sd_hg_pt_z1)
#散斗,欹
sd_hg_pt_z2 = rs.CurveMidPoint(sd_hg_cr_1)
direction_left = (x, 0, 2 * x)  # 任意方向向量 
distance = 0.5 * x # 移动距离 
# 单位化方向向量并计算实际位移 
unit_vector_left = rs.VectorUnitize(direction_left)
displacement_left = rs.VectorScale(unit_vector_left, distance)
rs.MoveObject(sd_hg_pt_z2, displacement_left)
sd_hg_cr_1 = rs.AddCurve([sd_hg_pt_o,sd_hg_pt_z2,sd_hg_pt_z1])
sd_hg_pt_3 = rs.MoveObject(rs.CopyObject(sd_hg_pt_o),(0,2 * x,0))
sd_hg_sr1 = rs.AddLine(sd_hg_pt_3,rs.MoveObject(rs.CopyObject(sd_hg_pt_3),(-2 * x,-2 * x,0)))
sd_hg_sr1 = rs.AddLoftSrf([sd_hg_sr1,rs.MoveObject(rs.CopyObject(sd_hg_sr1),(0,0,4* x))])
sd_hg_cr_1 =rs.ProjectCurveToSurface(sd_hg_cr_1,sd_hg_sr1,[0,1,0])
sd_hg_cr_2 = rs.MoveObject(rs.CopyObject(sd_hg_cr_1),(0,10 * x,0 ))
sd_hg_cr_2 = rs.RotateObject(sd_hg_cr_2, rs.CurveStartPoint(sd_hg_cr_2),-90,[0,0,1],copy=True)
sd_hg_cr_3 = rs.MoveObject(rs.CopyObject(sd_hg_cr_2),(12 * x,0,0 ))
sd_hg_cr_3 = rs.RotateObject(sd_hg_cr_3, rs.CurveStartPoint(sd_hg_cr_3),-90,[0,0,1],copy=True)
sd_hg_cr_4 = rs.MoveObject(rs.CopyObject(sd_hg_cr_1),(12 * x,0,0 ))
sd_hg_cr_4 = rs.RotateObject(sd_hg_cr_4, rs.CurveStartPoint(sd_hg_cr_4),90,[0,0,1],copy=True)
sd_hg_down_Brep = rs.AddLoftSrf([sd_hg_cr_1,sd_hg_cr_2,sd_hg_cr_3,sd_hg_cr_4],loft_type=2,closed=True)
rs.CapPlanarHoles(sd_hg_down_Brep)
#散斗,平
sd_hg_sr2 = rs.ExplodePolysurfaces(sd_hg_down_Brep)
sd_hg_sr2 = sd_hg_sr2[2]
sd_hg_mid_Brep = rs.ExtrudeSurface(sd_hg_sr2,rs.AddLine(rs.CurveEndPoint(sd_hg_cr_2),rs.MoveObject(rs.CurveEndPoint(sd_hg_cr_2),(0,0,2 * x))))
sd_hg_sr3_curve= rs.DuplicateEdgeCurves(sd_hg_mid_Brep)[9]
sd_hg_sr3 = rs.AddLoftSrf([sd_hg_sr3_curve,rs.MoveObject(rs.CopyObject(sd_hg_sr3_curve),(0,-2 * x,0))])
sd_hg_source_point = rs.SurfaceAreaCentroid(rs.ExplodePolysurfaces(sd_hg_down_Brep)[1])[0]
sd_hg_up_brep1 = rs.ExtrudeSurface(sd_hg_sr3,rs.AddLine(sd_hg_pt_o,rs.MoveObject(rs.CopyObject(sd_hg_pt_o),(0,0,3.5* x))))
sd_hg_up_brep2 =rs.CopyObject(sd_hg_up_brep1)
rs.MoveObject(sd_hg_up_brep2,(0, -12 * x ,0))


SanDou_hg_up = rs.BooleanDifference(sd_hg_mid_Brep,sd_hg_up_brep2,delete_input=False)
SanDou_hg_up = rs.BooleanDifference(SanDou_hg_up,sd_hg_up_brep1,delete_input=False)
SanDou_hg = rs.BooleanDifference(SanDou_hg_up,sd_hg_down_Brep,delete_input=False)

#散斗被馒头榫剪切
mts_SanDou_hg_hg = rs.ExplodePolysurfaces(SanDou_hg)[16]
mts_SanDou_hg_hg = rs.CurveEndPoint(rs.DuplicateEdgeCurves(mts_SanDou_hg_hg)[0])
rs.MoveObject(mts_SanDou_hg_hg,(4.75 * x,3.75 * x,0))
mts_SanDou_hg_hg = rs.AddLine(mts_SanDou_hg_hg,rs.MoveObject(rs.CopyObject(mts_SanDou_hg_hg),(0,2.5 * x,0)))
mts_SanDou_hg_hg = rs.ExtrudeCurve(mts_SanDou_hg_hg,rs.AddLine(rs.AddPoint(0,0,0),rs.AddPoint(2.5 * x,0,0)))
mts_SanDou_hg_hg = rs.ExtrudeSurface(mts_SanDou_hg_hg,rs.AddLine(rs.AddPoint(0,0,0),rs.AddPoint(0,0,2.5 * x)))

SanDou_hg = rs.BooleanUnion([SanDou_hg,mts_SanDou_hg_hg],delete_input=False)
SanDou_hg_jingshen = rs.CopyObject(SanDou_hg)
rs.RotateObject(SanDou_hg,rs.MoveObject(rs.CopyObject(ZhuTou_point),(-(HuaGong_CaiFen_left-6) * x,2 * x,0)),0,[0,0,x],copy=False)




#第二层枋上的散斗

SanDou1_sf2 =rs.MoveObject(rs.CopyObject(SanDou),((HuaGong_CaiFen_left-5) * x,(NiDaoGong_CaiFen_left-7) * x,15 * x))
SanDou2_sf2 = rs.MirrorObject(SanDou1_sf2,ZhuTou_point,rs.MoveObject(rs.CopyObject(ZhuTou_point),(x,0,0)),copy=True)
SanDous_sf2= [SanDou1_sf2,SanDou2_sf2]
##佛光寺东大殿横向枋生成
if NiDaoGong_CaiFen_left != NiDaoGong_CaiFen_right:
    raise ValueError(f"两边必须一样长")

sf1_pt_o = rs.CopyObject(ZhuTou_point)
if (NiDaoGong_CaiFen_left > 25) & (NiDaoGong_CaiFen_right > 25):
    rs.MoveObject(sf1_pt_o,(0,(NiDaoGong_CaiFen_left+22) * x,0))
else : raise ValueError(f"必须大于26分")

sf1_pt_z1 = rs.CopyObject(sf1_pt_o)
rs.MoveObject(sf1_pt_z1,(0,0,9 * x))
sf1_cr_z = rs.AddLine(sf1_pt_o,sf1_pt_z1)
sf1_pt_y1 = rs.CopyObject(sf1_pt_o)
rs.MoveObject(sf1_pt_y1 ,(0,-12 * x,0))
sf1_cr_y = rs.AddLine(sf1_pt_y1,sf1_pt_o)
div_cr_z =rs.DivideCurve(sf1_cr_z,5)
div_cr_y =rs.DivideCurve(sf1_cr_y,5)
#卷杀
CrossCurves_sf1 = []
for i in range(len(div_cr_z)):
    divide_y = div_cr_y[i]
    divide_z = div_cr_z[i]
    CrossCurve_sf1 = rs.AddLine(divide_y,divide_z)
    CrossCurves_sf1.append(CrossCurve_sf1)
CrossCurves_sf1 = CrossCurves_sf1[1:len(CrossCurves_sf1)-1]
#选择交点
CrossCurves_points_sf1 = []
for i in range(len(CrossCurves_sf1)):
    CrossCurves_point_sf1 = rs.CurveCurveIntersection(CrossCurves_sf1[i],CrossCurves_sf1[i-1])[0][1]
    CrossCurves_points_sf1.append(CrossCurves_point_sf1)
CrossCurves_points_sf1 = CrossCurves_points_sf1[1:len(CrossCurves_points_sf1)]
CrossCurves_points_sf1.insert(0,rs.CurveStartPoint(sf1_cr_y))
CrossCurves_points_sf1.insert(len(CrossCurves_points_sf1)+1,rs.CurveEndPoint(sf1_cr_z))
sf1_pt_z2 = rs.CopyObject(sf1_pt_z1)
rs.MoveObject(sf1_pt_z2,(0,0, 6 * x))
sf1_pt_z3 = rs.CopyObject(sf1_pt_z2)
rs.MoveObject(sf1_pt_z3,(0,-10 * x,0))
sf1_pt_y_1 = rs.CopyObject(ZhuTou_point)
rs.MoveObject(sf1_pt_y_1,(0,0,5 * x))
sf1_pt_y_2 = rs.CopyObject(sf1_pt_y_1)
rs.MoveObject(sf1_pt_y_2,(0,4 * x,0))
sf1_pt_y_3 = rs.CopyObject(sf1_pt_y_2)
rs.MoveObject(sf1_pt_y_3,(0,0,10 * x))
CrossCurves_points_sf1.append(sf1_pt_z2)
CrossCurves_points_sf1.append(sf1_pt_z3)
CrossCurves_points_sf1_right = rs.MirrorObjects(CrossCurves_points_sf1,ZhuTou_point,rs.MoveObject(rs.CopyObject(ZhuTou_point),(x,0,x)),copy=True)
rs.MoveObjects(CrossCurves_points_sf1_right,(0,(NiDaoGong_CaiFen_left - NiDaoGong_CaiFen_right) * x,0))
sf1_mid_pt1 = rs.CopyObject(ZhuTou_point)
sf1_mid_pt1 = rs.MoveObject(sf1_mid_pt1,(0,-4 * x,15 * x))
sf1_mid_pt4 = rs.CopyObject(ZhuTou_point)
sf1_mid_pt4 = rs.MoveObject(sf1_mid_pt4,(0,4 * x,15 * x))
sf1_mid_pt2 = rs.CopyObject(sf1_mid_pt1)
rs.MoveObject(sf1_mid_pt2,(0,0,-10 * x))
sf1_mid_pt3 = rs.CopyObject(sf1_mid_pt2)
rs.MoveObject(sf1_mid_pt3,(0,8 * x,0))
CrossCurves_points_sf1.insert(0,CrossCurves_points_sf1_right[0])
CrossCurves_points_sf1.insert(0,CrossCurves_points_sf1_right[1])
CrossCurves_points_sf1.insert(0,CrossCurves_points_sf1_right[2])
CrossCurves_points_sf1.insert(0,CrossCurves_points_sf1_right[3])
CrossCurves_points_sf1.insert(0,CrossCurves_points_sf1_right[4])
CrossCurves_points_sf1.insert(0,CrossCurves_points_sf1_right[5])
CrossCurves_points_sf1.insert(0,CrossCurves_points_sf1_right[6])
CrossCurves_points_sf1.insert(0,sf1_mid_pt1)
CrossCurves_points_sf1.insert(0,sf1_mid_pt2)
CrossCurves_points_sf1.insert(0,sf1_mid_pt3)
CrossCurves_points_sf1.insert(0,sf1_mid_pt4)
sf1_curve_left1 = rs.AddPolyline(CrossCurves_points_sf1)
sf1_curve_left1 = rs.JoinCurves([sf1_curve_left1,rs.AddLine(rs.CurveEndPoint(sf1_curve_left1),rs.CurveStartPoint(sf1_curve_left1))])
rs.MoveObject(sf1_curve_left1,(5 *x,0,0))




sf1_sr_left1 = rs.AddPlanarSrf(sf1_curve_left1)


sf1_brep = rs.ExtrudeSurface(sf1_sr_left1,rs.AddLine(rs.AddPoint(0,0,0),rs.AddPoint(-10 * x,0,0)))

# 拱眼
sf1_gyy_pt1 = rs.CopyObject(sf1_pt_z3)
rs.MoveObject(sf1_gyy_pt1,(-5 * x,0,x))
sf1_gyy_pt2 = rs.CopyObject(sf1_gyy_pt1)
rs.MoveObject(sf1_gyy_pt2,(0,0,-2 * x))
sf1_gyy_pt4 = rs.CopyObject(sf1_mid_pt4)
rs.MoveObject(sf1_gyy_pt4,(-5 * x, 1.625 * x,x))
sf1_gyy_pt3 = rs.CopyObject(sf1_gyy_pt4)
rs.MoveObject(sf1_gyy_pt3,(0,0,-2 * x))
sf1_gyy_cr1 = rs.AddLine(sf1_gyy_pt1,sf1_gyy_pt2)
sf1_gyy_cr2 = rs.AddLine(sf1_gyy_pt2,sf1_gyy_pt3)
sf1_gyy_cr3 = rs.AddLine(sf1_gyy_pt3,sf1_gyy_pt4)
sf1_gyy_cr1 = rs.AddFilletCurve(sf1_gyy_cr1,sf1_gyy_cr2,x)
sf1_gyy_cr2 = rs.AddFilletCurve(sf1_gyy_cr3,sf1_gyy_cr2,x)
sf1_gyy_cr3 = rs.AddLine(rs.CurveEndPoint(sf1_gyy_cr1),rs.CurveEndPoint(sf1_gyy_cr2))
sf1_gyy_cr4 = rs.AddLine(rs.CurveStartPoint(sf1_gyy_cr1),rs.MoveObject(rs.CopyObject(sf1_gyy_pt1),(0,0,x)))
sf1_gyy_cr5 = rs.AddLine(rs.CurveStartPoint(sf1_gyy_cr2),rs.MoveObject(rs.CopyObject(sf1_gyy_pt4),(0,0,x)))
sf1_gyy_1 =rs.JoinCurves([sf1_gyy_cr1,sf1_gyy_cr2,sf1_gyy_cr3,sf1_gyy_cr4,sf1_gyy_cr5])
sf1_gyy_1 =rs.JoinCurves([sf1_gyy_1,rs.AddLine(rs.CurveStartPoint(sf1_gyy_1),rs.CurveEndPoint(sf1_gyy_1))])
rs.MoveObject(sf1_gyy_1,(-x,0,0)) 
sf1_gyy_1 = rs.AddPlanarSrf(sf1_gyy_1)
sf1_gyy_1 = rs.ExtrudeSurface(sf1_gyy_1,rs.AddLine(ZhuTou_point,rs.MoveObject(rs.CopyObject(ZhuTou_point),(2 * x,0,0))))
sf1_gyy_2 = rs.MirrorObject(sf1_gyy_1,ZhuTou_point,rs.MoveObject(rs.CopyObject(ZhuTou_point),(0,x,0)),copy=True)
sf1_gyy_3 = rs.MirrorObject(sf1_gyy_1,ZhuTou_point,rs.MoveObject(rs.CopyObject(ZhuTou_point),(x,0,0)),copy=True)
sf1_gyy_4 = rs.MirrorObject(sf1_gyy_2,ZhuTou_point,rs.MoveObject(rs.CopyObject(ZhuTou_point),(x,0,0)),copy=True)
sf1_brep = rs.BooleanDifference(sf1_brep,sf1_gyy_1)
sf1_brep = rs.BooleanDifference(sf1_brep,sf1_gyy_2)
sf1_brep = rs.BooleanDifference(sf1_brep,sf1_gyy_3)
sf1_brep = rs.BooleanDifference(sf1_brep,sf1_gyy_4)

#素枋的馒头榫生成
mts_sf1 = rs.ExplodePolysurfaces(sf1_brep)[15]
mts_sf1 = rs.CurveEndPoint(rs.DuplicateEdgeCurves(mts_sf1)[0])
rs.MoveObject(mts_sf1,(-3.75 * x,-3.75 * x,0))
mts1_sf1 = rs.AddLine(mts_sf1,rs.MoveObject(rs.CopyObject(mts_sf1),(-2.5 * x,0,0)))
mts1_sf1 = rs.ExtrudeCurve(mts1_sf1,rs.AddLine(rs.AddPoint(0,0,0),rs.AddPoint(0,-2.5 * x,0)))
mts1_sf1 = rs.ExtrudeSurface(mts1_sf1,rs.AddLine(rs.AddPoint(0,0,0),rs.AddPoint(0,0,2.5 * x)))
mts1_sf2 = rs.MirrorObject(mts1_sf1,ZhuTou_point,rs.MoveObject(rs.CopyObject(ZhuTou_point),(x,0,0)),copy=True)

sf1_brep = rs.BooleanDifference(mts1_sf1,sf1_brep,delete_input=False)

sf1_brep = rs.BooleanIntersection(sf1_brep,mts1_sf2,delete_input=True)


#素枋被泥道栱的插销剪切

sf_2_cx_sf1 = rs.ExplodePolysurfaces(sf1_brep)[14]
sf_2_cx_sf1 = rs.CurveEndPoint(rs.DuplicateEdgeCurves(sf_2_cx_sf1)[0])
rs.MoveObject(sf_2_cx_sf1,(-3.75 * x,-3.75 * x,0))
sf_2_cx1_sf1 = rs.AddLine(sf_2_cx_sf1,rs.MoveObject(rs.CopyObject(sf_2_cx_sf1),(-2.5 * x,0,0)))
sf_2_cx1_sf1 = rs.ExtrudeCurve(sf_2_cx1_sf1,rs.AddLine(rs.AddPoint(0,0,0),rs.AddPoint(0,-4 * x,0)))
sf_2_cx1_sf1 = rs.ExtrudeSurface(sf_2_cx1_sf1,rs.AddLine(rs.AddPoint(0,0,0),rs.AddPoint(0,0,4 * x)))
rs.MoveObject(sf_2_cx1_sf1,(0,-(NiDaoGong_CaiFen_left-8) * x,0))

sf_2_cx2_sf1 = rs.MirrorObject(sf_2_cx1_sf1,ZhuTou_point,rs.MoveObject(rs.CopyObject(ZhuTou_point),(x,0,0)),copy=True)

sf1_brep = rs.BooleanDifference(sf_2_cx1_sf1,sf1_brep,delete_input=False)
sf1_brep = rs.BooleanIntersection(sf_2_cx2_sf1,sf1_brep,delete_input=False)
sf1_brep_jinshen = rs.CopyObject(sf1_brep)

#素枋从中间剪切
sf_trimed = rs.AddLine(ZhuTou_point,rs.MoveObject(rs.CopyObject(ZhuTou_point),(0,145 * x,0)))
rs.MoveObject(sf_trimed,(-10 * x,0,0))
sf_trimed = rs.ExtrudeCurve(sf_trimed,rs.AddLine(rs.AddPoint(0,0,0),rs.AddPoint(20 * x,0,0)))
sf_trimed = rs.ExtrudeSurface(sf_trimed,rs.AddLine(rs.AddPoint(0,0,0),rs.AddPoint(0,0,20 * x)))

sf1_brep1 = rs.BooleanDifference(sf1_brep,sf_trimed,delete_input = False)
sf1_brep2 = rs.MirrorObject(sf1_brep1,ZhuTou_point,rs.MoveObject(rs.CopyObject(ZhuTou_point),(x,0,0)),copy=True)
#连接处螳螂榫做法
tls_1 = rs.ExplodePolysurfaces(sf1_brep1)[5]
tls_1 = rs.CurveEndPoint(rs.DuplicateEdgeCurves(tls_1)[1])
rs.MoveObject(tls_1,(3 * x,0,0))

tls_1 = rs.AddLine(tls_1,rs.MoveObject(rs.CopyObject(tls_1),(4 * x,0,0)))
tls_1 = rs.ExtrudeCurve(tls_1,rs.AddLine(rs.AddPoint(0,0,0),rs.AddPoint(0,4 * x,0)))
tls_1 = rs.ExtrudeSurface(tls_1,rs.AddLine(rs.AddPoint(0,0,0),rs.AddPoint(0,0,-5 * x)))
tls_2 = rs.ExplodePolysurfaces(tls_1)[3]
tls_2 = rs.ExtrudeSurface(tls_2,rs.AddLine(rs.AddPoint(0,0,0),rs.AddPoint(0,1 * x,0)))
rs.ScaleObject(tls_2,ZhuTou_point,[1,1,3],copy=False)
tls_3 = rs.ExplodePolysurfaces(tls_2)[5]
rs.ScaleObject(tls_3,ZhuTou_point,[1.4,1,1],copy=False)
tls_3_1 = rs.CopyObject(tls_3)
rs.ScaleObject(tls_3_1,ZhuTou_point,[0.6,1,1],copy=False)
rs.MoveObject(tls_3_1,(0,4 * x))
tls_3 = rs.AddLoftSrf([rs.JoinCurves(rs.DuplicateEdgeCurves(tls_3)),rs.JoinCurves(rs.DuplicateEdgeCurves(tls_3_1))])
rs.CapPlanarHoles(tls_3)
tls = rs.BooleanDifference(tls_2,tls_1,delete_input=True)
tls = rs.BooleanDifference(tls,tls_3,delete_input=True)

sf1_brep1 = rs.BooleanDifference(tls,sf1_brep1,delete_input=False)
sf1_brep2 = rs.BooleanIntersection(sf1_brep2,sf1_brep1,delete_input=False)

sf4_connect_brep1 = rs.CopyObject(sf1_brep1)

sf4_connect_brep2 = rs.CopyObject(sf1_brep2)

sf1_breps = [sf1_brep1[0],sf1_brep2[0]]

sf2_breps = rs.CopyObjects(sf1_breps)




rs.MoveObjects(SanDou,((HuaGong_CaiFen_left-5) * x,-7 * x + (NiDaoGong_CaiFen_left+22) * x ,15 * x))



SanDou2 = rs.MirrorObject(SanDou,ZhuTou_point,rs.MoveObject(rs.CopyObject(ZhuTou_point),(x,0,0)),copy=True)


rs.MoveObjects(sf1_breps ,(0,j * x + (MianKuo-((MianKuo+1)/2+1)) * 16 * 15 * x,252 * x +21 * x))

rs.MoveObjects([SanDou,SanDou2] ,(0,j * x + (MianKuo-((MianKuo+1)/2+1)) * 16 * 15 * x,252 * x +21 * x))


sf1_brep_right_1 = [sf1_breps[0]]
sf1_brep_right_2 = [sf1_breps[1]]

sq_rule = [0,0,0,0,0,0,0,0,0,0,0,0,0,0,0,0,0,0,0,0,2.5,6]
for i in range(int((MianKuo - 3)/2)+1):
    if i + 1 < len(range(int((MianKuo - 3)/2)+1)):
        sf1_brep1 = rs.MoveObject(rs.CopyObject(sf1_breps[0]),(0,-(MianKuo_length * (i+1)) * x,sq_rule[-(int((MianKuo - 3)/2-i))] * x))
        sf1_brep2 = rs.MoveObject(rs.CopyObject(sf1_breps[1]),(0,-(MianKuo_length * (i+1)) * x,sq_rule[-(int((MianKuo - 3)/2-i))] * x))
        sf1_brep_right_1.append(sf1_brep1)
        sf1_brep_right_2.append(sf1_brep2)
    
sf1_brep_left_1 = rs.MirrorObjects(sf1_brep_right_2,rs.MoveObject(rs.CopyObject(ZhuTou_point),(0,(MianKuo_length * (MianKuo - 2) * x + 2 * j * x)/2 ,0)),rs.MoveObject(rs.CopyObject(ZhuTou_point),(x,(MianKuo_length * (MianKuo - 2) * x + 2 * j * x)/2 ,0)),copy=True)
sf1_brep_left_1 = sf1_brep_left_1[::-1]

#
sf1_brep_left_2 = rs.MirrorObjects(sf1_brep_right_1,rs.MoveObject(rs.CopyObject(ZhuTou_point),(0,(MianKuo_length * (MianKuo - 2) * x + 2 * j * x)/2 ,0)),rs.MoveObject(rs.CopyObject(ZhuTou_point),(x,(MianKuo_length * (MianKuo - 2) * x + 2 * j * x)/2 ,0)),copy=True)
sf1_brep_left_2 = sf1_brep_left_2[::-1]


sufang_breps_1 = sf1_brep_left_1 + sf1_brep_right_1
sufang_breps_2 = sf1_brep_left_2 + sf1_brep_right_2

sufang_breps_1_1 = sufang_breps_1[0:len(sufang_breps_1)-1]

sufang_breps_2_1 = sufang_breps_2[1:len(sufang_breps_2)]


#
le_brep_trimed_g =le_brep_trimed_g[::-1]
le_brep_trimed_g_1 = le_brep_trimed_g[1:len(le_brep_trimed_g)-1]

#连接素枋和上边的泥道栱

sufang_breps_x = []
sufang_breps = []
for i in range(len(le_brep_trimed_g_1)):
    if i < ((len(le_brep_trimed_g_1)+1)/2):
        sufang_brep = rs.BooleanUnion([le_brep_trimed_g_1[i],sufang_breps_1_1[i]],delete_input=False)[0]
    else:
        sufang_brep = rs.BooleanDifference(sufang_breps_1_1[i],le_brep_trimed_g_1[i],delete_input=False)[0]
    
    sufang_breps_x.append(sufang_brep)

for i in range(len(le_brep_trimed_g_1)):
    if i < ((len(le_brep_trimed_g_1)+1)/2-1):
        sufang_brep = rs.BooleanDifference(sufang_breps_2_1[i],sufang_breps_x[i],delete_input=False)[0]
    
    elif i == ((len(le_brep_trimed_g_1)+1)/2-1):
        sufang_brep = rs.BooleanUnion([sufang_breps_x[i],sufang_breps_2_1[i]],delete_input=False)[0]

    else:
        sufang_brep = rs.BooleanDifference(sufang_breps_x[i],sufang_breps_2_1[i],delete_input=False)[0]
    sufang_breps.append(sufang_brep)

sufang_brep_first = rs.BooleanDifference(sufang_breps_2[0],le_brep_trimed_g[0],delete_input = False)
sufang_brep_last = rs.BooleanDifference(sufang_breps_1[-1],le_brep_trimed_g[-1],delete_input = False)

sufang_breps.append(sufang_brep_last[0])
sufang_breps.insert(0,sufang_brep_first[0])








sufang_breps_houyan = rs.MirrorObjects(sufang_breps,rs.MoveObject(rs.CopyObject(ZhuTou_point),(4 * j/2 * x,0,0)),rs.MoveObject(rs.CopyObject(ZhuTou_point),(4 * j/2 * x,x,0)),copy=True)

#将素枋和补间辅作第一层泥道栱连接起来

sufang_breps_3 = []
for i in range(len(sufang_breps)):
    if i == (len(sufang_breps)+1)/2-1:
        sufang_brep_3 = rs.BooleanUnion([ndg_bj_breps[i],sufang_breps[i]],delete_input=False)[0]
    else:
        sufang_brep_3 = rs.BooleanDifference(sufang_breps[i],ndg_bj_breps[i],delete_input=False)[0]

    sufang_breps_3.append(sufang_brep_3)

sufang_breps = sufang_breps_3

#补间铺作第一跳华拱

#转角铺作泥道拱生成

#原点
BasePoint = 0
pt_o = rs.AddPoint(BasePoint * 500,0,0)
#卷杀结束y点
pt_1 = rs.AddPoint(BasePoint * 500,0,9 * x)
#卷杀结束x点
pt_2 = rs.AddPoint(BasePoint * 500 + 16 * x, 0 ,0)
#生成要进行拆分的曲线
curve_x = rs.AddLine(pt_2,pt_o)
curve_y = rs.AddLine(pt_o,pt_1)
#拆分曲线生成点
divide_curve_x_points = rs.DivideCurve(curve_x,5)
divide_curve_y_points = rs.DivideCurve(curve_y,5)
#卷杀
CrossCurves = []
for i in range(len(divide_curve_x_points)):
    divide_x = divide_curve_x_points[i]
    divide_y = divide_curve_y_points[i]
    CrossCurve = rs.AddLine(divide_x,divide_y)
    CrossCurves.append(CrossCurve)
CrossCurves = CrossCurves[1:len(CrossCurves)-1]
#选择交点
CrossCurves_points = []
for i in range(len(CrossCurves)):
    CrossCurves_point = rs.CurveCurveIntersection(CrossCurves[i],CrossCurves[i-1])[0][1]
    CrossCurves_points.append(CrossCurves_point)
CrossCurves_points = CrossCurves_points[1:len(CrossCurves_points)]
CrossCurves_points.insert(0,rs.CurveStartPoint(curve_x))
CrossCurves_points.insert(len(CrossCurves_points)+1,rs.CurveEndPoint(curve_y))
#卷杀线
JuanSha_curve = rs.AddPolyline(CrossCurves_points)
pt_3z = rs.CopyObject(pt_1)
rs.MoveObject(pt_3z,(0,0,6 * x))
pt_4z = rs.CopyObject(pt_3z)
rs.MoveObject(pt_4z,(12 * x,0,0))
pt_3x = rs.CopyObject(pt_2)
if HuaGong_CaiFen_left > 25:
    rs.MoveObject(pt_3x,((HuaGong_CaiFen_left - 16 /2 - 16) * x ,0,0))
pt_4x = rs.CopyObject(pt_3x)
#中间材，材广为16.5分
zjc_pt1 = rs.CopyObject(pt_3x)
zjc_pt1 = rs.MoveObject(zjc_pt1,(16 * x,0,0))
zjc_curve = rs.AddLine(pt_3x,zjc_pt1)
#右边斗拱的线
pt_3x_right = rs.CopyObject(zjc_pt1)
pt_2x_right = rs.CopyObject(zjc_pt1)
if HuaGong_CaiFen_right > 25:
    rs.MoveObject(pt_2x_right,((HuaGong_CaiFen_right - 16 - 16/2) * x,0,0))
else: rs.MoveObject(pt_2x_right,(0,0,0))
#卷杀结束x点
pt_1_right = rs.CopyObject(pt_2x_right)
rs.MoveObject(pt_1_right,(16 * x,0,0))
pt_2_right = rs.CopyObject(pt_1_right)
rs.MoveObject(pt_2_right,(0,0,9 * x))
curve_x_right = rs.AddLine(pt_2x_right,pt_1_right)
curve_y_right = rs.AddLine(pt_1_right,pt_2_right)
#拆分曲线生成点
divide_curve_x_points_right = rs.DivideCurve(curve_x_right,5)
divide_curve_y_points_right = rs.DivideCurve(curve_y_right,5)
#卷杀
CrossCurves_right = []
for i in range(len(divide_curve_x_points_right)):
    divide_x = divide_curve_x_points_right[i]
    divide_y = divide_curve_y_points_right[i]
    CrossCurve_right = rs.AddLine(divide_x,divide_y)
    CrossCurves_right.append(CrossCurve_right)
del CrossCurves_right[-1]
del CrossCurves_right[0]
CrossCurves_points_right = []
for i in range(len(CrossCurves_right)):
    CrossCurves_point_right = rs.CurveCurveIntersection(CrossCurves_right[i],CrossCurves_right[i-1])[0][1]
    CrossCurves_points_right.append(CrossCurves_point_right)
CrossCurves_points_right = CrossCurves_points_right[1:len(CrossCurves_points_right)]
pt_3x_right = rs.CopyObject(CrossCurves_points_right[0])
pt_4x_right = rs.CopyObject(CrossCurves_points_right[1])
pt_5x_right = rs.CopyObject(CrossCurves_points_right[2])
pt_3z_right = rs.CopyObject(pt_2_right)
rs.MoveObject(pt_3z_right,(0,0,6 * x))
pt_4z_right = rs.CopyObject(pt_3z_right)
rs.MoveObject(pt_4z_right,(-12 * x,0,0))
#华拱下弧线
CrossCurves_points.append(pt_3z)
CrossCurves_points.append(pt_4z)
CrossCurves_points.insert(0,pt_3x)
CrossCurves_points.insert(0,pt_4x)
CrossCurves_points.insert(0,pt_2x_right)
CrossCurves_points.insert(0,pt_3x_right)
CrossCurves_points.insert(0,pt_4x_right)
CrossCurves_points.insert(0,pt_5x_right)
CrossCurves_points.insert(0,pt_2_right)
CrossCurves_points.insert(0,pt_3z_right)
CrossCurves_points.insert(0,pt_4z_right)
JuanSha_curve = rs.AddPolyline(CrossCurves_points)
#欹幽
#左
qa_left_2 = rs.CopyObject(pt_4z)
rs.MoveObject(qa_left_2,(2 * x,0,4 * x))
qa_curve_left_1 = rs.AddLine(pt_4z,qa_left_2)

qa_left_3 = rs.CurveMidPoint(qa_curve_left_1)
direction_left = (-x, 0, 2 * x)  # 任意方向向量 
distance = 0.5 * x # 移动距离 
# 单位化方向向量并计算实际位移 
unit_vector_left = rs.VectorUnitize(direction_left)
displacement_left = rs.VectorScale(unit_vector_left, distance)
rs.MoveObject(qa_left_3, displacement_left)
qa_curve_left_1 = rs.AddCurve([pt_4z,qa_left_3,qa_left_2])
#欹幽
#右
qa_right_2 = rs.CopyObject(pt_4z_right)
rs.MoveObject(qa_right_2,(-2 * x,0,4 * x))
qa_curve_right_1 = rs.AddLine(pt_4z_right,qa_right_2)

qa_right_3 = rs.CurveMidPoint(qa_curve_right_1)
direction_right = (x, 0, 2 * x)  # 任意方向向量 
distance = 0.5 * x # 移动距离 
# 单位化方向向量并计算实际位移 
unit_vector_right = rs.VectorUnitize(direction_right)
displacement_right = rs.VectorScale(unit_vector_right, distance)
rs.MoveObject(qa_right_3, displacement_right)
qa_curve_right_1 = rs.AddCurve([pt_4z_right,qa_right_3,qa_right_2])
#拱眼上部
gy_left_up_1 = rs.CopyObject(qa_left_2)
rs.MoveObject(gy_left_up_1,(0,0,2 * x))
gy_right_up_1 = rs.CopyObject(qa_right_2)
rs.MoveObject(gy_right_up_1,(0,0,2 * x))
gy_up_curve = rs.AddPolyline([qa_left_2,gy_left_up_1,gy_right_up_1,qa_right_2])
#华拱未剪切前
HuaGong_untrimed = rs.JoinCurves([JuanSha_curve,qa_curve_left_1,qa_curve_right_1,gy_up_curve ])
HuaGong_untrimed = rs.AddPlanarSrf(HuaGong_untrimed)
extrude_curve1 = rs.AddLine(pt_o,rs.MoveObject(rs.CopyObject(pt_o),(0,10 * x,0)))
HuaGong_untrimed = rs.ExtrudeSurface(HuaGong_untrimed,extrude_curve1)
#剪切斗拱下部
#斗拱下部 广16分,厚为5分
HuaGong_dowm_curve = rs.AddLine(pt_3x,zjc_pt1)
HuaGong_dowm_curve2 =rs.CopyObject(HuaGong_dowm_curve)
rs.MoveObject(HuaGong_dowm_curve2,(0,0,5 * x))
HuaGong_dowm = rs.AddLoftSrf([HuaGong_dowm_curve,HuaGong_dowm_curve2])
HuaGong_dowm = rs.ExtrudeSurface(HuaGong_dowm,extrude_curve1)
rs.ScaleObject(HuaGong_dowm,ZhuTou_point,[10/16,1,1],copy=False)
HuaGong = rs.BooleanDifference(HuaGong_dowm,HuaGong_untrimed,delete_input = False)
#剪切斗拱中部
#斗拱下部 广10分,厚为10.125分
HuaGong_mid_curve_pt1 = rs.CopyObject(rs.CurveStartPoint(HuaGong_dowm_curve2))
rs.MoveObject(HuaGong_mid_curve_pt1,(3 * x,0,0))
HuaGong_mid_curve_pt2 = rs.CopyObject(HuaGong_mid_curve_pt1)
rs.MoveObject(HuaGong_mid_curve_pt2,(10 * x,0,0))
HuaGong_mid_curve1 = rs.AddLine(HuaGong_mid_curve_pt1,HuaGong_mid_curve_pt2)
HuaGong_mid_curve2 =rs.CopyObject(HuaGong_mid_curve1)
rs.MoveObject(HuaGong_mid_curve2,(0,0,10* x))
HuaGong_mid = rs.AddLoftSrf([HuaGong_mid_curve1,HuaGong_mid_curve2])
rs.MoveObject(HuaGong_mid,(0,1 * x,0))
extrude_curve2 = rs.AddLine(HuaGong_mid_curve_pt1,rs.MoveObject(rs.CopyObject(HuaGong_mid_curve_pt1),(0,-1 *x,0)))
HuaGong_mid = rs.ExtrudeSurface(HuaGong_mid,extrude_curve2)
HuaGong_mid2 =rs.CopyObject(HuaGong_mid)
rs.MoveObject(HuaGong_mid2,(0,9 * x,0))
HuaGong_mid = [HuaGong_mid,HuaGong_mid2]
HuaGong = rs.BooleanDifference(HuaGong,HuaGong_mid,delete_input = False)
#剪切拱眼
#左
gy_left_pt_1 = rs.CopyObject(rs.CurveStartPoint(HuaGong_mid_curve2))
rs.MoveObject(gy_left_pt_1,(-1.75/2 * x,0,0))
gy_right_pt_1 = rs.CopyObject(rs.CurveEndPoint(HuaGong_mid_curve2))
rs.MoveObject(gy_right_pt_1,(1.75/2 * x,0,0))


qa_left_2_2 = rs.CopyObject(gy_left_pt_1)
rs.MoveObject(qa_left_2_2,(-2 * x,0,4 * x))
qa_curve_left_1_2 = rs.AddLine(gy_left_pt_1,qa_left_2_2)

qa_left_3_2 = rs.CurveMidPoint(qa_curve_left_1_2)
direction_left_2 = (x, 0, 2 * x)  # 任意方向向量 
distance = 0.5 * x # 移动距离 
# 单位化方向向量并计算实际位移 
unit_vector_left_2 = rs.VectorUnitize(direction_left_2)
displacement_left_2 = rs.VectorScale(unit_vector_left_2, distance)
rs.MoveObject(qa_left_3_2, displacement_left_2)
qa_curve_left_1_2 = rs.AddCurve([gy_left_pt_1,qa_left_3_2,qa_left_2_2])


qa_right_2_2 = rs.CopyObject(gy_right_pt_1)
rs.MoveObject(qa_right_2_2,(2 * x,0,4 * x))
qa_curve_right_1_2 = rs.AddLine(gy_right_pt_1,qa_right_2_2)
qa_right_3_2 = rs.CurveMidPoint(qa_curve_right_1_2)
direction_right_2 = (-x, 0, 2 * x)  # 任意方向向量 
distance = 0.5 * x # 移动距离 
# 单位化方向向量并计算实际位移 
unit_vector_right_2 = rs.VectorUnitize(direction_right_2)
displacement_right_2 = rs.VectorScale(unit_vector_right_2, distance)
rs.MoveObject(qa_right_3_2, displacement_right_2)
qa_curve_right_1_2 = rs.AddCurve([gy_right_pt_1,qa_right_3_2,qa_right_2_2])

#拱眼出头
gy_up_1 = rs.CopyObject(qa_left_2_2)
rs.MoveObject(gy_up_1,(0,0,2 * x))
gy_up_2 = rs.CopyObject(qa_right_2_2)
rs.MoveObject(gy_up_2,(0,0,2 * x))
gy_curve_1_left = rs.AddLine(qa_left_2_2,gy_up_1)
gy_curve_1_right = rs.AddLine(qa_right_2_2,gy_up_2)

#拱眼隐去部深1分
#左
gy_y_l1 = rs.CopyObject(pt_4z)
rs.MoveObject(gy_y_l1,(0,0,-x))
gy_y_l2 = rs.CopyObject(gy_left_pt_1)
rs.MoveObject(gy_y_l2,(0,0,-x))
gy_y_curve = rs.AddPolyline([pt_4z,gy_y_l1,gy_y_l2,gy_left_pt_1])
gy_y_curve_1 = rs.AddFilletCurve(rs.AddLine(pt_4z,gy_y_l1),rs.AddLine(gy_y_l1,gy_y_l2),radius = x)
gy_y_curve_2 = rs.AddFilletCurve(rs.AddLine(gy_left_pt_1,gy_y_l2),rs.AddLine(gy_y_l2,gy_y_l1),radius = x)
gy_y_curve = rs.JoinCurves([gy_y_curve_1,rs.AddLine(rs.CurveEndPoint(gy_y_curve_1),rs.CurveEndPoint(gy_y_curve_2)),gy_y_curve_2])
#右
gy_y_r1 = rs.CopyObject(pt_4z_right)
rs.MoveObject(gy_y_r1,(0,0,-x))
gy_y_r2 = rs.CopyObject(gy_right_pt_1)
rs.MoveObject(gy_y_r2,(0,0,-x))
gy_y_curve_right = rs.AddPolyline([pt_4z_right,gy_y_r1,gy_y_l2,gy_right_pt_1])
gy_y_curve_1_right = rs.AddFilletCurve(rs.AddLine(pt_4z_right,gy_y_r1),rs.AddLine(gy_y_r1,gy_y_r2),radius = x)
gy_y_curve_2_right = rs.AddFilletCurve(rs.AddLine(gy_right_pt_1,gy_y_r2),rs.AddLine(gy_y_r2,gy_y_r1),radius = x)
gy_y_curve_right = rs.JoinCurves([gy_y_curve_1_right,rs.AddLine(rs.CurveEndPoint(gy_y_curve_1_right),rs.CurveEndPoint(gy_y_curve_2_right)),gy_y_curve_2_right])
#拱眼出头左
gy_ct_curve_left = rs.AddPolyline([qa_left_2,gy_left_up_1,gy_up_1,qa_left_2_2])
#拱眼出头右
gy_ct_curve_right = rs.AddPolyline([qa_right_2,gy_right_up_1,gy_up_2,qa_right_2_2])

gy_0 = rs.AddLine(qa_left_2,gy_left_up_1)
gy_1 = rs.JoinCurves([qa_curve_left_1,gy_0 ])
gy_2 = rs.CopyObject(gy_1)
rs.MoveObject(gy_2,(-x,0,0))
gy_3 = rs.AddLine(rs.CurveEndPoint(gy_1),rs.CurveEndPoint(gy_2))
gy_4 = rs.AddLine(rs.CurveStartPoint(gy_1),rs.CurveStartPoint(gy_2))
gy_5 = rs.AddPolyline([gy_left_up_1,gy_up_1,qa_left_2_2])
gy_0_r = rs.AddLine(qa_right_2,gy_right_up_1)
gy_1_r = rs.JoinCurves([qa_curve_right_1,gy_0_r ])
gy_2_r = rs.CopyObject(gy_1_r)
rs.MoveObject(gy_2_r,(x,0,0))
gy_3_r = rs.AddLine(rs.CurveEndPoint(gy_1_r),rs.CurveEndPoint(gy_2_r))
gy_4_r = rs.AddLine(rs.CurveStartPoint(gy_1_r),rs.CurveStartPoint(gy_2_r))
gy_5_r = rs.AddPolyline([gy_right_up_1,gy_up_2,qa_right_2_2])

gy_curve_left = rs.JoinCurves([gy_5,qa_curve_left_1_2,gy_y_curve,gy_2,gy_3,gy_4])
gy_curve_right = rs.JoinCurves([gy_5_r,qa_curve_right_1_2,gy_y_curve_right,gy_2_r,gy_3_r,gy_4_r])
gy_surface_left = rs.AddPlanarSrf(gy_curve_left)
gy_surface_right = rs.AddPlanarSrf(gy_curve_right)
extrude_curve3 = rs.AddLine(pt_o,rs.MoveObject(rs.CopyObject(pt_o),(0,x,0)))
gy_brep_left = rs.ExtrudeSurface(gy_surface_left,extrude_curve3)
gy_brep_right = rs.ExtrudeSurface(gy_surface_right,extrude_curve3)
gy_brep1 = gy_brep_left
gy_brep2 = gy_brep_right
gy_brep3 = rs.CopyObject(gy_brep1)
rs.MoveObjects(gy_brep3,(0,9 * x,0))
gy_brep4 = rs.CopyObject(gy_brep2)
rs.MoveObjects(gy_brep4,(0,9 * x,0))
HuaGong = rs.BooleanDifference(HuaGong,gy_brep2,delete_input = True)
HuaGong = rs.BooleanDifference(HuaGong,gy_brep4,delete_input = True)
HuaGong = rs.BooleanIntersection(gy_brep1,HuaGong,delete_input=True)
HuaGong = rs.BooleanIntersection(gy_brep3,HuaGong,delete_input=True)

#华拱上的馒头榫

mts_hg = rs.ExplodePolysurfaces(HuaGong)[56]
mts_hg = rs.CurveEndPoint(rs.DuplicateEdgeCurves(mts_hg)[2])
rs.MoveObject(mts_hg,(4.75 * x,3.75 * x,0))
mts_hg = rs.AddLine(mts_hg,rs.MoveObject(rs.CopyObject(mts_hg),(0,2.5 * x,0)))
mts_hg = rs.ExtrudeCurve(mts_hg,rs.AddLine(rs.AddPoint(0,0,0),rs.AddPoint(2.5 * x,0,0)))
mts_hg = rs.ExtrudeSurface(mts_hg,rs.AddLine(rs.AddPoint(0,0,0),rs.AddPoint(0,0,2.5 * x)))

mts_hg_1 = rs.MirrorObject(mts_hg,ZhuTou_point,rs.MoveObject(rs.CopyObject(ZhuTou_point),(0,x,0)),copy=True)


HuaGong = rs.BooleanUnion([mts_hg,HuaGong,mts_hg_1],delete_input=False)

HuaGong1_pj = rs.MoveObject(rs.CopyObject(HuaGong),(0,j * x + (MianKuo-((MianKuo+1)/2+1)) * 16 * 15 * x + (MianKuo_length * x)/2,252 * x +21 * x))

HuaGong2_pj = rs.MoveObject(rs.CopyObject(HuaGong1_pj),(0,0,21 * x))


HuaGong1_pj_g = [HuaGong1_pj]

sq_rule = [0,0,0,0,0,0,0,0,0,0,0,0,0,0,0,0,0,0,0,0,1.25,4.25]
for i in range(int((MianKuo - 3)/2)+1):
    if i + 1 < len(range(int((MianKuo - 3)/2)+1)):
        hg_bj_brep1 = rs.MoveObject(rs.CopyObject(HuaGong1_pj),(0,-(MianKuo_length * (i+1)) * x,sq_rule[-(int((MianKuo - 3)/2-i))] * x))
        HuaGong1_pj_g.append(hg_bj_brep1)

HuaGong1_pj_g_left  = rs.MirrorObjects(HuaGong1_pj_g[1 : len(HuaGong1_pj_g)],rs.MoveObject(rs.CopyObject(ZhuTou_point),(0,(MianKuo_length * (MianKuo - 2) * x + 2 * j * x)/2 ,0)),rs.MoveObject(rs.CopyObject(ZhuTou_point),(x,(MianKuo_length * (MianKuo - 2) * x + 2 * j * x)/2 ,0)),copy=True)

HuaGong1_pj_g_left = HuaGong1_pj_g_left[::-1]

HuaGong1_pj_g = HuaGong1_pj_g_left + HuaGong1_pj_g

HuaGong1_pj_g_last = rs.MoveObject(rs.CopyObject(HuaGong1_pj_g[-1]),(0,-(MianKuo_length * x/2) - j * x/2,5.75 * x))
HuaGong1_pj_g_first = rs.MirrorObject(HuaGong1_pj_g_last,rs.MoveObject(rs.CopyObject(ZhuTou_point),(0,(MianKuo_length * (MianKuo - 2) * x + 2 * j * x)/2 ,0)),rs.MoveObject(rs.CopyObject(ZhuTou_point),(x,(MianKuo_length * (MianKuo - 2) * x + 2 * j * x)/2 ,0)),copy=True)

HuaGong1_pj_g.insert(0,HuaGong1_pj_g_first)
HuaGong1_pj_g.append(HuaGong1_pj_g_last)


#第一层素枋被第一跳华拱剪切
sufang_breps_4 = []
for i in range(len(sufang_breps)):
    if i == (len(sufang_breps)+1)/2-1:
        sufang_brep = rs.BooleanDifference(sufang_breps[i],HuaGong1_pj_g[i],delete_input=False)[0]
    else:
        sufang_brep = rs.BooleanUnion([sufang_breps[i],HuaGong1_pj_g[i]],delete_input=False)[0]
    sufang_breps_4.append(sufang_brep)

sufang_breps = sufang_breps_4
#
sufang_breps_houyan = rs.MirrorObjects(sufang_breps,rs.MoveObject(rs.CopyObject(ZhuTou_point),(4 * j/2 * x,0,0)),rs.MoveObject(rs.CopyObject(ZhuTou_point),(4 * j/2 * x,x,0)),copy=True)

sufang_breps = sufang_breps + sufang_breps_houyan

HuaGong1_pj_g_houyan = rs.MirrorObjects(HuaGong1_pj_g,rs.MoveObject(rs.CopyObject(ZhuTou_point),(4 * j/2 * x,0,0)),rs.MoveObject(rs.CopyObject(ZhuTou_point),(4 * j/2 * x,x,0)),copy=True)

HuaGong1_pj_g = HuaGong1_pj_g + HuaGong1_pj_g_houyan

#散斗
SanDou_g = []
sq_rule = [0,0,0,0,0,0,0,0,0,0,0,0,0,0,0,0,0,0,0,0,2.5,6]
for i in range(int((MianKuo - 3)/2)+1):
    if i + 1 < len(range(int((MianKuo - 3)/2)+1)):
        SanDou_1 = rs.MoveObject(rs.CopyObject(SanDou),(0,-(MianKuo_length * (i+1)) * x,sq_rule[-(int((MianKuo - 3)/2-i))] * x))
        SanDou_2 = rs.MoveObject(rs.CopyObject(SanDou2),(0,-(MianKuo_length * (i+1)) * x,sq_rule[-(int((MianKuo - 3)/2-i))] * x))
        SanDou_g.append(SanDou_1)
        SanDou_g.append(SanDou_2)

SanDou_neiyan = rs.MoveObject(rs.CopyObject(SanDou),(j * x,0,0))
SanDou2_neiyan = rs.MoveObject(rs.CopyObject(SanDou2),(j * x,0,0))

SanDou_g.insert(0,SanDou2)
SanDou_g.insert(0,SanDou[0])

SanDou_g_left = rs.MirrorObjects(SanDou_g,rs.MoveObject(rs.CopyObject(ZhuTou_point),(0,(MianKuo_length * (MianKuo - 2) * x + 2 * j * x)/2 ,0)),rs.MoveObject(rs.CopyObject(ZhuTou_point),(x,(MianKuo_length * (MianKuo - 2) * x + 2 * j * x)/2 ,0)),copy=True)
SanDou_g_left = SanDou_g_left[::-1]
SanDou_g = SanDou_g_left + SanDou_g



#第二层素枋上泥道栱上的散斗

SanDou_g_2 = rs.MoveObjects(rs.CopyObjects(SanDou_g),(0,0,21 * x))
for i in range(int(len(SanDou_g_2)/2)):
    rs.MoveObject(SanDou_g_2[(i+1) * 2 - 2],(0,-21 * x,0))
    rs.MoveObject(SanDou_g_2[(i+1) * 2 - 1],(0,21 * x,0))




SanDou_g_late = rs.MirrorObjects(SanDou_g,rs.MoveObject(rs.CopyObject(ZhuTou_point),(4 * j/2 * x,0,0)),rs.MoveObject(rs.CopyObject(ZhuTou_point),(4 * j/2 * x,x,0)),copy=True)

SanDou_g = SanDou_g +SanDou_g_late


#


SanDou_g_2_late = rs.MirrorObjects(SanDou_g_2,rs.MoveObject(rs.CopyObject(ZhuTou_point),(4 * j/2 * x,0,0)),rs.MoveObject(rs.CopyObject(ZhuTou_point),(4 * j/2 * x,x,0)),copy=True)

SanDou_g_2 = SanDou_g_2 +SanDou_g_2_late


#第三层素枋泥道栱上的散斗
SanDou_g_3 = rs.MoveObjects(rs.CopyObjects(SanDou_g),(0,0,42 * x))

#第二层素枋泥道栱生成

sf2_brep_left = sf2_breps[1]
sf2_brep_right = sf2_breps[0]

sf2_trimed_brep = rs.ExplodePolysurfaces(sf2_brep_left)[4]
sf2_trimed_brep = rs.CurveEndPoint(rs.DuplicateEdgeCurves(sf2_trimed_brep)[2])

rs.MoveObject(sf2_trimed_brep,(-10 * x,0,-4 * x))

sf2_trimed_brep = rs.AddLine(sf2_trimed_brep,rs.MoveObject(rs.CopyObject(sf2_trimed_brep),(20 * x,0,0)))
sf2_trimed_brep = rs.ExtrudeCurve(sf2_trimed_brep,rs.AddLine(rs.AddPoint(0,0,0),rs.AddPoint(0,22 * x,0)))
sf2_trimed_brep = rs.ExtrudeSurface(sf2_trimed_brep,rs.AddLine(rs.AddPoint(0,0,0),rs.AddPoint(0,0,15 * x)))

sf2_trimed_brep2 = rs.MirrorObject(sf2_trimed_brep,ZhuTou_point,rs.MoveObject(rs.CopyObject(ZhuTou_point),(x,0,0)),copy=True)

sf2_brep_left_1 = rs.BooleanIntersection(sf2_trimed_brep,sf2_brep_left,delete_input=False)[0]
sf2_brep_left_2 = rs.BooleanIntersection(sf2_trimed_brep,sf2_brep_left,delete_input=False)[1]

rs.MoveObject(sf2_brep_left_2,(0,-22 * x,0))

sf2_brep_left = rs.BooleanUnion([sf2_brep_left_1,sf2_brep_left_2],delete_input=True)

#
sf2_brep_right_1 = rs.BooleanDifference(sf2_trimed_brep2,sf2_brep_right,delete_input=False)[0]
sf2_brep_right_2 = rs.BooleanDifference(sf2_trimed_brep2,sf2_brep_right,delete_input=False)[1]

rs.MoveObject(sf2_brep_right_2,(0,22 * x,0))

sf2_brep_right = rs.BooleanUnion([sf2_brep_right_1,sf2_brep_right_2],delete_input=True)

sf2_breps = [sf2_brep_left[0],sf2_brep_right[0]]

rs.MoveObjects(sf2_breps ,(0,j * x + (MianKuo-((MianKuo+1)/2+1)) * 16 * 15 * x,252 * x +42 * x))

sf2_brep_right_1 = [sf2_breps[0]]
sf2_brep_right_2 = [sf2_breps[1]]

sq_rule = [0,0,0,0,0,0,0,0,0,0,0,0,0,0,0,0,0,0,0,0,2.5,6]
for i in range(int((MianKuo - 3)/2)+1):
    if i + 1 < len(range(int((MianKuo - 3)/2)+1)):
        sf2_brep1 = rs.MoveObject(rs.CopyObject(sf2_breps[0]),(0,-(MianKuo_length * (i+1)) * x,sq_rule[-(int((MianKuo - 3)/2-i))] * x))
        sf2_brep2 = rs.MoveObject(rs.CopyObject(sf2_breps[1]),(0,-(MianKuo_length * (i+1)) * x,sq_rule[-(int((MianKuo - 3)/2-i))] * x))
        sf2_brep_right_1.append(sf2_brep1)
        sf2_brep_right_2.append(sf2_brep2)
    
sf2_brep_left_1 = rs.MirrorObjects(sf2_brep_right_2,rs.MoveObject(rs.CopyObject(ZhuTou_point),(0,(MianKuo_length * (MianKuo - 2) * x + 2 * j * x)/2 ,0)),rs.MoveObject(rs.CopyObject(ZhuTou_point),(x,(MianKuo_length * (MianKuo - 2) * x + 2 * j * x)/2 ,0)),copy=True)
sf2_brep_left_1 = sf2_brep_left_1[::-1]

#
sf2_brep_left_2 = rs.MirrorObjects(sf2_brep_right_1,rs.MoveObject(rs.CopyObject(ZhuTou_point),(0,(MianKuo_length * (MianKuo - 2) * x + 2 * j * x)/2 ,0)),rs.MoveObject(rs.CopyObject(ZhuTou_point),(x,(MianKuo_length * (MianKuo - 2) * x + 2 * j * x)/2 ,0)),copy=True)
sf2_brep_left_2 = sf2_brep_left_2[::-1]


sufang2_breps_1 = sf2_brep_left_1 + sf2_brep_right_1
sufang2_breps_2 = sf2_brep_left_2 + sf2_brep_right_2

#第二层素枋连接件生成
# 生起曲线
yws2_brep1_g = []
yws2_brep2_g = []
zhuzi_qy = []
le2_breps = []
le2_brep_trimed_g = []
le2_trimed2 = rs.CopyObjects(zhutou_pt_up[0:len(zhutou_pt_up)-1])
rs.MoveObjects(le2_trimed2,(0,(5) * x,0))
le2_trimed1 = rs.CopyObjects(zhutou_pt_up[1:len(zhutou_pt_up)])
rs.MoveObjects(le2_trimed1,(0,-(5) * x,0))
sq_cr = rs.AddInterpCurve(zhutou_pt_up)
sq_sr = rs.ExtrudeCurve(sq_cr,rs.AddLine(rs.AddPoint(0,0,0),rs.AddPoint(5 * x,0,0)))

sq_curves = []
for i in range(len(le2_trimed1)):
    cr1 = rs.AddLine(le2_trimed1[i],le2_trimed2[i])
    rs.MoveObject(cr1,(4 * x,0,21 * x))
    cr1 = rs.ProjectCurveToSurface(cr1,sq_sr,[0,0,x])

    sq_curves.append(cr1[0])

    le2_brep = rs.ExtrudeCurve(cr1,rs.AddLine(rs.AddPoint(0,0,0),rs.AddPoint(-10 * x ,0,0)))
    le2_brep = rs.ExtrudeSurface(le2_brep,rs.AddLine(rs.AddPoint(0,0,0),rs.AddPoint(0 ,0,-14.5 * x)))
    
    le2_brep_trimed = rs.ExtrudeCurve(cr1,rs.AddLine(rs.AddPoint(0,0,0),rs.AddPoint(-8 * x ,0,0)))
    le2_brep_trimed = rs.ExtrudeSurface(le2_brep_trimed,rs.AddLine(rs.AddPoint(0,0,0),rs.AddPoint(0 ,0,-15 * x)))
    rs.MoveObject(le2_brep_trimed,(0,0,5 * x))
    le2_brep_trimed_g.append(le2_brep_trimed)
rs.MoveObjects(le2_brep_trimed_g,(0,0,44.5 * x + 21 * x))

sufang2_breps_1_1 = sufang2_breps_1[1:len(sufang2_breps_1)]

sufang2_breps_2_1 = sufang2_breps_2[0:len(sufang2_breps_2)]


#
le2_brep_trimed_g =le2_brep_trimed_g[::-1]
le2_brep_trimed_g_1 = le2_brep_trimed_g[1:len(le2_brep_trimed_g)-1]


#连接素枋和上边的泥道栱


sufang2_breps = []
for i in range(len(le2_brep_trimed_g_1)):
    sufang2_brep = rs.BooleanUnion([le2_brep_trimed_g_1[i],sufang2_breps_1_1[i],sufang2_breps_2_1[i]],delete_input=False)[0]
    sufang2_breps.append(sufang2_brep)


sufang2_brep_first = rs.BooleanUnion([sufang2_breps_1[0],le2_brep_trimed_g[0]],delete_input = False)
sufang2_brep_last = rs.BooleanUnion([sufang2_breps_2[-1],le2_brep_trimed_g[-1]],delete_input = False)

sufang2_breps.append(sufang2_brep_last[0])
sufang2_breps.insert(0,sufang2_brep_first[0])

#补间铺作第二层泥道栱

#补间铺作第二层泥道栱剪切

ndg_bj2_trimed_brep = rs.ExplodePolysurfaces(ndg_bj2_brep)[24]
ndg_bj2_trimed_brep = rs.CurveEndPoint(rs.DuplicateEdgeCurves(ndg_bj2_trimed_brep)[0])
rs.MoveObject(ndg_bj2_trimed_brep,(-10 * x,0,0))
ndg_bj2_trimed_brep = rs.AddLine(ndg_bj2_trimed_brep,rs.MoveObject(rs.CopyObject(ndg_bj2_trimed_brep),(0,4 * x,0)))
ndg_bj2_trimed_brep = rs.ExtrudeCurve(ndg_bj2_trimed_brep,rs.AddLine(rs.AddPoint(0,0,0),rs.AddPoint(20 * x,0,0)))
ndg_bj2_trimed_brep = rs.ExtrudeSurface(ndg_bj2_trimed_brep,rs.AddLine(rs.AddPoint(0,0,0),rs.AddPoint(0,0,15 * x)))
ndg_bj2_trimed_brep2 =   rs.MirrorObjects(ndg_bj2_trimed_brep,rs.MoveObject(rs.CopyObject(ZhuTou_point),(0,(MianKuo_length * (MianKuo - 2) * x + 2 * j * x)/2 ,0)),rs.MoveObject(rs.CopyObject(ZhuTou_point),(x,(MianKuo_length * (MianKuo - 2) * x + 2 * j * x)/2 ,0)),copy=True)
ndg_bj2_brep_head1 = rs.BooleanDifference(ndg_bj2_brep,ndg_bj2_trimed_brep,delete_input=False)[1]
ndg_bj2_brep_mid = rs.BooleanDifference(ndg_bj2_brep,ndg_bj2_trimed_brep,delete_input=False)[0]

ndg_bj2_brep_mid = rs.BooleanDifference(ndg_bj2_brep_mid,ndg_bj2_trimed_brep2,delete_input=False)[0]

#加21分
rs.MoveObject(ndg_bj2_brep_head1,(0,21 * x,0))

#头和中间段连接
ndg_bj2_brep_head1_1 =rs.ExplodePolysurfaces(ndg_bj2_brep_head1)[15]
ndg_bj2_brep_head1_1 = rs.ExtrudeSurface(ndg_bj2_brep_head1_1,rs.AddLine(rs.AddPoint(0,0,0),rs.AddPoint(0,-25 * x,0)))

ndg_bj2_brep_head1 = rs.BooleanDifference(ndg_bj2_brep_head1_1,ndg_bj2_brep_head1,delete_input=False)

ndg_bj2_brep_head2 = rs.MirrorObjects(ndg_bj2_brep_head1,rs.MoveObject(rs.CopyObject(ZhuTou_point),(0,(MianKuo_length * (MianKuo - 2) * x + 2 * j * x)/2 ,0)),rs.MoveObject(rs.CopyObject(ZhuTou_point),(x,(MianKuo_length * (MianKuo - 2) * x + 2 * j * x)/2 ,0)),copy=True)

ndg_bj2_brep = rs.BooleanDifference(ndg_bj2_brep_head1,ndg_bj2_brep_mid,delete_input=False)
ndg_bj2_brep = rs.BooleanIntersection(ndg_bj2_brep_head2,ndg_bj2_brep,delete_input=False)

rs.MoveObject(ndg_bj2_brep,(0,0,21 * x))

ndg_bj2_brep_g = [ndg_bj2_brep[0]]

sq_rule = [0,0,0,0,0,0,0,0,0,0,0,0,0,0,0,0,0,0,0,0,1.25,4.25]
for i in range(int((MianKuo - 3)/2)+1):
    if i + 1 < len(range(int((MianKuo - 3)/2)+1)):
        ndg_bj2_brep1 = rs.MoveObject(rs.CopyObject(ndg_bj2_brep),(0,-(MianKuo_length * (i+1)) * x,sq_rule[-(int((MianKuo - 3)/2-i))] * x))
        ndg_bj2_brep_g.append(ndg_bj2_brep1)

ndg_bj2_brep_g_left  = rs.MirrorObjects(ndg_bj2_brep_g[1 : len(ndg_bj2_brep_g)],rs.MoveObject(rs.CopyObject(ZhuTou_point),(0,(MianKuo_length * (MianKuo - 2) * x + 2 * j * x)/2 ,0)),rs.MoveObject(rs.CopyObject(ZhuTou_point),(x,(MianKuo_length * (MianKuo - 2) * x + 2 * j * x)/2 ,0)),copy=True)

ndg_bj2_brep_g_left = ndg_bj2_brep_g_left[::-1]

ndg_bj2_brep_g = ndg_bj2_brep_g_left + ndg_bj2_brep_g

ndg_bj2_brep_g_last = rs.MoveObject(rs.CopyObject(ndg_bj2_brep_g[-1]),(0,-(MianKuo_length * x/2) - j * x/2,5.75 * x))
ndg_bj2_brep_g_first = rs.MirrorObject(ndg_bj2_brep_g_last,rs.MoveObject(rs.CopyObject(ZhuTou_point),(0,(MianKuo_length * (MianKuo - 2) * x + 2 * j * x)/2 ,0)),rs.MoveObject(rs.CopyObject(ZhuTou_point),(x,(MianKuo_length * (MianKuo - 2) * x + 2 * j * x)/2 ,0)),copy=True)

ndg_bj2_brep_g.insert(0,ndg_bj2_brep_g_first)
ndg_bj2_brep_g.append(ndg_bj2_brep_g_last)


#将素枋和补间辅作第二层泥道栱连接起来

sufang2_breps_2 = []
for i in range(len(sufang2_breps)):
    if i == (len(sufang2_breps)+1)/2-1:
        sufang2_brep_2 = rs.BooleanDifference(ndg_bj2_brep_g[i],sufang2_breps[i],delete_input=False)[0]
    else:
        sufang2_brep_2 = rs.BooleanDifference(ndg_bj2_brep_g[i],sufang2_breps[i],delete_input=False)[0]

    sufang2_breps_2.append(sufang2_brep_2)

sufang2_breps = sufang2_breps_2

#第二层素枋被补间辅作第一跳华拱剪切

sufang2_breps_3 = []
for i in range(len(sufang2_breps)):
    if i == (len(sufang2_breps)+1)/2-1:
        sufang2_brep = rs.BooleanUnion([sufang2_breps[i],HuaGong1_pj_g[i]],delete_input=False)[0]
    else:
        sufang2_brep = rs.BooleanUnion([sufang2_breps[i],HuaGong1_pj_g[i]],delete_input=False)[0]
    sufang2_breps_3.append(sufang2_brep)

sufang2_breps = sufang2_breps_3

#补间辅第二跳华拱

#加21分

HuaGong2_pj_trimed_brep = rs.ExplodePolysurfaces(HuaGong2_pj)[25]
HuaGong2_pj_trimed_brep = rs.CurveEndPoint(rs.DuplicateEdgeCurves(HuaGong2_pj_trimed_brep)[0])

HuaGong2_pj_trimed_brep = rs.AddLine(HuaGong2_pj_trimed_brep,rs.MoveObject(rs.CopyObject(HuaGong2_pj_trimed_brep),(0,10 * x,0)))
HuaGong2_pj_trimed_brep = rs.ExtrudeCurve(HuaGong2_pj_trimed_brep,rs.AddLine(rs.AddPoint(0,0,0),rs.AddPoint(x,0,0)))
HuaGong2_pj_trimed_brep = rs.ExtrudeSurface(HuaGong2_pj_trimed_brep,rs.AddLine(rs.AddPoint(0,0,0),rs.AddPoint(0,0,22 * x)))
HuaGong2_pj_trimed_brep2 = rs.MirrorObject(HuaGong2_pj_trimed_brep,ZhuTou_point,rs.MoveObject(rs.CopyObject(ZhuTou_point),(0,x,0)),copy=True)
HuaGong2_pj_head1 = rs.BooleanDifference(HuaGong2_pj,HuaGong2_pj_trimed_brep,delete_input=False)[1]
HuaGong2_pj_mid = rs.BooleanDifference(HuaGong2_pj,HuaGong2_pj_trimed_brep,delete_input=False)[0]

HuaGong2_pj_mid = rs.BooleanDifference(HuaGong2_pj_mid,HuaGong2_pj_trimed_brep2,delete_input=False)[1]

#将头和中间段连接
rs.MoveObject(HuaGong2_pj_head1,(-21 * x,0,0))
HuaGong2_pj_head1_1 = rs.ExplodePolysurfaces(HuaGong2_pj_head1)[18]
HuaGong2_pj_head1_1 = rs.ExtrudeSurface(HuaGong2_pj_head1_1,rs.AddLine(rs.AddPoint(0,0,0),rs.AddPoint(22 * x,0,0)))

HuaGong2_pj_head1 = rs.BooleanDifference(HuaGong2_pj_head1_1,HuaGong2_pj_head1,delete_input = False)
HuaGong2_pj_head2 = rs.MirrorObject(HuaGong2_pj_head1,ZhuTou_point,rs.MoveObject(rs.CopyObject(ZhuTou_point),(0,x,0)),copy=True)

HuaGong2_pj = rs.BooleanDifference(HuaGong2_pj_head1,HuaGong2_pj_mid,delete_input=False)
HuaGong2_pj = rs.BooleanIntersection(HuaGong2_pj_head2,HuaGong2_pj,delete_input=False)


#翼形拱生成

yxg_pt0 = rs.CopyObject(ZhuTou_point)

yxg_pt1 = rs.MoveObject(rs.CopyObject(yxg_pt0),(0,0,10 * x))

yxg_pt2 = rs.MoveObject(rs.CopyObject(yxg_pt1),(0,0,2 * x))
yxg_pt3 = rs.MoveObject(rs.CopyObject(yxg_pt2),(0,-2 * x,0))
rs.MoveObject(yxg_pt2,(0,-x*0.6,-x*0.6))

yxg_pt4 = rs.MoveObject(rs.CopyObject(yxg_pt3),(0,-1.5 * x,x*0.4))

yxg_pt5 = rs.MoveObject(rs.CopyObject(yxg_pt4),(0,-1 * x,-x*0.2))

yxg_pt6 = rs.MoveObject(rs.CopyObject(yxg_pt5),(0,-1.25 * x,x*0.3))

yxg_pt7 = rs.MoveObject(rs.CopyObject(yxg_pt6),(0,-1 * x,-x*0.2))

yxg_pt8 = rs.MoveObject(rs.CopyObject(yxg_pt7),(0,-1 * x,x*0.1))

yxg_pt9 = rs.MoveObject(rs.CopyObject(yxg_pt8),(0,-1 * x,-x*0.3))

yxg_pt10 = rs.MoveObject(rs.CopyObject(yxg_pt9),(0,-3.5 * x,x*0.25))

yxg_pt11 = rs.MoveObject(rs.CopyObject(yxg_pt10),(0,-0.75 * x,-x*0.3))

yxg_pt12 = rs.MoveObject(rs.CopyObject(yxg_pt11),(0,-2.5 * x,-x*0.6))

yxg_pt13 = rs.MoveObject(rs.CopyObject(yxg_pt12),(0,-0.4 * x,-x*0.6))

yxg_pt14 = rs.MoveObject(rs.CopyObject(yxg_pt12),(0,-0.3 * x,-x*1.5))

yxg_pt15 = rs.MoveObject(rs.CopyObject(yxg_pt14),(0,-0.3 * x,-x*0.75))

yxg_pt16 = rs.MoveObject(rs.CopyObject(yxg_pt15),(0,0.3 * x,-x*2))

yxg_pt17 = rs.MoveObject(rs.CopyObject(yxg_pt16),(0, 0,-x*0.75))

yxg_pt18 = rs.MoveObject(rs.CopyObject(yxg_pt17),(0,1 * x,-x*1.25))

yxg_pt19 = rs.MoveObject(rs.CopyObject(yxg_pt18),(0, 1 * x,-x*1.5))

yxg_pt20 = rs.MoveObject(rs.CopyObject(yxg_pt19),(0,0.75 * x,-x*0.5))

yxg_pt21 = rs.MoveObject(rs.CopyObject(yxg_pt20),(0, 0.5 * x,-x*1))

yxg_pt22 = rs.MoveObject(rs.CopyObject(yxg_pt21),(0,1.5 * x,-x*0.75))

yxg_pt23 = rs.MoveObject(rs.CopyObject(yxg_pt22),(0, 0.6 * x,-x*0.5))

yxg_pt24 = rs.MoveObject(rs.CopyObject(yxg_pt23),(0,1.5 * x,-x*0.4))

yxg_pt25 = rs.MoveObject(rs.CopyObject(yxg_pt24),(0, 0.6 * x,-x*0.5))

yxg_pt26 = rs.MoveObject(rs.CopyObject(yxg_pt25),(0,0.75 * x,-x*0.1))

yxg_pt27 = rs.MoveObject(rs.CopyObject(yxg_pt26),(0, 1 * x,-x*0.2))

yxg_pt28 = rs.MoveObject(rs.CopyObject(yxg_pt27),(0,0.75 * x,x*0.1))

yxg_pt29 = rs.MoveObject(rs.CopyObject(yxg_pt28),(0, 1 * x,-x*0.1))

yxg_pt30 = rs.MoveObject(rs.CopyObject(yxg_pt0),(0, -2 * x,0))


yxg_pts = [yxg_pt0,yxg_pt1,yxg_pt2,yxg_pt3,yxg_pt4,yxg_pt5,yxg_pt6,yxg_pt7,yxg_pt8,yxg_pt9,yxg_pt10,yxg_pt11,yxg_pt12,yxg_pt13,yxg_pt14,yxg_pt15,yxg_pt16,yxg_pt17,yxg_pt18,yxg_pt19,yxg_pt20,yxg_pt21,yxg_pt22,yxg_pt23,yxg_pt24,yxg_pt25,yxg_pt26,yxg_pt27,yxg_pt28,yxg_pt29,yxg_pt30]

yxg_cr1 = rs.AddInterpCurve([yxg_pt1,yxg_pt2,yxg_pt3],degree = 3,knotstyle=4)
yxg_cr2 = rs.AddInterpCurve([yxg_pt3,yxg_pt4,yxg_pt5],degree = 3,knotstyle=4)
yxg_cr3 = rs.AddInterpCurve([yxg_pt5,yxg_pt6,yxg_pt7],degree = 3,knotstyle=4)
yxg_cr4 = rs.AddInterpCurve([yxg_pt7,yxg_pt8,yxg_pt9],degree = 3,knotstyle=4)
yxg_cr5 = rs.AddInterpCurve([yxg_pt9,yxg_pt10,yxg_pt11],degree = 3,knotstyle=4)
yxg_cr6 = rs.AddInterpCurve([yxg_pt11,yxg_pt12,yxg_pt13,yxg_pt14],degree = 3,knotstyle=4)
yxg_cr7 = rs.AddInterpCurve([yxg_pt14,yxg_pt15,yxg_pt16],degree = 3,knotstyle=4)
yxg_cr8 = rs.AddInterpCurve([yxg_pt16,yxg_pt17,yxg_pt18],degree = 3,knotstyle=4)
yxg_cr9 = rs.AddInterpCurve([yxg_pt18,yxg_pt19,yxg_pt20],degree = 3,knotstyle=4)
yxg_cr10 = rs.AddInterpCurve([yxg_pt20,yxg_pt21,yxg_pt22],degree = 3,knotstyle=4)
yxg_cr11 = rs.AddInterpCurve([yxg_pt22,yxg_pt23,yxg_pt24],degree = 3,knotstyle=4)
yxg_cr12 = rs.AddInterpCurve([yxg_pt24,yxg_pt25,yxg_pt26],degree = 3,knotstyle=4)
yxg_cr13 = rs.AddInterpCurve([yxg_pt26,yxg_pt27,yxg_pt28],degree = 3,knotstyle=4)
yxg_cr14 = rs.AddInterpCurve([yxg_pt28,yxg_pt29,yxg_pt30],degree = 3,knotstyle=4)
yxg_cr15 = rs.AddPolyline([yxg_pt30,yxg_pt0,yxg_pt1])

yxg_cr = rs.JoinCurves([yxg_cr1,yxg_cr2,yxg_cr3,yxg_cr4,yxg_cr5,yxg_cr6,yxg_cr7,yxg_cr8,yxg_cr9,yxg_cr10,yxg_cr11,yxg_cr12,yxg_cr13,yxg_cr14,yxg_cr15])

rs.MoveObject(yxg_cr,(-5 * x,-5 * x,0)) 

yxg_right_brep = rs.AddPlanarSrf(yxg_cr)
yxg_right_brep = rs.ExtrudeSurface(yxg_right_brep,rs.AddLine(rs.AddPoint(0,0,0),rs.AddPoint(10 * x,0,0)))

rs.ScaleObject(yxg_right_brep,rs.MoveObject(rs.CopyObject(ZhuTou_point),(0,-5 * x,0)),[1,1.5,1.3])

yxg_left_brep = rs.MirrorObject(yxg_right_brep,ZhuTou_point,rs.MoveObject(rs.CopyObject(ZhuTou_point),(x,0,0)),copy=True)


yxg_mid = rs.MoveObject(rs.AddLine(yxg_pt0,yxg_pt1),(-4 * x,-5 * x,0))
yxg_mid = rs.ExtrudeCurve(yxg_mid,rs.AddLine(rs.AddPoint(0,0,0),rs.AddPoint(0,10 * x,0)))
yxg_mid = rs.ExtrudeSurface(yxg_mid,rs.AddLine(rs.AddPoint(0,0,0),rs.AddPoint(8 * x,0,0)))

yxg_brep = rs.BooleanDifference(yxg_left_brep,yxg_mid,delete_input = True)

yxg_brep = rs.BooleanIntersection(yxg_brep,yxg_right_brep,delete_input =True)


rs.MoveObject(yxg_brep ,(-HuaGong_CaiFen_left * x+6 * x,j * x + (MianKuo-((MianKuo+1)/2+1)) * 16 * 15 * x + (MianKuo_length * x)/2,252 * x +42 * x))


HuaGong3_pj = rs.CopyObject(HuaGong2_pj)


#第二跳华拱被翼形拱剪切


HuaGong2_pj = rs.BooleanDifference(yxg_brep,HuaGong2_pj,delete_input=False)


HuaGong2_pj_g = [HuaGong2_pj[0]]

sq_rule = [0,0,0,0,0,0,0,0,0,0,0,0,0,0,0,0,0,0,0,0,1.25,4.25]
for i in range(int((MianKuo - 3)/2)+1):
    if i + 1 < len(range(int((MianKuo - 3)/2)+1)):
        hg_bj2_brep1 = rs.MoveObject(rs.CopyObject(HuaGong2_pj),(0,-(MianKuo_length * (i+1)) * x,sq_rule[-(int((MianKuo - 3)/2-i))] * x))
        HuaGong2_pj_g.append(hg_bj2_brep1)

HuaGong2_pj_g_left  = rs.MirrorObjects(HuaGong2_pj_g[1 : len(HuaGong2_pj_g)],rs.MoveObject(rs.CopyObject(ZhuTou_point),(0,(MianKuo_length * (MianKuo - 2) * x + 2 * j * x)/2 ,0)),rs.MoveObject(rs.CopyObject(ZhuTou_point),(x,(MianKuo_length * (MianKuo - 2) * x + 2 * j * x)/2 ,0)),copy=True)

HuaGong2_pj_g_left = HuaGong2_pj_g_left[::-1]

HuaGong2_pj_g = HuaGong2_pj_g_left + HuaGong2_pj_g

HuaGong2_pj_g_last = rs.MoveObject(rs.CopyObject(HuaGong2_pj_g[-1]),(0,-(MianKuo_length * x/2) - j * x/2,5.75 * x))
HuaGong2_pj_g_first = rs.MirrorObject(HuaGong2_pj_g_last,rs.MoveObject(rs.CopyObject(ZhuTou_point),(0,(MianKuo_length * (MianKuo - 2) * x + 2 * j * x)/2 ,0)),rs.MoveObject(rs.CopyObject(ZhuTou_point),(x,(MianKuo_length * (MianKuo - 2) * x + 2 * j * x)/2 ,0)),copy=True)

HuaGong2_pj_g.insert(0,HuaGong2_pj_g_first)
HuaGong2_pj_g.append(HuaGong2_pj_g_last)





#第二层素枋被补间辅作第二跳华拱剪切

sufang2_breps_4 = []
for i in range(len(sufang2_breps)):
    if i == (len(sufang2_breps)+1)/2-1:
        sufang2_brep = rs.BooleanUnion([HuaGong2_pj_g[i],sufang2_breps[i]],delete_input=False)[0]
    else:
        sufang2_brep = rs.BooleanUnion([HuaGong2_pj_g[i],sufang2_breps[i]],delete_input=False)[0]
    sufang2_breps_4.append(sufang2_brep)

sufang2_breps = sufang2_breps_4

#第二层素枋后檐
sufang2_breps_houyan = rs.MirrorObjects(sufang2_breps,rs.MoveObject(rs.CopyObject(ZhuTou_point),(4 * j/2 * x,0,0)),rs.MoveObject(rs.CopyObject(ZhuTou_point),(4 * j/2 * x,x,0)),copy=True)

sufang2_breps = sufang2_breps + sufang2_breps_houyan

#补间第二跳华拱后檐

HuaGong2_pj_g_houyan = rs.MirrorObjects(HuaGong2_pj_g,rs.MoveObject(rs.CopyObject(ZhuTou_point),(4 * j/2 * x,0,0)),rs.MoveObject(rs.CopyObject(ZhuTou_point),(4 * j/2 * x,x,0)),copy=True)

HuaGong2_pj_g = HuaGong2_pj_g + HuaGong2_pj_g_houyan


#第三层素枋和第一层一样

sufang3_breps = rs.MoveObjects(rs.CopyObjects(sufang_breps),(0,0,42 * x))[0:int(MianKuo)]

#第三层素枋被第补间第二跳华拱剪切


sufang3_breps_1 = []
for i in range(len(sufang3_breps)):
    if i == (len(sufang3_breps)+1)/2-1:
        sufang3_brep = rs.BooleanDifference(sufang3_breps[i],HuaGong2_pj_g[i],delete_input=False)[0]
    else:
        sufang3_brep = rs.BooleanUnion([HuaGong2_pj_g[i],sufang3_breps[i]],delete_input=False)[0]
    sufang3_breps_1.append(sufang3_brep)

sufang3_breps = sufang3_breps_1

#第三层素枋后檐
sufang3_breps_houyan = rs.MirrorObjects(sufang3_breps,rs.MoveObject(rs.CopyObject(ZhuTou_point),(4 * j/2 * x,0,0)),rs.MoveObject(rs.CopyObject(ZhuTou_point),(4 * j/2 * x,x,0)),copy=True)

sufang3_breps = sufang3_breps + sufang3_breps_houyan


#补间辅作第一层泥道栱上的散斗
SanDous_ndg_bj1 = rs.MoveObjects(rs.CopyObjects(SanDous_sf2) ,(0,j * x + (MianKuo-((MianKuo+1)/2+1)) * 16 * 15 * x + (MianKuo_length * x)/2,252 * x +21 * x))


#散斗
SanDous_ndg_bj1_g = []

sq_rule = [0,0,0,0,0,0,0,0,0,0,0,0,0,0,0,0,0,0,0,1.25,4.25]
for i in range(int((MianKuo - 3)/2)+1):
    if i + 1 < len(range(int((MianKuo - 3)/2)+1)):
        SanDous_ndg_bj1_g_1 = rs.MoveObject(rs.CopyObject(SanDous_ndg_bj1[0]),(0,-(MianKuo_length * (i+1)) * x,sq_rule[-(int((MianKuo - 3)/2-i))] * x))
        SanDous_ndg_bj1_g_2 = rs.MoveObject(rs.CopyObject(SanDous_ndg_bj1[1]),(0,-(MianKuo_length * (i+1)) * x,sq_rule[-(int((MianKuo - 3)/2-i))] * x))
    SanDous_ndg_bj1_g.append(SanDous_ndg_bj1_g_1)
    SanDous_ndg_bj1_g.append(SanDous_ndg_bj1_g_2)
SanDous_ndg_bj1_g.insert(0,SanDous_ndg_bj1[1])

SanDous_ndg_bj1_g_last = rs.MoveObjects(rs.CopyObjects(SanDous_ndg_bj1_g[len(SanDous_ndg_bj1_g)-2:len(SanDous_ndg_bj1_g)+1]),(0,-(MianKuo_length * x/2) - j * x/2,5.75 * x))

SanDous_ndg_bj1_g.append(SanDous_ndg_bj1_g_last[0])
SanDous_ndg_bj1_g.append(SanDous_ndg_bj1_g_last[1])

SanDous_ndg_bj1_g_left = rs.MirrorObjects(SanDous_ndg_bj1_g,rs.MoveObject(rs.CopyObject(ZhuTou_point),(0,(MianKuo_length * (MianKuo - 2) * x + 2 * j * x)/2 ,0)),rs.MoveObject(rs.CopyObject(ZhuTou_point),(x,(MianKuo_length * (MianKuo - 2) * x + 2 * j * x)/2 ,0)),copy=True)

SanDous_ndg_bj1_g = SanDous_ndg_bj1_g_left + SanDous_ndg_bj1_g


#补间铺作第二层泥道栱上的散斗

SanDous_ndg_bj2_g = rs.MoveObjects(rs.CopyObjects(SanDous_ndg_bj1_g),(0,0,21 * x))

for i in range(int(len(SanDous_ndg_bj2_g)/2)):
    rs.MoveObject(SanDous_ndg_bj2_g[(i+1) * 2 - 2],(0,21 * x,0))
    rs.MoveObject(SanDous_ndg_bj2_g[(i+1) * 2 - 1],(0,-21 * x,0))



#补间铺作上的散斗后檐
SanDous_ndg_bj1_g_houyan = rs.MirrorObjects(SanDous_ndg_bj1_g,rs.MoveObject(rs.CopyObject(ZhuTou_point),(4 * j/2 * x,0,0)),rs.MoveObject(rs.CopyObject(ZhuTou_point),(4 * j/2 * x,x,0)),copy=True)


SanDous_ndg_bj1_g = SanDous_ndg_bj1_g + SanDous_ndg_bj1_g_houyan

#

SanDous_ndg_bj2_g_houyan = rs.MirrorObjects(SanDous_ndg_bj2_g,rs.MoveObject(rs.CopyObject(ZhuTou_point),(4 * j/2 * x,0,0)),rs.MoveObject(rs.CopyObject(ZhuTou_point),(4 * j/2 * x,x,0)),copy=True)


SanDous_ndg_bj2_g = SanDous_ndg_bj2_g + SanDous_ndg_bj2_g_houyan

#补间铺作第三层泥道栱上的散斗

SanDous_ndg_bj3_g = rs.MoveObjects(rs.CopyObjects(SanDous_ndg_bj1_g),(0,0,42 * x))


#第一跳华拱上的散斗
#补间辅作第一层泥道栱上的交互斗
jhd_hg_ndg_bj1 = rs.MoveObject(rs.CopyObject(SanDou_hg) ,(0,j * x + (MianKuo-((MianKuo+1)/2+1)) * 16 * 15 * x + (MianKuo_length * x)/2-2*x,252 * x +36 * x))

jhd2_hg_ndg_bj1 = rs.CopyObject(jhd_hg_ndg_bj1)
#将散斗剪成交互斗

jhd_hg_ndg_bj1_trimed_brep = rs.ExplodePolysurfaces(jhd_hg_ndg_bj1)[12]

jhd_hg_ndg_bj1_trimed_brep = rs.CurveEndPoint(rs.DuplicateEdgeCurves(jhd_hg_ndg_bj1_trimed_brep)[0])
rs.MoveObject(jhd_hg_ndg_bj1_trimed_brep,(3 * x,0,0))
jhd_hg_ndg_bj1_trimed_brep = rs.AddLine(jhd_hg_ndg_bj1_trimed_brep,rs.MoveObject(rs.CopyObject(jhd_hg_ndg_bj1_trimed_brep),(0,14 * x,0)))
jhd_hg_ndg_bj1_trimed_brep = rs.ExtrudeCurve(jhd_hg_ndg_bj1_trimed_brep,rs.AddLine(rs.AddPoint(0,0,0),rs.AddPoint(10 * x,0,0)))

jhd_hg_ndg_bj1_trimed_brep = rs.ExtrudeSurface(jhd_hg_ndg_bj1_trimed_brep,rs.AddLine(rs.AddPoint(0,0,0),rs.AddPoint(0,0,14 * x)))

jhd_hg_ndg_bj1 = rs.BooleanUnion([jhd_hg_ndg_bj1_trimed_brep,jhd_hg_ndg_bj1],delete_input=False)


jhd2_hg_ndg_bj1 = rs.MirrorObject(jhd2_hg_ndg_bj1,ZhuTou_point,rs.MoveObject(rs.CopyObject(ZhuTou_point),(0,x,0)),copy=True)

jhd_hg_ndg_bj1_g = []

sq_rule = [0,0,0,0,0,0,0,0,0,0,0,0,0,0,0,0,0,0,0,1.25,4.25]
for i in range(int((MianKuo - 3)/2)+1):
    if i + 1 < len(range(int((MianKuo - 3)/2)+1)):
        jhd_hg_ndg_bj1_g_1 = rs.MoveObject(rs.CopyObject(jhd_hg_ndg_bj1),(0,-(MianKuo_length * (i+1)) * x,sq_rule[-(int((MianKuo - 3)/2-i))] * x))
        jhd_hg_ndg_bj1_g_2 = rs.MoveObject(rs.CopyObject(jhd2_hg_ndg_bj1),(0,-(MianKuo_length * (i+1)) * x,sq_rule[-(int((MianKuo - 3)/2-i))] * x))
    jhd_hg_ndg_bj1_g.append(jhd_hg_ndg_bj1_g_1)
    jhd_hg_ndg_bj1_g.append(jhd_hg_ndg_bj1_g_2)

jhd_hg_ndg_bj1_g = jhd_hg_ndg_bj1_g[0:len(jhd_hg_ndg_bj1_g)-2]

jhd_hg_ndg_bj1_g_last = rs.MoveObjects(rs.CopyObjects(jhd_hg_ndg_bj1_g[len(jhd_hg_ndg_bj1_g)-2:len(jhd_hg_ndg_bj1_g)+1]),(0,-(MianKuo_length * x/2) - j * x/2,5.75 * x))


jhd_hg_ndg_bj1_g.append(jhd_hg_ndg_bj1_g_last[0])
jhd_hg_ndg_bj1_g.append(jhd_hg_ndg_bj1_g_last[1])

jhd_hg_ndg_bj1_g_left = rs.MirrorObjects(jhd_hg_ndg_bj1_g,rs.MoveObject(rs.CopyObject(ZhuTou_point),(0,(MianKuo_length * (MianKuo - 2) * x + 2 * j * x)/2 ,0)),rs.MoveObject(rs.CopyObject(ZhuTou_point),(x,(MianKuo_length * (MianKuo - 2) * x + 2 * j * x)/2 ,0)),copy=True)

jhd_hg_ndg_bj1_g_left = jhd_hg_ndg_bj1_g_left[::-1]
jhd_hg_ndg_bj1_g_left.append(jhd2_hg_ndg_bj1)
jhd_hg_ndg_bj1_g_left.append(jhd_hg_ndg_bj1[0])

jhd_hg_ndg_bj1_g = jhd_hg_ndg_bj1_g_left + jhd_hg_ndg_bj1_g

#第一层华拱上的散斗后檐
jhd_hg_ndg_bj1_g_houyan = rs.MirrorObjects(jhd_hg_ndg_bj1_g,rs.MoveObject(rs.CopyObject(ZhuTou_point),(4 * j/2 * x,0,0)),rs.MoveObject(rs.CopyObject(ZhuTou_point),(4 * j/2 * x,x,0)),copy=True)

jhd_hg_ndg_bj1_g = jhd_hg_ndg_bj1_g + jhd_hg_ndg_bj1_g_houyan



jhd_hg_ndg_bj2 = rs.MoveObject(rs.CopyObject(jhd_hg_ndg_bj1),(-21 * x,0,21 * x))

jhd2_hg_ndg_bj2 = rs.MirrorObject(jhd_hg_ndg_bj2,ZhuTou_point,rs.MoveObject(rs.CopyObject(ZhuTou_point),(0,x,0)),copy=True)

jhd_hg_ndg_bj2_g = []

sq_rule = [0,0,0,0,0,0,0,0,0,0,0,0,0,0,0,0,0,0,0,1.25,4.25]
for i in range(int((MianKuo - 3)/2)+1):
    if i + 1 < len(range(int((MianKuo - 3)/2)+1)):
        jhd_hg_ndg_bj2_g_1 = rs.MoveObject(rs.CopyObject(jhd_hg_ndg_bj2),(0,-(MianKuo_length * (i+1)) * x,sq_rule[-(int((MianKuo - 3)/2-i))] * x))
        jhd_hg_ndg_bj2_g_2 = rs.MoveObject(rs.CopyObject(jhd2_hg_ndg_bj2),(0,-(MianKuo_length * (i+1)) * x,sq_rule[-(int((MianKuo - 3)/2-i))] * x))
    jhd_hg_ndg_bj2_g.append(jhd_hg_ndg_bj2_g_1)
    jhd_hg_ndg_bj2_g.append(jhd_hg_ndg_bj2_g_2)

jhd_hg_ndg_bj2_g = jhd_hg_ndg_bj2_g[0:len(jhd_hg_ndg_bj2_g)-2]

jhd_hg_ndg_bj2_g_last = rs.MoveObjects(rs.CopyObjects(jhd_hg_ndg_bj2_g[len(jhd_hg_ndg_bj2_g)-2:len(jhd_hg_ndg_bj2_g)+1]),(0,-(MianKuo_length * x/2) - j * x/2,5.75 * x))


jhd_hg_ndg_bj2_g.append(jhd_hg_ndg_bj2_g_last[0])
jhd_hg_ndg_bj2_g.append(jhd_hg_ndg_bj2_g_last[1])

jhd_hg_ndg_bj2_g_left = rs.MirrorObjects(jhd_hg_ndg_bj2_g,rs.MoveObject(rs.CopyObject(ZhuTou_point),(0,(MianKuo_length * (MianKuo - 2) * x + 2 * j * x)/2 ,0)),rs.MoveObject(rs.CopyObject(ZhuTou_point),(x,(MianKuo_length * (MianKuo - 2) * x + 2 * j * x)/2 ,0)),copy=True)

jhd_hg_ndg_bj2_g_left = jhd_hg_ndg_bj2_g_left[::-1]
jhd_hg_ndg_bj2_g_left.append(jhd2_hg_ndg_bj2)
jhd_hg_ndg_bj2_g_left.append(jhd_hg_ndg_bj2)

jhd_hg_ndg_bj2_g = jhd_hg_ndg_bj2_g_left + jhd_hg_ndg_bj2_g

#第二层华拱上的散斗后檐
jhd_hg_ndg_bj2_g_houyan = rs.MirrorObjects(jhd_hg_ndg_bj2_g,rs.MoveObject(rs.CopyObject(ZhuTou_point),(4 * j/2 * x,0,0)),rs.MoveObject(rs.CopyObject(ZhuTou_point),(4 * j/2 * x,x,0)),copy=True)

jhd_hg_ndg_bj2_g = jhd_hg_ndg_bj2_g + jhd_hg_ndg_bj2_g_houyan


#翼形拱组

yxg_brep_g = []

sq_rule = [0,0,0,0,0,0,0,0,0,0,0,0,0,0,0,0,0,0,0,0,1.25,4.25]
for i in range(int((MianKuo - 3)/2)+1):
    if i + 1 < len(range(int((MianKuo - 3)/2)+1)):
        ndg_bj_brep1 = rs.MoveObject(rs.CopyObject(yxg_brep),(0,-(MianKuo_length * (i+1)) * x,sq_rule[-(int((MianKuo - 3)/2-i))] * x))
        yxg_brep_g.append(ndg_bj_brep1)

yxg_brep_g_left  = rs.MirrorObjects(yxg_brep_g[0 : len(yxg_brep_g)],rs.MoveObject(rs.CopyObject(ZhuTou_point),(0,(MianKuo_length * (MianKuo - 2) * x + 2 * j * x)/2 ,0)),rs.MoveObject(rs.CopyObject(ZhuTou_point),(x,(MianKuo_length * (MianKuo - 2) * x + 2 * j * x)/2 ,0)),copy=True)

yxg_brep_g_left = yxg_brep_g_left[::-1]
yxg_brep_g_left.append(yxg_brep[0])

yxg_brep_g = yxg_brep_g_left + yxg_brep_g

yxg_brep_g_last = rs.MoveObject(rs.CopyObject(yxg_brep_g[-1]),(0,-(MianKuo_length * x/2) - j * x/2,5.75 * x))
yxg_brep_g_first = rs.MirrorObject(yxg_brep_g_last,rs.MoveObject(rs.CopyObject(ZhuTou_point),(0,(MianKuo_length * (MianKuo - 2) * x + 2 * j * x)/2 ,0)),rs.MoveObject(rs.CopyObject(ZhuTou_point),(x,(MianKuo_length * (MianKuo - 2) * x + 2 * j * x)/2 ,0)),copy=True)

yxg_brep_g.insert(0,yxg_brep_g_first)
yxg_brep_g.append(yxg_brep_g_last)

#翼形拱后檐
yxg_brep_g_houyan = rs.MirrorObjects(yxg_brep_g,rs.MoveObject(rs.CopyObject(ZhuTou_point),(4 * j/2 * x,0,0)),rs.MoveObject(rs.CopyObject(ZhuTou_point),(4 * j/2 * x,x,0)),copy=True)

yxg_brep_g = yxg_brep_g + yxg_brep_g_houyan




#补间辅作第三跳华拱后尾出作垂头

rs.MoveObject((HuaGong3_pj),(0,0,21 * x))

#补间第三跳华拱剪切再出21分,并且将后尾变成垂头

HuaGong3_pj_trimed = rs.ExplodePolysurfaces(HuaGong3_pj)[50]
HuaGong3_pj_trimed = rs.CurveEndPoint(rs.DuplicateEdgeCurves(HuaGong3_pj_trimed)[2])

HuaGong3_pj_trimed_0 = rs.MoveObject(rs.CopyObject(HuaGong3_pj_trimed),(-2 * x,0,0))

HuaGong3_pj_trimed_1 = rs.MoveObject(rs.CopyObject(HuaGong3_pj_trimed_0),(-21 * x,0,-14 * x))


HuaGong3_pj_trimed_2 = rs.MoveObject(rs.CopyObject(HuaGong3_pj_trimed_1),(0,0,-1 * x))

HuaGong3_pj_trimed_3 = rs.MoveObject(rs.CopyObject(HuaGong3_pj_trimed_2),(39 * x,0,0))


HuaGong3_pj_trimed = rs.AddPolyline([HuaGong3_pj_trimed,HuaGong3_pj_trimed_0,HuaGong3_pj_trimed_1,HuaGong3_pj_trimed_2,HuaGong3_pj_trimed_3])

HuaGong3_pj_trimed = rs.JoinCurves([HuaGong3_pj_trimed,rs.AddLine(rs.CurveStartPoint(HuaGong3_pj_trimed),rs.CurveEndPoint(HuaGong3_pj_trimed))])

HuaGong3_pj_trimed = rs.AddPlanarSrf(HuaGong3_pj_trimed)

HuaGong3_pj_trimed = rs.ExtrudeSurface(HuaGong3_pj_trimed,rs.AddLine(rs.AddPoint(0,0,0),rs.AddPoint(0,-10 * x,0)))
HuaGong3_pj_trimed_2 = rs.MirrorObject(HuaGong3_pj_trimed,ZhuTou_point,rs.MoveObject(rs.CopyObject(ZhuTou_point),(0,x,0)),copy=True)

HuaGong3_pj = rs.BooleanDifference(HuaGong3_pj,HuaGong3_pj_trimed,delete_input=True)

HuaGong3_pj = rs.BooleanDifference(HuaGong3_pj,HuaGong3_pj_trimed_2,delete_input=True)

#补间铺作的的令拱生成

#佛光寺大殿,令拱生成


if NiDaoGong_CaiFen_left !=  NiDaoGong_CaiFen_right:
    raise ValueError(f"两边必须一样长")

lg_pt_o = rs.CopyObject(ZhuTou_point)
if (NiDaoGong_CaiFen_left > 25) & (NiDaoGong_CaiFen_right > 25):
    rs.MoveObject(lg_pt_o,(0,(NiDaoGong_CaiFen_left) * x,0))
else : raise ValueError(f"必须大于26分")

lg_pt_z1 = rs.CopyObject(lg_pt_o)
rs.MoveObject(lg_pt_z1,(0,0,9 * x))
lg_cr_z = rs.AddLine(lg_pt_o,lg_pt_z1)
lg_pt_y1 = rs.CopyObject(lg_pt_o)
rs.MoveObject(lg_pt_y1 ,(0,-20 * x,0))
lg_cr_y = rs.AddLine(lg_pt_y1,lg_pt_o)
div_cr_z =rs.DivideCurve(lg_cr_z,5)
div_cr_y =rs.DivideCurve(lg_cr_y,5)
#卷杀
CrossCurves_gzg = []
for i in range(len(div_cr_z)):
    divide_y = div_cr_y[i]
    divide_z = div_cr_z[i]
    CrossCurve_gzg = rs.AddLine(divide_y,divide_z)
    CrossCurves_gzg.append(CrossCurve_gzg)
CrossCurves_gzg = CrossCurves_gzg[1:len(CrossCurves_gzg)-1]
#选择交点
CrossCurves_points_gzg = []
for i in range(len(CrossCurves_gzg)):
    CrossCurves_point_gzg = rs.CurveCurveIntersection(CrossCurves_gzg[i],CrossCurves_gzg[i-1])[0][1]
    CrossCurves_points_gzg.append(CrossCurves_point_gzg)
CrossCurves_points_gzg = CrossCurves_points_gzg[1:len(CrossCurves_points_gzg)]
CrossCurves_points_gzg.insert(0,rs.CurveStartPoint(lg_cr_y))
CrossCurves_points_gzg.insert(len(CrossCurves_points_gzg)+1,rs.CurveEndPoint(lg_cr_z))
lg_pt_z2 = rs.CopyObject(lg_pt_z1)
rs.MoveObject(lg_pt_z2,(0,0, 6 * x))
lg_pt_z3 = rs.CopyObject(lg_pt_z2)
rs.MoveObject(lg_pt_z3,(0,-10 * x,0))
lg_pt_y_1 = rs.CopyObject(ZhuTou_point)
rs.MoveObject(lg_pt_y_1,(0,0,5 * x))
lg_pt_y_2 = rs.CopyObject(lg_pt_y_1)
rs.MoveObject(lg_pt_y_2,(0,4 * x,0))
lg_pt_y_3 = rs.CopyObject(lg_pt_y_2)
rs.MoveObject(lg_pt_y_3,(0,0,10 * x))
CrossCurves_points_gzg.append(lg_pt_z2)
CrossCurves_points_gzg.append(lg_pt_z3)
CrossCurves_points_lg_right = rs.MirrorObjects(CrossCurves_points_gzg,ZhuTou_point,rs.MoveObject(rs.CopyObject(ZhuTou_point),(x,0,x)),copy=True)
rs.MoveObjects(CrossCurves_points_lg_right,(0,(NiDaoGong_CaiFen_left - NiDaoGong_CaiFen_right) * x,0))
lg_mid_pt1 = rs.CopyObject(ZhuTou_point)
lg_mid_pt1 = rs.MoveObject(lg_mid_pt1,(0,-4 * x,15 * x))
lg_mid_pt4 = rs.CopyObject(ZhuTou_point)
lg_mid_pt4 = rs.MoveObject(lg_mid_pt4,(0,4 * x,15 * x))
lg_mid_pt2 = rs.CopyObject(lg_mid_pt1)
rs.MoveObject(lg_mid_pt2,(0,0,-10 * x))
lg_mid_pt3 = rs.CopyObject(lg_mid_pt2)
rs.MoveObject(lg_mid_pt3,(0,8 * x,0))

CrossCurves_points_gzg.insert(0,CrossCurves_points_lg_right[0])
CrossCurves_points_gzg.insert(0,CrossCurves_points_lg_right[1])
CrossCurves_points_gzg.insert(0,CrossCurves_points_lg_right[2])
CrossCurves_points_gzg.insert(0,CrossCurves_points_lg_right[3])
CrossCurves_points_gzg.insert(0,CrossCurves_points_lg_right[4])
CrossCurves_points_gzg.insert(0,CrossCurves_points_lg_right[5])
CrossCurves_points_gzg.insert(0,CrossCurves_points_lg_right[6])
CrossCurves_points_gzg.insert(0,lg_mid_pt1)
CrossCurves_points_gzg.insert(0,lg_mid_pt2)
CrossCurves_points_gzg.insert(0,lg_mid_pt3)
CrossCurves_points_gzg.insert(0,lg_mid_pt4)
lg_curve_left1 = rs.AddPolyline(CrossCurves_points_gzg)
lg_curve_left1 = rs.JoinCurves([lg_curve_left1,rs.AddLine(rs.CurveEndPoint(lg_curve_left1),rs.CurveStartPoint(lg_curve_left1))])
rs.MoveObject(lg_curve_left1,(5 *x,0,0))
lg_sr_left1 = rs.AddPlanarSrf(lg_curve_left1)

lg_brep = rs.ExtrudeSurface(lg_sr_left1,rs.AddLine(rs.AddPoint(0,0,0),rs.AddPoint(-10 * x,0,0)))

# 拱眼
lg_gyy_pt1 = rs.CopyObject(lg_pt_z3)
rs.MoveObject(lg_gyy_pt1,(-5 * x,0,x))
lg_gyy_pt2 = rs.CopyObject(lg_gyy_pt1)
rs.MoveObject(lg_gyy_pt2,(0,0,-2 * x))
lg_gyy_pt4 = rs.CopyObject(lg_mid_pt4)
rs.MoveObject(lg_gyy_pt4,(-5 * x, 1.625 * x,x))
lg_gyy_pt3 = rs.CopyObject(lg_gyy_pt4)
rs.MoveObject(lg_gyy_pt3,(0,0,-2 * x))
lg_gyy_cr1 = rs.AddLine(lg_gyy_pt1,lg_gyy_pt2)
lg_gyy_cr2 = rs.AddLine(lg_gyy_pt2,lg_gyy_pt3)
lg_gyy_cr3 = rs.AddLine(lg_gyy_pt3,lg_gyy_pt4)
lg_gyy_cr1 = rs.AddFilletCurve(lg_gyy_cr1,lg_gyy_cr2,x)
lg_gyy_cr2_1 = rs.AddFilletCurve(lg_gyy_cr3,lg_gyy_cr2,x)
lg_gyy_cr3 = rs.AddLine(rs.CurveEndPoint(lg_gyy_cr1),rs.CurveEndPoint(lg_gyy_cr2_1))
lg_gyy_cr4 = rs.AddLine(rs.CurveStartPoint(lg_gyy_cr1),rs.MoveObject(rs.CopyObject(lg_gyy_pt1),(0,0,x)))
lg_gyy_cr5 = rs.AddLine(rs.CurveStartPoint(lg_gyy_cr2_1),rs.MoveObject(rs.CopyObject(lg_gyy_pt4),(0,0,x)))
lg_gyy_1 =rs.JoinCurves([lg_gyy_cr1,lg_gyy_cr2_1,lg_gyy_cr3,lg_gyy_cr4,lg_gyy_cr5])
lg_gyy_1 =rs.JoinCurves([lg_gyy_1,rs.AddLine(rs.CurveStartPoint(lg_gyy_1),rs.CurveEndPoint(lg_gyy_1))])
lg_gyy_sr = rs.AddPlanarSrf(lg_gyy_1)
rs.MoveObject(lg_gyy_sr,(0,0,0))
lg_gyy_1_1= rs.MoveObject(rs.CopyObject(lg_gyy_1),(5 * x,0 , x))
rs.ScaleObject(lg_gyy_1_1,rs.CurveMidPoint(lg_gyy_cr2),[1,0.5,1])
lg_gyy_1 =rs.AddLoftSrf([lg_gyy_1,lg_gyy_1_1])
lg_gyy_2 =rs.MirrorObject(lg_gyy_1,ZhuTou_point,rs.MoveObject(rs.CopyObject(ZhuTou_point),(x,0,0)),copy=True)
lg_gyy_3 =rs.MirrorObject(lg_gyy_1,ZhuTou_point,rs.MoveObject(rs.CopyObject(ZhuTou_point),(0,x,0)),copy=True)
lg_gyy_4 =rs.MirrorObject(lg_gyy_2,ZhuTou_point,rs.MoveObject(rs.CopyObject(ZhuTou_point),(0,x,0)),copy=True)
rs.CapPlanarHoles(lg_gyy_1)
lg_brep = rs.BooleanDifference(lg_brep,lg_gyy_1)
lg_brep = rs.BooleanDifference(lg_brep,lg_gyy_2)
lg_brep = rs.BooleanDifference(lg_brep,lg_gyy_3)
lg_brep = rs.BooleanDifference(lg_brep,lg_gyy_4)

#令拱加上馒头榫

lg_brep = rs.BooleanDifference(mts1_ndg_bj1,lg_brep,delete_input=False)

lg_brep = rs.BooleanIntersection(lg_brep,mts1_ndg_bj2,delete_input=False)


rs.MoveObject(lg_brep,(-47 * x,j * x + (MianKuo-((MianKuo+1)/2+1)) * 16 * 15 * x + (MianKuo_length * x)/2,252 * x +63 * x))

lg_brep2 = rs.MirrorObject(lg_brep,ZhuTou_point,rs.MoveObject(rs.CopyObject(ZhuTou_point),(0,x,0)),copy=True)

lg_breps = [lg_brep,lg_brep2]

#补间辅作第三跳华拱被令拱剪切

HuaGong3_pj = rs.BooleanDifference(lg_brep,HuaGong3_pj,delete_input=False)
HuaGong3_pj = rs.BooleanIntersection(lg_brep2,HuaGong3_pj,delete_input=False)

#补间辅作第三跳华拱组

HuaGong3_pj_g = []

sq_rule = [0,0,0,0,0,0,0,0,0,0,0,0,0,0,0,0,0,0,0,0,1.25,4.25]
for i in range(int((MianKuo - 3)/2)+1):
    if i + 1 < len(range(int((MianKuo - 3)/2)+1)):
        ndg_bj_brep1 = rs.MoveObject(rs.CopyObject(HuaGong3_pj),(0,-(MianKuo_length * (i+1)) * x,sq_rule[-(int((MianKuo - 3)/2-i))] * x))
        HuaGong3_pj_g.append(ndg_bj_brep1)

HuaGong3_pj_g_left  = rs.MirrorObjects(HuaGong3_pj_g[0 : len(HuaGong3_pj_g)],rs.MoveObject(rs.CopyObject(ZhuTou_point),(0,(MianKuo_length * (MianKuo - 2) * x + 2 * j * x)/2 ,0)),rs.MoveObject(rs.CopyObject(ZhuTou_point),(x,(MianKuo_length * (MianKuo - 2) * x + 2 * j * x)/2 ,0)),copy=True)

HuaGong3_pj_g_left = HuaGong3_pj_g_left[::-1]
HuaGong3_pj_g_left.append(HuaGong3_pj[0])

HuaGong3_pj_g = HuaGong3_pj_g_left + HuaGong3_pj_g

HuaGong3_pj_g_last = rs.MoveObject(rs.CopyObject(HuaGong3_pj_g[-1]),(0,-(MianKuo_length * x/2) - j * x/2,5.75 * x))
HuaGong3_pj_g_first = rs.MirrorObject(HuaGong3_pj_g_last,rs.MoveObject(rs.CopyObject(ZhuTou_point),(0,(MianKuo_length * (MianKuo - 2) * x + 2 * j * x)/2 ,0)),rs.MoveObject(rs.CopyObject(ZhuTou_point),(x,(MianKuo_length * (MianKuo - 2) * x + 2 * j * x)/2 ,0)),copy=True)

HuaGong3_pj_g.insert(0,HuaGong3_pj_g_first)
HuaGong3_pj_g.append(HuaGong3_pj_g_last)

#补间辅作第三跳华拱后檐
HuaGong3_pj_g_houyan = rs.MirrorObjects(HuaGong3_pj_g,rs.MoveObject(rs.CopyObject(ZhuTou_point),(4 * j/2 * x,0,0)),rs.MoveObject(rs.CopyObject(ZhuTou_point),(4 * j/2 * x,x,0)),copy=True)

HuaGong3_pj_g = HuaGong3_pj_g + HuaGong3_pj_g_houyan


#补间辅作令拱组

lg_breps_g = []

sq_rule = [0,0,0,0,0,0,0,0,0,0,0,0,0,0,0,0,0,0,0,1.25,4.25]
for i in range(int((MianKuo - 3)/2)+1):
    if i + 1 < len(range(int((MianKuo - 3)/2)+1)):
        lg_breps_g_1 = rs.MoveObject(rs.CopyObject(lg_brep),(0,-(MianKuo_length * (i+1)) * x,sq_rule[-(int((MianKuo - 3)/2-i))] * x))
        lg_breps_g_2 = rs.MoveObject(rs.CopyObject(lg_brep2),(0,-(MianKuo_length * (i+1)) * x,sq_rule[-(int((MianKuo - 3)/2-i))] * x))
    lg_breps_g.append(lg_breps_g_1)
    lg_breps_g.append(lg_breps_g_2)

lg_breps_g = lg_breps_g[0:len(lg_breps_g)-2]

lg_breps_g_last = rs.MoveObjects(rs.CopyObjects(lg_breps_g[len(lg_breps_g)-2:len(lg_breps_g)+1]),(0,-(MianKuo_length * x/2) - j * x/2,5.75 * x))


lg_breps_g.append(lg_breps_g_last[0])
lg_breps_g.append(lg_breps_g_last[1])

lg_breps_g_left = rs.MirrorObjects(lg_breps_g,rs.MoveObject(rs.CopyObject(ZhuTou_point),(0,(MianKuo_length * (MianKuo - 2) * x + 2 * j * x)/2 ,0)),rs.MoveObject(rs.CopyObject(ZhuTou_point),(x,(MianKuo_length * (MianKuo - 2) * x + 2 * j * x)/2 ,0)),copy=True)

lg_breps_g_left = lg_breps_g_left[::-1]
lg_breps_g_left.append(lg_brep2)
lg_breps_g_left.append(lg_brep[0])

lg_breps_g = lg_breps_g_left + lg_breps_g

#令拱组后檐
lg_breps_g_houyan = rs.MirrorObjects(lg_breps_g,rs.MoveObject(rs.CopyObject(ZhuTou_point),(4 * j/2 * x,0,0)),rs.MoveObject(rs.CopyObject(ZhuTou_point),(4 * j/2 * x,x,0)),copy=True)

lg_breps_g = lg_breps_g + lg_breps_g_houyan

#令拱上的散斗

sandou_lg_g_1 = rs.MoveObjects(rs.CopyObjects(SanDous_ndg_bj3_g),(-47 * x,0,0))
sandou_lg_g_2 = rs.MoveObjects(rs.CopyObjects(SanDous_ndg_bj3_g),(47 * x,0,0))


sandou_lg_g = sandou_lg_g_1 + sandou_lg_g_2

sandou_lg_3 = rs.MoveObject(rs.CopyObject(SanDou),(-47 * x,71.5 * x,42 * x))

sandou2_lg_3 = rs.MirrorObject(sandou_lg_3,ZhuTou_point,rs.MoveObject(rs.CopyObject(ZhuTou_point),(0,x,0)),copy=True)

sandous_lg_3 = [sandou_lg_3,sandou2_lg_3]

sandous_lg_3_g = []

sq_rule = [0,0,0,0,0,0,0,0,0,0,0,0,0,0,0,0,0,0,0,1.25,4.25]
for i in range(int((MianKuo - 3)/2)+1):
    if i + 1 < len(range(int((MianKuo - 3)/2)+1)):
        sandous_lg_3_g_1 = rs.MoveObject(rs.CopyObject(sandou_lg_3),(0,-(MianKuo_length * (i+1)) * x,sq_rule[-(int((MianKuo - 3)/2-i))] * x))
        sandous_lg_3_g_2 = rs.MoveObject(rs.CopyObject(sandou2_lg_3),(0,-(MianKuo_length * (i+1)) * x,sq_rule[-(int((MianKuo - 3)/2-i))] * x))
    sandous_lg_3_g.append(sandous_lg_3_g_1)
    sandous_lg_3_g.append(sandous_lg_3_g_2)

sandous_lg_3_g = sandous_lg_3_g[0:len(sandous_lg_3_g)-2]

sandous_lg_3_g_last = rs.MoveObjects(rs.CopyObjects(sandous_lg_3_g[len(sandous_lg_3_g)-2:len(sandous_lg_3_g)+1]),(0,-(MianKuo_length * x/2) - j * x/2,5.75 * x))


sandous_lg_3_g.append(sandous_lg_3_g_last[0])
sandous_lg_3_g.append(sandous_lg_3_g_last[1])

sandous_lg_3_g_left = rs.MirrorObjects(sandous_lg_3_g,rs.MoveObject(rs.CopyObject(ZhuTou_point),(0,(MianKuo_length * (MianKuo - 2) * x + 2 * j * x)/2 ,0)),rs.MoveObject(rs.CopyObject(ZhuTou_point),(x,(MianKuo_length * (MianKuo - 2) * x + 2 * j * x)/2 ,0)),copy=True)

sandous_lg_3_g_left = sandous_lg_3_g_left[::-1]
sandous_lg_3_g_left.append(sandou2_lg_3)
sandous_lg_3_g_left.append(sandou_lg_3)

sandous_lg_3_g = sandous_lg_3_g_left + sandous_lg_3_g

sandous_lg_3_g_houyan = rs.MirrorObjects(sandous_lg_3_g,rs.MoveObject(rs.CopyObject(ZhuTou_point),(4 * j/2 * x,0,0)),rs.MoveObject(rs.CopyObject(ZhuTou_point),(4 * j/2 * x,x,0)),copy=True)

sandous_lg_3_g = sandous_lg_3_g + sandous_lg_3_g_houyan

sandou_lg_g = sandou_lg_g + sandous_lg_3_g

#第四层素枋


sf4_brep_trimed_g = []
le_trimed2 = rs.CopyObjects(zhutou_pt_up[0:len(zhutou_pt_up)-1])
rs.MoveObjects(le_trimed2,(0,(9.5) * x,0))
le_trimed1 = rs.CopyObjects(zhutou_pt_up[1:len(zhutou_pt_up)])
rs.MoveObjects(le_trimed1,(0,-(9.5) * x,0))
sq_cr = rs.AddInterpCurve(zhutou_pt_up)
sq_sr = rs.ExtrudeCurve(sq_cr,rs.AddLine(rs.AddPoint(0,0,0),rs.AddPoint(5 * x,0,0)))

sq_curves = []
for i in range(len(le_trimed1)):
    cr1 = rs.AddLine(le_trimed1[i],le_trimed2[i])
    rs.MoveObject(cr1,(5 * x,0,21 * x))
    cr1 = rs.ProjectCurveToSurface(cr1,sq_sr,[0,0,x])

    sq_curves.append(cr1[0])

    le_brep = rs.ExtrudeCurve(cr1,rs.AddLine(rs.AddPoint(0,0,0),rs.AddPoint(-10 * x ,0,0)))
    le_brep = rs.ExtrudeSurface(le_brep,rs.AddLine(rs.AddPoint(0,0,0),rs.AddPoint(0 ,0,-14.5 * x)))
    
    le_brep_trimed = rs.ExtrudeCurve(cr1,rs.AddLine(rs.AddPoint(0,0,0),rs.AddPoint(-10 * x ,0,0)))
    le_brep_trimed = rs.ExtrudeSurface(le_brep_trimed,rs.AddLine(rs.AddPoint(0,0,0),rs.AddPoint(0 ,0,-15 * x)))
    rs.MoveObject(le_brep_trimed,(0,0,5 * x))
    sf4_brep_trimed_g.append(le_brep_trimed)
rs.MoveObjects(sf4_brep_trimed_g,(0,0,44.5 * x + 64 * x))

#第四层素枋中间连接件

sf4_connect_brep_trimed = rs.ExplodePolysurfaces(sf4_connect_brep1)[10]

rs.ScaleObject(sf4_connect_brep_trimed,ZhuTou_point,[5,1,2],copy=False)

sf4_connect_brep_trimed = rs.ExtrudeSurface(sf4_connect_brep_trimed,rs.AddLine(rs.AddPoint(0,0,0),rs.AddPoint(0,50 * x,0)))
rs.MoveObject(sf4_connect_brep_trimed,(0,x,0))

sf4_connect_brep_trimed2 = rs.MirrorObject(sf4_connect_brep_trimed,ZhuTou_point,rs.MoveObject(rs.CopyObject(ZhuTou_point),(x,0,0)),copy=True)

sf4_connect_brep2 = rs.BooleanDifference(sf4_connect_brep2,sf4_connect_brep_trimed,delete_input=False)
sf4_connect_brep1 = rs.BooleanUnion([sf4_connect_brep_trimed2,sf4_connect_brep1],delete_input=False)

#将连接件的拱眼补上

sf4_connect_brep_fix1 =rs.ExplodePolysurfaces(sf4_connect_brep1)[20]
sf4_connect_brep_fix1 = rs.ExtrudeSurface(sf4_connect_brep_fix1,rs.AddLine(rs.AddPoint(0,0,0),rs.AddPoint(-x,0,0)))
sf4_connect_brep_fix2 = rs.MirrorObject(sf4_connect_brep_fix1,ZhuTou_point,rs.MoveObject(rs.CopyObject(ZhuTou_point),(0,x,0)),copy=True)
sf4_connect_brep_fix3 = rs.MirrorObject(sf4_connect_brep_fix1,ZhuTou_point,rs.MoveObject(rs.CopyObject(ZhuTou_point),(x,0,0)),copy=True)
sf4_connect_brep_fix4 = rs.MirrorObject(sf4_connect_brep_fix2,ZhuTou_point,rs.MoveObject(rs.CopyObject(ZhuTou_point),(x,0,0)),copy=True)

sf4_connect_brep1 = rs.BooleanDifference(sf4_connect_brep1,sf4_connect_brep_fix1,delete_input=False)

sf4_connect_brep1 = rs.BooleanDifference(sf4_connect_brep1,sf4_connect_brep_fix2,delete_input=False)

sf4_connect_brep2 = rs.BooleanUnion([sf4_connect_brep_fix3,sf4_connect_brep2,sf4_connect_brep_fix4],delete_input=False)



sf4_connect_breps = [sf4_connect_brep1[0],sf4_connect_brep2[0]]
rs.MoveObjects(sf4_connect_breps ,(0,j * x + (MianKuo-((MianKuo+1)/2+1)) * 16 * 15 * x,252 * x + 84 * x))



sf4_connect_brep_right_1 = [sf4_connect_breps[0]]
sf4_connect_brep_right_2 = [sf4_connect_breps[1]]

sq_rule = [0,0,0,0,0,0,0,0,0,0,0,0,0,0,0,0,0,0,0,0,2.5,6]
for i in range(int((MianKuo - 3)/2)+1):
    if i + 1 < len(range(int((MianKuo - 3)/2)+1)):
        sf4_connect_brep1 = rs.MoveObject(rs.CopyObject(sf4_connect_breps[0]),(0,-(MianKuo_length * (i+1)) * x,sq_rule[-(int((MianKuo - 3)/2-i))] * x))
        sf4_connect_brep2 = rs.MoveObject(rs.CopyObject(sf4_connect_breps[1]),(0,-(MianKuo_length * (i+1)) * x,sq_rule[-(int((MianKuo - 3)/2-i))] * x))
        sf4_connect_brep_right_1.append(sf4_connect_brep1)
        sf4_connect_brep_right_2.append(sf4_connect_brep2)
    
sf4_connect_brep_left_1 = rs.MirrorObjects(sf4_connect_brep_right_2,rs.MoveObject(rs.CopyObject(ZhuTou_point),(0,(MianKuo_length * (MianKuo - 2) * x + 2 * j * x)/2 ,0)),rs.MoveObject(rs.CopyObject(ZhuTou_point),(x,(MianKuo_length * (MianKuo - 2) * x + 2 * j * x)/2 ,0)),copy=True)
sf4_connect_brep_left_1 = sf4_connect_brep_left_1[::-1]

#
sf4_connect_brep_left_2 = rs.MirrorObjects(sf4_connect_brep_right_1,rs.MoveObject(rs.CopyObject(ZhuTou_point),(0,(MianKuo_length * (MianKuo - 2) * x + 2 * j * x)/2 ,0)),rs.MoveObject(rs.CopyObject(ZhuTou_point),(x,(MianKuo_length * (MianKuo - 2) * x + 2 * j * x)/2 ,0)),copy=True)
sf4_connect_brep_left_2 = sf4_connect_brep_left_2[::-1]


sf4_connect_breps_1 = sf4_connect_brep_left_1 + sf4_connect_brep_right_1
sf4_connect_breps_2 = sf4_connect_brep_left_2 + sf4_connect_brep_right_2


sf4_connect_breps_1_1 = sf4_connect_breps_1[0:len(sf4_connect_breps_1)-1]

sf4_connect_breps_2_1 = sf4_connect_breps_2[1:len(sf4_connect_breps_2)]

#
sf4_brep_trimed_g =sf4_brep_trimed_g[::-1]
sf4_brep_trimed_g_1 = sf4_brep_trimed_g[1:len(sf4_brep_trimed_g)-1]

#连接素枋和上边的泥道栱

sf4_brep_g_x = []
sf4_brep_g = []
for i in range(len(sf4_brep_trimed_g_1)):
    if i < ((len(sf4_brep_trimed_g_1)+1)/2):
        sufang_brep = rs.BooleanUnion([sf4_brep_trimed_g_1[i],sf4_connect_breps_1_1[i]],delete_input=False)[0]
    else:
        sufang_brep = rs.BooleanDifference(sf4_connect_breps_1_1[i],sf4_brep_trimed_g_1[i],delete_input=False)[0]
    
    sf4_brep_g_x.append(sufang_brep)





for i in range(len(sf4_brep_trimed_g_1)):
    if i < ((len(sf4_brep_trimed_g_1)+1)/2-1):
        sufang_brep = rs.BooleanDifference(sf4_connect_breps_2_1[i],sf4_brep_g_x[i],delete_input=False)[0]
    
    elif i == ((len(sf4_brep_trimed_g_1)+1)/2-1):
        sufang_brep = rs.BooleanUnion([sf4_brep_g_x[i],sf4_connect_breps_2_1[i]],delete_input=False)[0]

    else:
        sufang_brep = rs.BooleanDifference(sf4_brep_g_x[i],sf4_connect_breps_2_1[i],delete_input=False)[0]
    sf4_brep_g.append(sufang_brep)

sufang4_brep_first = rs.BooleanDifference(sf4_connect_breps_2[0],sf4_brep_trimed_g[0],delete_input = False)
sufang4_brep_last = rs.BooleanDifference(sf4_connect_breps_1[-1],sf4_brep_trimed_g[-1],delete_input = False)

sf4_brep_g.append(sufang4_brep_last[0])
sf4_brep_g.insert(0,sufang4_brep_first[0])


#平旗枋

pqf_brep_g = rs.MoveObjects(rs.CopyObjects(sf4_brep_g),(47 * x,0,0))

#第四层素枋后檐

sf4_brep_g_houyan = rs.MirrorObjects(sf4_brep_g,rs.MoveObject(rs.CopyObject(ZhuTou_point),(4 * j/2 * x,0,0)),rs.MoveObject(rs.CopyObject(ZhuTou_point),(4 * j/2 * x,x,0)),copy=True)

sf4_brep_g = sf4_brep_g + sf4_brep_g_houyan


#平旗枋后檐

pqf_brep_g_houyan = rs.MirrorObjects(pqf_brep_g,rs.MoveObject(rs.CopyObject(ZhuTou_point),(4 * j/2 * x,0,0)),rs.MoveObject(rs.CopyObject(ZhuTou_point),(4 * j/2 * x,x,0)),copy=True)

pqf_brep_g = pqf_brep_g + pqf_brep_g_houyan
# ---------- end python_3_script_12 ----------

# ----
brep_35 = Brep()
brep_36 = Brep()
brep_37 = Brep()
curve_16 = Curve()
python_3_script_13 = Python3Script(
    CaiFen=number_slider_2,
    HuaGong_CaiFen_left=number_slider_2,
    NiDaoGong_CaiFen_left=number_slider_16,
    NiDaoGong_CaiFen_right=number_slider_17)  # -> out, gzg_brep, gzg_gyy_1, gzg_mid_pt1, gzg_mid_pt3, gzg_mid_pt4, gzg_mid_pt2
# ---------- python_3_script_13: Python ----------
import rhinoscriptsyntax as rs
import Rhino.Geometry as rg
import itertools as it
x = CaiFen
#柱头点
ZhuTou_point = rs.AddPoint(HuaGong_CaiFen_left * x,5 *x,0)
#佛光寺大殿,令拱生成


if NiDaoGong_CaiFen_left !=  NiDaoGong_CaiFen_right:
    raise ValueError(f"两边必须一样长")

lg_pt_o = rs.CopyObject(ZhuTou_point)
if (NiDaoGong_CaiFen_left > 25) & (NiDaoGong_CaiFen_right > 25):
    rs.MoveObject(lg_pt_o,(0,(NiDaoGong_CaiFen_left - 3.5) * x,0))
else : raise ValueError(f"必须大于26分")

lg_pt_z1 = rs.CopyObject(lg_pt_o)
rs.MoveObject(lg_pt_z1,(0,0,9 * x))
lg_cr_z = rs.AddLine(lg_pt_o,lg_pt_z1)
lg_pt_y1 = rs.CopyObject(lg_pt_o)
rs.MoveObject(lg_pt_y1 ,(0,-20 * x,0))
lg_cr_y = rs.AddLine(lg_pt_y1,lg_pt_o)
div_cr_z =rs.DivideCurve(lg_cr_z,5)
div_cr_y =rs.DivideCurve(lg_cr_y,5)
#卷杀
CrossCurves_gzg = []
for i in range(len(div_cr_z)):
    divide_y = div_cr_y[i]
    divide_z = div_cr_z[i]
    CrossCurve_gzg = rs.AddLine(divide_y,divide_z)
    CrossCurves_gzg.append(CrossCurve_gzg)
CrossCurves_gzg = CrossCurves_gzg[1:len(CrossCurves_gzg)-1]
#选择交点
CrossCurves_points_gzg = []
for i in range(len(CrossCurves_gzg)):
    CrossCurves_point_gzg = rs.CurveCurveIntersection(CrossCurves_gzg[i],CrossCurves_gzg[i-1])[0][1]
    CrossCurves_points_gzg.append(CrossCurves_point_gzg)
CrossCurves_points_gzg = CrossCurves_points_gzg[1:len(CrossCurves_points_gzg)]
CrossCurves_points_gzg.insert(0,rs.CurveStartPoint(lg_cr_y))
CrossCurves_points_gzg.insert(len(CrossCurves_points_gzg)+1,rs.CurveEndPoint(lg_cr_z))
lg_pt_z2 = rs.CopyObject(lg_pt_z1)
rs.MoveObject(lg_pt_z2,(0,0, 6 * x))
lg_pt_z3 = rs.CopyObject(lg_pt_z2)
rs.MoveObject(lg_pt_z3,(0,-10 * x,0))
lg_pt_y_1 = rs.CopyObject(ZhuTou_point)
rs.MoveObject(lg_pt_y_1,(0,0,5 * x))
lg_pt_y_2 = rs.CopyObject(lg_pt_y_1)
rs.MoveObject(lg_pt_y_2,(0,4 * x,0))
lg_pt_y_3 = rs.CopyObject(lg_pt_y_2)
rs.MoveObject(lg_pt_y_3,(0,0,10 * x))
CrossCurves_points_gzg.append(lg_pt_z2)
CrossCurves_points_gzg.append(lg_pt_z3)
CrossCurves_points_lg_right = rs.MirrorObjects(CrossCurves_points_gzg,ZhuTou_point,rs.MoveObject(rs.CopyObject(ZhuTou_point),(x,0,x)),copy=True)
rs.MoveObjects(CrossCurves_points_lg_right,(0,(NiDaoGong_CaiFen_left - NiDaoGong_CaiFen_right) * x,0))
lg_mid_pt1 = rs.CopyObject(ZhuTou_point)
lg_mid_pt1 = rs.MoveObject(lg_mid_pt1,(0,-4 * x,15 * x))
lg_mid_pt4 = rs.CopyObject(ZhuTou_point)
lg_mid_pt4 = rs.MoveObject(lg_mid_pt4,(0,4 * x,15 * x))
lg_mid_pt2 = rs.CopyObject(lg_mid_pt1)
rs.MoveObject(lg_mid_pt2,(0,0,-10 * x))
lg_mid_pt3 = rs.CopyObject(lg_mid_pt2)
rs.MoveObject(lg_mid_pt3,(0,8 * x,0))

CrossCurves_points_gzg.insert(0,CrossCurves_points_lg_right[0])
CrossCurves_points_gzg.insert(0,CrossCurves_points_lg_right[1])
CrossCurves_points_gzg.insert(0,CrossCurves_points_lg_right[2])
CrossCurves_points_gzg.insert(0,CrossCurves_points_lg_right[3])
CrossCurves_points_gzg.insert(0,CrossCurves_points_lg_right[4])
CrossCurves_points_gzg.insert(0,CrossCurves_points_lg_right[5])
CrossCurves_points_gzg.insert(0,CrossCurves_points_lg_right[6])
CrossCurves_points_gzg.insert(0,lg_mid_pt1)
CrossCurves_points_gzg.insert(0,lg_mid_pt2)
CrossCurves_points_gzg.insert(0,lg_mid_pt3)
CrossCurves_points_gzg.insert(0,lg_mid_pt4)
lg_curve_left1 = rs.AddPolyline(CrossCurves_points_gzg)
lg_curve_left1 = rs.JoinCurves([lg_curve_left1,rs.AddLine(rs.CurveEndPoint(lg_curve_left1),rs.CurveStartPoint(lg_curve_left1))])
rs.MoveObject(lg_curve_left1,(5 *x,0,0))
lg_sr_left1 = rs.AddPlanarSrf(lg_curve_left1)

lg_brep = rs.ExtrudeSurface(lg_sr_left1,rs.AddLine(rs.AddPoint(0,0,0),rs.AddPoint(-10 * x,0,0)))

# 拱眼
lg_gyy_pt1 = rs.CopyObject(lg_pt_z3)
rs.MoveObject(lg_gyy_pt1,(-5 * x,0,x))
lg_gyy_pt2 = rs.CopyObject(lg_gyy_pt1)
rs.MoveObject(lg_gyy_pt2,(0,0,-2 * x))
lg_gyy_pt4 = rs.CopyObject(lg_mid_pt4)
rs.MoveObject(lg_gyy_pt4,(-5 * x, 1.625 * x,x))
lg_gyy_pt3 = rs.CopyObject(lg_gyy_pt4)
rs.MoveObject(lg_gyy_pt3,(0,0,-2 * x))
lg_gyy_cr1 = rs.AddLine(lg_gyy_pt1,lg_gyy_pt2)
lg_gyy_cr2 = rs.AddLine(lg_gyy_pt2,lg_gyy_pt3)
lg_gyy_cr3 = rs.AddLine(lg_gyy_pt3,lg_gyy_pt4)
lg_gyy_cr1 = rs.AddFilletCurve(lg_gyy_cr1,lg_gyy_cr2,x)
lg_gyy_cr2_1 = rs.AddFilletCurve(lg_gyy_cr3,lg_gyy_cr2,x)
lg_gyy_cr3 = rs.AddLine(rs.CurveEndPoint(lg_gyy_cr1),rs.CurveEndPoint(lg_gyy_cr2_1))
lg_gyy_cr4 = rs.AddLine(rs.CurveStartPoint(lg_gyy_cr1),rs.MoveObject(rs.CopyObject(lg_gyy_pt1),(0,0,x)))
lg_gyy_cr5 = rs.AddLine(rs.CurveStartPoint(lg_gyy_cr2_1),rs.MoveObject(rs.CopyObject(lg_gyy_pt4),(0,0,x)))
lg_gyy_1 =rs.JoinCurves([lg_gyy_cr1,lg_gyy_cr2_1,lg_gyy_cr3,lg_gyy_cr4,lg_gyy_cr5])
lg_gyy_1 =rs.JoinCurves([lg_gyy_1,rs.AddLine(rs.CurveStartPoint(lg_gyy_1),rs.CurveEndPoint(lg_gyy_1))])
lg_gyy_sr = rs.AddPlanarSrf(lg_gyy_1)
rs.MoveObject(lg_gyy_sr,(0,0,0))
lg_gyy_1_1= rs.MoveObject(rs.CopyObject(lg_gyy_1),(5 * x,0 , x))
rs.ScaleObject(lg_gyy_1_1,rs.CurveMidPoint(lg_gyy_cr2),[1,0.5,1])
lg_gyy_1 =rs.AddLoftSrf([lg_gyy_1,lg_gyy_1_1])
lg_gyy_2 =rs.MirrorObject(lg_gyy_1,ZhuTou_point,rs.MoveObject(rs.CopyObject(ZhuTou_point),(x,0,0)),copy=True)
lg_gyy_3 =rs.MirrorObject(lg_gyy_1,ZhuTou_point,rs.MoveObject(rs.CopyObject(ZhuTou_point),(0,x,0)),copy=True)
lg_gyy_4 =rs.MirrorObject(lg_gyy_2,ZhuTou_point,rs.MoveObject(rs.CopyObject(ZhuTou_point),(0,x,0)),copy=True)
rs.CapPlanarHoles(lg_gyy_1)
lg_brep = rs.BooleanDifference(lg_brep,lg_gyy_1)
lg_brep = rs.BooleanDifference(lg_brep,lg_gyy_2)
lg_brep = rs.BooleanDifference(lg_brep,lg_gyy_3)
lg_brep = rs.BooleanDifference(lg_brep,lg_gyy_4)
# ---------- end python_3_script_13 ----------

number_slider_26 = Slider(-1, range=-1..0)
brep_38 = Brep()

brep_39 = Brep()
point_4 = Point()
brep_40 = Brep()
brep_41 = Brep()

# ----
# 进深方向横向构件-外檐
python_3_script_14 = Python3Script(
    CaiFen=number_slider_2,
    HuaGong_CaiFen_left=number_slider_13,
    HuaGong_CaiFen_right=number_slider_11,
    NiDaoGong_CaiFen_left=number_slider_14,
    NiDaoGong_CaiFen_right=number_slider_14,
    MianKuo=number_slider_3)  # -> out, gyb_jinshen_waiyan_g
# ---------- python_3_script_14: Python ----------
#佛光寺东大殿柱基
#每一跳为21分
import rhinoscriptsyntax as rs
import Rhino.Geometry as rg
import itertools as it
#材分可调变量x
x = CaiFen
#柱头点
ZhuTou_point = rs.AddPoint(HuaGong_CaiFen_left * x,5 *x,0)
#原点
BasePoint = 0
pt_o = rs.AddPoint(BasePoint * 500,0,0)
#进深为14倍材广,一材广为15材分(j的单位为分)
j = 14 * 15
MianKuo_length = 16 * 15

#   面扩七开间，五进深,明间为16倍材广为240分，除了尽间，面阔皆为240分，尽间面扩为210分。进深开间 = 尽间开间也为210分
if (MianKuo % 2 == 0) | (MianKuo < 5):
    raise ValueError(f"开间最小数不能低于5,且为单数")

zhu_pt1 = rs.CopyObject(ZhuTou_point)
rs.MoveObject(zhu_pt1,(0,j * x,0))
zhu_pt2 = rs.CopyObject(zhu_pt1,(0,MianKuo_length * (MianKuo - 2) * x,0))
zhu_cr = rs.AddLine(zhu_pt1,zhu_pt2)
zhutou_pt = rs.DivideCurve(zhu_cr,MianKuo-2)
zhu_pt3 = rs.CopyObject(ZhuTou_point)
zhu_pt4 =rs.MoveObject(rs.CopyObject(zhutou_pt[-1]),(0, j * x,0))
zhutou_pt.insert(0,zhu_pt3)
zhutou_pt.append(zhu_pt4)
zhutou_pt2 = rs.MoveObjects(rs.CopyObjects(zhutou_pt),(j * x,0,0))

zhutou_pt3 = rs.MoveObjects(rs.CopyObjects(zhutou_pt2[0:2] ),(j * x,0,0))

zhutou_pt3_1 = rs.MoveObjects(rs.CopyObjects(zhutou_pt2[len(zhutou_pt2)-2:len(zhutou_pt2)] ),(j * x,0,0))

zhutou_pt3 = zhutou_pt3 + zhutou_pt3_1

zhutou_pt4 = rs.MoveObjects(rs.CopyObjects(zhutou_pt2),(2 * j * x,0,0))

zhutou_pt5 = rs.MoveObjects(rs.CopyObjects(zhutou_pt2),(3 * j * x,0,0))


#柱高
#当心间的柱高为237.5分

#生起的规律

zhutou_pt_up =rs.CopyObjects(zhutou_pt)
rs.MoveObjects(zhutou_pt_up,(0,0,237.5 * x))

zhutou_pt_up2 =rs.CopyObjects(zhutou_pt2)
rs.MoveObjects(zhutou_pt_up2,(0,0,237.5 * x))

zhutou_pt_up3 =rs.CopyObjects(zhutou_pt3)
rs.MoveObjects(zhutou_pt_up3,(0,0,237.5 * x))

if MianKuo > 5:
    #前檐
    rs.MoveObjects([zhutou_pt_up[0],zhutou_pt_up[-1]],(0,0,10.5 * x))
    rs.MoveObjects([zhutou_pt_up[1],zhutou_pt_up[-2]],(0,0,6 * x))
    rs.MoveObjects([zhutou_pt_up[2],zhutou_pt_up[-3]],(0,0,2.5 * x))
    #内檐
    rs.MoveObjects([zhutou_pt_up2[0],zhutou_pt_up2[-1]],(0,0,7.5 * x))
    rs.MoveObjects([zhutou_pt_up2[1],zhutou_pt_up2[-2]],(0,0,5 * x))
    rs.MoveObjects([zhutou_pt_up2[2],zhutou_pt_up2[-3]],(0,0,2.5 * x))
    #中柱
    rs.MoveObjects([zhutou_pt_up3[1],zhutou_pt_up3[-2]],(0,0, 2.5* x))
 
else: 
    #前檐
    rs.MoveObjects([zhutou_pt_up[0],zhutou_pt_up[-1]],(0,0,6 * x))
    rs.MoveObjects([zhutou_pt_up[1],zhutou_pt_up[-2]],(0,0,2.5 * x))
    #内檐
    rs.MoveObjects([zhutou_pt_up2[0],zhutou_pt_up2[-1]],(0,0,5 * x))
    rs.MoveObjects([zhutou_pt_up2[1],zhutou_pt_up2[-2]],(0,0,2.5 * x))



zhutou_pt_up4 = rs.CopyObjects(zhutou_pt_up2,(2 * j * x,0,0))
zhutou_pt_up5 = rs.CopyObjects(zhutou_pt_up,(4 * j * x,0,0))

# 生起曲线
le_brep_trimed_g_3 = []
shan_mian_pt_up = [zhutou_pt_up[0],zhutou_pt_up2[0],zhutou_pt_up3[0],zhutou_pt_up4[0],zhutou_pt_up5[0]]
le_trimed2_3 = rs.CopyObjects(shan_mian_pt_up[0:len(zhutou_pt_up)-1])
rs.MoveObjects(le_trimed2_3,((NiDaoGong_CaiFen_left+2) * x,0,0))
le_trimed1_3 = rs.CopyObjects(shan_mian_pt_up[1:len(zhutou_pt_up)])
rs.MoveObjects(le_trimed1_3,(-(NiDaoGong_CaiFen_left+2) * x,0,0))
sq_cr_3 = rs.AddInterpCurve(shan_mian_pt_up)
sq_sr_3 = rs.ExtrudeCurve(sq_cr_3,rs.AddLine(rs.AddPoint(0,0,0),rs.AddPoint(0,5 * x,0)))
for i in range(len(le_trimed1_3)):
    cr1_3 = rs.AddLine(le_trimed1_3[i],le_trimed2_3[i])
    rs.MoveObject(cr1_3,(0,4 * x,21 * x))
    cr1_3 = rs.ProjectCurveToSurface(cr1_3,sq_sr_3,[0,0,x])

    le_brep_3 = rs.ExtrudeCurve(cr1_3,rs.AddLine(rs.AddPoint(0,0,0),rs.AddPoint(0,-10 * x ,0)))
    le_brep_3 = rs.ExtrudeSurface(le_brep_3,rs.AddLine(rs.AddPoint(0,0,0),rs.AddPoint(0 ,0,-14.5 * x)))
    
    le_brep_trimed_3 = rs.ExtrudeCurve(cr1_3,rs.AddLine(rs.AddPoint(0,0,0),rs.AddPoint(0,-8 * x ,0)))
    le_brep_trimed_3 = rs.ExtrudeSurface(le_brep_trimed_3,rs.AddLine(rs.AddPoint(0,0,0),rs.AddPoint(0 ,0,-15 * x)))
    rs.MoveObject(le_brep_trimed_3,(0,0,5 * x))
    le_brep_trimed_g_3.append(le_brep_trimed_3)
rs.MoveObjects(le_brep_trimed_g_3,(0,0,44.5 * x))

#佛光寺东大殿散斗

x = CaiFen
#散斗,深12分,广10分,华拱/散斗.深10分,广12分,泥道栱
sd_pt_o = rs.AddPoint(0,0,0)
sd_pt2 = rs.AddPoint(10 * x,0,0)
sd_pt_z1 = rs.AddPoint(- 2 * x,0, 4 * x)
sd_cr_1 = rs.AddLine(sd_pt_o,sd_pt_z1)
#散斗,欹
sd_pt_z2 = rs.CurveMidPoint(sd_cr_1)
direction_left = (x, 0, 2 * x)  # 任意方向向量 
distance = 0.5 * x # 移动距离 
# 单位化方向向量并计算实际位移 
unit_vector_left = rs.VectorUnitize(direction_left)
displacement_left = rs.VectorScale(unit_vector_left, distance)
rs.MoveObject(sd_pt_z2, displacement_left)
sd_cr_1 = rs.AddCurve([sd_pt_o,sd_pt_z2,sd_pt_z1])
sd_pt_3 = rs.MoveObject(rs.CopyObject(sd_pt_o),(0,2 * x,0))
sd_sr1 = rs.AddLine(sd_pt_3,rs.MoveObject(rs.CopyObject(sd_pt_3),(-2 * x,-2 * x,0)))
sd_sr1 = rs.AddLoftSrf([sd_sr1,rs.MoveObject(rs.CopyObject(sd_sr1),(0,0,4* x))])
sd_cr_1 =rs.ProjectCurveToSurface(sd_cr_1,sd_sr1,[0,1,0])
sd_cr_2 = rs.MoveObject(rs.CopyObject(sd_cr_1),(0,10 * x,0 ))
sd_cr_2 = rs.RotateObject(sd_cr_2, rs.CurveStartPoint(sd_cr_2),-90,[0,0,1],copy=True)
sd_cr_3 = rs.MoveObject(rs.CopyObject(sd_cr_2),(10 * x,0,0 ))
sd_cr_3 = rs.RotateObject(sd_cr_3, rs.CurveStartPoint(sd_cr_3),-90,[0,0,1],copy=True)
sd_cr_4 = rs.MoveObject(rs.CopyObject(sd_cr_1),(10 * x,0,0 ))
sd_cr_4 = rs.RotateObject(sd_cr_4, rs.CurveStartPoint(sd_cr_4),90,[0,0,1],copy=True)
sd_down_Brep = rs.AddLoftSrf([sd_cr_1,sd_cr_2,sd_cr_3,sd_cr_4],loft_type=2,closed=True)
rs.CapPlanarHoles(sd_down_Brep)
#散斗,平
sd_sr2 = rs.ExplodePolysurfaces(sd_down_Brep)
sd_sr2 = sd_sr2[2]
sd_mid_Brep = rs.ExtrudeSurface(sd_sr2,rs.AddLine(rs.CurveEndPoint(sd_cr_2),rs.MoveObject(rs.CurveEndPoint(sd_cr_2),(0,0,2 * x))))
sd_sr3_curve= rs.DuplicateEdgeCurves(sd_mid_Brep)[9]
sd_sr3 = rs.AddLoftSrf([sd_sr3_curve,rs.MoveObject(rs.CopyObject(sd_sr3_curve),(0,-2 * x,0))])
sd_source_point = rs.SurfaceAreaCentroid(rs.ExplodePolysurfaces(sd_down_Brep)[1])[0]
sd_up_brep1 = rs.ExtrudeSurface(sd_sr3,rs.AddLine(sd_pt_o,rs.MoveObject(rs.CopyObject(sd_pt_o),(0,0,3.5* x))))
sd_up_brep2 =rs.CopyObject(sd_up_brep1)
rs.MoveObject(sd_up_brep2,(0, -12 * x ,0))


SanDou_up = rs.BooleanDifference(sd_mid_Brep,sd_up_brep2,delete_input=False)
SanDou_up = rs.BooleanDifference(SanDou_up,sd_up_brep1,delete_input=False)
SanDou = rs.BooleanDifference(SanDou_up,sd_down_Brep,delete_input=False)

#散斗被馒头榫剪切
mts_sandou = rs.ExplodePolysurfaces(SanDou)[16]
mts_sandou = rs.CurveEndPoint(rs.DuplicateEdgeCurves(mts_sandou)[0])
rs.MoveObject(mts_sandou,(3.75 * x,3.75 * x,0))
mts_sandou = rs.AddLine(mts_sandou,rs.MoveObject(rs.CopyObject(mts_sandou),(0,2.5 * x,0)))
mts_sandou = rs.ExtrudeCurve(mts_sandou,rs.AddLine(rs.AddPoint(0,0,0),rs.AddPoint(2.5 * x,0,0)))
mts_sandou = rs.ExtrudeSurface(mts_sandou,rs.AddLine(rs.AddPoint(0,0,0),rs.AddPoint(0,0,2.5 * x)))

SanDou = rs.BooleanUnion([SanDou,mts_sandou],delete_input=False)
rs.RotateObject(SanDou,rs.MoveObject(rs.CopyObject(ZhuTou_point),(-(HuaGong_CaiFen_left-5) * x,2 * x,0)),0,[0,0,x],copy=False)

#佛光寺东大殿散斗_华拱

x = CaiFen
#散斗,深12分,广10分,华拱/散斗.深10分,广12分,泥道栱
sd_hg_pt_o = rs.AddPoint(0,0,0)
sd_hg_pt2 = rs.AddPoint(10 * x,0,0)
sd_hg_pt_z1 = rs.AddPoint(- 2 * x,0, 4 * x)
sd_hg_cr_1 = rs.AddLine(sd_hg_pt_o,sd_hg_pt_z1)
#散斗,欹
sd_hg_pt_z2 = rs.CurveMidPoint(sd_hg_cr_1)
direction_left = (x, 0, 2 * x)  # 任意方向向量 
distance = 0.5 * x # 移动距离 
# 单位化方向向量并计算实际位移 
unit_vector_left = rs.VectorUnitize(direction_left)
displacement_left = rs.VectorScale(unit_vector_left, distance)
rs.MoveObject(sd_hg_pt_z2, displacement_left)
sd_hg_cr_1 = rs.AddCurve([sd_hg_pt_o,sd_hg_pt_z2,sd_hg_pt_z1])
sd_hg_pt_3 = rs.MoveObject(rs.CopyObject(sd_hg_pt_o),(0,2 * x,0))
sd_hg_sr1 = rs.AddLine(sd_hg_pt_3,rs.MoveObject(rs.CopyObject(sd_hg_pt_3),(-2 * x,-2 * x,0)))
sd_hg_sr1 = rs.AddLoftSrf([sd_hg_sr1,rs.MoveObject(rs.CopyObject(sd_hg_sr1),(0,0,4* x))])
sd_hg_cr_1 =rs.ProjectCurveToSurface(sd_hg_cr_1,sd_hg_sr1,[0,1,0])
sd_hg_cr_2 = rs.MoveObject(rs.CopyObject(sd_hg_cr_1),(0,10 * x,0 ))
sd_hg_cr_2 = rs.RotateObject(sd_hg_cr_2, rs.CurveStartPoint(sd_hg_cr_2),-90,[0,0,1],copy=True)
sd_hg_cr_3 = rs.MoveObject(rs.CopyObject(sd_hg_cr_2),(12 * x,0,0 ))
sd_hg_cr_3 = rs.RotateObject(sd_hg_cr_3, rs.CurveStartPoint(sd_hg_cr_3),-90,[0,0,1],copy=True)
sd_hg_cr_4 = rs.MoveObject(rs.CopyObject(sd_hg_cr_1),(12 * x,0,0 ))
sd_hg_cr_4 = rs.RotateObject(sd_hg_cr_4, rs.CurveStartPoint(sd_hg_cr_4),90,[0,0,1],copy=True)
sd_hg_down_Brep = rs.AddLoftSrf([sd_hg_cr_1,sd_hg_cr_2,sd_hg_cr_3,sd_hg_cr_4],loft_type=2,closed=True)
rs.CapPlanarHoles(sd_hg_down_Brep)
#散斗,平
sd_hg_sr2 = rs.ExplodePolysurfaces(sd_hg_down_Brep)
sd_hg_sr2 = sd_hg_sr2[2]
sd_hg_mid_Brep = rs.ExtrudeSurface(sd_hg_sr2,rs.AddLine(rs.CurveEndPoint(sd_hg_cr_2),rs.MoveObject(rs.CurveEndPoint(sd_hg_cr_2),(0,0,2 * x))))
sd_hg_sr3_curve= rs.DuplicateEdgeCurves(sd_hg_mid_Brep)[9]
sd_hg_sr3 = rs.AddLoftSrf([sd_hg_sr3_curve,rs.MoveObject(rs.CopyObject(sd_hg_sr3_curve),(0,-2 * x,0))])
sd_hg_source_point = rs.SurfaceAreaCentroid(rs.ExplodePolysurfaces(sd_hg_down_Brep)[1])[0]
sd_hg_up_brep1 = rs.ExtrudeSurface(sd_hg_sr3,rs.AddLine(sd_hg_pt_o,rs.MoveObject(rs.CopyObject(sd_hg_pt_o),(0,0,3.5* x))))
sd_hg_up_brep2 =rs.CopyObject(sd_hg_up_brep1)
rs.MoveObject(sd_hg_up_brep2,(0, -12 * x ,0))


SanDou_hg_up = rs.BooleanDifference(sd_hg_mid_Brep,sd_hg_up_brep2,delete_input=False)
SanDou_hg_up = rs.BooleanDifference(SanDou_hg_up,sd_hg_up_brep1,delete_input=False)
SanDou_hg = rs.BooleanDifference(SanDou_hg_up,sd_hg_down_Brep,delete_input=False)

#散斗被馒头榫剪切
mts_SanDou_hg_hg = rs.ExplodePolysurfaces(SanDou_hg)[16]
mts_SanDou_hg_hg = rs.CurveEndPoint(rs.DuplicateEdgeCurves(mts_SanDou_hg_hg)[0])
rs.MoveObject(mts_SanDou_hg_hg,(4.75 * x,3.75 * x,0))
mts_SanDou_hg_hg = rs.AddLine(mts_SanDou_hg_hg,rs.MoveObject(rs.CopyObject(mts_SanDou_hg_hg),(0,2.5 * x,0)))
mts_SanDou_hg_hg = rs.ExtrudeCurve(mts_SanDou_hg_hg,rs.AddLine(rs.AddPoint(0,0,0),rs.AddPoint(2.5 * x,0,0)))
mts_SanDou_hg_hg = rs.ExtrudeSurface(mts_SanDou_hg_hg,rs.AddLine(rs.AddPoint(0,0,0),rs.AddPoint(0,0,2.5 * x)))

SanDou_hg = rs.BooleanUnion([SanDou_hg,mts_SanDou_hg_hg],delete_input=False)
SanDou_hg_jingshen = rs.CopyObject(SanDou_hg)
rs.RotateObject(SanDou_hg,rs.MoveObject(rs.CopyObject(ZhuTou_point),(-(HuaGong_CaiFen_left-6) * x,2 * x,0)),90,[0,0,x],copy=False)

##佛光寺东大殿横向枋生成
if NiDaoGong_CaiFen_left != NiDaoGong_CaiFen_right:
    raise ValueError(f"两边必须一样长")

sf1_pt_o = rs.CopyObject(ZhuTou_point)
if (NiDaoGong_CaiFen_left > 25) & (NiDaoGong_CaiFen_right > 25):
    rs.MoveObject(sf1_pt_o,(0,(NiDaoGong_CaiFen_left+22) * x,0))
else : raise ValueError(f"必须大于26分")

sf1_pt_z1 = rs.CopyObject(sf1_pt_o)
rs.MoveObject(sf1_pt_z1,(0,0,9 * x))
sf1_cr_z = rs.AddLine(sf1_pt_o,sf1_pt_z1)
sf1_pt_y1 = rs.CopyObject(sf1_pt_o)
rs.MoveObject(sf1_pt_y1 ,(0,-12 * x,0))
sf1_cr_y = rs.AddLine(sf1_pt_y1,sf1_pt_o)
div_cr_z =rs.DivideCurve(sf1_cr_z,5)
div_cr_y =rs.DivideCurve(sf1_cr_y,5)
#卷杀
CrossCurves_sf1 = []
for i in range(len(div_cr_z)):
    divide_y = div_cr_y[i]
    divide_z = div_cr_z[i]
    CrossCurve_sf1 = rs.AddLine(divide_y,divide_z)
    CrossCurves_sf1.append(CrossCurve_sf1)
CrossCurves_sf1 = CrossCurves_sf1[1:len(CrossCurves_sf1)-1]
#选择交点
CrossCurves_points_sf1 = []
for i in range(len(CrossCurves_sf1)):
    CrossCurves_point_sf1 = rs.CurveCurveIntersection(CrossCurves_sf1[i],CrossCurves_sf1[i-1])[0][1]
    CrossCurves_points_sf1.append(CrossCurves_point_sf1)
CrossCurves_points_sf1 = CrossCurves_points_sf1[1:len(CrossCurves_points_sf1)]
CrossCurves_points_sf1.insert(0,rs.CurveStartPoint(sf1_cr_y))
CrossCurves_points_sf1.insert(len(CrossCurves_points_sf1)+1,rs.CurveEndPoint(sf1_cr_z))
sf1_pt_z2 = rs.CopyObject(sf1_pt_z1)
rs.MoveObject(sf1_pt_z2,(0,0, 6 * x))
sf1_pt_z3 = rs.CopyObject(sf1_pt_z2)
rs.MoveObject(sf1_pt_z3,(0,-10 * x,0))
sf1_pt_y_1 = rs.CopyObject(ZhuTou_point)
rs.MoveObject(sf1_pt_y_1,(0,0,5 * x))
sf1_pt_y_2 = rs.CopyObject(sf1_pt_y_1)
rs.MoveObject(sf1_pt_y_2,(0,4 * x,0))
sf1_pt_y_3 = rs.CopyObject(sf1_pt_y_2)
rs.MoveObject(sf1_pt_y_3,(0,0,10 * x))
CrossCurves_points_sf1.append(sf1_pt_z2)
CrossCurves_points_sf1.append(sf1_pt_z3)
CrossCurves_points_sf1_right = rs.MirrorObjects(CrossCurves_points_sf1,ZhuTou_point,rs.MoveObject(rs.CopyObject(ZhuTou_point),(x,0,x)),copy=True)
rs.MoveObjects(CrossCurves_points_sf1_right,(0,(NiDaoGong_CaiFen_left - NiDaoGong_CaiFen_right) * x,0))
sf1_mid_pt1 = rs.CopyObject(ZhuTou_point)
sf1_mid_pt1 = rs.MoveObject(sf1_mid_pt1,(0,-4 * x,15 * x))
sf1_mid_pt4 = rs.CopyObject(ZhuTou_point)
sf1_mid_pt4 = rs.MoveObject(sf1_mid_pt4,(0,4 * x,15 * x))
sf1_mid_pt2 = rs.CopyObject(sf1_mid_pt1)
rs.MoveObject(sf1_mid_pt2,(0,0,-10 * x))
sf1_mid_pt3 = rs.CopyObject(sf1_mid_pt2)
rs.MoveObject(sf1_mid_pt3,(0,8 * x,0))
CrossCurves_points_sf1.insert(0,CrossCurves_points_sf1_right[0])
CrossCurves_points_sf1.insert(0,CrossCurves_points_sf1_right[1])
CrossCurves_points_sf1.insert(0,CrossCurves_points_sf1_right[2])
CrossCurves_points_sf1.insert(0,CrossCurves_points_sf1_right[3])
CrossCurves_points_sf1.insert(0,CrossCurves_points_sf1_right[4])
CrossCurves_points_sf1.insert(0,CrossCurves_points_sf1_right[5])
CrossCurves_points_sf1.insert(0,CrossCurves_points_sf1_right[6])
CrossCurves_points_sf1.insert(0,sf1_mid_pt1)
CrossCurves_points_sf1.insert(0,sf1_mid_pt2)
CrossCurves_points_sf1.insert(0,sf1_mid_pt3)
CrossCurves_points_sf1.insert(0,sf1_mid_pt4)
sf1_curve_left1 = rs.AddPolyline(CrossCurves_points_sf1)
sf1_curve_left1 = rs.JoinCurves([sf1_curve_left1,rs.AddLine(rs.CurveEndPoint(sf1_curve_left1),rs.CurveStartPoint(sf1_curve_left1))])
rs.MoveObject(sf1_curve_left1,(5 *x,0,0))




sf1_sr_left1 = rs.AddPlanarSrf(sf1_curve_left1)


sf1_brep = rs.ExtrudeSurface(sf1_sr_left1,rs.AddLine(rs.AddPoint(0,0,0),rs.AddPoint(-10 * x,0,0)))

# 拱眼
sf1_gyy_pt1 = rs.CopyObject(sf1_pt_z3)
rs.MoveObject(sf1_gyy_pt1,(-5 * x,0,x))
sf1_gyy_pt2 = rs.CopyObject(sf1_gyy_pt1)
rs.MoveObject(sf1_gyy_pt2,(0,0,-2 * x))
sf1_gyy_pt4 = rs.CopyObject(sf1_mid_pt4)
rs.MoveObject(sf1_gyy_pt4,(-5 * x, 1.625 * x,x))
sf1_gyy_pt3 = rs.CopyObject(sf1_gyy_pt4)
rs.MoveObject(sf1_gyy_pt3,(0,0,-2 * x))
sf1_gyy_cr1 = rs.AddLine(sf1_gyy_pt1,sf1_gyy_pt2)
sf1_gyy_cr2 = rs.AddLine(sf1_gyy_pt2,sf1_gyy_pt3)
sf1_gyy_cr3 = rs.AddLine(sf1_gyy_pt3,sf1_gyy_pt4)
sf1_gyy_cr1 = rs.AddFilletCurve(sf1_gyy_cr1,sf1_gyy_cr2,x)
sf1_gyy_cr2 = rs.AddFilletCurve(sf1_gyy_cr3,sf1_gyy_cr2,x)
sf1_gyy_cr3 = rs.AddLine(rs.CurveEndPoint(sf1_gyy_cr1),rs.CurveEndPoint(sf1_gyy_cr2))
sf1_gyy_cr4 = rs.AddLine(rs.CurveStartPoint(sf1_gyy_cr1),rs.MoveObject(rs.CopyObject(sf1_gyy_pt1),(0,0,x)))
sf1_gyy_cr5 = rs.AddLine(rs.CurveStartPoint(sf1_gyy_cr2),rs.MoveObject(rs.CopyObject(sf1_gyy_pt4),(0,0,x)))
sf1_gyy_1 =rs.JoinCurves([sf1_gyy_cr1,sf1_gyy_cr2,sf1_gyy_cr3,sf1_gyy_cr4,sf1_gyy_cr5])
sf1_gyy_1 =rs.JoinCurves([sf1_gyy_1,rs.AddLine(rs.CurveStartPoint(sf1_gyy_1),rs.CurveEndPoint(sf1_gyy_1))])
rs.MoveObject(sf1_gyy_1,(-x,0,0)) 
sf1_gyy_1 = rs.AddPlanarSrf(sf1_gyy_1)
sf1_gyy_1 = rs.ExtrudeSurface(sf1_gyy_1,rs.AddLine(ZhuTou_point,rs.MoveObject(rs.CopyObject(ZhuTou_point),(2 * x,0,0))))
sf1_gyy_2 = rs.MirrorObject(sf1_gyy_1,ZhuTou_point,rs.MoveObject(rs.CopyObject(ZhuTou_point),(0,x,0)),copy=True)
sf1_gyy_3 = rs.MirrorObject(sf1_gyy_1,ZhuTou_point,rs.MoveObject(rs.CopyObject(ZhuTou_point),(x,0,0)),copy=True)
sf1_gyy_4 = rs.MirrorObject(sf1_gyy_2,ZhuTou_point,rs.MoveObject(rs.CopyObject(ZhuTou_point),(x,0,0)),copy=True)
sf1_brep = rs.BooleanDifference(sf1_brep,sf1_gyy_1)
sf1_brep = rs.BooleanDifference(sf1_brep,sf1_gyy_2)
sf1_brep = rs.BooleanDifference(sf1_brep,sf1_gyy_3)
sf1_brep = rs.BooleanDifference(sf1_brep,sf1_gyy_4)

#素枋的馒头榫生成
mts_sf1 = rs.ExplodePolysurfaces(sf1_brep)[15]
mts_sf1 = rs.CurveEndPoint(rs.DuplicateEdgeCurves(mts_sf1)[0])
rs.MoveObject(mts_sf1,(-3.75 * x,-3.75 * x,0))
mts1_sf1 = rs.AddLine(mts_sf1,rs.MoveObject(rs.CopyObject(mts_sf1),(-2.5 * x,0,0)))
mts1_sf1 = rs.ExtrudeCurve(mts1_sf1,rs.AddLine(rs.AddPoint(0,0,0),rs.AddPoint(0,-2.5 * x,0)))
mts1_sf1 = rs.ExtrudeSurface(mts1_sf1,rs.AddLine(rs.AddPoint(0,0,0),rs.AddPoint(0,0,2.5 * x)))
mts1_sf2 = rs.MirrorObject(mts1_sf1,ZhuTou_point,rs.MoveObject(rs.CopyObject(ZhuTou_point),(x,0,0)),copy=True)

sf1_brep = rs.BooleanDifference(mts1_sf1,sf1_brep,delete_input=False)

sf1_brep = rs.BooleanIntersection(sf1_brep,mts1_sf2,delete_input=True)


#素枋被泥道栱的插销剪切

sf_2_cx_sf1 = rs.ExplodePolysurfaces(sf1_brep)[14]
sf_2_cx_sf1 = rs.CurveEndPoint(rs.DuplicateEdgeCurves(sf_2_cx_sf1)[0])
rs.MoveObject(sf_2_cx_sf1,(-3.75 * x,-3.75 * x,0))
sf_2_cx1_sf1 = rs.AddLine(sf_2_cx_sf1,rs.MoveObject(rs.CopyObject(sf_2_cx_sf1),(-2.5 * x,0,0)))
sf_2_cx1_sf1 = rs.ExtrudeCurve(sf_2_cx1_sf1,rs.AddLine(rs.AddPoint(0,0,0),rs.AddPoint(0,-4 * x,0)))
sf_2_cx1_sf1 = rs.ExtrudeSurface(sf_2_cx1_sf1,rs.AddLine(rs.AddPoint(0,0,0),rs.AddPoint(0,0,4 * x)))
rs.MoveObject(sf_2_cx1_sf1,(0,-(NiDaoGong_CaiFen_left-8) * x,0))

sf_2_cx2_sf1 = rs.MirrorObject(sf_2_cx1_sf1,ZhuTou_point,rs.MoveObject(rs.CopyObject(ZhuTou_point),(x,0,0)),copy=True)

sf1_brep = rs.BooleanDifference(sf_2_cx1_sf1,sf1_brep,delete_input=False)
sf1_brep = rs.BooleanIntersection(sf_2_cx2_sf1,sf1_brep,delete_input=False)
sf1_brep_jinshen = rs.CopyObject(sf1_brep)

#素枋从中间剪切
sf_trimed = rs.AddLine(ZhuTou_point,rs.MoveObject(rs.CopyObject(ZhuTou_point),(0,145 * x,0)))
rs.MoveObject(sf_trimed,(-10 * x,0,0))
sf_trimed = rs.ExtrudeCurve(sf_trimed,rs.AddLine(rs.AddPoint(0,0,0),rs.AddPoint(20 * x,0,0)))
sf_trimed = rs.ExtrudeSurface(sf_trimed,rs.AddLine(rs.AddPoint(0,0,0),rs.AddPoint(0,0,20 * x)))

sf1_brep1 = rs.BooleanDifference(sf1_brep,sf_trimed,delete_input = False)
sf1_brep2 = rs.MirrorObject(sf1_brep1,ZhuTou_point,rs.MoveObject(rs.CopyObject(ZhuTou_point),(x,0,0)),copy=True)
#连接处螳螂榫做法
tls_1 = rs.ExplodePolysurfaces(sf1_brep1)[5]
tls_1 = rs.CurveEndPoint(rs.DuplicateEdgeCurves(tls_1)[1])
rs.MoveObject(tls_1,(3 * x,0,0))

tls_1 = rs.AddLine(tls_1,rs.MoveObject(rs.CopyObject(tls_1),(4 * x,0,0)))
tls_1 = rs.ExtrudeCurve(tls_1,rs.AddLine(rs.AddPoint(0,0,0),rs.AddPoint(0,4 * x,0)))
tls_1 = rs.ExtrudeSurface(tls_1,rs.AddLine(rs.AddPoint(0,0,0),rs.AddPoint(0,0,-5 * x)))
tls_2 = rs.ExplodePolysurfaces(tls_1)[3]
tls_2 = rs.ExtrudeSurface(tls_2,rs.AddLine(rs.AddPoint(0,0,0),rs.AddPoint(0,1 * x,0)))
rs.ScaleObject(tls_2,ZhuTou_point,[1,1,3],copy=False)
tls_3 = rs.ExplodePolysurfaces(tls_2)[5]
rs.ScaleObject(tls_3,ZhuTou_point,[1.4,1,1],copy=False)
tls_3_1 = rs.CopyObject(tls_3)
rs.ScaleObject(tls_3_1,ZhuTou_point,[0.6,1,1],copy=False)
rs.MoveObject(tls_3_1,(0,4 * x))
tls_3 = rs.AddLoftSrf([rs.JoinCurves(rs.DuplicateEdgeCurves(tls_3)),rs.JoinCurves(rs.DuplicateEdgeCurves(tls_3_1))])
rs.CapPlanarHoles(tls_3)
tls = rs.BooleanDifference(tls_2,tls_1,delete_input=True)
tls = rs.BooleanDifference(tls,tls_3,delete_input=True)

sf1_brep1 = rs.BooleanDifference(tls,sf1_brep1,delete_input=False)
sf1_brep2 = rs.BooleanIntersection(sf1_brep2,sf1_brep1,delete_input=False)

sf4_connect_brep1 = rs.CopyObject(sf1_brep1)

sf4_connect_brep2 = rs.CopyObject(sf1_brep2)

sf1_breps = [sf1_brep2[0],sf1_brep1[0]]



sf2_breps = rs.CopyObjects(sf1_breps)
sf2_breps = sf2_breps[::-1]





rs.RotateObject(sf1_breps,ZhuTou_point,90,[0,0,x],copy=False)

rs.MoveObjects(sf1_breps,(j * x,0,259.5 * x + 21 * x))

sf1_breps_2 = rs.MoveObjects(rs.CopyObjects(sf1_breps),(j*x,0,-7.5 * x))

sf1_breps_3 = rs.MoveObjects(rs.CopyObjects(sf1_breps),(2 * j*x,0,0))

sf1_breps = sf1_breps + sf1_breps_2 + sf1_breps_3


sf1_breps_first = rs.BooleanUnion([le_brep_trimed_g_3[0],sf1_breps[0]],delete_input=False)

sf1_breps_last = rs.BooleanDifference(sf1_breps[-1],le_brep_trimed_g_3[-1],delete_input=False)

sf1_breps_2 = rs.BooleanDifference(sf1_breps[1],le_brep_trimed_g_3[1],delete_input=False)

sf1_breps_2 = rs.BooleanDifference(sf1_breps_2,sf1_breps[2],delete_input=False)

sf1_breps_3 = rs.BooleanDifference(sf1_breps[3],le_brep_trimed_g_3[2],delete_input=False)

sf1_breps_3 = rs.BooleanDifference(sf1_breps_3,sf1_breps[4],delete_input=False)

sf1_breps_g = sf1_breps_first + sf1_breps_2 + sf1_breps_3 + sf1_breps_last

#泥道栱
if NiDaoGong_CaiFen_left != NiDaoGong_CaiFen_right:
    raise ValueError(f"两边必须一样长")

ndg_bj1_pt_o = rs.CopyObject(ZhuTou_point)
if (NiDaoGong_CaiFen_left > 25) & (NiDaoGong_CaiFen_right > 25):
    rs.MoveObject(ndg_bj1_pt_o,(0,(NiDaoGong_CaiFen_left) * x,0))
else : raise ValueError(f"必须大于26分")

ndg_bj1_pt_z1 = rs.CopyObject(ndg_bj1_pt_o)
rs.MoveObject(ndg_bj1_pt_z1,(0,0,9 * x))
ndg_bj1_cr_z = rs.AddLine(ndg_bj1_pt_o,ndg_bj1_pt_z1)
ndg_bj1_pt_y1 = rs.CopyObject(ndg_bj1_pt_o)
rs.MoveObject(ndg_bj1_pt_y1 ,(0,-12 * x,0))
ndg_bj1_cr_y = rs.AddLine(ndg_bj1_pt_y1,ndg_bj1_pt_o)
div_cr_z =rs.DivideCurve(ndg_bj1_cr_z,5)
div_cr_y =rs.DivideCurve(ndg_bj1_cr_y,5)
#卷杀
CrossCurves_ndg_bj1 = []
for i in range(len(div_cr_z)):
    divide_y = div_cr_y[i]
    divide_z = div_cr_z[i]
    CrossCurve_ndg_bj1 = rs.AddLine(divide_y,divide_z)
    CrossCurves_ndg_bj1.append(CrossCurve_ndg_bj1)
CrossCurves_ndg_bj1 = CrossCurves_ndg_bj1[1:len(CrossCurves_ndg_bj1)-1]
#选择交点
CrossCurves_points_ndg_bj1 = []
for i in range(len(CrossCurves_ndg_bj1)):
    CrossCurves_point_ndg_bj1 = rs.CurveCurveIntersection(CrossCurves_ndg_bj1[i],CrossCurves_ndg_bj1[i-1])[0][1]
    CrossCurves_points_ndg_bj1.append(CrossCurves_point_ndg_bj1)
CrossCurves_points_ndg_bj1 = CrossCurves_points_ndg_bj1[1:len(CrossCurves_points_ndg_bj1)]
CrossCurves_points_ndg_bj1.insert(0,rs.CurveStartPoint(ndg_bj1_cr_y))
CrossCurves_points_ndg_bj1.insert(len(CrossCurves_points_ndg_bj1)+1,rs.CurveEndPoint(ndg_bj1_cr_z))
ndg_bj1_pt_z2 = rs.CopyObject(ndg_bj1_pt_z1)
rs.MoveObject(ndg_bj1_pt_z2,(0,0, 6 * x))
ndg_bj1_pt_z3 = rs.CopyObject(ndg_bj1_pt_z2)
rs.MoveObject(ndg_bj1_pt_z3,(0,-10 * x,0))
ndg_bj1_pt_y_1 = rs.CopyObject(ZhuTou_point)
rs.MoveObject(ndg_bj1_pt_y_1,(0,0,5 * x))
ndg_bj1_pt_y_2 = rs.CopyObject(ndg_bj1_pt_y_1)
rs.MoveObject(ndg_bj1_pt_y_2,(0,4 * x,0))
ndg_bj1_pt_y_3 = rs.CopyObject(ndg_bj1_pt_y_2)
rs.MoveObject(ndg_bj1_pt_y_3,(0,0,10 * x))
CrossCurves_points_ndg_bj1.append(ndg_bj1_pt_z2)
CrossCurves_points_ndg_bj1.append(ndg_bj1_pt_z3)
CrossCurves_points_ndg_bj1_right = rs.MirrorObjects(CrossCurves_points_ndg_bj1,ZhuTou_point,rs.MoveObject(rs.CopyObject(ZhuTou_point),(x,0,x)),copy=True)
rs.MoveObjects(CrossCurves_points_ndg_bj1_right,(0,(NiDaoGong_CaiFen_left - NiDaoGong_CaiFen_right) * x,0))
ndg_bj1_mid_pt1 = rs.CopyObject(ZhuTou_point)
ndg_bj1_mid_pt1 = rs.MoveObject(ndg_bj1_mid_pt1,(0,-4 * x,15 * x))
ndg_bj1_mid_pt4 = rs.CopyObject(ZhuTou_point)
ndg_bj1_mid_pt4 = rs.MoveObject(ndg_bj1_mid_pt4,(0,4 * x,15 * x))
ndg_bj1_mid_pt2 = rs.CopyObject(ndg_bj1_mid_pt1)
rs.MoveObject(ndg_bj1_mid_pt2,(0,0,-10 * x))
ndg_bj1_mid_pt3 = rs.CopyObject(ndg_bj1_mid_pt2)
rs.MoveObject(ndg_bj1_mid_pt3,(0,8 * x,0))
CrossCurves_points_ndg_bj1.insert(0,CrossCurves_points_ndg_bj1_right[0])
CrossCurves_points_ndg_bj1.insert(0,CrossCurves_points_ndg_bj1_right[1])
CrossCurves_points_ndg_bj1.insert(0,CrossCurves_points_ndg_bj1_right[2])
CrossCurves_points_ndg_bj1.insert(0,CrossCurves_points_ndg_bj1_right[3])
CrossCurves_points_ndg_bj1.insert(0,CrossCurves_points_ndg_bj1_right[4])
CrossCurves_points_ndg_bj1.insert(0,CrossCurves_points_ndg_bj1_right[5])
CrossCurves_points_ndg_bj1.insert(0,CrossCurves_points_ndg_bj1_right[6])
CrossCurves_points_ndg_bj1.insert(0,ndg_bj1_mid_pt1)
CrossCurves_points_ndg_bj1.insert(0,ndg_bj1_mid_pt2)
CrossCurves_points_ndg_bj1.insert(0,ndg_bj1_mid_pt3)
CrossCurves_points_ndg_bj1.insert(0,ndg_bj1_mid_pt4)
ndg_bj1_curve_left1 = rs.AddPolyline(CrossCurves_points_ndg_bj1)
ndg_bj1_curve_left1 = rs.JoinCurves([ndg_bj1_curve_left1,rs.AddLine(rs.CurveEndPoint(ndg_bj1_curve_left1),rs.CurveStartPoint(ndg_bj1_curve_left1))])
rs.MoveObject(ndg_bj1_curve_left1,(5 *x,0,0))




ndg_bj1_sr_left1 = rs.AddPlanarSrf(ndg_bj1_curve_left1)


ndg_bj1_brep = rs.ExtrudeSurface(ndg_bj1_sr_left1,rs.AddLine(rs.AddPoint(0,0,0),rs.AddPoint(-10 * x,0,0)))

# 拱眼
ndg_bj1_gyy_pt1 = rs.CopyObject(ndg_bj1_pt_z3)
rs.MoveObject(ndg_bj1_gyy_pt1,(-5 * x,0,x))
ndg_bj1_gyy_pt2 = rs.CopyObject(ndg_bj1_gyy_pt1)
rs.MoveObject(ndg_bj1_gyy_pt2,(0,0,-2 * x))
ndg_bj1_gyy_pt4 = rs.CopyObject(ndg_bj1_mid_pt4)
rs.MoveObject(ndg_bj1_gyy_pt4,(-5 * x, 1.625 * x,x))
ndg_bj1_gyy_pt3 = rs.CopyObject(ndg_bj1_gyy_pt4)
rs.MoveObject(ndg_bj1_gyy_pt3,(0,0,-2 * x))
ndg_bj1_gyy_cr1 = rs.AddLine(ndg_bj1_gyy_pt1,ndg_bj1_gyy_pt2)
ndg_bj1_gyy_cr2 = rs.AddLine(ndg_bj1_gyy_pt2,ndg_bj1_gyy_pt3)
ndg_bj1_gyy_cr3 = rs.AddLine(ndg_bj1_gyy_pt3,ndg_bj1_gyy_pt4)
ndg_bj1_gyy_cr1 = rs.AddFilletCurve(ndg_bj1_gyy_cr1,ndg_bj1_gyy_cr2,x)
ndg_bj1_gyy_cr2 = rs.AddFilletCurve(ndg_bj1_gyy_cr3,ndg_bj1_gyy_cr2,x)
ndg_bj1_gyy_cr3 = rs.AddLine(rs.CurveEndPoint(ndg_bj1_gyy_cr1),rs.CurveEndPoint(ndg_bj1_gyy_cr2))
ndg_bj1_gyy_cr4 = rs.AddLine(rs.CurveStartPoint(ndg_bj1_gyy_cr1),rs.MoveObject(rs.CopyObject(ndg_bj1_gyy_pt1),(0,0,x)))
ndg_bj1_gyy_cr5 = rs.AddLine(rs.CurveStartPoint(ndg_bj1_gyy_cr2),rs.MoveObject(rs.CopyObject(ndg_bj1_gyy_pt4),(0,0,x)))
ndg_bj1_gyy_1 =rs.JoinCurves([ndg_bj1_gyy_cr1,ndg_bj1_gyy_cr2,ndg_bj1_gyy_cr3,ndg_bj1_gyy_cr4,ndg_bj1_gyy_cr5])
ndg_bj1_gyy_1 =rs.JoinCurves([ndg_bj1_gyy_1,rs.AddLine(rs.CurveStartPoint(ndg_bj1_gyy_1),rs.CurveEndPoint(ndg_bj1_gyy_1))])
rs.MoveObject(ndg_bj1_gyy_1,(-x,0,0)) 
ndg_bj1_gyy_1 = rs.AddPlanarSrf(ndg_bj1_gyy_1)
ndg_bj1_gyy_1 = rs.ExtrudeSurface(ndg_bj1_gyy_1,rs.AddLine(ZhuTou_point,rs.MoveObject(rs.CopyObject(ZhuTou_point),(2 * x,0,0))))
ndg_bj1_gyy_2 = rs.MirrorObject(ndg_bj1_gyy_1,ZhuTou_point,rs.MoveObject(rs.CopyObject(ZhuTou_point),(0,x,0)),copy=True)
ndg_bj1_gyy_3 = rs.MirrorObject(ndg_bj1_gyy_1,ZhuTou_point,rs.MoveObject(rs.CopyObject(ZhuTou_point),(x,0,0)),copy=True)
ndg_bj1_gyy_4 = rs.MirrorObject(ndg_bj1_gyy_2,ZhuTou_point,rs.MoveObject(rs.CopyObject(ZhuTou_point),(x,0,0)),copy=True)
ndg_bj1_brep = rs.BooleanDifference(ndg_bj1_brep,ndg_bj1_gyy_1)
ndg_bj1_brep = rs.BooleanDifference(ndg_bj1_brep,ndg_bj1_gyy_2)
ndg_bj1_brep = rs.BooleanDifference(ndg_bj1_brep,ndg_bj1_gyy_3)
ndg_bj1_brep = rs.BooleanDifference(ndg_bj1_brep,ndg_bj1_gyy_4)

#素枋的馒头榫生成
mts_ndg_bj1 = rs.ExplodePolysurfaces(ndg_bj1_brep)[15]
mts_ndg_bj1 = rs.CurveEndPoint(rs.DuplicateEdgeCurves(mts_ndg_bj1)[0])
rs.MoveObject(mts_ndg_bj1,(-3.75 * x,-3.75 * x,0))
mts1_ndg_bj1 = rs.AddLine(mts_ndg_bj1,rs.MoveObject(rs.CopyObject(mts_ndg_bj1),(-2.5 * x,0,0)))
mts1_ndg_bj1 = rs.ExtrudeCurve(mts1_ndg_bj1,rs.AddLine(rs.AddPoint(0,0,0),rs.AddPoint(0,-2.5 * x,0)))
mts1_ndg_bj1 = rs.ExtrudeSurface(mts1_ndg_bj1,rs.AddLine(rs.AddPoint(0,0,0),rs.AddPoint(0,0,2.5 * x)))
mts1_ndg_bj2 = rs.MirrorObject(mts1_ndg_bj1,ZhuTou_point,rs.MoveObject(rs.CopyObject(ZhuTou_point),(x,0,0)),copy=True)

ndg_bj1_brep = rs.BooleanDifference(mts1_ndg_bj1,ndg_bj1_brep,delete_input=False)

ndg_bj1_brep = rs.BooleanIntersection(ndg_bj1_brep,mts1_ndg_bj2,delete_input=False)

ndg_bj2_brep = rs.CopyObject(ndg_bj1_brep)

rs.RotateObject(ndg_bj2_brep,ZhuTou_point,0,[0,0,x],copy=False)
#素枋被泥道栱的插销剪切

ndg_bj_2_cx_ndg_bj1 = rs.ExplodePolysurfaces(ndg_bj1_brep)[14]
ndg_bj_2_cx_ndg_bj1 = rs.CurveEndPoint(rs.DuplicateEdgeCurves(ndg_bj_2_cx_ndg_bj1)[0])
rs.MoveObject(ndg_bj_2_cx_ndg_bj1,(-3.75 * x,-3.75 * x,0))
ndg_bj_2_cx1_ndg_bj1 = rs.AddLine(ndg_bj_2_cx_ndg_bj1,rs.MoveObject(rs.CopyObject(ndg_bj_2_cx_ndg_bj1),(-2.5 * x,0,0)))
ndg_bj_2_cx1_ndg_bj1 = rs.ExtrudeCurve(ndg_bj_2_cx1_ndg_bj1,rs.AddLine(rs.AddPoint(0,0,0),rs.AddPoint(0,-4 * x,0)))
ndg_bj_2_cx1_ndg_bj1 = rs.ExtrudeSurface(ndg_bj_2_cx1_ndg_bj1,rs.AddLine(rs.AddPoint(0,0,0),rs.AddPoint(0,0,4 * x)))
rs.MoveObject(ndg_bj_2_cx1_ndg_bj1,(0,-(NiDaoGong_CaiFen_left-8) * x,0))

ndg_bj_2_cx2_ndg_bj1 = rs.MirrorObject(ndg_bj_2_cx1_ndg_bj1,ZhuTou_point,rs.MoveObject(rs.CopyObject(ZhuTou_point),(x,0,0)),copy=True)

ndg_bj1_brep = rs.BooleanDifference(ndg_bj_2_cx1_ndg_bj1,ndg_bj1_brep,delete_input=False)
ndg_bj1_brep = rs.BooleanIntersection(ndg_bj_2_cx2_ndg_bj1,ndg_bj1_brep,delete_input=False)
ndg_bj1_brep_jinshen = rs.CopyObject(ndg_bj1_brep)

rs.RotateObject(ndg_bj1_brep,ZhuTou_point,90,[0,0,x],copy=False)
ndg_bj1_brep1 = rs.MoveObject(rs.CopyObject(ndg_bj1_brep) ,( j * x/2,0,262.5 * x +21 * x -1.5 * x))

ndg_bj1_brep2 = rs.MoveObject(rs.CopyObject(ndg_bj1_brep) ,( j * x + j * x/2,0,262.5 * x - 3 * x +21 * x -3.75 * x))

ndg_bj1_brep3 = rs.MoveObject(rs.CopyObject(ndg_bj1_brep2) ,( j * x,0,0))
ndg_bj1_brep4 = rs.MoveObject(rs.CopyObject(ndg_bj1_brep1) ,( j * x * 3,0,0))

sf1_brep_1 = rs.BooleanUnion([ndg_bj1_brep1,sf1_breps_g[0]],delete_input=False)
sf1_brep_2 = rs.BooleanDifference(sf1_breps_g[1],ndg_bj1_brep2,delete_input=False)
sf1_brep_3 = rs.BooleanDifference(sf1_breps_g[2],ndg_bj1_brep3,delete_input=False)
sf1_brep_4 = rs.BooleanDifference(sf1_breps_g[3],ndg_bj1_brep4,delete_input=False)

sf1_breps_g = sf1_brep_1 + sf1_brep_2 + sf1_brep_3 + sf1_brep_4




#转角铺作泥道拱生成

#原点
BasePoint = 0
pt_o = rs.AddPoint(BasePoint * 500,0,0)
#卷杀结束y点
pt_1 = rs.AddPoint(BasePoint * 500,0,9 * x)
#卷杀结束x点
pt_2 = rs.AddPoint(BasePoint * 500 + 16 * x, 0 ,0)
#生成要进行拆分的曲线
curve_x = rs.AddLine(pt_2,pt_o)
curve_y = rs.AddLine(pt_o,pt_1)
#拆分曲线生成点
divide_curve_x_points = rs.DivideCurve(curve_x,5)
divide_curve_y_points = rs.DivideCurve(curve_y,5)
#卷杀
CrossCurves = []
for i in range(len(divide_curve_x_points)):
    divide_x = divide_curve_x_points[i]
    divide_y = divide_curve_y_points[i]
    CrossCurve = rs.AddLine(divide_x,divide_y)
    CrossCurves.append(CrossCurve)
CrossCurves = CrossCurves[1:len(CrossCurves)-1]
#选择交点
CrossCurves_points = []
for i in range(len(CrossCurves)):
    CrossCurves_point = rs.CurveCurveIntersection(CrossCurves[i],CrossCurves[i-1])[0][1]
    CrossCurves_points.append(CrossCurves_point)
CrossCurves_points = CrossCurves_points[1:len(CrossCurves_points)]
CrossCurves_points.insert(0,rs.CurveStartPoint(curve_x))
CrossCurves_points.insert(len(CrossCurves_points)+1,rs.CurveEndPoint(curve_y))
#卷杀线
JuanSha_curve = rs.AddPolyline(CrossCurves_points)
pt_3z = rs.CopyObject(pt_1)
rs.MoveObject(pt_3z,(0,0,6 * x))
pt_4z = rs.CopyObject(pt_3z)
rs.MoveObject(pt_4z,(12 * x,0,0))
pt_3x = rs.CopyObject(pt_2)
if HuaGong_CaiFen_left > 25:
    rs.MoveObject(pt_3x,((HuaGong_CaiFen_left - 16 /2 - 16) * x ,0,0))
pt_4x = rs.CopyObject(pt_3x)
#中间材，材广为16.5分
zjc_pt1 = rs.CopyObject(pt_3x)
zjc_pt1 = rs.MoveObject(zjc_pt1,(16 * x,0,0))
zjc_curve = rs.AddLine(pt_3x,zjc_pt1)
#右边斗拱的线
pt_3x_right = rs.CopyObject(zjc_pt1)
pt_2x_right = rs.CopyObject(zjc_pt1)
if HuaGong_CaiFen_right > 25:
    rs.MoveObject(pt_2x_right,((HuaGong_CaiFen_right - 16 - 16/2) * x,0,0))
else: rs.MoveObject(pt_2x_right,(0,0,0))
#卷杀结束x点
pt_1_right = rs.CopyObject(pt_2x_right)
rs.MoveObject(pt_1_right,(16 * x,0,0))
pt_2_right = rs.CopyObject(pt_1_right)
rs.MoveObject(pt_2_right,(0,0,9 * x))
curve_x_right = rs.AddLine(pt_2x_right,pt_1_right)
curve_y_right = rs.AddLine(pt_1_right,pt_2_right)
#拆分曲线生成点
divide_curve_x_points_right = rs.DivideCurve(curve_x_right,5)
divide_curve_y_points_right = rs.DivideCurve(curve_y_right,5)
#卷杀
CrossCurves_right = []
for i in range(len(divide_curve_x_points_right)):
    divide_x = divide_curve_x_points_right[i]
    divide_y = divide_curve_y_points_right[i]
    CrossCurve_right = rs.AddLine(divide_x,divide_y)
    CrossCurves_right.append(CrossCurve_right)
del CrossCurves_right[-1]
del CrossCurves_right[0]
CrossCurves_points_right = []
for i in range(len(CrossCurves_right)):
    CrossCurves_point_right = rs.CurveCurveIntersection(CrossCurves_right[i],CrossCurves_right[i-1])[0][1]
    CrossCurves_points_right.append(CrossCurves_point_right)
CrossCurves_points_right = CrossCurves_points_right[1:len(CrossCurves_points_right)]
pt_3x_right = rs.CopyObject(CrossCurves_points_right[0])
pt_4x_right = rs.CopyObject(CrossCurves_points_right[1])
pt_5x_right = rs.CopyObject(CrossCurves_points_right[2])
pt_3z_right = rs.CopyObject(pt_2_right)
rs.MoveObject(pt_3z_right,(0,0,6 * x))
pt_4z_right = rs.CopyObject(pt_3z_right)
rs.MoveObject(pt_4z_right,(-12 * x,0,0))
#华拱下弧线
CrossCurves_points.append(pt_3z)
CrossCurves_points.append(pt_4z)
CrossCurves_points.insert(0,pt_3x)
CrossCurves_points.insert(0,pt_4x)
CrossCurves_points.insert(0,pt_2x_right)
CrossCurves_points.insert(0,pt_3x_right)
CrossCurves_points.insert(0,pt_4x_right)
CrossCurves_points.insert(0,pt_5x_right)
CrossCurves_points.insert(0,pt_2_right)
CrossCurves_points.insert(0,pt_3z_right)
CrossCurves_points.insert(0,pt_4z_right)
JuanSha_curve = rs.AddPolyline(CrossCurves_points)
#欹幽
#左
qa_left_2 = rs.CopyObject(pt_4z)
rs.MoveObject(qa_left_2,(2 * x,0,4 * x))
qa_curve_left_1 = rs.AddLine(pt_4z,qa_left_2)

qa_left_3 = rs.CurveMidPoint(qa_curve_left_1)
direction_left = (-x, 0, 2 * x)  # 任意方向向量 
distance = 0.5 * x # 移动距离 
# 单位化方向向量并计算实际位移 
unit_vector_left = rs.VectorUnitize(direction_left)
displacement_left = rs.VectorScale(unit_vector_left, distance)
rs.MoveObject(qa_left_3, displacement_left)
qa_curve_left_1 = rs.AddCurve([pt_4z,qa_left_3,qa_left_2])
#欹幽
#右
qa_right_2 = rs.CopyObject(pt_4z_right)
rs.MoveObject(qa_right_2,(-2 * x,0,4 * x))
qa_curve_right_1 = rs.AddLine(pt_4z_right,qa_right_2)

qa_right_3 = rs.CurveMidPoint(qa_curve_right_1)
direction_right = (x, 0, 2 * x)  # 任意方向向量 
distance = 0.5 * x # 移动距离 
# 单位化方向向量并计算实际位移 
unit_vector_right = rs.VectorUnitize(direction_right)
displacement_right = rs.VectorScale(unit_vector_right, distance)
rs.MoveObject(qa_right_3, displacement_right)
qa_curve_right_1 = rs.AddCurve([pt_4z_right,qa_right_3,qa_right_2])
#拱眼上部
gy_left_up_1 = rs.CopyObject(qa_left_2)
rs.MoveObject(gy_left_up_1,(0,0,2 * x))
gy_right_up_1 = rs.CopyObject(qa_right_2)
rs.MoveObject(gy_right_up_1,(0,0,2 * x))
gy_up_curve = rs.AddPolyline([qa_left_2,gy_left_up_1,gy_right_up_1,qa_right_2])
#华拱未剪切前
HuaGong_untrimed = rs.JoinCurves([JuanSha_curve,qa_curve_left_1,qa_curve_right_1,gy_up_curve ])
HuaGong_untrimed = rs.AddPlanarSrf(HuaGong_untrimed)
extrude_curve1 = rs.AddLine(pt_o,rs.MoveObject(rs.CopyObject(pt_o),(0,10 * x,0)))
HuaGong_untrimed = rs.ExtrudeSurface(HuaGong_untrimed,extrude_curve1)
#剪切斗拱下部
#斗拱下部 广16分,厚为5分
HuaGong_dowm_curve = rs.AddLine(pt_3x,zjc_pt1)
HuaGong_dowm_curve2 =rs.CopyObject(HuaGong_dowm_curve)
rs.MoveObject(HuaGong_dowm_curve2,(0,0,5 * x))
HuaGong_dowm = rs.AddLoftSrf([HuaGong_dowm_curve,HuaGong_dowm_curve2])
HuaGong_dowm = rs.ExtrudeSurface(HuaGong_dowm,extrude_curve1)
rs.ScaleObject(HuaGong_dowm,ZhuTou_point,[10/16,1,1],copy=False)
HuaGong = rs.BooleanDifference(HuaGong_dowm,HuaGong_untrimed,delete_input = False)
#剪切斗拱中部
#斗拱下部 广10分,厚为10.125分
HuaGong_mid_curve_pt1 = rs.CopyObject(rs.CurveStartPoint(HuaGong_dowm_curve2))
rs.MoveObject(HuaGong_mid_curve_pt1,(3 * x,0,0))
HuaGong_mid_curve_pt2 = rs.CopyObject(HuaGong_mid_curve_pt1)
rs.MoveObject(HuaGong_mid_curve_pt2,(10 * x,0,0))
HuaGong_mid_curve1 = rs.AddLine(HuaGong_mid_curve_pt1,HuaGong_mid_curve_pt2)
HuaGong_mid_curve2 =rs.CopyObject(HuaGong_mid_curve1)
rs.MoveObject(HuaGong_mid_curve2,(0,0,10* x))
HuaGong_mid = rs.AddLoftSrf([HuaGong_mid_curve1,HuaGong_mid_curve2])
rs.MoveObject(HuaGong_mid,(0,1 * x,0))
extrude_curve2 = rs.AddLine(HuaGong_mid_curve_pt1,rs.MoveObject(rs.CopyObject(HuaGong_mid_curve_pt1),(0,-1 *x,0)))
HuaGong_mid = rs.ExtrudeSurface(HuaGong_mid,extrude_curve2)
HuaGong_mid2 =rs.CopyObject(HuaGong_mid)
rs.MoveObject(HuaGong_mid2,(0,9 * x,0))
HuaGong_mid = [HuaGong_mid,HuaGong_mid2]
HuaGong = rs.BooleanDifference(HuaGong,HuaGong_mid,delete_input = False)
#剪切拱眼
#左
gy_left_pt_1 = rs.CopyObject(rs.CurveStartPoint(HuaGong_mid_curve2))
rs.MoveObject(gy_left_pt_1,(-1.75/2 * x,0,0))
gy_right_pt_1 = rs.CopyObject(rs.CurveEndPoint(HuaGong_mid_curve2))
rs.MoveObject(gy_right_pt_1,(1.75/2 * x,0,0))


qa_left_2_2 = rs.CopyObject(gy_left_pt_1)
rs.MoveObject(qa_left_2_2,(-2 * x,0,4 * x))
qa_curve_left_1_2 = rs.AddLine(gy_left_pt_1,qa_left_2_2)

qa_left_3_2 = rs.CurveMidPoint(qa_curve_left_1_2)
direction_left_2 = (x, 0, 2 * x)  # 任意方向向量 
distance = 0.5 * x # 移动距离 
# 单位化方向向量并计算实际位移 
unit_vector_left_2 = rs.VectorUnitize(direction_left_2)
displacement_left_2 = rs.VectorScale(unit_vector_left_2, distance)
rs.MoveObject(qa_left_3_2, displacement_left_2)
qa_curve_left_1_2 = rs.AddCurve([gy_left_pt_1,qa_left_3_2,qa_left_2_2])


qa_right_2_2 = rs.CopyObject(gy_right_pt_1)
rs.MoveObject(qa_right_2_2,(2 * x,0,4 * x))
qa_curve_right_1_2 = rs.AddLine(gy_right_pt_1,qa_right_2_2)
qa_right_3_2 = rs.CurveMidPoint(qa_curve_right_1_2)
direction_right_2 = (-x, 0, 2 * x)  # 任意方向向量 
distance = 0.5 * x # 移动距离 
# 单位化方向向量并计算实际位移 
unit_vector_right_2 = rs.VectorUnitize(direction_right_2)
displacement_right_2 = rs.VectorScale(unit_vector_right_2, distance)
rs.MoveObject(qa_right_3_2, displacement_right_2)
qa_curve_right_1_2 = rs.AddCurve([gy_right_pt_1,qa_right_3_2,qa_right_2_2])

#拱眼出头
gy_up_1 = rs.CopyObject(qa_left_2_2)
rs.MoveObject(gy_up_1,(0,0,2 * x))
gy_up_2 = rs.CopyObject(qa_right_2_2)
rs.MoveObject(gy_up_2,(0,0,2 * x))
gy_curve_1_left = rs.AddLine(qa_left_2_2,gy_up_1)
gy_curve_1_right = rs.AddLine(qa_right_2_2,gy_up_2)

#拱眼隐去部深1分
#左
gy_y_l1 = rs.CopyObject(pt_4z)
rs.MoveObject(gy_y_l1,(0,0,-x))
gy_y_l2 = rs.CopyObject(gy_left_pt_1)
rs.MoveObject(gy_y_l2,(0,0,-x))
gy_y_curve = rs.AddPolyline([pt_4z,gy_y_l1,gy_y_l2,gy_left_pt_1])
gy_y_curve_1 = rs.AddFilletCurve(rs.AddLine(pt_4z,gy_y_l1),rs.AddLine(gy_y_l1,gy_y_l2),radius = x)
gy_y_curve_2 = rs.AddFilletCurve(rs.AddLine(gy_left_pt_1,gy_y_l2),rs.AddLine(gy_y_l2,gy_y_l1),radius = x)
gy_y_curve = rs.JoinCurves([gy_y_curve_1,rs.AddLine(rs.CurveEndPoint(gy_y_curve_1),rs.CurveEndPoint(gy_y_curve_2)),gy_y_curve_2])
#右
gy_y_r1 = rs.CopyObject(pt_4z_right)
rs.MoveObject(gy_y_r1,(0,0,-x))
gy_y_r2 = rs.CopyObject(gy_right_pt_1)
rs.MoveObject(gy_y_r2,(0,0,-x))
gy_y_curve_right = rs.AddPolyline([pt_4z_right,gy_y_r1,gy_y_l2,gy_right_pt_1])
gy_y_curve_1_right = rs.AddFilletCurve(rs.AddLine(pt_4z_right,gy_y_r1),rs.AddLine(gy_y_r1,gy_y_r2),radius = x)
gy_y_curve_2_right = rs.AddFilletCurve(rs.AddLine(gy_right_pt_1,gy_y_r2),rs.AddLine(gy_y_r2,gy_y_r1),radius = x)
gy_y_curve_right = rs.JoinCurves([gy_y_curve_1_right,rs.AddLine(rs.CurveEndPoint(gy_y_curve_1_right),rs.CurveEndPoint(gy_y_curve_2_right)),gy_y_curve_2_right])
#拱眼出头左
gy_ct_curve_left = rs.AddPolyline([qa_left_2,gy_left_up_1,gy_up_1,qa_left_2_2])
#拱眼出头右
gy_ct_curve_right = rs.AddPolyline([qa_right_2,gy_right_up_1,gy_up_2,qa_right_2_2])

gy_0 = rs.AddLine(qa_left_2,gy_left_up_1)
gy_1 = rs.JoinCurves([qa_curve_left_1,gy_0 ])
gy_2 = rs.CopyObject(gy_1)
rs.MoveObject(gy_2,(-x,0,0))
gy_3 = rs.AddLine(rs.CurveEndPoint(gy_1),rs.CurveEndPoint(gy_2))
gy_4 = rs.AddLine(rs.CurveStartPoint(gy_1),rs.CurveStartPoint(gy_2))
gy_5 = rs.AddPolyline([gy_left_up_1,gy_up_1,qa_left_2_2])
gy_0_r = rs.AddLine(qa_right_2,gy_right_up_1)
gy_1_r = rs.JoinCurves([qa_curve_right_1,gy_0_r ])
gy_2_r = rs.CopyObject(gy_1_r)
rs.MoveObject(gy_2_r,(x,0,0))
gy_3_r = rs.AddLine(rs.CurveEndPoint(gy_1_r),rs.CurveEndPoint(gy_2_r))
gy_4_r = rs.AddLine(rs.CurveStartPoint(gy_1_r),rs.CurveStartPoint(gy_2_r))
gy_5_r = rs.AddPolyline([gy_right_up_1,gy_up_2,qa_right_2_2])

gy_curve_left = rs.JoinCurves([gy_5,qa_curve_left_1_2,gy_y_curve,gy_2,gy_3,gy_4])
gy_curve_right = rs.JoinCurves([gy_5_r,qa_curve_right_1_2,gy_y_curve_right,gy_2_r,gy_3_r,gy_4_r])
gy_surface_left = rs.AddPlanarSrf(gy_curve_left)
gy_surface_right = rs.AddPlanarSrf(gy_curve_right)
extrude_curve3 = rs.AddLine(pt_o,rs.MoveObject(rs.CopyObject(pt_o),(0,x,0)))
gy_brep_left = rs.ExtrudeSurface(gy_surface_left,extrude_curve3)
gy_brep_right = rs.ExtrudeSurface(gy_surface_right,extrude_curve3)
gy_brep1 = gy_brep_left
gy_brep2 = gy_brep_right
gy_brep3 = rs.CopyObject(gy_brep1)
rs.MoveObjects(gy_brep3,(0,9 * x,0))
gy_brep4 = rs.CopyObject(gy_brep2)
rs.MoveObjects(gy_brep4,(0,9 * x,0))
HuaGong = rs.BooleanDifference(HuaGong,gy_brep2,delete_input = True)
HuaGong = rs.BooleanDifference(HuaGong,gy_brep4,delete_input = True)
HuaGong = rs.BooleanIntersection(gy_brep1,HuaGong,delete_input=True)
HuaGong = rs.BooleanIntersection(gy_brep3,HuaGong,delete_input=True)

#华拱上的馒头榫

mts_hg = rs.ExplodePolysurfaces(HuaGong)[56]
mts_hg = rs.CurveEndPoint(rs.DuplicateEdgeCurves(mts_hg)[2])
rs.MoveObject(mts_hg,(4.75 * x,3.75 * x,0))
mts_hg = rs.AddLine(mts_hg,rs.MoveObject(rs.CopyObject(mts_hg),(0,2.5 * x,0)))
mts_hg = rs.ExtrudeCurve(mts_hg,rs.AddLine(rs.AddPoint(0,0,0),rs.AddPoint(2.5 * x,0,0)))
mts_hg = rs.ExtrudeSurface(mts_hg,rs.AddLine(rs.AddPoint(0,0,0),rs.AddPoint(0,0,2.5 * x)))

mts_hg_1 = rs.MirrorObject(mts_hg,ZhuTou_point,rs.MoveObject(rs.CopyObject(ZhuTou_point),(0,x,0)),copy=True)


HuaGong = rs.BooleanUnion([mts_hg,HuaGong,mts_hg_1],delete_input=False)

HuaGong2_pj = rs.MoveObject(rs.CopyObject(HuaGong),(0,0,21 * x))



rs.RotateObject(HuaGong,ZhuTou_point,90,[0,0,x],copy=False)



hg1_bj1 = rs.MoveObject(rs.CopyObject(HuaGong) ,( j * x/2,0,262.5 * x +21 * x -1.5 * x))

hg1_bj2 = rs.MoveObject(rs.CopyObject(HuaGong) ,( j * x + j * x/2,0,262.5 * x - 3 * x +21 * x -3.75 * x))

hg1_bj3 = rs.MoveObject(rs.CopyObject(hg1_bj2) ,( j * x,0,0))
hg1_bj4 = rs.MoveObject(rs.CopyObject(hg1_bj1) ,( j * x * 3,0,0))

hg1_bj_g = [hg1_bj1 , hg1_bj2 , hg1_bj3 , hg1_bj4]

#第一层素枋被补间辅作第一跳华拱剪切

sf1_brep_1 = rs.BooleanDifference(sf1_breps_g[0],hg1_bj1,delete_input=False)
sf1_brep_2 = rs.BooleanUnion([hg1_bj2,sf1_breps_g[1]],delete_input=False)
sf1_brep_3 = rs.BooleanUnion([hg1_bj3,sf1_breps_g[2]],delete_input=False)
sf1_brep_4 = rs.BooleanUnion([hg1_bj4,sf1_breps_g[3]],delete_input=False)

sf1_breps_g = sf1_brep_1 + sf1_brep_2 + sf1_brep_3 + sf1_brep_4

#第一层素上的散斗

SanDou1_sf1 = rs.MoveObjects(rs.CopyObject(SanDou),(j * x- 21.5 * x,-2 * x,259.5 * x + 36 * x))
SanDou2_sf1 = rs.MoveObjects(rs.CopyObject(SanDou1_sf1),(NiDaoGong_CaiFen_left*x*2 + 34 * x,0,0))

SanDous_sf1 = [SanDou1_sf1[0],SanDou2_sf1[0]]
SanDous2_sf1 = rs.MoveObjects(rs.CopyObjects(SanDous_sf1),(j*x,0,-7.5 * x))
SanDous3_sf1 = rs.MoveObjects(rs.CopyObjects(SanDous_sf1),(j*x * 2,0,0))

SanDous_sf1_g = SanDous_sf1 + SanDous2_sf1 + SanDous3_sf1

#补间辅作第一层泥道栱上的散斗

SanDou1_ndg_bj1 = rs.MoveObjects(rs.CopyObject(SanDou),(j * x/2 + 0.5*x,-2 * x,261 * x + 36 * x))
SanDou2_ndg_bj1 = rs.MoveObjects(rs.CopyObject(SanDou1_ndg_bj1),(NiDaoGong_CaiFen_left*x*2-10 * x,0,0))

SanDous_ndg_bj1 = [SanDou1_ndg_bj1[0],SanDou2_ndg_bj1[0]]

SanDous_ndg_bj2 = rs.MoveObjects(rs.CopyObjects(SanDous_ndg_bj1) ,( j * x ,0,-5.25 * x))

SanDous_ndg_bj3 = rs.MoveObjects(rs.CopyObjects(SanDous_ndg_bj2) ,( j * x,0,0))
SanDous_ndg_bj4 = rs.MoveObjects(rs.CopyObjects(SanDous_ndg_bj1) ,( j * x * 3,0,0))

SanDous_ndg_g = SanDous_ndg_bj1 + SanDous_ndg_bj2 + SanDous_ndg_bj3 + SanDous_ndg_bj4

#补间辅作第一跳华拱上的散斗

rs.MoveObjects(SanDou_hg,(j * x/2 + NiDaoGong_CaiFen_left * x-5.5 * x,-2 * x + HuaGong_CaiFen_left*x-6*x,259.5 * x + 37.5 * x))

#补间辅作第一跳华拱上的交互斗

jhd_hg = rs.MirrorObject(SanDou_hg,ZhuTou_point,rs.MoveObject(rs.CopyObject(ZhuTou_point),(x,0,0)),copy=True)

#将散斗剪成交互斗

jhd_hg_trimed_brep = rs.ExplodePolysurfaces(jhd_hg)[6]
jhd_hg_trimed_brep = rs.CurveEndPoint(rs.DuplicateEdgeCurves(jhd_hg_trimed_brep)[0])
rs.MoveObject(jhd_hg_trimed_brep,(0,3 * x,0))

jhd_hg_trimed_brep = rs.AddLine(jhd_hg_trimed_brep,rs.MoveObject(rs.CopyObject(jhd_hg_trimed_brep),(15 * x,0,0)))
jhd_hg_trimed_brep = rs.ExtrudeCurve(jhd_hg_trimed_brep,rs.AddLine(rs.AddPoint(0,0,0),rs.AddPoint(0,10 * x,0)))
jhd_hg_trimed_brep = rs.ExtrudeSurface(jhd_hg_trimed_brep,rs.AddLine(rs.AddPoint(0,0,0),rs.AddPoint(0,0,10 * x)))
rs.MoveObject(jhd_hg_trimed_brep,(0,0,2 * x))
jhd_hg = rs.BooleanDifference(jhd_hg_trimed_brep,jhd_hg,delete_input=True)

#将散斗和交互斗组合一起

Dous1_hg1 = [jhd_hg[0],SanDou_hg[0]]


Dous2_hg1 = rs.MoveObjects(rs.CopyObjects(Dous1_hg1) ,( j * x ,0,-5.25 * x))

Dous3_hg1 = rs.MoveObjects(rs.CopyObjects(Dous2_hg1) ,( j * x,0,0))
Dous4_hg1 = rs.MoveObjects(rs.CopyObjects(Dous1_hg1) ,( j * x * 3,0,0))

Dous_hg_g = Dous1_hg1 + Dous2_hg1 + Dous3_hg1 + Dous4_hg1

#补间铺作第二跳华拱
#补间辅第二跳华拱

#加21分

HuaGong2_pj_trimed_brep = rs.ExplodePolysurfaces(HuaGong2_pj)[25]
HuaGong2_pj_trimed_brep = rs.CurveEndPoint(rs.DuplicateEdgeCurves(HuaGong2_pj_trimed_brep)[0])

HuaGong2_pj_trimed_brep = rs.AddLine(HuaGong2_pj_trimed_brep,rs.MoveObject(rs.CopyObject(HuaGong2_pj_trimed_brep),(0,10 * x,0)))
HuaGong2_pj_trimed_brep = rs.ExtrudeCurve(HuaGong2_pj_trimed_brep,rs.AddLine(rs.AddPoint(0,0,0),rs.AddPoint(x,0,0)))
HuaGong2_pj_trimed_brep = rs.ExtrudeSurface(HuaGong2_pj_trimed_brep,rs.AddLine(rs.AddPoint(0,0,0),rs.AddPoint(0,0,22 * x)))
HuaGong2_pj_trimed_brep2 = rs.MirrorObject(HuaGong2_pj_trimed_brep,ZhuTou_point,rs.MoveObject(rs.CopyObject(ZhuTou_point),(0,x,0)),copy=True)
HuaGong2_pj_head1 = rs.BooleanDifference(HuaGong2_pj,HuaGong2_pj_trimed_brep,delete_input=False)[1]
HuaGong2_pj_mid = rs.BooleanDifference(HuaGong2_pj,HuaGong2_pj_trimed_brep,delete_input=False)[0]

HuaGong2_pj_mid = rs.BooleanDifference(HuaGong2_pj_mid,HuaGong2_pj_trimed_brep2,delete_input=False)[1]

#将头和中间段连接
rs.MoveObject(HuaGong2_pj_head1,(-21 * x,0,0))
HuaGong2_pj_head1_1 = rs.ExplodePolysurfaces(HuaGong2_pj_head1)[18]
HuaGong2_pj_head1_1 = rs.ExtrudeSurface(HuaGong2_pj_head1_1,rs.AddLine(rs.AddPoint(0,0,0),rs.AddPoint(22 * x,0,0)))

HuaGong2_pj_head1 = rs.BooleanDifference(HuaGong2_pj_head1_1,HuaGong2_pj_head1,delete_input = False)
HuaGong2_pj_head2 = rs.MirrorObject(HuaGong2_pj_head1,ZhuTou_point,rs.MoveObject(rs.CopyObject(ZhuTou_point),(0,x,0)),copy=True)

HuaGong2_pj = rs.BooleanDifference(HuaGong2_pj_head1,HuaGong2_pj_mid,delete_input=False)
HuaGong2_pj = rs.BooleanIntersection(HuaGong2_pj_head2,HuaGong2_pj,delete_input=False)

rs.RotateObject(HuaGong2_pj,ZhuTou_point,90,[0,0,x],copy=False)



hg2_bj1 = rs.MoveObject(rs.CopyObject(HuaGong2_pj) ,( j * x/2,0,262.5 * x +21 * x -1.5 * x))

#翼形拱生成

yxg_pt0 = rs.CopyObject(ZhuTou_point)

yxg_pt1 = rs.MoveObject(rs.CopyObject(yxg_pt0),(0,0,10 * x))

yxg_pt2 = rs.MoveObject(rs.CopyObject(yxg_pt1),(0,0,2 * x))
yxg_pt3 = rs.MoveObject(rs.CopyObject(yxg_pt2),(0,-2 * x,0))
rs.MoveObject(yxg_pt2,(0,-x*0.6,-x*0.6))

yxg_pt4 = rs.MoveObject(rs.CopyObject(yxg_pt3),(0,-1.5 * x,x*0.4))

yxg_pt5 = rs.MoveObject(rs.CopyObject(yxg_pt4),(0,-1 * x,-x*0.2))

yxg_pt6 = rs.MoveObject(rs.CopyObject(yxg_pt5),(0,-1.25 * x,x*0.3))

yxg_pt7 = rs.MoveObject(rs.CopyObject(yxg_pt6),(0,-1 * x,-x*0.2))

yxg_pt8 = rs.MoveObject(rs.CopyObject(yxg_pt7),(0,-1 * x,x*0.1))

yxg_pt9 = rs.MoveObject(rs.CopyObject(yxg_pt8),(0,-1 * x,-x*0.3))

yxg_pt10 = rs.MoveObject(rs.CopyObject(yxg_pt9),(0,-3.5 * x,x*0.25))

yxg_pt11 = rs.MoveObject(rs.CopyObject(yxg_pt10),(0,-0.75 * x,-x*0.3))

yxg_pt12 = rs.MoveObject(rs.CopyObject(yxg_pt11),(0,-2.5 * x,-x*0.6))

yxg_pt13 = rs.MoveObject(rs.CopyObject(yxg_pt12),(0,-0.4 * x,-x*0.6))

yxg_pt14 = rs.MoveObject(rs.CopyObject(yxg_pt12),(0,-0.3 * x,-x*1.5))

yxg_pt15 = rs.MoveObject(rs.CopyObject(yxg_pt14),(0,-0.3 * x,-x*0.75))

yxg_pt16 = rs.MoveObject(rs.CopyObject(yxg_pt15),(0,0.3 * x,-x*2))

yxg_pt17 = rs.MoveObject(rs.CopyObject(yxg_pt16),(0, 0,-x*0.75))

yxg_pt18 = rs.MoveObject(rs.CopyObject(yxg_pt17),(0,1 * x,-x*1.25))

yxg_pt19 = rs.MoveObject(rs.CopyObject(yxg_pt18),(0, 1 * x,-x*1.5))

yxg_pt20 = rs.MoveObject(rs.CopyObject(yxg_pt19),(0,0.75 * x,-x*0.5))

yxg_pt21 = rs.MoveObject(rs.CopyObject(yxg_pt20),(0, 0.5 * x,-x*1))

yxg_pt22 = rs.MoveObject(rs.CopyObject(yxg_pt21),(0,1.5 * x,-x*0.75))

yxg_pt23 = rs.MoveObject(rs.CopyObject(yxg_pt22),(0, 0.6 * x,-x*0.5))

yxg_pt24 = rs.MoveObject(rs.CopyObject(yxg_pt23),(0,1.5 * x,-x*0.4))

yxg_pt25 = rs.MoveObject(rs.CopyObject(yxg_pt24),(0, 0.6 * x,-x*0.5))

yxg_pt26 = rs.MoveObject(rs.CopyObject(yxg_pt25),(0,0.75 * x,-x*0.1))

yxg_pt27 = rs.MoveObject(rs.CopyObject(yxg_pt26),(0, 1 * x,-x*0.2))

yxg_pt28 = rs.MoveObject(rs.CopyObject(yxg_pt27),(0,0.75 * x,x*0.1))

yxg_pt29 = rs.MoveObject(rs.CopyObject(yxg_pt28),(0, 1 * x,-x*0.1))

yxg_pt30 = rs.MoveObject(rs.CopyObject(yxg_pt0),(0, -2 * x,0))


yxg_pts = [yxg_pt0,yxg_pt1,yxg_pt2,yxg_pt3,yxg_pt4,yxg_pt5,yxg_pt6,yxg_pt7,yxg_pt8,yxg_pt9,yxg_pt10,yxg_pt11,yxg_pt12,yxg_pt13,yxg_pt14,yxg_pt15,yxg_pt16,yxg_pt17,yxg_pt18,yxg_pt19,yxg_pt20,yxg_pt21,yxg_pt22,yxg_pt23,yxg_pt24,yxg_pt25,yxg_pt26,yxg_pt27,yxg_pt28,yxg_pt29,yxg_pt30]

yxg_cr1 = rs.AddInterpCurve([yxg_pt1,yxg_pt2,yxg_pt3],degree = 3,knotstyle=4)
yxg_cr2 = rs.AddInterpCurve([yxg_pt3,yxg_pt4,yxg_pt5],degree = 3,knotstyle=4)
yxg_cr3 = rs.AddInterpCurve([yxg_pt5,yxg_pt6,yxg_pt7],degree = 3,knotstyle=4)
yxg_cr4 = rs.AddInterpCurve([yxg_pt7,yxg_pt8,yxg_pt9],degree = 3,knotstyle=4)
yxg_cr5 = rs.AddInterpCurve([yxg_pt9,yxg_pt10,yxg_pt11],degree = 3,knotstyle=4)
yxg_cr6 = rs.AddInterpCurve([yxg_pt11,yxg_pt12,yxg_pt13,yxg_pt14],degree = 3,knotstyle=4)
yxg_cr7 = rs.AddInterpCurve([yxg_pt14,yxg_pt15,yxg_pt16],degree = 3,knotstyle=4)
yxg_cr8 = rs.AddInterpCurve([yxg_pt16,yxg_pt17,yxg_pt18],degree = 3,knotstyle=4)
yxg_cr9 = rs.AddInterpCurve([yxg_pt18,yxg_pt19,yxg_pt20],degree = 3,knotstyle=4)
yxg_cr10 = rs.AddInterpCurve([yxg_pt20,yxg_pt21,yxg_pt22],degree = 3,knotstyle=4)
yxg_cr11 = rs.AddInterpCurve([yxg_pt22,yxg_pt23,yxg_pt24],degree = 3,knotstyle=4)
yxg_cr12 = rs.AddInterpCurve([yxg_pt24,yxg_pt25,yxg_pt26],degree = 3,knotstyle=4)
yxg_cr13 = rs.AddInterpCurve([yxg_pt26,yxg_pt27,yxg_pt28],degree = 3,knotstyle=4)
yxg_cr14 = rs.AddInterpCurve([yxg_pt28,yxg_pt29,yxg_pt30],degree = 3,knotstyle=4)
yxg_cr15 = rs.AddPolyline([yxg_pt30,yxg_pt0,yxg_pt1])

yxg_cr = rs.JoinCurves([yxg_cr1,yxg_cr2,yxg_cr3,yxg_cr4,yxg_cr5,yxg_cr6,yxg_cr7,yxg_cr8,yxg_cr9,yxg_cr10,yxg_cr11,yxg_cr12,yxg_cr13,yxg_cr14,yxg_cr15])

rs.MoveObject(yxg_cr,(-5 * x,-5 * x,0)) 

yxg_right_brep = rs.AddPlanarSrf(yxg_cr)
yxg_right_brep = rs.ExtrudeSurface(yxg_right_brep,rs.AddLine(rs.AddPoint(0,0,0),rs.AddPoint(10 * x,0,0)))

rs.ScaleObject(yxg_right_brep,rs.MoveObject(rs.CopyObject(ZhuTou_point),(0,-5 * x,0)),[1,1.5,1.3])

yxg_left_brep = rs.MirrorObject(yxg_right_brep,ZhuTou_point,rs.MoveObject(rs.CopyObject(ZhuTou_point),(x,0,0)),copy=True)


yxg_mid = rs.MoveObject(rs.AddLine(yxg_pt0,yxg_pt1),(-4 * x,-5 * x,0))
yxg_mid = rs.ExtrudeCurve(yxg_mid,rs.AddLine(rs.AddPoint(0,0,0),rs.AddPoint(0,10 * x,0)))
yxg_mid = rs.ExtrudeSurface(yxg_mid,rs.AddLine(rs.AddPoint(0,0,0),rs.AddPoint(8 * x,0,0)))

yxg_brep = rs.BooleanDifference(yxg_left_brep,yxg_mid,delete_input = True)

yxg_brep = rs.BooleanIntersection(yxg_brep,yxg_right_brep,delete_input =True)

rs.RotateObject(yxg_brep,ZhuTou_point,90,[0,0,x],copy=False)



rs.MoveObject(yxg_brep ,( j * x/2,-26 * x,262.5 * x +21 * x -1.5 * x+21 * x))

HuaGong3_pj = rs.CopyObject(HuaGong2_pj)

#补间铺作第一跳华拱被翼形拱剪切

hg2_bj1 = rs.BooleanDifference(yxg_brep,hg2_bj1,delete_input = False)

hg2_bj2 = rs.MoveObject(rs.CopyObject(hg2_bj1) ,( j * x,0, -3.75 * x))

hg2_bj3 = rs.MoveObject(rs.CopyObject(hg2_bj2) ,( j * x,0,0))
hg2_bj4 = rs.MoveObject(rs.CopyObject(hg2_bj1) ,( j * x * 3,0,0))

hg2_bj_g = [hg2_bj1[0] , hg2_bj2 , hg2_bj3 , hg2_bj4]

#翼形拱组

yxg_brep2 = rs.MoveObject(rs.CopyObject(yxg_brep) ,( j * x,0, -3.75 * x))

yxg_brep3 = rs.MoveObject(rs.CopyObject(yxg_brep2) ,( j * x,0,0))
yxg_brep4 = rs.MoveObject(rs.CopyObject(yxg_brep) ,( j * x * 3,0,0))

yxg_brep_g = [yxg_brep[0] , yxg_brep2 , yxg_brep3 , yxg_brep4]


#补间铺作第二跳华拱的交互斗

jhd1_hg2 = rs.MoveObject(rs.CopyObject(jhd_hg),(0,-21 * x,21 * x))
jhd2_hg2 = rs.MirrorObject(jhd1_hg2,ZhuTou_point,rs.MoveObject(rs.CopyObject(ZhuTou_point),(x,0,0)),copy=True)
jhds_hg2 = [jhd1_hg2,jhd2_hg2]

jhds2_hg2 = rs.MoveObjects(rs.CopyObjects(jhds_hg2) ,( j * x,0, -3.75 * x))

jhds3_hg2 = rs.MoveObjects(rs.CopyObjects(jhds2_hg2) ,( j * x,0,0))
jhds4_hg2 = rs.MoveObjects(rs.CopyObjects(jhds_hg2) ,( j * x * 3,0,0))

jhds_hg_g = jhds_hg2 + jhds2_hg2  + jhds3_hg2  + jhds4_hg2 


#补间辅作第三跳华拱后尾出作垂头

rs.MoveObject((HuaGong3_pj),(0,0,21 * x))

#补间第三跳华拱剪切再出21分,并且将后尾变成垂头

HuaGong3_pj_trimed = rs.ExplodePolysurfaces(HuaGong3_pj)[50]
HuaGong3_pj_trimed = rs.CurveEndPoint(rs.DuplicateEdgeCurves(HuaGong3_pj_trimed)[2])

HuaGong3_pj_trimed_0 = rs.MoveObject(rs.CopyObject(HuaGong3_pj_trimed),(0,-2 * x,0))

HuaGong3_pj_trimed_1 = rs.MoveObject(rs.CopyObject(HuaGong3_pj_trimed_0),(0,-21 * x,-14 * x))


HuaGong3_pj_trimed_2 = rs.MoveObject(rs.CopyObject(HuaGong3_pj_trimed_1),(0,0,-1 * x))

HuaGong3_pj_trimed_3 = rs.MoveObject(rs.CopyObject(HuaGong3_pj_trimed_2),(0,39 * x,0))


HuaGong3_pj_trimed = rs.AddPolyline([HuaGong3_pj_trimed,HuaGong3_pj_trimed_0,HuaGong3_pj_trimed_1,HuaGong3_pj_trimed_2,HuaGong3_pj_trimed_3])

HuaGong3_pj_trimed = rs.JoinCurves([HuaGong3_pj_trimed,rs.AddLine(rs.CurveStartPoint(HuaGong3_pj_trimed),rs.CurveEndPoint(HuaGong3_pj_trimed))])

HuaGong3_pj_trimed = rs.AddPlanarSrf(HuaGong3_pj_trimed)

HuaGong3_pj_trimed = rs.ExtrudeSurface(HuaGong3_pj_trimed,rs.AddLine(rs.AddPoint(0,0,0),rs.AddPoint(10 * x,0,0)))
HuaGong3_pj_trimed_2 = rs.MirrorObject(HuaGong3_pj_trimed,ZhuTou_point,rs.MoveObject(rs.CopyObject(ZhuTou_point),(x,0,0)),copy=True)

HuaGong3_pj = rs.BooleanDifference(HuaGong3_pj,HuaGong3_pj_trimed,delete_input=True)

HuaGong3_pj = rs.BooleanDifference(HuaGong3_pj,HuaGong3_pj_trimed_2,delete_input=True)

rs.MoveObject(HuaGong3_pj  ,( j * x/2,0,262.5 * x +21 * x -1.5 * x))

#补间铺作的的令拱生成

#佛光寺大殿,令拱生成


if NiDaoGong_CaiFen_left !=  NiDaoGong_CaiFen_right:
    raise ValueError(f"两边必须一样长")

lg_pt_o = rs.CopyObject(ZhuTou_point)
if (NiDaoGong_CaiFen_left > 25) & (NiDaoGong_CaiFen_right > 25):
    rs.MoveObject(lg_pt_o,(0,(NiDaoGong_CaiFen_left) * x,0))
else : raise ValueError(f"必须大于26分")

lg_pt_z1 = rs.CopyObject(lg_pt_o)
rs.MoveObject(lg_pt_z1,(0,0,9 * x))
lg_cr_z = rs.AddLine(lg_pt_o,lg_pt_z1)
lg_pt_y1 = rs.CopyObject(lg_pt_o)
rs.MoveObject(lg_pt_y1 ,(0,-20 * x,0))
lg_cr_y = rs.AddLine(lg_pt_y1,lg_pt_o)
div_cr_z =rs.DivideCurve(lg_cr_z,5)
div_cr_y =rs.DivideCurve(lg_cr_y,5)
#卷杀
CrossCurves_gzg = []
for i in range(len(div_cr_z)):
    divide_y = div_cr_y[i]
    divide_z = div_cr_z[i]
    CrossCurve_gzg = rs.AddLine(divide_y,divide_z)
    CrossCurves_gzg.append(CrossCurve_gzg)
CrossCurves_gzg = CrossCurves_gzg[1:len(CrossCurves_gzg)-1]
#选择交点
CrossCurves_points_gzg = []
for i in range(len(CrossCurves_gzg)):
    CrossCurves_point_gzg = rs.CurveCurveIntersection(CrossCurves_gzg[i],CrossCurves_gzg[i-1])[0][1]
    CrossCurves_points_gzg.append(CrossCurves_point_gzg)
CrossCurves_points_gzg = CrossCurves_points_gzg[1:len(CrossCurves_points_gzg)]
CrossCurves_points_gzg.insert(0,rs.CurveStartPoint(lg_cr_y))
CrossCurves_points_gzg.insert(len(CrossCurves_points_gzg)+1,rs.CurveEndPoint(lg_cr_z))
lg_pt_z2 = rs.CopyObject(lg_pt_z1)
rs.MoveObject(lg_pt_z2,(0,0, 6 * x))
lg_pt_z3 = rs.CopyObject(lg_pt_z2)
rs.MoveObject(lg_pt_z3,(0,-10 * x,0))
lg_pt_y_1 = rs.CopyObject(ZhuTou_point)
rs.MoveObject(lg_pt_y_1,(0,0,5 * x))
lg_pt_y_2 = rs.CopyObject(lg_pt_y_1)
rs.MoveObject(lg_pt_y_2,(0,4 * x,0))
lg_pt_y_3 = rs.CopyObject(lg_pt_y_2)
rs.MoveObject(lg_pt_y_3,(0,0,10 * x))
CrossCurves_points_gzg.append(lg_pt_z2)
CrossCurves_points_gzg.append(lg_pt_z3)
CrossCurves_points_lg_right = rs.MirrorObjects(CrossCurves_points_gzg,ZhuTou_point,rs.MoveObject(rs.CopyObject(ZhuTou_point),(x,0,x)),copy=True)
rs.MoveObjects(CrossCurves_points_lg_right,(0,(NiDaoGong_CaiFen_left - NiDaoGong_CaiFen_right) * x,0))
lg_mid_pt1 = rs.CopyObject(ZhuTou_point)
lg_mid_pt1 = rs.MoveObject(lg_mid_pt1,(0,-4 * x,15 * x))
lg_mid_pt4 = rs.CopyObject(ZhuTou_point)
lg_mid_pt4 = rs.MoveObject(lg_mid_pt4,(0,4 * x,15 * x))
lg_mid_pt2 = rs.CopyObject(lg_mid_pt1)
rs.MoveObject(lg_mid_pt2,(0,0,-10 * x))
lg_mid_pt3 = rs.CopyObject(lg_mid_pt2)
rs.MoveObject(lg_mid_pt3,(0,8 * x,0))

CrossCurves_points_gzg.insert(0,CrossCurves_points_lg_right[0])
CrossCurves_points_gzg.insert(0,CrossCurves_points_lg_right[1])
CrossCurves_points_gzg.insert(0,CrossCurves_points_lg_right[2])
CrossCurves_points_gzg.insert(0,CrossCurves_points_lg_right[3])
CrossCurves_points_gzg.insert(0,CrossCurves_points_lg_right[4])
CrossCurves_points_gzg.insert(0,CrossCurves_points_lg_right[5])
CrossCurves_points_gzg.insert(0,CrossCurves_points_lg_right[6])
CrossCurves_points_gzg.insert(0,lg_mid_pt1)
CrossCurves_points_gzg.insert(0,lg_mid_pt2)
CrossCurves_points_gzg.insert(0,lg_mid_pt3)
CrossCurves_points_gzg.insert(0,lg_mid_pt4)
lg_curve_left1 = rs.AddPolyline(CrossCurves_points_gzg)
lg_curve_left1 = rs.JoinCurves([lg_curve_left1,rs.AddLine(rs.CurveEndPoint(lg_curve_left1),rs.CurveStartPoint(lg_curve_left1))])
rs.MoveObject(lg_curve_left1,(5 *x,0,0))
lg_sr_left1 = rs.AddPlanarSrf(lg_curve_left1)

lg_brep = rs.ExtrudeSurface(lg_sr_left1,rs.AddLine(rs.AddPoint(0,0,0),rs.AddPoint(-10 * x,0,0)))

# 拱眼
lg_gyy_pt1 = rs.CopyObject(lg_pt_z3)
rs.MoveObject(lg_gyy_pt1,(-5 * x,0,x))
lg_gyy_pt2 = rs.CopyObject(lg_gyy_pt1)
rs.MoveObject(lg_gyy_pt2,(0,0,-2 * x))
lg_gyy_pt4 = rs.CopyObject(lg_mid_pt4)
rs.MoveObject(lg_gyy_pt4,(-5 * x, 1.625 * x,x))
lg_gyy_pt3 = rs.CopyObject(lg_gyy_pt4)
rs.MoveObject(lg_gyy_pt3,(0,0,-2 * x))
lg_gyy_cr1 = rs.AddLine(lg_gyy_pt1,lg_gyy_pt2)
lg_gyy_cr2 = rs.AddLine(lg_gyy_pt2,lg_gyy_pt3)
lg_gyy_cr3 = rs.AddLine(lg_gyy_pt3,lg_gyy_pt4)
lg_gyy_cr1 = rs.AddFilletCurve(lg_gyy_cr1,lg_gyy_cr2,x)
lg_gyy_cr2_1 = rs.AddFilletCurve(lg_gyy_cr3,lg_gyy_cr2,x)
lg_gyy_cr3 = rs.AddLine(rs.CurveEndPoint(lg_gyy_cr1),rs.CurveEndPoint(lg_gyy_cr2_1))
lg_gyy_cr4 = rs.AddLine(rs.CurveStartPoint(lg_gyy_cr1),rs.MoveObject(rs.CopyObject(lg_gyy_pt1),(0,0,x)))
lg_gyy_cr5 = rs.AddLine(rs.CurveStartPoint(lg_gyy_cr2_1),rs.MoveObject(rs.CopyObject(lg_gyy_pt4),(0,0,x)))
lg_gyy_1 =rs.JoinCurves([lg_gyy_cr1,lg_gyy_cr2_1,lg_gyy_cr3,lg_gyy_cr4,lg_gyy_cr5])
lg_gyy_1 =rs.JoinCurves([lg_gyy_1,rs.AddLine(rs.CurveStartPoint(lg_gyy_1),rs.CurveEndPoint(lg_gyy_1))])
lg_gyy_sr = rs.AddPlanarSrf(lg_gyy_1)
rs.MoveObject(lg_gyy_sr,(0,0,0))
lg_gyy_1_1= rs.MoveObject(rs.CopyObject(lg_gyy_1),(5 * x,0 , x))
rs.ScaleObject(lg_gyy_1_1,rs.CurveMidPoint(lg_gyy_cr2),[1,0.5,1])
lg_gyy_1 =rs.AddLoftSrf([lg_gyy_1,lg_gyy_1_1])
lg_gyy_2 =rs.MirrorObject(lg_gyy_1,ZhuTou_point,rs.MoveObject(rs.CopyObject(ZhuTou_point),(x,0,0)),copy=True)
lg_gyy_3 =rs.MirrorObject(lg_gyy_1,ZhuTou_point,rs.MoveObject(rs.CopyObject(ZhuTou_point),(0,x,0)),copy=True)
lg_gyy_4 =rs.MirrorObject(lg_gyy_2,ZhuTou_point,rs.MoveObject(rs.CopyObject(ZhuTou_point),(0,x,0)),copy=True)
rs.CapPlanarHoles(lg_gyy_1)
lg_brep = rs.BooleanDifference(lg_brep,lg_gyy_1)
lg_brep = rs.BooleanDifference(lg_brep,lg_gyy_2)
lg_brep = rs.BooleanDifference(lg_brep,lg_gyy_3)
lg_brep = rs.BooleanDifference(lg_brep,lg_gyy_4)

#令拱加上馒头榫

lg_brep = rs.BooleanDifference(mts1_ndg_bj1,lg_brep,delete_input=False)

lg_brep = rs.BooleanIntersection(lg_brep,mts1_ndg_bj2,delete_input=False)

rs.RotateObject(lg_brep,ZhuTou_point,90,[0,0,x],copy=False)

rs.MoveObject(lg_brep ,(j * x/2,-47 * x,264 * x - 3 * x +63 * x))
lg2_brep = rs.MirrorObject(lg_brep,ZhuTou_point,rs.MoveObject(rs.CopyObject(ZhuTou_point),(x,0,0)),copy=True)

lgs_brep = [lg_brep[0],lg2_brep]

#第三跳华拱剪切

HuaGong3_pj = rs.BooleanDifference(lg_brep,HuaGong3_pj,delete_input=False)
HuaGong3_pj = rs.BooleanIntersection(lg2_brep,HuaGong3_pj,delete_input=False)

#补间第三跳华拱组

hg3_bj1 = rs.CopyObject(HuaGong3_pj)

hg3_bj2 = rs.MoveObject(rs.CopyObject(hg3_bj1) ,( j * x,0, -3.75 * x))

hg3_bj3 = rs.MoveObject(rs.CopyObject(hg3_bj2) ,( j * x,0,0))
hg3_bj4 = rs.MoveObject(rs.CopyObject(hg3_bj1) ,( j * x * 3,0,0))

hg3_bj_g = [hg3_bj1,hg3_bj2,hg3_bj3,hg3_bj4]


#补间令拱组

lgs_brep1 = rs.CopyObjects(lgs_brep)

lgs_brep2 = rs.MoveObjects(rs.CopyObjects(lgs_brep1) ,( j * x,0, -3.75 * x))

lgs_brep3 = rs.MoveObjects(rs.CopyObjects(lgs_brep2) ,( j * x,0,0))
lgs_brep4 = rs.MoveObjects(rs.CopyObjects(lgs_brep1) ,( j * x * 3,0,0))

lgs_brep_g = lgs_brep1+lgs_brep2+lgs_brep3+lgs_brep4

#第二层素枋
# 生起曲线
le2_brep_trimed_g_3 = []
shan_mian_pt_up = [zhutou_pt_up[0],zhutou_pt_up2[0],zhutou_pt_up3[0],zhutou_pt_up4[0],zhutou_pt_up5[0]]
le_trimed2_3 = rs.CopyObjects(shan_mian_pt_up[0:len(zhutou_pt_up)-1])
rs.MoveObjects(le_trimed2_3,((5) * x,0,0))
le_trimed1_3 = rs.CopyObjects(shan_mian_pt_up[1:len(zhutou_pt_up)])
rs.MoveObjects(le_trimed1_3,(-(5) * x,0,0))
sq_cr_3 = rs.AddInterpCurve(shan_mian_pt_up)
sq_sr_3 = rs.ExtrudeCurve(sq_cr_3,rs.AddLine(rs.AddPoint(0,0,0),rs.AddPoint(0,5 * x,0)))
for i in range(len(le_trimed1_3)):
    cr1_3 = rs.AddLine(le_trimed1_3[i],le_trimed2_3[i])
    rs.MoveObject(cr1_3,(0,4 * x,21 * x))
    cr1_3 = rs.ProjectCurveToSurface(cr1_3,sq_sr_3,[0,0,x])

    le2_brep_3 = rs.ExtrudeCurve(cr1_3,rs.AddLine(rs.AddPoint(0,0,0),rs.AddPoint(0,-10 * x ,0)))
    le2_brep_3 = rs.ExtrudeSurface(le2_brep_3,rs.AddLine(rs.AddPoint(0,0,0),rs.AddPoint(0 ,0,-14.5 * x)))
    
    le2_brep_trimed_3 = rs.ExtrudeCurve(cr1_3,rs.AddLine(rs.AddPoint(0,0,0),rs.AddPoint(0,-8 * x ,0)))
    le2_brep_trimed_3 = rs.ExtrudeSurface(le2_brep_trimed_3,rs.AddLine(rs.AddPoint(0,0,0),rs.AddPoint(0 ,0,-15 * x)))
    rs.MoveObject(le2_brep_trimed_3,(0,0,5 * x))
    le2_brep_trimed_g_3.append(le2_brep_trimed_3)
rs.MoveObjects(le2_brep_trimed_g_3,(0,0,44.5 * x +21 * x))


#第二层素枋泥道栱生成

sf2_brep_left = sf2_breps[1]
sf2_brep_right = sf2_breps[0]

sf2_trimed_brep = rs.ExplodePolysurfaces(sf2_brep_left)[4]
sf2_trimed_brep = rs.CurveEndPoint(rs.DuplicateEdgeCurves(sf2_trimed_brep)[2])

rs.MoveObject(sf2_trimed_brep,(-10 * x,0,-4 * x))

sf2_trimed_brep = rs.AddLine(sf2_trimed_brep,rs.MoveObject(rs.CopyObject(sf2_trimed_brep),(20 * x,0,0)))
sf2_trimed_brep = rs.ExtrudeCurve(sf2_trimed_brep,rs.AddLine(rs.AddPoint(0,0,0),rs.AddPoint(0,22 * x,0)))
sf2_trimed_brep = rs.ExtrudeSurface(sf2_trimed_brep,rs.AddLine(rs.AddPoint(0,0,0),rs.AddPoint(0,0,15 * x)))

sf2_trimed_brep2 = rs.MirrorObject(sf2_trimed_brep,ZhuTou_point,rs.MoveObject(rs.CopyObject(ZhuTou_point),(x,0,0)),copy=True)

sf2_brep_left_1 = rs.BooleanIntersection(sf2_trimed_brep,sf2_brep_left,delete_input=False)[0]

sf2_brep_left_2 = rs.BooleanIntersection(sf2_trimed_brep,sf2_brep_left,delete_input=False)[1]

rs.MoveObject(sf2_brep_left_2,(0,-22 * x,0))

sf2_brep_left = rs.BooleanUnion([sf2_brep_left_1,sf2_brep_left_2],delete_input=True)

#
sf2_brep_right_1 = rs.BooleanDifference(sf2_trimed_brep2,sf2_brep_right,delete_input=False)[0]
sf2_brep_right_2 = rs.BooleanDifference(sf2_trimed_brep2,sf2_brep_right,delete_input=False)[1]

rs.MoveObject(sf2_brep_right_2,(0,22 * x,0))

sf2_brep_right = rs.BooleanUnion([sf2_brep_right_1,sf2_brep_right_2],delete_input=True)

sf2_breps = [sf2_brep_left[0],sf2_brep_right[0]]

rs.RotateObjects(sf2_breps,ZhuTou_point,90,[0,0,x],copy=False)

rs.MoveObjects(sf2_breps,(j * x,0,259.5 * x + 42 * x))

sf2_breps_2 = rs.MoveObjects(rs.CopyObjects(sf2_breps),(j*x,0,-7.5 * x))

sf2_breps_3 = rs.MoveObjects(rs.CopyObjects(sf2_breps),(2 * j*x,0,0))

sf2_breps = sf2_breps + sf2_breps_2 + sf2_breps_3

#补间辅作第二层泥道栱
#补间铺作第二层泥道栱

#补间铺作第二层泥道栱剪切

ndg_bj2_trimed_brep = rs.ExplodePolysurfaces(ndg_bj2_brep)[24]
ndg_bj2_trimed_brep = rs.CurveEndPoint(rs.DuplicateEdgeCurves(ndg_bj2_trimed_brep)[0])
rs.MoveObject(ndg_bj2_trimed_brep,(-10 * x,0,0))
ndg_bj2_trimed_brep = rs.AddLine(ndg_bj2_trimed_brep,rs.MoveObject(rs.CopyObject(ndg_bj2_trimed_brep),(0,4 * x,0)))
ndg_bj2_trimed_brep = rs.ExtrudeCurve(ndg_bj2_trimed_brep,rs.AddLine(rs.AddPoint(0,0,0),rs.AddPoint(20 * x,0,0)))
ndg_bj2_trimed_brep = rs.ExtrudeSurface(ndg_bj2_trimed_brep,rs.AddLine(rs.AddPoint(0,0,0),rs.AddPoint(0,0,17 * x)))
rs.MoveObject(ndg_bj2_trimed_brep,(0,0,-15 * x))
ndg_bj2_trimed_brep2 =   rs.MirrorObjects(ndg_bj2_trimed_brep,ZhuTou_point,rs.MoveObject(rs.CopyObject(ZhuTou_point),(x,0,0)),copy=True)

ndg_bj2_brep_head1 = rs.BooleanUnion([ndg_bj2_trimed_brep,ndg_bj2_brep],delete_input=False)[0]

ndg_bj2_brep_mid = rs.BooleanUnion([ndg_bj2_trimed_brep,ndg_bj2_brep],delete_input=False)[1]

ndg_bj2_brep_mid = rs.BooleanUnion([ndg_bj2_brep_mid,ndg_bj2_trimed_brep2],delete_input=False)[0]

#加21分
rs.MoveObject(ndg_bj2_brep_head1,(0,21 * x,0))

#头和中间段连接
ndg_bj2_brep_head1_1 =rs.ExplodePolysurfaces(ndg_bj2_brep_head1)[21]
ndg_bj2_brep_head1_1 = rs.ExtrudeSurface(ndg_bj2_brep_head1_1,rs.AddLine(rs.AddPoint(0,0,0),rs.AddPoint(0,-25 * x,0)))

ndg_bj2_brep_head1 = rs.BooleanDifference(ndg_bj2_brep_head1,ndg_bj2_brep_head1_1,delete_input=False)

ndg_bj2_brep_head2 = rs.MirrorObjects(ndg_bj2_brep_head1,ZhuTou_point,rs.MoveObject(rs.CopyObject(ZhuTou_point),(x,0,0)),copy=True)

ndg_bj2_brep = rs.BooleanIntersection(ndg_bj2_brep_head1,ndg_bj2_brep_mid,delete_input=False)

ndg_bj2_brep = rs.BooleanIntersection(ndg_bj2_brep_head2,ndg_bj2_brep,delete_input=False)

rs.RotateObject(ndg_bj2_brep,ZhuTou_point,90,[0,0,x],copy=False)

ndg_bj2_brep1 = rs.MoveObject(rs.CopyObject(ndg_bj2_brep) ,( j * x/2,0,262.5 * x +42 * x -1.5 * x))

ndg_bj2_brep2 = rs.MoveObject(rs.CopyObject(ndg_bj2_brep) ,( j * x + j * x/2,0,262.5 * x - 3 * x +42 * x -3.75 * x))

ndg_bj2_brep3 = rs.MoveObject(rs.CopyObject(ndg_bj2_brep2) ,( j * x,0,0))
ndg_bj2_brep4 = rs.MoveObject(rs.CopyObject(ndg_bj2_brep1) ,( j * x * 3,0,0))

ndg_bj2_brep_g = [ndg_bj2_brep1 , ndg_bj2_brep2 , ndg_bj2_brep3 , ndg_bj2_brep4]


#
sf2_breps_first = rs.BooleanUnion([le2_brep_trimed_g_3[0],sf2_breps[0]],delete_input=False)

sf2_breps_first = rs.BooleanDifference(ndg_bj2_brep_g[0],sf2_breps_first,delete_input=False)

sf2_breps_first = rs.BooleanUnion([sf2_breps_first,hg2_bj_g[0]],delete_input=False)


sf2_breps_last = rs.BooleanUnion([le2_brep_trimed_g_3[-1],sf2_breps[-1]],delete_input=False)

sf2_breps_last = rs.BooleanDifference(ndg_bj2_brep_g[-1],sf2_breps_last,delete_input=False)

sf2_breps_last = rs.BooleanUnion([sf2_breps_last,hg2_bj_g[-1]],delete_input=False)



sf2_breps_2 = rs.BooleanUnion([le2_brep_trimed_g_3[1],sf2_breps[1],sf2_breps[2]],delete_input=False)

sf2_breps_2 = rs.BooleanDifference(ndg_bj2_brep_g[1],sf2_breps_2,delete_input=False)

sf2_breps_2 = rs.BooleanUnion([sf2_breps_2,hg2_bj_g[1]],delete_input=False)


sf2_breps_3 = rs.BooleanUnion([le2_brep_trimed_g_3[2],sf2_breps[3],sf2_breps[4]],delete_input=False)

sf2_breps_3 = rs.BooleanDifference(ndg_bj2_brep_g[2],sf2_breps_3,delete_input=False)

sf2_breps_3 = rs.BooleanUnion([sf2_breps_3,hg2_bj_g[2]],delete_input=False)

sf2_breps_g = [sf2_breps_first[0],sf2_breps_last[0],sf2_breps_2[0],sf2_breps_3[0]]

#补间辅作第二层泥道栱上的散斗

SanDou1_ndg_bj2 = rs.MoveObject(rs.CopyObject(SanDou1_ndg_bj1),(-21 * x,0,21 * x))

SanDou2_ndg_bj2 = rs.MoveObject(rs.CopyObject(SanDou2_ndg_bj1),(21 * x,0,21 * x))

SanDous2_ndg_bj1 = [SanDou1_ndg_bj2,SanDou2_ndg_bj2]

SanDous2_ndg_bj2 = rs.MoveObjects(rs.CopyObjects(SanDous2_ndg_bj1) ,( j * x ,0,-5.25 * x))

SanDous2_ndg_bj3 = rs.MoveObjects(rs.CopyObjects(SanDous2_ndg_bj2) ,( j * x,0,0))
SanDous2_ndg_bj4 = rs.MoveObjects(rs.CopyObjects(SanDous2_ndg_bj1) ,( j * x * 3,0,0))

SanDous2_ndg_g = SanDous2_ndg_bj1 + SanDous2_ndg_bj2 + SanDous2_ndg_bj3 + SanDous2_ndg_bj4

#补间辅作第二层素枋上的散斗

SanDou1_sf2 = rs.MoveObject(rs.CopyObject(SanDou1_sf1),(22 * x,0,21 * x))
SanDou2_sf2 = rs.MoveObject(rs.CopyObject(SanDou2_sf1),(-22 * x,0,21 * x))

SanDous_sf2= [SanDou1_sf2,SanDou2_sf2]

SanDous2_sf2 = rs.MoveObjects(rs.CopyObjects(SanDous_sf2),(j*x,0,-7.5 * x))
SanDous3_sf2 = rs.MoveObjects(rs.CopyObjects(SanDous_sf2),(j*x * 2,0,0))

SanDous_sf2_g = SanDous_sf2 + SanDous2_sf2 + SanDous3_sf2

#第三层素枋

sf3_breps_g = rs.MoveObjects(rs.CopyObjects(sf1_breps_g),(0,0,42 * x))

#第三层素枋上的散斗

SanDous_sf3_g = rs.MoveObjects(rs.CopyObjects(SanDous_sf1_g),(0,0,42 * x))

#补间辅作第三层泥道栱上的散斗

SanDous3_ndg_g = rs.MoveObjects(rs.CopyObjects(SanDous_ndg_g),(0,0,42 * x))

#令拱上的散斗

SanDou_lg = rs.MoveObjects(rs.CopyObjects(SanDous3_ndg_g),(0,-47 * x,0))

SanDou_lg_1 = rs.MirrorObjects(SanDou_lg,ZhuTou_point,rs.MoveObject(rs.CopyObject(ZhuTou_point),(x,0,0)),copy=True)

SanDou_lg = SanDou_lg + SanDou_lg_1


#补间辅作第三跳华拱上的散斗


#佛光寺东大殿散斗

x = CaiFen
#散斗,深12分,广10分,华拱/散斗.深10分,广12分,泥道栱
sd_hg3_pt_o = rs.AddPoint(0,0,0)
sd_hg3_pt2 = rs.AddPoint(10 * x,0,0)
sd_hg3_pt_z1 = rs.AddPoint(- 2 * x,0, 4 * x)
sd_hg3_cr_1 = rs.AddLine(sd_hg3_pt_o,sd_hg3_pt_z1)
#散斗,欹
sd_hg3_pt_z2 = rs.CurveMidPoint(sd_hg3_cr_1)
direction_left = (x, 0, 2 * x)  # 任意方向向量 
distance = 0.5 * x # 移动距离 
# 单位化方向向量并计算实际位移 
unit_vector_left = rs.VectorUnitize(direction_left)
displacement_left = rs.VectorScale(unit_vector_left, distance)
rs.MoveObject(sd_hg3_pt_z2, displacement_left)
sd_hg3_cr_1 = rs.AddCurve([sd_hg3_pt_o,sd_hg3_pt_z2,sd_hg3_pt_z1])
sd_hg3_pt_3 = rs.MoveObject(rs.CopyObject(sd_hg3_pt_o),(0,2 * x,0))
sd_hg3_sr1 = rs.AddLine(sd_hg3_pt_3,rs.MoveObject(rs.CopyObject(sd_hg3_pt_3),(-2 * x,-2 * x,0)))
sd_hg3_sr1 = rs.AddLoftSrf([sd_hg3_sr1,rs.MoveObject(rs.CopyObject(sd_hg3_sr1),(0,0,4* x))])
sd_hg3_cr_1 =rs.ProjectCurveToSurface(sd_hg3_cr_1,sd_hg3_sr1,[0,1,0])
sd_hg3_cr_2 = rs.MoveObject(rs.CopyObject(sd_hg3_cr_1),(0,12 * x,0 ))
sd_hg3_cr_2 = rs.RotateObject(sd_hg3_cr_2, rs.CurveStartPoint(sd_hg3_cr_2),-90,[0,0,1],copy=True)
sd_hg3_cr_3 = rs.MoveObject(rs.CopyObject(sd_hg3_cr_2),(10 * x,0,0 ))
sd_hg3_cr_3 = rs.RotateObject(sd_hg3_cr_3, rs.CurveStartPoint(sd_hg3_cr_3),-90,[0,0,1],copy=True)
sd_hg3_cr_4 = rs.MoveObject(rs.CopyObject(sd_hg3_cr_1),(10 * x,0,0 ))
sd_hg3_cr_4 = rs.RotateObject(sd_hg3_cr_4, rs.CurveStartPoint(sd_hg3_cr_4),90,[0,0,1],copy=True)
sd_hg3_down_Brep = rs.AddLoftSrf([sd_hg3_cr_1,sd_hg3_cr_2,sd_hg3_cr_3,sd_hg3_cr_4],loft_type=2,closed=True)
rs.CapPlanarHoles(sd_hg3_down_Brep)
#散斗,平
sd_hg3_sr2 = rs.ExplodePolysurfaces(sd_hg3_down_Brep)
sd_hg3_sr2 = sd_hg3_sr2[2]
sd_hg3_mid_Brep = rs.ExtrudeSurface(sd_hg3_sr2,rs.AddLine(rs.CurveEndPoint(sd_hg3_cr_2),rs.MoveObject(rs.CurveEndPoint(sd_hg3_cr_2),(0,0,2 * x))))
sd_hg3_sr3_curve= rs.DuplicateEdgeCurves(sd_hg3_mid_Brep)[9]
sd_hg3_sr3 = rs.AddLoftSrf([sd_hg3_sr3_curve,rs.MoveObject(rs.CopyObject(sd_hg3_sr3_curve),(0,-3 * x,0))])
sd_hg3_source_point = rs.SurfaceAreaCentroid(rs.ExplodePolysurfaces(sd_hg3_down_Brep)[1])[0]
sd_hg3_up_brep1 = rs.ExtrudeSurface(sd_hg3_sr3,rs.AddLine(sd_hg3_pt_o,rs.MoveObject(rs.CopyObject(sd_hg3_pt_o),(0,0,3.5* x))))
sd_hg3_up_brep2 =rs.CopyObject(sd_hg3_up_brep1)
rs.MoveObject(sd_hg3_up_brep2,(0, -13 * x ,0))


SanDou_hg3_up = rs.BooleanDifference(sd_hg3_mid_Brep,sd_hg3_up_brep2,delete_input=False)
SanDou_hg3_up = rs.BooleanDifference(SanDou_hg3_up,sd_hg3_up_brep1,delete_input=False)
SanDou_hg3 = rs.BooleanDifference(SanDou_hg3_up,sd_hg3_down_Brep,delete_input=False)

#散斗被馒头榫剪切
mts_SanDou_hg3 = rs.ExplodePolysurfaces(SanDou_hg3)[16]
mts_SanDou_hg3 = rs.CurveEndPoint(rs.DuplicateEdgeCurves(mts_SanDou_hg3)[0])
rs.MoveObject(mts_SanDou_hg3,(3.75 * x,4.75 * x,0))
mts_SanDou_hg3 = rs.AddLine(mts_SanDou_hg3,rs.MoveObject(rs.CopyObject(mts_SanDou_hg3),(0,2.5 * x,0)))
mts_SanDou_hg3 = rs.ExtrudeCurve(mts_SanDou_hg3,rs.AddLine(rs.AddPoint(0,0,0),rs.AddPoint(2.5 * x,0,0)))
mts_SanDou_hg3 = rs.ExtrudeSurface(mts_SanDou_hg3,rs.AddLine(rs.AddPoint(0,0,0),rs.AddPoint(0,0,2.5 * x)))

SanDou_hg3 = rs.BooleanUnion([SanDou_hg3,mts_SanDou_hg3],delete_input=False)
rs.RotateObject(SanDou_hg3,rs.MoveObject(rs.CopyObject(ZhuTou_point),(-(HuaGong_CaiFen_left-5) * x,2 * x,0)),0,[0,0,x],copy=False)

rs.MoveObject(SanDou_hg3 ,( j * x/2+27 * x,-50 * x,262.5 * x +78 * x -1.5 * x ))

SanDou2_hg3 = rs.MirrorObject(SanDou_hg3,ZhuTou_point,rs.MoveObject(rs.CopyObject(ZhuTou_point),(x,0,0)),copy=True)

SanDous_hg3 = [SanDou_hg3[0],SanDou2_hg3]


SanDous2_hg3 = rs.MoveObjects(rs.CopyObjects(SanDous_hg3) ,( j * x ,0,-5.25 * x))

SanDous3_hg3 = rs.MoveObjects(rs.CopyObjects(SanDous2_hg3) ,( j * x,0,0))
SanDous4_hg3 = rs.MoveObjects(rs.CopyObjects(SanDous_hg3) ,( j * x * 3,0,0))

SanDous_hg3 = SanDous_hg3 + SanDous2_hg3 + SanDous3_hg3 + SanDous4_hg3


#第四层素枋
#第四层素枋中间连接件

sf4_connect_brep_trimed = rs.ExplodePolysurfaces(sf4_connect_brep1)[10]

rs.ScaleObject(sf4_connect_brep_trimed,ZhuTou_point,[5,1,2],copy=False)

sf4_connect_brep_trimed = rs.ExtrudeSurface(sf4_connect_brep_trimed,rs.AddLine(rs.AddPoint(0,0,0),rs.AddPoint(0,50 * x,0)))
rs.MoveObject(sf4_connect_brep_trimed,(0,x,0))

sf4_connect_brep_trimed2 = rs.MirrorObject(sf4_connect_brep_trimed,ZhuTou_point,rs.MoveObject(rs.CopyObject(ZhuTou_point),(x,0,0)),copy=True)

sf4_connect_brep2 = rs.BooleanDifference(sf4_connect_brep2,sf4_connect_brep_trimed,delete_input=False)
sf4_connect_brep1 = rs.BooleanUnion([sf4_connect_brep_trimed2,sf4_connect_brep1],delete_input=False)

#将连接件的拱眼补上

sf4_connect_brep_fix1 =rs.ExplodePolysurfaces(sf4_connect_brep1)[20]
sf4_connect_brep_fix1 = rs.ExtrudeSurface(sf4_connect_brep_fix1,rs.AddLine(rs.AddPoint(0,0,0),rs.AddPoint(-x,0,0)))
sf4_connect_brep_fix2 = rs.MirrorObject(sf4_connect_brep_fix1,ZhuTou_point,rs.MoveObject(rs.CopyObject(ZhuTou_point),(0,x,0)),copy=True)
sf4_connect_brep_fix3 = rs.MirrorObject(sf4_connect_brep_fix1,ZhuTou_point,rs.MoveObject(rs.CopyObject(ZhuTou_point),(x,0,0)),copy=True)
sf4_connect_brep_fix4 = rs.MirrorObject(sf4_connect_brep_fix2,ZhuTou_point,rs.MoveObject(rs.CopyObject(ZhuTou_point),(x,0,0)),copy=True)

sf4_connect_brep1 = rs.BooleanDifference(sf4_connect_brep1,sf4_connect_brep_fix1,delete_input=False)

sf4_connect_brep1 = rs.BooleanDifference(sf4_connect_brep1,sf4_connect_brep_fix2,delete_input=False)

sf4_connect_brep2 = rs.BooleanUnion([sf4_connect_brep_fix3,sf4_connect_brep2,sf4_connect_brep_fix4],delete_input=False)



sf4_connect_breps = [sf4_connect_brep2[0],sf4_connect_brep1[0]]

rs.RotateObjects(sf4_connect_breps,ZhuTou_point,90,[0,0,x],copy=False)

rs.MoveObjects(sf4_connect_breps,(j * x,0,259.5 * x + 84 * x))

sf4_connect_breps_2 = rs.MoveObjects(rs.CopyObjects(sf4_connect_breps),(j*x,0,-7.5 * x))

sf4_connect_breps_3 = rs.MoveObjects(rs.CopyObjects(sf4_connect_breps),(2 * j*x,0,0))

sf4_connect_breps = sf4_connect_breps + sf4_connect_breps_2 + sf4_connect_breps_3

# 生起曲线
sf4_brep_trimed_g_3 = []
shan_mian_pt_up = [zhutou_pt_up[0],zhutou_pt_up2[0],zhutou_pt_up3[0],zhutou_pt_up4[0],zhutou_pt_up5[0]]
le_trimed2_3 = rs.CopyObjects(shan_mian_pt_up[0:len(zhutou_pt_up)-1])
rs.MoveObjects(le_trimed2_3,((9.5) * x,0,0))
le_trimed1_3 = rs.CopyObjects(shan_mian_pt_up[1:len(zhutou_pt_up)])
rs.MoveObjects(le_trimed1_3,(-(9.5) * x,0,0))
sq_cr_3 = rs.AddInterpCurve(shan_mian_pt_up)
sq_sr_3 = rs.ExtrudeCurve(sq_cr_3,rs.AddLine(rs.AddPoint(0,0,0),rs.AddPoint(0,5 * x,0)))
for i in range(len(le_trimed1_3)):
    cr1_3 = rs.AddLine(le_trimed1_3[i],le_trimed2_3[i])
    rs.MoveObject(cr1_3,(0,5 * x,21 * x))
    cr1_3 = rs.ProjectCurveToSurface(cr1_3,sq_sr_3,[0,0,x])

    le_brep_3 = rs.ExtrudeCurve(cr1_3,rs.AddLine(rs.AddPoint(0,0,0),rs.AddPoint(0,-10 * x ,0)))
    le_brep_3 = rs.ExtrudeSurface(le_brep_3,rs.AddLine(rs.AddPoint(0,0,0),rs.AddPoint(0 ,0,-15 * x)))
    
    le_brep_trimed_3 = rs.ExtrudeCurve(cr1_3,rs.AddLine(rs.AddPoint(0,0,0),rs.AddPoint(0,-10 * x ,0)))
    le_brep_trimed_3 = rs.ExtrudeSurface(le_brep_trimed_3,rs.AddLine(rs.AddPoint(0,0,0),rs.AddPoint(0 ,0,-15 * x)))
    rs.MoveObject(le_brep_trimed_3,(0,0,5 * x))
    sf4_brep_trimed_g_3.append(le_brep_trimed_3)
rs.MoveObjects(sf4_brep_trimed_g_3,(0,0,44.5 * x+ 64 * x))

sf4_brep1 = rs.BooleanUnion([sf4_brep_trimed_g_3[0],sf4_connect_breps[0]],delete_input=False)

sf4_brep2 = rs.BooleanDifference(sf4_connect_breps[1],sf4_brep_trimed_g_3[1],delete_input=False)
sf4_brep2 = rs.BooleanDifference(sf4_brep2,sf4_connect_breps[2],delete_input=False)

sf4_brep3 = rs.BooleanDifference(sf4_connect_breps[3],sf4_brep_trimed_g_3[2],delete_input=False)
sf4_brep3 = rs.BooleanDifference(sf4_brep3,sf4_connect_breps[4],delete_input=False)

sf4_brep4 = rs.BooleanDifference(sf4_connect_breps[-1],sf4_brep_trimed_g_3[-1],delete_input=False)

sf4_breps = [sf4_brep1[0],sf4_brep2[0],sf4_brep3[0],sf4_brep4[0]]

#平棋枋

pqf_breps = rs.MoveObjects(rs.CopyObjects(sf4_breps),(0,47 * x,0))

#组件整合

gyb_g_right = SanDous_sf1_g + SanDous_ndg_g + Dous_hg_g + sf1_breps_g + sf3_breps_g + hg1_bj_g + hg2_bj_g + hg3_bj_g + yxg_brep_g + jhds_hg_g + lgs_brep_g + sf2_breps_g + SanDous_sf3_g + SanDous2_ndg_g + SanDous_sf2_g + SanDous3_ndg_g + SanDou_lg + SanDous_hg3 + pqf_breps + sf4_breps

gyb_g_left = rs.MirrorObjects(gyb_g_right,rs.MoveObject(rs.CopyObject(ZhuTou_point),(0,(MianKuo_length * (MianKuo - 2) * x + 2 * j * x)/2 ,0)),rs.MoveObject(rs.CopyObject(ZhuTou_point),(x,(MianKuo_length * (MianKuo - 2) * x + 2 * j * x)/2 ,0)),copy=True)

gyb_jinshen_waiyan_g = gyb_g_left + gyb_g_right
# ---------- end python_3_script_14 ----------

brep_42 = Brep()
list_item_12 = ListItem(Index=number_slider_21, Wrap=True)
panel_7 = Panel(brep_41)
python_3_script_15 = Python3Script()  # -> out, a; unedited script template
list_item_13 = ListItem(Index=Slider(24, range=0..100), Wrap=True)
number_slider_27 = Slider(10, range=0..10)

# ----
# 面扩和进深方向横向构件-内檐
python_3_script_16 = Python3Script(
    CaiFen=number_slider_2,
    HuaGong_CaiFen_left=number_slider_13,
    HuaGong_CaiFen_right=number_slider_11,
    NiDaoGong_CaiFen_left=number_slider_14,
    NiDaoGong_CaiFen_right=number_slider_14,
    MianKuo=number_slider_3)  # -> out, GongYanBi_jinshen, GongYanBi_neiyan
# ---------- python_3_script_16: Python ----------
#佛光寺东大殿柱基
#每一跳为21分
import rhinoscriptsyntax as rs
import Rhino.Geometry as rg
import itertools as it
#材分可调变量x
x = CaiFen
#柱头点
ZhuTou_point = rs.AddPoint(HuaGong_CaiFen_left * x,5 *x,0)
#原点
BasePoint = 0
pt_o = rs.AddPoint(BasePoint * 500,0,0)
#进深为14倍材广,一材广为15材分(j的单位为分)
j = 14 * 15
MianKuo_length = 16 * 15

#   面扩七开间，五进深,明间为16倍材广为240分，除了尽间，面阔皆为240分，尽间面扩为210分。进深开间 = 尽间开间也为210分
if (MianKuo % 2 == 0) | (MianKuo < 5):
    raise ValueError(f"开间最小数不能低于5,且为单数")

zhu_pt1 = rs.CopyObject(ZhuTou_point)
rs.MoveObject(zhu_pt1,(0,j * x,0))
zhu_pt2 = rs.CopyObject(zhu_pt1,(0,MianKuo_length * (MianKuo - 2) * x,0))
zhu_cr = rs.AddLine(zhu_pt1,zhu_pt2)
zhutou_pt = rs.DivideCurve(zhu_cr,MianKuo-2)
zhu_pt3 = rs.CopyObject(ZhuTou_point)
zhu_pt4 =rs.MoveObject(rs.CopyObject(zhutou_pt[-1]),(0, j * x,0))
zhutou_pt.insert(0,zhu_pt3)
zhutou_pt.append(zhu_pt4)
zhutou_pt2 = rs.MoveObjects(rs.CopyObjects(zhutou_pt),(j * x,0,0))

zhutou_pt3 = rs.MoveObjects(rs.CopyObjects(zhutou_pt2[0:2] ),(j * x,0,0))

zhutou_pt3_1 = rs.MoveObjects(rs.CopyObjects(zhutou_pt2[len(zhutou_pt2)-2:len(zhutou_pt2)] ),(j * x,0,0))

zhutou_pt3 = zhutou_pt3 + zhutou_pt3_1

zhutou_pt4 = rs.MoveObjects(rs.CopyObjects(zhutou_pt2),(2 * j * x,0,0))

zhutou_pt5 = rs.MoveObjects(rs.CopyObjects(zhutou_pt2),(3 * j * x,0,0))


#柱高
#当心间的柱高为237.5分

#生起的规律

zhutou_pt_up =rs.CopyObjects(zhutou_pt)
rs.MoveObjects(zhutou_pt_up,(0,0,237.5 * x))

zhutou_pt_up2 =rs.CopyObjects(zhutou_pt2)
rs.MoveObjects(zhutou_pt_up2,(0,0,237.5 * x))

zhutou_pt_up3 =rs.CopyObjects(zhutou_pt3)
rs.MoveObjects(zhutou_pt_up3,(0,0,237.5 * x))

if MianKuo > 5:
    #前檐
    rs.MoveObjects([zhutou_pt_up[0],zhutou_pt_up[-1]],(0,0,10.5 * x))
    rs.MoveObjects([zhutou_pt_up[1],zhutou_pt_up[-2]],(0,0,6 * x))
    rs.MoveObjects([zhutou_pt_up[2],zhutou_pt_up[-3]],(0,0,2.5 * x))
    #内檐
    rs.MoveObjects([zhutou_pt_up2[0],zhutou_pt_up2[-1]],(0,0,7.5 * x))
    rs.MoveObjects([zhutou_pt_up2[1],zhutou_pt_up2[-2]],(0,0,5 * x))
    rs.MoveObjects([zhutou_pt_up2[2],zhutou_pt_up2[-3]],(0,0,2.5 * x))
    #中柱
    rs.MoveObjects([zhutou_pt_up3[1],zhutou_pt_up3[-2]],(0,0, 2.5* x))
 
else: 
    #前檐
    rs.MoveObjects([zhutou_pt_up[0],zhutou_pt_up[-1]],(0,0,6 * x))
    rs.MoveObjects([zhutou_pt_up[1],zhutou_pt_up[-2]],(0,0,2.5 * x))
    #内檐
    rs.MoveObjects([zhutou_pt_up2[0],zhutou_pt_up2[-1]],(0,0,5 * x))
    rs.MoveObjects([zhutou_pt_up2[1],zhutou_pt_up2[-2]],(0,0,2.5 * x))



zhutou_pt_up4 = rs.CopyObjects(zhutou_pt_up2,(2 * j * x,0,0))
zhutou_pt_up5 = rs.CopyObjects(zhutou_pt_up,(4 * j * x,0,0))

# 生起曲线

le_breps_2 = []
le_brep_trimed_g_2 = []
le_trimed2_2 = rs.CopyObjects(zhutou_pt_up2[1:len(zhutou_pt_up)-2])
rs.MoveObjects(le_trimed2_2,(0,(NiDaoGong_CaiFen_left+2) * x,0))
le_trimed1_2 = rs.CopyObjects(zhutou_pt_up2[2:len(zhutou_pt_up)-1])
rs.MoveObjects(le_trimed1_2,(0,-(NiDaoGong_CaiFen_left+2) * x,0))
sq_cr_2 = rs.AddInterpCurve(zhutou_pt_up2[1:len(zhutou_pt_up)-1])
sq_sr_2 = rs.ExtrudeCurve(sq_cr_2,rs.AddLine(rs.AddPoint(0,0,0),rs.AddPoint(5 * x,0,0)))
for i in range(len(le_trimed1_2)):
    cr1_2 = rs.AddLine(le_trimed1_2[i],le_trimed2_2[i])
    rs.MoveObject(cr1_2,(4 * x,0,21 * x))
    cr1_2 = rs.ProjectCurveToSurface(cr1_2,sq_sr_2,[0,0,x])

    le_brep_2 = rs.ExtrudeCurve(cr1_2,rs.AddLine(rs.AddPoint(0,0,0),rs.AddPoint(-10 * x ,0,0)))
    le_brep_2 = rs.ExtrudeSurface(le_brep_2,rs.AddLine(rs.AddPoint(0,0,0),rs.AddPoint(0 ,0,-14.5 * x)))
    
    le_brep_trimed_2 = rs.ExtrudeCurve(cr1_2,rs.AddLine(rs.AddPoint(0,0,0),rs.AddPoint(-8 * x ,0,0)))
    le_brep_trimed_2 = rs.ExtrudeSurface(le_brep_trimed_2,rs.AddLine(rs.AddPoint(0,0,0),rs.AddPoint(0 ,0,-15 * x)))
    rs.MoveObject(le_brep_trimed_2,(0,0,5 * x))
    le_brep_trimed_g_2.append(le_brep_trimed_2)

rs.MoveObjects(le_brep_trimed_g_2,(0,0,44.5 * x))


#第一层素上的散斗

#佛光寺东大殿散斗

x = CaiFen
#散斗,深12分,广10分,华拱/散斗.深10分,广12分,泥道栱
sd_pt_o = rs.AddPoint(0,0,0)
sd_pt2 = rs.AddPoint(10 * x,0,0)
sd_pt_z1 = rs.AddPoint(- 2 * x,0, 4 * x)
sd_cr_1 = rs.AddLine(sd_pt_o,sd_pt_z1)
#散斗,欹
sd_pt_z2 = rs.CurveMidPoint(sd_cr_1)
direction_left = (x, 0, 2 * x)  # 任意方向向量 
distance = 0.5 * x # 移动距离 
# 单位化方向向量并计算实际位移 
unit_vector_left = rs.VectorUnitize(direction_left)
displacement_left = rs.VectorScale(unit_vector_left, distance)
rs.MoveObject(sd_pt_z2, displacement_left)
sd_cr_1 = rs.AddCurve([sd_pt_o,sd_pt_z2,sd_pt_z1])
sd_pt_3 = rs.MoveObject(rs.CopyObject(sd_pt_o),(0,2 * x,0))
sd_sr1 = rs.AddLine(sd_pt_3,rs.MoveObject(rs.CopyObject(sd_pt_3),(-2 * x,-2 * x,0)))
sd_sr1 = rs.AddLoftSrf([sd_sr1,rs.MoveObject(rs.CopyObject(sd_sr1),(0,0,4* x))])
sd_cr_1 =rs.ProjectCurveToSurface(sd_cr_1,sd_sr1,[0,1,0])
sd_cr_2 = rs.MoveObject(rs.CopyObject(sd_cr_1),(0,10 * x,0 ))
sd_cr_2 = rs.RotateObject(sd_cr_2, rs.CurveStartPoint(sd_cr_2),-90,[0,0,1],copy=True)
sd_cr_3 = rs.MoveObject(rs.CopyObject(sd_cr_2),(10 * x,0,0 ))
sd_cr_3 = rs.RotateObject(sd_cr_3, rs.CurveStartPoint(sd_cr_3),-90,[0,0,1],copy=True)
sd_cr_4 = rs.MoveObject(rs.CopyObject(sd_cr_1),(10 * x,0,0 ))
sd_cr_4 = rs.RotateObject(sd_cr_4, rs.CurveStartPoint(sd_cr_4),90,[0,0,1],copy=True)
sd_down_Brep = rs.AddLoftSrf([sd_cr_1,sd_cr_2,sd_cr_3,sd_cr_4],loft_type=2,closed=True)
rs.CapPlanarHoles(sd_down_Brep)
#散斗,平
sd_sr2 = rs.ExplodePolysurfaces(sd_down_Brep)
sd_sr2 = sd_sr2[2]
sd_mid_Brep = rs.ExtrudeSurface(sd_sr2,rs.AddLine(rs.CurveEndPoint(sd_cr_2),rs.MoveObject(rs.CurveEndPoint(sd_cr_2),(0,0,2 * x))))
sd_sr3_curve= rs.DuplicateEdgeCurves(sd_mid_Brep)[9]
sd_sr3 = rs.AddLoftSrf([sd_sr3_curve,rs.MoveObject(rs.CopyObject(sd_sr3_curve),(0,-2 * x,0))])
sd_source_point = rs.SurfaceAreaCentroid(rs.ExplodePolysurfaces(sd_down_Brep)[1])[0]
sd_up_brep1 = rs.ExtrudeSurface(sd_sr3,rs.AddLine(sd_pt_o,rs.MoveObject(rs.CopyObject(sd_pt_o),(0,0,3.5* x))))
sd_up_brep2 =rs.CopyObject(sd_up_brep1)
rs.MoveObject(sd_up_brep2,(0, -12 * x ,0))


SanDou_up = rs.BooleanDifference(sd_mid_Brep,sd_up_brep2,delete_input=False)
SanDou_up = rs.BooleanDifference(SanDou_up,sd_up_brep1,delete_input=False)
SanDou = rs.BooleanDifference(SanDou_up,sd_down_Brep,delete_input=False)

#散斗被馒头榫剪切
mts_sandou = rs.ExplodePolysurfaces(SanDou)[16]
mts_sandou = rs.CurveEndPoint(rs.DuplicateEdgeCurves(mts_sandou)[0])
rs.MoveObject(mts_sandou,(3.75 * x,3.75 * x,0))
mts_sandou = rs.AddLine(mts_sandou,rs.MoveObject(rs.CopyObject(mts_sandou),(0,2.5 * x,0)))
mts_sandou = rs.ExtrudeCurve(mts_sandou,rs.AddLine(rs.AddPoint(0,0,0),rs.AddPoint(2.5 * x,0,0)))
mts_sandou = rs.ExtrudeSurface(mts_sandou,rs.AddLine(rs.AddPoint(0,0,0),rs.AddPoint(0,0,2.5 * x)))

SanDou = rs.BooleanUnion([SanDou,mts_sandou],delete_input=False)
SanDou_jingshen = rs.CopyObject(SanDou)
rs.RotateObject(SanDou,rs.MoveObject(rs.CopyObject(ZhuTou_point),(-(HuaGong_CaiFen_left-5) * x,2 * x,0)),90,[0,0,x],copy=False)

SanDou_lg_mid = rs.CopyObject(SanDou)
#第二层枋上的散斗


SanDou1_sf2 =rs.MoveObject(rs.CopyObject(SanDou),((HuaGong_CaiFen_left) * x,(NiDaoGong_CaiFen_left-7) * x,15 * x))
SanDou2_sf2 = rs.MirrorObject(SanDou1_sf2,ZhuTou_point,rs.MoveObject(rs.CopyObject(ZhuTou_point),(x,0,0)),copy=True)

SanDous_sf2 = [SanDou1_sf2,SanDou2_sf2]



SanDous_ndg_bj = rs.MoveObjects(rs.CopyObjects(SanDous_sf2),(0,0,-21 * x))

rs.MoveObjects(SanDous_sf2,(j * x - 5 * x,j * x + (MianKuo-((MianKuo+1)/2+1)) * 16 * 15 * x,252 * x +42 * x))

#佛光寺东大殿散斗_华拱

x = CaiFen
#散斗,深12分,广10分,华拱/散斗.深10分,广12分,泥道栱
sd_hg_pt_o = rs.AddPoint(0,0,0)
sd_hg_pt2 = rs.AddPoint(10 * x,0,0)
sd_hg_pt_z1 = rs.AddPoint(- 2 * x,0, 4 * x)
sd_hg_cr_1 = rs.AddLine(sd_hg_pt_o,sd_hg_pt_z1)
#散斗,欹
sd_hg_pt_z2 = rs.CurveMidPoint(sd_hg_cr_1)
direction_left = (x, 0, 2 * x)  # 任意方向向量 
distance = 0.5 * x # 移动距离 
# 单位化方向向量并计算实际位移 
unit_vector_left = rs.VectorUnitize(direction_left)
displacement_left = rs.VectorScale(unit_vector_left, distance)
rs.MoveObject(sd_hg_pt_z2, displacement_left)
sd_hg_cr_1 = rs.AddCurve([sd_hg_pt_o,sd_hg_pt_z2,sd_hg_pt_z1])
sd_hg_pt_3 = rs.MoveObject(rs.CopyObject(sd_hg_pt_o),(0,2 * x,0))
sd_hg_sr1 = rs.AddLine(sd_hg_pt_3,rs.MoveObject(rs.CopyObject(sd_hg_pt_3),(-2 * x,-2 * x,0)))
sd_hg_sr1 = rs.AddLoftSrf([sd_hg_sr1,rs.MoveObject(rs.CopyObject(sd_hg_sr1),(0,0,4* x))])
sd_hg_cr_1 =rs.ProjectCurveToSurface(sd_hg_cr_1,sd_hg_sr1,[0,1,0])
sd_hg_cr_2 = rs.MoveObject(rs.CopyObject(sd_hg_cr_1),(0,10 * x,0 ))
sd_hg_cr_2 = rs.RotateObject(sd_hg_cr_2, rs.CurveStartPoint(sd_hg_cr_2),-90,[0,0,1],copy=True)
sd_hg_cr_3 = rs.MoveObject(rs.CopyObject(sd_hg_cr_2),(12 * x,0,0 ))
sd_hg_cr_3 = rs.RotateObject(sd_hg_cr_3, rs.CurveStartPoint(sd_hg_cr_3),-90,[0,0,1],copy=True)
sd_hg_cr_4 = rs.MoveObject(rs.CopyObject(sd_hg_cr_1),(12 * x,0,0 ))
sd_hg_cr_4 = rs.RotateObject(sd_hg_cr_4, rs.CurveStartPoint(sd_hg_cr_4),90,[0,0,1],copy=True)
sd_hg_down_Brep = rs.AddLoftSrf([sd_hg_cr_1,sd_hg_cr_2,sd_hg_cr_3,sd_hg_cr_4],loft_type=2,closed=True)
rs.CapPlanarHoles(sd_hg_down_Brep)
#散斗,平
sd_hg_sr2 = rs.ExplodePolysurfaces(sd_hg_down_Brep)
sd_hg_sr2 = sd_hg_sr2[2]
sd_hg_mid_Brep = rs.ExtrudeSurface(sd_hg_sr2,rs.AddLine(rs.CurveEndPoint(sd_hg_cr_2),rs.MoveObject(rs.CurveEndPoint(sd_hg_cr_2),(0,0,2 * x))))
sd_hg_sr3_curve= rs.DuplicateEdgeCurves(sd_hg_mid_Brep)[9]
sd_hg_sr3 = rs.AddLoftSrf([sd_hg_sr3_curve,rs.MoveObject(rs.CopyObject(sd_hg_sr3_curve),(0,-2 * x,0))])
sd_hg_source_point = rs.SurfaceAreaCentroid(rs.ExplodePolysurfaces(sd_hg_down_Brep)[1])[0]
sd_hg_up_brep1 = rs.ExtrudeSurface(sd_hg_sr3,rs.AddLine(sd_hg_pt_o,rs.MoveObject(rs.CopyObject(sd_hg_pt_o),(0,0,3.5* x))))
sd_hg_up_brep2 =rs.CopyObject(sd_hg_up_brep1)
rs.MoveObject(sd_hg_up_brep2,(0, -12 * x ,0))


SanDou_hg_up = rs.BooleanDifference(sd_hg_mid_Brep,sd_hg_up_brep2,delete_input=False)
SanDou_hg_up = rs.BooleanDifference(SanDou_hg_up,sd_hg_up_brep1,delete_input=False)
SanDou_hg = rs.BooleanDifference(SanDou_hg_up,sd_hg_down_Brep,delete_input=False)

#散斗被馒头榫剪切
mts_SanDou_hg_hg = rs.ExplodePolysurfaces(SanDou_hg)[16]
mts_SanDou_hg_hg = rs.CurveEndPoint(rs.DuplicateEdgeCurves(mts_SanDou_hg_hg)[0])
rs.MoveObject(mts_SanDou_hg_hg,(4.75 * x,3.75 * x,0))
mts_SanDou_hg_hg = rs.AddLine(mts_SanDou_hg_hg,rs.MoveObject(rs.CopyObject(mts_SanDou_hg_hg),(0,2.5 * x,0)))
mts_SanDou_hg_hg = rs.ExtrudeCurve(mts_SanDou_hg_hg,rs.AddLine(rs.AddPoint(0,0,0),rs.AddPoint(2.5 * x,0,0)))
mts_SanDou_hg_hg = rs.ExtrudeSurface(mts_SanDou_hg_hg,rs.AddLine(rs.AddPoint(0,0,0),rs.AddPoint(0,0,2.5 * x)))

SanDou_hg = rs.BooleanUnion([SanDou_hg,mts_SanDou_hg_hg],delete_input=False)
SanDou_hg_jingshen = rs.CopyObject(SanDou_hg)
rs.RotateObject(SanDou_hg,rs.MoveObject(rs.CopyObject(ZhuTou_point),(-(HuaGong_CaiFen_left-6) * x,2 * x,0)),0,[0,0,x],copy=False)





#第二层枋上的散斗

SanDou1_sf2 =rs.MoveObject(rs.CopyObject(SanDou),((HuaGong_CaiFen_left-5) * x,(NiDaoGong_CaiFen_left-7) * x,15 * x))
SanDou2_sf2 = rs.MirrorObject(SanDou1_sf2,ZhuTou_point,rs.MoveObject(rs.CopyObject(ZhuTou_point),(x,0,0)),copy=True)

##佛光寺东大殿横向枋生成
if NiDaoGong_CaiFen_left != NiDaoGong_CaiFen_right:
    raise ValueError(f"两边必须一样长")

sf1_pt_o = rs.CopyObject(ZhuTou_point)
if (NiDaoGong_CaiFen_left > 25) & (NiDaoGong_CaiFen_right > 25):
    rs.MoveObject(sf1_pt_o,(0,(NiDaoGong_CaiFen_left+22) * x,0))
else : raise ValueError(f"必须大于26分")

sf1_pt_z1 = rs.CopyObject(sf1_pt_o)
rs.MoveObject(sf1_pt_z1,(0,0,9 * x))
sf1_cr_z = rs.AddLine(sf1_pt_o,sf1_pt_z1)
sf1_pt_y1 = rs.CopyObject(sf1_pt_o)
rs.MoveObject(sf1_pt_y1 ,(0,-12 * x,0))
sf1_cr_y = rs.AddLine(sf1_pt_y1,sf1_pt_o)
div_cr_z =rs.DivideCurve(sf1_cr_z,5)
div_cr_y =rs.DivideCurve(sf1_cr_y,5)
#卷杀
CrossCurves_sf1 = []
for i in range(len(div_cr_z)):
    divide_y = div_cr_y[i]
    divide_z = div_cr_z[i]
    CrossCurve_sf1 = rs.AddLine(divide_y,divide_z)
    CrossCurves_sf1.append(CrossCurve_sf1)
CrossCurves_sf1 = CrossCurves_sf1[1:len(CrossCurves_sf1)-1]
#选择交点
CrossCurves_points_sf1 = []
for i in range(len(CrossCurves_sf1)):
    CrossCurves_point_sf1 = rs.CurveCurveIntersection(CrossCurves_sf1[i],CrossCurves_sf1[i-1])[0][1]
    CrossCurves_points_sf1.append(CrossCurves_point_sf1)
CrossCurves_points_sf1 = CrossCurves_points_sf1[1:len(CrossCurves_points_sf1)]
CrossCurves_points_sf1.insert(0,rs.CurveStartPoint(sf1_cr_y))
CrossCurves_points_sf1.insert(len(CrossCurves_points_sf1)+1,rs.CurveEndPoint(sf1_cr_z))
sf1_pt_z2 = rs.CopyObject(sf1_pt_z1)
rs.MoveObject(sf1_pt_z2,(0,0, 6 * x))
sf1_pt_z3 = rs.CopyObject(sf1_pt_z2)
rs.MoveObject(sf1_pt_z3,(0,-10 * x,0))
sf1_pt_y_1 = rs.CopyObject(ZhuTou_point)
rs.MoveObject(sf1_pt_y_1,(0,0,5 * x))
sf1_pt_y_2 = rs.CopyObject(sf1_pt_y_1)
rs.MoveObject(sf1_pt_y_2,(0,4 * x,0))
sf1_pt_y_3 = rs.CopyObject(sf1_pt_y_2)
rs.MoveObject(sf1_pt_y_3,(0,0,10 * x))
CrossCurves_points_sf1.append(sf1_pt_z2)
CrossCurves_points_sf1.append(sf1_pt_z3)
CrossCurves_points_sf1_right = rs.MirrorObjects(CrossCurves_points_sf1,ZhuTou_point,rs.MoveObject(rs.CopyObject(ZhuTou_point),(x,0,x)),copy=True)
rs.MoveObjects(CrossCurves_points_sf1_right,(0,(NiDaoGong_CaiFen_left - NiDaoGong_CaiFen_right) * x,0))
sf1_mid_pt1 = rs.CopyObject(ZhuTou_point)
sf1_mid_pt1 = rs.MoveObject(sf1_mid_pt1,(0,-4 * x,15 * x))
sf1_mid_pt4 = rs.CopyObject(ZhuTou_point)
sf1_mid_pt4 = rs.MoveObject(sf1_mid_pt4,(0,4 * x,15 * x))
sf1_mid_pt2 = rs.CopyObject(sf1_mid_pt1)
rs.MoveObject(sf1_mid_pt2,(0,0,-10 * x))
sf1_mid_pt3 = rs.CopyObject(sf1_mid_pt2)
rs.MoveObject(sf1_mid_pt3,(0,8 * x,0))
CrossCurves_points_sf1.insert(0,CrossCurves_points_sf1_right[0])
CrossCurves_points_sf1.insert(0,CrossCurves_points_sf1_right[1])
CrossCurves_points_sf1.insert(0,CrossCurves_points_sf1_right[2])
CrossCurves_points_sf1.insert(0,CrossCurves_points_sf1_right[3])
CrossCurves_points_sf1.insert(0,CrossCurves_points_sf1_right[4])
CrossCurves_points_sf1.insert(0,CrossCurves_points_sf1_right[5])
CrossCurves_points_sf1.insert(0,CrossCurves_points_sf1_right[6])
CrossCurves_points_sf1.insert(0,sf1_mid_pt1)
CrossCurves_points_sf1.insert(0,sf1_mid_pt2)
CrossCurves_points_sf1.insert(0,sf1_mid_pt3)
CrossCurves_points_sf1.insert(0,sf1_mid_pt4)
sf1_curve_left1 = rs.AddPolyline(CrossCurves_points_sf1)
sf1_curve_left1 = rs.JoinCurves([sf1_curve_left1,rs.AddLine(rs.CurveEndPoint(sf1_curve_left1),rs.CurveStartPoint(sf1_curve_left1))])
rs.MoveObject(sf1_curve_left1,(5 *x,0,0))




sf1_sr_left1 = rs.AddPlanarSrf(sf1_curve_left1)


sf1_brep = rs.ExtrudeSurface(sf1_sr_left1,rs.AddLine(rs.AddPoint(0,0,0),rs.AddPoint(-10 * x,0,0)))

# 拱眼
sf1_gyy_pt1 = rs.CopyObject(sf1_pt_z3)
rs.MoveObject(sf1_gyy_pt1,(-5 * x,0,x))
sf1_gyy_pt2 = rs.CopyObject(sf1_gyy_pt1)
rs.MoveObject(sf1_gyy_pt2,(0,0,-2 * x))
sf1_gyy_pt4 = rs.CopyObject(sf1_mid_pt4)
rs.MoveObject(sf1_gyy_pt4,(-5 * x, 1.625 * x,x))
sf1_gyy_pt3 = rs.CopyObject(sf1_gyy_pt4)
rs.MoveObject(sf1_gyy_pt3,(0,0,-2 * x))
sf1_gyy_cr1 = rs.AddLine(sf1_gyy_pt1,sf1_gyy_pt2)
sf1_gyy_cr2 = rs.AddLine(sf1_gyy_pt2,sf1_gyy_pt3)
sf1_gyy_cr3 = rs.AddLine(sf1_gyy_pt3,sf1_gyy_pt4)
sf1_gyy_cr1 = rs.AddFilletCurve(sf1_gyy_cr1,sf1_gyy_cr2,x)
sf1_gyy_cr2 = rs.AddFilletCurve(sf1_gyy_cr3,sf1_gyy_cr2,x)
sf1_gyy_cr3 = rs.AddLine(rs.CurveEndPoint(sf1_gyy_cr1),rs.CurveEndPoint(sf1_gyy_cr2))
sf1_gyy_cr4 = rs.AddLine(rs.CurveStartPoint(sf1_gyy_cr1),rs.MoveObject(rs.CopyObject(sf1_gyy_pt1),(0,0,x)))
sf1_gyy_cr5 = rs.AddLine(rs.CurveStartPoint(sf1_gyy_cr2),rs.MoveObject(rs.CopyObject(sf1_gyy_pt4),(0,0,x)))
sf1_gyy_1 =rs.JoinCurves([sf1_gyy_cr1,sf1_gyy_cr2,sf1_gyy_cr3,sf1_gyy_cr4,sf1_gyy_cr5])
sf1_gyy_1 =rs.JoinCurves([sf1_gyy_1,rs.AddLine(rs.CurveStartPoint(sf1_gyy_1),rs.CurveEndPoint(sf1_gyy_1))])
rs.MoveObject(sf1_gyy_1,(-x,0,0)) 
sf1_gyy_1 = rs.AddPlanarSrf(sf1_gyy_1)
sf1_gyy_1 = rs.ExtrudeSurface(sf1_gyy_1,rs.AddLine(ZhuTou_point,rs.MoveObject(rs.CopyObject(ZhuTou_point),(2 * x,0,0))))
sf1_gyy_2 = rs.MirrorObject(sf1_gyy_1,ZhuTou_point,rs.MoveObject(rs.CopyObject(ZhuTou_point),(0,x,0)),copy=True)
sf1_gyy_3 = rs.MirrorObject(sf1_gyy_1,ZhuTou_point,rs.MoveObject(rs.CopyObject(ZhuTou_point),(x,0,0)),copy=True)
sf1_gyy_4 = rs.MirrorObject(sf1_gyy_2,ZhuTou_point,rs.MoveObject(rs.CopyObject(ZhuTou_point),(x,0,0)),copy=True)
sf1_brep = rs.BooleanDifference(sf1_brep,sf1_gyy_1)
sf1_brep = rs.BooleanDifference(sf1_brep,sf1_gyy_2)
sf1_brep = rs.BooleanDifference(sf1_brep,sf1_gyy_3)
sf1_brep = rs.BooleanDifference(sf1_brep,sf1_gyy_4)

#素枋的馒头榫生成
mts_sf1 = rs.ExplodePolysurfaces(sf1_brep)[15]
mts_sf1 = rs.CurveEndPoint(rs.DuplicateEdgeCurves(mts_sf1)[0])
rs.MoveObject(mts_sf1,(-3.75 * x,-3.75 * x,0))
mts1_sf1 = rs.AddLine(mts_sf1,rs.MoveObject(rs.CopyObject(mts_sf1),(-2.5 * x,0,0)))
mts1_sf1 = rs.ExtrudeCurve(mts1_sf1,rs.AddLine(rs.AddPoint(0,0,0),rs.AddPoint(0,-2.5 * x,0)))
mts1_sf1 = rs.ExtrudeSurface(mts1_sf1,rs.AddLine(rs.AddPoint(0,0,0),rs.AddPoint(0,0,2.5 * x)))
mts1_sf2 = rs.MirrorObject(mts1_sf1,ZhuTou_point,rs.MoveObject(rs.CopyObject(ZhuTou_point),(x,0,0)),copy=True)

sf1_brep = rs.BooleanDifference(mts1_sf1,sf1_brep,delete_input=False)

sf1_brep = rs.BooleanIntersection(sf1_brep,mts1_sf2,delete_input=True)


#素枋被泥道栱的插销剪切

sf_2_cx_sf1 = rs.ExplodePolysurfaces(sf1_brep)[14]
sf_2_cx_sf1 = rs.CurveEndPoint(rs.DuplicateEdgeCurves(sf_2_cx_sf1)[0])
rs.MoveObject(sf_2_cx_sf1,(-3.75 * x,-3.75 * x,0))
sf_2_cx1_sf1 = rs.AddLine(sf_2_cx_sf1,rs.MoveObject(rs.CopyObject(sf_2_cx_sf1),(-2.5 * x,0,0)))
sf_2_cx1_sf1 = rs.ExtrudeCurve(sf_2_cx1_sf1,rs.AddLine(rs.AddPoint(0,0,0),rs.AddPoint(0,-4 * x,0)))
sf_2_cx1_sf1 = rs.ExtrudeSurface(sf_2_cx1_sf1,rs.AddLine(rs.AddPoint(0,0,0),rs.AddPoint(0,0,4 * x)))
rs.MoveObject(sf_2_cx1_sf1,(0,-(NiDaoGong_CaiFen_left-8) * x,0))

sf_2_cx2_sf1 = rs.MirrorObject(sf_2_cx1_sf1,ZhuTou_point,rs.MoveObject(rs.CopyObject(ZhuTou_point),(x,0,0)),copy=True)

sf1_brep = rs.BooleanDifference(sf_2_cx1_sf1,sf1_brep,delete_input=False)
sf1_brep = rs.BooleanIntersection(sf_2_cx2_sf1,sf1_brep,delete_input=False)
sf1_brep_jinshen = rs.CopyObject(sf1_brep)

#素枋从中间剪切
sf_trimed = rs.AddLine(ZhuTou_point,rs.MoveObject(rs.CopyObject(ZhuTou_point),(0,145 * x,0)))
rs.MoveObject(sf_trimed,(-10 * x,0,0))
sf_trimed = rs.ExtrudeCurve(sf_trimed,rs.AddLine(rs.AddPoint(0,0,0),rs.AddPoint(20 * x,0,0)))
sf_trimed = rs.ExtrudeSurface(sf_trimed,rs.AddLine(rs.AddPoint(0,0,0),rs.AddPoint(0,0,20 * x)))

sf1_brep1 = rs.BooleanDifference(sf1_brep,sf_trimed,delete_input = False)
sf1_brep2 = rs.MirrorObject(sf1_brep1,ZhuTou_point,rs.MoveObject(rs.CopyObject(ZhuTou_point),(x,0,0)),copy=True)
#连接处螳螂榫做法
tls_1 = rs.ExplodePolysurfaces(sf1_brep1)[5]
tls_1 = rs.CurveEndPoint(rs.DuplicateEdgeCurves(tls_1)[1])
rs.MoveObject(tls_1,(3 * x,0,0))

tls_1 = rs.AddLine(tls_1,rs.MoveObject(rs.CopyObject(tls_1),(4 * x,0,0)))
tls_1 = rs.ExtrudeCurve(tls_1,rs.AddLine(rs.AddPoint(0,0,0),rs.AddPoint(0,4 * x,0)))
tls_1 = rs.ExtrudeSurface(tls_1,rs.AddLine(rs.AddPoint(0,0,0),rs.AddPoint(0,0,-5 * x)))
tls_2 = rs.ExplodePolysurfaces(tls_1)[3]
tls_2 = rs.ExtrudeSurface(tls_2,rs.AddLine(rs.AddPoint(0,0,0),rs.AddPoint(0,1 * x,0)))
rs.ScaleObject(tls_2,ZhuTou_point,[1,1,3],copy=False)
tls_3 = rs.ExplodePolysurfaces(tls_2)[5]
rs.ScaleObject(tls_3,ZhuTou_point,[1.4,1,1],copy=False)
tls_3_1 = rs.CopyObject(tls_3)
rs.ScaleObject(tls_3_1,ZhuTou_point,[0.6,1,1],copy=False)
rs.MoveObject(tls_3_1,(0,4 * x))
tls_3 = rs.AddLoftSrf([rs.JoinCurves(rs.DuplicateEdgeCurves(tls_3)),rs.JoinCurves(rs.DuplicateEdgeCurves(tls_3_1))])
rs.CapPlanarHoles(tls_3)
tls = rs.BooleanDifference(tls_2,tls_1,delete_input=True)
tls = rs.BooleanDifference(tls,tls_3,delete_input=True)

sf1_brep1 = rs.BooleanDifference(tls,sf1_brep1,delete_input=False)
sf1_brep2 = rs.BooleanIntersection(sf1_brep2,sf1_brep1,delete_input=False)

sf4_connect_brep1 = rs.CopyObject(sf1_brep1)

sf4_connect_brep2 = rs.CopyObject(sf1_brep2)

sf1_breps = [sf1_brep1[0],sf1_brep2[0]]

sf2_breps = rs.CopyObjects(sf1_breps)




rs.MoveObjects(SanDou,((HuaGong_CaiFen_left-5) * x,-7 * x + (NiDaoGong_CaiFen_left+22) * x ,15 * x))



SanDou2 = rs.MirrorObject(SanDou,ZhuTou_point,rs.MoveObject(rs.CopyObject(ZhuTou_point),(x,0,0)),copy=True)


rs.MoveObjects(sf1_breps ,(j * x,j * x + (MianKuo-((MianKuo+1)/2+1)) * 16 * 15 * x,252 * x +21 * x))

rs.MoveObjects([SanDou,SanDou2] ,(j * x,j * x + (MianKuo-((MianKuo+1)/2+1)) * 16 * 15 * x,252 * x +21 * x))


sf1_brep_right_1 = [sf1_breps[0]]
sf1_brep_right_2 = [sf1_breps[1]]


sq_rule = [0,0,0,0,0,0,0,0,0,0,0,0,0,0,0,0,0,0,0,0,2.5,5]
for i in range(int((MianKuo - 3)/2)):
    if i + 1 < len(range(int((MianKuo - 3)/2))):
        sf1_brep1 = rs.MoveObject(rs.CopyObject(sf1_breps[0]),(0,-(MianKuo_length * (i+1)) * x,sq_rule[-(int((MianKuo - 3)/2-i))] * x))
        sf1_brep2 = rs.MoveObject(rs.CopyObject(sf1_breps[1]),(0,-(MianKuo_length * (i+1)) * x,sq_rule[-(int((MianKuo - 3)/2-i))] * x))
        sf1_brep_right_1.append(sf1_brep1)
        sf1_brep_right_2.append(sf1_brep2)
    
sf1_brep_left_1 = rs.MirrorObjects(sf1_brep_right_2,rs.MoveObject(rs.CopyObject(ZhuTou_point),(0,(MianKuo_length * (MianKuo - 2) * x + 2 * j * x)/2 ,0)),rs.MoveObject(rs.CopyObject(ZhuTou_point),(x,(MianKuo_length * (MianKuo - 2) * x + 2 * j * x)/2 ,0)),copy=True)
sf1_brep_left_1 = sf1_brep_left_1[::-1]

#
sf1_brep_left_2 = rs.MirrorObjects(sf1_brep_right_1,rs.MoveObject(rs.CopyObject(ZhuTou_point),(0,(MianKuo_length * (MianKuo - 2) * x + 2 * j * x)/2 ,0)),rs.MoveObject(rs.CopyObject(ZhuTou_point),(x,(MianKuo_length * (MianKuo - 2) * x + 2 * j * x)/2 ,0)),copy=True)
sf1_brep_left_2 = sf1_brep_left_2[::-1]


sufang_breps_1 = sf1_brep_left_1 + sf1_brep_right_1
sufang_breps_2 = sf1_brep_left_2 + sf1_brep_right_2

#铺间辅作
##佛光寺东大殿柱头铺作生成





#泥道栱
if NiDaoGong_CaiFen_left != NiDaoGong_CaiFen_right:
    raise ValueError(f"两边必须一样长")

ndg_bj1_pt_o = rs.CopyObject(ZhuTou_point)
if (NiDaoGong_CaiFen_left > 25) & (NiDaoGong_CaiFen_right > 25):
    rs.MoveObject(ndg_bj1_pt_o,(0,(NiDaoGong_CaiFen_left) * x,0))
else : raise ValueError(f"必须大于26分")

ndg_bj1_pt_z1 = rs.CopyObject(ndg_bj1_pt_o)
rs.MoveObject(ndg_bj1_pt_z1,(0,0,9 * x))
ndg_bj1_cr_z = rs.AddLine(ndg_bj1_pt_o,ndg_bj1_pt_z1)
ndg_bj1_pt_y1 = rs.CopyObject(ndg_bj1_pt_o)
rs.MoveObject(ndg_bj1_pt_y1 ,(0,-12 * x,0))
ndg_bj1_cr_y = rs.AddLine(ndg_bj1_pt_y1,ndg_bj1_pt_o)
div_cr_z =rs.DivideCurve(ndg_bj1_cr_z,5)
div_cr_y =rs.DivideCurve(ndg_bj1_cr_y,5)
#卷杀
CrossCurves_ndg_bj1 = []
for i in range(len(div_cr_z)):
    divide_y = div_cr_y[i]
    divide_z = div_cr_z[i]
    CrossCurve_ndg_bj1 = rs.AddLine(divide_y,divide_z)
    CrossCurves_ndg_bj1.append(CrossCurve_ndg_bj1)
CrossCurves_ndg_bj1 = CrossCurves_ndg_bj1[1:len(CrossCurves_ndg_bj1)-1]
#选择交点
CrossCurves_points_ndg_bj1 = []
for i in range(len(CrossCurves_ndg_bj1)):
    CrossCurves_point_ndg_bj1 = rs.CurveCurveIntersection(CrossCurves_ndg_bj1[i],CrossCurves_ndg_bj1[i-1])[0][1]
    CrossCurves_points_ndg_bj1.append(CrossCurves_point_ndg_bj1)
CrossCurves_points_ndg_bj1 = CrossCurves_points_ndg_bj1[1:len(CrossCurves_points_ndg_bj1)]
CrossCurves_points_ndg_bj1.insert(0,rs.CurveStartPoint(ndg_bj1_cr_y))
CrossCurves_points_ndg_bj1.insert(len(CrossCurves_points_ndg_bj1)+1,rs.CurveEndPoint(ndg_bj1_cr_z))
ndg_bj1_pt_z2 = rs.CopyObject(ndg_bj1_pt_z1)
rs.MoveObject(ndg_bj1_pt_z2,(0,0, 6 * x))
ndg_bj1_pt_z3 = rs.CopyObject(ndg_bj1_pt_z2)
rs.MoveObject(ndg_bj1_pt_z3,(0,-10 * x,0))
ndg_bj1_pt_y_1 = rs.CopyObject(ZhuTou_point)
rs.MoveObject(ndg_bj1_pt_y_1,(0,0,5 * x))
ndg_bj1_pt_y_2 = rs.CopyObject(ndg_bj1_pt_y_1)
rs.MoveObject(ndg_bj1_pt_y_2,(0,4 * x,0))
ndg_bj1_pt_y_3 = rs.CopyObject(ndg_bj1_pt_y_2)
rs.MoveObject(ndg_bj1_pt_y_3,(0,0,10 * x))
CrossCurves_points_ndg_bj1.append(ndg_bj1_pt_z2)
CrossCurves_points_ndg_bj1.append(ndg_bj1_pt_z3)
CrossCurves_points_ndg_bj1_right = rs.MirrorObjects(CrossCurves_points_ndg_bj1,ZhuTou_point,rs.MoveObject(rs.CopyObject(ZhuTou_point),(x,0,x)),copy=True)
rs.MoveObjects(CrossCurves_points_ndg_bj1_right,(0,(NiDaoGong_CaiFen_left - NiDaoGong_CaiFen_right) * x,0))
ndg_bj1_mid_pt1 = rs.CopyObject(ZhuTou_point)
ndg_bj1_mid_pt1 = rs.MoveObject(ndg_bj1_mid_pt1,(0,-4 * x,15 * x))
ndg_bj1_mid_pt4 = rs.CopyObject(ZhuTou_point)
ndg_bj1_mid_pt4 = rs.MoveObject(ndg_bj1_mid_pt4,(0,4 * x,15 * x))
ndg_bj1_mid_pt2 = rs.CopyObject(ndg_bj1_mid_pt1)
rs.MoveObject(ndg_bj1_mid_pt2,(0,0,-10 * x))
ndg_bj1_mid_pt3 = rs.CopyObject(ndg_bj1_mid_pt2)
rs.MoveObject(ndg_bj1_mid_pt3,(0,8 * x,0))
CrossCurves_points_ndg_bj1.insert(0,CrossCurves_points_ndg_bj1_right[0])
CrossCurves_points_ndg_bj1.insert(0,CrossCurves_points_ndg_bj1_right[1])
CrossCurves_points_ndg_bj1.insert(0,CrossCurves_points_ndg_bj1_right[2])
CrossCurves_points_ndg_bj1.insert(0,CrossCurves_points_ndg_bj1_right[3])
CrossCurves_points_ndg_bj1.insert(0,CrossCurves_points_ndg_bj1_right[4])
CrossCurves_points_ndg_bj1.insert(0,CrossCurves_points_ndg_bj1_right[5])
CrossCurves_points_ndg_bj1.insert(0,CrossCurves_points_ndg_bj1_right[6])
CrossCurves_points_ndg_bj1.insert(0,ndg_bj1_mid_pt1)
CrossCurves_points_ndg_bj1.insert(0,ndg_bj1_mid_pt2)
CrossCurves_points_ndg_bj1.insert(0,ndg_bj1_mid_pt3)
CrossCurves_points_ndg_bj1.insert(0,ndg_bj1_mid_pt4)
ndg_bj1_curve_left1 = rs.AddPolyline(CrossCurves_points_ndg_bj1)
ndg_bj1_curve_left1 = rs.JoinCurves([ndg_bj1_curve_left1,rs.AddLine(rs.CurveEndPoint(ndg_bj1_curve_left1),rs.CurveStartPoint(ndg_bj1_curve_left1))])
rs.MoveObject(ndg_bj1_curve_left1,(5 *x,0,0))




ndg_bj1_sr_left1 = rs.AddPlanarSrf(ndg_bj1_curve_left1)


ndg_bj1_brep = rs.ExtrudeSurface(ndg_bj1_sr_left1,rs.AddLine(rs.AddPoint(0,0,0),rs.AddPoint(-10 * x,0,0)))

# 拱眼
ndg_bj1_gyy_pt1 = rs.CopyObject(ndg_bj1_pt_z3)
rs.MoveObject(ndg_bj1_gyy_pt1,(-5 * x,0,x))
ndg_bj1_gyy_pt2 = rs.CopyObject(ndg_bj1_gyy_pt1)
rs.MoveObject(ndg_bj1_gyy_pt2,(0,0,-2 * x))
ndg_bj1_gyy_pt4 = rs.CopyObject(ndg_bj1_mid_pt4)
rs.MoveObject(ndg_bj1_gyy_pt4,(-5 * x, 1.625 * x,x))
ndg_bj1_gyy_pt3 = rs.CopyObject(ndg_bj1_gyy_pt4)
rs.MoveObject(ndg_bj1_gyy_pt3,(0,0,-2 * x))
ndg_bj1_gyy_cr1 = rs.AddLine(ndg_bj1_gyy_pt1,ndg_bj1_gyy_pt2)
ndg_bj1_gyy_cr2 = rs.AddLine(ndg_bj1_gyy_pt2,ndg_bj1_gyy_pt3)
ndg_bj1_gyy_cr3 = rs.AddLine(ndg_bj1_gyy_pt3,ndg_bj1_gyy_pt4)
ndg_bj1_gyy_cr1 = rs.AddFilletCurve(ndg_bj1_gyy_cr1,ndg_bj1_gyy_cr2,x)
ndg_bj1_gyy_cr2 = rs.AddFilletCurve(ndg_bj1_gyy_cr3,ndg_bj1_gyy_cr2,x)
ndg_bj1_gyy_cr3 = rs.AddLine(rs.CurveEndPoint(ndg_bj1_gyy_cr1),rs.CurveEndPoint(ndg_bj1_gyy_cr2))
ndg_bj1_gyy_cr4 = rs.AddLine(rs.CurveStartPoint(ndg_bj1_gyy_cr1),rs.MoveObject(rs.CopyObject(ndg_bj1_gyy_pt1),(0,0,x)))
ndg_bj1_gyy_cr5 = rs.AddLine(rs.CurveStartPoint(ndg_bj1_gyy_cr2),rs.MoveObject(rs.CopyObject(ndg_bj1_gyy_pt4),(0,0,x)))
ndg_bj1_gyy_1 =rs.JoinCurves([ndg_bj1_gyy_cr1,ndg_bj1_gyy_cr2,ndg_bj1_gyy_cr3,ndg_bj1_gyy_cr4,ndg_bj1_gyy_cr5])
ndg_bj1_gyy_1 =rs.JoinCurves([ndg_bj1_gyy_1,rs.AddLine(rs.CurveStartPoint(ndg_bj1_gyy_1),rs.CurveEndPoint(ndg_bj1_gyy_1))])
rs.MoveObject(ndg_bj1_gyy_1,(-x,0,0)) 
ndg_bj1_gyy_1 = rs.AddPlanarSrf(ndg_bj1_gyy_1)
ndg_bj1_gyy_1 = rs.ExtrudeSurface(ndg_bj1_gyy_1,rs.AddLine(ZhuTou_point,rs.MoveObject(rs.CopyObject(ZhuTou_point),(2 * x,0,0))))
ndg_bj1_gyy_2 = rs.MirrorObject(ndg_bj1_gyy_1,ZhuTou_point,rs.MoveObject(rs.CopyObject(ZhuTou_point),(0,x,0)),copy=True)
ndg_bj1_gyy_3 = rs.MirrorObject(ndg_bj1_gyy_1,ZhuTou_point,rs.MoveObject(rs.CopyObject(ZhuTou_point),(x,0,0)),copy=True)
ndg_bj1_gyy_4 = rs.MirrorObject(ndg_bj1_gyy_2,ZhuTou_point,rs.MoveObject(rs.CopyObject(ZhuTou_point),(x,0,0)),copy=True)
ndg_bj1_brep = rs.BooleanDifference(ndg_bj1_brep,ndg_bj1_gyy_1)
ndg_bj1_brep = rs.BooleanDifference(ndg_bj1_brep,ndg_bj1_gyy_2)
ndg_bj1_brep = rs.BooleanDifference(ndg_bj1_brep,ndg_bj1_gyy_3)
ndg_bj1_brep = rs.BooleanDifference(ndg_bj1_brep,ndg_bj1_gyy_4)

#素枋的馒头榫生成
mts_ndg_bj1 = rs.ExplodePolysurfaces(ndg_bj1_brep)[15]
mts_ndg_bj1 = rs.CurveEndPoint(rs.DuplicateEdgeCurves(mts_ndg_bj1)[0])
rs.MoveObject(mts_ndg_bj1,(-3.75 * x,-3.75 * x,0))
mts1_ndg_bj1 = rs.AddLine(mts_ndg_bj1,rs.MoveObject(rs.CopyObject(mts_ndg_bj1),(-2.5 * x,0,0)))
mts1_ndg_bj1 = rs.ExtrudeCurve(mts1_ndg_bj1,rs.AddLine(rs.AddPoint(0,0,0),rs.AddPoint(0,-2.5 * x,0)))
mts1_ndg_bj1 = rs.ExtrudeSurface(mts1_ndg_bj1,rs.AddLine(rs.AddPoint(0,0,0),rs.AddPoint(0,0,2.5 * x)))
mts1_ndg_bj2 = rs.MirrorObject(mts1_ndg_bj1,ZhuTou_point,rs.MoveObject(rs.CopyObject(ZhuTou_point),(x,0,0)),copy=True)

ndg_bj1_brep = rs.BooleanDifference(mts1_ndg_bj1,ndg_bj1_brep,delete_input=False)

ndg_bj1_brep = rs.BooleanIntersection(ndg_bj1_brep,mts1_ndg_bj2,delete_input=False)


#素枋被泥道栱的插销剪切

ndg_bj_2_cx_ndg_bj1 = rs.ExplodePolysurfaces(ndg_bj1_brep)[14]
ndg_bj_2_cx_ndg_bj1 = rs.CurveEndPoint(rs.DuplicateEdgeCurves(ndg_bj_2_cx_ndg_bj1)[0])
rs.MoveObject(ndg_bj_2_cx_ndg_bj1,(-3.75 * x,-3.75 * x,0))
ndg_bj_2_cx1_ndg_bj1 = rs.AddLine(ndg_bj_2_cx_ndg_bj1,rs.MoveObject(rs.CopyObject(ndg_bj_2_cx_ndg_bj1),(-2.5 * x,0,0)))
ndg_bj_2_cx1_ndg_bj1 = rs.ExtrudeCurve(ndg_bj_2_cx1_ndg_bj1,rs.AddLine(rs.AddPoint(0,0,0),rs.AddPoint(0,-4 * x,0)))
ndg_bj_2_cx1_ndg_bj1 = rs.ExtrudeSurface(ndg_bj_2_cx1_ndg_bj1,rs.AddLine(rs.AddPoint(0,0,0),rs.AddPoint(0,0,4 * x)))
rs.MoveObject(ndg_bj_2_cx1_ndg_bj1,(0,-(NiDaoGong_CaiFen_left-8) * x,0))

ndg_bj_2_cx2_ndg_bj1 = rs.MirrorObject(ndg_bj_2_cx1_ndg_bj1,ZhuTou_point,rs.MoveObject(rs.CopyObject(ZhuTou_point),(x,0,0)),copy=True)

ndg_bj1_brep = rs.BooleanDifference(ndg_bj_2_cx1_ndg_bj1,ndg_bj1_brep,delete_input=False)
ndg_bj1_brep = rs.BooleanIntersection(ndg_bj_2_cx2_ndg_bj1,ndg_bj1_brep,delete_input=False)
ndg_bj1_brep_jinshen = rs.CopyObject(ndg_bj1_brep)


rs.MoveObject(ndg_bj1_brep ,(j * x,j * x + (MianKuo-((MianKuo+1)/2+1)) * 16 * 15 * x + (MianKuo_length * x)/2,252 * x +21 * x))



ndg_bj_breps = [ndg_bj1_brep[0]]
ndg_bj2_brep = rs.CopyObject(ndg_bj1_brep)



sq_rule = [0,0,0,0,0,0,0,0,0,0,0,0,0,0,0,0,0,0,0,0,1.25,4.25]
for i in range(int((MianKuo - 3)/2)):
    if i + 1 < len(range(int((MianKuo - 3)/2)+1)):
        ndg_bj_brep1 = rs.MoveObject(rs.CopyObject(ndg_bj1_brep),(0,-(MianKuo_length * (i+1)) * x,sq_rule[-(int((MianKuo - 3)/2-i))] * x))
        ndg_bj_breps.append(ndg_bj_brep1)

ndg_bj_breps_left  = rs.MirrorObjects(ndg_bj_breps[1:len(ndg_bj_breps)],rs.MoveObject(rs.CopyObject(ZhuTou_point),(j * x,(MianKuo_length * (MianKuo - 2) * x + 2 * j * x)/2 ,0)),rs.MoveObject(rs.CopyObject(ZhuTou_point),(x,(MianKuo_length * (MianKuo - 2) * x + 2 * j * x)/2 ,0)),copy=True)

ndg_bj_breps_left = ndg_bj_breps_left[::-1]

ndg_bj_breps = ndg_bj_breps_left + ndg_bj_breps

ndg_bj3_breps = rs.MoveObjects(rs.CopyObjects(ndg_bj_breps[1:len(ndg_bj_breps)-1]),(0,0,42 * x))

#将第一层枋和素枋第一层泥道连接
le_brep_trimed_g_2 = le_brep_trimed_g_2[::-1]

sufang_breps_1_1 = sufang_breps_1[0 : len(sufang_breps_1)-1]

sufang_breps_2_1 = sufang_breps_2[1 : len(sufang_breps_2)]

le_brep_trimed_g_2_1 = le_brep_trimed_g_2[1:len(le_brep_trimed_g_2)-1]

sufang_breps = []

for i in range(len(le_brep_trimed_g_2_1)):

    if i <= len(le_brep_trimed_g_2_1)/2:
        sufang_brep = rs.BooleanUnion([le_brep_trimed_g_2_1[i],sufang_breps_1_1[i]],delete_input=False)[0]
    else:
        sufang_brep = rs.BooleanDifference(sufang_breps_1_1[i],le_brep_trimed_g_2_1[i],delete_input=False)[0]
    sufang_breps.append(sufang_brep)

sufang_breps1 = []

for i in range(len(sufang_breps)):
    if i > len(le_brep_trimed_g_2_1)/2:
        sufang_brep = rs.BooleanDifference(sufang_breps[i],sufang_breps_2_1[i],delete_input=False)[0]
    elif i == int(len(le_brep_trimed_g_2_1)/2):
        sufang_brep = rs.BooleanUnion([sufang_breps[i],sufang_breps_2_1[i]],delete_input=False)[0]
    else:
        sufang_brep = rs.BooleanDifference(sufang_breps_2_1[i],sufang_breps[i],delete_input=False)[0]
    
    sufang_breps1.append(sufang_brep)

sufang_breps1_first = rs.BooleanDifference(sufang_breps_2[0],le_brep_trimed_g_2[0],delete_input=False)

sufang_breps1.insert(0,sufang_breps1_first[0])

sufang_breps1_last = rs.BooleanDifference(sufang_breps_1[-1],le_brep_trimed_g_2[-1],delete_input=False)

sufang_breps1.append(sufang_breps1_last[0])


sufang_breps = sufang_breps1

##将第一层枋和补间的泥道栱连接

sufang3_breps = sufang_breps
sufang_breps2 = []
for i in range(len(sufang_breps)):
    if i == int(len(sufang_breps)/2):
        sufang_brep = rs.BooleanUnion([sufang_breps[i],ndg_bj_breps[i]],delete_input=False)
    else:
        sufang_brep = rs.BooleanDifference(sufang_breps[i],ndg_bj_breps[i],delete_input=False)    
    sufang_breps2.append(sufang_brep[0])

sufang_breps = sufang_breps2

#补间辅作第二跳华拱
#原点
BasePoint = 0
pt_o = rs.AddPoint(BasePoint * 500,0,0)
#卷杀结束y点
pt_1 = rs.AddPoint(BasePoint * 500,0,9 * x)
#卷杀结束x点
pt_2 = rs.AddPoint(BasePoint * 500 + 16 * x, 0 ,0)
#生成要进行拆分的曲线
curve_x = rs.AddLine(pt_2,pt_o)
curve_y = rs.AddLine(pt_o,pt_1)
#拆分曲线生成点
divide_curve_x_points = rs.DivideCurve(curve_x,5)
divide_curve_y_points = rs.DivideCurve(curve_y,5)
#卷杀
CrossCurves = []
for i in range(len(divide_curve_x_points)):
    divide_x = divide_curve_x_points[i]
    divide_y = divide_curve_y_points[i]
    CrossCurve = rs.AddLine(divide_x,divide_y)
    CrossCurves.append(CrossCurve)
CrossCurves = CrossCurves[1:len(CrossCurves)-1]
#选择交点
CrossCurves_points = []
for i in range(len(CrossCurves)):
    CrossCurves_point = rs.CurveCurveIntersection(CrossCurves[i],CrossCurves[i-1])[0][1]
    CrossCurves_points.append(CrossCurves_point)
CrossCurves_points = CrossCurves_points[1:len(CrossCurves_points)]
CrossCurves_points.insert(0,rs.CurveStartPoint(curve_x))
CrossCurves_points.insert(len(CrossCurves_points)+1,rs.CurveEndPoint(curve_y))
#卷杀线
JuanSha_curve = rs.AddPolyline(CrossCurves_points)
pt_3z = rs.CopyObject(pt_1)
rs.MoveObject(pt_3z,(0,0,6 * x))
pt_4z = rs.CopyObject(pt_3z)
rs.MoveObject(pt_4z,(12 * x,0,0))
pt_3x = rs.CopyObject(pt_2)
if HuaGong_CaiFen_left > 25:
    rs.MoveObject(pt_3x,((HuaGong_CaiFen_left - 16 /2 - 16) * x ,0,0))
pt_4x = rs.CopyObject(pt_3x)
#中间材，材广为16.5分
zjc_pt1 = rs.CopyObject(pt_3x)
zjc_pt1 = rs.MoveObject(zjc_pt1,(16 * x,0,0))
zjc_curve = rs.AddLine(pt_3x,zjc_pt1)
#右边斗拱的线
pt_3x_right = rs.CopyObject(zjc_pt1)
pt_2x_right = rs.CopyObject(zjc_pt1)
if HuaGong_CaiFen_right > 25:
    rs.MoveObject(pt_2x_right,((HuaGong_CaiFen_right - 16 - 16/2) * x,0,0))
else: rs.MoveObject(pt_2x_right,(0,0,0))
#卷杀结束x点
pt_1_right = rs.CopyObject(pt_2x_right)
rs.MoveObject(pt_1_right,(16 * x,0,0))
pt_2_right = rs.CopyObject(pt_1_right)
rs.MoveObject(pt_2_right,(0,0,9 * x))
curve_x_right = rs.AddLine(pt_2x_right,pt_1_right)
curve_y_right = rs.AddLine(pt_1_right,pt_2_right)
#拆分曲线生成点
divide_curve_x_points_right = rs.DivideCurve(curve_x_right,5)
divide_curve_y_points_right = rs.DivideCurve(curve_y_right,5)
#卷杀
CrossCurves_right = []
for i in range(len(divide_curve_x_points_right)):
    divide_x = divide_curve_x_points_right[i]
    divide_y = divide_curve_y_points_right[i]
    CrossCurve_right = rs.AddLine(divide_x,divide_y)
    CrossCurves_right.append(CrossCurve_right)
del CrossCurves_right[-1]
del CrossCurves_right[0]
CrossCurves_points_right = []
for i in range(len(CrossCurves_right)):
    CrossCurves_point_right = rs.CurveCurveIntersection(CrossCurves_right[i],CrossCurves_right[i-1])[0][1]
    CrossCurves_points_right.append(CrossCurves_point_right)
CrossCurves_points_right = CrossCurves_points_right[1:len(CrossCurves_points_right)]
pt_3x_right = rs.CopyObject(CrossCurves_points_right[0])
pt_4x_right = rs.CopyObject(CrossCurves_points_right[1])
pt_5x_right = rs.CopyObject(CrossCurves_points_right[2])
pt_3z_right = rs.CopyObject(pt_2_right)
rs.MoveObject(pt_3z_right,(0,0,6 * x))
pt_4z_right = rs.CopyObject(pt_3z_right)
rs.MoveObject(pt_4z_right,(-12 * x,0,0))
#华拱下弧线
CrossCurves_points.append(pt_3z)
CrossCurves_points.append(pt_4z)
CrossCurves_points.insert(0,pt_3x)
CrossCurves_points.insert(0,pt_4x)
CrossCurves_points.insert(0,pt_2x_right)
CrossCurves_points.insert(0,pt_3x_right)
CrossCurves_points.insert(0,pt_4x_right)
CrossCurves_points.insert(0,pt_5x_right)
CrossCurves_points.insert(0,pt_2_right)
CrossCurves_points.insert(0,pt_3z_right)
CrossCurves_points.insert(0,pt_4z_right)
JuanSha_curve = rs.AddPolyline(CrossCurves_points)
#欹幽
#左
qa_left_2 = rs.CopyObject(pt_4z)
rs.MoveObject(qa_left_2,(2 * x,0,4 * x))
qa_curve_left_1 = rs.AddLine(pt_4z,qa_left_2)

qa_left_3 = rs.CurveMidPoint(qa_curve_left_1)
direction_left = (-x, 0, 2 * x)  # 任意方向向量 
distance = 0.5 * x # 移动距离 
# 单位化方向向量并计算实际位移 
unit_vector_left = rs.VectorUnitize(direction_left)
displacement_left = rs.VectorScale(unit_vector_left, distance)
rs.MoveObject(qa_left_3, displacement_left)
qa_curve_left_1 = rs.AddCurve([pt_4z,qa_left_3,qa_left_2])
#欹幽
#右
qa_right_2 = rs.CopyObject(pt_4z_right)
rs.MoveObject(qa_right_2,(-2 * x,0,4 * x))
qa_curve_right_1 = rs.AddLine(pt_4z_right,qa_right_2)

qa_right_3 = rs.CurveMidPoint(qa_curve_right_1)
direction_right = (x, 0, 2 * x)  # 任意方向向量 
distance = 0.5 * x # 移动距离 
# 单位化方向向量并计算实际位移 
unit_vector_right = rs.VectorUnitize(direction_right)
displacement_right = rs.VectorScale(unit_vector_right, distance)
rs.MoveObject(qa_right_3, displacement_right)
qa_curve_right_1 = rs.AddCurve([pt_4z_right,qa_right_3,qa_right_2])
#拱眼上部
gy_left_up_1 = rs.CopyObject(qa_left_2)
rs.MoveObject(gy_left_up_1,(0,0,2 * x))
gy_right_up_1 = rs.CopyObject(qa_right_2)
rs.MoveObject(gy_right_up_1,(0,0,2 * x))
gy_up_curve = rs.AddPolyline([qa_left_2,gy_left_up_1,gy_right_up_1,qa_right_2])
#华拱未剪切前
HuaGong_untrimed = rs.JoinCurves([JuanSha_curve,qa_curve_left_1,qa_curve_right_1,gy_up_curve ])
HuaGong_untrimed = rs.AddPlanarSrf(HuaGong_untrimed)
extrude_curve1 = rs.AddLine(pt_o,rs.MoveObject(rs.CopyObject(pt_o),(0,10 * x,0)))
HuaGong_untrimed = rs.ExtrudeSurface(HuaGong_untrimed,extrude_curve1)
#剪切斗拱下部
#斗拱下部 广16分,厚为5分
HuaGong_dowm_curve = rs.AddLine(pt_3x,zjc_pt1)
HuaGong_dowm_curve2 =rs.CopyObject(HuaGong_dowm_curve)
rs.MoveObject(HuaGong_dowm_curve2,(0,0,5 * x))
HuaGong_dowm = rs.AddLoftSrf([HuaGong_dowm_curve,HuaGong_dowm_curve2])
HuaGong_dowm = rs.ExtrudeSurface(HuaGong_dowm,extrude_curve1)
rs.ScaleObject(HuaGong_dowm,ZhuTou_point,[10/16,1,1],copy=False)
HuaGong = rs.BooleanDifference(HuaGong_dowm,HuaGong_untrimed,delete_input = False)
#剪切斗拱中部
#斗拱下部 广10分,厚为10.125分
HuaGong_mid_curve_pt1 = rs.CopyObject(rs.CurveStartPoint(HuaGong_dowm_curve2))
rs.MoveObject(HuaGong_mid_curve_pt1,(3 * x,0,0))
HuaGong_mid_curve_pt2 = rs.CopyObject(HuaGong_mid_curve_pt1)
rs.MoveObject(HuaGong_mid_curve_pt2,(10 * x,0,0))
HuaGong_mid_curve1 = rs.AddLine(HuaGong_mid_curve_pt1,HuaGong_mid_curve_pt2)
HuaGong_mid_curve2 =rs.CopyObject(HuaGong_mid_curve1)
rs.MoveObject(HuaGong_mid_curve2,(0,0,10* x))
HuaGong_mid = rs.AddLoftSrf([HuaGong_mid_curve1,HuaGong_mid_curve2])
rs.MoveObject(HuaGong_mid,(0,1 * x,0))
extrude_curve2 = rs.AddLine(HuaGong_mid_curve_pt1,rs.MoveObject(rs.CopyObject(HuaGong_mid_curve_pt1),(0,-1 *x,0)))
HuaGong_mid = rs.ExtrudeSurface(HuaGong_mid,extrude_curve2)
HuaGong_mid2 =rs.CopyObject(HuaGong_mid)
rs.MoveObject(HuaGong_mid2,(0,9 * x,0))
HuaGong_mid = [HuaGong_mid,HuaGong_mid2]
HuaGong = rs.BooleanDifference(HuaGong,HuaGong_mid,delete_input = False)
#剪切拱眼
#左
gy_left_pt_1 = rs.CopyObject(rs.CurveStartPoint(HuaGong_mid_curve2))
rs.MoveObject(gy_left_pt_1,(-1.75/2 * x,0,0))
gy_right_pt_1 = rs.CopyObject(rs.CurveEndPoint(HuaGong_mid_curve2))
rs.MoveObject(gy_right_pt_1,(1.75/2 * x,0,0))


qa_left_2_2 = rs.CopyObject(gy_left_pt_1)
rs.MoveObject(qa_left_2_2,(-2 * x,0,4 * x))
qa_curve_left_1_2 = rs.AddLine(gy_left_pt_1,qa_left_2_2)

qa_left_3_2 = rs.CurveMidPoint(qa_curve_left_1_2)
direction_left_2 = (x, 0, 2 * x)  # 任意方向向量 
distance = 0.5 * x # 移动距离 
# 单位化方向向量并计算实际位移 
unit_vector_left_2 = rs.VectorUnitize(direction_left_2)
displacement_left_2 = rs.VectorScale(unit_vector_left_2, distance)
rs.MoveObject(qa_left_3_2, displacement_left_2)
qa_curve_left_1_2 = rs.AddCurve([gy_left_pt_1,qa_left_3_2,qa_left_2_2])


qa_right_2_2 = rs.CopyObject(gy_right_pt_1)
rs.MoveObject(qa_right_2_2,(2 * x,0,4 * x))
qa_curve_right_1_2 = rs.AddLine(gy_right_pt_1,qa_right_2_2)
qa_right_3_2 = rs.CurveMidPoint(qa_curve_right_1_2)
direction_right_2 = (-x, 0, 2 * x)  # 任意方向向量 
distance = 0.5 * x # 移动距离 
# 单位化方向向量并计算实际位移 
unit_vector_right_2 = rs.VectorUnitize(direction_right_2)
displacement_right_2 = rs.VectorScale(unit_vector_right_2, distance)
rs.MoveObject(qa_right_3_2, displacement_right_2)
qa_curve_right_1_2 = rs.AddCurve([gy_right_pt_1,qa_right_3_2,qa_right_2_2])

#拱眼出头
gy_up_1 = rs.CopyObject(qa_left_2_2)
rs.MoveObject(gy_up_1,(0,0,2 * x))
gy_up_2 = rs.CopyObject(qa_right_2_2)
rs.MoveObject(gy_up_2,(0,0,2 * x))
gy_curve_1_left = rs.AddLine(qa_left_2_2,gy_up_1)
gy_curve_1_right = rs.AddLine(qa_right_2_2,gy_up_2)

#拱眼隐去部深1分
#左
gy_y_l1 = rs.CopyObject(pt_4z)
rs.MoveObject(gy_y_l1,(0,0,-x))
gy_y_l2 = rs.CopyObject(gy_left_pt_1)
rs.MoveObject(gy_y_l2,(0,0,-x))
gy_y_curve = rs.AddPolyline([pt_4z,gy_y_l1,gy_y_l2,gy_left_pt_1])
gy_y_curve_1 = rs.AddFilletCurve(rs.AddLine(pt_4z,gy_y_l1),rs.AddLine(gy_y_l1,gy_y_l2),radius = x)
gy_y_curve_2 = rs.AddFilletCurve(rs.AddLine(gy_left_pt_1,gy_y_l2),rs.AddLine(gy_y_l2,gy_y_l1),radius = x)
gy_y_curve = rs.JoinCurves([gy_y_curve_1,rs.AddLine(rs.CurveEndPoint(gy_y_curve_1),rs.CurveEndPoint(gy_y_curve_2)),gy_y_curve_2])
#右
gy_y_r1 = rs.CopyObject(pt_4z_right)
rs.MoveObject(gy_y_r1,(0,0,-x))
gy_y_r2 = rs.CopyObject(gy_right_pt_1)
rs.MoveObject(gy_y_r2,(0,0,-x))
gy_y_curve_right = rs.AddPolyline([pt_4z_right,gy_y_r1,gy_y_l2,gy_right_pt_1])
gy_y_curve_1_right = rs.AddFilletCurve(rs.AddLine(pt_4z_right,gy_y_r1),rs.AddLine(gy_y_r1,gy_y_r2),radius = x)
gy_y_curve_2_right = rs.AddFilletCurve(rs.AddLine(gy_right_pt_1,gy_y_r2),rs.AddLine(gy_y_r2,gy_y_r1),radius = x)
gy_y_curve_right = rs.JoinCurves([gy_y_curve_1_right,rs.AddLine(rs.CurveEndPoint(gy_y_curve_1_right),rs.CurveEndPoint(gy_y_curve_2_right)),gy_y_curve_2_right])
#拱眼出头左
gy_ct_curve_left = rs.AddPolyline([qa_left_2,gy_left_up_1,gy_up_1,qa_left_2_2])
#拱眼出头右
gy_ct_curve_right = rs.AddPolyline([qa_right_2,gy_right_up_1,gy_up_2,qa_right_2_2])

gy_0 = rs.AddLine(qa_left_2,gy_left_up_1)
gy_1 = rs.JoinCurves([qa_curve_left_1,gy_0 ])
gy_2 = rs.CopyObject(gy_1)
rs.MoveObject(gy_2,(-x,0,0))
gy_3 = rs.AddLine(rs.CurveEndPoint(gy_1),rs.CurveEndPoint(gy_2))
gy_4 = rs.AddLine(rs.CurveStartPoint(gy_1),rs.CurveStartPoint(gy_2))
gy_5 = rs.AddPolyline([gy_left_up_1,gy_up_1,qa_left_2_2])
gy_0_r = rs.AddLine(qa_right_2,gy_right_up_1)
gy_1_r = rs.JoinCurves([qa_curve_right_1,gy_0_r ])
gy_2_r = rs.CopyObject(gy_1_r)
rs.MoveObject(gy_2_r,(x,0,0))
gy_3_r = rs.AddLine(rs.CurveEndPoint(gy_1_r),rs.CurveEndPoint(gy_2_r))
gy_4_r = rs.AddLine(rs.CurveStartPoint(gy_1_r),rs.CurveStartPoint(gy_2_r))
gy_5_r = rs.AddPolyline([gy_right_up_1,gy_up_2,qa_right_2_2])

gy_curve_left = rs.JoinCurves([gy_5,qa_curve_left_1_2,gy_y_curve,gy_2,gy_3,gy_4])
gy_curve_right = rs.JoinCurves([gy_5_r,qa_curve_right_1_2,gy_y_curve_right,gy_2_r,gy_3_r,gy_4_r])
gy_surface_left = rs.AddPlanarSrf(gy_curve_left)
gy_surface_right = rs.AddPlanarSrf(gy_curve_right)
extrude_curve3 = rs.AddLine(pt_o,rs.MoveObject(rs.CopyObject(pt_o),(0,x,0)))
gy_brep_left = rs.ExtrudeSurface(gy_surface_left,extrude_curve3)
gy_brep_right = rs.ExtrudeSurface(gy_surface_right,extrude_curve3)
gy_brep1 = gy_brep_left
gy_brep2 = gy_brep_right
gy_brep3 = rs.CopyObject(gy_brep1)
rs.MoveObjects(gy_brep3,(0,9 * x,0))
gy_brep4 = rs.CopyObject(gy_brep2)
rs.MoveObjects(gy_brep4,(0,9 * x,0))
HuaGong = rs.BooleanDifference(HuaGong,gy_brep2,delete_input = True)
HuaGong = rs.BooleanDifference(HuaGong,gy_brep4,delete_input = True)
HuaGong = rs.BooleanIntersection(gy_brep1,HuaGong,delete_input=True)
HuaGong = rs.BooleanIntersection(gy_brep3,HuaGong,delete_input=True)

#华拱上的馒头榫

mts_hg = rs.ExplodePolysurfaces(HuaGong)[56]
mts_hg = rs.CurveEndPoint(rs.DuplicateEdgeCurves(mts_hg)[2])
rs.MoveObject(mts_hg,(4.75 * x,3.75 * x,0))
mts_hg = rs.AddLine(mts_hg,rs.MoveObject(rs.CopyObject(mts_hg),(0,2.5 * x,0)))
mts_hg = rs.ExtrudeCurve(mts_hg,rs.AddLine(rs.AddPoint(0,0,0),rs.AddPoint(2.5 * x,0,0)))
mts_hg = rs.ExtrudeSurface(mts_hg,rs.AddLine(rs.AddPoint(0,0,0),rs.AddPoint(0,0,2.5 * x)))

mts_hg_1 = rs.MirrorObject(mts_hg,ZhuTou_point,rs.MoveObject(rs.CopyObject(ZhuTou_point),(0,x,0)),copy=True)


HuaGong = rs.BooleanUnion([mts_hg,HuaGong,mts_hg_1],delete_input=False)

HuaGong1_pj = rs.MoveObject(rs.CopyObject(HuaGong),(j * x,j * x + (MianKuo-((MianKuo+1)/2+1)) * 16 * 15 * x + (MianKuo_length * x)/2,252 * x +21 * x))

HuaGong2_pj = rs.MoveObject(rs.CopyObject(HuaGong),(0,0,21 * x))

HuaGong4_pj = rs.MoveObject(rs.CopyObject(HuaGong),(0,0,42 * x))

HuaGong5_pj = rs.MoveObject(rs.CopyObject(HuaGong),(0,0,63 * x))
#第一跳华拱被剪切去后尾

HuaGong1_bj_trimed = rs.ExplodePolysurfaces(HuaGong1_pj)[24]
HuaGong1_bj_trimed = rs.ExtrudeSurface(HuaGong1_bj_trimed,rs.AddLine(rs.AddPoint(0,0,0),rs.AddPoint(0,0,30 * x)))
HuaGong3_pj_tail_1 = rs.BooleanDifference(HuaGong1_pj,HuaGong1_bj_trimed,delete_input=False)[0]
HuaGong1_bj = rs.BooleanDifference(HuaGong1_pj,HuaGong1_bj_trimed,delete_input=False)[1]



#第一跳华拱组
HuaGong1_bjs = [HuaGong1_bj]
sq_rule = [0,0,0,0,0,0,0,0,0,0,0,0,0,0,0,0,0,0,0,0,1.25,4.25]
for i in range(int((MianKuo - 3)/2)):
    if i + 1 < len(range(int((MianKuo - 3)/2)+1)):
        HuaGong1_bj1 = rs.MoveObject(rs.CopyObject(HuaGong1_bj),(0,-(MianKuo_length * (i+1)) * x,sq_rule[-(int((MianKuo - 3)/2-i))] * x))
        HuaGong1_bjs.append(HuaGong1_bj1)

HuaGong1_bjs_left  = rs.MirrorObjects(HuaGong1_bjs[1:len(HuaGong1_bjs)],rs.MoveObject(rs.CopyObject(ZhuTou_point),(j * x,(MianKuo_length * (MianKuo - 2) * x + 2 * j * x)/2 ,0)),rs.MoveObject(rs.CopyObject(ZhuTou_point),(x,(MianKuo_length * (MianKuo - 2) * x + 2 * j * x)/2 ,0)),copy=True)

HuaGong1_bjs_left = HuaGong1_bjs_left[::-1]

HuaGong1_bjs = HuaGong1_bjs_left + HuaGong1_bjs


#第一层素枋被补间第一跳华拱剪切
sufang_breps3 = []
for i in range(len(sufang_breps)):
    if i == int(len(sufang_breps)/2):
        sufang_brep = rs.BooleanDifference(sufang_breps[i],HuaGong1_bjs[i],delete_input=False)
    else:
        sufang_brep = rs.BooleanUnion([sufang_breps[i],HuaGong1_bjs[i]],delete_input=False)    
    sufang_breps3.append(sufang_brep[0])

sufang_breps = sufang_breps3

#补间铺作第二层泥道栱剪切

ndg_bj2_trimed_brep = rs.ExplodePolysurfaces(ndg_bj2_brep)[24]
ndg_bj2_trimed_brep = rs.CurveEndPoint(rs.DuplicateEdgeCurves(ndg_bj2_trimed_brep)[0])
rs.MoveObject(ndg_bj2_trimed_brep,(-10 * x,0,0))
ndg_bj2_trimed_brep = rs.AddLine(ndg_bj2_trimed_brep,rs.MoveObject(rs.CopyObject(ndg_bj2_trimed_brep),(0,4 * x,0)))
ndg_bj2_trimed_brep = rs.ExtrudeCurve(ndg_bj2_trimed_brep,rs.AddLine(rs.AddPoint(0,0,0),rs.AddPoint(20 * x,0,0)))
ndg_bj2_trimed_brep = rs.ExtrudeSurface(ndg_bj2_trimed_brep,rs.AddLine(rs.AddPoint(0,0,0),rs.AddPoint(0,0,15 * x)))
ndg_bj2_trimed_brep2 =   rs.MirrorObjects(ndg_bj2_trimed_brep,rs.MoveObject(rs.CopyObject(ZhuTou_point),(0,(MianKuo_length * (MianKuo - 2) * x + 2 * j * x)/2 ,0)),rs.MoveObject(rs.CopyObject(ZhuTou_point),(x,(MianKuo_length * (MianKuo - 2) * x + 2 * j * x)/2 ,0)),copy=True)
ndg_bj2_brep_head1 = rs.BooleanDifference(ndg_bj2_brep,ndg_bj2_trimed_brep,delete_input=False)[1]
ndg_bj2_brep_mid = rs.BooleanDifference(ndg_bj2_brep,ndg_bj2_trimed_brep,delete_input=False)[0]

ndg_bj2_brep_mid = rs.BooleanDifference(ndg_bj2_brep_mid,ndg_bj2_trimed_brep2,delete_input=False)[0]

#加21分
rs.MoveObject(ndg_bj2_brep_head1,(0,21 * x,0))

#头和中间段连接
ndg_bj2_brep_head1_1 =rs.ExplodePolysurfaces(ndg_bj2_brep_head1)[15]
ndg_bj2_brep_head1_1 = rs.ExtrudeSurface(ndg_bj2_brep_head1_1,rs.AddLine(rs.AddPoint(0,0,0),rs.AddPoint(0,-25 * x,0)))

ndg_bj2_brep_head1 = rs.BooleanDifference(ndg_bj2_brep_head1_1,ndg_bj2_brep_head1,delete_input=False)

ndg_bj2_brep_head2 = rs.MirrorObjects(ndg_bj2_brep_head1,rs.MoveObject(rs.CopyObject(ZhuTou_point),(0,(MianKuo_length * (MianKuo - 2) * x + 2 * j * x)/2 ,0)),rs.MoveObject(rs.CopyObject(ZhuTou_point),(x,(MianKuo_length * (MianKuo - 2) * x + 2 * j * x)/2 ,0)),copy=True)

ndg_bj2_brep = rs.BooleanDifference(ndg_bj2_brep_head1,ndg_bj2_brep_mid,delete_input=False)
ndg_bj2_brep = rs.BooleanIntersection(ndg_bj2_brep_head2,ndg_bj2_brep,delete_input=False)

rs.MoveObject(ndg_bj2_brep,(0,0,21 * x))


#补间第二层华拱组

ndg_bj2_brep_g = [ndg_bj2_brep[0]]

sq_rule = [0,0,0,0,0,0,0,0,0,0,0,0,0,0,0,0,0,0,0,0,1.25,4.25]
for i in range(int((MianKuo - 3)/2)):
    if i + 1 < len(range(int((MianKuo - 3)/2)+1)):
        ndg_bj2_brep1 = rs.MoveObject(rs.CopyObject(ndg_bj2_brep),(0,-(MianKuo_length * (i+1)) * x,sq_rule[-(int((MianKuo - 3)/2-i))] * x))
        ndg_bj2_brep_g.append(ndg_bj2_brep1)

ndg_bj2_brep_g_left  = rs.MirrorObjects(ndg_bj2_brep_g[1:len(ndg_bj2_brep_g)],rs.MoveObject(rs.CopyObject(ZhuTou_point),(j * x,(MianKuo_length * (MianKuo - 2) * x + 2 * j * x)/2 ,0)),rs.MoveObject(rs.CopyObject(ZhuTou_point),(x,(MianKuo_length * (MianKuo - 2) * x + 2 * j * x)/2 ,0)),copy=True)

ndg_bj2_brep_g_left = ndg_bj2_brep_g_left[::-1]

ndg_bj2_brep_g = ndg_bj2_brep_g_left + ndg_bj2_brep_g

#第二层素枋连接件生成

# 生起曲线
# 生起曲线

le2_breps_2 = []
le2_brep_trimed_g_2 = []
le2_trimed2_2 = rs.CopyObjects(zhutou_pt_up2[1:len(zhutou_pt_up)-2])
rs.MoveObjects(le2_trimed2_2,(0,(5) * x,0))
le2_trimed1_2 = rs.CopyObjects(zhutou_pt_up2[2:len(zhutou_pt_up)-1])
rs.MoveObjects(le2_trimed1_2,(0,-(5) * x,0))
sq_cr_2 = rs.AddInterpCurve(zhutou_pt_up2[1:len(zhutou_pt_up)-1])
sq_sr_2 = rs.ExtrudeCurve(sq_cr_2,rs.AddLine(rs.AddPoint(0,0,0),rs.AddPoint(5 * x,0,0)))
for i in range(len(le2_trimed1_2)):
    cr1_2 = rs.AddLine(le2_trimed1_2[i],le2_trimed2_2[i])
    rs.MoveObject(cr1_2,(4 * x,0,21 * x))
    cr1_2 = rs.ProjectCurveToSurface(cr1_2,sq_sr_2,[0,0,x])

    le2_brep_2 = rs.ExtrudeCurve(cr1_2,rs.AddLine(rs.AddPoint(0,0,0),rs.AddPoint(-10 * x ,0,0)))
    le2_brep_2 = rs.ExtrudeSurface(le2_brep_2,rs.AddLine(rs.AddPoint(0,0,0),rs.AddPoint(0 ,0,-14.5 * x)))
    
    le2_brep_trimed_2 = rs.ExtrudeCurve(cr1_2,rs.AddLine(rs.AddPoint(0,0,0),rs.AddPoint(-8 * x ,0,0)))
    le2_brep_trimed_2 = rs.ExtrudeSurface(le2_brep_trimed_2,rs.AddLine(rs.AddPoint(0,0,0),rs.AddPoint(0 ,0,-15 * x)))
    rs.MoveObject(le2_brep_trimed_2,(0,0,5 * x))
    le2_brep_trimed_g_2.append(le2_brep_trimed_2)

rs.MoveObjects(le2_brep_trimed_g_2,(0,0,44.5 * x + 22 * x))

#第二层素枋泥道栱生成
rs.MoveObjects(sf2_breps,(j * x,0,0))

sf2_brep_left = sf2_breps[1]
sf2_brep_right = sf2_breps[0]


sf2_trimed_brep = rs.ExplodePolysurfaces(sf2_brep_left)[4]
sf2_trimed_brep = rs.CurveEndPoint(rs.DuplicateEdgeCurves(sf2_trimed_brep)[2])

rs.MoveObject(sf2_trimed_brep,(-10 * x,0,-4 * x))

sf2_trimed_brep = rs.AddLine(sf2_trimed_brep,rs.MoveObject(rs.CopyObject(sf2_trimed_brep),(20 * x,0,0)))
sf2_trimed_brep = rs.ExtrudeCurve(sf2_trimed_brep,rs.AddLine(rs.AddPoint(0,0,0),rs.AddPoint(0,22 * x,0)))
sf2_trimed_brep = rs.ExtrudeSurface(sf2_trimed_brep,rs.AddLine(rs.AddPoint(0,0,0),rs.AddPoint(0,0,15 * x)))

sf2_trimed_brep2 = rs.MirrorObject(sf2_trimed_brep,ZhuTou_point,rs.MoveObject(rs.CopyObject(ZhuTou_point),(x,0,0)),copy=True)

sf2_brep_left_1 = rs.BooleanIntersection(sf2_trimed_brep,sf2_brep_left,delete_input=False)[0]
sf2_brep_left_2 = rs.BooleanIntersection(sf2_trimed_brep,sf2_brep_left,delete_input=False)[1]

rs.MoveObject(sf2_brep_left_2,(0,-22 * x,0))

sf2_brep_left = rs.BooleanUnion([sf2_brep_left_1,sf2_brep_left_2],delete_input=True)

#
sf2_brep_right_1 = rs.BooleanDifference(sf2_trimed_brep2,sf2_brep_right,delete_input=False)[0]
sf2_brep_right_2 = rs.BooleanDifference(sf2_trimed_brep2,sf2_brep_right,delete_input=False)[1]

rs.MoveObject(sf2_brep_right_2,(0,22 * x,0))

sf2_brep_right = rs.BooleanUnion([sf2_brep_right_1,sf2_brep_right_2],delete_input=True)

sf2_breps = [sf2_brep_left[0],sf2_brep_right[0]]

rs.MoveObjects(sf2_breps ,(0,j * x + (MianKuo-((MianKuo+1)/2+1)) * 16 * 15 * x,252 * x +42 * x))

sf2_brep_right_1 = [sf2_breps[0]]
sf2_brep_right_2 = [sf2_breps[1]]

sq_rule = [0,0,0,0,0,0,0,0,0,0,0,0,0,0,0,0,0,0,0,0,2.5,6]
for i in range(int((MianKuo - 3)/2)):
    if i + 1 < len(range(int((MianKuo - 3)/2))):
        sf2_brep1 = rs.MoveObject(rs.CopyObject(sf2_breps[0]),(0,-(MianKuo_length * (i+1)) * x,sq_rule[-(int((MianKuo - 3)/2-i))] * x))
        sf2_brep2 = rs.MoveObject(rs.CopyObject(sf2_breps[1]),(0,-(MianKuo_length * (i+1)) * x,sq_rule[-(int((MianKuo - 3)/2-i))] * x))
        sf2_brep_right_1.append(sf2_brep1)
        sf2_brep_right_2.append(sf2_brep2)
    
sf2_brep_left_1 = rs.MirrorObjects(sf2_brep_right_2,rs.MoveObject(rs.CopyObject(ZhuTou_point),(0,(MianKuo_length * (MianKuo - 2) * x + 2 * j * x)/2 ,0)),rs.MoveObject(rs.CopyObject(ZhuTou_point),(x,(MianKuo_length * (MianKuo - 2) * x + 2 * j * x)/2 ,0)),copy=True)
sf2_brep_left_1 = sf2_brep_left_1[::-1]

#
sf2_brep_left_2 = rs.MirrorObjects(sf2_brep_right_1,rs.MoveObject(rs.CopyObject(ZhuTou_point),(0,(MianKuo_length * (MianKuo - 2) * x + 2 * j * x)/2 ,0)),rs.MoveObject(rs.CopyObject(ZhuTou_point),(x,(MianKuo_length * (MianKuo - 2) * x + 2 * j * x)/2 ,0)),copy=True)
sf2_brep_left_2 = sf2_brep_left_2[::-1]


sufang2_breps_1 = sf2_brep_left_1 + sf2_brep_right_1
sufang2_breps_2 = sf2_brep_left_2 + sf2_brep_right_2


#将第二层枋和素枋第二层泥道连接
le2_brep_trimed_g_2 = le2_brep_trimed_g_2[::-1]

sufang2_breps_1_1 = sufang2_breps_1[1 : len(sufang2_breps_1)]

sufang2_breps_2_1 = sufang2_breps_2[0 : len(sufang2_breps_2)-1]

le2_brep_trimed_g_2_1 = le2_brep_trimed_g_2[1:len(le2_brep_trimed_g_2)-1]

sufang2_breps = []

for i in range(len(le2_brep_trimed_g_2_1)):

    sufang2_brep = rs.BooleanUnion([le2_brep_trimed_g_2_1[i],sufang2_breps_1_1[i]],delete_input=False)[0]
    
    sufang2_breps.append(sufang2_brep)

sufang2_breps1 = []

for i in range(len(le2_brep_trimed_g_2_1)):

    sufang2_brep = rs.BooleanUnion([sufang2_breps[i],sufang2_breps_2_1[i]],delete_input=False)[0]
    
    sufang2_breps1.append(sufang2_brep)

sufang2_breps1_first = rs.BooleanUnion([le2_brep_trimed_g_2[0],sufang2_breps_1[0]],delete_input=False)
sufang2_breps1_last = rs.BooleanUnion([le2_brep_trimed_g_2[-1],sufang2_breps_2[-1]],delete_input=False)

sufang2_breps1.insert(0,sufang2_breps1_first[0])
sufang2_breps1.append(sufang2_breps1_last[0])
sufang2_breps = sufang2_breps1

#将第二层枋和补间辅作第二层泥道连接("时间紧迫,转角辅作做错了,不管了先调整,在这里调整的办法是不做尽间内檐补间辅作的二层泥道栱,让第一层散斗直接架起枋")


le2_brep_trimed_g_2_1 = sufang2_breps[1:len(sufang2_breps)-1]

ndg_bj2_brep_g_1 = ndg_bj2_brep_g[1:len(ndg_bj2_brep_g)-1]


sufang2_breps2 = []

for i in range(len(le2_brep_trimed_g_2_1)):

    sufang2_brep = rs.BooleanDifference(ndg_bj2_brep_g_1[i],le2_brep_trimed_g_2_1[i],delete_input=False)[0]
    
    sufang2_breps2.append(sufang2_brep)

sufang2_breps2.insert(0,sufang2_breps[0])
sufang2_breps2.append(sufang2_breps[-1])

sufang2_breps = sufang2_breps2

#第补间第二华拱生成

#补间辅第二跳华拱

#加21分

HuaGong2_pj_trimed_brep = rs.ExplodePolysurfaces(HuaGong2_pj)[25]
HuaGong2_pj_trimed_brep = rs.CurveEndPoint(rs.DuplicateEdgeCurves(HuaGong2_pj_trimed_brep)[0])

HuaGong2_pj_trimed_brep = rs.AddLine(HuaGong2_pj_trimed_brep,rs.MoveObject(rs.CopyObject(HuaGong2_pj_trimed_brep),(0,10 * x,0)))
HuaGong2_pj_trimed_brep = rs.ExtrudeCurve(HuaGong2_pj_trimed_brep,rs.AddLine(rs.AddPoint(0,0,0),rs.AddPoint(x,0,0)))
HuaGong2_pj_trimed_brep = rs.ExtrudeSurface(HuaGong2_pj_trimed_brep,rs.AddLine(rs.AddPoint(0,0,0),rs.AddPoint(0,0,22 * x)))
HuaGong2_pj_trimed_brep2 = rs.MirrorObject(HuaGong2_pj_trimed_brep,ZhuTou_point,rs.MoveObject(rs.CopyObject(ZhuTou_point),(0,x,0)),copy=True)
HuaGong2_pj_head1 = rs.BooleanDifference(HuaGong2_pj,HuaGong2_pj_trimed_brep,delete_input=False)[1]
HuaGong2_pj_mid = rs.BooleanDifference(HuaGong2_pj,HuaGong2_pj_trimed_brep,delete_input=False)[0]

HuaGong2_pj_mid = rs.BooleanDifference(HuaGong2_pj_mid,HuaGong2_pj_trimed_brep2,delete_input=False)[1]

#将头和中间段连接
rs.MoveObject(HuaGong2_pj_head1,(-21 * x,0,0))
HuaGong2_pj_head1_1 = rs.ExplodePolysurfaces(HuaGong2_pj_head1)[18]
HuaGong2_pj_head1_1 = rs.ExtrudeSurface(HuaGong2_pj_head1_1,rs.AddLine(rs.AddPoint(0,0,0),rs.AddPoint(22 * x,0,0)))

HuaGong2_pj_head1 = rs.BooleanDifference(HuaGong2_pj_head1_1,HuaGong2_pj_head1,delete_input = False)
HuaGong2_pj_head2 = rs.MirrorObject(HuaGong2_pj_head1,ZhuTou_point,rs.MoveObject(rs.CopyObject(ZhuTou_point),(0,x,0)),copy=True)

HuaGong2_pj = rs.BooleanDifference(HuaGong2_pj_head1,HuaGong2_pj_mid,delete_input=False)
HuaGong2_pj = rs.BooleanIntersection(HuaGong2_pj_head2,HuaGong2_pj,delete_input=False)

HuaGong3_pj = rs.CopyObject(HuaGong2_pj)

rs.MoveObject(HuaGong2_pj,(j * x,j * x + (MianKuo-((MianKuo+1)/2+1)) * 16 * 15 * x + (MianKuo_length * x)/2,252 * x +21 * x))

#补间辅作第三跳华拱后尾出作垂头

rs.MoveObject((HuaGong3_pj),(0,0,21 * x))

#补间第三跳华拱剪切再出21分,并且将后尾变成垂头

HuaGong3_pj_trimed = rs.ExplodePolysurfaces(HuaGong3_pj)[50]
HuaGong3_pj_trimed = rs.CurveEndPoint(rs.DuplicateEdgeCurves(HuaGong3_pj_trimed)[2])

HuaGong3_pj_trimed_0 = rs.MoveObject(rs.CopyObject(HuaGong3_pj_trimed),(-2 * x,0,0))

HuaGong3_pj_trimed_1 = rs.MoveObject(rs.CopyObject(HuaGong3_pj_trimed_0),(-21 * x,0,-14 * x))


HuaGong3_pj_trimed_2 = rs.MoveObject(rs.CopyObject(HuaGong3_pj_trimed_1),(0,0,-1 * x))

HuaGong3_pj_trimed_3 = rs.MoveObject(rs.CopyObject(HuaGong3_pj_trimed_2),(39 * x,0,0))


HuaGong3_pj_trimed = rs.AddPolyline([HuaGong3_pj_trimed,HuaGong3_pj_trimed_0,HuaGong3_pj_trimed_1,HuaGong3_pj_trimed_2,HuaGong3_pj_trimed_3])

HuaGong3_pj_trimed = rs.JoinCurves([HuaGong3_pj_trimed,rs.AddLine(rs.CurveStartPoint(HuaGong3_pj_trimed),rs.CurveEndPoint(HuaGong3_pj_trimed))])

HuaGong3_pj_trimed = rs.AddPlanarSrf(HuaGong3_pj_trimed)

HuaGong3_pj_trimed = rs.ExtrudeSurface(HuaGong3_pj_trimed,rs.AddLine(rs.AddPoint(0,0,0),rs.AddPoint(0,-10 * x,0)))
HuaGong3_pj_trimed_2 = rs.MirrorObject(HuaGong3_pj_trimed,ZhuTou_point,rs.MoveObject(rs.CopyObject(ZhuTou_point),(0,x,0)),copy=True)

HuaGong3_pj = rs.BooleanDifference(HuaGong3_pj,HuaGong3_pj_trimed,delete_input=True)

HuaGong3_pj = rs.BooleanDifference(HuaGong3_pj,HuaGong3_pj_trimed_2,delete_input=True)






#第二跳华拱被剪切
rs.MoveObject(HuaGong3_pj_tail_1,(0,0,42 * x))
HuaGong2_bj_trimed = rs.MoveObject(rs.CopyObject(HuaGong1_bj_trimed),(0,0,21 * x))
#第三跳华拱的后尾
HuaGong3_pj_tail = rs.BooleanUnion([HuaGong2_bj_trimed,HuaGong2_pj],delete_input=False)[0]
HuaGong2_pj = rs.BooleanUnion([HuaGong2_bj_trimed,HuaGong2_pj],delete_input=False)[1]

#佛光寺大殿,令拱生成


if NiDaoGong_CaiFen_left !=  NiDaoGong_CaiFen_right:
    raise ValueError(f"两边必须一样长")

lg_pt_o = rs.CopyObject(ZhuTou_point)
if (NiDaoGong_CaiFen_left > 25) & (NiDaoGong_CaiFen_right > 25):
    rs.MoveObject(lg_pt_o,(0,(NiDaoGong_CaiFen_left) * x,0))
else : raise ValueError(f"必须大于26分")

lg_pt_z1 = rs.CopyObject(lg_pt_o)
rs.MoveObject(lg_pt_z1,(0,0,9 * x))
lg_cr_z = rs.AddLine(lg_pt_o,lg_pt_z1)
lg_pt_y1 = rs.CopyObject(lg_pt_o)
rs.MoveObject(lg_pt_y1 ,(0,-20 * x,0))
lg_cr_y = rs.AddLine(lg_pt_y1,lg_pt_o)
div_cr_z =rs.DivideCurve(lg_cr_z,5)
div_cr_y =rs.DivideCurve(lg_cr_y,5)
#卷杀
CrossCurves_gzg = []
for i in range(len(div_cr_z)):
    divide_y = div_cr_y[i]
    divide_z = div_cr_z[i]
    CrossCurve_gzg = rs.AddLine(divide_y,divide_z)
    CrossCurves_gzg.append(CrossCurve_gzg)
CrossCurves_gzg = CrossCurves_gzg[1:len(CrossCurves_gzg)-1]
#选择交点
CrossCurves_points_gzg = []
for i in range(len(CrossCurves_gzg)):
    CrossCurves_point_gzg = rs.CurveCurveIntersection(CrossCurves_gzg[i],CrossCurves_gzg[i-1])[0][1]
    CrossCurves_points_gzg.append(CrossCurves_point_gzg)
CrossCurves_points_gzg = CrossCurves_points_gzg[1:len(CrossCurves_points_gzg)]
CrossCurves_points_gzg.insert(0,rs.CurveStartPoint(lg_cr_y))
CrossCurves_points_gzg.insert(len(CrossCurves_points_gzg)+1,rs.CurveEndPoint(lg_cr_z))
lg_pt_z2 = rs.CopyObject(lg_pt_z1)
rs.MoveObject(lg_pt_z2,(0,0, 6 * x))
lg_pt_z3 = rs.CopyObject(lg_pt_z2)
rs.MoveObject(lg_pt_z3,(0,-10 * x,0))
lg_pt_y_1 = rs.CopyObject(ZhuTou_point)
rs.MoveObject(lg_pt_y_1,(0,0,5 * x))
lg_pt_y_2 = rs.CopyObject(lg_pt_y_1)
rs.MoveObject(lg_pt_y_2,(0,4 * x,0))
lg_pt_y_3 = rs.CopyObject(lg_pt_y_2)
rs.MoveObject(lg_pt_y_3,(0,0,10 * x))
CrossCurves_points_gzg.append(lg_pt_z2)
CrossCurves_points_gzg.append(lg_pt_z3)
CrossCurves_points_lg_right = rs.MirrorObjects(CrossCurves_points_gzg,ZhuTou_point,rs.MoveObject(rs.CopyObject(ZhuTou_point),(x,0,x)),copy=True)
rs.MoveObjects(CrossCurves_points_lg_right,(0,(NiDaoGong_CaiFen_left - NiDaoGong_CaiFen_right) * x,0))
lg_mid_pt1 = rs.CopyObject(ZhuTou_point)
lg_mid_pt1 = rs.MoveObject(lg_mid_pt1,(0,-4 * x,15 * x))
lg_mid_pt4 = rs.CopyObject(ZhuTou_point)
lg_mid_pt4 = rs.MoveObject(lg_mid_pt4,(0,4 * x,15 * x))
lg_mid_pt2 = rs.CopyObject(lg_mid_pt1)
rs.MoveObject(lg_mid_pt2,(0,0,-10 * x))
lg_mid_pt3 = rs.CopyObject(lg_mid_pt2)
rs.MoveObject(lg_mid_pt3,(0,8 * x,0))

CrossCurves_points_gzg.insert(0,CrossCurves_points_lg_right[0])
CrossCurves_points_gzg.insert(0,CrossCurves_points_lg_right[1])
CrossCurves_points_gzg.insert(0,CrossCurves_points_lg_right[2])
CrossCurves_points_gzg.insert(0,CrossCurves_points_lg_right[3])
CrossCurves_points_gzg.insert(0,CrossCurves_points_lg_right[4])
CrossCurves_points_gzg.insert(0,CrossCurves_points_lg_right[5])
CrossCurves_points_gzg.insert(0,CrossCurves_points_lg_right[6])
CrossCurves_points_gzg.insert(0,lg_mid_pt1)
CrossCurves_points_gzg.insert(0,lg_mid_pt2)
CrossCurves_points_gzg.insert(0,lg_mid_pt3)
CrossCurves_points_gzg.insert(0,lg_mid_pt4)
lg_curve_left1 = rs.AddPolyline(CrossCurves_points_gzg)
lg_curve_left1 = rs.JoinCurves([lg_curve_left1,rs.AddLine(rs.CurveEndPoint(lg_curve_left1),rs.CurveStartPoint(lg_curve_left1))])
rs.MoveObject(lg_curve_left1,(5 *x,0,0))
lg_sr_left1 = rs.AddPlanarSrf(lg_curve_left1)

lg_brep = rs.ExtrudeSurface(lg_sr_left1,rs.AddLine(rs.AddPoint(0,0,0),rs.AddPoint(-10 * x,0,0)))

# 拱眼
lg_gyy_pt1 = rs.CopyObject(lg_pt_z3)
rs.MoveObject(lg_gyy_pt1,(-5 * x,0,x))
lg_gyy_pt2 = rs.CopyObject(lg_gyy_pt1)
rs.MoveObject(lg_gyy_pt2,(0,0,-2 * x))
lg_gyy_pt4 = rs.CopyObject(lg_mid_pt4)
rs.MoveObject(lg_gyy_pt4,(-5 * x, 1.625 * x,x))
lg_gyy_pt3 = rs.CopyObject(lg_gyy_pt4)
rs.MoveObject(lg_gyy_pt3,(0,0,-2 * x))
lg_gyy_cr1 = rs.AddLine(lg_gyy_pt1,lg_gyy_pt2)
lg_gyy_cr2 = rs.AddLine(lg_gyy_pt2,lg_gyy_pt3)
lg_gyy_cr3 = rs.AddLine(lg_gyy_pt3,lg_gyy_pt4)
lg_gyy_cr1 = rs.AddFilletCurve(lg_gyy_cr1,lg_gyy_cr2,x)
lg_gyy_cr2_1 = rs.AddFilletCurve(lg_gyy_cr3,lg_gyy_cr2,x)
lg_gyy_cr3 = rs.AddLine(rs.CurveEndPoint(lg_gyy_cr1),rs.CurveEndPoint(lg_gyy_cr2_1))
lg_gyy_cr4 = rs.AddLine(rs.CurveStartPoint(lg_gyy_cr1),rs.MoveObject(rs.CopyObject(lg_gyy_pt1),(0,0,x)))
lg_gyy_cr5 = rs.AddLine(rs.CurveStartPoint(lg_gyy_cr2_1),rs.MoveObject(rs.CopyObject(lg_gyy_pt4),(0,0,x)))
lg_gyy_1 =rs.JoinCurves([lg_gyy_cr1,lg_gyy_cr2_1,lg_gyy_cr3,lg_gyy_cr4,lg_gyy_cr5])
lg_gyy_1 =rs.JoinCurves([lg_gyy_1,rs.AddLine(rs.CurveStartPoint(lg_gyy_1),rs.CurveEndPoint(lg_gyy_1))])
lg_gyy_sr = rs.AddPlanarSrf(lg_gyy_1)
rs.MoveObject(lg_gyy_sr,(0,0,0))
lg_gyy_1_1= rs.MoveObject(rs.CopyObject(lg_gyy_1),(5 * x,0 , x))
rs.ScaleObject(lg_gyy_1_1,rs.CurveMidPoint(lg_gyy_cr2),[1,0.5,1])
lg_gyy_1 =rs.AddLoftSrf([lg_gyy_1,lg_gyy_1_1])
lg_gyy_2 =rs.MirrorObject(lg_gyy_1,ZhuTou_point,rs.MoveObject(rs.CopyObject(ZhuTou_point),(x,0,0)),copy=True)
lg_gyy_3 =rs.MirrorObject(lg_gyy_1,ZhuTou_point,rs.MoveObject(rs.CopyObject(ZhuTou_point),(0,x,0)),copy=True)
lg_gyy_4 =rs.MirrorObject(lg_gyy_2,ZhuTou_point,rs.MoveObject(rs.CopyObject(ZhuTou_point),(0,x,0)),copy=True)
rs.CapPlanarHoles(lg_gyy_1)
lg_brep = rs.BooleanDifference(lg_brep,lg_gyy_1)
lg_brep = rs.BooleanDifference(lg_brep,lg_gyy_2)
lg_brep = rs.BooleanDifference(lg_brep,lg_gyy_3)
lg_brep = rs.BooleanDifference(lg_brep,lg_gyy_4)

#令拱加上馒头榫

lg_brep = rs.BooleanDifference(mts1_ndg_bj1,lg_brep,delete_input=False)

lg_brep = rs.BooleanIntersection(lg_brep,mts1_ndg_bj2,delete_input=False)


rs.MoveObject(lg_brep,(-47 * x + j * x,j * x + (MianKuo-((MianKuo+1)/2+1)) * 16 * 15 * x + (MianKuo_length * x)/2,252 * x +63 * x))

#第一跳华拱上的散斗

SanDou_hg_bj = rs.MoveObject(rs.CopyObject(SanDou_hg) ,(j * x,j * x + (MianKuo-((MianKuo+1)/2+1)) * 16 * 15 * x + (MianKuo_length * x)/2-2 * x,252 * x +36* x))


#第二跳华拱上的交互斗

JiaoHuDou_hg_bj2 = rs.MoveObject(rs.CopyObject(SanDou_hg_bj),(-21 * x,0,21 * x))

#将散斗剪成交互斗

JiaoHuDou_hg_bj2 = rs.BooleanDifference(lg_brep,JiaoHuDou_hg_bj2,delete_input=False)

#第三跳华拱上的散斗
SanDou_hg_bj3 = rs.MirrorObject(SanDou_hg_bj,rs.MoveObject(rs.CopyObject(ZhuTou_point),(j*x,0,0)),rs.MoveObject(rs.CopyObject(ZhuTou_point),(j*x,x,0)),copy=True)

rs.MoveObject(SanDou_hg_bj3,(0,0,42 * x))

#第四跳华拱上的散斗

SanDou_hg_bj4 = rs.MoveObject(rs.CopyObject(SanDou_hg_bj3),(21 * x,0,21 * x))

#第五跳华拱上的散斗

SanDou_hg_bj5 = rs.MirrorObject(JiaoHuDou_hg_bj2,rs.MoveObject(rs.CopyObject(ZhuTou_point),(j*x,0,0)),rs.MoveObject(rs.CopyObject(ZhuTou_point),(j*x,x,0)),copy=True)

rs.MoveObject(SanDou_hg_bj5,(21 * x,0,63 * x))

#将交互斗变成散斗

SanDou_hg_bj5_trimed = rs.ExplodePolysurfaces(SanDou_hg_bj5)[10]
SanDou_hg_bj5_trimed = rs.ExtrudeSurface(SanDou_hg_bj5_trimed,rs.AddLine(rs.AddPoint(0,0,0),rs.AddPoint(0,0,3.5 * x)))

SanDou_hg_bj5_trimed2 = rs.MoveObject(rs.CopyObject(SanDou_hg_bj5_trimed ),(-13 * x,0,0))

SanDou_hg_bj5 = rs.BooleanDifference(SanDou_hg_bj5_trimed,SanDou_hg_bj5,delete_input=False)

SanDou_hg_bj5 = rs.BooleanIntersection(SanDou_hg_bj5_trimed2,SanDou_hg_bj5,delete_input=False)

#补间辅作华拱上的斗组

Dous_hg_bjs = [SanDou_hg_bj,JiaoHuDou_hg_bj2[0],SanDou_hg_bj3,SanDou_hg_bj4,SanDou_hg_bj5[0]]

#第二跳华拱组
HuaGong2_bjs = [HuaGong2_pj]
sq_rule = [0,0,0,0,0,0,0,0,0,0,0,0,0,0,0,0,0,0,0,0,1.25,4.25]
for i in range(int((MianKuo - 3)/2)):
    if i + 1 < len(range(int((MianKuo - 3)/2)+1)):
        HuaGong2_bj1 = rs.MoveObject(rs.CopyObject(HuaGong2_pj),(0,-(MianKuo_length * (i+1)) * x,sq_rule[-(int((MianKuo - 3)/2-i))] * x))
        HuaGong2_bjs.append(HuaGong2_bj1)

HuaGong2_bjs_left  = rs.MirrorObjects(HuaGong2_bjs[1:len(HuaGong2_bjs)],rs.MoveObject(rs.CopyObject(ZhuTou_point),(j * x,(MianKuo_length * (MianKuo - 2) * x + 2 * j * x)/2 ,0)),rs.MoveObject(rs.CopyObject(ZhuTou_point),(x,(MianKuo_length * (MianKuo - 2) * x + 2 * j * x)/2 ,0)),copy=True)

HuaGong2_bjs_left = HuaGong2_bjs_left[::-1]

HuaGong2_bjs = HuaGong2_bjs_left + HuaGong2_bjs

#第二层素枋被补间第二跳华拱剪切


le2_brep_trimed_g_2_1 = sufang2_breps[1:len(sufang2_breps)-1]

HuaGong2_bjs_1 = HuaGong2_bjs[1:len(HuaGong2_bjs)-1]
sufang2_breps3 = []

for i in range(len(le2_brep_trimed_g_2_1)):

    sufang2_brep = rs.BooleanDifference(HuaGong2_bjs_1[i],le2_brep_trimed_g_2_1[i],delete_input=False)[0]
    
    sufang2_breps3.append(sufang2_brep)

sufang2_breps3_first = rs.BooleanIntersection(HuaGong2_bjs[0],sufang2_breps[0],delete_input=False)
sufang2_breps3_last = rs.BooleanIntersection(HuaGong2_bjs[-1],sufang2_breps[-1],delete_input=False)

sufang2_breps3.insert(0,sufang2_breps3_first[0])
sufang2_breps3.append(sufang2_breps3_last[0])

sufang2_breps = sufang2_breps3

#第三层素枋

rs.MoveObject(sufang3_breps,(0,0,42 * x))

#第三层素枋和补间第三层泥道栱连接

sufang3_breps_1 = sufang3_breps[1:len(sufang3_breps)-1]

sufang3_breps1 = []

for i in range(len(sufang3_breps_1)):
    if i == int(len(sufang3_breps_1)/2): 
        sufang3_brep = rs.BooleanUnion([sufang3_breps_1[i],ndg_bj3_breps[i]],delete_input=False)[0]
    else:
        sufang3_brep = rs.BooleanDifference(sufang3_breps_1[i],ndg_bj3_breps[i],delete_input=False)[0]
    sufang3_breps1.append(sufang3_brep)

sufang3_breps1.insert(0,sufang3_breps[0])
sufang3_breps1.append(sufang3_breps[-1])
sufang3_breps = sufang3_breps1

#补间第三跳华拱外檐出垂头

rs.MoveObject(HuaGong3_pj,(j * x,j * x + (MianKuo-((MianKuo+1)/2+1)) * 16 * 15 * x + (MianKuo_length * x)/2,252 * x +21 * x))

HuaGong3_bj_trimed = rs.MoveObject(rs.CopyObject(HuaGong2_bj_trimed),(11 * x,0,21 * x))

HuaGong3_pj = rs.BooleanUnion([HuaGong3_bj_trimed,HuaGong3_pj],delete_input=False)[0]

rs.MoveObject(HuaGong3_pj_tail,(0,0,21 * x))

HuaGong3_pj = rs.BooleanDifference(HuaGong3_pj,HuaGong3_pj_tail_1,delete_input=False)

#第三跳拱被令拱剪切

HuaGong3_pj = rs.BooleanDifference(lg_brep,HuaGong3_pj,delete_input=False)

#第三跳华拱组
HuaGong3_bjs = [HuaGong3_pj[0]]
sq_rule = [0,0,0,0,0,0,0,0,0,0,0,0,0,0,0,0,0,0,0,0,1.25,4.25]
for i in range(int((MianKuo - 3)/2)):
    if i + 1 < len(range(int((MianKuo - 3)/2)+1)):
        HuaGong3_bj1 = rs.MoveObject(rs.CopyObject(HuaGong3_pj),(0,-(MianKuo_length * (i+1)) * x,sq_rule[-(int((MianKuo - 3)/2-i))] * x))
        HuaGong3_bjs.append(HuaGong3_bj1)

HuaGong3_bjs_left  = rs.MirrorObjects(HuaGong3_bjs[1:len(HuaGong3_bjs)],rs.MoveObject(rs.CopyObject(ZhuTou_point),(j * x,(MianKuo_length * (MianKuo - 2) * x + 2 * j * x)/2 ,0)),rs.MoveObject(rs.CopyObject(ZhuTou_point),(x,(MianKuo_length * (MianKuo - 2) * x + 2 * j * x)/2 ,0)),copy=True)

HuaGong3_bjs_left = HuaGong3_bjs_left[::-1]

HuaGong3_bjs = HuaGong3_bjs_left + HuaGong3_bjs


#第三层素枋被补间第三跳华拱剪切

le3_brep_trimed_g_2_1 = sufang3_breps[1:len(sufang3_breps)-1]

HuaGong3_bjs_1 = HuaGong3_bjs[1:len(HuaGong3_bjs)-1]
sufang3_breps2 = []

for i in range(len(le3_brep_trimed_g_2_1)):
    if i == int(len(le3_brep_trimed_g_2_1)/2):
        sufang3_brep = rs.BooleanDifference(le3_brep_trimed_g_2_1[i],HuaGong3_bjs_1[i],delete_input=False)[0]
    else:
        sufang3_brep = rs.BooleanUnion([le3_brep_trimed_g_2_1[i],HuaGong3_bjs_1[i]],delete_input=False)[0]
    sufang3_breps2.append(sufang3_brep)

sufang3_breps2_first = rs.BooleanUnion([HuaGong3_bjs[0],sufang3_breps[0]],delete_input=False)
sufang3_breps2_last = rs.BooleanUnion([HuaGong3_bjs[-1],sufang3_breps[-1]],delete_input=False)

sufang3_breps2.insert(0,sufang3_breps2_first[0])
sufang3_breps2.append(sufang3_breps2_last[0])

sufang3_breps = sufang3_breps2

#第四层素枋生成

sufang4_breps = rs.MoveObjects(rs.CopyObjects(sufang2_breps),(0,0,42 * x))

#将尽间的补间辅作的第四层华拱和枋连接


ndg_bj4_breps_first = rs.MoveObject(rs.CopyObject(ndg_bj2_brep_g[0]),(0,0,42 * x))
ndg_bj4_breps_last = rs.MoveObject(rs.CopyObject(ndg_bj2_brep_g[-1]),(0,0,42 * x))

sufang4_breps[0] = rs.BooleanDifference(ndg_bj4_breps_first,sufang4_breps[0],delete_input=False)[0]
sufang4_breps[-1] = rs.BooleanDifference(ndg_bj4_breps_last,sufang4_breps[-1],delete_input=False)[0]


#第补间第四华拱生成

#补间辅第四跳华拱

#加42分

HuaGong4_pj_trimed_brep = rs.ExplodePolysurfaces(HuaGong4_pj)[25]
HuaGong4_pj_trimed_brep = rs.CurveEndPoint(rs.DuplicateEdgeCurves(HuaGong4_pj_trimed_brep)[0])

HuaGong4_pj_trimed_brep = rs.AddLine(HuaGong4_pj_trimed_brep,rs.MoveObject(rs.CopyObject(HuaGong4_pj_trimed_brep),(0,10 * x,0)))
HuaGong4_pj_trimed_brep = rs.ExtrudeCurve(HuaGong4_pj_trimed_brep,rs.AddLine(rs.AddPoint(0,0,0),rs.AddPoint(x,0,0)))
HuaGong4_pj_trimed_brep = rs.ExtrudeSurface(HuaGong4_pj_trimed_brep,rs.AddLine(rs.AddPoint(0,0,0),rs.AddPoint(0,0,22 * x)))
HuaGong4_pj_trimed_brep2 = rs.MirrorObject(HuaGong4_pj_trimed_brep,ZhuTou_point,rs.MoveObject(rs.CopyObject(ZhuTou_point),(0,x,0)),copy=True)
HuaGong4_pj_head1 = rs.BooleanDifference(HuaGong4_pj,HuaGong4_pj_trimed_brep,delete_input=False)[1]
HuaGong4_pj_mid = rs.BooleanDifference(HuaGong4_pj,HuaGong4_pj_trimed_brep,delete_input=False)[0]

HuaGong4_pj_mid = rs.BooleanDifference(HuaGong4_pj_mid,HuaGong4_pj_trimed_brep2,delete_input=False)[1]

#将头和中间段连接
rs.MoveObject(HuaGong4_pj_head1,(-21 * x,0,0))
HuaGong4_pj_head1_1 = rs.ExplodePolysurfaces(HuaGong4_pj_head1)[18]
HuaGong4_pj_head1_1 = rs.ExtrudeSurface(HuaGong4_pj_head1_1,rs.AddLine(rs.AddPoint(0,0,0),rs.AddPoint(22 * x,0,0)))

HuaGong4_pj_head1 = rs.BooleanDifference(HuaGong4_pj_head1_1,HuaGong4_pj_head1,delete_input = False)
HuaGong4_pj_head2 = rs.MirrorObject(HuaGong4_pj_head1,ZhuTou_point,rs.MoveObject(rs.CopyObject(ZhuTou_point),(0,x,0)),copy=True)

HuaGong4_pj = rs.BooleanDifference(HuaGong4_pj_head1,HuaGong4_pj_mid,delete_input=False)
HuaGong4_pj = rs.BooleanIntersection(HuaGong4_pj_head2,HuaGong4_pj,delete_input=False)

rs.MoveObject(HuaGong4_pj,(j * x,j * x + (MianKuo-((MianKuo+1)/2+1)) * 16 * 15 * x + (MianKuo_length * x)/2,252 * x +42 * x))

#第四层华拱剪切
#第四跳华拱被剪切

HuaGong4_bj_trimed = rs.MoveObject(rs.CopyObject(HuaGong1_bj_trimed),(-21 * x,0,63 * x))
HuaGong4_pj = rs.BooleanUnion([HuaGong4_pj,HuaGong4_bj_trimed],delete_input=False)[0]

#第四跳华拱组
HuaGong4_bjs = [HuaGong4_pj]
sq_rule = [0,0,0,0,0,0,0,0,0,0,0,0,0,0,0,0,0,0,0,0,1.25,4.25]
for i in range(int((MianKuo - 3)/2)):
    if i + 1 < len(range(int((MianKuo - 3)/2)+1)):
        HuaGong4_bj1 = rs.MoveObject(rs.CopyObject(HuaGong4_pj),(0,-(MianKuo_length * (i+1)) * x,sq_rule[-(int((MianKuo - 3)/2-i))] * x))
        HuaGong4_bjs.append(HuaGong4_bj1)

HuaGong4_bjs_left  = rs.MirrorObjects(HuaGong4_bjs[1:len(HuaGong3_bjs)],rs.MoveObject(rs.CopyObject(ZhuTou_point),(j * x,(MianKuo_length * (MianKuo - 2) * x + 2 * j * x)/2 ,0)),rs.MoveObject(rs.CopyObject(ZhuTou_point),(x,(MianKuo_length * (MianKuo - 2) * x + 2 * j * x)/2 ,0)),copy=True)

HuaGong4_bjs_left = HuaGong4_bjs_left[::-1]

HuaGong4_bjs = HuaGong4_bjs_left + HuaGong4_bjs

#令拱组
lg_breps = [lg_brep[0]]
sq_rule = [0,0,0,0,0,0,0,0,0,0,0,0,0,0,0,0,0,0,0,0,1.25,4.25]
for i in range(int((MianKuo - 3)/2)):
    if i + 1 < len(range(int((MianKuo - 3)/2)+1)):
        lg_brep1 = rs.MoveObject(rs.CopyObject(lg_brep),(0,-(MianKuo_length * (i+1)) * x,sq_rule[-(int((MianKuo - 3)/2-i))] * x))
        lg_breps.append(lg_brep1)

lg_breps_left  = rs.MirrorObjects(lg_breps[1:len(lg_breps)],rs.MoveObject(rs.CopyObject(ZhuTou_point),(j * x,(MianKuo_length * (MianKuo - 2) * x + 2 * j * x)/2 ,0)),rs.MoveObject(rs.CopyObject(ZhuTou_point),(x,(MianKuo_length * (MianKuo - 2) * x + 2 * j * x)/2 ,0)),copy=True)

lg_breps_left = lg_breps_left[::-1]

lg_breps = lg_breps_left + lg_breps



#补间辅第五跳华拱

#加42分

HuaGong5_pj_trimed_brep = rs.ExplodePolysurfaces(HuaGong5_pj)[25]
HuaGong5_pj_trimed_brep = rs.CurveEndPoint(rs.DuplicateEdgeCurves(HuaGong5_pj_trimed_brep)[0])

HuaGong5_pj_trimed_brep = rs.AddLine(HuaGong5_pj_trimed_brep,rs.MoveObject(rs.CopyObject(HuaGong5_pj_trimed_brep),(0,10 * x,0)))
HuaGong5_pj_trimed_brep = rs.ExtrudeCurve(HuaGong5_pj_trimed_brep,rs.AddLine(rs.AddPoint(0,0,0),rs.AddPoint(x,0,0)))
HuaGong5_pj_trimed_brep = rs.ExtrudeSurface(HuaGong5_pj_trimed_brep,rs.AddLine(rs.AddPoint(0,0,0),rs.AddPoint(0,0,43 * x)))
HuaGong5_pj_trimed_brep2 = rs.MirrorObject(HuaGong5_pj_trimed_brep,ZhuTou_point,rs.MoveObject(rs.CopyObject(ZhuTou_point),(0,x,0)),copy=True)
HuaGong5_pj_head1 = rs.BooleanDifference(HuaGong5_pj,HuaGong5_pj_trimed_brep,delete_input=False)[1]
HuaGong5_pj_mid = rs.BooleanDifference(HuaGong5_pj,HuaGong5_pj_trimed_brep,delete_input=False)[0]

HuaGong5_pj_mid = rs.BooleanDifference(HuaGong5_pj_mid,HuaGong5_pj_trimed_brep2,delete_input=False)[1]

#将头和中间段连接
rs.MoveObject(HuaGong5_pj_head1,(-42 * x,0,0))
HuaGong5_pj_head1_1 = rs.ExplodePolysurfaces(HuaGong5_pj_head1)[18]
HuaGong5_pj_head1_1 = rs.ExtrudeSurface(HuaGong5_pj_head1_1,rs.AddLine(rs.AddPoint(0,0,0),rs.AddPoint(43 * x,0,0)))

HuaGong5_pj_head1 = rs.BooleanDifference(HuaGong5_pj_head1_1,HuaGong5_pj_head1,delete_input = False)
HuaGong5_pj_head2 = rs.MirrorObject(HuaGong5_pj_head1,ZhuTou_point,rs.MoveObject(rs.CopyObject(ZhuTou_point),(0,x,0)),copy=True)

HuaGong5_pj = rs.BooleanDifference(HuaGong5_pj_head1,HuaGong5_pj_mid,delete_input=False)
HuaGong5_pj = rs.BooleanIntersection(HuaGong5_pj_head2,HuaGong5_pj,delete_input=False)

rs.MoveObject(HuaGong5_pj,(j * x,j * x + (MianKuo-((MianKuo+1)/2+1)) * 16 * 15 * x + (MianKuo_length * x)/2,252 * x +42 * x))

#第五跳华拱被剪切

HuaGong5_bj_trimed = rs.MoveObject(rs.CopyObject(HuaGong1_bj_trimed),(-21 * x,0,84 * x))
HuaGong5_pj = rs.BooleanUnion([HuaGong5_pj,HuaGong5_bj_trimed],delete_input=False)[0]

#第五跳华拱组
HuaGong5_bjs = [HuaGong5_pj]
sq_rule = [0,0,0,0,0,0,0,0,0,0,0,0,0,0,0,0,0,0,0,0,1.25,4.25]
for i in range(int((MianKuo - 3)/2)):
    if i + 1 < len(range(int((MianKuo - 3)/2)+1)):
        HuaGong5_bj1 = rs.MoveObject(rs.CopyObject(HuaGong5_pj),(0,-(MianKuo_length * (i+1)) * x,sq_rule[-(int((MianKuo - 3)/2-i))] * x))
        HuaGong5_bjs.append(HuaGong5_bj1)

HuaGong5_bjs_left  = rs.MirrorObjects(HuaGong5_bjs[1:len(HuaGong3_bjs)],rs.MoveObject(rs.CopyObject(ZhuTou_point),(j * x,(MianKuo_length * (MianKuo - 2) * x + 2 * j * x)/2 ,0)),rs.MoveObject(rs.CopyObject(ZhuTou_point),(x,(MianKuo_length * (MianKuo - 2) * x + 2 * j * x)/2 ,0)),copy=True)

HuaGong5_bjs_left = HuaGong5_bjs_left[::-1]

HuaGong5_bjs = HuaGong5_bjs_left + HuaGong5_bjs



#第四层素枋
# 生起曲线

le5_breps_2 = []
le5_brep_trimed_g_2 = []
le5_trimed2_2 = rs.CopyObjects(zhutou_pt_up2[1:len(zhutou_pt_up)-2])
rs.MoveObjects(le5_trimed2_2,(0,(9.5) * x,0))
le5_trimed1_2 = rs.CopyObjects(zhutou_pt_up2[2:len(zhutou_pt_up)-1])
rs.MoveObjects(le5_trimed1_2,(0,-(9.5) * x,0))
sq_cr_2 = rs.AddInterpCurve(zhutou_pt_up2[1:len(zhutou_pt_up)-1])
sq_sr_2 = rs.ExtrudeCurve(sq_cr_2,rs.AddLine(rs.AddPoint(0,0,0),rs.AddPoint(5 * x,0,0)))
for i in range(len(le5_trimed1_2)):
    cr1_2 = rs.AddLine(le5_trimed1_2[i],le5_trimed2_2[i])
    rs.MoveObject(cr1_2,(5 * x,0,21 * x))
    cr1_2 = rs.ProjectCurveToSurface(cr1_2,sq_sr_2,[0,0,x])

    le5_brep_2 = rs.ExtrudeCurve(cr1_2,rs.AddLine(rs.AddPoint(0,0,0),rs.AddPoint(-10 * x ,0,0)))
    le5_brep_2 = rs.ExtrudeSurface(le5_brep_2,rs.AddLine(rs.AddPoint(0,0,0),rs.AddPoint(0 ,0,-14.5 * x)))
    
    le5_brep_trimed_2 = rs.ExtrudeCurve(cr1_2,rs.AddLine(rs.AddPoint(0,0,0),rs.AddPoint(-10 * x ,0,0)))
    le5_brep_trimed_2 = rs.ExtrudeSurface(le5_brep_trimed_2,rs.AddLine(rs.AddPoint(0,0,0),rs.AddPoint(0 ,0,-15 * x)))
    rs.MoveObject(le5_brep_trimed_2,(0,0,5 * x))
    le5_brep_trimed_g_2.append(le5_brep_trimed_2)

rs.MoveObjects(le5_brep_trimed_g_2,(0,0,44.5 * x + 85 * x))

#第四层素枋中间连接件

sf5_connect_brep_trimed = rs.ExplodePolysurfaces(sf4_connect_brep1)[10]

rs.ScaleObject(sf5_connect_brep_trimed,ZhuTou_point,[5,1,2],copy=False)

sf5_connect_brep_trimed = rs.ExtrudeSurface(sf5_connect_brep_trimed,rs.AddLine(rs.AddPoint(0,0,0),rs.AddPoint(0,50 * x,0)))
rs.MoveObject(sf5_connect_brep_trimed,(0,x,0))

sf5_connect_brep_trimed2 = rs.MirrorObject(sf5_connect_brep_trimed,ZhuTou_point,rs.MoveObject(rs.CopyObject(ZhuTou_point),(x,0,0)),copy=True)

sf5_connect_brep2 = rs.BooleanDifference(sf4_connect_brep2,sf5_connect_brep_trimed,delete_input=False)
sf5_connect_brep1 = rs.BooleanUnion([sf5_connect_brep_trimed2,sf4_connect_brep1],delete_input=False)

#将连接件的拱眼补上

sf5_connect_brep_fix1 =rs.ExplodePolysurfaces(sf5_connect_brep1)[20]
sf5_connect_brep_fix1 = rs.ExtrudeSurface(sf5_connect_brep_fix1,rs.AddLine(rs.AddPoint(0,0,0),rs.AddPoint(-x,0,0)))
sf5_connect_brep_fix2 = rs.MirrorObject(sf5_connect_brep_fix1,ZhuTou_point,rs.MoveObject(rs.CopyObject(ZhuTou_point),(0,x,0)),copy=True)
sf5_connect_brep_fix3 = rs.MirrorObject(sf5_connect_brep_fix1,ZhuTou_point,rs.MoveObject(rs.CopyObject(ZhuTou_point),(x,0,0)),copy=True)
sf5_connect_brep_fix4 = rs.MirrorObject(sf5_connect_brep_fix2,ZhuTou_point,rs.MoveObject(rs.CopyObject(ZhuTou_point),(x,0,0)),copy=True)

sf5_connect_brep1 = rs.BooleanDifference(sf5_connect_brep1,sf5_connect_brep_fix1,delete_input=False)

sf5_connect_brep1 = rs.BooleanDifference(sf5_connect_brep1,sf5_connect_brep_fix2,delete_input=False)

sf5_connect_brep2 = rs.BooleanUnion([sf5_connect_brep_fix3,sf5_connect_brep2,sf5_connect_brep_fix4],delete_input=False)



sf5_connect_breps = [sf5_connect_brep1[0],sf5_connect_brep2[0]]
rs.MoveObjects(sf5_connect_breps ,(j * x,j * x + (MianKuo-((MianKuo+1)/2+1)) * 16 * 15 * x,252 * x + 105 * x))





sf5_connect_breps1 =[sf5_connect_breps[0]]
sf5_connect_breps2 =[sf5_connect_breps[1]]
sq_rule = [0,0,0,0,0,0,0,0,0,0,0,0,0,0,0,0,0,0,0,0,2.5,5]
for i in range(int((MianKuo - 3)/2)):
    if i + 1 < len(range(int((MianKuo - 3)/2))):
        sf5_brep1 = rs.MoveObject(rs.CopyObject(sf5_connect_breps[0]),(0,-(MianKuo_length * (i+1)) * x,sq_rule[-(int((MianKuo - 3)/2-i))] * x))
        sf5_brep2 = rs.MoveObject(rs.CopyObject(sf5_connect_breps[1]),(0,-(MianKuo_length * (i+1)) * x,sq_rule[-(int((MianKuo - 3)/2-i))] * x))
        sf5_connect_breps1.append(sf5_brep1)
        sf5_connect_breps2.append(sf5_brep2)
    
sf5_connect_breps1_left_1 = rs.MirrorObjects(sf5_connect_breps2,rs.MoveObject(rs.CopyObject(ZhuTou_point),(0,(MianKuo_length * (MianKuo - 2) * x + 2 * j * x)/2 ,0)),rs.MoveObject(rs.CopyObject(ZhuTou_point),(x,(MianKuo_length * (MianKuo - 2) * x + 2 * j * x)/2 ,0)),copy=True)
sf5_connect_breps1_left_1 = sf5_connect_breps1_left_1[::-1]

#
sf5_connect_breps2_right_1 = rs.MirrorObjects(sf5_connect_breps1,rs.MoveObject(rs.CopyObject(ZhuTou_point),(0,(MianKuo_length * (MianKuo - 2) * x + 2 * j * x)/2 ,0)),rs.MoveObject(rs.CopyObject(ZhuTou_point),(x,(MianKuo_length * (MianKuo - 2) * x + 2 * j * x)/2 ,0)),copy=True)
sf5_connect_breps2_right_1 = sf5_connect_breps2_right_1[::-1]


sf5_connect_breps1 = sf5_connect_breps1_left_1 + sf5_connect_breps1
sf5_connect_breps2 =   sf5_connect_breps2_right_1 + sf5_connect_breps2




#将第五层枋和素枋第五层连接件
le5_brep_trimed_g_2 = le5_brep_trimed_g_2[::-1]

sf5_connect_breps1_1 = sf5_connect_breps1[0 : len(sf5_connect_breps1)-1]

sf5_connect_breps2_1 = sf5_connect_breps2[1 : len(sf5_connect_breps2)]

le5_brep_trimed_g_2_1 = le5_brep_trimed_g_2[1:len(le5_brep_trimed_g_2)-1]

sufang5_breps = []

for i in range(len(le5_brep_trimed_g_2_1 )):

    if i <= len(le5_brep_trimed_g_2_1 )/2:
        sufang_brep = rs.BooleanUnion([le5_brep_trimed_g_2_1 [i],sf5_connect_breps1_1[i]],delete_input=False)[0]
    else:
        sufang_brep = rs.BooleanDifference(sf5_connect_breps1_1[i],le5_brep_trimed_g_2_1 [i],delete_input=False)[0]
    sufang5_breps.append(sufang_brep)

sufang5_breps1 = []

for i in range(len(sufang5_breps)):
    if i == int(len(le5_brep_trimed_g_2_1)/2):
        sufang_brep = rs.BooleanUnion([sufang5_breps[i],sf5_connect_breps2_1[i]],delete_input=False)[0]
    elif i < len(le5_brep_trimed_g_2_1)/2:
        sufang_brep = rs.BooleanDifference(sf5_connect_breps2_1[i],sufang5_breps[i],delete_input=False)[0]
    else:
        sufang_brep = rs.BooleanDifference(sufang5_breps[i],sf5_connect_breps2_1[i],delete_input=False)[0]
    sufang5_breps1.append(sufang_brep)    

sufang5_breps1_first = rs.BooleanDifference(sf5_connect_breps2[0],le5_brep_trimed_g_2[0],delete_input=False)

sufang5_breps1.insert(0,sufang5_breps1_first[0])

sufang5_breps1_last = rs.BooleanDifference(sf5_connect_breps1[-1],le5_brep_trimed_g_2[-1],delete_input=False)

sufang5_breps1.append(sufang5_breps1_last[0])



sufang5_breps = sufang5_breps1

#第一层素枋上的散斗

SanDous_sf1 = [SanDou[0],SanDou2]

SanDous_sf1_g = []

sq_rule = [0,0,0,0,0,0,0,0,0,0,0,0,0,0,0,0,0,0,0,0,1.25,4.25]
for i in range(int((MianKuo - 3)/2)):
    if i + 1 < len(range(int((MianKuo - 3)/2))):
        SanDous_sf1_g1 = rs.MoveObject(rs.CopyObject(SanDous_sf1[0]),(0,-(MianKuo_length * (i+1)) * x,sq_rule[-(int((MianKuo - 3)/2-i))] * x))
        SanDous_sf1_g2 = rs.MoveObject(rs.CopyObject(SanDous_sf1[1]),(0,-(MianKuo_length * (i+1)) * x,sq_rule[-(int((MianKuo - 3)/2-i))] * x))
        SanDous_sf1_g.append(SanDous_sf1_g1)
        SanDous_sf1_g.append(SanDous_sf1_g2)
SanDous_sf1_g.insert(0,SanDous_sf1[1])
SanDous_sf1_g.insert(0,SanDous_sf1[0])
SanDous_sf1_g_left  = rs.MirrorObjects(SanDous_sf1_g,rs.MoveObject(rs.CopyObject(ZhuTou_point),(j * x,(MianKuo_length * (MianKuo - 2) * x + 2 * j * x)/2 ,0)),rs.MoveObject(rs.CopyObject(ZhuTou_point),(x,(MianKuo_length * (MianKuo - 2) * x + 2 * j * x)/2 ,0)),copy=True)

SanDous_sf1_g_left = SanDous_sf1_g_left[::-1]

SanDous_sf1_g = SanDous_sf1_g_left + SanDous_sf1_g

#第二层素枋上的散斗

SanDous_sf2_g = []

sq_rule = [0,0,0,0,0,0,0,0,0,0,0,0,0,0,0,0,0,0,0,0,1.25,4.25]
for i in range(int((MianKuo - 3)/2)):
    if i + 1 < len(range(int((MianKuo - 3)/2))):
        SanDous_sf2_g1 = rs.MoveObject(rs.CopyObject(SanDous_sf2[0]),(0,-(MianKuo_length * (i+1)) * x,sq_rule[-(int((MianKuo - 3)/2-i))] * x))
        SanDous_sf2_g2 = rs.MoveObject(rs.CopyObject(SanDous_sf2[1]),(0,-(MianKuo_length * (i+1)) * x,sq_rule[-(int((MianKuo - 3)/2-i))] * x))
        SanDous_sf2_g.append(SanDous_sf2_g1)
        SanDous_sf2_g.append(SanDous_sf2_g2)
SanDous_sf2_g.insert(0,SanDous_sf2[1])
SanDous_sf2_g.insert(0,SanDous_sf2[0])
SanDous_sf2_g_left  = rs.MirrorObjects(SanDous_sf2_g,rs.MoveObject(rs.CopyObject(ZhuTou_point),(j * x,(MianKuo_length * (MianKuo - 2) * x + 2 * j * x)/2 ,0)),rs.MoveObject(rs.CopyObject(ZhuTou_point),(x,(MianKuo_length * (MianKuo - 2) * x + 2 * j * x)/2 ,0)),copy=True)

SanDous_sf2_g_left = SanDous_sf2_g_left[::-1]

SanDous_sf2_g = SanDous_sf2_g_left + SanDous_sf2_g

#第一层铺作上的散斗

rs.MoveObjects(SanDous_ndg_bj,(j * x - 5 * x,j * x + (MianKuo-((MianKuo+1)/2+1)) * 16 * 15 * x + (MianKuo_length * x)/2,252 * x +42 * x))


SanDous_ndg_bj_g = []
sq_rule = [0,0,0,0,0,0,0,0,0,0,0,0,0,0,0,0,0,0,0,0,1.25,4.25]
for i in range(int((MianKuo - 3)/2)):
    if i + 1 < len(range(int((MianKuo - 3)/2)+1)):
        SanDous_ndg_bj_g1 = rs.MoveObject(rs.CopyObject(SanDous_ndg_bj[0]),(0,-(MianKuo_length * (i+1)) * x,sq_rule[-(int((MianKuo - 3)/2-i))] * x))
        SanDous_ndg_bj_g2 = rs.MoveObject(rs.CopyObject(SanDous_ndg_bj[1]),(0,-(MianKuo_length * (i+1)) * x,sq_rule[-(int((MianKuo - 3)/2-i))] * x))
        SanDous_ndg_bj_g.append(SanDous_ndg_bj_g1)
        SanDous_ndg_bj_g.append(SanDous_ndg_bj_g2)

SanDous_ndg_bj_g_left  = rs.MirrorObjects(SanDous_ndg_bj_g,rs.MoveObject(rs.CopyObject(ZhuTou_point),(j * x,(MianKuo_length * (MianKuo - 2) * x + 2 * j * x)/2 ,0)),rs.MoveObject(rs.CopyObject(ZhuTou_point),(x,(MianKuo_length * (MianKuo - 2) * x + 2 * j * x)/2 ,0)),copy=True)

SanDous_ndg_bj_g_left = SanDous_ndg_bj_g_left[::-1]

SanDous_ndg_bj_g = SanDous_ndg_bj_g_left + SanDous_ndg_bj +SanDous_ndg_bj_g

#第二层铺作上的散斗

SanDou2_ndg_bj2 = rs.MoveObject(rs.CopyObjects(SanDou),(0,24 * x,21 * x))

SanDou1_ndg_bj2 = rs.MirrorObject(SanDou2_ndg_bj2,rs.MoveObject(rs.CopyObject(ZhuTou_point),(0,(MianKuo_length * (MianKuo - 2) * x + 2 * j * x)/2 ,0)),rs.MoveObject(rs.CopyObject(ZhuTou_point),(x,(MianKuo_length * (MianKuo - 2) * x + 2 * j * x)/2 ,0)),copy=True)

SanDous_ndg_bj2 = [SanDou1_ndg_bj2,SanDou2_ndg_bj2]

SanDous_ndg_bj2_g = []
sq_rule = [0,0,0,0,0,0,0,0,0,0,0,0,0,0,0,0,0,0,0,0,1.25,4.25]
for i in range(int((MianKuo - 3)/2)):
    if i + 1 < len(range(int((MianKuo - 3)/2)+1)):
        SanDous_ndg_bj2_g1 = rs.MoveObject(rs.CopyObject(SanDous_ndg_bj2[0]),(0,-(MianKuo_length * (i+1)) * x,sq_rule[-(int((MianKuo - 3)/2-i))] * x))
        SanDous_ndg_bj2_g2 = rs.MoveObject(rs.CopyObject(SanDous_ndg_bj2[1]),(0,-(MianKuo_length * (i+1)) * x,sq_rule[-(int((MianKuo - 3)/2-i))] * x))
        SanDous_ndg_bj2_g.append(SanDous_ndg_bj2_g1)
        SanDous_ndg_bj2_g.append(SanDous_ndg_bj2_g2)

SanDous_ndg_bj2_g_left  = rs.MirrorObjects(SanDous_ndg_bj2_g,rs.MoveObject(rs.CopyObject(ZhuTou_point),(j * x,(MianKuo_length * (MianKuo - 2) * x + 2 * j * x)/2 ,0)),rs.MoveObject(rs.CopyObject(ZhuTou_point),(x,(MianKuo_length * (MianKuo - 2) * x + 2 * j * x)/2 ,0)),copy=True)

SanDous_ndg_bj2_g_left = SanDous_ndg_bj2_g_left[::-1]

SanDous_ndg_bj2_g = SanDous_ndg_bj2_g_left + SanDous_ndg_bj2 +SanDous_ndg_bj2_g

SanDous_ndg_bj4_g = rs.MoveObjects(rs.CopyObjects(SanDous_ndg_bj2_g ),(0,0,42 * x))

SanDous_ndg_bj2_g = SanDous_ndg_bj2_g [2:len(SanDous_ndg_bj2_g)-2]


SanDous_ndg_bj3_g = rs.MoveObjects(rs.CopyObjects(SanDous_ndg_bj_g ),(0,0,42 * x))

#令拱上的散斗

rs.MoveObject(SanDou_lg_mid ,(j * x -20 * x,j * x + (MianKuo-((MianKuo+1)/2+1)) * 16 * 15 * x + (MianKuo_length * x)/2-2 * x,252 * x +78 * x))

SanDous_lg_g = rs.MoveObjects(rs.CopyObjects(SanDous_ndg_bj3_g),(-47 * x,0,0))

SanDous_lg_g_jinjian = SanDous_lg_g[len(SanDous_lg_g)-2:len(SanDous_lg_g)]
SanDous_ndg_bj3_g = SanDous_ndg_bj3_g [2:len(SanDous_ndg_bj3_g)-2]

SanDous_sf3_g = rs.MoveObjects(rs.CopyObjects(SanDous_sf1_g),(0,0,42 * x))

SanDous_sf4_g = rs.MoveObjects(rs.CopyObjects(SanDous_sf2_g),(0,0,42 * x))

#令拱中间的组
SanDou_lg_mids = [SanDou_lg_mid]
sq_rule = [0,0,0,0,0,0,0,0,0,0,0,0,0,0,0,0,0,0,0,0,1.25,4.25]
for i in range(int((MianKuo - 3)/2)):
    if i + 1 < len(range(int((MianKuo - 3)/2)+1)):
        SanDou_lg_mid1 = rs.MoveObject(rs.CopyObject(SanDou_lg_mid),(0,-(MianKuo_length * (i+1)) * x,sq_rule[-(int((MianKuo - 3)/2-i))] * x))
        SanDou_lg_mids.append(SanDou_lg_mid1)

SanDou_lg_mids_left  = rs.MirrorObjects(SanDou_lg_mids[1:len(SanDou_lg_mids)],rs.MoveObject(rs.CopyObject(ZhuTou_point),(j * x,(MianKuo_length * (MianKuo - 2) * x + 2 * j * x)/2 ,0)),rs.MoveObject(rs.CopyObject(ZhuTou_point),(x,(MianKuo_length * (MianKuo - 2) * x + 2 * j * x)/2 ,0)),copy=True)

SanDou_lg_mids_left = SanDou_lg_mids_left[::-1]

SanDou_lg_mids = SanDou_lg_mids_left + SanDou_lg_mids

SanDous_lg_g = SanDous_lg_g + SanDou_lg_mids

SanDous_lg_houyan_g = rs.MirrorObjects(SanDous_lg_g,rs.MoveObject(rs.CopyObject(ZhuTou_point),(j*x,0,0)),rs.MoveObject(rs.CopyObject(ZhuTou_point),(j*x,x,0)),copy=True)
rs.MoveObjects(SanDous_lg_houyan_g,(21 * x,0,63 * x))

#补间华拱上的斗群成组

Dous_hg_bjs_g = []
sq_rule = [0,0,0,0,0,0,0,0,0,0,0,0,0,0,0,0,0,0,0,0,1.25,4.25]
for i in range(int((MianKuo - 3)/2)):
    if i + 1 < len(range(int((MianKuo - 3)/2)+1)):
        Dous_hg_bjs_g1 = rs.MoveObjects(rs.CopyObjects(Dous_hg_bjs),(0,-(MianKuo_length * (i+1)) * x,sq_rule[-(int((MianKuo - 3)/2-i))] * x))
        Dous_hg_bjs_g = Dous_hg_bjs_g + Dous_hg_bjs_g1

Dous_hg_bjs_g_left  = rs.MirrorObjects(Dous_hg_bjs_g,rs.MoveObject(rs.CopyObject(ZhuTou_point),(j * x,(MianKuo_length * (MianKuo - 2) * x + 2 * j * x)/2 ,0)),rs.MoveObject(rs.CopyObject(ZhuTou_point),(x,(MianKuo_length * (MianKuo - 2) * x + 2 * j * x)/2 ,0)),copy=True)

Dous_hg_bjs_g_left = Dous_hg_bjs_g_left[::-1]

Dous_hg_bjs_g =  Dous_hg_bjs +Dous_hg_bjs_g_left + Dous_hg_bjs_g

#令拱后檐

lg_brep_houyan = rs.MoveObject(rs.CopyObject(ndg_bj1_brep),(68 * x,0,105 * x))



#将令拱中间连接起来

lg_brep_houyan_trimed1 = rs.ExplodePolysurfaces(lg_brep_houyan)[15]

lg_brep_houyan_trimed1 = rs.ExtrudeSurface(lg_brep_houyan_trimed1,rs.AddLine(rs.AddPoint(0,0,0),rs.AddPoint(0,-8 * x,0)))


lg_brep_houyan_trimed2 = rs.ExplodePolysurfaces(lg_brep_houyan)[3]
lg_brep_houyan_trimed2 = rs.ExtrudeSurface(lg_brep_houyan_trimed2,rs.AddLine(rs.AddPoint(0,0,0),rs.AddPoint(-2.5 * x,0,0)))

lg_brep_houyan_trimed3 = rs.ExplodePolysurfaces(lg_brep_houyan)[8]
lg_brep_houyan_trimed3 = rs.ExtrudeSurface(lg_brep_houyan_trimed3,rs.AddLine(rs.AddPoint(0,0,0),rs.AddPoint(-2.5 * x,0,0)))


lg_brep_houyan = rs.BooleanDifference(lg_brep_houyan_trimed1,lg_brep_houyan,delete_input=False)

lg_brep_houyan = rs.BooleanIntersection(lg_brep_houyan,lg_brep_houyan_trimed2,delete_input=False)
lg_brep_houyan = rs.BooleanIntersection(lg_brep_houyan,lg_brep_houyan_trimed3,delete_input=False)

#令拱中间的馒头榫

mts_lg_mid = rs.ExplodePolysurfaces(lg_brep_houyan_trimed1)[0]
mts_lg_mid = rs.CurveEndPoint(rs.DuplicateEdgeCurves(mts_lg_mid)[0])

rs.MoveObject(mts_lg_mid,(-3.75 * x,-2.75 * x,0))

mts_lg_mid = rs.AddLine(mts_lg_mid,rs.MoveObject(rs.CopyObject(mts_lg_mid),(-2.5 * x,0,0)))
mts_lg_mid = rs.ExtrudeCurve(mts_lg_mid,rs.AddLine(rs.AddPoint(0,0,0),rs.AddPoint(0,-2.5 * x,0)))
mts_lg_mid = rs.ExtrudeSurface(mts_lg_mid,rs.AddLine(rs.AddPoint(0,0,0),rs.AddPoint(0,0,2.5 * x)))

lg_brep_houyan = rs.BooleanIntersection(lg_brep_houyan,mts_lg_mid,delete_input=False)

#令拱组

lg_brep_houyans = [lg_brep_houyan[0]]
sq_rule = [0,0,0,0,0,0,0,0,0,0,0,0,0,0,0,0,0,0,0,0,1.25,4.25]
for i in range(int((MianKuo - 3)/2)):
    if i + 1 < len(range(int((MianKuo - 3)/2)+1)):
        lg_brep_houyan1 = rs.MoveObject(rs.CopyObject(lg_brep_houyan),(0,-(MianKuo_length * (i+1)) * x,sq_rule[-(int((MianKuo - 3)/2-i))] * x))
        lg_brep_houyans.append(lg_brep_houyan1)

lg_brep_houyans_left  = rs.MirrorObjects(lg_brep_houyans[1:len(lg_brep_houyans)],rs.MoveObject(rs.CopyObject(ZhuTou_point),(j * x,(MianKuo_length * (MianKuo - 2) * x + 2 * j * x)/2 ,0)),rs.MoveObject(rs.CopyObject(ZhuTou_point),(x,(MianKuo_length * (MianKuo - 2) * x + 2 * j * x)/2 ,0)),copy=True)

lg_brep_houyans_left = lg_brep_houyans_left[::-1]

lg_brep_houyans = lg_brep_houyans_left + lg_brep_houyans

#第一层素枋被补间第一跳华拱剪切
sufang5_breps2 = []
for i in range(len(sufang_breps)):
    if i == int(len(sufang_breps)/2):
        sufang_brep = rs.BooleanIntersection(HuaGong5_bjs[i],sufang5_breps[i],delete_input=False)
    else:
        sufang_brep = rs.BooleanDifference(HuaGong5_bjs[i],sufang5_breps[i],delete_input=False)    
    sufang5_breps2.append(sufang_brep[0])

sufang5_breps = sufang5_breps2

#进深方向的拱眼壁生成

GongYanBi_jinshen = [HuaGong1_bjs[-1],HuaGong2_bjs[-1],HuaGong3_bjs[-1],HuaGong4_bjs[-1],HuaGong5_bjs[-1],lg_breps[-1],lg_brep_houyans[-1],SanDous_lg_g[-1],SanDous_lg_houyan_g[-1]]

GongYanBi_jinshen = GongYanBi_jinshen + Dous_hg_bjs_g[len(Dous_hg_bjs_g)-5:len(Dous_hg_bjs_g)]
GongYanBi_jinshen = GongYanBi_jinshen + SanDous_ndg_bj_g[len(SanDous_ndg_bj_g)-2:len(SanDous_ndg_bj_g)]
GongYanBi_jinshen = GongYanBi_jinshen + SanDous_ndg_bj4_g[len(SanDous_ndg_bj4_g)-2:len(SanDous_ndg_bj4_g)]
GongYanBi_jinshen = GongYanBi_jinshen + SanDous_lg_g_jinjian

SanDous_lg2_g_jinjian = rs.MirrorObjects(SanDous_lg_g_jinjian,rs.MoveObject(rs.CopyObject(ZhuTou_point),(j*x,0,0)),rs.MoveObject(rs.CopyObject(ZhuTou_point),(j*x,x,0)),copy=True)
rs.MoveObjects(SanDous_lg2_g_jinjian,(21 * x,0,63 * x))

GongYanBi_jinshen = GongYanBi_jinshen + SanDous_lg2_g_jinjian
GongYanBi_jinshen2 = rs.CopyObjects(GongYanBi_jinshen)
rs.RotateObjects(GongYanBi_jinshen2,rs.MoveObject(rs.CopyObject(ZhuTou_point),(j * x,j * x,0)),90,[0,0,x],copy=False)

rs.MoveObjects(GongYanBi_jinshen2,(2 * j * x +10 * x ,0,0))

GongYanBi_jinshen1 = rs.MirrorObjects(GongYanBi_jinshen2,rs.MoveObject(rs.CopyObject(ZhuTou_point),(2 * j *x,0,0)),rs.MoveObject(rs.CopyObject(ZhuTou_point),(2 * j *x,x,0)),copy=True)

sufangs_breps_g = rs.MoveObjects(rs.CopyObjects([sf1_breps[0],sf1_breps[1],sf2_breps[0],sf2_breps[1],sf5_connect_breps[0],sf5_connect_breps[1]]),(0,-((MianKuo-2) * MianKuo_length )*x/2,0))

rs.RotateObjects(sufangs_breps_g,rs.MoveObject(rs.CopyObject(ZhuTou_point),(j * x,j * x,0)),90,[0,0,x],copy=False)

rs.MoveObjects(sufangs_breps_g,(j * x/2- 15 * x ,0,2.5 * x))

#补间辅作泥道栱群

ndgs_bjs = rs.MoveObjects(rs.CopyObjects([ndg_bj1_brep,rs.MoveObject(rs.CopyObject(ndg_bj2_brep),(0,0,42 * x))]),(0,-((MianKuo-2) * MianKuo_length )*x/2,0))

rs.RotateObjects(ndgs_bjs,rs.MoveObject(rs.CopyObject(ZhuTou_point),(j * x,j * x,0)),90,[0,0,x],copy=False)

rs.MoveObjects(ndgs_bjs,(j * x/2+ 5 * x,0,4.25 * x))

#第一层素枋
# 生起曲线

le_brep_trimed_g_4 = []
shan_mian_pt_up_2 = [zhutou_pt_up2[1],zhutou_pt_up3[1],zhutou_pt_up4[1]]
le_trimed2_4 = rs.CopyObjects(shan_mian_pt_up_2[0:len(zhutou_pt_up)-1])
rs.MoveObjects(le_trimed2_4,((NiDaoGong_CaiFen_left+2) * x,0,0))
le_trimed1_4 = rs.CopyObjects(shan_mian_pt_up_2[1:len(zhutou_pt_up)])
rs.MoveObjects(le_trimed1_4,(-(NiDaoGong_CaiFen_left+2) * x,0,0))
sq_cr_4 = rs.AddInterpCurve(shan_mian_pt_up_2)
sq_sr_4 = rs.ExtrudeCurve(sq_cr_4,rs.AddLine(rs.AddPoint(0,0,0),rs.AddPoint(0,5 * x,0)))
for i in range(len(le_trimed1_4)):
    cr1_4 = rs.AddLine(le_trimed1_4[i],le_trimed2_4[i])
    rs.MoveObject(cr1_4,(0,4 * x,21 * x))
    cr1_4 = rs.ProjectCurveToSurface(cr1_4,sq_sr_4,[0,0,x])

    le_brep_4 = rs.ExtrudeCurve(cr1_4,rs.AddLine(rs.AddPoint(0,0,0),rs.AddPoint(0,-8 * x ,0)))
    le_brep_4 = rs.ExtrudeSurface(le_brep_4,rs.AddLine(rs.AddPoint(0,0,0),rs.AddPoint(0 ,0,-14.5 * x)))
    
    le_brep_trimed_4 = rs.ExtrudeCurve(cr1_4,rs.AddLine(rs.AddPoint(0,0,0),rs.AddPoint(0,-8 * x ,0)))
    le_brep_trimed_4 = rs.ExtrudeSurface(le_brep_trimed_4,rs.AddLine(rs.AddPoint(0,0,0),rs.AddPoint(0 ,0,-14.5 * x)))
    rs.MoveObject(le_brep_trimed_4,(0,0,5 * x))
    le_brep_trimed_g_4.append(le_brep_trimed_4)

rs.MoveObjects(le_brep_trimed_g_4,(0,0,44.5 * x))

#第二层素枋
# 生起曲线

le2_brep_trimed_g_4 = []
shan_mian_pt_up_2 = [zhutou_pt_up2[1],zhutou_pt_up3[1],zhutou_pt_up4[1]]
le2_trimed2_4 = rs.CopyObjects(shan_mian_pt_up_2[0:len(zhutou_pt_up)-1])
rs.MoveObjects(le2_trimed2_4,((10) * x,0,0))
le2_trimed1_4 = rs.CopyObjects(shan_mian_pt_up_2[1:len(zhutou_pt_up)])
rs.MoveObjects(le2_trimed1_4,(-(10) * x,0,0))
sq_cr_4 = rs.AddInterpCurve(shan_mian_pt_up_2)
sq_sr_4 = rs.ExtrudeCurve(sq_cr_4,rs.AddLine(rs.AddPoint(0,0,0),rs.AddPoint(0,5 * x,0)))
for i in range(len(le2_trimed1_4)):
    cr1_4 = rs.AddLine(le2_trimed1_4[i],le2_trimed2_4[i])
    rs.MoveObject(cr1_4,(0,4 * x,21 * x))
    cr1_4 = rs.ProjectCurveToSurface(cr1_4,sq_sr_4,[0,0,x])

    le2_brep_4 = rs.ExtrudeCurve(cr1_4,rs.AddLine(rs.AddPoint(0,0,0),rs.AddPoint(0,-8 * x ,0)))
    le2_brep_4 = rs.ExtrudeSurface(le2_brep_4,rs.AddLine(rs.AddPoint(0,0,0),rs.AddPoint(0 ,0,-14.5 * x)))
    
    le2_brep_trimed_4 = rs.ExtrudeCurve(cr1_4,rs.AddLine(rs.AddPoint(0,0,0),rs.AddPoint(0,-8 * x ,0)))
    le2_brep_trimed_4 = rs.ExtrudeSurface(le2_brep_trimed_4,rs.AddLine(rs.AddPoint(0,0,0),rs.AddPoint(0 ,0,-14.5 * x)))
    rs.MoveObject(le2_brep_trimed_4,(0,0,5 * x))
    le2_brep_trimed_g_4.append(le2_brep_trimed_4)

rs.MoveObjects(le2_brep_trimed_g_4,(0,0,44.5 * x +21 * x))

#第五层素枋

le5_brep_trimed_g_4 = []
shan_mian_pt_up_2 = [zhutou_pt_up2[1],zhutou_pt_up3[1],zhutou_pt_up4[1]]
le5_trimed2_4 = rs.CopyObjects(shan_mian_pt_up_2[0:len(zhutou_pt_up)-1])
rs.MoveObjects(le5_trimed2_4,((9.5) * x,0,0))
le5_trimed1_4 = rs.CopyObjects(shan_mian_pt_up_2[1:len(zhutou_pt_up)])
rs.MoveObjects(le5_trimed1_4,(-(9.5) * x,0,0))
sq_cr_4 = rs.AddInterpCurve(shan_mian_pt_up_2)
sq_sr_4 = rs.ExtrudeCurve(sq_cr_4,rs.AddLine(rs.AddPoint(0,0,0),rs.AddPoint(0,5 * x,0)))
for i in range(len(le5_trimed1_4)):
    cr1_4 = rs.AddLine(le5_trimed1_4[i],le5_trimed2_4[i])
    rs.MoveObject(cr1_4,(0,5 * x,21 * x))
    cr1_4 = rs.ProjectCurveToSurface(cr1_4,sq_sr_4,[0,0,x])

    le5_brep_4 = rs.ExtrudeCurve(cr1_4,rs.AddLine(rs.AddPoint(0,0,0),rs.AddPoint(0,-10 * x ,0)))
    le5_brep_4 = rs.ExtrudeSurface(le5_brep_4,rs.AddLine(rs.AddPoint(0,0,0),rs.AddPoint(0 ,0,-15 * x)))
    
    le5_brep_trimed_4 = rs.ExtrudeCurve(cr1_4,rs.AddLine(rs.AddPoint(0,0,0),rs.AddPoint(0,-10 * x ,0)))
    le5_brep_trimed_4 = rs.ExtrudeSurface(le5_brep_trimed_4,rs.AddLine(rs.AddPoint(0,0,0),rs.AddPoint(0 ,0,-15 * x)))
    rs.MoveObject(le5_brep_trimed_4,(0,0,5 * x))
    le5_brep_trimed_g_4.append(le5_brep_trimed_4)

rs.MoveObjects(le5_brep_trimed_g_4,(0,0,44.5 * x +84 * x))
sufang1_brep_jinshen1 = rs.BooleanUnion([sufangs_breps_g[1],le_brep_trimed_g_4[0]],delete_input=False)
sufang1_brep_jinshen2 = rs.BooleanDifference(sufangs_breps_g[0],le_brep_trimed_g_4[1],delete_input=False)
#第一层素枋被间第一跳华拱剪切
sufang1_brep_jinshen1 = rs.BooleanDifference(sufang1_brep_jinshen1,GongYanBi_jinshen1[0],delete_input=False)

sufang1_brep_jinshen2 = rs.BooleanUnion([sufang1_brep_jinshen2,GongYanBi_jinshen2[0]],delete_input=False)



sufang2_brep_jinshen1 = rs.BooleanUnion([sufangs_breps_g[2],le2_brep_trimed_g_4[0]],delete_input=False)
sufang2_brep_jinshen2 = rs.BooleanUnion([le2_brep_trimed_g_4[1],sufangs_breps_g[3]],delete_input=False)

#第二层素枋被间第二跳华拱剪切
sufang2_brep_jinshen1 = rs.BooleanIntersection(GongYanBi_jinshen1[1],sufang2_brep_jinshen1,delete_input=False)

sufang2_brep_jinshen2 = rs.BooleanIntersection(sufang2_brep_jinshen2,GongYanBi_jinshen2[1],delete_input=False)


sufang3_breps_jinshen = rs.MoveObjects(rs.CopyObjects([sufang1_brep_jinshen1,sufang1_brep_jinshen2]),(0,0,42 * x))

sufang4_brep_jinshen1 = rs.MoveObject(rs.CopyObjects([sufang2_brep_jinshen1,sufang1_brep_jinshen2]),(0,0,42 * x))
sufang4_brep_jinshen2 = rs.MoveObject(rs.CopyObjects([sufang2_brep_jinshen2,sufang1_brep_jinshen2]),(0,0,42 * x))

#第一层素枋和补间一层泥道栱连接

sufang1_brep_jinshen1 = rs.BooleanUnion([sufang1_brep_jinshen1,ndgs_bjs[0]],delete_input=False)
sufang1_brep_jinshen2 = rs.BooleanDifference(sufang1_brep_jinshen2,rs.MirrorObject(ndgs_bjs[0],rs.MoveObject(rs.CopyObject(ZhuTou_point),(2 *j * x,0,0)),rs.MoveObject(rs.CopyObject(ZhuTou_point),(2 *j * x,x,0)),copy=True),delete_input=False)

#第三层素枋和补间第三层泥道栱连接
sufang4_brep_jinshen1 = rs.BooleanDifference(ndgs_bjs[1],sufang4_brep_jinshen1,delete_input=False)
sufang4_brep_jinshen2 = rs.BooleanDifference(rs.MirrorObject(ndgs_bjs[1],rs.MoveObject(rs.CopyObject(ZhuTou_point),(2 *j * x,0,0)),rs.MoveObject(rs.CopyObject(ZhuTou_point),(2 *j * x,x,0)),copy=True),sufang4_brep_jinshen2,delete_input=False)

#第素枋和连接件连接

sufang5_brep_jinshen1 = rs.BooleanUnion([le5_brep_trimed_g_4[0],sufangs_breps_g[5]],delete_input=False)
sufang5_brep_jinshen2 = rs.BooleanDifference(sufangs_breps_g[4],le5_brep_trimed_g_4[1],delete_input=False)

#第一层素枋上的散斗

SanDou1_sf1_jinshen = rs.MoveObject(rs.CopyObject(GongYanBi_jinshen1[14]),(25 * x,0,-1.75 * x))
SanDou1_sf2_jinshen = rs.MoveObject(rs.CopyObject(SanDou1_sf1_jinshen),(22 * x,0,21 * x))
SanDou1_sf3_jinshen = rs.MoveObject(rs.CopyObject(SanDou1_sf1_jinshen),(0,0,42 * x))
SanDou1_sf4_jinshen = rs.MoveObject(rs.CopyObject(SanDou1_sf2_jinshen),(0,0,42 * x))

SanDous_sfs_jinshen = [SanDou1_sf1_jinshen,SanDou1_sf2_jinshen,SanDou1_sf3_jinshen,SanDou1_sf4_jinshen]

SanDous_sfs_jinshen = SanDous_sfs_jinshen + rs.MirrorObjects(SanDous_sfs_jinshen,rs.MoveObject(rs.CopyObject(ZhuTou_point),(2 *j * x,0,0)),rs.MoveObject(rs.CopyObject(ZhuTou_point),(2 *j * x,x,0)),copy=True)

#将第五层素枋两端向外延伸

sufang5_breps_1 = rs.ExplodePolysurfaces(sufang5_breps[0])[24]
sufang5_breps_1 = rs.ExtrudeSurface(sufang5_breps_1,rs.AddLine(rs.AddPoint(0,0,0),rs.AddPoint(0,10 * x,0)))

sufang5_breps_2 = rs.ExplodePolysurfaces(sufang5_breps[-1])[24]
sufang5_breps_2 = rs.ExtrudeSurface(sufang5_breps_2,rs.AddLine(rs.AddPoint(0,0,0),rs.AddPoint(0,-10 * x,0)))

sufang5_breps[0] = rs.BooleanDifference(sufang5_breps_1,sufang5_breps[0],delete_input=False)[0]
sufang5_breps[-1] = rs.BooleanDifference(sufang5_breps_2,sufang5_breps[-1],delete_input=False)[0]

#整合
lg_brep_houyans = lg_brep_houyans[1:len(lg_brep_houyans)-1]


GongYanBi_jinshen1 = GongYanBi_jinshen1 + [sufang1_brep_jinshen1[0],sufang2_brep_jinshen1[0],sufang3_breps_jinshen[0],sufang4_brep_jinshen1[0],sufang5_brep_jinshen1[0]] + SanDous_sfs_jinshen[0:4]
del GongYanBi_jinshen1[6]

GongYanBi_jinshen2 = GongYanBi_jinshen2 + [sufang1_brep_jinshen2[0],sufang2_brep_jinshen2[0],sufang3_breps_jinshen[1],sufang4_brep_jinshen2[0],sufang5_brep_jinshen2[0]] + SanDous_sfs_jinshen[4:7]
del GongYanBi_jinshen2[6]
GongYanBi_jinshen = GongYanBi_jinshen1 + GongYanBi_jinshen2

GongYanBi_neiyan = sufang_breps + sufang2_breps + sufang3_breps + sufang4_breps + sufang5_breps + HuaGong1_bjs + HuaGong2_bjs + HuaGong3_bjs + HuaGong4_bjs + HuaGong5_bjs + SanDous_ndg_bj_g + SanDous_ndg_bj2_g + SanDous_ndg_bj3_g + SanDous_ndg_bj4_g + SanDous_sf1_g + SanDous_sf2_g + SanDous_sf3_g + SanDous_sf4_g + lg_breps + lg_brep_houyans + SanDous_lg_g + SanDous_lg_houyan_g + Dous_hg_bjs_g

GongYanBi_neiyan = GongYanBi_neiyan + rs.MirrorObjects(GongYanBi_neiyan,rs.MoveObject(rs.CopyObject(ZhuTou_point),(4 * j/2 * x,0,0)),rs.MoveObject(rs.CopyObject(ZhuTou_point),(4 * j/2 * x,x,0)),copy=True)

GongYanBi_jinshen = GongYanBi_jinshen + rs.MirrorObjects(GongYanBi_jinshen,rs.MoveObject(rs.CopyObject(ZhuTou_point),(0,(MianKuo_length * (MianKuo - 2) * x + 2 * j * x)/2 ,0)),rs.MoveObject(rs.CopyObject(ZhuTou_point),(x,(MianKuo_length * (MianKuo - 2) * x + 2 * j * x)/2 ,0)),copy=True)
# ---------- end python_3_script_16 ----------

number_slider_28 = Slider(0, range=0..100)
custom_mapping = CustomMapping()
number_slider_29 = Slider(32, range=0..100)
curve_17 = Curve()
number_slider_30 = Slider(32, range=0..100)
brep_43 = Brep()
brep_44 = Brep()
number_slider_31 = Slider(7, range=0..15)
list_item_14 = ListItem(Index=number_slider_28, Wrap=True)
list_item_15 = ListItem(Index=number_slider_28, Wrap=True)
panel_8 = Panel(brep_43)
relay = Relay()
python_3_script_17 = Python3Script(
    CaiFen=number_slider_2,
    HuaGong_CaiFen_left=number_slider_2,
    NiDaoGong_CaiFen_left=number_slider_16,
    NiDaoGong_CaiFen_right=number_slider_17)  # -> out, crf_zj_pt0, crf_zj_brep, jb_zj_brep, JiaoLiang_brep, ZiJiaoLiang_brep, JiaoLiang_jia_brep2, JiaoLiang_jia_brep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
# ---------- python_3_script_17: Python ----------
import rhinoscriptsyntax as rs
import Rhino.Geometry as rg
import itertools as it
import math
x = CaiFen
#柱头点
ZhuTou_point = rs.AddPoint(HuaGong_CaiFen_left * x,5 *x,0)

j = 14 * 15
#转角草乳袱生成

crf_zj_pt0 = rs.MoveObject(rs.CopyObject(ZhuTou_point),(j * x + HuaGong_CaiFen_left * x/2,j * x,377 * x))

crf_zj_brep = rs.AddLine(crf_zj_pt0,rs.MoveObject(rs.CopyObject(crf_zj_pt0),(-j * x -150 * x,0,0)))

rs.MoveObject(crf_zj_brep,(5 * x,5 * x,0))
crf_zj_brep = rs.ExtrudeCurve(crf_zj_brep,rs.AddLine(rs.AddPoint(0,0,0),rs.AddPoint(0,-10 * x,0)))
crf_zj_brep = rs.ExtrudeSurface(crf_zj_brep,rs.AddLine(rs.AddPoint(0,0,0),rs.AddPoint(0,0,15 * x)))
rs.RotateObject(crf_zj_brep,crf_zj_pt0,45,[0,0,x],copy=False)

#草乳袱上的缴背

jb_zj_brep = rs.ExplodePolysurfaces(crf_zj_brep)[5]
jb_zj_brep = rs.ExtrudeSurface(jb_zj_brep,rs.AddLine(rs.AddPoint(0,0,0),rs.AddPoint(0,0,6.5* x)))

#大角梁生成

JiaoLiang_brep = rs.AddLine(crf_zj_pt0,rs.MoveObject(rs.CopyObject(crf_zj_pt0),(-math.sqrt(2) * 2 * j * x + 76 * x,0,0)))

JiaoLiang_brep_pt = rs.CurveStartPoint(JiaoLiang_brep)
JiaoLiang_brep = rs.ExtrudeCurve(JiaoLiang_brep,rs.AddLine(rs.AddPoint(0,0,0),rs.AddPoint(0,0,25 * x)))

rs.MoveObject(JiaoLiang_brep,(-12 * x,5 * x,0))

JiaoLiang_brep = rs.ExtrudeSurface(JiaoLiang_brep,rs.AddLine(rs.AddPoint(0,0,0),rs.AddPoint(0,-10 * x,0)))

#大角梁进行剪切

JiaoLiang_trimed = rs.ExplodePolysurfaces(JiaoLiang_brep)[0]
JiaoLiang_trimed = rs.CurveEndPoint(rs.DuplicateEdgeCurves(JiaoLiang_trimed)[0])
rs.MoveObject(JiaoLiang_trimed,(30 * x,0,0))

JiaoLiang_trimed_pts = [JiaoLiang_trimed,rs.MoveObject(rs.CopyObject(JiaoLiang_trimed),(-3 * x,0,2.5 * x)),rs.MoveObject(rs.CopyObject(JiaoLiang_trimed),(-1 * x,0,4* x)),rs.MoveObject(rs.CopyObject(JiaoLiang_trimed),(-1 * x,0,6* x)),rs.MoveObject(rs.CopyObject(JiaoLiang_trimed),(-4 * x,0,6.5* x)),rs.MoveObject(rs.CopyObject(JiaoLiang_trimed),(-10 * x,0,7* x)),rs.MoveObject(rs.CopyObject(JiaoLiang_trimed),(-25 * x,0,9* x)),rs.MoveObject(rs.CopyObject(JiaoLiang_trimed),(-29.5 * x,0,15* x)),rs.MoveObject(rs.CopyObject(JiaoLiang_trimed),(-30 * x,0,25* x)),]


JiaoLiang_trimed = rs.AddInterpCurve(JiaoLiang_trimed_pts)
rs.MoveObject(JiaoLiang_trimed,(0,x,0))
JiaoLiang_trimed = rs.ExtrudeCurve(JiaoLiang_trimed,rs.AddLine(rs.AddPoint(0,0,0),rs.AddPoint(0,-12 * x,0)))
JiaoLiang_trimed = rs.ExtrudeSurface(JiaoLiang_trimed,rs.AddLine(rs.AddPoint(0,0,0),rs.AddPoint(-35 * x,0,0)))


JiaoLiang_brep = rs.BooleanDifference(JiaoLiang_brep,JiaoLiang_trimed,delete_input=True)

rs.RotateObject(JiaoLiang_brep,JiaoLiang_brep_pt,-9,[0,x,0],copy=False)

rs.RotateObject(JiaoLiang_brep,crf_zj_pt0,45,[0,0,x],copy=False)

rs.MoveObject(JiaoLiang_brep,(0,0,54.5 * x))

#子角梁生成

ZiJiaoLiang_brep = rs.DuplicateEdgeCurves(rs.ExplodePolysurfaces(JiaoLiang_brep)[0])[1]

ZiJiaoLiang_brep = rs.DivideCurveLength(ZiJiaoLiang_brep,103* x,create_points=True)[1]

rs.RotateObject(ZiJiaoLiang_brep,crf_zj_pt0,-45,[0,0,x],copy=False)
ZiJiaoLiang_brep_pt = rs.CopyObject(ZiJiaoLiang_brep)

rs.MoveObject(ZiJiaoLiang_brep,(0,0,0))
ZiJiaoLiang_brep = rs.AddLine(ZiJiaoLiang_brep,rs.MoveObject(rs.CopyObject(ZiJiaoLiang_brep),(-121 * x,0,0)))
ZiJiaoLiang_brep= rs.ExtrudeCurve(ZiJiaoLiang_brep,rs.AddLine(rs.AddPoint(0,0,0),rs.AddPoint(0,-10 * x,0)))
ZiJiaoLiang_brep= rs.ExtrudeSurface(ZiJiaoLiang_brep,rs.AddLine(rs.AddPoint(0,0,0),rs.AddPoint(0,0,-8 * x)))

rs.RotateObject(ZiJiaoLiang_brep,ZiJiaoLiang_brep_pt,-4.5,[0,x,0],copy=False)
rs.RotateObject(ZiJiaoLiang_brep,crf_zj_pt0,45,[0,0,x],copy=False)

#子角梁被大角昂剪切
ZiJiaoLiang_brep = rs.BooleanDifference(ZiJiaoLiang_brep,JiaoLiang_brep,delete_input=False)

#子角梁的头
ZiJiaoLiang_brep_head= rs.ExplodePolysurfaces(ZiJiaoLiang_brep)[1]

rs.RotateObject(ZiJiaoLiang_brep_head,crf_zj_pt0,-45,[0,0,x],copy=False)

ZiJiaoLiang_brep_head = rs.DuplicateEdgeCurves(ZiJiaoLiang_brep_head)[2]
rs.MoveObject(ZiJiaoLiang_brep_head,(0,0,-1.5 * x))

ZiJiaoLiang_brep_head_trimed = rs.CurveStartPoint(ZiJiaoLiang_brep_head)

ZiJiaoLiang_brep_head = rs.ExtrudeCurve(ZiJiaoLiang_brep_head,rs.AddLine(rs.AddPoint(0,0,0),rs.AddPoint(0,0,11 * x)))
ZiJiaoLiang_brep_head = rs.ExtrudeSurface(ZiJiaoLiang_brep_head,rs.AddLine(rs.AddPoint(0,0,0),rs.AddPoint(-13 * x,0,x)))

rs.MoveObject(ZiJiaoLiang_brep_head_trimed,(0,0,x))

ZiJiaoLiang_brep_head_trimed = rs.AddInterpCurve([ZiJiaoLiang_brep_head_trimed,rs.MoveObject(rs.CopyObject(ZiJiaoLiang_brep_head_trimed),(-0.1 * x,0,-0.5 * x)),rs.MoveObject(rs.CopyObject(ZiJiaoLiang_brep_head_trimed),(-x,0,-x)),rs.MoveObject(rs.CopyObject(ZiJiaoLiang_brep_head_trimed),(-5 * x,0,0.2 * x)),rs.MoveObject(rs.CopyObject(ZiJiaoLiang_brep_head_trimed),(-10 * x,0,3 * x)),rs.MoveObject(rs.CopyObject(ZiJiaoLiang_brep_head_trimed),(-12 * x,0,5 * x)),rs.MoveObject(rs.CopyObject(ZiJiaoLiang_brep_head_trimed),(-13 * x,0,5 * x)),rs.MoveObject(rs.CopyObject(ZiJiaoLiang_brep_head_trimed),(-12 * x,0,6 * x)),rs.MoveObject(rs.CopyObject(ZiJiaoLiang_brep_head_trimed),(-13 * x,0,7 * x)),rs.MoveObject(rs.CopyObject(ZiJiaoLiang_brep_head_trimed),(-15 * x,0,10 * x))])
ZiJiaoLiang_brep_head_trimed2 = rs.CurveEndPoint(ZiJiaoLiang_brep_head_trimed)

ZiJiaoLiang_brep_head_trimed2 = rs.AddInterpCurve([ZiJiaoLiang_brep_head_trimed2,rs.MoveObject(rs.CopyObject(ZiJiaoLiang_brep_head_trimed2),(-0.5 * x,0,0.5 * x)),rs.MoveObject(rs.CopyObject(ZiJiaoLiang_brep_head_trimed2),(1 * x,0,0.5 * x)),rs.MoveObject(rs.CopyObject(ZiJiaoLiang_brep_head_trimed2),(2 * x,0,-0.3 * x)),rs.MoveObject(rs.CopyObject(ZiJiaoLiang_brep_head_trimed2),(3 * x,0,0.05 * x)),rs.MoveObject(rs.CopyObject(ZiJiaoLiang_brep_head_trimed2),(3.5 * x,0,0.06 * x)),rs.MoveObject(rs.CopyObject(ZiJiaoLiang_brep_head_trimed2),(4 * x,0,0.15 * x)),rs.MoveObject(rs.CopyObject(ZiJiaoLiang_brep_head_trimed2),(4.5 * x,0,0.3 * x)),rs.MoveObject(rs.CopyObject(ZiJiaoLiang_brep_head_trimed2),(5 * x,0,0.8 * x)),rs.MoveObject(rs.CopyObject(ZiJiaoLiang_brep_head_trimed2),(7 * x,0,0.8 * x))])
ZiJiaoLiang_brep_head_trimed3 = rs.CurveEndPoint(ZiJiaoLiang_brep_head_trimed2)

ZiJiaoLiang_brep_head_trimed3 = rs.AddInterpCurve([ZiJiaoLiang_brep_head_trimed3,rs.MoveObject(rs.CopyObject(ZiJiaoLiang_brep_head_trimed3),(0.5 * x,0,1 * x)),rs.MoveObject(rs.CopyObject(ZiJiaoLiang_brep_head_trimed3),(1 * x,0,-0.1 * x)),rs.MoveObject(rs.CopyObject(ZiJiaoLiang_brep_head_trimed3),(2 * x,0,-0.5 * x)),rs.MoveObject(rs.CopyObject(ZiJiaoLiang_brep_head_trimed3),(7 * x,0,-1 * x)),rs.MoveObject(rs.CopyObject(ZiJiaoLiang_brep_head_trimed3),(8 * x,0,-2 * x))])

ZiJiaoLiang_brep_head = rs.JoinCurves([ZiJiaoLiang_brep_head_trimed,ZiJiaoLiang_brep_head_trimed2,ZiJiaoLiang_brep_head_trimed3])
ZiJiaoLiang_brep_head = rs.JoinCurves([ZiJiaoLiang_brep_head,rs.AddLine(rs.CurveStartPoint(ZiJiaoLiang_brep_head),rs.CurveEndPoint(ZiJiaoLiang_brep_head))])
ZiJiaoLiang_brep_head =rs.ExtrudeCurve(ZiJiaoLiang_brep_head,rs.AddLine(rs.AddPoint(0,0,0),rs.AddPoint(0,-10 * x,0)))
rs.CapPlanarHoles(ZiJiaoLiang_brep_head)
rs.RotateObject(ZiJiaoLiang_brep_head,crf_zj_pt0,45,[0,0,x],copy=False)

ZiJiaoLiang_brep = rs.BooleanUnion([ZiJiaoLiang_brep_head,ZiJiaoLiang_brep],delete_input=False)

#草乳袱被角梁剪切

crf_zj_brep = rs.BooleanUnion([JiaoLiang_brep,crf_zj_brep],delete_input=False)

jb_zj_brep = rs.BooleanDifference(jb_zj_brep,JiaoLiang_brep,delete_input=False)[0]

#角梁两侧的架子

JiaoLiang_jia_brep1 = rs.MoveObject(rs.CopyObject(ZhuTou_point),(-(HuaGong_CaiFen_left + 57-5) * x,j * x/2-21 * x,368 * x))
JiaoLiang_jia_brep_point = rs.MoveObject(rs.CopyObject(JiaoLiang_jia_brep1),(-5,0,0))
JiaoLiang_jia_brep1 = rs.AddLine(JiaoLiang_jia_brep1,rs.MoveObject(rs.CopyObject(JiaoLiang_jia_brep1),(-10 * x,0,0)))

JiaoLiang_jia_brep1 = rs.ExtrudeCurve(JiaoLiang_jia_brep1,rs.AddLine(rs.AddPoint(0,0,0),rs.AddPoint(0,0,2 * x)))





JiaoLiang_jia_brep1 = rs.JoinCurves(rs.DuplicateEdgeCurves(JiaoLiang_jia_brep1))
JiaoLiang_jia2_brep1 = rs.MoveObject(rs.CopyObject(JiaoLiang_jia_brep1),(0,-56 * x,0))
JiaoLiang_jia2_brep2 = rs.MoveObject(rs.CopyObject(JiaoLiang_jia_brep1),(0,-170 * x,0))
rs.ScaleObject(JiaoLiang_jia2_brep2,JiaoLiang_jia_brep_point,[1,1,6],copy=False)


JiaoLiang_jia_brep2 = rs.MoveObject(rs.CopyObject(JiaoLiang_jia_brep1),(0,-215 * x,0))
rs.ScaleObject(JiaoLiang_jia_brep2,JiaoLiang_jia_brep_point,[1,1,6],copy=False)

JiaoLiang_jia_brep = rs.AddLoftSrf([JiaoLiang_jia_brep1,JiaoLiang_jia_brep2])
rs.CapPlanarHoles(JiaoLiang_jia_brep)

JiaoLiang_jia2_brep = rs.AddLoftSrf([JiaoLiang_jia2_brep1,JiaoLiang_jia2_brep2])
rs.CapPlanarHoles(JiaoLiang_jia2_brep)

rs.RotateObject(JiaoLiang_jia_brep,JiaoLiang_jia_brep_point,-10,[0,0,x],copy=False)

#架子被大角昂剪切

JiaoLiang_jia_brep = rs.BooleanDifference(JiaoLiang_jia_brep,JiaoLiang_brep,delete_input=False)
JiaoLiang_jia2_brep = rs.BooleanDifference(JiaoLiang_jia2_brep,JiaoLiang_brep,delete_input=False)



#架子的插销

cx_JiaoLiang_jia_brep = rs.ExplodePolysurfaces(JiaoLiang_jia_brep)[2]
cx_JiaoLiang_jia_brep = rs.CurveEndPoint(rs.DuplicateEdgeCurves(cx_JiaoLiang_jia_brep))

rs.MoveObject(cx_JiaoLiang_jia_brep,(-2.5 * x,-2.5 * x,-3 * x))
cx_JiaoLiang_jia_brep = rs.AddLine(cx_JiaoLiang_jia_brep,rs.MoveObject(rs.CopyObject(cx_JiaoLiang_jia_brep),(-7 * x,-7 *x,0)))
cx_JiaoLiang_jia_brep = rs.ExtrudeCurve(cx_JiaoLiang_jia_brep,rs.AddLine(rs.AddPoint(0,0,0),rs.AddPoint(0,0,-4.5 * x)))
cx_JiaoLiang_jia_brep = rs.ExtrudeSurface(cx_JiaoLiang_jia_brep,rs.AddLine(rs.AddPoint(0,0,0),rs.AddPoint(2.5 * x,-2.5 * x,0)))

JiaoLiang_jia_brep = rs.BooleanDifference(cx_JiaoLiang_jia_brep,JiaoLiang_jia_brep,delete_input=False)
JiaoLiang_jia_brep2 = rs.MirrorObject(JiaoLiang_jia_brep,crf_zj_pt0,rs.MoveObject(rs.CopyObject(crf_zj_pt0),(x,x,0)),copy=True)

#大角梁被架子剪切
JiaoLiang_brep = rs.BooleanIntersection(JiaoLiang_brep,JiaoLiang_jia_brep,delete_input=False)
JiaoLiang_brep = rs.BooleanIntersection(JiaoLiang_jia_brep2,JiaoLiang_brep,delete_input=False)

cx_JiaoLiang_jia2_brep = rs.ExplodePolysurfaces(JiaoLiang_jia2_brep)[3]

cx_JiaoLiang_jia2_brep = rs.CurveEndPoint(rs.DuplicateEdgeCurves(cx_JiaoLiang_jia2_brep)[0])

rs.MoveObject(cx_JiaoLiang_jia2_brep,(-1.5 * x,-1.5 * x,-3 * x))
cx_JiaoLiang_jia2_brep = rs.AddLine(cx_JiaoLiang_jia2_brep,rs.MoveObject(rs.CopyObject(cx_JiaoLiang_jia2_brep),(-7 * x,-7 *x,0)))
cx_JiaoLiang_jia2_brep = rs.ExtrudeCurve(cx_JiaoLiang_jia2_brep,rs.AddLine(rs.AddPoint(0,0,0),rs.AddPoint(0,0,-4.5 * x)))
cx_JiaoLiang_jia2_brep = rs.ExtrudeSurface(cx_JiaoLiang_jia2_brep,rs.AddLine(rs.AddPoint(0,0,0),rs.AddPoint(2.5 * x,-2.5 * x,0)))

JiaoLiang_jia2_brep = rs.BooleanDifference(cx_JiaoLiang_jia2_brep,JiaoLiang_jia2_brep,delete_input=False)
JiaoLiang_jia2_brep2 = rs.MirrorObject(JiaoLiang_jia2_brep,crf_zj_pt0,rs.MoveObject(rs.CopyObject(crf_zj_pt0),(x,x,0)),copy=True)
#大角梁被架子剪切
JiaoLiang_brep = rs.BooleanIntersection(JiaoLiang_jia2_brep,JiaoLiang_brep,delete_input=False)
JiaoLiang_brep = rs.BooleanIntersection(JiaoLiang_jia2_brep2,JiaoLiang_brep,delete_input=False)

#草乳袱上的插销
cx_crf = rs.ExplodePolysurfaces(crf_zj_brep)[5]
cx_crf = rs.DuplicateEdgeCurves(cx_crf)[2]
rs.MoveObject(cx_crf,(3 * x,-3 * x,0))
cx_crf  = rs.ExtrudeCurve(cx_crf,rs.AddLine(rs.AddPoint(0,0,0),rs.AddPoint(2 * x,-2 * x,0)))
cx_crf  = rs.ExtrudeSurface(cx_crf,rs.AddLine(rs.AddPoint(0,0,0),rs.AddPoint(0,0,6 * x)))

crf_zj_brep = rs.BooleanDifference(crf_zj_brep,cx_crf,delete_input=False)

#大角梁被草乳袱剪切
JiaoLiang_brep = rs.BooleanIntersection(crf_zj_brep,JiaoLiang_brep,delete_input=False)

#大角梁上的插销
cx_JiaoLiang = rs.ExplodePolysurfaces(JiaoLiang_brep)[22]
cx_JiaoLiang = rs.CurveEndPoint(rs.DuplicateEdgeCurves(cx_JiaoLiang)[0])

rs.MoveObject(cx_JiaoLiang,(2 * x,2 * x,0))
rs.MoveObject(cx_JiaoLiang,(3 * x,-3 * x,0))

cx_JiaoLiang = rs.AddLine(cx_JiaoLiang,rs.MoveObject(rs.CopyObject(cx_JiaoLiang),((2 * x,-2 * x,0))))
cx_JiaoLiang  = rs.ExtrudeCurve(cx_JiaoLiang,rs.AddLine(rs.AddPoint(0,0,0),rs.AddPoint(27 * x,27 * x,0)))
cx_JiaoLiang  = rs.ExtrudeSurface(cx_JiaoLiang,rs.AddLine(rs.AddPoint(0,0,0),rs.AddPoint(0,0,6 * x)))





JiaoLiang_brep = rs.BooleanDifference(cx_JiaoLiang,JiaoLiang_brep,delete_input=False)

ZiJiaoLiang_brep = rs.BooleanIntersection(JiaoLiang_brep,ZiJiaoLiang_brep,delete_input=False)
# ---------- end python_3_script_17 ----------
point_5 = Point()
point_6 = Point(relay)
number_slider_32 = Slider(6, range=0..100)
brep_45 = Brep()
brep_46 = Brep()
number_slider_33 = Slider(21, range=0..100)
brep_47 = Brep()
brep_48 = Brep()
brep_49 = Brep()
brep_50 = Brep()
brep_51 = Brep()
brep_52 = Brep()
brep_53 = Brep()
brep_54 = Brep()
brep_55 = Brep()
brep_56 = Brep(python_3_script_16.GongYanBi_jinshen)
brep_57 = Brep()
number_slider_34 = Slider(1, range=0..10)
brep_58 = Brep()
brep_59 = Brep()
number_slider_35 = Slider(3, range=0..10)
brep_60 = Brep([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])
brep_61 = Brep(python_3_script_16.GongYanBi_neiyan)
merge_2 = Merge(
    Data1=斗拱编辑器_5,
    Data2=斗拱编辑器_4.PuZuo_waiyan_g,
    Data3=斗拱编辑器_4.PuZuo_neiyan_g,
    Data4=python_3_script_9.Laner_breps,
    Data5=python_3_script_12.sufang_breps,
    Data6=python_3_script_12.HuaGong1_pj_g,
    Data7=python_3_script_12.SanDou_g,
    Data8=python_3_script_12.SanDou_g_2,
    Data9=python_3_script_12.SanDou_g_3,
    Data10=python_3_script_12.sufang2_breps,
    Data12=python_3_script_12.HuaGong2_pj_g,
    Data13=python_3_script_12.sufang3_breps,
    Data14=python_3_script_12.SanDous_ndg_bj1_g,
    Data15=python_3_script_12.SanDous_ndg_bj2_g,
    Data16=python_3_script_12.SanDous_ndg_bj3_g,
    Data17=python_3_script_12.SanDou_hg_ndg_bj1_g,
    Data18=python_3_script_12.SanDou_hg_ndg_bj2_g,
    Data19=python_3_script_12.jhd_hg_ndg_bj1_g,
    Data20=python_3_script_12.jhd_hg_ndg_bj2_g,
    Data22=python_3_script_12.jhd_hg_ndg_bj3_g,
    Data23=python_3_script_12.yxg_brep_g,
    Data24=python_3_script_12.HuaGong3_pj_g,
    Data25=python_3_script_12.lg_breps_g,
    Data26=python_3_script_12.sandou_lg_g,
    Data27=python_3_script_12.sf4_brep_g,
    Data28=python_3_script_12.pqf_brep_g,
    Data29=python_3_script_14.gyb_jinshen_waiyan_g,
    Data30=python_3_script_16.GongYanBi_jinshen,
    Data31=python_3_script_16.GongYanBi_neiyan,
    Data33=斗拱编辑器_3,
    Data34=斗拱编辑器_2.chuans,
    Data35=斗拱编辑器_2.chuans_jinshen,
    Data36=斗拱编辑器_2.yjc_breps,
    Data37=brep_17)
brep_62 = Brep(merge_2)
create_material_2 = CreateMaterial(
    Diffuse=ColourSwatch(SwatchColor=RGB(145, 113, 78)),
    Specular=RGB(255, 255, 255),
    Emission=RGB(0, 0, 0),
    Transparency=0,
    Shine=0)
custom_preview_5 = CustomPreview(Material=create_material_2)
create_material_3 = CreateMaterial(
    Diffuse=ColourSwatch(SwatchColor=RGB(125, 66, 52)),
    Specular=RGB(255, 255, 255),
    Emission=RGB(0, 0, 0),
    Transparency=0,
    Shine=0)
brep_63 = Brep(python_3_script_9.zhuzi_breps)
custom_preview_6 = CustomPreview(Geometry=merge_2, Material=create_material_2)
custom_preview_7 = CustomPreview(Geometry=python_3_script_9.zhuzi_breps, Material=create_material_3)
panel_9 = Panel(brep_56)
panel_10 = Panel(brep_48)
number_slider_36 = Slider(0, range=0..100)
number_slider_37 = Slider(-1, range=-1..0)
list_item_16 = ListItem(Index=number_slider_32, Wrap=True)
list_item_17 = ListItem(List=brep_46, Index=number_slider_32, Wrap=True)
list_item_18 = ListItem(Index=number_slider_32, Wrap=True)
brep_64 = Brep()
list_item_19 = ListItem(List=brep_47, Index=Slider(0, range=0..100), Wrap=True)
brep_65 = Brep(python_3_script_14.gyb_jinshen_waiyan_g)
panel_11 = Panel(python_3_script_14.gyb_jinshen_waiyan_g)
list_item_20 = ListItem(List=brep_60, Index=number_slider_32, Wrap=True)
list_item_21 = ListItem(List=python_3_script_14.gyb_jinshen_waiyan_g, Index=Slider(111, range=0..1000), Wrap=True)
list_item_22 = ListItem(List=list_item_21, Index=Slider(0, range=0..100), Wrap=True)
panel_12 = Panel(list_item_22)
